# Dynamo graph script.dyn "Alinear Empalmes Barras Verticales" (Dynamo 2.3.2.15696)
# packages: Data-Shapes 2021.2.93, Clockwork for Dynamo 2.x 2.3.0, WombatDynamo 2.3.4, Rhythm 2021.4.2, Genius Loci 2021.4.13

code_block = CodeBlock { "Alinear Empalmes"; }
file_path = Filename("..\00_IMAGENES\editable Arainco-cmyk-01.png")
code_block_2 = CodeBlock { "INICIAR"; "CANCELAR"; 130; }
code_block_3 = CodeBlock { "Empalme Ejemplo"; }
code_block_4 = CodeBlock { "SELECCIONAR"; }
code_block_5 = CodeBlock { "Dimensions"; }
byName = Category.ByName(name=code_block_5)
code_block_6 = CodeBlock { true; }
selectmodelelements_data = Custom[SelectModelElements Data](InputName=code_block_3, ButtonText=code_block_4, CategoryFilter=byName, SelectSingleElement=code_block_6)  # package Data-Shapes; Creates a Revit element selection input for UI.MultipleInputForm++ . Check out www.data-shapes.net for more infos!
code_block_7 = CodeBlock { "Empalmes a Alinear"; }
code_block_8 = CodeBlock { "SELECCIONAR"; }
code_block_9 = CodeBlock { "Dimensions"; }
byName_2 = Category.ByName(name=code_block_9)
selectmodelelements_data_2 = Custom[SelectModelElements Data](InputName=code_block_7, ButtonText=code_block_8, CategoryFilter=byName_2)
list_create = List.Create(item0=selectmodelelements_data, item1=selectmodelelements_data_2)
boolean = BoolSelector(true)
multipleinputform = Custom[MultipleInputForm ++](Description_optional=code_block, Logo_optional=file_path, ButtonText_optional=code_block_2.out0, Inputs=list_create, Toggle=boolean, CancelButtonText_optional=code_block_2.out1, LabelWidth_optional=code_block_2.out2)  # package Data-Shapes; Create a form with multiple inputs. see www.data-shapes.net for tutorials and infos!
nullItem = WombatDynamo.List.NullItem()
if_ = If(test=multipleinputform.Was_Cancelled, true=nullItem, false=multipleinputform.User_Inputs)
name = Element.Name(element=if_)
code_block_10 = CodeBlock { "EST_EMPALME"; }
eq = name == code_block_10
filterByBoolMask = List.FilterByBoolMask(list=if_, mask=eq)
code_block_11 = CodeBlock(l=filterByBoolMask.in) { l[1]; }
code_block_12 = CodeBlock(l=filterByBoolMask.in) { l[0]; }
id = Element.Id(element=code_block_12)
id_2 = Element.Id(element=code_block_11)
eq_2 = id == id_2
filterByBoolMask_2 = List.FilterByBoolMask(list=code_block_11, mask=eq_2)
ʳʰʸᵗʰᵐ_dimensions_getcurve = Rhythm.Revit.Elements.Dimensions.GetCurve(dimension=code_block_12)
code_block_13 = CodeBlock { 0.5; }
pointAtParameter = Curve.PointAtParameter(curve=ʳʰʸᵗʰᵐ_dimensions_getcurve, param=code_block_13)
ZAxis = Vector.ZAxis()
ʳʰʸᵗʰᵐ_dimensions_getcurve_2 = Rhythm.Revit.Elements.Dimensions.GetCurve(dimension=filterByBoolMask_2.out)
code_block_14 = CodeBlock { 0.5; }
pointAtParameter_2 = Curve.PointAtParameter(curve=ʳʰʸᵗʰᵐ_dimensions_getcurve_2, param=code_block_14)
flatten = List.Flatten(list=pointAtParameter_2)
ZAxis_2 = Vector.ZAxis()
byOriginNormal = Plane.ByOriginNormal(origin=flatten, normal=ZAxis_2)
intersectWithPlane = Custom[Vector.IntersectWithPlane](vectorBasePoint=pointAtParameter, vector=ZAxis, plane=byOriginNormal, lacing=Longest)  # package Clockwork for Dynamo 2.x; Finds the intersection point between a plane and a vector
element_setlocation = Custom[Element SetLocation](element=filterByBoolMask_2.out, location=intersectWithPlane)  # package Genius Loci; Modify the location of the given element. (Same as the Move command in Revit.) Works for point/ line/ sketch based elements, view-specific elements, groups and link instances.
