# Dynamo graph script.dyn "Alinear Etiquetas Barras Verticales" (Dynamo 2.3.2.15696)
# packages: Data-Shapes 2021.2.93, Genius Loci 2021.4.13, Clockwork for Dynamo 2.x 2.3.0, WombatDynamo 2.3.4

code_block = CodeBlock { "Alinear Etiquetas"; }
file_path = Filename("..\00_IMAGENES\editable Arainco-cmyk-01.png")
code_block_2 = CodeBlock { "INICIAR"; "CANCELAR"; }
code_block_3 = CodeBlock { "Tag Ejemplo"; }
code_block_4 = CodeBlock { "SELECCIONAR"; }
code_block_5 = CodeBlock { "Detail Item Tags"; }
byName = Category.ByName(name=code_block_5)
code_block_6 = CodeBlock { true; }
selectmodelelements_data = Custom[SelectModelElements Data](InputName=code_block_3, ButtonText=code_block_4, CategoryFilter=byName, SelectSingleElement=code_block_6)  # package Data-Shapes; Creates a Revit element selection input for UI.MultipleInputForm++ . Check out www.data-shapes.net for more infos!
code_block_7 = CodeBlock { "Tags a Alinear"; }
code_block_8 = CodeBlock { "SELECCIONAR"; }
code_block_9 = CodeBlock { "Detail Item Tags"; }
byName_2 = Category.ByName(name=code_block_9)
selectmodelelements_data_2 = Custom[SelectModelElements Data](InputName=code_block_7, ButtonText=code_block_8, CategoryFilter=byName_2)
list_create = List.Create(item0=selectmodelelements_data, item1=selectmodelelements_data_2)
boolean = BoolSelector(true)
multipleinputform = Custom[MultipleInputForm ++](Description_optional=code_block, Logo_optional=file_path, ButtonText_optional=code_block_2.out0, Inputs=list_create, Toggle=boolean, CancelButtonText_optional=code_block_2.out1)  # package Data-Shapes; Create a form with multiple inputs. see www.data-shapes.net for tutorials and infos!
nullItem = WombatDynamo.List.NullItem()
if_ = If(test=multipleinputform.Was_Cancelled, true=nullItem, false=multipleinputform.User_Inputs)
code_block_10 = CodeBlock(l=if_) { l[1]; }
code_block_11 = CodeBlock(l=if_) { l[0]; }
id = Element.Id(element=code_block_11)
id_2 = Element.Id(element=code_block_10)
eq = id == id_2
filterByBoolMask = List.FilterByBoolMask(list=code_block_10, mask=eq)
tag_getlocation = Custom[Tag GetLocation](tag=code_block_11)  # package Genius Loci; Retrieves the position of the head of tag.
ZAxis = Vector.ZAxis()
tag_getlocation_2 = Custom[Tag GetLocation](tag=filterByBoolMask.out)
ZAxis_2 = Vector.ZAxis()
byOriginNormal = Plane.ByOriginNormal(origin=tag_getlocation_2, normal=ZAxis_2)
intersectWithPlane = Custom[Vector.IntersectWithPlane](vectorBasePoint=tag_getlocation, vector=ZAxis, plane=byOriginNormal)  # package Clockwork for Dynamo 2.x; Finds the intersection point between a plane and a vector
tag_setlocation = Custom[Tag SetLocation](tag=filterByBoolMask.out, location=intersectWithPlane)  # package Genius Loci; Moves the head of the tag to the given location point.
