# Dynamo graph script.dyn "Etiquetado Lineas de Fierro" (Dynamo 2.3.2.15696)
# packages: Data-Shapes 2021.2.93, WombatDynamo 2.3.4, Clockwork for Dynamo 2.x 2.3.0, archi-lab.net 2021.25.2621, Genius Loci 2021.4.13, Orchid 204.1.4.7501

activeView = Orchid.RevitProject.Common.Document.ActiveView()
code_block = CodeBlock { "Etiquetado Lineas de Fierro"; }
file_path = Filename("..\00_IMAGENES\editable Arainco-cmyk-01.png")
code_block_2 = CodeBlock { 150; "INICIAR"; "CANCELAR"; }
code_block_3 = CodeBlock { "Barra A Empalmar"; }
code_block_4 = CodeBlock { "SELECCIONAR"; }
code_block_5 = CodeBlock { "Detail Items"; }
byName = Category.ByName(name=code_block_5)
selectmodelelements_data = Custom[SelectModelElements Data](InputName=code_block_3, ButtonText=code_block_4, CategoryFilter=byName)  # package Data-Shapes; Creates a Revit element selection input for UI.MultipleInputForm++ . Check out www.data-shapes.net for more infos!
boolean = BoolSelector(true)
multipleinputform = Custom[MultipleInputForm ++](Description_optional=code_block, Logo_optional=file_path, ButtonText_optional=code_block_2.out1, Inputs=selectmodelelements_data, Toggle=boolean, CancelButtonText_optional=code_block_2.out2, LabelWidth_optional=code_block_2.out0)  # package Data-Shapes; Create a form with multiple inputs. see www.data-shapes.net for tutorials and infos!
nullItem = WombatDynamo.List.NullItem()
if_ = If(test=multipleinputform.Was_Cancelled, true=nullItem, false=multipleinputform.User_Inputs)
code_block_6 = CodeBlock(l=if_) { l[0]; }
familyType = Custom[FamilyInstance.FamilyType](familyInstance=code_block_6)  # package archi-lab.net; This node will return a Family Type of a given Family Instance. If no Family Type can be assigned to a Family then it will return Null.
family = FamilyType.Family(familyType=familyType)
name = Family.Name(family=family)
code_block_7 = CodeBlock { "EST_D_BARRA VERTICAL_DERECHA_PATA INFERIOR"; }
eq = name == code_block_7
code_block_8 = CodeBlock { null; }
if_2 = If(test=eq, true=code_block_6, false=code_block_8)
list_clean = Custom[List Clean](list=if_2)  # package Genius Loci; Removes all Null, Empty and Blank from a list or nested list of lists.
familyinstance_2d_geometry = Custom[FamilyInstance 2D Geometry](element=list_clean)  # package Genius Loci; Gets the curves of the family instance. Works only with the family categories : Generic Annotation and Detail Item.
code_block_9 = CodeBlock { 0; }
getItemAtIndex = List.GetItemAtIndex(list=familyinstance_2d_geometry@L2, index=code_block_9)
code_block_10 = CodeBlock { 0.5; }
pointAtParameter = Curve.PointAtParameter(curve=getItemAtIndex, param=code_block_10)
code_block_11 = CodeBlock { "Detail Item Tags"; }
byName_2 = Category.ByName(name=code_block_11)
all_family_types_of_category = Custom[All Family Types Of Category](category=byName_2)  # package Clockwork for Dynamo 2.x; Gets all family types/symbols of a given category in the model.
familyName = Custom[FamilyType.FamilyName](familyType=all_family_types_of_category)  # package Clockwork for Dynamo 2.x; Returns the *family* name of a given family *type*
string = StringInput("EST_A_TAG BARRA_LINEA DE FIERRO")
eq_2 = familyName == string  # lacing=Longest
filterByBoolMask = List.FilterByBoolMask(list=all_family_types_of_category, mask=eq_2)
code_block_12 = CodeBlock(t1=filterByBoolMask.in) { str2 = Revit.Elements.Element.Name(t1); t2 = str2 == "Barra con Pata Inferior"; }
filterByBoolMask_2 = List.FilterByBoolMask(list=filterByBoolMask.in, mask=code_block_12.t2)
code_block_13 = CodeBlock(l=filterByBoolMask_2.in) { l[0]; }
code_block_14 = CodeBlock { false; }
boolean_2 = BoolSelector(true)
create_tag = Custom[Create Tag](view=activeView, element=list_clean, TagLocation=pointAtParameter, TagType=code_block_13, horizontal=code_block_14, RunIt=boolean_2)  # package Genius Loci; Works only in Revit 2018 and later. Creates a tag at a given location, of given type and in a supplied view. The node also works with Linked Elements (except space and area), Multi Category tag and Material Tag. Based on an archilab node
activeView_2 = Orchid.RevitProject.Common.Document.ActiveView()
familyType_2 = Custom[FamilyInstance.FamilyType](familyInstance=code_block_6)
family_2 = FamilyType.Family(familyType=familyType_2)
name_2 = Family.Name(family=family_2)
code_block_15 = CodeBlock { "EST_D_BARRA VERTICAL_DERECHA_DOS PATAS"; }
eq_3 = name_2 == code_block_15
code_block_16 = CodeBlock { null; }
if_3 = If(test=eq_3, true=code_block_6, false=code_block_16)
list_clean_2 = Custom[List Clean](list=if_3)
familyinstance_2d_geometry_2 = Custom[FamilyInstance 2D Geometry](element=list_clean_2)
code_block_17 = CodeBlock { 0; }
getItemAtIndex_2 = List.GetItemAtIndex(list=familyinstance_2d_geometry_2@L2, index=code_block_17)
code_block_18 = CodeBlock { 0.5; }
pointAtParameter_2 = Curve.PointAtParameter(curve=getItemAtIndex_2, param=code_block_18)
code_block_19 = CodeBlock { "Detail Item Tags"; }
byName_3 = Category.ByName(name=code_block_19)
all_family_types_of_category_2 = Custom[All Family Types Of Category](category=byName_3)
familyName_2 = Custom[FamilyType.FamilyName](familyType=all_family_types_of_category_2)
string_2 = StringInput("EST_A_TAG BARRA_LINEA DE FIERRO")
eq_4 = familyName_2 == string_2  # lacing=Longest
filterByBoolMask_3 = List.FilterByBoolMask(list=all_family_types_of_category_2, mask=eq_4)
code_block_20 = CodeBlock(t1=filterByBoolMask_3.in) { str2 = Revit.Elements.Element.Name(t1); t2 = str2 == "Barra Dos Patas"; }
filterByBoolMask_4 = List.FilterByBoolMask(list=filterByBoolMask_3.in, mask=code_block_20.t2)
code_block_21 = CodeBlock(l=filterByBoolMask_4.in) { l[0]; }
code_block_22 = CodeBlock { false; }
boolean_3 = BoolSelector(true)
create_tag_2 = Custom[Create Tag](view=activeView_2, element=list_clean_2, TagLocation=pointAtParameter_2, TagType=code_block_21, horizontal=code_block_22, RunIt=boolean_3)
activeView_3 = Orchid.RevitProject.Common.Document.ActiveView()
familyType_3 = Custom[FamilyInstance.FamilyType](familyInstance=code_block_6)
family_3 = FamilyType.Family(familyType=familyType_3)
name_3 = Family.Name(family=family_3)
code_block_23 = CodeBlock { "EST_D_BARRA VERTICAL_DERECHA_PATA SUPERIOR"; }
eq_5 = name_3 == code_block_23
code_block_24 = CodeBlock { null; }
if_4 = If(test=eq_5, true=code_block_6, false=code_block_24)
list_clean_3 = Custom[List Clean](list=if_4)
familyinstance_2d_geometry_3 = Custom[FamilyInstance 2D Geometry](element=list_clean_3)
code_block_25 = CodeBlock { 0; }
getItemAtIndex_3 = List.GetItemAtIndex(list=familyinstance_2d_geometry_3@L2, index=code_block_25)
code_block_26 = CodeBlock { 0.5; }
pointAtParameter_3 = Curve.PointAtParameter(curve=getItemAtIndex_3, param=code_block_26)
code_block_27 = CodeBlock { "Detail Item Tags"; }
byName_4 = Category.ByName(name=code_block_27)
all_family_types_of_category_3 = Custom[All Family Types Of Category](category=byName_4)
familyName_3 = Custom[FamilyType.FamilyName](familyType=all_family_types_of_category_3)
string_3 = StringInput("EST_A_TAG BARRA_LINEA DE FIERRO")
eq_6 = familyName_3 == string_3  # lacing=Longest
filterByBoolMask_5 = List.FilterByBoolMask(list=all_family_types_of_category_3, mask=eq_6)
code_block_28 = CodeBlock(t1=filterByBoolMask_5.in) { str2 = Revit.Elements.Element.Name(t1); t2 = str2 == "Barra con Pata Superior"; }
filterByBoolMask_6 = List.FilterByBoolMask(list=filterByBoolMask_5.in, mask=code_block_28.t2)
code_block_29 = CodeBlock(l=filterByBoolMask_6.in) { l[0]; }
code_block_30 = CodeBlock { false; }
boolean_4 = BoolSelector(true)
create_tag_3 = Custom[Create Tag](view=activeView_3, element=list_clean_3, TagLocation=pointAtParameter_3, TagType=code_block_29, horizontal=code_block_30, RunIt=boolean_4)
