# Dynamo graph script.dyn (Dynamo 2.3.2.15696)
# packages: Clockwork for Dynamo 2.x 2.3.0, Data-Shapes 2021.2.93, Genius Loci 2021.4.13

current = Document.Current()
activeView = Document.ActiveView(document=current)
code_block = CodeBlock { "Diametro de Barras"; }
code_block_2 = CodeBlock { "EST_D_BARRA VERTICAL_DERECHA_DOS PATAS"; }
byName = Family.ByName(name=code_block_2)
code_block_3 = CodeBlock()
# ---------- code_block_3.designscript (13 lines) ----------
[
"ø6",
"ø8",
"ø10",
"ø12",
"ø16",
"ø18",
"ø22",
"ø25",
"ø28",
"ø32",
"ø36"
];
# ----------------------------------------
byFamilyAndName = FamilyType.ByFamilyAndName(family=byName, name=code_block_3)
name = Element.Name()  # unwired: element
sortByFunction = List.SortByFunction(list=byFamilyAndName, func=name)
code_block_4 = CodeBlock { 2; }
shiftIndices = List.ShiftIndices(list=sortByFunction, amount=code_block_4)
name_2 = Element.Name(element=shiftIndices)
code_block_5 = CodeBlock { 4; }
code_block_6 = CodeBlock { false; }
dropdown_data = Custom[DropDown Data](InputName=code_block, Keys=name_2, Values=shiftIndices, DefaultValueIndex=code_block_5, Sorted_optional=code_block_6)  # package Data-Shapes; Create data for DropDown input in UI.MultiInputForm ++ . Check out www.data-shapes.net for more infos.
code_block_7 = CodeBlock { "Cantidad de Barras"; }
code_block_8 = CodeBlock { 1..10..1; 1; }
code_block_9 = CodeBlock { false; }
dropdown_data_2 = Custom[DropDown Data](InputName=code_block_7, Keys=code_block_8.out0, Values=code_block_8.out0, DefaultValueIndex=code_block_8.out1, Sorted_optional=code_block_9)
code_block_10 = CodeBlock { "Selecciona un punto de Inserción"; "SELECCIONAR"; }
selectpointsonface_data = Custom[SelectPointsOnFace data](InputName=code_block_10.out0, ButtonText=code_block_10.out1)  # package Data-Shapes; Creates a UI.MultipleInputForm++ input that allows point on face selection
list_create = List.Create(item0=dropdown_data, item1=dropdown_data_2, item2=selectpointsonface_data)
code_block_11 = CodeBlock(inputs=list_create)
# ---------- code_block_11.designscript (29 lines) ----------
//Description_optional
"Barra Vertical con Pata Inferior";

//Logo


//ButtonText
"INICIAR";

//Inputs
inputs;

//Toggle
true;

//LinkToHelp


//CancelButtonText
"CANCELAR";

//MaxHeight


//Width
490;

//LabelWidth
150;
# ----------------------------------------
multipleinputform = Custom[MultipleInputForm ++](Description_optional=code_block_11.out0, ButtonText_optional=code_block_11.out1, Inputs=code_block_11.inputs, Toggle=code_block_11.out3, CancelButtonText_optional=code_block_11.out4, Width_optional=code_block_11.out5, LabelWidth_optional=code_block_11.out6)  # package Data-Shapes; Create a form with multiple inputs. see www.data-shapes.net for tutorials and infos!
python_script = Python(IN[0]=multipleinputform.User_Inputs)
# ---------- python_script.python (7 lines) ----------
input = IN[0]

if input == [] or input == None:
	res = [[], [], [[]], []]
else:
	res = input
OUT = res
# ----------------------------------------
code_block_12 = CodeBlock(l=python_script) { l[2][0]; }
code_block_13 = CodeBlock(l=python_script) { l[0]; }
byPointInView = Custom[FamilyInstance.ByPointInView](point=code_block_12, familyType=code_block_13, view=activeView)  # package Clockwork for Dynamo 2.x; Places a family instance at a given point in a given view (e.g. a detail component).
code_block_14 = CodeBlock { "Cantidad de Barras"; }
code_block_15 = CodeBlock(l=python_script) { l[1]; }
setParameterByName = Element.SetParameterByName(element=byPointInView, parameterName=code_block_14, value=code_block_15)
end = Revit.Transaction.Transaction.End(input=setParameterByName)
familyinstance_2d_geometry = Custom[FamilyInstance 2D Geometry](element=end)  # package Genius Loci; Gets the curves of the family instance. Works only with the family categories : Generic Annotation and Detail Item.
python_script_2 = Python(IN[0]=familyinstance_2d_geometry)
# ---------- python_script_2.python (7 lines) ----------
input = IN[0]

if input == [] or input == None:
	res = None
else:
	res = input
OUT = res
# ----------------------------------------
code_block_16 = CodeBlock { 0; }
getItemAtIndex = List.GetItemAtIndex(list=python_script_2@L2, index=code_block_16)
python_script_3 = Python(IN[0]=getItemAtIndex)
# ---------- python_script_3.python (7 lines) ----------
input = IN[0][0]

if input == [] or input == None:
	res = []
else:
	res = input
OUT = res
# ----------------------------------------
code_block_17 = CodeBlock { 0.5; }
pointAtParameter = Curve.PointAtParameter(curve=python_script_3, param=code_block_17)
code_block_18 = CodeBlock { "Barra Vertical con Patas"; }
byName_2 = FamilyType.ByName(name=code_block_18)
code_block_19 = CodeBlock { true; }
boolean = BoolSelector(true)
create_tag = Custom[Create Tag](view=activeView, element=end, TagLocation=pointAtParameter, TagType=byName_2, addLeader=code_block_19, RunIt=boolean)  # package Genius Loci; Works only in Revit 2018 and later. Creates a tag at a given location, of given type and in a supplied view. The node also works with Linked Elements (except space and area), Multi Category tag and Material Tag. Based on an archilab node
tag_getlocation = Custom[Tag GetLocation](tag=create_tag)  # package Genius Loci; Retrieves the position of the head of tag.
code_block_20 = CodeBlock { 75; }
translate = Geometry.Translate(geometry=tag_getlocation, xTranslation=code_block_20, yTranslation=code_block_20)
tag_setlocation = Custom[Tag SetLocation](tag=create_tag, location=translate)  # package Genius Loci; Moves the head of the tag to the given location point.
end_2 = Revit.Transaction.Transaction.End(input=tag_setlocation)
code_block_21 = CodeBlock { "Leader Type"; 1; }
setParameterByName_2 = Element.SetParameterByName(element=end_2, parameterName=code_block_21.out0, value=code_block_21.out1)
