# Dynamo graph script.dyn (Dynamo 2.6.2.15705)
# packages: Clockwork for Dynamo 2.x 2.3.0, Data-Shapes 2021.2.93, Genius Loci 2021.4.13, WombatDynamo 2.3.4, Rhythm 2021.4.2, archi-lab.net 2021.25.2621

current = Document.Current()
activeView = Document.ActiveView(document=current)
code_block = CodeBlock { "Suple Superior Pata Derecha"; }
file_path = Filename("..\00_IMAGENES\editable Arainco-cmyk-01.png")
code_block_2 = CodeBlock { 160; "INICIAR"; "CANCELAR"; }
code_block_3 = CodeBlock { "Diametro de Barras"; }
code_block_4 = CodeBlock { "EST_D_VIGA_BARRA HORIZONTAL_INFERIOR_SUPLE_DOS PATAS"; }
byName = Family.ByName(name=code_block_4)
code_block_5 = CodeBlock()
# ---------- code_block_5.designscript (13 lines) ----------
[
"ø6",
"ø8",
"ø10",
"ø12",
"ø16",
"ø18",
"ø22",
"ø25",
"ø28",
"ø32",
"ø36"
];
# ----------------------------------------
byFamilyAndName = FamilyType.ByFamilyAndName(family=byName, name=code_block_5)
name = Element.Name(element=byFamilyAndName)
sortByKey = List.SortByKey(list=byFamilyAndName, keys=name)
code_block_6 = CodeBlock { 4; }
code_block_7 = CodeBlock { false; }
dropdown_data = Custom[DropDown Data](InputName=code_block_3, Keys=sortByKey.sorted_keys, Values=sortByKey.sorted_list, DefaultValueIndex=code_block_6, Sorted_optional=code_block_7)  # package Data-Shapes; Create data for DropDown input in UI.MultiInputForm ++ . Check out www.data-shapes.net for more infos.
code_block_8 = CodeBlock { "Cantidad de Barras"; }
code_block_9 = CodeBlock { 1..10..1; 1; }
code_block_10 = CodeBlock { false; }
dropdown_data_2 = Custom[DropDown Data](InputName=code_block_8, Keys=code_block_9.out0, Values=code_block_9.out0, DefaultValueIndex=code_block_9.out1, Sorted_optional=code_block_10)
code_block_11 = CodeBlock { "Selecciona una Barra de Primera Capa"; }
code_block_12 = CodeBlock { "SELECCIONAR"; }
code_block_13 = CodeBlock { "Detail Items"; }
byName_2 = Category.ByName(name=code_block_13)
code_block_14 = CodeBlock { true; }
selectmodelelements_data = Custom[SelectModelElements Data](InputName=code_block_11, ButtonText=code_block_12, CategoryFilter=byName_2, SelectSingleElement=code_block_14)  # package Data-Shapes; Creates a Revit element selection input for UI.MultipleInputForm++ . Check out www.data-shapes.net for more infos!
list_create = List.Create(item0=dropdown_data, item1=dropdown_data_2, item2=selectmodelelements_data)
boolean = BoolSelector(true)
multipleinputform = Custom[MultipleInputForm ++](Description_optional=code_block, Logo_optional=file_path, ButtonText_optional=code_block_2.out1, Inputs=list_create, Toggle=boolean, CancelButtonText_optional=code_block_2.out2, LabelWidth_optional=code_block_2.out0)  # package Data-Shapes; Create a form with multiple inputs. see www.data-shapes.net for tutorials and infos!
nullItem = WombatDynamo.List.NullItem()
if_ = If(test=multipleinputform.Was_Cancelled, true=nullItem, false=multipleinputform.User_Inputs)
code_block_15 = CodeBlock(l=if_) { l[2]; }
familyType = Custom[FamilyInstance.FamilyType](familyInstance=code_block_15)  # package archi-lab.net; This node will return a Family Type of a given Family Instance. If no Family Type can be assigned to a Family then it will return Null.
family = FamilyType.Family(familyType=familyType)
name_2 = Family.Name(family=family)
code_block_16 = CodeBlock { "EST_D_VIGA_BARRA HORIZONTAL_INFERIOR_DOS PATAS"; }
eq = name_2 == code_block_16
code_block_17 = CodeBlock { null; }
if_2 = If(test=eq, true=code_block_15, false=code_block_17)
familyinstance_2d_geometry = Custom[FamilyInstance 2D Geometry](element=if_2)  # package Genius Loci; Gets the curves of the family instance. Works only with the family categories : Generic Annotation and Detail Item.
code_block_18 = CodeBlock { 1; }
getItemAtIndex = List.GetItemAtIndex(list=familyinstance_2d_geometry@L2, index=code_block_18)
startPoint = Curve.StartPoint(curve=getItemAtIndex)
code_block_19 = CodeBlock(l=if_) { l[0]; }
byPointInView = Custom[FamilyInstance.ByPointInView](point=startPoint, familyType=code_block_19, view=activeView)  # package Clockwork for Dynamo 2.x; Places a family instance at a given point in a given view (e.g. a detail component).
code_block_20 = CodeBlock { "Cantidad de Barras"; }
code_block_21 = CodeBlock(l=if_) { l[1]; }
setParameterByName = Element.SetParameterByName(element=byPointInView, parameterName=code_block_20, value=code_block_21)
code_block_22 = CodeBlock { "Parcial&Recubrimientos"; }
code_block_23 = CodeBlock { "Parcial&Recubrimientos"; }
getParameterValueByName = Element.GetParameterValueByName(element=if_2, parameterName=code_block_23)
code_block_24 = CodeBlock { 60; }
sub = getParameterValueByName - code_block_24
setParameterByName_2 = Element.SetParameterByName(element=setParameterByName, parameterName=code_block_22, value=sub)
end = Revit.Transaction.Transaction.End(input=setParameterByName_2)
code_block_25 = CodeBlock { "Detail Item Tags"; }
byName_3 = Category.ByName(name=code_block_25)
all_family_types_of_category = Custom[All Family Types Of Category](category=byName_3)  # package Clockwork for Dynamo 2.x; Gets all family types/symbols of a given category in the model.
familyName = Custom[FamilyType.FamilyName](familyType=all_family_types_of_category)  # package Clockwork for Dynamo 2.x; Returns the *family* name of a given family *type*
string = StringInput("EST_A_VIGA_SUPLE INFERIOR_TAG BARRA")
eq_2 = familyName == string  # lacing=Longest
filterByBoolMask = List.FilterByBoolMask(list=all_family_types_of_category, mask=eq_2)
code_block_26 = CodeBlock(l=filterByBoolMask.in) { l[3]; }

# group: BARRA VERTICAL CON PATA INFERIOR
familyinstance_2d_geometry_2 = Custom[FamilyInstance 2D Geometry](element=end)
code_block_27 = CodeBlock { 1; }
getItemAtIndex_2 = List.GetItemAtIndex(list=familyinstance_2d_geometry_2@L2, index=code_block_27)
code_block_28 = CodeBlock { 0.5; }
pointAtParameter = Curve.PointAtParameter(curve=getItemAtIndex_2, param=code_block_28)
boolean_2 = BoolSelector(true)
create_tag = Custom[Create Tag](view=activeView, element=end, TagLocation=pointAtParameter, TagType=code_block_26, RunIt=boolean_2)  # package Genius Loci; Works only in Revit 2018 and later. Creates a tag at a given location, of given type and in a supplied view. The node also works with Linked Elements (except space and area), Multi Category tag and Material Tag. Based on an archilab node
tag_getlocation = Custom[Tag GetLocation](tag=create_tag)  # package Genius Loci; Retrieves the position of the head of tag.
code_block_29 = CodeBlock { -550; 250; }
translate = Geometry.Translate(geometry=tag_getlocation, xTranslation=code_block_29.out1, yTranslation=code_block_29.out1, zTranslation=code_block_29.out0)
tag_setlocation = Custom[Tag SetLocation](tag=create_tag, location=translate)  # package Genius Loci; Moves the head of the tag to the given location point.

code_block_30 = CodeBlock { "Leader Line"; 1; }
setParameterByName_3 = Element.SetParameterByName(element=tag_setlocation, parameterName=code_block_30.out0, value=code_block_30.out1)
code_block_31 = CodeBlock { "Leader Type"; 1; }
setParameterByName_4 = Element.SetParameterByName(element=setParameterByName_3, parameterName=code_block_31.out0, value=code_block_31.out1)
translate_2 = Geometry.Translate(geometry=pointAtParameter, zTranslation=code_block_29.out0)
ʳʰʸᵗʰᵐ_tags = Rhythm.Revit.Elements.Tags.SetLeaderElbowPosition(tag=setParameterByName_4, location=translate_2)
ʳʰʸᵗʰᵐ_tags_setleaderendposition = Rhythm.Revit.Elements.Tags.SetLeaderEndPosition(tag=setParameterByName_4, location=pointAtParameter)
