# Dynamo graph horCorcheteMultiLarFijo_script.dyn (Dynamo 2.6.2.15705)
# packages: Data-Shapes 2022.2.103, Clockwork for Dynamo 2.x 2.4.0, Structural Design 2021.1.22, Genius Loci 2021.11.10

current = Document.Current()
activeView = Document.ActiveView(document=current)
code_block = CodeBlock { "Seleccionar Elementos"; }
categories_ᶜᵒⁿᵛᵉʳᵗᵉᵈ_ᵈʳᵒᵖᵈᵒʷⁿ = CodeBlock()
# ---------- categories_ᶜᵒⁿᵛᵉʳᵗᵉᵈ_ᵈʳᵒᵖᵈᵒʷⁿ.designscript (8 lines) ----------
//InputName
"";
//ButtonText
"SELECCIONAR";
//CategoryFilter
Revit.Category.ByName("Walls");
//SelectSingleElement
false;
# ----------------------------------------
selectmodelelements_data = Custom[SelectModelElements Data](InputName=categories_ᶜᵒⁿᵛᵉʳᵗᵉᵈ_ᵈʳᵒᵖᵈᵒʷⁿ.out0, ButtonText=categories_ᶜᵒⁿᵛᵉʳᵗᵉᵈ_ᵈʳᵒᵖᵈᵒʷⁿ.out1, CategoryFilter=categories_ᶜᵒⁿᵛᵉʳᵗᵉᵈ_ᵈʳᵒᵖᵈᵒʷⁿ.out2, SelectSingleElement=categories_ᶜᵒⁿᵛᵉʳᵗᵉᵈ_ᵈʳᵒᵖᵈᵒʷⁿ.out3)  # package Data-Shapes; Creates a Revit element selection input for UI.MultipleInputForm++ . Check out www.data-shapes.net for more infos!
inputgroup_data = Custom[InputGroup Data](GroupTitle=code_block, Inputs=selectmodelelements_data)  # package Data-Shapes; Creates a group of inputs for UI.MultipleInputForm ++ . Check out www.data-shapes.net for more infos !
code_block_2 = CodeBlock { "Datos de Posición Barra"; }
code_block_3 = CodeBlock()
# ---------- code_block_3.designscript (4 lines) ----------
//InputName
"Segmento Mayor";
//ButtonText
"SELECCIONAR";
# ----------------------------------------
selectfaces_data = Custom[SelectFaces Data](InputName=code_block_3.out0, ButtonText=code_block_3.out1)  # package Data-Shapes; Creates a Revit face selection input for UI.MultipleInputForm++. Check out www.data-shapes.net for more infos!
code_block_4 = CodeBlock()
# ---------- code_block_4.designscript (4 lines) ----------
//InputName
"Inicio";
//ButtonText
"SELECCIONAR";
# ----------------------------------------
selectfaces_data_2 = Custom[SelectFaces Data](InputName=code_block_4.out0, ButtonText=code_block_4.out1)
code_block_5 = CodeBlock()
# ---------- code_block_5.designscript (4 lines) ----------
//InputName
"Término";
//ButtonText
"SELECCIONAR";
# ----------------------------------------
selectfaces_data_3 = Custom[SelectFaces Data](InputName=code_block_5.out0, ButtonText=code_block_5.out1)
list_create = List.Create(item0=selectfaces_data, item1=selectfaces_data_2, item2=selectfaces_data_3)
inputgroup_data_2 = Custom[InputGroup Data](GroupTitle=code_block_2, Inputs=list_create)
code_block_6 = CodeBlock { "Datos de Armadura"; }
element_types_ᶜᵒⁿᵛᵉʳᵗᵉᵈ_ᵈʳᵒᵖᵈᵒʷⁿ = CodeBlock { DSCore.Types.FindTypeByNameInAssembly("RebarBarType", "RevitAPI"); }
all_elements_of_type = ElementsOfType(element_type=element_types_ᶜᵒⁿᵛᵉʳᵗᵉᵈ_ᵈʳᵒᵖᵈᵒʷⁿ)
code_block_7 = CodeBlock(elem_type=all_elements_of_type) { elem_type; elem_type_diameter = Properties.RebarDiameter(elem_type); }
sortByKey = List.SortByKey(list=code_block_7.elem_type, keys=code_block_7.elem_type_diameter)
code_block_8 = CodeBlock(elem_sorted=sortByKey.sorted_list)
# ---------- code_block_8.designscript (12 lines) ----------
elem_name = Revit.Elements.Element.Name(elem_sorted);

//InputName
"Diametro";
//Keys
elem_name;
//Values
elem_sorted;
//DefaultValueIndex
0;
//Sorted_optional
false;
# ----------------------------------------
dropdown_data = Custom[DropDown Data](InputName=code_block_8.out1, Keys=code_block_8.out2, Values=code_block_8.out3, DefaultValueIndex=code_block_8.out4, Sorted_optional=code_block_8.out5)  # package Data-Shapes; Create data for DropDown input in UI.MultiInputForm ++ . Check out www.data-shapes.net for more infos.
code_block_9 = CodeBlock { "Cant. de Barras"; "2"; true; }
textbox_data = Custom[TextBox Data](InputName=code_block_9.out0, DefaultText=code_block_9.out1, IsNumberEntry=code_block_9.out2)  # package Data-Shapes; Create Data for TextBox input in UI.MultipleInputForm ++ . Check out www.data-shapes.net for more informations
code_block_10 = CodeBlock { "Capa"; ["1ª Capa", "2ª Capa", "3ª Capa", "4ª Capa", "5ª Capa"]; [40, 90, 140, 190, 240]; 0; }
dropdown_data_2 = Custom[DropDown Data](InputName=code_block_10.out0, Keys=code_block_10.out1, Values=code_block_10.out2, DefaultValueIndex=code_block_10.out3)
code_block_11 = CodeBlock()
# ---------- code_block_11.designscript (6 lines) ----------
//InputName
"Largo 1º Barra";
//DefaultText
"6000";
//IsNumberEntry
true;
# ----------------------------------------
textbox_data_2 = Custom[TextBox Data](InputName=code_block_11.out0, DefaultText=code_block_11.out1, IsNumberEntry=code_block_11.out2)
code_block_12 = CodeBlock()
# ---------- code_block_12.designscript (6 lines) ----------
//InputName
"Largo Típico";
//DefaultText
"6000";
//IsNumberEntry
true;
# ----------------------------------------
textbox_data_3 = Custom[TextBox Data](InputName=code_block_12.out0, DefaultText=code_block_12.out1, IsNumberEntry=code_block_12.out2)
list_create_2 = List.Create(item0=dropdown_data, item1=textbox_data, item2=dropdown_data_2, item3=textbox_data_2, item4=textbox_data_3)
inputgroup_data_3 = Custom[InputGroup Data](GroupTitle=code_block_6, Inputs=list_create_2)
list_create_3 = List.Create(item0=inputgroup_data, item1=inputgroup_data_2, item2=inputgroup_data_3)
code_block_13 = CodeBlock(inputs=list_create_3)
# ---------- code_block_13.designscript (20 lines) ----------
//Description
"Multisegmento Largos Fijos";
//Logo
"C:\\Arainco\\Arainco.png";
//ButtonText
"INICIAR";
//Inputs
inputs;
//Toggle
true;
//LinkToHelp
null;
//CancelButtonText
"CANCELAR";
//MaxHeight
0;
//Width
430;
//LabelWidth
170;
# ----------------------------------------
multipleinputform = Custom[MultipleInputForm ++](Description_optional=code_block_13.out0, Logo_optional=code_block_13.out1, ButtonText_optional=code_block_13.out2, Inputs=code_block_13.inputs, Toggle=code_block_13.out4, LinkToHelp_optional=code_block_13.out5, CancelButtonText_optional=code_block_13.out6, MaxHeight_optional=code_block_13.out7, Width_optional=code_block_13.out8, LabelWidth_optional=code_block_13.out9)  # package Data-Shapes; Create a form with multiple inputs. see www.data-shapes.net for tutorials and infos!
code_block_14 = CodeBlock(l=multipleinputform.User_Inputs)
# ---------- code_block_14.designscript (12 lines) ----------
l;
[Imperative]
{
	if (l == null)
	{
		return = [[],[],[],[],[],[],[],[],[],[]];
	}
	else
	{
		return = l;
	}
};
# ----------------------------------------
code_block_15 = CodeBlock(x=code_block_14.out1) { x[1][0]; }
recubrimiento_segmento_mayor = Python(IN[0]=code_block_15)
# ---------- recubrimiento_segmento_mayor.python (35 lines) ----------
import clr
clr.AddReference('ProtoGeometry')
from Autodesk.DesignScript.Geometry import *

clr.AddReference('RevitAPI')
import Autodesk
from Autodesk.Revit.DB import *

clr.AddReference('RevitAPIUI')
from Autodesk.Revit.UI import *
from Autodesk.Revit.UI.Selection import *

clr.AddReference('RevitServices')
import RevitServices
from RevitServices.Persistence import DocumentManager

clr.AddReference("RevitNodes")
import Revit
# Import ToProtoType, ToRevitType geometry conversion extension methods
clr.ImportExtensions(Revit.GeometryConversion)
doc = DocumentManager.Instance.CurrentDBDocument


surface = UnwrapElement(IN[0])
ref = surface.Tags.LookupTag("RevitFaceReference")
elemId = ref.ElementId
element = doc.GetElement(ref.ElementId)
category = element.Category.Name

if "Foundations" in category:
	recubrimiento = True
else:
	recubrimiento = False

OUT = recubrimiento
# ----------------------------------------
code_block_16 = CodeBlock(x=code_block_14.out1) { x[2][0]; }
recubrimiento_inicio = Python(IN[0]=code_block_16)
# ---------- recubrimiento_inicio.python (35 lines) ----------
import clr
clr.AddReference('ProtoGeometry')
from Autodesk.DesignScript.Geometry import *

clr.AddReference('RevitAPI')
import Autodesk
from Autodesk.Revit.DB import *

clr.AddReference('RevitAPIUI')
from Autodesk.Revit.UI import *
from Autodesk.Revit.UI.Selection import *

clr.AddReference('RevitServices')
import RevitServices
from RevitServices.Persistence import DocumentManager

clr.AddReference("RevitNodes")
import Revit
# Import ToProtoType, ToRevitType geometry conversion extension methods
clr.ImportExtensions(Revit.GeometryConversion)
doc = DocumentManager.Instance.CurrentDBDocument


surface = UnwrapElement(IN[0])
ref = surface.Tags.LookupTag("RevitFaceReference")
elemId = ref.ElementId
element = doc.GetElement(ref.ElementId)
category = element.Category.Name

if "Foundations" in category:
	recubrimiento = 50
else:
	recubrimiento = 25

OUT = recubrimiento
# ----------------------------------------
code_block_17 = CodeBlock(x=code_block_14.out1) { x[3][0]; }
recubrimiento_termino = Python(IN[0]=code_block_17)  # same code as recubrimiento_inicio
current_2 = Document.Current()
activeView_2 = Document.ActiveView(document=current_2)
plane = Custom[View.Plane](view=activeView_2)  # package Clockwork for Dynamo 2.x; Retrieves the plane of a given view
element_types_ᶜᵒⁿᵛᵉʳᵗᵉᵈ_ᵈʳᵒᵖᵈᵒʷⁿ_2 = CodeBlock { DSCore.Types.FindTypeByNameInAssembly("RebarHookType", "RevitAPI"); }
all_elements_of_type_2 = ElementsOfType(element_type=element_types_ᶜᵒⁿᵛᵉʳᵗᵉᵈ_ᵈʳᵒᵖᵈᵒʷⁿ_2)
code_block_18 = CodeBlock(x=code_block_14.out1, rec_seg_mayor=recubrimiento_segmento_mayor, rec_inicio=recubrimiento_inicio, rec_termino=recubrimiento_termino, view_plane=plane, hook_types=all_elements_of_type_2)
# ---------- code_block_18.designscript (349 lines) ----------
elem = x[0];
dist_traslacion_curva;
distribucion = x[1][0];
rec_seg_mayor;
empotramiento = x[2][0];
rec_inicio;
termino = x[3][0];
rec_termino;
tipo_barra = x[4];
cantidad_barras = x[5];
capa = x[6];
capa_as_str = Strings.ToString(x[6], "");
largo_primera_barra = x[7];
largo_tip = x[8];
view_plane;
view_plane_normal = Autodesk.Plane.Normal(view_plane);
view_plane_vector_y = Autodesk.Plane.YAxis(view_plane);
view_plane_normal_reverse = Autodesk.Vector.Reverse(view_plane_normal);
hook_types;

//
pata_names = Revit.Elements.Element.Name(hook_types);
pata_mask = pata_names == "Standard - 90 deg.";
pata = DSCore.List.FilterByBoolMask(hook_types, pata_mask)["in"][0];

//Vector Normal Cara de Distribucion
normal_distribucion = Autodesk.Surface.NormalAtParameter(distribucion, 0.5, 0.5);

//Variables para filtrar elementos por categoria
elem_category = Revit.Elements.Element.GetCategory(elem);
elem_category_name = Revit.Category.Name(elem_category);

//Filtrar muros paralelos a la vista actual
wall_vector = Rhythm.Walls.Direction(elem)["facingVector"];
wall_centroid = Autodesk.Solid.Centroid(DSCore.List.Flatten(Revit.Elements.Element.Geometry(elem)));
wall_coo_sys = CoordinateSystem.ByOriginVectors(wall_centroid, wall_vector, Autodesk.Vector.YAxis());
wall_vector_mask = Autodesk.Vector.IsParallel(CoordinateSystem.XAxis(wall_coo_sys), view_plane_normal);
wall_lst = DSCore.List.FilterByBoolMask(elem, wall_vector_mask)["in"];

//Filtrar vigas de hormigon paralelos a la vista actual
structural_framing_mask = elem_category_name == "Structural Framing";
structural_framing = DSCore.List.FilterByBoolMask(elem, structural_framing_mask)["in"];
structural_framing_material = DSCore.List.Flatten(Revit.Elements.Element.GetMaterials(structural_framing, false));
structural_framing_material_name = Revit.Material.Name(structural_framing_material);
structural_framing_material_mask = structural_framing_material_name == "Concrete, Cast-in-Place gray";
structural_framing_hormigon = DSCore.List.FilterByBoolMask(structural_framing, structural_framing_material_mask)["in"];
structural_framing_hormigon_location = Revit.Elements.Element.GetLocation(structural_framing_hormigon);
structural_framing_hormigon_vector = Line.Direction(structural_framing_hormigon_location);
structural_framing_hormigon_centroid = Autodesk.Solid.Centroid(DSCore.List.Flatten(Revit.Elements.Element.Geometry(structural_framing_hormigon)));
structural_framing_hormigon_coo_sys = CoordinateSystem.ByOriginVectors(structural_framing_hormigon_centroid, structural_framing_hormigon_vector, Autodesk.Vector.XAxis());
structural_framing_hormigon_vector_mask = Autodesk.Vector.IsParallel(CoordinateSystem.YAxis(structural_framing_hormigon_coo_sys), view_plane_normal);
structural_framing_hormigon_lst = DSCore.List.FilterByBoolMask(structural_framing_hormigon, structural_framing_hormigon_vector_mask)["in"];

//lista de elemetos paralelos a la vista actual
elem_lst = DSCore.List.Flatten([wall_lst, structural_framing_hormigon_lst]);

//Geometria a Cortar
g_elem_solid = DSCore.List.Flatten(Revit.Elements.Element.Geometry(elem_lst));
g_solid_centroid = Autodesk.Solid.Centroid(g_elem_solid);
g_solid_plane = Autodesk.Plane.ByOriginNormal(g_solid_centroid, view_plane_normal);
g_solid_coo_sys = CoordinateSystem.ByPlane(g_solid_plane);
g_solid_scaled = Autodesk.Geometry.Scale(g_elem_solid, g_solid_plane, 100, 100, 1);
geom_a_cortar = Autodesk.Solid.ByUnion(g_solid_scaled);

//Numero de Capa
key_2 = ["40", "90", "140", "190", "240"];
val_2 = ["1", "2", "3", "4", "5"];
dict_capa = Dictionary.ByKeysValues(key_2, val_2);
num_capa = Dictionary.ValueAtKey(dict_capa, capa_as_str);

//Desplazamiento etiqueta
key_1 = ["40", "90", "140", "190", "240"];
val_1 = [450, 700, 950, 1200, 1450];
dict_desplazamiento = Dictionary.ByKeysValues(key_1, val_1);
despl_etiqueta = Dictionary.ValueAtKey(dict_desplazamiento, capa_as_str);

//Vector Normal Caras capturadas
distribucion_normal = Autodesk.Surface.NormalAtParameter(distribucion, 0.5, 0.5);
empotramiento_normal = Autodesk.Surface.NormalAtParameter(empotramiento, 0.5, 0.5);
termino_normal = Autodesk.Surface.NormalAtParameter(termino, 0.5, 0.5);

//Centroide Caras Capturadas
distribucion_point = Autodesk.Surface.PointAtParameter(distribucion, 0.5, 0.5);
empotramiento_point = Points.PullOntoPlane(Autodesk.Surface.PointAtParameter(empotramiento, 0.5, 0.5), view_plane);
termino_point = Points.PullOntoPlane(Autodesk.Surface.PointAtParameter(termino, 0.5, 0.5), view_plane);
empotramiento_point_z = Autodesk.Point.Z(empotramiento_point);
termino_point_x = Autodesk.Point.X(termino_point);
termino_point_y = Autodesk.Point.Y(termino_point);
termino_point_corregido = Autodesk.Point.ByCoordinates(termino_point_x, termino_point_y, empotramiento_point_z);

//Planos caras capturadas
distribucion_plane_1 = Autodesk.Plane.ByOriginNormal(distribucion_point, distribucion_normal);
empotramiento_plane_1 = Autodesk.Plane.ByOriginNormal(empotramiento_point, empotramiento_normal);
termino_plane_1 = Autodesk.Plane.ByOriginNormal(termino_point, termino_normal);

//Planos Trasladados
capa_1 = [Imperative]
{
	if(rec_seg_mayor == true)
	{
		return = capa + 25;
	}
	else
	{
		return = capa;
	}
};
distribucion_plane = Autodesk.Geometry.Translate(distribucion_plane_1, distribucion_normal, capa_1  * -1);
empotramiento_plane = Autodesk.Geometry.Translate(empotramiento_plane_1, empotramiento_normal, rec_inicio * -1);
termino_plane = Autodesk.Geometry.Translate(termino_plane_1, termino_normal, rec_termino * -1);

//Plano de ajuste para cotas de empalme
distribucion_plane_ajuste = Autodesk.Geometry.Translate(distribucion_plane_1, distribucion_normal, 310);

//Vector entre Planos de Empotramiento y Termino
l = Line.ByBestFitThroughPoints([empotramiento_point, termino_point_corregido]);
vector_normalizado = Autodesk.Vector.Normalized(Line.Direction(l));

//Sistema de Coordenadas Vista Actual
view_coo_sys = Autodesk.Plane.ToCoordinateSystem(view_plane);
y_axis = CoordinateSystem.YAxis(view_coo_sys);

//Vector de Traslacion
booleano = Autodesk.Vector.IsAlmostEqualTo(y_axis, vector_normalizado);
vector_traslacion = booleano ? view_plane_normal_reverse : view_plane_normal_reverse;

//Traslacion curva
category = Revit.Elements.Element.GetCategory(elem_lst);
category_name = Revit.Category.Name(category);
mask = category_name == "Walls";
element = DSCore.List.FilterByBoolMask(elem_lst, mask)["in"];
element_type = Revit.Elements.Element.GetParameterValueByName(element, "Type");
element_width = Revit.Elements.Element.GetParameterValueByName(element_type, "Width");
dist_traslacion_curva = (element_width[0] / 2) - 40;


//Empotramiento Armadura
tipo_barra_str = Strings.ToString(Properties.RebarDiameter(tipo_barra),"");
key = ["8","10","12","16","18","22","25","28","32","36"];
val = [570, 710, 860, 1140, 1290, 1960, 2230, 2500, 2850, 3210];
dict_traslapo = Dictionary.ByKeysValues(key, val);
empotramiento_dict = Dictionary.ValueAtKey(dict_traslapo, tipo_barra_str);

//Largo Pata en funcion del diametro de barra
key_l_pata = ["8","10","12","16","18","22","25","28","32","36"];
val_l_pata = [160, 200, 240, 320, 360, 440, 500, 570, 650, 720];
dict_l_pata = Dictionary.ByKeysValues(key_l_pata, val_l_pata);
l_pata_dict = Dictionary.ValueAtKey(dict_l_pata, tipo_barra_str);

//Superficies
surf_distribucion = Autodesk.Geometry.Intersect(geom_a_cortar, distribucion_plane)[0];
surf_empotramiento = Autodesk.Geometry.Intersect(geom_a_cortar, empotramiento_plane)[0];
surf_termino = Autodesk.Geometry.Intersect(geom_a_cortar, termino_plane)[0];

//Intersecciones
intersect_start = Autodesk.Geometry.Intersect(surf_distribucion, surf_empotramiento)[0];
intersect_end = Autodesk.Geometry.Intersect(surf_distribucion, surf_termino)[0];

//Puntos para Generar Curva
point_start = Autodesk.Curve.PointAtParameter(intersect_start, 0.5);
point_end = Autodesk.Curve.PointAtParameter(intersect_end, 0.5);

//Rebar Curve
rebar_curve_init = Line.ByStartPointEndPoint(point_start, point_end);
rebar_curve = Autodesk.Geometry.Translate(rebar_curve_init, vector_traslacion, dist_traslacion_curva);
first_point = Autodesk.Curve.PointAtSegmentLength(rebar_curve_init<1>, (largo_primera_barra - l_pata_dict) - (empotramiento_dict / 2));
rebar_curve_puntos_division_1 = Autodesk.Curve.PointsAtChordLengthFromPoint(rebar_curve, first_point, (largo_tip - empotramiento_dict));
rebar_curve_puntos_division_2 = DSCore.List.DropItems(rebar_curve_puntos_division_1, 1);
rebar_curve_puntos_division_3 = [Imperative]
{
	if (largo_primera_barra >= largo_tip)
	{
		return = rebar_curve_puntos_division_2;
	}
	else
	{
		return = rebar_curve_puntos_division_1;
	}
};
rebar_curve_param_last_point = DSCore.List.LastItem(Autodesk.Curve.ParameterAtPoint(rebar_curve, rebar_curve_puntos_division_3));
rebar_curve_puntos_division = [Imperative]
{
	if (rebar_curve_param_last_point >= 0.95)
	{
		return = DSCore.List.DropItems(rebar_curve_puntos_division_3, -1);
	}
	else
	{
		return = rebar_curve_puntos_division_3;
	}
};
rebar_curve_splited = Autodesk.Curve.SplitByPoints(rebar_curve, rebar_curve_puntos_division);
distribucion_vector = Autodesk.Surface.NormalAtParameter(distribucion, 0.5, 0.5);
vector_z = Autodesk.Vector.Z(distribucion_vector);

rebar_curve_last = Autodesk.Curve.ExtendEnd(DSCore.List.FirstItem(rebar_curve_splited), empotramiento_dict / 2);
rebar_curve_middle = Autodesk.Curve.ExtendEnd(Autodesk.Curve.ExtendStart(DSCore.List.Slice(rebar_curve_splited, 1, -1, 1), empotramiento_dict / 2), empotramiento_dict / 2);
rebar_curve_first = Autodesk.Curve.ExtendStart(DSCore.List.LastItem(rebar_curve_splited), empotramiento_dict / 2);

orintacion_pata = vector_z < 0 ? "Left" : "Right";

//Buscar Host mas cercano
elem_solid = DSCore.List.Flatten(Revit.Elements.Element.Geometry(elem_lst));
solid_centroid = Autodesk.Solid.Centroid(elem_solid);

//ArrayLength
array_length = DSCore.List.FirstItem(element_width - 80);
cantidad_barras;

//Primera Barra
rebar_curve_first_mid_point = Autodesk.Curve.PointAtParameter(rebar_curve_first, 0.5);
rebar_curve_first_distance_to = Autodesk.Geometry.DistanceTo(solid_centroid, rebar_curve_first_mid_point);
rebar_curve_first_min = DSCore.List.MinimumItem(rebar_curve_first_distance_to);
rebar_curve_first_mask = rebar_curve_first_distance_to == rebar_curve_first_min;
rebar_curve_first_host = DSCore.List.FilterByBoolMask(elem, rebar_curve_first_mask)["in"][0];
//curves
rebar_curve_first;
//rebarStyle
"Standard";
//rebarBarType
tipo_barra;
//startHookType
null;
//endHookType
pata;
//startHookOrientation
orintacion_pata;
//endtHookOrientation
orintacion_pata;
//hostElement
rebar_curve_first_host;
//vector
view_plane_normal;
//arrayLength
array_length;
//numberOfBarPositions
cantidad_barras;
//Vector Normal Cara de Distribucion
normal_distribucion;
//Desplazamiento Etiqueta
view_plane_vector_y;
//Capa
capa_as_str;
num_capa;


















//Barras Intermedias
rebar_curve_middle_mid_point = Autodesk.Curve.PointAtParameter(rebar_curve_middle, 0.5);
rebar_curve_middle_distance_to = Autodesk.Geometry.DistanceTo(solid_centroid@L2<1L>, rebar_curve_middle_mid_point@L1<1L>);
rebar_curve_middle_min = DSCore.List.MinimumItem(rebar_curve_middle_distance_to);
rebar_curve_middle_mask = rebar_curve_middle_distance_to@L2<1L> == rebar_curve_middle_min@L1<1L>;
rebar_curve_middle_host = DSCore.List.Flatten(DSCore.List.FilterByBoolMask(elem@L2<1L>, rebar_curve_middle_mask@L2<1L>)["in"]);
//curves
rebar_curve_middle;
//rebarStyle
"Standard";
//rebarBarType
tipo_barra;
//startHookType
null;
//endHookType
null;
//startHookOrientation
orintacion_pata;
//endtHookOrientation
orintacion_pata;
//hostElement
rebar_curve_middle_host;
//vector
view_plane_normal;
//arrayLength
array_length;
//numberOfBarPositions
cantidad_barras;
//Vector Normal Cara de Distribucion
normal_distribucion;
//Desplazamiento Etiqueta
view_plane_vector_y;
//Capa
capa_as_str;
num_capa;

















//Ultima Barra
rebar_curve_last_mid_point = Autodesk.Curve.PointAtParameter(rebar_curve_last, 0.5);
rebar_curve_last_distance_to = Autodesk.Geometry.DistanceTo(solid_centroid, rebar_curve_last_mid_point);
rebar_curve_last_min = DSCore.List.MinimumItem(rebar_curve_last_distance_to);
rebar_curve_last_mask = rebar_curve_last_distance_to == rebar_curve_last_min;
rebar_curve_last_host = DSCore.List.FilterByBoolMask(elem, rebar_curve_last_mask)["in"][0];
//curves
rebar_curve_last;
//rebarStyle
"Standard";
//rebarBarType
tipo_barra;
//startHookType
pata;
//endHookType
null;
//startHookOrientation
orintacion_pata;
//endtHookOrientation
orintacion_pata;
//hostElement
rebar_curve_last_host;
//vector
view_plane_normal;
//arrayLength
array_length;
//numberOfBarPositions
cantidad_barras;
//Vector Normal Cara de Distribucion
normal_distribucion;
//Desplazamiento Etiqueta
view_plane_vector_y;
//Capa
capa_as_str;
num_capa;
# ----------------------------------------
fromCurves = StructuralDesign.Rebar.Create.FromCurves(curves=code_block_18.out128, rebarStyle=code_block_18.out129, rebarBarType=code_block_18.out130, startHookType=code_block_18.out131, endHookType=code_block_18.out132, startHookOrientation=code_block_18.out133, endHookOrientation=code_block_18.out134, hostElement=code_block_18.out135, vector=code_block_18.out136)
setLayoutAsFixedNumber = StructuralDesign.Rebar.Layout.SetLayoutAsFixedNumber(rebar=fromCurves, arrayLength=code_block_18.out137, numberOfBarPositions=code_block_18.out138)
element_types_ᶜᵒⁿᵛᵉʳᵗᵉᵈ_ᵈʳᵒᵖᵈᵒʷⁿ_3 = CodeBlock { DSCore.Types.FindTypeByNameInAssembly("RebarShape", "RevitAPI"); }
all_elements_of_type_3 = ElementsOfType(element_type=element_types_ᶜᵒⁿᵛᵉʳᵗᵉᵈ_ᵈʳᵒᵖᵈᵒʷⁿ_3)
code_block_19 = CodeBlock(rebar=setLayoutAsFixedNumber, capa=code_block_18.out142, elem=all_elements_of_type_3)
# ---------- code_block_19.designscript (8 lines) ----------
//Asigna Numero de Capa
Revit.Elements.Element.SetParameterByName(rebar, "Capa", capa);

//Asigna el Rebar Shape Indicado
elem_names = Revit.Elements.Element.Name(elem);
mask = elem_names == "R_S_01";
rebar_shape_R_S_01 = DSCore.List.FilterByBoolMask(elem, mask)["in"];
Revit.Elements.Element.SetParameterByName(rebar, "Shape", rebar_shape_R_S_01)[0];
# ----------------------------------------
rebarCenterlineCurves = StructuralDesign.Rebar.Properties.RebarCenterlineCurves(rebar=code_block_19.out4)
code_block_20 = CodeBlock(x=rebarCenterlineCurves, normal_distribucion=code_block_18.out139, view_plane_vector_y=code_block_18.out140, capa=code_block_18.out141, element=code_block_19.out4)
# ---------- code_block_20.designscript (36 lines) ----------
rebar_curve = x;
normal_distribucion;
view_plane_vector_y;
capa;
//TagLocationParam
[40, 90, 140, 190, 240];
key_param = ["40", "90", "140", "190", "240"];
val_param = [0.2, 0.16, 0.14, 0.12, 0.10];
dict_param = Dictionary.ByKeysValues(key_param, val_param);
param = Dictionary.ValueAtKey(dict_param, capa);

//TagLocation dist
[40, 90, 140, 190, 240];
key_dist = ["40", "90", "140", "190", "240"];
val_dist = [450, 900, 1350, 1800, 2250];
dict_dist = Dictionary.ByKeysValues(key_dist, val_dist);
dist = Dictionary.ValueAtKey(dict_dist, capa);


//element
element;
//TagLocation
point_leader_end = Autodesk.Curve.PointAtParameter(rebar_curve, param);
point_leader_elbow = Autodesk.Geometry.Translate(point_leader_end, normal_distribucion, dist);
point_tag_location = Autodesk.Geometry.Translate(point_leader_elbow, view_plane_vector_y, 650);
//TagType
family = Revit.Family.ByName("EST_A_STRUCTURAL REBAR TAG_STANDAR");
tag_type = Revit.Elements.FamilyType.ByFamilyAndName(family, "R_S_01");
//horizontal
true;
//addLeader
false;
//LinkInstance
null;
//RunIt
true;
# ----------------------------------------
create_tag = Custom[Create Tag](view=activeView, element=code_block_20.element, TagLocation=code_block_20.point_leader_end, TagType=code_block_20.tag_type, horizontal=code_block_20.out20, addLeader=code_block_20.out21, LinkInstance=code_block_20.out22, RunIt=code_block_20.out23, lacing=Shortest)  # package Genius Loci; Works only in Revit 2018 and later. Creates a tag at a given location, of given type and in a supplied view. The node also works with Linked Elements (except space and area), Multi Category tag and Material Tag. Based on an archilab node
code_block_21 = CodeBlock(x=create_tag, p1=code_block_20.point_tag_location, p2=code_block_20.point_leader_end, p3=code_block_20.point_leader_elbow)
# ---------- code_block_21.designscript (11 lines) ----------
tag = x[0];
//Activa Leader Line
Revit.Elements.Element.SetParameterByName(tag, "Leader Line", 1);
//Leader Line Free End
Revit.Elements.Element.SetParameterByName(tag, "Leader Type", 1);
//Posicion Tag
Rhythm.Tags.SetHeadPosition(tag, p1);
//Leader End Position
Rhythm.Tags.SetLeaderEndPosition(tag, p2);
//Leader Elbow
Rhythm.Tags.SetLeaderElbowPosition(tag, p3);
# ----------------------------------------
current_3 = Document.Current()
activeView_3 = Document.ActiveView(document=current_3)
fromCurves_2 = StructuralDesign.Rebar.Create.FromCurves(curves=code_block_18.out168, rebarStyle=code_block_18.out169, rebarBarType=code_block_18.out170, startHookType=code_block_18.out171, endHookType=code_block_18.out172, startHookOrientation=code_block_18.out173, endHookOrientation=code_block_18.out174, hostElement=code_block_18.out175, vector=code_block_18.out176)
setLayoutAsFixedNumber_2 = StructuralDesign.Rebar.Layout.SetLayoutAsFixedNumber(rebar=fromCurves_2, arrayLength=code_block_18.out177, numberOfBarPositions=code_block_18.out178)
element_types_ᶜᵒⁿᵛᵉʳᵗᵉᵈ_ᵈʳᵒᵖᵈᵒʷⁿ_4 = CodeBlock { DSCore.Types.FindTypeByNameInAssembly("RebarShape", "RevitAPI"); }
all_elements_of_type_4 = ElementsOfType(element_type=element_types_ᶜᵒⁿᵛᵉʳᵗᵉᵈ_ᵈʳᵒᵖᵈᵒʷⁿ_4)
code_block_22 = CodeBlock(rebar=setLayoutAsFixedNumber_2, capa=code_block_18.out182, elem=all_elements_of_type_4)  # same code as code_block_19
rebarCenterlineCurves_2 = StructuralDesign.Rebar.Properties.RebarCenterlineCurves(rebar=code_block_22.out4)
code_block_23 = CodeBlock(x=rebarCenterlineCurves_2, normal_distribucion=code_block_18.out179, view_plane_vector_y=code_block_18.out180, capa=code_block_18.out181, element=code_block_22.out4)
# ---------- code_block_23.designscript (36 lines) ----------
rebar_curve = x;
normal_distribucion;
view_plane_vector_y;
capa;
//TagLocationParam
[40, 90, 140, 190, 240];
key_param = ["40", "90", "140", "190", "240"];
val_param = [0.5, 0.52, 0.54, 0.56, 0.58];
dict_param = Dictionary.ByKeysValues(key_param, val_param);
param = Dictionary.ValueAtKey(dict_param, capa);

//TagLocation dist
[40, 90, 140, 190, 240];
key_dist = ["40", "90", "140", "190", "240"];
val_dist = [450, 900, 1350, 1800, 2250];
dict_dist = Dictionary.ByKeysValues(key_dist, val_dist);
dist = Dictionary.ValueAtKey(dict_dist, capa);


//element
element;
//TagLocation
point_leader_end = Autodesk.Curve.PointAtParameter(rebar_curve, param);
point_leader_elbow = Autodesk.Geometry.Translate(point_leader_end, normal_distribucion, dist);
point_tag_location = Autodesk.Geometry.Translate(point_leader_elbow, view_plane_vector_y, 650);
//TagType
family = Revit.Family.ByName("EST_A_STRUCTURAL REBAR TAG_STANDAR");
tag_type = Revit.Elements.FamilyType.ByFamilyAndName(family, "R_S_01");
//horizontal
true;
//addLeader
false;
//LinkInstance
null;
//RunIt
true;
# ----------------------------------------
create_tag_2 = Custom[Create Tag](view=activeView_3, element=code_block_23.element, TagLocation=code_block_23.point_leader_end, TagType=code_block_23.tag_type, horizontal=code_block_23.out20, addLeader=code_block_23.out21, LinkInstance=code_block_23.out22, RunIt=code_block_23.out23, lacing=Shortest)
code_block_24 = CodeBlock(x=create_tag_2, p1=code_block_23.point_tag_location, p2=code_block_23.point_leader_end, p3=code_block_23.point_leader_elbow)  # same code as code_block_21
current_4 = Document.Current()
activeView_4 = Document.ActiveView(document=current_4)
fromCurves_3 = StructuralDesign.Rebar.Create.FromCurves(curves=code_block_18.out148, rebarStyle=code_block_18.out149, rebarBarType=code_block_18.out150, startHookType=code_block_18.out151, endHookType=code_block_18.out152, startHookOrientation=code_block_18.out153, endHookOrientation=code_block_18.out154, hostElement=code_block_18.out155, vector=code_block_18.out156, lacing=Longest)
setLayoutAsFixedNumber_3 = StructuralDesign.Rebar.Layout.SetLayoutAsFixedNumber(rebar=fromCurves_3, arrayLength=code_block_18.out157, numberOfBarPositions=code_block_18.out158)
element_types_ᶜᵒⁿᵛᵉʳᵗᵉᵈ_ᵈʳᵒᵖᵈᵒʷⁿ_5 = CodeBlock { DSCore.Types.FindTypeByNameInAssembly("RebarShape", "RevitAPI"); }
all_elements_of_type_5 = ElementsOfType(element_type=element_types_ᶜᵒⁿᵛᵉʳᵗᵉᵈ_ᵈʳᵒᵖᵈᵒʷⁿ_5)
code_block_25 = CodeBlock(rebar=setLayoutAsFixedNumber_3, capa=code_block_18.out162, elem=all_elements_of_type_5)
# ---------- code_block_25.designscript (8 lines) ----------
//Asigna Numero de Capa
Revit.Elements.Element.SetParameterByName(rebar, "Capa", capa);

//Asigna el Rebar Shape Indicado
elem_names = Revit.Elements.Element.Name(elem);
mask = elem_names == "R_S_00";
rebar_shape_R_S_00 = DSCore.List.FilterByBoolMask(elem, mask)["in"];
Revit.Elements.Element.SetParameterByName(rebar<1L>, "Shape", rebar_shape_R_S_00<1L>);
# ----------------------------------------
rebarCenterlineCurves_3 = StructuralDesign.Rebar.Properties.RebarCenterlineCurves(rebar=code_block_25.out4)
code_block_26 = CodeBlock(x=rebarCenterlineCurves_3, normal_distribucion=code_block_18.out159, view_plane_vector_y=code_block_18.out160, capa=code_block_18.out161, element=code_block_25.out4)
# ---------- code_block_26.designscript (36 lines) ----------
rebar_curve = DSCore.List.Flatten(x);
normal_distribucion;
view_plane_vector_y;
capa;
//TagLocationParam
[40, 90, 140, 190, 240];
key_param = ["40", "90", "140", "190", "240"];
val_param = [0.5, 0.52, 0.54, 0.56, 0.58];
dict_param = Dictionary.ByKeysValues(key_param, val_param);
param = Dictionary.ValueAtKey(dict_param, capa);

//TagLocation dist
[40, 90, 140, 190, 240];
key_dist = ["40", "90", "140", "190", "240"];
val_dist = [450, 700, 950, 1200, 1450];
dict_dist = Dictionary.ByKeysValues(key_dist, val_dist);
dist = Dictionary.ValueAtKey(dict_dist, capa);


//element
element;
//TagLocation
point_leader_end = Autodesk.Curve.PointAtParameter(rebar_curve<1L>, param);
point_leader_elbow = Autodesk.Geometry.Translate(point_leader_end<1L>, normal_distribucion<1L>, dist);
point_tag_location = Autodesk.Geometry.Translate(point_leader_elbow<1L>, view_plane_vector_y<1L>, 650);
//TagType
family = Revit.Family.ByName("EST_A_STRUCTURAL REBAR TAG_STANDAR");
tag_type = Revit.Elements.FamilyType.ByFamilyAndName(family, "R_S_00");
//horizontal
true;
//addLeader
false;
//LinkInstance
null;
//RunIt
true;
# ----------------------------------------
create_tag_3 = Custom[Create Tag](view=activeView_4, element=code_block_26.element, TagLocation=code_block_26.point_leader_end, TagType=code_block_26.tag_type, horizontal=code_block_26.out20, addLeader=code_block_26.out21, LinkInstance=code_block_26.out22, RunIt=code_block_26.out23, lacing=Longest)
code_block_27 = CodeBlock(x=create_tag_3, p1=code_block_26.point_tag_location, p2=code_block_26.point_leader_end, p3=code_block_26.point_leader_elbow)
# ---------- code_block_27.designscript (11 lines) ----------
tag = DSCore.List.Flatten(x);
//Activa Leader Line
Revit.Elements.Element.SetParameterByName(tag, "Leader Line", 1);
//Leader Line Free End
Revit.Elements.Element.SetParameterByName(tag, "Leader Type", 1);
//Posicion Tag
Rhythm.Tags.SetHeadPosition(tag, p1);
//Leader End Position
Rhythm.Tags.SetLeaderEndPosition(tag, p2);
//Leader Elbow
Rhythm.Tags.SetLeaderElbowPosition(tag, p3);
# ----------------------------------------
element_types_ᶜᵒⁿᵛᵉʳᵗᵉᵈ_ᵈʳᵒᵖᵈᵒʷⁿ_6 = CodeBlock { DSCore.Types.FindTypeByNameInAssembly("DimensionType", "RevitAPI"); }
all_elements_of_type_6 = ElementsOfType(element_type=element_types_ᶜᵒⁿᵛᵉʳᵗᵉᵈ_ᵈʳᵒᵖᵈᵒʷⁿ_6)
current_5 = Document.Current()
activeView_5 = Document.ActiveView(document=current_5)
current_6 = Document.Current()
activeView_6 = Document.ActiveView(document=current_6)
plane_2 = Custom[View.Plane](view=activeView_6)
code_block_28 = CodeBlock(rebar_inicio=rebarCenterlineCurves, rebar_mid=rebarCenterlineCurves_3, rebar_final=rebarCenterlineCurves_2, plane=plane_2)
# ---------- code_block_28.designscript (8 lines) ----------
empalme_list = [570, 710, 860, 1140, 1290, 1960, 2230, 2500, 2850, 3210];

rebar_curve_list = DSCore.List.Flatten([rebar_inicio, rebar_mid, rebar_final]);
pulled_curve = Autodesk.Curve.PullOntoPlane(rebar_curve_list, plane);
intersecciones = DSCore.List.Flatten(Autodesk.Geometry.Intersect(pulled_curve@L1<1L>, pulled_curve@L2<1L>));
intersecciones_length = Autodesk.Curve.Length(intersecciones);
intersecciones_mask = Orchid.List.AnyTrue(intersecciones_length@L1<1L> == empalme_list@L2<1L>);
empalmes = DSCore.List.FilterByBoolMask(intersecciones, intersecciones_mask)["in"];
# ----------------------------------------
pruneDuplicates = Custom[Geometry.PruneDuplicates](GeometryList=code_block_28.empalmes)  # package Data-Shapes; Removes all duplicate geometries from list.
code_block_29 = CodeBlock(empalmes=pruneDuplicates, plane=plane_2, plane_ajuste=code_block_18.out74)
# ---------- code_block_29.designscript (2 lines) ----------
empalmes_to_plane = Autodesk.Curve.PullOntoPlane(empalmes, plane);
curve_ref_cota = Autodesk.Curve.PullOntoPlane(empalmes_to_plane, plane_ajuste);
# ----------------------------------------
family_types_ᶜᵒⁿᵛᵉʳᵗᵉᵈ_ᵈʳᵒᵖᵈᵒʷⁿ = CodeBlock { Revit.Elements.FamilyType.ByName("EST_D_DEATIL ITEM_EMPALME"); }
current_7 = Document.Current()
activeView_7 = Document.ActiveView(document=current_7)
byCurve = Custom[DetailComponent.ByCurve](curve=pruneDuplicates, familyType=family_types_ᶜᵒⁿᵛᵉʳᵗᵉᵈ_ᵈʳᵒᵖᵈᵒʷⁿ, view=activeView_7)  # package Clockwork for Dynamo 2.x; Places a line-based detail component in a given view
code_block_30 = CodeBlock { ["Right", "Left"]; }
familyinstance_reference_byname = Custom[FamilyInstance Reference ByName](familyInstance=byCurve@L1, name=code_block_30@L2, lacing=Longest)  # package Genius Loci; Works only in Revit 2018.1 and later. Gets the reference corresponding to the named reference plane in the instance's family.
transpose = List.Transpose(lists=familyinstance_reference_byname.Reference@L2)
code_block_31 = CodeBlock(x=all_elements_of_type_6, view=activeView_5, line=code_block_29.curve_ref_cota, references=transpose)
# ---------- code_block_31.designscript (13 lines) ----------
dimensionType = x;
elem_names = Revit.Elements.Element.Name(dimensionType);
mask = elem_names == "Linear - 2.5mm Arial";
dimensionType_1 = DSCore.List.FilterByBoolMask(dimensionType, mask)["in"][0];

//view
view;
//line
line;
//references
references;
//dimensionType
dimensionType_1;
# ----------------------------------------
dimension_byreferences = Custom[Dimension ByReferences](view=code_block_31.out4@L1, line=code_block_31.out5@L1, references=code_block_31.out6@L2, dimensionType=code_block_31.out7@L1, lacing=Longest)  # package Genius Loci; Creates a new linear dimension from at least two geometric references of an object.
