# Dynamo graph script.dyn (Dynamo 2.6.2.15705)
# packages: Data-Shapes 2022.2.103, Clockwork for Dynamo 2.x 2.4.0, Structural Design 2021.1.22, Genius Loci 2021.11.10, archi-lab.net 2022.210.2419

element_types_ᶜᵒⁿᵛᵉʳᵗᵉᵈ_ᵈʳᵒᵖᵈᵒʷⁿ = CodeBlock { DSCore.Types.FindTypeByNameInAssembly("DimensionType", "RevitAPI"); }
all_elements_of_type = ElementsOfType(element_type=element_types_ᶜᵒⁿᵛᵉʳᵗᵉᵈ_ᵈʳᵒᵖᵈᵒʷⁿ)
current = Document.Current()
activeView = Document.ActiveView(document=current)
code_block = CodeBlock { "Seleccionar Elementos"; }
categories_ᶜᵒⁿᵛᵉʳᵗᵉᵈ_ᵈʳᵒᵖᵈᵒʷⁿ = CodeBlock()
# ---------- categories_ᶜᵒⁿᵛᵉʳᵗᵉᵈ_ᵈʳᵒᵖᵈᵒʷⁿ.designscript (8 lines) ----------
//InputName
"";
//ButtonText
"SELECCIONAR";
//CategoryFilter
Revit.Category.ByName("Walls");
//SelectSingleElement
false;
# ----------------------------------------
selectmodelelements_data = Custom[SelectModelElements Data](InputName=categories_ᶜᵒⁿᵛᵉʳᵗᵉᵈ_ᵈʳᵒᵖᵈᵒʷⁿ.out0, ButtonText=categories_ᶜᵒⁿᵛᵉʳᵗᵉᵈ_ᵈʳᵒᵖᵈᵒʷⁿ.out1, CategoryFilter=categories_ᶜᵒⁿᵛᵉʳᵗᵉᵈ_ᵈʳᵒᵖᵈᵒʷⁿ.out2, SelectSingleElement=categories_ᶜᵒⁿᵛᵉʳᵗᵉᵈ_ᵈʳᵒᵖᵈᵒʷⁿ.out3)  # package Data-Shapes; Creates a Revit element selection input for UI.MultipleInputForm++ . Check out www.data-shapes.net for more infos!
inputgroup_data = Custom[InputGroup Data](GroupTitle=code_block, Inputs=selectmodelelements_data)  # package Data-Shapes; Creates a group of inputs for UI.MultipleInputForm ++ . Check out www.data-shapes.net for more infos !
code_block_2 = CodeBlock { "Datos de Posición Barra"; }
code_block_3 = CodeBlock()
# ---------- code_block_3.designscript (4 lines) ----------
//InputName
"Segmento Mayor";
//ButtonText
"SELECCIONAR";
# ----------------------------------------
selectfaces_data = Custom[SelectFaces Data](InputName=code_block_3.out0, ButtonText=code_block_3.out1)  # package Data-Shapes; Creates a Revit face selection input for UI.MultipleInputForm++. Check out www.data-shapes.net for more infos!
code_block_4 = CodeBlock()
# ---------- code_block_4.designscript (4 lines) ----------
//InputName
"Inicio";
//ButtonText
"SELECCIONAR";
# ----------------------------------------
selectfaces_data_2 = Custom[SelectFaces Data](InputName=code_block_4.out0, ButtonText=code_block_4.out1)
code_block_5 = CodeBlock()
# ---------- code_block_5.designscript (4 lines) ----------
//InputName
"Termino";
//ButtonText
"SELECCIONAR";
# ----------------------------------------
selectfaces_data_3 = Custom[SelectFaces Data](InputName=code_block_5.out0, ButtonText=code_block_5.out1)
list_create = List.Create(item0=selectfaces_data, item1=selectfaces_data_2, item2=selectfaces_data_3)
inputgroup_data_2 = Custom[InputGroup Data](GroupTitle=code_block_2, Inputs=list_create)
code_block_6 = CodeBlock { "Definir Empalmes"; }
code_block_7 = CodeBlock()
# ---------- code_block_7.designscript (4 lines) ----------
//InputName
"";
//ButtonText
"SELECCIONAR";
# ----------------------------------------
selectfaces_data_4 = Custom[SelectFaces Data](InputName=code_block_7.out0, ButtonText=code_block_7.out1)
inputgroup_data_3 = Custom[InputGroup Data](GroupTitle=code_block_6, Inputs=selectfaces_data_4)
code_block_8 = CodeBlock { "Datos de Armadura"; }
element_types_ᶜᵒⁿᵛᵉʳᵗᵉᵈ_ᵈʳᵒᵖᵈᵒʷⁿ_2 = CodeBlock { DSCore.Types.FindTypeByNameInAssembly("RebarBarType", "RevitAPI"); }
all_elements_of_type_2 = ElementsOfType(element_type=element_types_ᶜᵒⁿᵛᵉʳᵗᵉᵈ_ᵈʳᵒᵖᵈᵒʷⁿ_2)
code_block_9 = CodeBlock(elem_type=all_elements_of_type_2) { elem_type; elem_type_diameter = Properties.RebarDiameter(elem_type); }
sortByKey = List.SortByKey(list=code_block_9.elem_type, keys=code_block_9.elem_type_diameter)
code_block_10 = CodeBlock(elem_sorted=sortByKey.sorted_list)
# ---------- code_block_10.designscript (12 lines) ----------
elem_name = Revit.Elements.Element.Name(elem_sorted);

//InputName
"Diametro";
//Keys
elem_name;
//Values
elem_sorted;
//DefaultValueIndex
0;
//Sorted_optional
false;
# ----------------------------------------
dropdown_data = Custom[DropDown Data](InputName=code_block_10.out1, Keys=code_block_10.out2, Values=code_block_10.out3, DefaultValueIndex=code_block_10.out4, Sorted_optional=code_block_10.out5)  # package Data-Shapes; Create data for DropDown input in UI.MultiInputForm ++ . Check out www.data-shapes.net for more infos.
code_block_11 = CodeBlock { "Cant. de Barras"; "2"; true; }
textbox_data = Custom[TextBox Data](InputName=code_block_11.out0, DefaultText=code_block_11.out1, IsNumberEntry=code_block_11.out2)  # package Data-Shapes; Create Data for TextBox input in UI.MultipleInputForm ++ . Check out www.data-shapes.net for more informations
code_block_12 = CodeBlock { "Capa"; ["1ª Capa", "2ª Capa", "3ª Capa", "4ª Capa", "5ª Capa"]; [40, 140, 240, 340, 440]; 0; }
dropdown_data_2 = Custom[DropDown Data](InputName=code_block_12.out0, Keys=code_block_12.out1, Values=code_block_12.out2, DefaultValueIndex=code_block_12.out3)
list_create_2 = List.Create(item0=dropdown_data, item1=textbox_data, item2=dropdown_data_2)
inputgroup_data_4 = Custom[InputGroup Data](GroupTitle=code_block_8, Inputs=list_create_2)
list_create_3 = List.Create(item0=inputgroup_data, item1=inputgroup_data_2, item2=inputgroup_data_3, item3=inputgroup_data_4)
code_block_13 = CodeBlock(inputs=list_create_3)
# ---------- code_block_13.designscript (20 lines) ----------
//Description
"Corchete Multisegmento Empalmes Indicados";
//Logo
"C:\\Arainco\\Arainco.png";
//ButtonText
"INICIAR";
//Inputs
inputs;
//Toggle
true;
//LinkToHelp
null;
//CancelButtonText
"CANCELAR";
//MaxHeight
0;
//Width
430;
//LabelWidth
170;
# ----------------------------------------
multipleinputform = Custom[MultipleInputForm ++](Description_optional=code_block_13.out0, Logo_optional=code_block_13.out1, ButtonText_optional=code_block_13.out2, Inputs=code_block_13.inputs, Toggle=code_block_13.out4, LinkToHelp_optional=code_block_13.out5, CancelButtonText_optional=code_block_13.out6, MaxHeight_optional=code_block_13.out7, Width_optional=code_block_13.out8, LabelWidth_optional=code_block_13.out9)  # package Data-Shapes; Create a form with multiple inputs. see www.data-shapes.net for tutorials and infos!
code_block_14 = CodeBlock(l=multipleinputform.User_Inputs)
# ---------- code_block_14.designscript (12 lines) ----------
l;
[Imperative]
{
	if (l == null)
	{
		return = [[],[],[],[],[],[],[],[],[],[]];
	}
	else
	{
		return = l;
	}
};
# ----------------------------------------
code_block_15 = CodeBlock(x=code_block_14.out1) { x[1][0]; }
recubrimiento_segmento_mayor = Python(IN[0]=code_block_15)
# ---------- recubrimiento_segmento_mayor.python (35 lines) ----------
import clr
clr.AddReference('ProtoGeometry')
from Autodesk.DesignScript.Geometry import *

clr.AddReference('RevitAPI')
import Autodesk
from Autodesk.Revit.DB import *

clr.AddReference('RevitAPIUI')
from Autodesk.Revit.UI import *
from Autodesk.Revit.UI.Selection import *

clr.AddReference('RevitServices')
import RevitServices
from RevitServices.Persistence import DocumentManager

clr.AddReference("RevitNodes")
import Revit
# Import ToProtoType, ToRevitType geometry conversion extension methods
clr.ImportExtensions(Revit.GeometryConversion)
doc = DocumentManager.Instance.CurrentDBDocument


surface = UnwrapElement(IN[0])
ref = surface.Tags.LookupTag("RevitFaceReference")
elemId = ref.ElementId
element = doc.GetElement(ref.ElementId)
category = element.Category.Name

if "Foundations" in category:
	recubrimiento = True
else:
	recubrimiento = False

OUT = recubrimiento
# ----------------------------------------
code_block_16 = CodeBlock(x=code_block_14.out1) { x[2][0]; }
recubrimiento_inicio = Python(IN[0]=code_block_16)
# ---------- recubrimiento_inicio.python (35 lines) ----------
import clr
clr.AddReference('ProtoGeometry')
from Autodesk.DesignScript.Geometry import *

clr.AddReference('RevitAPI')
import Autodesk
from Autodesk.Revit.DB import *

clr.AddReference('RevitAPIUI')
from Autodesk.Revit.UI import *
from Autodesk.Revit.UI.Selection import *

clr.AddReference('RevitServices')
import RevitServices
from RevitServices.Persistence import DocumentManager

clr.AddReference("RevitNodes")
import Revit
# Import ToProtoType, ToRevitType geometry conversion extension methods
clr.ImportExtensions(Revit.GeometryConversion)
doc = DocumentManager.Instance.CurrentDBDocument


surface = UnwrapElement(IN[0])
ref = surface.Tags.LookupTag("RevitFaceReference")
elemId = ref.ElementId
element = doc.GetElement(ref.ElementId)
category = element.Category.Name

if "Foundations" in category:
	recubrimiento = 50
else:
	recubrimiento = 25

OUT = recubrimiento
# ----------------------------------------
code_block_17 = CodeBlock(x=code_block_14.out1) { x[3][0]; }
recubrimiento_termino = Python(IN[0]=code_block_17)  # same code as recubrimiento_inicio
current_2 = Document.Current()
activeView_2 = Document.ActiveView(document=current_2)
plane = Custom[View.Plane](view=activeView_2)  # package Clockwork for Dynamo 2.x; Retrieves the plane of a given view
element_types_ᶜᵒⁿᵛᵉʳᵗᵉᵈ_ᵈʳᵒᵖᵈᵒʷⁿ_3 = CodeBlock { DSCore.Types.FindTypeByNameInAssembly("RebarHookType", "RevitAPI"); }
all_elements_of_type_3 = ElementsOfType(element_type=element_types_ᶜᵒⁿᵛᵉʳᵗᵉᵈ_ᵈʳᵒᵖᵈᵒʷⁿ_3)
code_block_18 = CodeBlock(x=code_block_14.out1, rec_seg_mayor=recubrimiento_segmento_mayor, rec_inicio=recubrimiento_inicio, rec_termino=recubrimiento_termino, view_plane=plane, pata=all_elements_of_type_3)
# ---------- code_block_18.designscript (344 lines) ----------
elem = x[0];
dist_traslacion_curva;
seg_mayor = x[1][0];
rec_seg_mayor;
inicio = x[2][0];
rec_inicio;
termino = x[3][0];
rec_termino;
empalmes = x[4];
tipo_barra = x[5];
cantidad_barras = x[6];
capa = x[7];
capa_as_str = Strings.ToString(x[7], "");
view_plane;
view_plane_normal = Autodesk.Plane.Normal(view_plane);
view_plane_vector_y = Autodesk.Plane.YAxis(view_plane);
view_plane_normal_reverse = Autodesk.Vector.Reverse(view_plane_normal);
empalmes_plane = CoordinateSystem.XYPlane(Autodesk.Surface.CoordinateSystemAtParameter(empalmes, 0.5, 0.5));

//Pata
pata_names = Revit.Elements.Element.Name(pata);
hook_mask = pata_names == "Standard - 90 deg.";
hook_90 = DSCore.List.FilterByBoolMask(pata, hook_mask)["in"][0];

//Vector Normal Cara Segmento Mayor
normal_seg_mayor = Autodesk.Surface.NormalAtParameter(seg_mayor, 0.5, 0.5);

//Filtrar muros paralelos a la vista actual
elem_location = Revit.Elements.Element.GetLocation(elem);
elem_vector = Line.Direction(elem_location);
elem_centroid = Autodesk.Solid.Centroid(DSCore.List.Flatten(Revit.Elements.Element.Geometry(elem)));
elem_coo_sys = Autodesk.Curve.CoordinateSystemAtParameter(elem_location, 0.5);
elem_vector_mask = Autodesk.Vector.IsParallel(CoordinateSystem.XAxis(elem_coo_sys), view_plane_normal);
elem_lst = DSCore.List.FilterByBoolMask(elem, elem_vector_mask)["in"];

//Geometria a Cortar
g_elem_solid = DSCore.List.Flatten(Revit.Elements.Element.Geometry(elem_lst));
g_solid_centroid = Autodesk.Solid.Centroid(g_elem_solid);
g_solid_plane = Autodesk.Plane.ByOriginNormal(g_solid_centroid, view_plane_normal);
g_solid_coo_sys = CoordinateSystem.ByPlane(g_solid_plane);
g_solid_scaled = Autodesk.Geometry.Scale(g_elem_solid, g_solid_plane, 10, 10, 1);
geom_a_cortar = Autodesk.Solid.ByUnion(g_solid_scaled);

//Numero de Capa
key_2 = ["40", "140", "240", "340", "440"];
val_2 = ["1", "2", "3", "4", "5"];
dict_capa = Dictionary.ByKeysValues(key_2, val_2);
num_capa = Dictionary.ValueAtKey(dict_capa, capa_as_str);

//Desplazamiento etiqueta
key_1 = ["40", "90", "140", "190", "240"];
val_1 = [450, 700, 950, 1200, 1450];
dict_desplazamiento = Dictionary.ByKeysValues(key_1, val_1);
despl_etiqueta = Dictionary.ValueAtKey(dict_desplazamiento, capa_as_str);

//Vector Normal Caras capturadas
seg_mayor_normal = Autodesk.Surface.NormalAtParameter(seg_mayor, 0.5, 0.5);
inicio_normal = Autodesk.Surface.NormalAtParameter(inicio, 0.5, 0.5);
termino_normal = Autodesk.Surface.NormalAtParameter(termino, 0.5, 0.5);

//Centroide Caras Capturadas
seg_mayor_point = Autodesk.Surface.PointAtParameter(seg_mayor, 0.5, 0.5);
inicio_point = Points.PullOntoPlane(Autodesk.Surface.PointAtParameter(inicio, 0.5, 0.5), view_plane);
termino_point = Points.PullOntoPlane(Autodesk.Surface.PointAtParameter(termino, 0.5, 0.5), view_plane);
inicio_point_z = Autodesk.Point.Z(inicio_point);
termino_point_x = Autodesk.Point.X(termino_point);
termino_point_y = Autodesk.Point.Y(termino_point);
termino_point_corregido = Autodesk.Point.ByCoordinates(termino_point_x, termino_point_y, inicio_point_z);

//Planos caras capturadas
seg_mayor_plane_1 = Autodesk.Plane.ByOriginNormal(seg_mayor_point, seg_mayor_normal);
inicio_plane_1 = Autodesk.Plane.ByOriginNormal(inicio_point, inicio_normal);
termino_plane_1 = Autodesk.Plane.ByOriginNormal(termino_point, termino_normal);

//Planos Trasladados
capa_1 = [Imperative]
{
	if(rec_seg_mayor == true)
	{
		return = capa + 25;
	}
	else
	{
		return = capa;
	}
};
seg_mayor_plane = Autodesk.Geometry.Translate(seg_mayor_plane_1, seg_mayor_normal, capa_1  * -1);
inicio_plane = Autodesk.Geometry.Translate(inicio_plane_1, inicio_normal, rec_inicio * -1);
termino_plane = Autodesk.Geometry.Translate(termino_plane_1, termino_normal, rec_termino * -1);

//Plano de ajuste para cotas de empalme
seg_mayor_plane_ajuste = Autodesk.Geometry.Translate(seg_mayor_plane_1, seg_mayor_normal, 310);

//Vector entre Planos de Empotramiento y Termino
l = Line.ByBestFitThroughPoints([inicio_point, termino_point_corregido]);
vector_normalizado = Autodesk.Vector.Normalized(Line.Direction(l));

//Sistema de Coordenadas Vista Actual
view_coo_sys = Autodesk.Plane.ToCoordinateSystem(view_plane);
y_axis = CoordinateSystem.YAxis(view_coo_sys);

//Traslacion curva
category = Revit.Elements.Element.GetCategory(elem_lst);
category_name = Revit.Category.Name(category);
mask = category_name == "Walls";
element = DSCore.List.FilterByBoolMask(elem_lst, mask)["in"];
element_type = Revit.Elements.Element.GetParameterValueByName(element, "Type");
element_width = Revit.Elements.Element.GetParameterValueByName(element_type, "Width");
dist_traslacion_curva = (element_width[0] / 2) - 40;

//Empotramiento Armadura
tipo_barra_str = Strings.ToString(Properties.RebarDiameter(tipo_barra),"");
key = ["8","10","12","16","18","22","25","28","32","36"];
val = [570, 710, 860, 1140, 1290, 1960, 2230, 2500, 2850, 3210];
dict_traslapo = Dictionary.ByKeysValues(key, val);
empotramiento_dict = Dictionary.ValueAtKey(dict_traslapo, tipo_barra_str);

//Largo Pata en funcion del diametro de barra
key_l_pata = ["8","10","12","16","18","22","25","28","32","36"];
val_l_pata = [160, 200, 240, 320, 360, 440, 500, 570, 650, 720];
dict_l_pata = Dictionary.ByKeysValues(key_l_pata, val_l_pata);
l_pata_dict = Dictionary.ValueAtKey(dict_l_pata, tipo_barra_str);

//Superficies
surf_seg_mayor = Autodesk.Geometry.Intersect(geom_a_cortar, seg_mayor_plane)[0];
surf_inicio = Autodesk.Geometry.Intersect(geom_a_cortar, inicio_plane)[0];
surf_termino = Autodesk.Geometry.Intersect(geom_a_cortar, termino_plane)[0];

//Intersecciones
intersect_start = Autodesk.Geometry.Intersect(surf_seg_mayor, surf_inicio)[0];
intersect_end = Autodesk.Geometry.Intersect(surf_seg_mayor, surf_termino)[0];

//Puntos para Generar Curva
point_start = Autodesk.Curve.PointAtParameter(intersect_start, 0.5);
point_end = Autodesk.Curve.PointAtParameter(intersect_end, 0.5);

//Rebar Curve
rebar_curve_init = Line.ByStartPointEndPoint(point_start, point_end);
rebar_curve = Autodesk.Geometry.Translate(rebar_curve_init, view_plane_normal_reverse, dist_traslacion_curva);

//Vector de la linea para armadura
rebar_curve_vector = Autodesk.Vector.ByTwoPoints(point_start, point_end);
rebar_curve_vector_normalized = Autodesk.Vector.Normalized(rebar_curve_vector);

//Evaluador para reversar la curva
bool_vector = Autodesk.Vector.IsAlmostEqualTo(rebar_curve_vector_normalized, view_plane_vector_y);

//List de curvas para crear barras
rebar_curve_start_p = Autodesk.Curve.PointAtParameter(rebar_curve, 0);
rebar_curve_intersect_p = DSCore.List.Flatten(Autodesk.Geometry.Intersect(rebar_curve, empalmes_plane));
dist_p_corregidos = DSCore.Math.Round(Autodesk.Geometry.DistanceTo(rebar_curve_start_p, rebar_curve_intersect_p) / 5) * 5;
rebar_curve_split_p = Autodesk.Curve.PointAtSegmentLength(rebar_curve, dist_p_corregidos);
rebar_curve_splited = Autodesk.Curve.SplitByPoints(rebar_curve, rebar_curve_split_p);

seg_mayor_vector = Autodesk.Surface.NormalAtParameter(seg_mayor, 0.5, 0.5);

seg_mayor_vector_normal = Autodesk.Surface.NormalAtParameter(seg_mayor, 0.5, 0.5);
vector_z = Autodesk.Vector.Z(seg_mayor_vector_normal);

comparador_pata = Autodesk.Vector.IsAlmostEqualTo(y_axis, seg_mayor_normal);

orintacion_pata = comparador_pata == true ? "Left" : "Right";

hook_type = bool_vector ? [hook_90, null] : [null, hook_90];


//Curvas de inicio e intermedias y final
rebar_curve_first = Autodesk.Curve.ExtendEnd(DSCore.List.FirstItem(rebar_curve_splited), empotramiento_dict);
rebar_curve_middle = Autodesk.Curve.ExtendEnd(DSCore.List.Slice(rebar_curve_splited, 1, -1, 1), empotramiento_dict);
rebar_curve_last = DSCore.List.LastItem(rebar_curve_splited);

bool_first = bool_vector ? rebar_curve_first : rebar_curve_last;
bool_last = bool_vector ? rebar_curve_last : rebar_curve_first;

//Buscar Host mas cercano
elem_solid = DSCore.List.Flatten(Revit.Elements.Element.Geometry(elem_lst));
solid_centroid = Autodesk.Solid.Centroid(elem_solid);

//ArrayLength
array_length = DSCore.List.FirstItem(element_width - 80);
cantidad_barras;

//Primera Barra
rebar_curve_mid_point = Autodesk.Curve.PointAtParameter(rebar_curve, 0.5);
rebar_curve_distance_to = Autodesk.Geometry.DistanceTo(solid_centroid, rebar_curve_mid_point);
rebar_curve_min = DSCore.List.MinimumItem(rebar_curve_distance_to);
rebar_curve_mask = rebar_curve_distance_to == rebar_curve_min;
rebar_curve_host = DSCore.List.FilterByBoolMask(elem, rebar_curve_mask)["in"][0];
//curves
bool_first;
//rebarStyle
"Standard";
//rebarBarType
tipo_barra;
//startHookType
null;
//endHookType
hook_90;
//startHookOrientation
orintacion_pata;
//endtHookOrientation
orintacion_pata;
//hostElement
rebar_curve_host;
//vector
view_plane_normal;
//arrayLength
array_length;
//numberOfBarPositions
cantidad_barras;
//Vector Normal Cara de Distribucion
normal_seg_mayor;
//Desplazamiento Etiqueta
view_plane_vector_y;
//Valor de capa como string
capa_as_str;
//Plano de ajuste para posicion de etiquetas de barras
seg_mayor_plane_ajuste_tag = Autodesk.Geometry.Translate(seg_mayor_plane_1, seg_mayor_normal, 700);
//Numero de capa
num_capa;
























//Barras Rectas
rebar_curve_middle_mid_point = Autodesk.Curve.PointAtParameter(rebar_curve_middle, 0.5);
rebar_curve_middle_distance_to = Autodesk.Geometry.DistanceTo(solid_centroid@L2<1L>, rebar_curve_middle_mid_point@L1<1L>);
rebar_curve_middle_min = DSCore.List.MinimumItem(rebar_curve_middle_distance_to);
rebar_curve_middle_mask = rebar_curve_middle_distance_to@L2<1L> == rebar_curve_middle_min@L1<1L>;
rebar_curve_middle_host = DSCore.List.Flatten(DSCore.List.FilterByBoolMask(elem@L2<1L>, rebar_curve_middle_mask@L2<1L>)["in"]);
//curves
rebar_curve_middle;
//rebarStyle
"Standard";
//rebarBarType
tipo_barra;
//startHookType
null;
//endHookType
null;
//startHookOrientation
orintacion_pata;
//endtHookOrientation
orintacion_pata;
//hostElement
rebar_curve_host;
//vector
view_plane_normal;
//arrayLength
array_length;
//numberOfBarPositions
cantidad_barras;
//Vector Normal Cara de Distribucion
normal_seg_mayor;
//Desplazamiento Etiqueta
view_plane_vector_y;
//Valor de capa como string
capa_as_str;
//Plano de ajuste para posicion de etiquetas de barras
seg_mayor_plane_ajuste_tag;
//Numero de capa
num_capa;
























//Barra Final
rebar_curve_last_mid_point = Autodesk.Curve.PointAtParameter(rebar_curve_last, 0.5);
rebar_curve_last_distance_to = Autodesk.Geometry.DistanceTo(solid_centroid, rebar_curve_last_mid_point);
rebar_curve_last_min = DSCore.List.MinimumItem(rebar_curve_last_distance_to);
rebar_curve_last_mask = rebar_curve_last_distance_to == rebar_curve_last_min;
rebar_curve_last_host = DSCore.List.FilterByBoolMask(elem, rebar_curve_last_mask)["in"][0];
//curves
bool_last;
//rebarStyle
"Standard";
//rebarBarType
tipo_barra;
//startHookType
hook_90;
//endHookType
null;
//startHookOrientation
orintacion_pata;
//endtHookOrientation
orintacion_pata;
//hostElement
rebar_curve_host;
//vector
view_plane_normal;
//arrayLength
array_length;
//numberOfBarPositions
cantidad_barras;
//Vector Normal Cara de Distribucion
normal_seg_mayor;
//Desplazamiento Etiqueta
view_plane_vector_y;
//Valor de capa como string
capa_as_str;
//Plano de ajuste para posicion de etiquetas de barras
seg_mayor_plane_ajuste_tag;
//Numero de capa
num_capa;
# ----------------------------------------
fromCurves = StructuralDesign.Rebar.Create.FromCurves(curves=code_block_18.out117, rebarStyle=code_block_18.out118, rebarBarType=code_block_18.out119, startHookType=code_block_18.out120, endHookType=code_block_18.out121, startHookOrientation=code_block_18.out122, endHookOrientation=code_block_18.out123, hostElement=code_block_18.out124, vector=code_block_18.out125)
setLayoutAsFixedNumber = StructuralDesign.Rebar.Layout.SetLayoutAsFixedNumber(rebar=fromCurves, arrayLength=code_block_18.out126, numberOfBarPositions=code_block_18.out127)
element_types_ᶜᵒⁿᵛᵉʳᵗᵉᵈ_ᵈʳᵒᵖᵈᵒʷⁿ_4 = CodeBlock { DSCore.Types.FindTypeByNameInAssembly("RebarShape", "RevitAPI"); }
all_elements_of_type_4 = ElementsOfType(element_type=element_types_ᶜᵒⁿᵛᵉʳᵗᵉᵈ_ᵈʳᵒᵖᵈᵒʷⁿ_4)
code_block_19 = CodeBlock(rebar=setLayoutAsFixedNumber, num_capa=code_block_18.out132, elem=all_elements_of_type_4)
# ---------- code_block_19.designscript (8 lines) ----------
//Asigna Numero de Capa
Revit.Elements.Element.SetParameterByName(rebar, "Capa", num_capa);

//Asigna el Rebar Shape Indicado
elem_names = Revit.Elements.Element.Name(elem);
mask = elem_names == "R_S_01";
rebar_shape_R_S_01 = DSCore.List.FilterByBoolMask(elem, mask)["in"];
Revit.Elements.Element.SetParameterByName(rebar, "Shape", rebar_shape_R_S_01)[0];
# ----------------------------------------
rebarCenterlineCurves = StructuralDesign.Rebar.Properties.RebarCenterlineCurves(rebar=code_block_19.out4)
fromCurves_2 = StructuralDesign.Rebar.Create.FromCurves(curves=code_block_18.out138, rebarStyle=code_block_18.out139, rebarBarType=code_block_18.out140, startHookType=code_block_18.out141, endHookType=code_block_18.out142, startHookOrientation=code_block_18.out143, endHookOrientation=code_block_18.out144, hostElement=code_block_18.out145, vector=code_block_18.out146, lacing=Longest)
setLayoutAsFixedNumber_2 = StructuralDesign.Rebar.Layout.SetLayoutAsFixedNumber(rebar=fromCurves_2, arrayLength=code_block_18.out147, numberOfBarPositions=code_block_18.out148)
element_types_ᶜᵒⁿᵛᵉʳᵗᵉᵈ_ᵈʳᵒᵖᵈᵒʷⁿ_5 = CodeBlock { DSCore.Types.FindTypeByNameInAssembly("RebarShape", "RevitAPI"); }
all_elements_of_type_5 = ElementsOfType(element_type=element_types_ᶜᵒⁿᵛᵉʳᵗᵉᵈ_ᵈʳᵒᵖᵈᵒʷⁿ_5)
code_block_20 = CodeBlock(rebar=setLayoutAsFixedNumber_2, capa=code_block_18.out153, elem=all_elements_of_type_5)
# ---------- code_block_20.designscript (8 lines) ----------
//Asigna Numero de Capa
Revit.Elements.Element.SetParameterByName(rebar, "Capa", capa);

//Asigna el Rebar Shape Indicado
elem_names = Revit.Elements.Element.Name(elem);
mask = elem_names == "R_S_00";
rebar_shape_R_S_00 = DSCore.List.FilterByBoolMask(elem, mask)["in"];
Revit.Elements.Element.SetParameterByName(rebar<1L>, "Shape", rebar_shape_R_S_00<1L>);
# ----------------------------------------
rebarCenterlineCurves_2 = StructuralDesign.Rebar.Properties.RebarCenterlineCurves(rebar=code_block_20.out4)
fromCurves_3 = StructuralDesign.Rebar.Create.FromCurves(curves=code_block_18.out159, rebarStyle=code_block_18.out160, rebarBarType=code_block_18.out161, startHookType=code_block_18.out162, endHookType=code_block_18.out163, startHookOrientation=code_block_18.out164, endHookOrientation=code_block_18.out165, hostElement=code_block_18.out166, vector=code_block_18.out167, lacing=Longest)
setLayoutAsFixedNumber_3 = StructuralDesign.Rebar.Layout.SetLayoutAsFixedNumber(rebar=fromCurves_3, arrayLength=code_block_18.out168, numberOfBarPositions=code_block_18.out169)
element_types_ᶜᵒⁿᵛᵉʳᵗᵉᵈ_ᵈʳᵒᵖᵈᵒʷⁿ_6 = CodeBlock { DSCore.Types.FindTypeByNameInAssembly("RebarShape", "RevitAPI"); }
all_elements_of_type_6 = ElementsOfType(element_type=element_types_ᶜᵒⁿᵛᵉʳᵗᵉᵈ_ᵈʳᵒᵖᵈᵒʷⁿ_6)
code_block_21 = CodeBlock(rebar=setLayoutAsFixedNumber_3, capa=code_block_18.out174, elem=all_elements_of_type_6)
# ---------- code_block_21.designscript (8 lines) ----------
//Asigna Numero de Capa
Revit.Elements.Element.SetParameterByName(rebar, "Capa", capa);

//Asigna el Rebar Shape Indicado
elem_names = Revit.Elements.Element.Name(elem);
mask = elem_names == "R_S_01";
rebar_shape_R_S_01 = DSCore.List.FilterByBoolMask(elem, mask)["in"];
Revit.Elements.Element.SetParameterByName(rebar<1L>, "Shape", rebar_shape_R_S_01<1L>);
# ----------------------------------------
rebarCenterlineCurves_3 = StructuralDesign.Rebar.Properties.RebarCenterlineCurves(rebar=code_block_21.out4)
current_3 = Document.Current()
activeView_3 = Document.ActiveView(document=current_3)
plane_2 = Custom[View.Plane](view=activeView_3)
code_block_22 = CodeBlock(rebar_inicio=rebarCenterlineCurves, rebar_mid=rebarCenterlineCurves_2, rebar_final=rebarCenterlineCurves_3, plane=plane_2)
# ---------- code_block_22.designscript (8 lines) ----------
empalme_list = [570, 710, 860, 1140, 1290, 1960, 2230, 2500, 2850, 3210];

rebar_curve_list = DSCore.List.Flatten([rebar_inicio, rebar_mid, rebar_final]);
pulled_curve = Autodesk.Curve.PullOntoPlane(rebar_curve_list, plane);
intersecciones = DSCore.List.Flatten(Autodesk.Geometry.Intersect(pulled_curve@L1<1L>, pulled_curve@L2<1L>));
intersecciones_length = Autodesk.Curve.Length(intersecciones);
intersecciones_mask = Orchid.List.AnyTrue(intersecciones_length@L1<1L> == empalme_list@L2<1L>);
empalmes = DSCore.List.FilterByBoolMask(intersecciones, intersecciones_mask)["in"];
# ----------------------------------------
pruneDuplicates = Custom[Geometry.PruneDuplicates](GeometryList=code_block_22.empalmes)  # package Data-Shapes; Removes all duplicate geometries from list.
code_block_23 = CodeBlock(empalmes=pruneDuplicates, plane=plane_2, plane_ajuste=code_block_18.out59)
# ---------- code_block_23.designscript (2 lines) ----------
empalmes_to_plane = Autodesk.Curve.PullOntoPlane(empalmes, plane);
curve_ref_cota = Autodesk.Curve.PullOntoPlane(empalmes_to_plane, plane_ajuste);
# ----------------------------------------
family_types_ᶜᵒⁿᵛᵉʳᵗᵉᵈ_ᵈʳᵒᵖᵈᵒʷⁿ = CodeBlock { Revit.Elements.FamilyType.ByName("EST_D_DEATIL ITEM_EMPALME"); }
current_4 = Document.Current()
activeView_4 = Document.ActiveView(document=current_4)
byCurve = Custom[DetailComponent.ByCurve](curve=pruneDuplicates, familyType=family_types_ᶜᵒⁿᵛᵉʳᵗᵉᵈ_ᵈʳᵒᵖᵈᵒʷⁿ, view=activeView_4)  # package Clockwork for Dynamo 2.x; Places a line-based detail component in a given view
code_block_24 = CodeBlock { ["Right", "Left"]; }
familyinstance_reference_byname = Custom[FamilyInstance Reference ByName](familyInstance=byCurve@L1, name=code_block_24@L2, lacing=Longest)  # package Genius Loci; Works only in Revit 2018.1 and later. Gets the reference corresponding to the named reference plane in the instance's family.
transpose = List.Transpose(lists=familyinstance_reference_byname.Reference@L2)
code_block_25 = CodeBlock(x=all_elements_of_type, view=activeView, line=code_block_23.curve_ref_cota, references=transpose)
# ---------- code_block_25.designscript (13 lines) ----------
dimensionType = x;
elem_names = Revit.Elements.Element.Name(dimensionType);
mask = elem_names == "Linear - 2.5mm Arial";
dimensionType_1 = DSCore.List.FilterByBoolMask(dimensionType, mask)["in"][0];

//view
view;
//line
line;
//references
references;
//dimensionType
dimensionType_1;
# ----------------------------------------
dimension_byreferences = Custom[Dimension ByReferences](view=code_block_25.out4@L1, line=code_block_25.out5@L1, references=code_block_25.out6@L2, dimensionType=code_block_25.out7@L1, lacing=Longest)  # package Genius Loci; Creates a new linear dimension from at least two geometric references of an object.
current_5 = Document.Current()
activeView_5 = Document.ActiveView(document=current_5)
code_block_26 = CodeBlock(curves=rebarCenterlineCurves, normal_seg_mayor=code_block_18.out128, view_plane_vector_y=code_block_18.out129, capa_as_str=code_block_18.out130, seg_mayor_plane_ajuste_tag=code_block_18.out131, element=code_block_19.out4)
# ---------- code_block_26.designscript (28 lines) ----------
rebar_curve = curves[0];
normal_seg_mayor;
view_plane_vector_y;
capa_as_str;
seg_mayor_plane_ajuste_tag;

//TagLocationParam
[40, 90, 140, 190, 240];
key_param = ["40", "90", "140", "190", "240"];
val_param = [0.2, 0.16, 0.14, 0.12, 0.10];
dict_param = Dictionary.ByKeysValues(key_param, val_param);
param = Dictionary.ValueAtKey(dict_param, capa_as_str);

//element
element;
//TagLocation
point_leader_end = Autodesk.Curve.PointAtParameter(rebar_curve, param);
//TagType
family = Revit.Family.ByName("EST_A_STRUCTURAL REBAR TAG_STANDAR");
tag_type = Revit.Elements.FamilyType.ByFamilyAndName(family, "R_S_01");
//horizontal
true;
//addLeader
true;
//LinkInstance
null;
//RunIt
true;
# ----------------------------------------
create_tag = Custom[Create Tag](view=activeView_5, element=code_block_26.element, TagLocation=code_block_26.point_leader_end, TagType=code_block_26.tag_type, horizontal=code_block_26.out14, addLeader=code_block_26.out15, LinkInstance=code_block_26.out16, RunIt=code_block_26.out17, lacing=Shortest)  # package Genius Loci; Works only in Revit 2018 and later. Creates a tag at a given location, of given type and in a supplied view. The node also works with Linked Elements (except space and area), Multi Category tag and Material Tag. Based on an archilab node
code_block_27 = CodeBlock(tag=create_tag, plane=code_block_26.seg_mayor_plane_ajuste_tag)
# ---------- code_block_27.designscript (8 lines) ----------
tag[0];
plane;
//Posicion actual del tag
tag_points = Rhythm.Tags.GetHeadPosition(tag);
//Puntos para nueva posicion de tag
tag_points_f = Points.PullOntoPlane(tag_points, plane);
//Nueva posicion de tags
Rhythm.Tags.SetHeadPosition(tag, tag_points_f);
# ----------------------------------------
current_6 = Document.Current()
activeView_6 = Document.ActiveView(document=current_6)
code_block_28 = CodeBlock(curves=rebarCenterlineCurves_2, normal_seg_mayor=code_block_18.out149, view_plane_vector_y=code_block_18.out150, capa_as_str=code_block_18.out151, seg_mayor_plane_ajust=code_block_18.out152, element=code_block_20.out4)
# ---------- code_block_28.designscript (28 lines) ----------
rebar_curve = DSCore.List.Flatten(curves);
normal_seg_mayor;
view_plane_vector_y;
capa_as_str;
seg_mayor_plane_ajuste_tag;

//TagLocationParam
[40, 90, 140, 190, 240];
key_param = ["40", "90", "140", "190", "240"];
val_param = [0.5, 0.52, 0.54, 0.56, 0.58];
dict_param = Dictionary.ByKeysValues(key_param, val_param);
param = Dictionary.ValueAtKey(dict_param, capa_as_str);

//element
element;
//TagLocation
point_leader_end = Autodesk.Curve.PointAtParameter(rebar_curve<1L>, param);
//TagType
family = Revit.Family.ByName("EST_A_STRUCTURAL REBAR TAG_STANDAR");
tag_type = Revit.Elements.FamilyType.ByFamilyAndName(family, "R_S_00");
//horizontal
true;
//addLeader
true;
//LinkInstance
null;
//RunIt
true;
# ----------------------------------------
create_tag_2 = Custom[Create Tag](view=activeView_6, element=code_block_28.element, TagLocation=code_block_28.point_leader_end, TagType=code_block_28.tag_type, horizontal=code_block_28.out14, addLeader=code_block_28.out15, LinkInstance=code_block_28.out16, RunIt=code_block_28.out17, lacing=Longest)
code_block_29 = CodeBlock(tag=create_tag_2, plane=code_block_28.seg_mayor_plane_ajuste_tag)
# ---------- code_block_29.designscript (8 lines) ----------
tag;
plane;
//Posicion actual del tag
tag_points = Rhythm.Tags.GetHeadPosition(tag);
//Puntos para nueva posicion de tag
tag_points_f = Points.PullOntoPlane(tag_points, plane);
//Nueva posicion de tags
Rhythm.Tags.SetHeadPosition(tag, tag_points_f);
# ----------------------------------------
current_7 = Document.Current()
activeView_7 = Document.ActiveView(document=current_7)
code_block_30 = CodeBlock(curves=rebarCenterlineCurves_3, normal_seg_mayor=code_block_18.out170, view_plane_vector_y=code_block_18.out171, capa_as_str=code_block_18.out172, seg_mayor_plane_ajust=code_block_18.out173, element=code_block_21.out4)
# ---------- code_block_30.designscript (28 lines) ----------
rebar_curve = DSCore.List.Flatten(curves);
normal_seg_mayor;
view_plane_vector_y;
capa_as_str;
seg_mayor_plane_ajuste_tag;

//TagLocationParam
[40, 90, 140, 190, 240];
key_param = ["40", "90", "140", "190", "240"];
val_param = [0.5, 0.52, 0.54, 0.56, 0.58];
dict_param = Dictionary.ByKeysValues(key_param, val_param);
param = Dictionary.ValueAtKey(dict_param, capa_as_str);

//element
element;
//TagLocation
point_leader_end = Autodesk.Curve.PointAtParameter(rebar_curve<1L>, param);
//TagType
family = Revit.Family.ByName("EST_A_STRUCTURAL REBAR TAG_STANDAR");
tag_type = Revit.Elements.FamilyType.ByFamilyAndName(family, "R_S_01");
//horizontal
true;
//addLeader
true;
//LinkInstance
null;
//RunIt
true;
# ----------------------------------------
create_tag_3 = Custom[Create Tag](view=activeView_7, element=code_block_30.element, TagLocation=code_block_30.point_leader_end, TagType=code_block_30.tag_type, horizontal=code_block_30.out14, addLeader=code_block_30.out15, LinkInstance=code_block_30.out16, RunIt=code_block_30.out17, lacing=Longest)
code_block_31 = CodeBlock(tag=create_tag_3, plane=code_block_30.seg_mayor_plane_ajuste_tag)  # same code as code_block_27
code_block_32 = CodeBlock { "Views"; }
byName = Category.ByName(name=code_block_32)
all_elements_of_category = ElementsOfCategory(Category=byName)
type = Custom[View.Type](view=all_elements_of_category)  # package Clockwork for Dynamo 2.x; Returns the type of a given view
code_block_33 = CodeBlock()
# ---------- code_block_33.designscript (8 lines) ----------
[
"FloorPlan",
"CelilingPlan",
"EngineeringPlan",
"Elevation",
"Section",
"Detail"
];
# ----------------------------------------
eq = type@L1 == code_block_33@L2  # lacing=Longest
anyTrue = Custom[Booleans.AnyTrue](seq=eq)  # package Clockwork for Dynamo 2.x; Returns true if any item in a list of booleans is true.
filterByBoolMask = List.FilterByBoolMask(list=all_elements_of_category, mask=anyTrue)
isViewTemplate = Custom[View.IsViewTemplate+](view=filterByBoolMask.in)  # package Clockwork for Dynamo 2.x; Checks if a given view is a view template. Unlike the OOTB node it works for all view types.
filterByBoolMask_2 = List.FilterByBoolMask(list=filterByBoolMask.in, mask=isViewTemplate)
name = Element.Name(element=filterByBoolMask_2.out)
current_8 = Document.Current()
activeView_8 = Document.ActiveView(document=current_8)
name_2 = Element.Name(element=activeView_8)
eq_2 = name == name_2
filterByBoolMask_3 = List.FilterByBoolMask(list=filterByBoolMask_2.out, mask=eq_2)
list_create_4 = List.Create(item0=code_block_19.out4, item1=code_block_20.out4, item2=code_block_21.out4)
flatten = List.Flatten(list=list_create_4)
hideElements = archilab.Revit.Views.Views.HideElements(view=filterByBoolMask_3.out@L1, elements=flatten@L2, lacing=Longest)
