# Dynamo graph verEmpotradaUnicoPata_script.dyn (Dynamo 2.6.2.15705)
# packages: Data-Shapes 2022.2.103, Clockwork for Dynamo 2.x 2.4.0, Structural Design 2021.1.22, Genius Loci 2021.11.10

current = Document.Current()
activeView = Document.ActiveView(document=current)
code_block = CodeBlock { "Seleccionar Elementos"; }
categories_ᶜᵒⁿᵛᵉʳᵗᵉᵈ_ᵈʳᵒᵖᵈᵒʷⁿ = CodeBlock()
# ---------- categories_ᶜᵒⁿᵛᵉʳᵗᵉᵈ_ᵈʳᵒᵖᵈᵒʷⁿ.designscript (8 lines) ----------
//InputName
"";
//ButtonText
"SELECCIONAR";
//CategoryFilter
Revit.Category.ByName("Walls");
//SelectSingleElement
false;
# ----------------------------------------
selectmodelelements_data = Custom[SelectModelElements Data](InputName=categories_ᶜᵒⁿᵛᵉʳᵗᵉᵈ_ᵈʳᵒᵖᵈᵒʷⁿ.out0, ButtonText=categories_ᶜᵒⁿᵛᵉʳᵗᵉᵈ_ᵈʳᵒᵖᵈᵒʷⁿ.out1, CategoryFilter=categories_ᶜᵒⁿᵛᵉʳᵗᵉᵈ_ᵈʳᵒᵖᵈᵒʷⁿ.out2, SelectSingleElement=categories_ᶜᵒⁿᵛᵉʳᵗᵉᵈ_ᵈʳᵒᵖᵈᵒʷⁿ.out3)  # package Data-Shapes; Creates a Revit element selection input for UI.MultipleInputForm++ . Check out www.data-shapes.net for more infos!
inputgroup_data = Custom[InputGroup Data](GroupTitle=code_block, Inputs=selectmodelelements_data)  # package Data-Shapes; Creates a group of inputs for UI.MultipleInputForm ++ . Check out www.data-shapes.net for more infos !
code_block_2 = CodeBlock { "Datos de Posición Barra"; }
code_block_3 = CodeBlock()
# ---------- code_block_3.designscript (4 lines) ----------
//InputName
"Segmento Mayor";
//ButtonText
"SELECCIONAR";
# ----------------------------------------
selectfaces_data = Custom[SelectFaces Data](InputName=code_block_3.out0, ButtonText=code_block_3.out1)  # package Data-Shapes; Creates a Revit face selection input for UI.MultipleInputForm++. Check out www.data-shapes.net for more infos!
code_block_4 = CodeBlock()
# ---------- code_block_4.designscript (4 lines) ----------
//InputName
"Empotramiento Inicio";
//ButtonText
"SELECCIONAR";
# ----------------------------------------
selectfaces_data_2 = Custom[SelectFaces Data](InputName=code_block_4.out0, ButtonText=code_block_4.out1)
code_block_5 = CodeBlock()
# ---------- code_block_5.designscript (4 lines) ----------
//InputName
"Empotramiento Término";
//ButtonText
"SELECCIONAR";
# ----------------------------------------
selectfaces_data_3 = Custom[SelectFaces Data](InputName=code_block_5.out0, ButtonText=code_block_5.out1)
list_create = List.Create(item0=selectfaces_data, item1=selectfaces_data_2, item2=selectfaces_data_3)
inputgroup_data_2 = Custom[InputGroup Data](GroupTitle=code_block_2, Inputs=list_create)
code_block_6 = CodeBlock { "Datos de Armadura"; }
element_types_ᶜᵒⁿᵛᵉʳᵗᵉᵈ_ᵈʳᵒᵖᵈᵒʷⁿ = CodeBlock { DSCore.Types.FindTypeByNameInAssembly("RebarBarType", "RevitAPI"); }
all_elements_of_type = ElementsOfType(element_type=element_types_ᶜᵒⁿᵛᵉʳᵗᵉᵈ_ᵈʳᵒᵖᵈᵒʷⁿ)
code_block_7 = CodeBlock(elem_type=all_elements_of_type) { elem_type; elem_type_diameter = Properties.RebarDiameter(elem_type); }
sortByKey = List.SortByKey(list=code_block_7.elem_type, keys=code_block_7.elem_type_diameter)
code_block_8 = CodeBlock(elem_sorted=sortByKey.sorted_list)
# ---------- code_block_8.designscript (12 lines) ----------
elem_name = Revit.Elements.Element.Name(elem_sorted);

//InputName
"Diametro";
//Keys
elem_name;
//Values
elem_sorted;
//DefaultValueIndex
0;
//Sorted_optional
false;
# ----------------------------------------
dropdown_data = Custom[DropDown Data](InputName=code_block_8.out1, Keys=code_block_8.out2, Values=code_block_8.out3, DefaultValueIndex=code_block_8.out4, Sorted_optional=code_block_8.out5)  # package Data-Shapes; Create data for DropDown input in UI.MultiInputForm ++ . Check out www.data-shapes.net for more infos.
code_block_9 = CodeBlock { "Cant. de Barras"; "2"; true; }
textbox_data = Custom[TextBox Data](InputName=code_block_9.out0, DefaultText=code_block_9.out1, IsNumberEntry=code_block_9.out2)  # package Data-Shapes; Create Data for TextBox input in UI.MultipleInputForm ++ . Check out www.data-shapes.net for more informations
code_block_10 = CodeBlock { "Capa"; ["1ª Capa", "2ª Capa", "3ª Capa", "4ª Capa", "5ª Capa"]; [40, 90, 140, 190, 240]; 0; }
dropdown_data_2 = Custom[DropDown Data](InputName=code_block_10.out0, Keys=code_block_10.out1, Values=code_block_10.out2, DefaultValueIndex=code_block_10.out3)
list_create_2 = List.Create(item0=dropdown_data, item1=textbox_data, item2=dropdown_data_2)
inputgroup_data_3 = Custom[InputGroup Data](GroupTitle=code_block_6, Inputs=list_create_2)
list_create_3 = List.Create(item0=inputgroup_data, item1=inputgroup_data_2, item2=inputgroup_data_3)
code_block_11 = CodeBlock(inputs=list_create_3)
# ---------- code_block_11.designscript (20 lines) ----------
//Description
"Empotrada Segmento Unico Recta";
//Logo
"C:\\Arainco\\Arainco.png";
//ButtonText
"INICIAR";
//Inputs
inputs;
//Toggle
true;
//LinkToHelp
null;
//CancelButtonText
"CANCELAR";
//MaxHeight
0;
//Width
430;
//LabelWidth
170;
# ----------------------------------------
multipleinputform = Custom[MultipleInputForm ++](Description_optional=code_block_11.out0, Logo_optional=code_block_11.out1, ButtonText_optional=code_block_11.out2, Inputs=code_block_11.inputs, Toggle=code_block_11.out4, LinkToHelp_optional=code_block_11.out5, CancelButtonText_optional=code_block_11.out6, MaxHeight_optional=code_block_11.out7, Width_optional=code_block_11.out8, LabelWidth_optional=code_block_11.out9)  # package Data-Shapes; Create a form with multiple inputs. see www.data-shapes.net for tutorials and infos!
code_block_12 = CodeBlock(l=multipleinputform.User_Inputs)
# ---------- code_block_12.designscript (12 lines) ----------
l;
[Imperative]
{
	if (l == null)
	{
		return = [[],[],[],[],[],[],[],[],[],[]];
	}
	else
	{
		return = l;
	}
};
# ----------------------------------------
code_block_13 = CodeBlock(x=code_block_12.out1) { x[1][0]; }
recubrimiento_segmento_mayor = Python(IN[0]=code_block_13)
# ---------- recubrimiento_segmento_mayor.python (35 lines) ----------
import clr
clr.AddReference('ProtoGeometry')
from Autodesk.DesignScript.Geometry import *

clr.AddReference('RevitAPI')
import Autodesk
from Autodesk.Revit.DB import *

clr.AddReference('RevitAPIUI')
from Autodesk.Revit.UI import *
from Autodesk.Revit.UI.Selection import *

clr.AddReference('RevitServices')
import RevitServices
from RevitServices.Persistence import DocumentManager

clr.AddReference("RevitNodes")
import Revit
# Import ToProtoType, ToRevitType geometry conversion extension methods
clr.ImportExtensions(Revit.GeometryConversion)
doc = DocumentManager.Instance.CurrentDBDocument


surface = UnwrapElement(IN[0])
ref = surface.Tags.LookupTag("RevitFaceReference")
elemId = ref.ElementId
element = doc.GetElement(ref.ElementId)
category = element.Category.Name

if "Foundations" in category:
	recubrimiento = True
else:
	recubrimiento = False

OUT = recubrimiento
# ----------------------------------------
code_block_14 = CodeBlock(x=code_block_12.out1) { x[2][0]; }
recubrimiento_inicio = Python(IN[0]=code_block_14)
# ---------- recubrimiento_inicio.python (35 lines) ----------
import clr
clr.AddReference('ProtoGeometry')
from Autodesk.DesignScript.Geometry import *

clr.AddReference('RevitAPI')
import Autodesk
from Autodesk.Revit.DB import *

clr.AddReference('RevitAPIUI')
from Autodesk.Revit.UI import *
from Autodesk.Revit.UI.Selection import *

clr.AddReference('RevitServices')
import RevitServices
from RevitServices.Persistence import DocumentManager

clr.AddReference("RevitNodes")
import Revit
# Import ToProtoType, ToRevitType geometry conversion extension methods
clr.ImportExtensions(Revit.GeometryConversion)
doc = DocumentManager.Instance.CurrentDBDocument


surface = UnwrapElement(IN[0])
ref = surface.Tags.LookupTag("RevitFaceReference")
elemId = ref.ElementId
element = doc.GetElement(ref.ElementId)
category = element.Category.Name

if "Foundations" in category:
	recubrimiento = 50
else:
	recubrimiento = 25

OUT = recubrimiento
# ----------------------------------------
code_block_15 = CodeBlock(x=code_block_12.out1) { x[3][0]; }
recubrimiento_termino = Python(IN[0]=code_block_15)  # same code as recubrimiento_inicio
current_2 = Document.Current()
activeView_2 = Document.ActiveView(document=current_2)
plane = Custom[View.Plane](view=activeView_2)  # package Clockwork for Dynamo 2.x; Retrieves the plane of a given view
element_types_ᶜᵒⁿᵛᵉʳᵗᵉᵈ_ᵈʳᵒᵖᵈᵒʷⁿ_2 = CodeBlock { DSCore.Types.FindTypeByNameInAssembly("RebarHookType", "RevitAPI"); }
all_elements_of_type_2 = ElementsOfType(element_type=element_types_ᶜᵒⁿᵛᵉʳᵗᵉᵈ_ᵈʳᵒᵖᵈᵒʷⁿ_2)
pata_90º = CodeBlock(x=all_elements_of_type_2)
# ---------- pata_90º.designscript (4 lines) ----------
elem = x;
elem_names = Revit.Elements.Element.Name(elem);
mask = elem_names == "Standard - 90 deg.";
DSCore.List.FilterByBoolMask(elem, mask)["in"][0];
# ----------------------------------------
code_block_16 = CodeBlock(x=code_block_12.out1, rec_seg_mayor=recubrimiento_segmento_mayor, rec_inicio=recubrimiento_inicio, rec_termino=recubrimiento_termino, view_plane=plane, p=pata_90º.out3)
# ---------- code_block_16.designscript (191 lines) ----------
muros = x[0];
dist_traslacion_curva;
seg_mayor = x[1][0];
rec_seg_mayor;
inicio = x[2][0];
rec_inicio;
termino = x[3][0];
rec_termino;
tipo_barra = x[4];
cantidad_barras = x[5];
capa = x[6];
capa_as_str = Strings.ToString(x[6], "");
view_plane;
view_plane_normal = Autodesk.Plane.Normal(view_plane);
view_plane_vector_y = Autodesk.Plane.YAxis(view_plane);
view_plane_normal_reverse = Autodesk.Vector.Reverse(view_plane_normal);

//Vector Normal Cara de Distribucion
normal_seg_mayor = Autodesk.Surface.NormalAtParameter(seg_mayor, 0.5, 0.5);

//Filtrar muros paralelos a la vista actual
wall_vector = Rhythm.Walls.Direction(muros)["facingVector"];
wall_centroid = Autodesk.Solid.Centroid(DSCore.List.Flatten(Revit.Elements.Element.Geometry(muros)));
wall_coo_sys = CoordinateSystem.ByOriginVectors(wall_centroid, wall_vector, Autodesk.Vector.YAxis());
wall_vector_mask = Autodesk.Vector.IsParallel(CoordinateSystem.XAxis(wall_coo_sys), view_plane_normal);
wall_lst = DSCore.List.FilterByBoolMask(muros, wall_vector_mask)["in"];

//Geometria a Cortar
g_elem_solid = DSCore.List.Flatten(Revit.Elements.Element.Geometry(wall_lst));
g_solid_centroid = Autodesk.Solid.Centroid(g_elem_solid);
g_solid_plane = Autodesk.Plane.ByOriginNormal(g_solid_centroid, view_plane_normal);
g_solid_coo_sys = CoordinateSystem.ByPlane(g_solid_plane);
g_solid_scaled = Autodesk.Geometry.Scale(g_elem_solid, g_solid_plane, 100, 100, 1);
geom_a_cortar = Autodesk.Solid.ByUnion(g_solid_scaled);

//Numero de Capa
key_2 = ["40", "90", "140", "190", "240"];
val_2 = ["1", "2", "3", "4", "5"];
dict_capa = Dictionary.ByKeysValues(key_2, val_2);
num_capa = Dictionary.ValueAtKey(dict_capa, capa_as_str);

//Desplazamiento etiqueta
key_1 = ["40", "90", "140", "190", "240"];
val_1 = [450, 700, 950, 1200, 1450];
dict_desplazamiento = Dictionary.ByKeysValues(key_1, val_1);
despl_etiqueta = Dictionary.ValueAtKey(dict_desplazamiento, capa_as_str);

//Vector Normal Caras capturadas
seg_mayor_normal = Autodesk.Surface.NormalAtParameter(seg_mayor, 0.5, 0.5);
inicio_normal = Autodesk.Surface.NormalAtParameter(inicio, 0.5, 0.5);
termino_normal = Autodesk.Surface.NormalAtParameter(termino, 0.5, 0.5);

//Centroide Caras Capturadas
seg_mayor_point = Autodesk.Surface.PointAtParameter(seg_mayor, 0.5, 0.5);
inicio_point = Points.PullOntoPlane(Autodesk.Surface.PointAtParameter(inicio, 0.5, 0.5), view_plane);
termino_point = Points.PullOntoPlane(Autodesk.Surface.PointAtParameter(termino, 0.5, 0.5), view_plane);
inicio_point_z = Autodesk.Point.Z(inicio_point);
termino_point_x = Autodesk.Point.X(termino_point);
termino_point_y = Autodesk.Point.Y(termino_point);
termino_point_corregido = Autodesk.Point.ByCoordinates(termino_point_x, termino_point_y, inicio_point_z);

//Planos caras capturadas
seg_mayor_plane_1 = Autodesk.Plane.ByOriginNormal(seg_mayor_point, seg_mayor_normal);
inicio_plane_1 = Autodesk.Plane.ByOriginNormal(inicio_point, inicio_normal);
termino_plane_1 = Autodesk.Plane.ByOriginNormal(termino_point, termino_normal);

//Planos Trasladados
capa_1 = [Imperative]
{
	if(rec_seg_mayor == true)
	{
		return = capa + 25;
	}
	else
	{
		return = capa;
	}
};
seg_mayor_plane = Autodesk.Geometry.Translate(seg_mayor_plane_1, seg_mayor_normal, capa_1  * -1);
inicio_plane = Autodesk.Geometry.Translate(inicio_plane_1, inicio_normal, 0);
termino_plane = Autodesk.Geometry.Translate(termino_plane_1, termino_normal, 0);

//Plano de ajuste para cotas de empalme
seg_mayor_plane_ajuste = Autodesk.Geometry.Translate(seg_mayor_plane_1, seg_mayor_normal, 310);

//Vector entre Planos de Empotramiento y Termino
l = Line.ByBestFitThroughPoints([inicio_point, termino_point_corregido]);
vector_normalizado = Autodesk.Vector.Normalized(Line.Direction(l));

//Sistema de Coordenadas Vista Actual
view_coo_sys = Autodesk.Plane.ToCoordinateSystem(view_plane);
y_axis = CoordinateSystem.YAxis(view_coo_sys);

//Traslacion curva
category = Revit.Elements.Element.GetCategory(wall_lst);
category_name = Revit.Category.Name(category);
mask = category_name == "Walls";
element = DSCore.List.FilterByBoolMask(wall_lst, mask)["in"];
element_type = Revit.Elements.Element.GetParameterValueByName(element, "Type");
element_width = Revit.Elements.Element.GetParameterValueByName(element_type, "Width");
dist_traslacion_curva = (element_width[0] / 2) - 40;

//Empotramiento Armadura
tipo_barra_str = Strings.ToString(Properties.RebarDiameter(tipo_barra),"");
key = ["8","10","12","16","18","22","25","28","32","36"];
val = [570, 710, 860, 1140, 1290, 1960, 2230, 2500, 2850, 3210];
dict_traslapo = Dictionary.ByKeysValues(key, val);
empotramiento_dict = Dictionary.ValueAtKey(dict_traslapo, tipo_barra_str);

//Largo Pata en funcion del diametro de barra
key_l_pata = ["8","10","12","16","18","22","25","28","32","36"];
val_l_pata = [160, 200, 240, 320, 360, 440, 500, 570, 650, 720];
dict_l_pata = Dictionary.ByKeysValues(key_l_pata, val_l_pata);
l_pata_dict = Dictionary.ValueAtKey(dict_l_pata, tipo_barra_str);

//Superficies
surf_seg_mayor = Autodesk.Geometry.Intersect(geom_a_cortar, seg_mayor_plane)[0];
surf_inicio = Autodesk.Geometry.Intersect(geom_a_cortar, inicio_plane)[0];
surf_termino = Autodesk.Geometry.Intersect(geom_a_cortar, termino_plane)[0];

//Intersecciones
intersect_start = Autodesk.Geometry.Intersect(surf_seg_mayor, surf_inicio)[0];
intersect_end = Autodesk.Geometry.Intersect(surf_seg_mayor, surf_termino)[0];

//Puntos para Generar Curva
point_start = Autodesk.Curve.PointAtParameter(intersect_start, 0.5);
point_end = Autodesk.Curve.PointAtParameter(intersect_end, 0.5);

//Rebar Curve
rebar_curve_init = Line.ByStartPointEndPoint(point_start, point_end);
rebar_curve_extend = Autodesk.Curve.ExtendStart(Autodesk.Curve.ExtendEnd(rebar_curve_init, empotramiento_dict), empotramiento_dict);
rebar_curve = Autodesk.Geometry.Translate(rebar_curve_extend, view_plane_normal_reverse, dist_traslacion_curva);

comparador_pata = Autodesk.Vector.IsAlmostEqualTo(y_axis, seg_mayor_normal);
orintacion_pata = comparador_pata == true ? "Left" : "Right";

//Vector de la linea para armadura
rebar_curve_vector = Autodesk.Vector.ByTwoPoints(point_start, point_end);
rebar_curve_vector_normalized = Autodesk.Vector.Normalized(rebar_curve_vector);

bool_vector = Autodesk.Vector.IsAlmostEqualTo(rebar_curve_vector_normalized, Autodesk.Vector.ZAxis());

rebar_curve_f = bool_vector ? rebar_curve : Autodesk.Curve.Reverse(rebar_curve);

hook_type = bool_vector ? [p, null] : [null, p];

//Buscar Host mas cercano
elem_solid = DSCore.List.Flatten(Revit.Elements.Element.Geometry(wall_lst));
solid_centroid = Autodesk.Solid.Centroid(elem_solid);

//ArrayLength
array_length = DSCore.List.FirstItem(element_width - 80);
cantidad_barras;

//Primera Barra
rebar_curve_mid_point = Autodesk.Curve.PointAtParameter(rebar_curve_f, 0.5);
rebar_curve_distance_to = Autodesk.Geometry.DistanceTo(solid_centroid<1L>, rebar_curve_mid_point);
rebar_curve_min = DSCore.List.MinimumItem(rebar_curve_distance_to);
rebar_curve_mask = rebar_curve_distance_to == rebar_curve_min;
rebar_curve_host = DSCore.List.FilterByBoolMask(muros, rebar_curve_mask)["in"];
//curves
rebar_curve_f;
//rebarStyle
"Standard";
//rebarBarType
tipo_barra;
//startHookType
null;
//endHookType
null;
//startHookOrientation
orintacion_pata;
//endtHookOrientation
orintacion_pata;
//hostElement
rebar_curve_host;
//vector
view_plane_normal;
//Layout Primera Barra
array_length;
cantidad_barras;
//Vector Normal Cara de Distribucion
normal_seg_mayor;
//Desplazamiento Etiqueta
view_plane_vector_y;
//Valor de capa como string
capa_as_str;
//Plano de ajuste para posicion de etiquetas de barras
seg_mayor_plane_ajuste_tag = Autodesk.Geometry.Translate(seg_mayor_plane_1, seg_mayor_normal, 700);
//Numero de capa
num_capa;
# ----------------------------------------
fromCurves = StructuralDesign.Rebar.Create.FromCurves(curves=code_block_16.out100, rebarStyle=code_block_16.out101, rebarBarType=code_block_16.out102, startHookType=code_block_16.out103, endHookType=code_block_16.out104, startHookOrientation=code_block_16.out105, endHookOrientation=code_block_16.out106, hostElement=code_block_16.out107, vector=code_block_16.out108)
setLayoutAsFixedNumber = StructuralDesign.Rebar.Layout.SetLayoutAsFixedNumber(rebar=fromCurves, arrayLength=code_block_16.out109, numberOfBarPositions=code_block_16.out110)
element_types_ᶜᵒⁿᵛᵉʳᵗᵉᵈ_ᵈʳᵒᵖᵈᵒʷⁿ_3 = CodeBlock { DSCore.Types.FindTypeByNameInAssembly("RebarShape", "RevitAPI"); }
all_elements_of_type_3 = ElementsOfType(element_type=element_types_ᶜᵒⁿᵛᵉʳᵗᵉᵈ_ᵈʳᵒᵖᵈᵒʷⁿ_3)
code_block_17 = CodeBlock(rebar=setLayoutAsFixedNumber, num_capa=code_block_16.out115, elem=all_elements_of_type_3)
# ---------- code_block_17.designscript (8 lines) ----------
//Asigna Numero de Capa
Revit.Elements.Element.SetParameterByName(rebar, "Capa", num_capa);

//Asigna el Rebar Shape Indicado
elem_names = Revit.Elements.Element.Name(elem);
mask = elem_names == "R_S_00";
rebar_shape_R_S_00 = DSCore.List.FilterByBoolMask(elem, mask)["in"];
Revit.Elements.Element.SetParameterByName(rebar, "Shape", rebar_shape_R_S_00)[0];
# ----------------------------------------
rebarCenterlineCurves = StructuralDesign.Rebar.Properties.RebarCenterlineCurves(rebar=code_block_17.out4)
code_block_18 = CodeBlock(curves=rebarCenterlineCurves, normal_seg_mayor=code_block_16.out111, view_plane_vector_y=code_block_16.out112, capa_as_str=code_block_16.out113, seg_mayor_plane_ajuste_tag=code_block_16.out114, element=code_block_17.out4)
# ---------- code_block_18.designscript (28 lines) ----------
rebar_curve = curves[0];
normal_seg_mayor;
view_plane_vector_y;
capa_as_str;
seg_mayor_plane_ajuste_tag;

//TagLocationParam
[40, 90, 140, 190, 240];
key_param = ["40", "90", "140", "190", "240"];
val_param = [0.2, 0.3, 0.4, 0.5, 0.6];
dict_param = Dictionary.ByKeysValues(key_param, val_param);
param = Dictionary.ValueAtKey(dict_param, capa_as_str);

//element
element;
//TagLocation
point_leader_end = Autodesk.Curve.PointAtParameter(rebar_curve, param);
//TagType
family = Revit.Family.ByName("EST_A_STRUCTURAL REBAR TAG_STANDAR");
tag_type = Revit.Elements.FamilyType.ByFamilyAndName(family, "R_S_00");
//horizontal
true;
//addLeader
true;
//LinkInstance
null;
//RunIt
true;
# ----------------------------------------
create_tag = Custom[Create Tag](view=activeView, element=code_block_18.element, TagLocation=code_block_18.point_leader_end, TagType=code_block_18.tag_type, horizontal=code_block_18.out14, addLeader=code_block_18.out15, LinkInstance=code_block_18.out16, RunIt=code_block_18.out17, lacing=Shortest)  # package Genius Loci; Works only in Revit 2018 and later. Creates a tag at a given location, of given type and in a supplied view. The node also works with Linked Elements (except space and area), Multi Category tag and Material Tag. Based on an archilab node
code_block_19 = CodeBlock(tag=create_tag, plane=code_block_18.seg_mayor_plane_ajuste_tag)
# ---------- code_block_19.designscript (8 lines) ----------
tag[0];
plane;
//Posicion actual del tag
tag_points = Rhythm.Tags.GetHeadPosition(tag);
//Puntos para nueva posicion de tag
tag_points_f = Points.PullOntoPlane(tag_points, plane);
//Nueva posicion de tags
Rhythm.Tags.SetHeadPosition(tag, tag_points_f);
# ----------------------------------------
