# Dynamo graph cambiar_dia_cant_barras_script.dyn (Dynamo 2.6.2.15705)
# packages: Data-Shapes 2022.2.103

code_block = CodeBlock { "Actualizar armadura con Traslapo"; }
file_path = Filename("..\..\..\..\..\..\..\..\..\..\Arainco\Arainco.png")
code_block_2 = CodeBlock { "INICIAR"; "CANCELAR"; true; 430; 170; 650; }
categories_ᶜᵒⁿᵛᵉʳᵗᵉᵈ_ᵈʳᵒᵖᵈᵒʷⁿ = CodeBlock { "Seleccionar Tags\nde Armadura"; "SELECCIONAR"; Revit.Category.ByName("Structural Rebar Tags"); }
selectmodelelements_data = Custom[SelectModelElements Data](InputName=categories_ᶜᵒⁿᵛᵉʳᵗᵉᵈ_ᵈʳᵒᵖᵈᵒʷⁿ.out0, ButtonText=categories_ᶜᵒⁿᵛᵉʳᵗᵉᵈ_ᵈʳᵒᵖᵈᵒʷⁿ.out1, CategoryFilter=categories_ᶜᵒⁿᵛᵉʳᵗᵉᵈ_ᵈʳᵒᵖᵈᵒʷⁿ.out2)  # package Data-Shapes; Creates a Revit element selection input for UI.MultipleInputForm++ . Check out www.data-shapes.net for more infos!
code_block_3 = CodeBlock { "Datos de Armadura"; }
code_block_4 = CodeBlock { "Diametro"; }
element_types_ᶜᵒⁿᵛᵉʳᵗᵉᵈ_ᵈʳᵒᵖᵈᵒʷⁿ = CodeBlock { DSCore.Types.FindTypeByNameInAssembly("RebarBarType", "RevitAPI"); }
all_elements_of_type = ElementsOfType(element_type=element_types_ᶜᵒⁿᵛᵉʳᵗᵉᵈ_ᵈʳᵒᵖᵈᵒʷⁿ)
code_block_5 = CodeBlock(t5=all_elements_of_type)
# ---------- code_block_5.designscript (8 lines) ----------
t4 = t5;
t1 = t4;
num1 = Properties.RebarDiameter(t1);
t2 = DSCore.List.SortByKey(t1, num1);
t3 = Dictionary.ValueAtKey(t2, "sorted list");
str1 = Revit.Elements.Element.Name(t3);
0;
false;
# ----------------------------------------
dropdown_data = Custom[DropDown Data](InputName=code_block_4, Keys=code_block_5.str1, Values=code_block_5.t3, DefaultValueIndex=code_block_5.out6, Sorted_optional=code_block_5.out7)  # package Data-Shapes; Create data for DropDown input in UI.MultiInputForm ++ . Check out www.data-shapes.net for more infos.
code_block_6 = CodeBlock { "Cantidad de Barras"; "2"; true; }
textbox_data = Custom[TextBox Data](InputName=code_block_6.out0, DefaultText=code_block_6.out1, IsNumberEntry=code_block_6.out2)  # package Data-Shapes; Create Data for TextBox input in UI.MultipleInputForm ++ . Check out www.data-shapes.net for more informations
list_create = List.Create(item0=dropdown_data, item1=textbox_data)
inputgroup_data = Custom[InputGroup Data](GroupTitle=code_block_3, Inputs=list_create)  # package Data-Shapes; Creates a group of inputs for UI.MultipleInputForm ++ . Check out www.data-shapes.net for more infos !
list_create_2 = List.Create(item0=selectmodelelements_data, item1=inputgroup_data)
multipleinputform = Custom[MultipleInputForm ++](Description_optional=code_block, Logo_optional=file_path, ButtonText_optional=code_block_2.out0, Inputs=list_create_2, Toggle=code_block_2.out2, CancelButtonText_optional=code_block_2.out1, MaxHeight_optional=code_block_2.out5, Width_optional=code_block_2.out3, LabelWidth_optional=code_block_2.out4)  # package Data-Shapes; Create a form with multiple inputs. see www.data-shapes.net for tutorials and infos!
code_block_7 = CodeBlock(l=multipleinputform.User_Inputs)
# ---------- code_block_7.designscript (12 lines) ----------
l;
[Imperative]
{
	if (l == null)
	{
		return = [[],[],[],[],[],[]];
	}
	else
	{
		return = l;
	}
};
# ----------------------------------------
code_block_8 = CodeBlock(x=code_block_7.out1) { x; }
r_s_00_barra_recta = CodeBlock(t8=code_block_8)
# ---------- r_s_00_barra_recta.designscript (10 lines) ----------
x = t8;
t7 = Get.ValueAtIndex(x, 0);
t6 = t7;
t1 = t6;
element1 = Revit.Tag.TaggedElement(t1);
t2 = Revit.Elements.Element.GetParameterValueByName(element1, "Shape");
str3 = Revit.Elements.Element.Name(t2);
t3 = str3 == "R_S_00";
t4 = DSCore.List.FilterByBoolMask(element1, t3);
t5 = Dictionary.ValueAtKey(t4, "in");
# ----------------------------------------
code_block_9 = CodeBlock { "A"; }
code_block_10 = CodeBlock { "A"; }
getParameterValueByName = Element.GetParameterValueByName(element=r_s_00_barra_recta.t5, parameterName=code_block_10)
traslapo_armadura = CodeBlock(rebar=r_s_00_barra_recta.t5)
# ---------- traslapo_armadura.designscript (5 lines) ----------
diametro_barra = Strings.ToString(Properties.RebarDiameter(rebar),"");
key = ["8","10","12","16","18","22","25","28","32","36"];
val = [570, 710, 860, 1140, 1290, 1960, 2230, 2500, 2850, 3210];
dict_traslapo = Dictionary.ByKeysValues(key, val);
t3 = Dictionary.ValueAtKey(dict_traslapo, diametro_barra);
# ----------------------------------------
sub = getParameterValueByName - traslapo_armadura.t3
code_block_11 = CodeBlock(x=code_block_8) { x[1]; }
traslapo_armadura_2 = CodeBlock(rebar=code_block_11)  # same code as traslapo_armadura
add = sub + traslapo_armadura_2.t3
setParameterByName = Element.SetParameterByName(element=r_s_00_barra_recta.t5, parameterName=code_block_9, value=add)
code_block_12 = CodeBlock { "Quantity"; }
code_block_13 = CodeBlock(x=code_block_8) { x[2]; }
setParameterByName_2 = Element.SetParameterByName(element=setParameterByName, parameterName=code_block_12, value=code_block_13)
code_block_14 = CodeBlock { "Type"; }
code_block_15 = CodeBlock(x=code_block_8) { x[1]; }
setParameterByName_3 = Element.SetParameterByName(element=setParameterByName_2, parameterName=code_block_14, value=code_block_15)
code_block_16 = CodeBlock(x=code_block_7.out1) { x; }
r_s_01_barra_pata_inferior = CodeBlock(t8=code_block_16)
# ---------- r_s_01_barra_pata_inferior.designscript (10 lines) ----------
x = t8;
t7 = Get.ValueAtIndex(x, 0);
t6 = t7;
t1 = t6;
element1 = Revit.Tag.TaggedElement(t1);
t2 = Revit.Elements.Element.GetParameterValueByName(element1, "Shape");
str3 = Revit.Elements.Element.Name(t2);
t3 = str3 == "R_S_01";
t4 = DSCore.List.FilterByBoolMask(element1, t3);
t5 = Dictionary.ValueAtKey(t4, "in");
# ----------------------------------------
code_block_17 = CodeBlock { "A"; }
code_block_18 = CodeBlock { "A"; }
getParameterValueByName_2 = Element.GetParameterValueByName(element=r_s_01_barra_pata_inferior.t5, parameterName=code_block_18)
traslapo_armadura_3 = CodeBlock(rebar=r_s_01_barra_pata_inferior.t5)  # same code as traslapo_armadura
sub_2 = getParameterValueByName_2 - traslapo_armadura_3.t3
code_block_19 = CodeBlock(x=code_block_16) { x[1]; }
traslapo_armadura_4 = CodeBlock(rebar=code_block_19)  # same code as traslapo_armadura
add_2 = sub_2 + traslapo_armadura_4.t3
setParameterByName_4 = Element.SetParameterByName(element=r_s_01_barra_pata_inferior.t5, parameterName=code_block_17, value=add_2)
code_block_20 = CodeBlock { "Quantity"; }
code_block_21 = CodeBlock(x=code_block_16) { x[2]; }
setParameterByName_5 = Element.SetParameterByName(element=setParameterByName_4, parameterName=code_block_20, value=code_block_21)
code_block_22 = CodeBlock { "Type"; }
code_block_23 = CodeBlock(x=code_block_16) { x[1]; }
setParameterByName_6 = Element.SetParameterByName(element=setParameterByName_5, parameterName=code_block_22, value=code_block_23)
