# Dynamo graph 4 Capas_2_E+T_script.dyn (Dynamo 2.6.2.15705)
# packages: Data-Shapes 2022.2.103, Structural Design 2021.1.22, Genius Loci 2021.11.10, Orchid 206.3.0.8161

byBestFitThroughPoints = Line.ByBestFitThroughPoints()  # unwired: bestFitPoints
code_block = CodeBlock { "Confinamiento Cabezal 4 Capas\nTipo 2 - Estribos y Traba"; }
file_path = Filename("..\..\..\..\..\..\..\..\..\..\Arainco\Arainco.png")
code_block_2 = CodeBlock { "INICIAR"; "CANCELAR"; true; 430; 170; 650; }
categories_ᶜᵒⁿᵛᵉʳᵗᵉᵈ_ᵈʳᵒᵖᵈᵒʷⁿ = CodeBlock { "Seleccionar Muros a Armar"; "SELECCIONAR"; Revit.Category.ByName("Walls"); }
selectmodelelements_data = Custom[SelectModelElements Data](InputName=categories_ᶜᵒⁿᵛᵉʳᵗᵉᵈ_ᵈʳᵒᵖᵈᵒʷⁿ.out0, ButtonText=categories_ᶜᵒⁿᵛᵉʳᵗᵉᵈ_ᵈʳᵒᵖᵈᵒʷⁿ.out1, CategoryFilter=categories_ᶜᵒⁿᵛᵉʳᵗᵉᵈ_ᵈʳᵒᵖᵈᵒʷⁿ.out2)  # package Data-Shapes; Creates a Revit element selection input for UI.MultipleInputForm++ . Check out www.data-shapes.net for more infos!
code_block_3 = CodeBlock { "Seleccionar Cara de\nDistribucion"; "SELECCIONAR"; }
selectfaces_data = Custom[SelectFaces Data](InputName=code_block_3.out0, ButtonText=code_block_3.out1)  # package Data-Shapes; Creates a Revit face selection input for UI.MultipleInputForm++. Check out www.data-shapes.net for more infos!
code_block_4 = CodeBlock { "Definir Recorrido"; "SELECCIONAR"; }
selectfaces_data_2 = Custom[SelectFaces Data](InputName=code_block_4.out0, ButtonText=code_block_4.out1)
code_block_5 = CodeBlock { "Datos Armadura"; }
element_types_ᶜᵒⁿᵛᵉʳᵗᵉᵈ_ᵈʳᵒᵖᵈᵒʷⁿ = CodeBlock { DSCore.Types.FindTypeByNameInAssembly("RebarBarType", "RevitAPI"); }
all_elements_of_type = ElementsOfType(element_type=element_types_ᶜᵒⁿᵛᵉʳᵗᵉᵈ_ᵈʳᵒᵖᵈᵒʷⁿ)
code_block_6 = CodeBlock(elem_type=all_elements_of_type) { elem_type; elem_type_diameter = Properties.RebarDiameter(elem_type); }
sortByKey = List.SortByKey(list=code_block_6.elem_type, keys=code_block_6.elem_type_diameter)
code_block_7 = CodeBlock(elem_sorted=sortByKey.sorted_list)
# ---------- code_block_7.designscript (12 lines) ----------
elem_name = Revit.Elements.Element.Name(elem_sorted);

//InputName
"Diametro";
//Keys
elem_name;
//Values
elem_sorted;
//DefaultValueIndex
0;
//Sorted_optional
false;
# ----------------------------------------
dropdown_data = Custom[DropDown Data](InputName=code_block_7.out1, Keys=code_block_7.out2, Values=code_block_7.out3, DefaultValueIndex=code_block_7.out4, Sorted_optional=code_block_7.out5)  # package Data-Shapes; Create data for DropDown input in UI.MultiInputForm ++ . Check out www.data-shapes.net for more infos.
code_block_8 = CodeBlock { "Distanciamiento"; "200"; true; }
textbox_data = Custom[TextBox Data](InputName=code_block_8.out0, DefaultText=code_block_8.out1, IsNumberEntry=code_block_8.out2)  # package Data-Shapes; Create Data for TextBox input in UI.MultipleInputForm ++ . Check out www.data-shapes.net for more informations
list_create = List.Create(item0=dropdown_data, item1=textbox_data)
inputgroup_data = Custom[InputGroup Data](GroupTitle=code_block_5, Inputs=list_create)  # package Data-Shapes; Creates a group of inputs for UI.MultipleInputForm ++ . Check out www.data-shapes.net for more infos !
list_create_2 = List.Create(item0=selectmodelelements_data, item1=selectfaces_data, item2=selectfaces_data_2, item3=inputgroup_data)
multipleinputform = Custom[MultipleInputForm ++](Description_optional=code_block, Logo_optional=file_path, ButtonText_optional=code_block_2.out0, Inputs=list_create_2, Toggle=code_block_2.out2, CancelButtonText_optional=code_block_2.out1, MaxHeight_optional=code_block_2.out5, Width_optional=code_block_2.out3, LabelWidth_optional=code_block_2.out4)  # package Data-Shapes; Create a form with multiple inputs. see www.data-shapes.net for tutorials and infos!
code_block_9 = CodeBlock(l=multipleinputform.User_Inputs)
# ---------- code_block_9.designscript (12 lines) ----------
l;
[Imperative]
{
	if (l == null)
	{
		return = [[],[],[],[],[],[],[]];
	}
	else
	{
		return = l;
	}
};
# ----------------------------------------
code_block_10 = CodeBlock(x=code_block_9.out1)
# ---------- code_block_10.designscript (7 lines) ----------
dist_surface = x[1];
recorrido_surface = x[2];

point_1 = Autodesk.Surface.PointAtParameter(recorrido_surface, 0.5, 0.5);
plane = Autodesk.Plane.ByOriginNormal(point_1, Autodesk.Vector.ZAxis());
curve_1 = DSCore.List.Flatten(Autodesk.Geometry.Intersect(dist_surface<1L>, plane<1L>), 2);
DesignScript.Curve.PointAtParameter(curve_1, 0.5);
# ----------------------------------------
function_apply = ApplyFunction(func=byBestFitThroughPoints, arg1=[code_block_10.out5, code_block_10.out5])
control_de_flujo = Python(IN[0]=function_apply)
# ---------- control_de_flujo.python (9 lines) ----------
var = IN[0]
lst = None

if var == lst:
	x = [] 
else:
	x = var

OUT = x
# ----------------------------------------
code_block_11 = CodeBlock { -50; }
extendStart = Curve.ExtendStart(curve=control_de_flujo, distance=code_block_11)
extendEnd = Curve.ExtendEnd(curve=extendStart, distance=code_block_11)
code_block_12 = CodeBlock { 0.5; }
pointAtParameter = Curve.PointAtParameter(curve=extendEnd, param=code_block_12)
o_document_activeview = Orchid.RevitProject.Common.Document.ActiveView()
byLoft = Surface.ByLoft()  # unwired: crossSections
code_block_13 = CodeBlock(c=extendEnd)
# ---------- code_block_13.designscript (8 lines) ----------
endP = DesignScript.Curve.EndPoint(c);
strP = DesignScript.Curve.StartPoint(c);
lstP = [endP, strP];
valZ = Autodesk.Point.Z(lstP);
minZ = DSCore.List.MinimumItem(valZ);
mask = valZ == minZ;
plane_origin = DSCore.List.FilterByBoolMask(lstP, mask)["in"];
Autodesk.Plane.ByOriginNormal(plane_origin, Autodesk.Vector.ZAxis());
# ----------------------------------------
code_block_14 = CodeBlock(x=code_block_9.out1)
# ---------- code_block_14.designscript (10 lines) ----------
surface = x[1];
point_surf = Autodesk.Surface.PointAtParameter(surface, 0.5, 0.5);
surface_normal = Autodesk.Surface.NormalAtParameter(surface, 0.5, 0.5);
plane = Autodesk.Plane.ByOriginNormal(point_surf, Autodesk.Vector.ZAxis());
curve_1 = DSCore.List.Flatten(Autodesk.Geometry.Intersect(surface, plane),2);
curve_rev = DesignScript.Curve.Reverse(curve_1);
curve_2 = DesignScript.Curve.ExtendEnd(curve_rev, -20);
curve_3 = DesignScript.Curve.ExtendStart(curve_2, -20);
curve_4 = Autodesk.Geometry.Translate(curve_3, surface_normal, -20);
Autodesk.Plane.Normal(plane);
# ----------------------------------------
code_block_15 = CodeBlock(plane_1=code_block_13.out7, curve_1=code_block_14.curve_4, vector_1=code_block_14.surface_normal)
# ---------- code_block_15.designscript (6 lines) ----------
plane_1;
curve_1;
vector_1;
curve_2 = DesignScript.Curve.PullOntoPlane(curve_1, plane_1);
curve_3 = Autodesk.Geometry.Translate(curve_2, vector_1, -340);
DSCore.List.Flatten([curve_2, curve_3], 2);
# ----------------------------------------
function_apply_2 = ApplyFunction(func=byLoft, arg1=code_block_15.out5)
perimeterCurves = Surface.PerimeterCurves(surface=function_apply_2)
code_block_16 = CodeBlock(x=code_block_9.out1) { x[3]; }
code_block_17 = CodeBlock(x=code_block_9.out1) { x[0]; }
reverse = Vector.Reverse(vector=code_block_14.out9)
code_block_18 = CodeBlock(curves=perimeterCurves, rebarBarType=code_block_16, hostElement=code_block_17, vector=reverse)
# ---------- code_block_18.designscript (18 lines) ----------
//curves
curves;
//rebarStyle
"Standard";
//rebarBarType
rebarBarType;
//startHookType
null;
//endHookType
null;
//startHookOrientation
"Left";
//endtHookOrientation
"Left";
//hostElement
hostElement;
//vector
vector;
# ----------------------------------------
fromCurves = StructuralDesign.Rebar.Create.FromCurves(curves=code_block_18.curves@L2, rebarStyle=code_block_18.out1@L1, rebarBarType=code_block_18.rebarBarType@L1, startHookType=code_block_18.out3@L1, endHookType=code_block_18.out4@L1, startHookOrientation=code_block_18.out5@L1, endHookOrientation=code_block_18.out6@L1, hostElement=code_block_18.hostElement@L1, vector=code_block_18.vector@L1, lacing=Longest)
element_types_ᶜᵒⁿᵛᵉʳᵗᵉᵈ_ᵈʳᵒᵖᵈᵒʷⁿ_2 = CodeBlock { DSCore.Types.FindTypeByNameInAssembly("RebarShape", "RevitAPI"); }
all_elements_of_type_2 = ElementsOfType(element_type=element_types_ᶜᵒⁿᵛᵉʳᵗᵉᵈ_ᵈʳᵒᵖᵈᵒʷⁿ_2)
code_block_19 = CodeBlock(t1=all_elements_of_type_2)
# ---------- code_block_19.designscript (5 lines) ----------
"Shape";
str2 = Revit.Elements.Element.Name(t1);
t2 = str2 == "R_E_00";
t3 = DSCore.List.FilterByBoolMask(t1, t2);
t4 = Dictionary.ValueAtKey(t3, "in");
# ----------------------------------------
setParameterByName = Element.SetParameterByName(element=fromCurves, parameterName=code_block_19.out0, value=code_block_19.t4)
code_block_20 = CodeBlock(x=code_block_9.out1) { x[4]; }
length = Curve.Length(curve=extendEnd)
setLayoutAsMaximumSpacing = StructuralDesign.Rebar.Layout.SetLayoutAsMaximumSpacing(rebar=setParameterByName, spacing=code_block_20, arrayLength=length)
code_block_21 = CodeBlock(x=code_block_9.out1) { surface = x[1]; surface_normal = Autodesk.Surface.NormalAtParameter(surface, 0.5, 0.5); }
code_block_22 = CodeBlock(surface_normal=code_block_21.surface_normal, curve_1=extendEnd)
# ---------- code_block_22.designscript (4 lines) ----------
surface_normal;
point_1 = DesignScript.Curve.PointAtParameter(curve_1, 0.5);
tag_estribo = Autodesk.Geometry.Translate(point_1, surface_normal, 130);
tag_traba = Autodesk.Geometry.Translate(point_1, surface_normal, 330);
# ----------------------------------------
code_block_23 = CodeBlock()
# ---------- code_block_23.designscript (4 lines) ----------
family1 = Revit.Family.ByName("EST_A_STRUCTURAL REBAR TAG_CONFINAMIENTO");
familytype1 = Revit.Elements.FamilyType.ByFamilyAndName(family1, "R_E_00");
false;
true;
# ----------------------------------------
create_tag = Custom[Create Tag](view=o_document_activeview@L1, element=setLayoutAsMaximumSpacing@L1, TagLocation=code_block_22.tag_estribo@L1, TagType=code_block_23.familytype1@L1, addLeader=code_block_23.out2@L1, RunIt=code_block_23.out3@L1, lacing=Longest)  # package Genius Loci; Works only in Revit 2018 and later. Creates a tag at a given location, of given type and in a supplied view. The node also works with Linked Elements (except space and area), Multi Category tag and Material Tag. Based on an archilab node
flatten = List.Flatten(list=create_tag)
code_block_24 = CodeBlock { "Orientation"; 1; }
setParameterByName_2 = Element.SetParameterByName(element=flatten, parameterName=code_block_24.out0, value=code_block_24.out1)
o_document_activeview_2 = Orchid.RevitProject.Common.Document.ActiveView()
code_block_25 = CodeBlock(plane_1=code_block_13.out7, curve_1=code_block_14.curve_4, vector_1=code_block_14.surface_normal)
# ---------- code_block_25.designscript (6 lines) ----------
plane_1;
curve_1;
vector_1;
curve_2 = DesignScript.Curve.PullOntoPlane(curve_1, plane_1);
curve_3 = Autodesk.Geometry.Translate(curve_2@L1<1>, vector_1@L1<1>, [-135, -235]@L2<1>);
DesignScript.Curve.Reverse(curve_3);
# ----------------------------------------
code_block_26 = CodeBlock(curves=code_block_25.out5, rebarBarType=code_block_16, hostElement=code_block_17, vector=code_block_14.out9)
# ---------- code_block_26.designscript (18 lines) ----------
//curves
curves;
//rebarStyle
"Standard";
//rebarBarType
rebarBarType;
//startHookType
null;
//endHookType
null;
//startHookOrientation
"Right";
//endtHookOrientation
"Right";
//hostElement
hostElement;
//vector
vector;
# ----------------------------------------
fromCurves_2 = StructuralDesign.Rebar.Create.FromCurves(curves=code_block_26.curves@L1, rebarStyle=code_block_26.out1@L1, rebarBarType=code_block_26.rebarBarType@L1, startHookType=code_block_26.out3@L1, endHookType=code_block_26.out4@L1, startHookOrientation=code_block_26.out5@L1, endHookOrientation=code_block_26.out6@L1, hostElement=code_block_26.hostElement@L1, vector=code_block_26.vector@L1, lacing=Longest)
element_types_ᶜᵒⁿᵛᵉʳᵗᵉᵈ_ᵈʳᵒᵖᵈᵒʷⁿ_3 = CodeBlock { DSCore.Types.FindTypeByNameInAssembly("RebarShape", "RevitAPI"); }
all_elements_of_type_3 = ElementsOfType(element_type=element_types_ᶜᵒⁿᵛᵉʳᵗᵉᵈ_ᵈʳᵒᵖᵈᵒʷⁿ_3)
code_block_27 = CodeBlock(t1=all_elements_of_type_3)
# ---------- code_block_27.designscript (5 lines) ----------
"Shape";
str2 = Revit.Elements.Element.Name(t1);
t2 = str2 == "R_T_00";
t3 = DSCore.List.FilterByBoolMask(t1, t2);
t4 = Dictionary.ValueAtKey(t3, "in");
# ----------------------------------------
setParameterByName_3 = Element.SetParameterByName(element=fromCurves_2, parameterName=code_block_27.out0, value=code_block_27.t4, lacing=Longest)
setLayoutAsMaximumSpacing_2 = StructuralDesign.Rebar.Layout.SetLayoutAsMaximumSpacing(rebar=setParameterByName_3, spacing=code_block_20, arrayLength=length, lacing=Longest)
firstItem = List.FirstItem(list=setLayoutAsMaximumSpacing_2)
code_block_28 = CodeBlock()
# ---------- code_block_28.designscript (4 lines) ----------
family1 = Revit.Family.ByName("EST_A_STRUCTURAL REBAR TAG_CONFINAMIENTO");
familytype1 = Revit.Elements.FamilyType.ByFamilyAndName(family1, "R_T_00");
false;
true;
# ----------------------------------------
create_tag_2 = Custom[Create Tag](view=o_document_activeview_2@L1, element=firstItem@L1, TagLocation=code_block_22.tag_traba@L1, TagType=code_block_28.familytype1@L1, addLeader=code_block_28.out2@L1, RunIt=code_block_28.out3@L1, lacing=Longest)
flatten_2 = List.Flatten(list=create_tag_2)
code_block_29 = CodeBlock { "Orientation"; 1; }
setParameterByName_4 = Element.SetParameterByName(element=flatten_2, parameterName=code_block_29.out0, value=code_block_29.out1)
