# Dynamo graph estriboLateral1Segmento_script.dyn (Dynamo 2.6.2.15705)
# packages: Clockwork for Dynamo 2.x 2.4.0, Data-Shapes 2022.2.103, Genius Loci 2021.11.10, Structural Design 2021.1.22, archi-lab.net 2022.210.2419

current = Document.Current()
activeView = Document.ActiveView(document=current)
code_block = CodeBlock { "Seleccionar Vigas"; }
categories_ᶜᵒⁿᵛᵉʳᵗᵉᵈ_ᵈʳᵒᵖᵈᵒʷⁿ = CodeBlock()
# ---------- categories_ᶜᵒⁿᵛᵉʳᵗᵉᵈ_ᵈʳᵒᵖᵈᵒʷⁿ.designscript (8 lines) ----------
//InputName
"";
//ButtonText
"SELECCIONAR";
//CategoryFilter
Revit.Category.ByName("Structural Framing");
//SelectSingleElement
false;
# ----------------------------------------
selectmodelelements_data = Custom[SelectModelElements Data](InputName=categories_ᶜᵒⁿᵛᵉʳᵗᵉᵈ_ᵈʳᵒᵖᵈᵒʷⁿ.out0, ButtonText=categories_ᶜᵒⁿᵛᵉʳᵗᵉᵈ_ᵈʳᵒᵖᵈᵒʷⁿ.out1, CategoryFilter=categories_ᶜᵒⁿᵛᵉʳᵗᵉᵈ_ᵈʳᵒᵖᵈᵒʷⁿ.out2, SelectSingleElement=categories_ᶜᵒⁿᵛᵉʳᵗᵉᵈ_ᵈʳᵒᵖᵈᵒʷⁿ.out3)  # package Data-Shapes; Creates a Revit element selection input for UI.MultipleInputForm++ . Check out www.data-shapes.net for more infos!
inputgroup_data = Custom[InputGroup Data](GroupTitle=code_block, Inputs=selectmodelelements_data)  # package Data-Shapes; Creates a group of inputs for UI.MultipleInputForm ++ . Check out www.data-shapes.net for more infos !
code_block_2 = CodeBlock { "Estribos"; }
element_types_ᶜᵒⁿᵛᵉʳᵗᵉᵈ_ᵈʳᵒᵖᵈᵒʷⁿ = CodeBlock { DSCore.Types.FindTypeByNameInAssembly("RebarBarType", "RevitAPI"); }
all_elements_of_type = ElementsOfType(element_type=element_types_ᶜᵒⁿᵛᵉʳᵗᵉᵈ_ᵈʳᵒᵖᵈᵒʷⁿ)
code_block_3 = CodeBlock(elem_type=all_elements_of_type)
# ---------- code_block_3.designscript (15 lines) ----------
elem_type;
elem_type_diameter = Properties.RebarDiameter(elem_type);
elem_sorted = DSCore.List.SortByKey(elem_type, elem_type_diameter)["sorted list"];
elem_name = Revit.Elements.Element.Name(elem_sorted);

//InputName
"Diametro";
//Keys
elem_name;
//Values
elem_sorted;
//DefaultValueIndex
0;
//Sorted_optional
false;
# ----------------------------------------
dropdown_data = Custom[DropDown Data](InputName=code_block_3.out4, Keys=code_block_3.out5, Values=code_block_3.out6, DefaultValueIndex=code_block_3.out7, Sorted_optional=code_block_3.out8)  # package Data-Shapes; Create data for DropDown input in UI.MultiInputForm ++ . Check out www.data-shapes.net for more infos.
code_block_4 = CodeBlock()
# ---------- code_block_4.designscript (6 lines) ----------
//InputName
"Espaciamiento";
//DefaultText
"200";
//IsNumberEntry
true;
# ----------------------------------------
textbox_data = Custom[TextBox Data](InputName=code_block_4.out0, DefaultText=code_block_4.out1, IsNumberEntry=code_block_4.out2)  # package Data-Shapes; Create Data for TextBox input in UI.MultipleInputForm ++ . Check out www.data-shapes.net for more informations
list_create = List.Create(item0=dropdown_data, item1=textbox_data)
inputgroup_data_2 = Custom[InputGroup Data](GroupTitle=code_block_2, Inputs=list_create)
code_block_5 = CodeBlock { "Laterales"; }
element_types_ᶜᵒⁿᵛᵉʳᵗᵉᵈ_ᵈʳᵒᵖᵈᵒʷⁿ_2 = CodeBlock { DSCore.Types.FindTypeByNameInAssembly("RebarBarType", "RevitAPI"); }
all_elements_of_type_2 = ElementsOfType(element_type=element_types_ᶜᵒⁿᵛᵉʳᵗᵉᵈ_ᵈʳᵒᵖᵈᵒʷⁿ_2)
code_block_6 = CodeBlock(elem_type=all_elements_of_type_2)  # same code as code_block_3
dropdown_data_2 = Custom[DropDown Data](InputName=code_block_6.out4, Keys=code_block_6.out5, Values=code_block_6.out6, DefaultValueIndex=code_block_6.out7, Sorted_optional=code_block_6.out8)
inputgroup_data_3 = Custom[InputGroup Data](GroupTitle=code_block_5, Inputs=dropdown_data_2)
list_create_2 = List.Create(item0=inputgroup_data, item1=inputgroup_data_2, item2=inputgroup_data_3)
code_block_7 = CodeBlock(inputs=list_create_2)
# ---------- code_block_7.designscript (20 lines) ----------
//Description
"Estribos";
//Logo
"C:\\Arainco\\Arainco.png";
//ButtonText
"INICIAR";
//Inputs
inputs;
//Toggle
true;
//LinkToHelp
null;
//CancelButtonText
"CANCELAR";
//MaxHeight
0;
//Width
430;
//LabelWidth
170;
# ----------------------------------------
multipleinputform = Custom[MultipleInputForm ++](Description_optional=code_block_7.out0, Logo_optional=code_block_7.out1, ButtonText_optional=code_block_7.out2, Inputs=code_block_7.inputs, Toggle=code_block_7.out4, LinkToHelp_optional=code_block_7.out5, CancelButtonText_optional=code_block_7.out6, MaxHeight_optional=code_block_7.out7, Width_optional=code_block_7.out8, LabelWidth_optional=code_block_7.out9)  # package Data-Shapes; Create a form with multiple inputs. see www.data-shapes.net for tutorials and infos!
code_block_8 = CodeBlock(l=multipleinputform.User_Inputs)
# ---------- code_block_8.designscript (12 lines) ----------
l;
[Imperative]
{
	if (l == null)
	{
		return = [[],[],[],[],[],[],[],[],[],[]];
	}
	else
	{
		return = l;
	}
};
# ----------------------------------------
current_2 = Document.Current()

# group: 2 Barras
element_types_ᶜᵒⁿᵛᵉʳᵗᵉᵈ_ᵈʳᵒᵖᵈᵒʷⁿ_3 = CodeBlock { DSCore.Types.FindTypeByNameInAssembly("RebarHookType", "RevitAPI"); }
all_elements_of_type_3 = ElementsOfType(element_type=element_types_ᶜᵒⁿᵛᵉʳᵗᵉᵈ_ᵈʳᵒᵖᵈᵒʷⁿ_3)
activeView_2 = Document.ActiveView(document=current_2)
plane = Custom[View.Plane](view=activeView_2)  # package Clockwork for Dynamo 2.x; Retrieves the plane of a given view
code_block_9 = CodeBlock(x=code_block_8.out1, pata=all_elements_of_type_3, view_plane=plane)
# ---------- code_block_9.designscript (120 lines) ----------
elementos = x[0];
tipo_barra_extremos = x[1];
espaciamiento_extremos = x[2];
pata;
pata_names = Revit.Elements.Element.Name(pata);
mask = pata_names == "Stirrup/Tie - 135 deg.";
hook = DSCore.List.FilterByBoolMask(pata, mask)["in"][0];

//Obtener la cantidad de barras para definir cuantos estribos utilizar
rebar_cat = Revit.Category.ByName("Structural Rebar");
str_framing_rebars = Rhythm.Elements.DependentElementsOfCategory(elementos, rebar_cat);
str_framing_rebars_shapes = Revit.Elements.Element.GetParameterValueByName(str_framing_rebars, "Shape");
str_framing_rebars_shapes_names = Revit.Elements.Element.Name(str_framing_rebars_shapes);
str_framing_rebars_mask = DSCore.String.Contains(str_framing_rebars_shapes_names, "R_S_", false);
str_framing_rebars_R_S_ = DSCore.List.GetItemAtIndex(DSCore.List.FilterByBoolMask(str_framing_rebars, str_framing_rebars_mask)["in"]@L2<1>, 0);
str_framing_rebars_quantities = Revit.Elements.Element.GetParameterValueByName(str_framing_rebars_R_S_, "Quantity");

//filtro de elementos en funcion de la cantidad de barras
elementos_mask = str_framing_rebars_quantities == 2;
elem = DSCore.List.FilterByBoolMask(elementos, elementos_mask)["in"];


//Normal plano vista actual
view_plane_normal = Autodesk.Plane.Normal(view_plane);

//Variables para filtrar elementos por categoria
elem_category = Revit.Elements.Element.GetCategory(elem);
elem_category_name = Revit.Category.Name(elem_category);

//Filtrar vigas de hormigon paralelos a la vista actual
structural_framing_mask = elem_category_name == "Structural Framing";
structural_framing = DSCore.List.FilterByBoolMask(elem, structural_framing_mask)["in"];
structural_framing_material = DSCore.List.Flatten(Revit.Elements.Element.GetMaterials(structural_framing, false));
structural_framing_material_name = Revit.Material.Name(structural_framing_material);
structural_framing_material_mask = structural_framing_material_name == "Concrete, Cast-in-Place gray";
structural_framing_hormigon = DSCore.List.FilterByBoolMask(structural_framing, structural_framing_material_mask)["in"];
structural_framing_hormigon_location = Revit.Elements.Element.GetLocation(structural_framing_hormigon);
structural_framing_hormigon_vector = Line.Direction(structural_framing_hormigon_location);
structural_framing_hormigon_centroid = Autodesk.Solid.Centroid(DSCore.List.Flatten(Revit.Elements.Element.Geometry(structural_framing_hormigon)));
structural_framing_hormigon_coo_sys = Autodesk.Curve.CoordinateSystemAtParameter(structural_framing_hormigon_location);
structural_framing_hormigon_vector_mask = Autodesk.Vector.IsParallel(CoordinateSystem.XAxis(structural_framing_hormigon_coo_sys), view_plane_normal);
structural_framing_hormigon_lst = DSCore.List.FilterByBoolMask(structural_framing_hormigon, structural_framing_hormigon_vector_mask)["in"];
structural_framing_hormigon_lst_location = Revit.Elements.Element.GetLocation(structural_framing_hormigon_lst);
structural_framing_hormigon_lst_cut_len = Revit.Elements.Element.GetParameterValueByName(structural_framing_hormigon_lst, "Cut Length");
structural_framing_hormigon_lst_location_len = Autodesk.Curve.Length(structural_framing_hormigon_lst_location);
structural_framing_hormigon_lst_location_start_p = Autodesk.Curve.StartPoint(structural_framing_hormigon_lst_location);
structural_framing_hormigon_lst_location_end_p = Autodesk.Curve.EndPoint(structural_framing_hormigon_lst_location);
structural_framing_hormigon_lst_vector = Autodesk.Vector.ByTwoPoints(structural_framing_hormigon_lst_location_start_p, structural_framing_hormigon_lst_location_end_p);
structural_framing_hormigon_lst_vector_len = Autodesk.Vector.Length(structural_framing_hormigon_lst_vector);

//Altura de Vigas seleccionadas
elem_altura = Revit.Elements.Element.GetParameterValueByName(Revit.Elements.Element.GetParameterValueByName(elem, "Type"), "Height");

//Curva de las Vigas
elem_curve_inicial = Revit.Elements.Element.GetLocation(structural_framing_hormigon_lst);
elem_curve_inicial_len = DesignScript.Curve.Length(elem_curve_inicial);
dif_len = DSCore.Math.Abs(structural_framing_hormigon_lst_cut_len - structural_framing_hormigon_lst_location_len) / 2;
x_1 = Autodesk.Curve.ExtendEnd(Autodesk.Curve.ExtendStart(structural_framing_hormigon_lst_location, (dif_len + 50) * -1), (dif_len + 50) * -1);
x_2 = Autodesk.Curve.ExtendEnd(Autodesk.Curve.ExtendStart(structural_framing_hormigon_lst_location, (dif_len + 50) * -1), (dif_len + 50) * -1);

elem_curve = [Imperative]
{
	if(structural_framing_hormigon_lst_location_len >= structural_framing_hormigon_lst_cut_len)
	{
		return  x_1;
	}
	else
	{
		return  x_2;
	}
};
elem_curve_start_p = Autodesk.Curve.StartPoint(elem_curve);
elem_curve_end_p = Autodesk.Curve.EndPoint(elem_curve);
elem_curve_vector = Autodesk.Vector.ByTwoPoints(elem_curve_start_p, elem_curve_end_p);
elem_curve_vector_len = Autodesk.Vector.Length(elem_curve_vector);

//Geometria a Cortar
g_elem_solid = DSCore.List.Flatten(Revit.Elements.Element.Geometry(structural_framing_hormigon_lst));
g_solid_centroid = Autodesk.Solid.Centroid(g_elem_solid);
g_solid_coo_sys = Autodesk.Curve.CoordinateSystemAtParameter(structural_framing_hormigon_lst_location, 0.5);
g_solid_plane = CoordinateSystem.YZPlane(g_solid_coo_sys);
g_solid_scaled = Autodesk.Geometry.Scale(g_elem_solid, g_solid_plane, 5, 1, 1);

//Geometria Estribo
geom_param_at_point = DesignScript.Curve.ParameterAtPoint(elem_curve, elem_curve_start_p);
geom_plane_at_param = DesignScript.Curve.PlaneAtParameter(elem_curve, geom_param_at_point);
geom_surface = DSCore.List.Flatten(Autodesk.Geometry.Intersect(g_solid_scaled, geom_plane_at_param), -1);
geom_surface_perimeter = Autodesk.Surface.PerimeterCurves(geom_surface);
geom_surface_perimeter_as_polycurve = PolyCurve.ByJoinedCurves(geom_surface_perimeter);
geom_surface_perimeter_curves = Autodesk.Geometry.Explode(PolyCurve.Offset(geom_surface_perimeter_as_polycurve, -25, false));

//Estribos Extermos
tag_location = g_solid_centroid;
//curves
geom_surface_perimeter_curves;
//rebarStyle
"StirrupTie";
//rebarBarType
tipo_barra_extremos;
//startHookType
hook;
//endHookType
hook;
//startHookOrientation
"Left";
//endtHookOrientation
"Left";
//hostElement
structural_framing_hormigon_lst;
//vector
structural_framing_hormigon_lst_vector;
//spacing
espaciamiento_extremos;
//ArrayLength
elem_curve_vector_len;
//Punto para posicionar tag
tag_location;


//
# ----------------------------------------
fromCurves = StructuralDesign.Rebar.Create.FromCurves(curves=code_block_9.out61, rebarStyle=code_block_9.out62, rebarBarType=code_block_9.out63, startHookType=code_block_9.out64, endHookType=code_block_9.out65, startHookOrientation=code_block_9.out66, endHookOrientation=code_block_9.out67, hostElement=code_block_9.out68, vector=code_block_9.out69)
setLayoutAsMaximumSpacing = StructuralDesign.Rebar.Layout.SetLayoutAsMaximumSpacing(rebar=fromCurves, spacing=code_block_9.out70, arrayLength=code_block_9.out71, lacing=Longest)
code_block_10 = CodeBlock { "FirstLast"; }
setRebarPresentation = Custom[SetRebarPresentation](rebarElements=setLayoutAsMaximumSpacing, rebarRepresentation=code_block_10)  # Change de Rebar representation of the selected elements in the active view. Rebar Representations Options - All - FirstLast - Middle
flatten = List.Flatten(list=setRebarPresentation)
code_block_11 = CodeBlock(element=flatten, tag_location=code_block_9.out72)
# ---------- code_block_11.designscript (19 lines) ----------
//Asigna el tipo de estribo (sim, doble, etc...)
Revit.Elements.Element.SetParameterByName(element, "Estribo", "E.");
tag_location;

//element
element;
//TagLocation
tag_location;
//TagType
family = Revit.Family.ByName("EST_A_STRUCTURAL REBAR TAG_ESTRIBO");
tag_type = Revit.Elements.FamilyType.ByFamilyAndName(family, "R_E_00");
//horizontal
true;
//addLeader
false;
//LinkInstance
null;
//RunIt
true;
# ----------------------------------------
create_tag = Custom[Create Tag](view=activeView@L1, element=code_block_11.out2@L2, TagLocation=code_block_11.out3@L2, TagType=code_block_11.out5@L1, horizontal=code_block_11.out6@L1, addLeader=code_block_11.out7@L1, LinkInstance=code_block_11.out8@L1, RunIt=code_block_11.out9@L1, lacing=Longest)  # package Genius Loci; Works only in Revit 2018 and later. Creates a tag at a given location, of given type and in a supplied view. The node also works with Linked Elements (except space and area), Multi Category tag and Material Tag. Based on an archilab node

current_3 = Document.Current()
activeView_3 = Document.ActiveView(document=current_3)

# group: 3 Barras
element_types_ᶜᵒⁿᵛᵉʳᵗᵉᵈ_ᵈʳᵒᵖᵈᵒʷⁿ_4 = CodeBlock { DSCore.Types.FindTypeByNameInAssembly("RebarHookType", "RevitAPI"); }
all_elements_of_type_4 = ElementsOfType(element_type=element_types_ᶜᵒⁿᵛᵉʳᵗᵉᵈ_ᵈʳᵒᵖᵈᵒʷⁿ_4)
current_4 = Document.Current()
activeView_4 = Document.ActiveView(document=current_4)
plane_2 = Custom[View.Plane](view=activeView_4)
code_block_12 = CodeBlock(x=code_block_8.out1, pata=all_elements_of_type_4, view_plane=plane_2)
# ---------- code_block_12.designscript (120 lines) ----------
elementos = x[0];
tipo_barra_extremos = x[1];
espaciamiento_extremos = x[2];
pata;
pata_names = Revit.Elements.Element.Name(pata);
mask = pata_names == "Stirrup/Tie - 135 deg.";
hook = DSCore.List.FilterByBoolMask(pata, mask)["in"][0];

//Obtener la cantidad de barras para definir cuantos estribos utilizar
rebar_cat = Revit.Category.ByName("Structural Rebar");
str_framing_rebars = Rhythm.Elements.DependentElementsOfCategory(elementos, rebar_cat);
str_framing_rebars_shapes = Revit.Elements.Element.GetParameterValueByName(str_framing_rebars, "Shape");
str_framing_rebars_shapes_names = Revit.Elements.Element.Name(str_framing_rebars_shapes);
str_framing_rebars_mask = DSCore.String.Contains(str_framing_rebars_shapes_names, "R_S_", false);
str_framing_rebars_R_S_ = DSCore.List.GetItemAtIndex(DSCore.List.FilterByBoolMask(str_framing_rebars, str_framing_rebars_mask)["in"]@L2<1>, 0);
str_framing_rebars_quantities = Revit.Elements.Element.GetParameterValueByName(str_framing_rebars_R_S_, "Quantity");

//filtro de elementos en funcion de la cantidad de barras
elementos_mask = str_framing_rebars_quantities == 3;
elem = DSCore.List.FilterByBoolMask(elementos, elementos_mask)["in"];


//Normal plano vista actual
view_plane_normal = Autodesk.Plane.Normal(view_plane);

//Variables para filtrar elementos por categoria
elem_category = Revit.Elements.Element.GetCategory(elem);
elem_category_name = Revit.Category.Name(elem_category);

//Filtrar vigas de hormigon paralelos a la vista actual
structural_framing_mask = elem_category_name == "Structural Framing";
structural_framing = DSCore.List.FilterByBoolMask(elem, structural_framing_mask)["in"];
structural_framing_material = DSCore.List.Flatten(Revit.Elements.Element.GetMaterials(structural_framing, false));
structural_framing_material_name = Revit.Material.Name(structural_framing_material);
structural_framing_material_mask = structural_framing_material_name == "Concrete, Cast-in-Place gray";
structural_framing_hormigon = DSCore.List.FilterByBoolMask(structural_framing, structural_framing_material_mask)["in"];
structural_framing_hormigon_location = Revit.Elements.Element.GetLocation(structural_framing_hormigon);
structural_framing_hormigon_vector = Line.Direction(structural_framing_hormigon_location);
structural_framing_hormigon_centroid = Autodesk.Solid.Centroid(DSCore.List.Flatten(Revit.Elements.Element.Geometry(structural_framing_hormigon)));
structural_framing_hormigon_coo_sys = Autodesk.Curve.CoordinateSystemAtParameter(structural_framing_hormigon_location);
structural_framing_hormigon_vector_mask = Autodesk.Vector.IsParallel(CoordinateSystem.XAxis(structural_framing_hormigon_coo_sys), view_plane_normal);
structural_framing_hormigon_lst = DSCore.List.FilterByBoolMask(structural_framing_hormigon, structural_framing_hormigon_vector_mask)["in"];
structural_framing_hormigon_lst_location = Revit.Elements.Element.GetLocation(structural_framing_hormigon_lst);
structural_framing_hormigon_lst_cut_len = Revit.Elements.Element.GetParameterValueByName(structural_framing_hormigon_lst, "Cut Length");
structural_framing_hormigon_lst_location_len = Autodesk.Curve.Length(structural_framing_hormigon_lst_location);
structural_framing_hormigon_lst_location_start_p = Autodesk.Curve.StartPoint(structural_framing_hormigon_lst_location);
structural_framing_hormigon_lst_location_end_p = Autodesk.Curve.EndPoint(structural_framing_hormigon_lst_location);
structural_framing_hormigon_lst_vector = Autodesk.Vector.ByTwoPoints(structural_framing_hormigon_lst_location_start_p, structural_framing_hormigon_lst_location_end_p);
structural_framing_hormigon_lst_vector_len = Autodesk.Vector.Length(structural_framing_hormigon_lst_vector);

//Altura de Vigas seleccionadas
elem_altura = Revit.Elements.Element.GetParameterValueByName(Revit.Elements.Element.GetParameterValueByName(elem, "Type"), "Height");

//Curva de las Vigas
elem_curve_inicial = Revit.Elements.Element.GetLocation(structural_framing_hormigon_lst);
elem_curve_inicial_len = DesignScript.Curve.Length(elem_curve_inicial);
dif_len = DSCore.Math.Abs(structural_framing_hormigon_lst_cut_len - structural_framing_hormigon_lst_location_len) / 2;
x_1 = Autodesk.Curve.ExtendEnd(Autodesk.Curve.ExtendStart(structural_framing_hormigon_lst_location, (dif_len + 50) * -1), (dif_len + 50) * -1);
x_2 = Autodesk.Curve.ExtendEnd(Autodesk.Curve.ExtendStart(structural_framing_hormigon_lst_location, (dif_len + 50) * -1), (dif_len + 50) * -1);

elem_curve = [Imperative]
{
	if(structural_framing_hormigon_lst_location_len >= structural_framing_hormigon_lst_cut_len)
	{
		return  x_1;
	}
	else
	{
		return  x_2;
	}
};
elem_curve_start_p = Autodesk.Curve.StartPoint(elem_curve);
elem_curve_end_p = Autodesk.Curve.EndPoint(elem_curve);
elem_curve_vector = Autodesk.Vector.ByTwoPoints(elem_curve_start_p, elem_curve_end_p);
elem_curve_vector_len = Autodesk.Vector.Length(elem_curve_vector);

//Geometria a Cortar
g_elem_solid = DSCore.List.Flatten(Revit.Elements.Element.Geometry(structural_framing_hormigon_lst));
g_solid_centroid = Autodesk.Solid.Centroid(g_elem_solid);
g_solid_coo_sys = Autodesk.Curve.CoordinateSystemAtParameter(structural_framing_hormigon_lst_location, 0.5);
g_solid_plane = CoordinateSystem.YZPlane(g_solid_coo_sys);
g_solid_scaled = Autodesk.Geometry.Scale(g_elem_solid, g_solid_plane, 5, 1, 1);

//Geometria Estribo
geom_param_at_point = DesignScript.Curve.ParameterAtPoint(elem_curve, elem_curve_start_p);
geom_plane_at_param = DesignScript.Curve.PlaneAtParameter(elem_curve, geom_param_at_point);
geom_surface = DSCore.List.Flatten(Autodesk.Geometry.Intersect(g_solid_scaled, geom_plane_at_param), -1);
geom_surface_perimeter = Autodesk.Surface.PerimeterCurves(geom_surface);
geom_surface_perimeter_as_polycurve = PolyCurve.ByJoinedCurves(geom_surface_perimeter);
geom_surface_perimeter_curves = Autodesk.Geometry.Explode(PolyCurve.Offset(geom_surface_perimeter_as_polycurve, -25, false));

//Estribos Extermos
tag_location = g_solid_centroid;
//curves
geom_surface_perimeter_curves;
//rebarStyle
"StirrupTie";
//rebarBarType
tipo_barra_extremos;
//startHookType
hook;
//endHookType
hook;
//startHookOrientation
"Left";
//endtHookOrientation
"Left";
//hostElement
structural_framing_hormigon_lst;
//vector
structural_framing_hormigon_lst_vector;
//spacing
espaciamiento_extremos;
//ArrayLength
elem_curve_vector_len;
//Punto para posicionar tag
tag_location;


//
# ----------------------------------------
fromCurves_2 = StructuralDesign.Rebar.Create.FromCurves(curves=code_block_12.out61, rebarStyle=code_block_12.out62, rebarBarType=code_block_12.out63, startHookType=code_block_12.out64, endHookType=code_block_12.out65, startHookOrientation=code_block_12.out66, endHookOrientation=code_block_12.out67, hostElement=code_block_12.out68, vector=code_block_12.out69)
setLayoutAsMaximumSpacing_2 = StructuralDesign.Rebar.Layout.SetLayoutAsMaximumSpacing(rebar=fromCurves_2, spacing=code_block_12.out70, arrayLength=code_block_12.out71, lacing=Longest)
code_block_13 = CodeBlock { "FirstLast"; }
setRebarPresentation_2 = Custom[SetRebarPresentation](rebarElements=setLayoutAsMaximumSpacing_2, rebarRepresentation=code_block_13)
flatten_2 = List.Flatten(list=setRebarPresentation_2)
code_block_14 = CodeBlock(element=flatten_2, tag_location=code_block_12.out72)  # same code as code_block_11
create_tag_2 = Custom[Create Tag](view=activeView_3@L1, element=code_block_14.out2@L2, TagLocation=code_block_14.out3@L2, TagType=code_block_14.out5@L1, horizontal=code_block_14.out6@L1, addLeader=code_block_14.out7@L1, LinkInstance=code_block_14.out8@L1, RunIt=code_block_14.out9@L1, lacing=Longest)

current_5 = Document.Current()
activeView_5 = Document.ActiveView(document=current_5)

# group: 4 Barras
element_types_ᶜᵒⁿᵛᵉʳᵗᵉᵈ_ᵈʳᵒᵖᵈᵒʷⁿ_5 = CodeBlock { DSCore.Types.FindTypeByNameInAssembly("RebarHookType", "RevitAPI"); }
all_elements_of_type_5 = ElementsOfType(element_type=element_types_ᶜᵒⁿᵛᵉʳᵗᵉᵈ_ᵈʳᵒᵖᵈᵒʷⁿ_5)
current_6 = Document.Current()
activeView_6 = Document.ActiveView(document=current_6)
plane_3 = Custom[View.Plane](view=activeView_6)
code_block_15 = CodeBlock(x=code_block_8.out1, pata=all_elements_of_type_5, view_plane=plane_3)
# ---------- code_block_15.designscript (171 lines) ----------
elementos = x[0];
tipo_barra_extremos = x[1];
espaciamiento_extremos = x[2];
pata;
pata_names = Revit.Elements.Element.Name(pata);
mask = pata_names == "Stirrup/Tie - 135 deg.";
hook = DSCore.List.FilterByBoolMask(pata, mask)["in"][0];

//Obtener la cantidad de barras para definir cuantos estribos utilizar
rebar_cat = Revit.Category.ByName("Structural Rebar");
str_framing_rebars = Rhythm.Elements.DependentElementsOfCategory(elementos, rebar_cat);
str_framing_rebars_shapes = Revit.Elements.Element.GetParameterValueByName(str_framing_rebars, "Shape");
str_framing_rebars_shapes_names = Revit.Elements.Element.Name(str_framing_rebars_shapes);
str_framing_rebars_mask = DSCore.String.Contains(str_framing_rebars_shapes_names, "R_S_", false);
str_framing_rebars_R_S_ = DSCore.List.GetItemAtIndex(DSCore.List.FilterByBoolMask(str_framing_rebars, str_framing_rebars_mask)["in"]@L2<1>, 0);
str_framing_rebars_quantities = Revit.Elements.Element.GetParameterValueByName(str_framing_rebars_R_S_, "Quantity");

//filtro de elementos en funcion de la cantidad de barras
elementos_mask = str_framing_rebars_quantities == 4;
elem = DSCore.List.FilterByBoolMask(elementos, elementos_mask)["in"];

//Normal plano vista actual
view_plane_normal = Autodesk.Plane.Normal(view_plane);

//Variables para filtrar elementos por categoria
elem_category = Revit.Elements.Element.GetCategory(elem);
elem_category_name = Revit.Category.Name(elem_category);

//Filtrar vigas de hormigon paralelos a la vista actual
structural_framing_mask = elem_category_name == "Structural Framing";
structural_framing = DSCore.List.FilterByBoolMask(elem, structural_framing_mask)["in"];
structural_framing_material = DSCore.List.Flatten(Revit.Elements.Element.GetMaterials(structural_framing, false));
structural_framing_material_name = Revit.Material.Name(structural_framing_material);
structural_framing_material_mask = structural_framing_material_name == "Concrete, Cast-in-Place gray";
structural_framing_hormigon = DSCore.List.FilterByBoolMask(structural_framing, structural_framing_material_mask)["in"];
structural_framing_hormigon_location = Revit.Elements.Element.GetLocation(structural_framing_hormigon);
structural_framing_hormigon_vector = Line.Direction(structural_framing_hormigon_location);
structural_framing_hormigon_centroid = Autodesk.Solid.Centroid(DSCore.List.Flatten(Revit.Elements.Element.Geometry(structural_framing_hormigon)));
structural_framing_hormigon_coo_sys = Autodesk.Curve.CoordinateSystemAtParameter(structural_framing_hormigon_location);
structural_framing_hormigon_vector_mask = Autodesk.Vector.IsParallel(CoordinateSystem.XAxis(structural_framing_hormigon_coo_sys), view_plane_normal);
structural_framing_hormigon_lst = DSCore.List.FilterByBoolMask(structural_framing_hormigon, structural_framing_hormigon_vector_mask)["in"];
structural_framing_hormigon_lst_location = Revit.Elements.Element.GetLocation(structural_framing_hormigon_lst);
structural_framing_hormigon_lst_cut_len = Revit.Elements.Element.GetParameterValueByName(structural_framing_hormigon_lst, "Cut Length");
structural_framing_hormigon_lst_location_len = Autodesk.Curve.Length(structural_framing_hormigon_lst_location);
structural_framing_hormigon_lst_location_start_p = Autodesk.Curve.StartPoint(structural_framing_hormigon_lst_location);
structural_framing_hormigon_lst_location_end_p = Autodesk.Curve.EndPoint(structural_framing_hormigon_lst_location);
structural_framing_hormigon_lst_vector = Autodesk.Vector.ByTwoPoints(structural_framing_hormigon_lst_location_start_p, structural_framing_hormigon_lst_location_end_p);
structural_framing_hormigon_lst_vector_len = Autodesk.Vector.Length(structural_framing_hormigon_lst_vector);

//Altura de Vigas seleccionadas
elem_altura = Revit.Elements.Element.GetParameterValueByName(Revit.Elements.Element.GetParameterValueByName(elem, "Type"), "Height");

//Curva de las Vigas
elem_curve_inicial = Revit.Elements.Element.GetLocation(structural_framing_hormigon_lst);
elem_curve_inicial_len = DesignScript.Curve.Length(elem_curve_inicial);
dif_len = DSCore.Math.Abs(structural_framing_hormigon_lst_cut_len - structural_framing_hormigon_lst_location_len) / 2;
x_1 = Autodesk.Curve.ExtendEnd(Autodesk.Curve.ExtendStart(structural_framing_hormigon_lst_location, (dif_len + 50) * -1), (dif_len + 50) * -1);
x_2 = Autodesk.Curve.ExtendEnd(Autodesk.Curve.ExtendStart(structural_framing_hormigon_lst_location, (dif_len + 50) * -1), (dif_len + 50) * -1);

elem_curve = [Imperative]
{
	if(structural_framing_hormigon_lst_location_len >= structural_framing_hormigon_lst_cut_len)
	{
		return  x_1;
	}
	else
	{
		return  x_2;
	}
};
elem_curve_start_p = Autodesk.Curve.StartPoint(elem_curve);
elem_curve_end_p = Autodesk.Curve.EndPoint(elem_curve);
elem_curve_vector = Autodesk.Vector.ByTwoPoints(elem_curve_start_p, elem_curve_end_p);
elem_curve_vector_len = Autodesk.Vector.Length(elem_curve_vector);

//Geometria a Cortar
g_elem_solid = DSCore.List.Flatten(Revit.Elements.Element.Geometry(structural_framing_hormigon_lst));
g_solid_centroid = Autodesk.Solid.Centroid(g_elem_solid);
g_solid_coo_sys = Autodesk.Curve.CoordinateSystemAtParameter(structural_framing_hormigon_lst_location, 0.5);
g_solid_plane = CoordinateSystem.YZPlane(g_solid_coo_sys);
g_solid_scaled = Autodesk.Geometry.Scale(g_elem_solid, g_solid_plane, 5, 1, 1);

//Geometria Estribo
geom_param_at_point = DesignScript.Curve.ParameterAtPoint(elem_curve, elem_curve_start_p);
geom_plane_at_param = DesignScript.Curve.PlaneAtParameter(elem_curve, geom_param_at_point);
geom_surface = DSCore.List.Flatten(Autodesk.Geometry.Intersect(g_solid_scaled, geom_plane_at_param), -1);
geom_surface_perimeter = Autodesk.Surface.PerimeterCurves(geom_surface);
geom_surface_perimeter_as_polycurve = PolyCurve.Offset(PolyCurve.ByJoinedCurves(geom_surface_perimeter), -25, false);
geom_surface_offset = Autodesk.Surface.ByPatch(geom_surface_perimeter_as_polycurve);
//Estribo 1
geom_surface_coo_sys_1 = Autodesk.Surface.CoordinateSystemAtParameter(geom_surface_offset, 0, 0.6935);
geom_surface_cut_plane_1 = CoordinateSystem.ZXPlane(geom_surface_coo_sys_1);
geom_surface_split_1 = Autodesk.Geometry.Split(geom_surface_offset, geom_surface_cut_plane_1);
geom_surface_1 = DSCore.List.GetItemAtIndex(geom_surface_split_1@L2<1>, 1);
geom_surface_perimeter_1 = Autodesk.Surface.PerimeterCurves(geom_surface_1);
geom_surface_perimeter_as_polycurve_1 = PolyCurve.ByJoinedCurves(geom_surface_perimeter_1);
geom_surface_perimeter_curves_1 = Autodesk.Geometry.Explode(geom_surface_perimeter_as_polycurve_1);
//Estribo 2
geom_surface_coo_sys_2 = Autodesk.Surface.CoordinateSystemAtParameter(geom_surface_offset, 0, 0.3065);
geom_surface_cut_plane_2 = CoordinateSystem.ZXPlane(geom_surface_coo_sys_2);
geom_surface_split_2 = Autodesk.Geometry.Split(geom_surface_offset, geom_surface_cut_plane_2);
geom_surface_2 = DSCore.List.GetItemAtIndex(geom_surface_split_2@L2<1>, 0);
geom_surface_perimeter_2 = Autodesk.Surface.PerimeterCurves(geom_surface_2);
geom_surface_perimeter_as_polycurve_2 = PolyCurve.ByJoinedCurves(geom_surface_perimeter_2);
geom_surface_perimeter_curves_2 = Autodesk.Geometry.Explode(geom_surface_perimeter_as_polycurve_2);

geom_surface_perimeter_curves_lst = [geom_surface_perimeter_curves_1, geom_surface_perimeter_curves_2];

//Estribos 1
tag_location = g_solid_centroid;
//curves
geom_surface_perimeter_curves_1;
//rebarStyle
"StirrupTie";
//rebarBarType
tipo_barra_extremos;
//startHookType
hook;
//endHookType
hook;
//startHookOrientation
"Right";
//endtHookOrientation
"Right";
//hostElement
structural_framing_hormigon_lst;
//vector
structural_framing_hormigon_lst_vector;
//spacing
espaciamiento_extremos;
//ArrayLength
elem_curve_vector_len;
//Punto para posicionar tag
tag_location;










//Estribos 2
//curves
geom_surface_perimeter_curves_2;
//rebarStyle
"StirrupTie";
//rebarBarType
tipo_barra_extremos;
//startHookType
hook;
//endHookType
hook;
//startHookOrientation
"Left";
//endtHookOrientation
"Left";
//hostElement
structural_framing_hormigon_lst;
//vector
structural_framing_hormigon_lst_vector;
//spacing
espaciamiento_extremos;
//ArrayLength
elem_curve_vector_len;
//Punto para posicionar tag
tag_location;

//
# ----------------------------------------
fromCurves_3 = StructuralDesign.Rebar.Create.FromCurves(curves=code_block_15.out76, rebarStyle=code_block_15.out77, rebarBarType=code_block_15.out78, startHookType=code_block_15.out79, endHookType=code_block_15.out80, startHookOrientation=code_block_15.out81, endHookOrientation=code_block_15.out82, hostElement=code_block_15.out83, vector=code_block_15.out84)
setLayoutAsMaximumSpacing_3 = StructuralDesign.Rebar.Layout.SetLayoutAsMaximumSpacing(rebar=fromCurves_3, spacing=code_block_15.out85, arrayLength=code_block_15.out86, lacing=Longest)
code_block_16 = CodeBlock { "FirstLast"; }
setRebarPresentation_3 = Custom[SetRebarPresentation](rebarElements=setLayoutAsMaximumSpacing_3, rebarRepresentation=code_block_16)
flatten_3 = List.Flatten(list=setRebarPresentation_3)
code_block_17 = CodeBlock(element=flatten_3, tag_location=code_block_15.out87)
# ---------- code_block_17.designscript (19 lines) ----------
//Asigna el tipo de estribo (sim, doble, etc...)
Revit.Elements.Element.SetParameterByName(element, "Estribo", "ED.");
tag_location;

//element
element;
//TagLocation
tag_location;
//TagType
family = Revit.Family.ByName("EST_A_STRUCTURAL REBAR TAG_ESTRIBO");
tag_type = Revit.Elements.FamilyType.ByFamilyAndName(family, "R_E_00");
//horizontal
true;
//addLeader
false;
//LinkInstance
null;
//RunIt
true;
# ----------------------------------------
create_tag_3 = Custom[Create Tag](view=activeView_5@L1, element=code_block_17.out2@L2, TagLocation=code_block_17.out3@L2, TagType=code_block_17.out5@L1, horizontal=code_block_17.out6@L1, addLeader=code_block_17.out7@L1, LinkInstance=code_block_17.out8@L1, RunIt=code_block_17.out9@L1, lacing=Longest)
fromCurves_4 = StructuralDesign.Rebar.Create.FromCurves(curves=code_block_15.out88, rebarStyle=code_block_15.out89, rebarBarType=code_block_15.out90, startHookType=code_block_15.out91, endHookType=code_block_15.out92, startHookOrientation=code_block_15.out93, endHookOrientation=code_block_15.out94, hostElement=code_block_15.out95, vector=code_block_15.out96)
setLayoutAsMaximumSpacing_4 = StructuralDesign.Rebar.Layout.SetLayoutAsMaximumSpacing(rebar=fromCurves_4, spacing=code_block_15.out97, arrayLength=code_block_15.out98, lacing=Longest)
code_block_18 = CodeBlock { "FirstLast"; }
setRebarPresentation_4 = Custom[SetRebarPresentation](rebarElements=setLayoutAsMaximumSpacing_4, rebarRepresentation=code_block_18)
flatten_4 = List.Flatten(list=setRebarPresentation_4)
code_block_19 = CodeBlock(element=flatten_4)
# ---------- code_block_19.designscript (2 lines) ----------
//Asigna el tipo de estribo (sim, doble, etc...)
Revit.Elements.Element.SetParameterByName(element, "Estribo", "ED.");
# ----------------------------------------

current_7 = Document.Current()
activeView_7 = Document.ActiveView(document=current_7)

# group: 5 Barras
current_8 = Document.Current()
activeView_8 = Document.ActiveView(document=current_8)
element_types_ᶜᵒⁿᵛᵉʳᵗᵉᵈ_ᵈʳᵒᵖᵈᵒʷⁿ_6 = CodeBlock { DSCore.Types.FindTypeByNameInAssembly("RebarHookType", "RevitAPI"); }
all_elements_of_type_6 = ElementsOfType(element_type=element_types_ᶜᵒⁿᵛᵉʳᵗᵉᵈ_ᵈʳᵒᵖᵈᵒʷⁿ_6)
plane_4 = Custom[View.Plane](view=activeView_8)
code_block_20 = CodeBlock(x=code_block_8.out1, pata=all_elements_of_type_6, view_plane=plane_4)
# ---------- code_block_20.designscript (174 lines) ----------
elementos = x[0];
tipo_barra_extremos = x[1];
espaciamiento_extremos = x[2];
pata;
pata_names = Revit.Elements.Element.Name(pata);
mask = pata_names == "Stirrup/Tie - 135 deg.";
hook = DSCore.List.FilterByBoolMask(pata, mask)["in"][0];

//Obtener la cantidad de barras para definir cuantos estribos utilizar
rebar_cat = Revit.Category.ByName("Structural Rebar");
str_framing_rebars = Rhythm.Elements.DependentElementsOfCategory(elementos, rebar_cat);
str_framing_rebars_shapes = Revit.Elements.Element.GetParameterValueByName(str_framing_rebars, "Shape");
str_framing_rebars_shapes_names = Revit.Elements.Element.Name(str_framing_rebars_shapes);
str_framing_rebars_mask = DSCore.String.Contains(str_framing_rebars_shapes_names, "R_S_", false);
str_framing_rebars_R_S_ = DSCore.List.GetItemAtIndex(DSCore.List.FilterByBoolMask(str_framing_rebars, str_framing_rebars_mask)["in"]@L2<1>, 0);
str_framing_rebars_quantities = Revit.Elements.Element.GetParameterValueByName(str_framing_rebars_R_S_, "Quantity");

//filtro de elementos en funcion de la cantidad de barras
elementos_mask = str_framing_rebars_quantities == 5;
elem = DSCore.List.FilterByBoolMask(elementos, elementos_mask)["in"];

//Normal plano vista actual
view_plane_normal = Autodesk.Plane.Normal(view_plane);

//Variables para filtrar elementos por categoria
elem_category = Revit.Elements.Element.GetCategory(elem);
elem_category_name = Revit.Category.Name(elem_category);

//Filtrar vigas de hormigon paralelos a la vista actual
structural_framing_mask = elem_category_name == "Structural Framing";
structural_framing = DSCore.List.FilterByBoolMask(elem, structural_framing_mask)["in"];
structural_framing_material = DSCore.List.Flatten(Revit.Elements.Element.GetMaterials(structural_framing, false));
structural_framing_material_name = Revit.Material.Name(structural_framing_material);
structural_framing_material_mask = structural_framing_material_name == "Concrete, Cast-in-Place gray";
structural_framing_hormigon = DSCore.List.FilterByBoolMask(structural_framing, structural_framing_material_mask)["in"];
structural_framing_hormigon_location = Revit.Elements.Element.GetLocation(structural_framing_hormigon);
structural_framing_hormigon_vector = Line.Direction(structural_framing_hormigon_location);
structural_framing_hormigon_centroid = Autodesk.Solid.Centroid(DSCore.List.Flatten(Revit.Elements.Element.Geometry(structural_framing_hormigon)));
structural_framing_hormigon_coo_sys = Autodesk.Curve.CoordinateSystemAtParameter(structural_framing_hormigon_location);
structural_framing_hormigon_vector_mask = Autodesk.Vector.IsParallel(CoordinateSystem.XAxis(structural_framing_hormigon_coo_sys), view_plane_normal);
structural_framing_hormigon_lst = DSCore.List.FilterByBoolMask(structural_framing_hormigon, structural_framing_hormigon_vector_mask)["in"];
structural_framing_hormigon_lst_location = Revit.Elements.Element.GetLocation(structural_framing_hormigon_lst);
structural_framing_hormigon_lst_cut_len = Revit.Elements.Element.GetParameterValueByName(structural_framing_hormigon_lst, "Cut Length");
structural_framing_hormigon_lst_location_len = Autodesk.Curve.Length(structural_framing_hormigon_lst_location);
structural_framing_hormigon_lst_location_start_p = Autodesk.Curve.StartPoint(structural_framing_hormigon_lst_location);
structural_framing_hormigon_lst_location_end_p = Autodesk.Curve.EndPoint(structural_framing_hormigon_lst_location);
structural_framing_hormigon_lst_vector = Autodesk.Vector.ByTwoPoints(structural_framing_hormigon_lst_location_start_p, structural_framing_hormigon_lst_location_end_p);
structural_framing_hormigon_lst_vector_len = Autodesk.Vector.Length(structural_framing_hormigon_lst_vector);

//Altura de Vigas seleccionadas
elem_altura = Revit.Elements.Element.GetParameterValueByName(Revit.Elements.Element.GetParameterValueByName(elem, "Type"), "Height");

//Curva de las Vigas
elem_curve_inicial = Revit.Elements.Element.GetLocation(structural_framing_hormigon_lst);
elem_curve_inicial_len = DesignScript.Curve.Length(elem_curve_inicial);
dif_len = DSCore.Math.Abs(structural_framing_hormigon_lst_cut_len - structural_framing_hormigon_lst_location_len) / 2;
x_1 = Autodesk.Curve.ExtendEnd(Autodesk.Curve.ExtendStart(structural_framing_hormigon_lst_location, (dif_len + 50) * -1), (dif_len + 50) * -1);
x_2 = Autodesk.Curve.ExtendEnd(Autodesk.Curve.ExtendStart(structural_framing_hormigon_lst_location, (dif_len + 50) * -1), (dif_len + 50) * -1);

elem_curve = [Imperative]
{
	if(structural_framing_hormigon_lst_location_len >= structural_framing_hormigon_lst_cut_len)
	{
		return  x_1;
	}
	else
	{
		return  x_2;
	}
};
elem_curve_start_p = Autodesk.Curve.StartPoint(elem_curve);
elem_curve_end_p = Autodesk.Curve.EndPoint(elem_curve);
elem_curve_vector = Autodesk.Vector.ByTwoPoints(elem_curve_start_p, elem_curve_end_p);
elem_curve_vector_len = Autodesk.Vector.Length(elem_curve_vector);

//Geometria a Cortar
g_elem_solid = DSCore.List.Flatten(Revit.Elements.Element.Geometry(structural_framing_hormigon_lst));
g_solid_centroid = Autodesk.Solid.Centroid(g_elem_solid);
g_solid_coo_sys = Autodesk.Curve.CoordinateSystemAtParameter(structural_framing_hormigon_lst_location, 0.5);
g_solid_plane = CoordinateSystem.YZPlane(g_solid_coo_sys);
g_solid_scaled = Autodesk.Geometry.Scale(g_elem_solid, g_solid_plane, 5, 1, 1);

//Geometria Estribo
geom_param_at_point = DesignScript.Curve.ParameterAtPoint(elem_curve, elem_curve_start_p);
geom_plane_at_param = DesignScript.Curve.PlaneAtParameter(elem_curve, geom_param_at_point);
geom_surface = DSCore.List.Flatten(Autodesk.Geometry.Intersect(g_solid_scaled, geom_plane_at_param), -1);
geom_surface_perimeter = Autodesk.Surface.PerimeterCurves(geom_surface);
geom_surface_perimeter_as_polycurve = PolyCurve.Offset(PolyCurve.ByJoinedCurves(geom_surface_perimeter), -25, false);
geom_surface_offset = Autodesk.Surface.ByPatch(geom_surface_perimeter_as_polycurve);
//Estribo 1
geom_surface_coo_sys_1 = Autodesk.Surface.CoordinateSystemAtParameter(geom_surface_offset, 0, 0.76715);
geom_surface_cut_plane_1 = CoordinateSystem.ZXPlane(geom_surface_coo_sys_1);
geom_surface_split_1 = Autodesk.Geometry.Split(geom_surface_offset, geom_surface_cut_plane_1);
geom_surface_1 = DSCore.List.GetItemAtIndex(geom_surface_split_1@L2<1>, 1);
geom_surface_perimeter_1 = Autodesk.Surface.PerimeterCurves(geom_surface_1);
geom_surface_perimeter_as_polycurve_1 = PolyCurve.ByJoinedCurves(geom_surface_perimeter_1);
geom_surface_perimeter_curves_1 = Autodesk.Geometry.Explode(geom_surface_perimeter_as_polycurve_1);
//Estribo 2
geom_surface_coo_sys_2 = Autodesk.Surface.CoordinateSystemAtParameter(geom_surface_offset, 0, 0.23285);
geom_surface_cut_plane_2 = CoordinateSystem.ZXPlane(geom_surface_coo_sys_2);
geom_surface_split_2 = Autodesk.Geometry.Split(geom_surface_offset, geom_surface_cut_plane_2);
geom_surface_2 = DSCore.List.GetItemAtIndex(geom_surface_split_2@L2<1>, 0);
geom_surface_perimeter_2 = Autodesk.Surface.PerimeterCurves(geom_surface_2);
geom_surface_perimeter_as_polycurve_2 = PolyCurve.ByJoinedCurves(geom_surface_perimeter_2);
geom_surface_perimeter_curves_2 = Autodesk.Geometry.Explode(geom_surface_perimeter_as_polycurve_2);
//Traba
geom_surface_coo_sys_3 = Autodesk.Surface.CoordinateSystemAtParameter(geom_surface_offset, 0, 0.454257);
geom_surface_cut_plane_3 = CoordinateSystem.ZXPlane(geom_surface_coo_sys_3);
geom_surface_intersect_3 = Autodesk.Geometry.Intersect(geom_surface_offset, geom_surface_cut_plane_3);




//Estribos 1
tag_location = g_solid_centroid;
//curves
geom_surface_perimeter_curves_1;
//rebarStyle
"StirrupTie";
//rebarBarType
tipo_barra_extremos;
//startHookType
hook;
//endHookType
hook;
//startHookOrientation
"Right";
//endtHookOrientation
"Right";
//hostElement
structural_framing_hormigon_lst;
//vector
structural_framing_hormigon_lst_vector;
//spacing
espaciamiento_extremos;
//ArrayLength
elem_curve_vector_len;
//Punto para posicionar tag
tag_location;










//Estribos 2
//curves
geom_surface_perimeter_curves_2;
//rebarStyle
"StirrupTie";
//rebarBarType
tipo_barra_extremos;
//startHookType
hook;
//endHookType
hook;
//startHookOrientation
"Left";
//endtHookOrientation
"Left";
//hostElement
structural_framing_hormigon_lst;
//vector
structural_framing_hormigon_lst_vector;
//spacing
espaciamiento_extremos;
//ArrayLength
elem_curve_vector_len;

//
# ----------------------------------------
fromCurves_5 = StructuralDesign.Rebar.Create.FromCurves(curves=code_block_20.out78, rebarStyle=code_block_20.out79, rebarBarType=code_block_20.out80, startHookType=code_block_20.out81, endHookType=code_block_20.out82, startHookOrientation=code_block_20.out83, endHookOrientation=code_block_20.out84, hostElement=code_block_20.out85, vector=code_block_20.out86)
setLayoutAsMaximumSpacing_5 = StructuralDesign.Rebar.Layout.SetLayoutAsMaximumSpacing(rebar=fromCurves_5, spacing=code_block_20.out87, arrayLength=code_block_20.out88, lacing=Longest)
code_block_21 = CodeBlock { "FirstLast"; }
setRebarPresentation_5 = Custom[SetRebarPresentation](rebarElements=setLayoutAsMaximumSpacing_5, rebarRepresentation=code_block_21)
flatten_5 = List.Flatten(list=setRebarPresentation_5)
code_block_22 = CodeBlock(element=flatten_5, tag_location=code_block_20.out89)  # same code as code_block_17
create_tag_4 = Custom[Create Tag](view=activeView_7@L1, element=code_block_22.out2@L2, TagLocation=code_block_22.out3@L2, TagType=code_block_22.out5@L1, horizontal=code_block_22.out6@L1, addLeader=code_block_22.out7@L1, LinkInstance=code_block_22.out8@L1, RunIt=code_block_22.out9@L1, lacing=Longest)
fromCurves_6 = StructuralDesign.Rebar.Create.FromCurves(curves=code_block_20.out90, rebarStyle=code_block_20.out91, rebarBarType=code_block_20.out92, startHookType=code_block_20.out93, endHookType=code_block_20.out94, startHookOrientation=code_block_20.out95, endHookOrientation=code_block_20.out96, hostElement=code_block_20.out97, vector=code_block_20.out98)
setLayoutAsMaximumSpacing_6 = StructuralDesign.Rebar.Layout.SetLayoutAsMaximumSpacing(rebar=fromCurves_6, spacing=code_block_20.out99, arrayLength=code_block_20.out100, lacing=Longest)
code_block_23 = CodeBlock { "FirstLast"; }
setRebarPresentation_6 = Custom[SetRebarPresentation](rebarElements=setLayoutAsMaximumSpacing_6, rebarRepresentation=code_block_23)
flatten_6 = List.Flatten(list=setRebarPresentation_6)
code_block_24 = CodeBlock(element=flatten_6)  # same code as code_block_19

# group: 5 Barras
element_types_ᶜᵒⁿᵛᵉʳᵗᵉᵈ_ᵈʳᵒᵖᵈᵒʷⁿ_7 = CodeBlock { DSCore.Types.FindTypeByNameInAssembly("RebarHookType", "RevitAPI"); }
all_elements_of_type_7 = ElementsOfType(element_type=element_types_ᶜᵒⁿᵛᵉʳᵗᵉᵈ_ᵈʳᵒᵖᵈᵒʷⁿ_7)
plane_5 = Custom[View.Plane](view=activeView_8)
code_block_25 = CodeBlock(x=code_block_8.out1, pata=all_elements_of_type_7, view_plane=plane_5)  # same code as code_block_20
fromCurves_7 = StructuralDesign.Rebar.Create.FromCurves(curves=code_block_25.out78, rebarStyle=code_block_25.out79, rebarBarType=code_block_25.out80, startHookType=code_block_25.out81, endHookType=code_block_25.out82, startHookOrientation=code_block_25.out83, endHookOrientation=code_block_25.out84, hostElement=code_block_25.out85, vector=code_block_25.out86)
setLayoutAsMaximumSpacing_7 = StructuralDesign.Rebar.Layout.SetLayoutAsMaximumSpacing(rebar=fromCurves_7, spacing=code_block_25.out87, arrayLength=code_block_25.out88, lacing=Longest)
code_block_26 = CodeBlock { "FirstLast"; }
setRebarPresentation_7 = Custom[SetRebarPresentation](rebarElements=setLayoutAsMaximumSpacing_7, rebarRepresentation=code_block_26)
flatten_7 = List.Flatten(list=setRebarPresentation_7)
code_block_27 = CodeBlock(element=flatten_7, tag_location=code_block_25.out89)  # same code as code_block_17
create_tag_5 = Custom[Create Tag](view=activeView_7@L1, element=code_block_27.out2@L2, TagLocation=code_block_27.out3@L2, TagType=code_block_27.out5@L1, horizontal=code_block_27.out6@L1, addLeader=code_block_27.out7@L1, LinkInstance=code_block_27.out8@L1, RunIt=code_block_27.out9@L1, lacing=Longest)
fromCurves_8 = StructuralDesign.Rebar.Create.FromCurves(curves=code_block_25.out90, rebarStyle=code_block_25.out91, rebarBarType=code_block_25.out92, startHookType=code_block_25.out93, endHookType=code_block_25.out94, startHookOrientation=code_block_25.out95, endHookOrientation=code_block_25.out96, hostElement=code_block_25.out97, vector=code_block_25.out98)
setLayoutAsMaximumSpacing_8 = StructuralDesign.Rebar.Layout.SetLayoutAsMaximumSpacing(rebar=fromCurves_8, spacing=code_block_25.out99, arrayLength=code_block_25.out100, lacing=Longest)
code_block_28 = CodeBlock { "FirstLast"; }
setRebarPresentation_8 = Custom[SetRebarPresentation](rebarElements=setLayoutAsMaximumSpacing_8, rebarRepresentation=code_block_28)
flatten_8 = List.Flatten(list=setRebarPresentation_8)
code_block_29 = CodeBlock(element=flatten_8)  # same code as code_block_19

current_9 = Document.Current()
activeView_9 = Document.ActiveView(document=current_9)

# group: 6 Barras
element_types_ᶜᵒⁿᵛᵉʳᵗᵉᵈ_ᵈʳᵒᵖᵈᵒʷⁿ_8 = CodeBlock { DSCore.Types.FindTypeByNameInAssembly("RebarHookType", "RevitAPI"); }
all_elements_of_type_8 = ElementsOfType(element_type=element_types_ᶜᵒⁿᵛᵉʳᵗᵉᵈ_ᵈʳᵒᵖᵈᵒʷⁿ_8)
current_10 = Document.Current()
activeView_10 = Document.ActiveView(document=current_10)
plane_6 = Custom[View.Plane](view=activeView_10)
code_block_30 = CodeBlock(x=code_block_8.out1, pata=all_elements_of_type_8, view_plane=plane_6)
# ---------- code_block_30.designscript (213 lines) ----------
elementos = x[0];
tipo_barra_extremos = x[1];
espaciamiento_extremos = x[2];
pata;
pata_names = Revit.Elements.Element.Name(pata);
mask = pata_names == "Stirrup/Tie - 135 deg.";
hook = DSCore.List.FilterByBoolMask(pata, mask)["in"][0];

//Obtener la cantidad de barras para definir cuantos estribos utilizar
rebar_cat = Revit.Category.ByName("Structural Rebar");
str_framing_rebars = Rhythm.Elements.DependentElementsOfCategory(elementos, rebar_cat);
str_framing_rebars_shapes = Revit.Elements.Element.GetParameterValueByName(str_framing_rebars, "Shape");
str_framing_rebars_shapes_names = Revit.Elements.Element.Name(str_framing_rebars_shapes);
str_framing_rebars_mask = DSCore.String.Contains(str_framing_rebars_shapes_names, "R_S_", false);
str_framing_rebars_R_S_ = DSCore.List.GetItemAtIndex(DSCore.List.FilterByBoolMask(str_framing_rebars, str_framing_rebars_mask)["in"]@L2<1>, 0);
str_framing_rebars_quantities = Revit.Elements.Element.GetParameterValueByName(str_framing_rebars_R_S_, "Quantity");

//filtro de elementos en funcion de la cantidad de barras
elementos_mask = str_framing_rebars_quantities == 6;
elem = DSCore.List.FilterByBoolMask(elementos, elementos_mask)["in"];

//Normal plano vista actual
view_plane_normal = Autodesk.Plane.Normal(view_plane);

//Variables para filtrar elementos por categoria
elem_category = Revit.Elements.Element.GetCategory(elem);
elem_category_name = Revit.Category.Name(elem_category);

//Filtrar vigas de hormigon paralelos a la vista actual
structural_framing_mask = elem_category_name == "Structural Framing";
structural_framing = DSCore.List.FilterByBoolMask(elem, structural_framing_mask)["in"];
structural_framing_material = DSCore.List.Flatten(Revit.Elements.Element.GetMaterials(structural_framing, false));
structural_framing_material_name = Revit.Material.Name(structural_framing_material);
structural_framing_material_mask = structural_framing_material_name == "Concrete, Cast-in-Place gray";
structural_framing_hormigon = DSCore.List.FilterByBoolMask(structural_framing, structural_framing_material_mask)["in"];
structural_framing_hormigon_location = Revit.Elements.Element.GetLocation(structural_framing_hormigon);
structural_framing_hormigon_vector = Line.Direction(structural_framing_hormigon_location);
structural_framing_hormigon_centroid = Autodesk.Solid.Centroid(DSCore.List.Flatten(Revit.Elements.Element.Geometry(structural_framing_hormigon)));
structural_framing_hormigon_coo_sys = Autodesk.Curve.CoordinateSystemAtParameter(structural_framing_hormigon_location);
structural_framing_hormigon_vector_mask = Autodesk.Vector.IsParallel(CoordinateSystem.XAxis(structural_framing_hormigon_coo_sys), view_plane_normal);
structural_framing_hormigon_lst = DSCore.List.FilterByBoolMask(structural_framing_hormigon, structural_framing_hormigon_vector_mask)["in"];
structural_framing_hormigon_lst_location = Revit.Elements.Element.GetLocation(structural_framing_hormigon_lst);
structural_framing_hormigon_lst_cut_len = Revit.Elements.Element.GetParameterValueByName(structural_framing_hormigon_lst, "Cut Length");
structural_framing_hormigon_lst_location_len = Autodesk.Curve.Length(structural_framing_hormigon_lst_location);
structural_framing_hormigon_lst_location_start_p = Autodesk.Curve.StartPoint(structural_framing_hormigon_lst_location);
structural_framing_hormigon_lst_location_end_p = Autodesk.Curve.EndPoint(structural_framing_hormigon_lst_location);
structural_framing_hormigon_lst_vector = Autodesk.Vector.ByTwoPoints(structural_framing_hormigon_lst_location_start_p, structural_framing_hormigon_lst_location_end_p);
structural_framing_hormigon_lst_vector_len = Autodesk.Vector.Length(structural_framing_hormigon_lst_vector);

//Altura de Vigas seleccionadas
elem_altura = Revit.Elements.Element.GetParameterValueByName(Revit.Elements.Element.GetParameterValueByName(elem, "Type"), "Height");

//Curva de las Vigas
elem_curve_inicial = Revit.Elements.Element.GetLocation(structural_framing_hormigon_lst);
elem_curve_inicial_len = DesignScript.Curve.Length(elem_curve_inicial);
dif_len = DSCore.Math.Abs(structural_framing_hormigon_lst_cut_len - structural_framing_hormigon_lst_location_len) / 2;
x_1 = Autodesk.Curve.ExtendEnd(Autodesk.Curve.ExtendStart(structural_framing_hormigon_lst_location, (dif_len + 50) * -1), (dif_len + 50) * -1);
x_2 = Autodesk.Curve.ExtendEnd(Autodesk.Curve.ExtendStart(structural_framing_hormigon_lst_location, (dif_len + 50) * -1), (dif_len + 50) * -1);

elem_curve = [Imperative]
{
	if(structural_framing_hormigon_lst_location_len >= structural_framing_hormigon_lst_cut_len)
	{
		return  x_1;
	}
	else
	{
		return  x_2;
	}
};
elem_curve_start_p = Autodesk.Curve.StartPoint(elem_curve);
elem_curve_end_p = Autodesk.Curve.EndPoint(elem_curve);
elem_curve_vector = Autodesk.Vector.ByTwoPoints(elem_curve_start_p, elem_curve_end_p);
elem_curve_vector_len = Autodesk.Vector.Length(elem_curve_vector);

//Geometria a Cortar
g_elem_solid = DSCore.List.Flatten(Revit.Elements.Element.Geometry(structural_framing_hormigon_lst));
g_solid_centroid = Autodesk.Solid.Centroid(g_elem_solid);
g_solid_coo_sys = Autodesk.Curve.CoordinateSystemAtParameter(structural_framing_hormigon_lst_location, 0.5);
g_solid_plane = CoordinateSystem.YZPlane(g_solid_coo_sys);
g_solid_scaled = Autodesk.Geometry.Scale(g_elem_solid, g_solid_plane, 5, 1, 1);

//Geometria Estribo
geom_param_at_point = DesignScript.Curve.ParameterAtPoint(elem_curve, elem_curve_start_p);
geom_plane_at_param = DesignScript.Curve.PlaneAtParameter(elem_curve, geom_param_at_point);
geom_surface = DSCore.List.Flatten(Autodesk.Geometry.Intersect(g_solid_scaled, geom_plane_at_param), -1);
geom_surface_perimeter = Autodesk.Surface.PerimeterCurves(geom_surface);
geom_surface_perimeter_as_polycurve = PolyCurve.Offset(PolyCurve.ByJoinedCurves(geom_surface_perimeter), -25, false);
geom_surface_offset = Autodesk.Surface.ByPatch(geom_surface_perimeter_as_polycurve);
//Estribo 1
geom_surface_coo_sys_1 = Autodesk.Surface.CoordinateSystemAtParameter(geom_surface_offset, 0, 0.6343);
geom_surface_cut_plane_1 = CoordinateSystem.ZXPlane(geom_surface_coo_sys_1);
geom_surface_split_1 = Autodesk.Geometry.Split(geom_surface_offset, geom_surface_cut_plane_1);
geom_surface_1 = DSCore.List.GetItemAtIndex(geom_surface_split_1@L2<1>, 1);
geom_surface_perimeter_1 = Autodesk.Surface.PerimeterCurves(geom_surface_1);
geom_surface_perimeter_as_polycurve_1 = PolyCurve.ByJoinedCurves(geom_surface_perimeter_1);
geom_surface_perimeter_curves_1 = Autodesk.Geometry.Explode(geom_surface_perimeter_as_polycurve_1);
//Estribo 2
geom_surface_coo_sys_2 = Autodesk.Surface.CoordinateSystemAtParameter(geom_surface_offset, 0, 0.3657);
geom_surface_cut_plane_2 = CoordinateSystem.ZXPlane(geom_surface_coo_sys_2);
geom_surface_split_2 = Autodesk.Geometry.Split(geom_surface_offset, geom_surface_cut_plane_2);
geom_surface_2 = DSCore.List.GetItemAtIndex(geom_surface_split_2@L2<1>, 0);
geom_surface_perimeter_2 = Autodesk.Surface.PerimeterCurves(geom_surface_2);
geom_surface_perimeter_as_polycurve_2 = PolyCurve.ByJoinedCurves(geom_surface_perimeter_2);
geom_surface_perimeter_curves_2 = Autodesk.Geometry.Explode(geom_surface_perimeter_as_polycurve_2);
//Estribo 3
geom_surface_coo_sys_3_A = Autodesk.Surface.CoordinateSystemAtParameter(geom_surface_offset, 0, 0.1885);
geom_surface_coo_sys_3_B = Autodesk.Surface.CoordinateSystemAtParameter(geom_surface_offset, 0, 0.8115);
geom_surface_cut_plane_3_A = CoordinateSystem.ZXPlane(geom_surface_coo_sys_3_A);
geom_surface_cut_plane_3_B = CoordinateSystem.ZXPlane(geom_surface_coo_sys_3_B);
geom_surface_intersect_3_A = Autodesk.Geometry.Intersect(geom_surface_offset, geom_surface_cut_plane_3_A);
geom_surface_intersect_3_B = Autodesk.Geometry.Intersect(geom_surface_offset, geom_surface_cut_plane_3_B);
geom_surface_transpose = DSCore.List.Flatten(DSCore.List.Transpose([geom_surface_intersect_3_A, geom_surface_intersect_3_B])@L3<1>, -1);
geom_surface_3 = Autodesk.Surface.ByLoft(geom_surface_transpose@L2<1>);
geom_surface_perimeter_curves_3 = Autodesk.Surface.PerimeterCurves(geom_surface_3);


//Estribos 1
tag_location = g_solid_centroid;
//curves
geom_surface_perimeter_curves_1;
//rebarStyle
"StirrupTie";
//rebarBarType
tipo_barra_extremos;
//startHookType
hook;
//endHookType
hook;
//startHookOrientation
"Right";
//endtHookOrientation
"Right";
//hostElement
structural_framing_hormigon_lst;
//vector
structural_framing_hormigon_lst_vector;
//spacing
espaciamiento_extremos;
//ArrayLength
elem_curve_vector_len;
//Punto para posicionar tag
tag_location;










//Estribos 2
tag_location;
//curves
geom_surface_perimeter_curves_2;
//rebarStyle
"StirrupTie";
//rebarBarType
tipo_barra_extremos;
//startHookType
hook;
//endHookType
hook;
//startHookOrientation
"Left";
//endtHookOrientation
"Left";
//hostElement
structural_framing_hormigon_lst;
//vector
structural_framing_hormigon_lst_vector;
//spacing
espaciamiento_extremos;
//ArrayLength
elem_curve_vector_len;











//Estribos 2
//curves
geom_surface_perimeter_curves_3;
//rebarStyle
"StirrupTie";
//rebarBarType
tipo_barra_extremos;
//startHookType
hook;
//endHookType
hook;
//startHookOrientation
"Left";
//endtHookOrientation
"Left";
//hostElement
structural_framing_hormigon_lst;
//vector
structural_framing_hormigon_lst_vector;
//spacing
espaciamiento_extremos;
//ArrayLength
elem_curve_vector_len;

//
# ----------------------------------------
fromCurves_9 = StructuralDesign.Rebar.Create.FromCurves(curves=code_block_30.out108, rebarStyle=code_block_30.out109, rebarBarType=code_block_30.out110, startHookType=code_block_30.out111, endHookType=code_block_30.out112, startHookOrientation=code_block_30.out113, endHookOrientation=code_block_30.out114, hostElement=code_block_30.out115, vector=code_block_30.out116)
setLayoutAsMaximumSpacing_9 = StructuralDesign.Rebar.Layout.SetLayoutAsMaximumSpacing(rebar=fromCurves_9, spacing=code_block_30.out117, arrayLength=code_block_30.out118, lacing=Longest)
code_block_31 = CodeBlock { "FirstLast"; }
setRebarPresentation_9 = Custom[SetRebarPresentation](rebarElements=setLayoutAsMaximumSpacing_9, rebarRepresentation=code_block_31)
flatten_9 = List.Flatten(list=setRebarPresentation_9)
code_block_32 = CodeBlock(element=flatten_9)
# ---------- code_block_32.designscript (2 lines) ----------
//Asigna el tipo de estribo (sim, doble, etc...)
Revit.Elements.Element.SetParameterByName(element, "Estribo", "ET.");
# ----------------------------------------
fromCurves_10 = StructuralDesign.Rebar.Create.FromCurves(curves=code_block_30.out84, rebarStyle=code_block_30.out85, rebarBarType=code_block_30.out86, startHookType=code_block_30.out87, endHookType=code_block_30.out88, startHookOrientation=code_block_30.out89, endHookOrientation=code_block_30.out90, hostElement=code_block_30.out91, vector=code_block_30.out92)
setLayoutAsMaximumSpacing_10 = StructuralDesign.Rebar.Layout.SetLayoutAsMaximumSpacing(rebar=fromCurves_10, spacing=code_block_30.out93, arrayLength=code_block_30.out94, lacing=Longest)
code_block_33 = CodeBlock { "FirstLast"; }
setRebarPresentation_10 = Custom[SetRebarPresentation](rebarElements=setLayoutAsMaximumSpacing_10, rebarRepresentation=code_block_33)
flatten_10 = List.Flatten(list=setRebarPresentation_10)
code_block_34 = CodeBlock(element=flatten_10, tag_location=code_block_30.out95)
# ---------- code_block_34.designscript (19 lines) ----------
//Asigna el tipo de estribo (sim, doble, etc...)
Revit.Elements.Element.SetParameterByName(element, "Estribo", "ET.");
tag_location;

//element
element;
//TagLocation
tag_location;
//TagType
family = Revit.Family.ByName("EST_A_STRUCTURAL REBAR TAG_ESTRIBO");
tag_type = Revit.Elements.FamilyType.ByFamilyAndName(family, "R_E_00");
//horizontal
true;
//addLeader
false;
//LinkInstance
null;
//RunIt
true;
# ----------------------------------------
create_tag_6 = Custom[Create Tag](view=activeView_9@L1, element=code_block_34.out2@L2, TagLocation=code_block_34.out3@L2, TagType=code_block_34.out5@L1, horizontal=code_block_34.out6@L1, addLeader=code_block_34.out7@L1, LinkInstance=code_block_34.out8@L1, RunIt=code_block_34.out9@L1, lacing=Longest)
fromCurves_11 = StructuralDesign.Rebar.Create.FromCurves(curves=code_block_30.out97, rebarStyle=code_block_30.out98, rebarBarType=code_block_30.out99, startHookType=code_block_30.out100, endHookType=code_block_30.out101, startHookOrientation=code_block_30.out102, endHookOrientation=code_block_30.out103, hostElement=code_block_30.out104, vector=code_block_30.out105)
setLayoutAsMaximumSpacing_11 = StructuralDesign.Rebar.Layout.SetLayoutAsMaximumSpacing(rebar=fromCurves_11, spacing=code_block_30.out106, arrayLength=code_block_30.out107, lacing=Longest)
code_block_35 = CodeBlock { "FirstLast"; }
setRebarPresentation_11 = Custom[SetRebarPresentation](rebarElements=setLayoutAsMaximumSpacing_11, rebarRepresentation=code_block_35)
flatten_11 = List.Flatten(list=setRebarPresentation_11)
code_block_36 = CodeBlock(element=flatten_11)  # same code as code_block_32

current_11 = Document.Current()
activeView_11 = Document.ActiveView(document=current_11)

# group: 7 Barras
element_types_ᶜᵒⁿᵛᵉʳᵗᵉᵈ_ᵈʳᵒᵖᵈᵒʷⁿ_9 = CodeBlock { DSCore.Types.FindTypeByNameInAssembly("RebarHookType", "RevitAPI"); }
all_elements_of_type_9 = ElementsOfType(element_type=element_types_ᶜᵒⁿᵛᵉʳᵗᵉᵈ_ᵈʳᵒᵖᵈᵒʷⁿ_9)
current_12 = Document.Current()
activeView_12 = Document.ActiveView(document=current_12)
plane_7 = Custom[View.Plane](view=activeView_12)
code_block_37 = CodeBlock(x=code_block_8.out1, pata=all_elements_of_type_9, view_plane=plane_7)  # unwired: elementos, tipo_barra_extremos
# ---------- code_block_37.designscript (216 lines) ----------
https://helpcenter.bimcollab.com/portal/es/kb/articles/downloads-eselementos = x[0];
tipo_barra_extremos = x[1];
espaciamiento_extremos = x[2];
pata;
pata_names = Revit.Elements.Element.Name(pata);
mask = pata_names == "Stirrup/Tie - 135 deg.";
hook = DSCore.List.FilterByBoolMask(pata, mask)["in"][0];

//Obtener la cantidad de barras para definir cuantos estribos utilizar
rebar_cat = Revit.Category.ByName("Structural Rebar");
str_framing_rebars = Rhythm.Elements.DependentElementsOfCategory(elementos, rebar_cat);
str_framing_rebars_shapes = Revit.Elements.Element.GetParameterValueByName(str_framing_rebars, "Shape");
str_framing_rebars_shapes_names = Revit.Elements.Element.Name(str_framing_rebars_shapes);
str_framing_rebars_mask = DSCore.String.Contains(str_framing_rebars_shapes_names, "R_S_", false);
str_framing_rebars_R_S_ = DSCore.List.GetItemAtIndex(DSCore.List.FilterByBoolMask(str_framing_rebars, str_framing_rebars_mask)["in"]@L2<1>, 0);
str_framing_rebars_quantities = Revit.Elements.Element.GetParameterValueByName(str_framing_rebars_R_S_, "Quantity");

//filtro de elementos en funcion de la cantidad de barras
elementos_mask = str_framing_rebars_quantities == 7;
elem = DSCore.List.FilterByBoolMask(elementos, elementos_mask)["in"];

//Normal plano vista actual
view_plane_normal = Autodesk.Plane.Normal(view_plane);

//Variables para filtrar elementos por categoria
elem_category = Revit.Elements.Element.GetCategory(elem);
elem_category_name = Revit.Category.Name(elem_category);

//Filtrar vigas de hormigon paralelos a la vista actual
structural_framing_mask = elem_category_name == "Structural Framing";
structural_framing = DSCore.List.FilterByBoolMask(elem, structural_framing_mask)["in"];
structural_framing_material = DSCore.List.Flatten(Revit.Elements.Element.GetMaterials(structural_framing, false));
structural_framing_material_name = Revit.Material.Name(structural_framing_material);
structural_framing_material_mask = structural_framing_material_name == "Concrete, Cast-in-Place gray";
structural_framing_hormigon = DSCore.List.FilterByBoolMask(structural_framing, structural_framing_material_mask)["in"];
structural_framing_hormigon_location = Revit.Elements.Element.GetLocation(structural_framing_hormigon);
structural_framing_hormigon_vector = Line.Direction(structural_framing_hormigon_location);
structural_framing_hormigon_centroid = Autodesk.Solid.Centroid(DSCore.List.Flatten(Revit.Elements.Element.Geometry(structural_framing_hormigon)));
structural_framing_hormigon_coo_sys = Autodesk.Curve.CoordinateSystemAtParameter(structural_framing_hormigon_location);
structural_framing_hormigon_vector_mask = Autodesk.Vector.IsParallel(CoordinateSystem.XAxis(structural_framing_hormigon_coo_sys), view_plane_normal);
structural_framing_hormigon_lst = DSCore.List.FilterByBoolMask(structural_framing_hormigon, structural_framing_hormigon_vector_mask)["in"];
structural_framing_hormigon_lst_location = Revit.Elements.Element.GetLocation(structural_framing_hormigon_lst);
structural_framing_hormigon_lst_cut_len = Revit.Elements.Element.GetParameterValueByName(structural_framing_hormigon_lst, "Cut Length");
structural_framing_hormigon_lst_location_len = Autodesk.Curve.Length(structural_framing_hormigon_lst_location);
structural_framing_hormigon_lst_location_start_p = Autodesk.Curve.StartPoint(structural_framing_hormigon_lst_location);
structural_framing_hormigon_lst_location_end_p = Autodesk.Curve.EndPoint(structural_framing_hormigon_lst_location);
structural_framing_hormigon_lst_vector = Autodesk.Vector.ByTwoPoints(structural_framing_hormigon_lst_location_start_p, structural_framing_hormigon_lst_location_end_p);
structural_framing_hormigon_lst_vector_len = Autodesk.Vector.Length(structural_framing_hormigon_lst_vector);

//Altura de Vigas seleccionadas
elem_altura = Revit.Elements.Element.GetParameterValueByName(Revit.Elements.Element.GetParameterValueByName(elem, "Type"), "Height");

//Curva de las Vigas
elem_curve_inicial = Revit.Elements.Element.GetLocation(structural_framing_hormigon_lst);
elem_curve_inicial_len = DesignScript.Curve.Length(elem_curve_inicial);
dif_len = DSCore.Math.Abs(structural_framing_hormigon_lst_cut_len - structural_framing_hormigon_lst_location_len) / 2;
x_1 = Autodesk.Curve.ExtendEnd(Autodesk.Curve.ExtendStart(structural_framing_hormigon_lst_location, (dif_len + 50) * -1), (dif_len + 50) * -1);
x_2 = Autodesk.Curve.ExtendEnd(Autodesk.Curve.ExtendStart(structural_framing_hormigon_lst_location, (dif_len + 50) * -1), (dif_len + 50) * -1);

elem_curve = [Imperative]
{
	if(structural_framing_hormigon_lst_location_len >= structural_framing_hormigon_lst_cut_len)
	{
		return  x_1;
	}
	else
	{
		return  x_2;
	}
};
elem_curve_start_p = Autodesk.Curve.StartPoint(elem_curve);
elem_curve_end_p = Autodesk.Curve.EndPoint(elem_curve);
elem_curve_vector = Autodesk.Vector.ByTwoPoints(elem_curve_start_p, elem_curve_end_p);
elem_curve_vector_len = Autodesk.Vector.Length(elem_curve_vector);

//Geometria a Cortar
g_elem_solid = DSCore.List.Flatten(Revit.Elements.Element.Geometry(structural_framing_hormigon_lst));
g_solid_centroid = Autodesk.Solid.Centroid(g_elem_solid);
g_solid_coo_sys = Autodesk.Curve.CoordinateSystemAtParameter(structural_framing_hormigon_lst_location, 0.5);
g_solid_plane = CoordinateSystem.YZPlane(g_solid_coo_sys);
g_solid_scaled = Autodesk.Geometry.Scale(g_elem_solid, g_solid_plane, 5, 1, 1);

//Geometria Estribo
geom_param_at_point = DesignScript.Curve.ParameterAtPoint(elem_curve, elem_curve_start_p);
geom_plane_at_param = DesignScript.Curve.PlaneAtParameter(elem_curve, geom_param_at_point);
geom_surface = DSCore.List.Flatten(Autodesk.Geometry.Intersect(g_solid_scaled, geom_plane_at_param), -1);
geom_surface_perimeter = Autodesk.Surface.PerimeterCurves(geom_surface);
geom_surface_perimeter_as_polycurve = PolyCurve.Offset(PolyCurve.ByJoinedCurves(geom_surface_perimeter), -25, false);
geom_surface_offset = Autodesk.Surface.ByPatch(geom_surface_perimeter_as_polycurve);
//Estribo 1
geom_surface_coo_sys_1 = Autodesk.Surface.CoordinateSystemAtParameter(geom_surface_offset, 0, 0.69333);
geom_surface_cut_plane_1 = CoordinateSystem.ZXPlane(geom_surface_coo_sys_1);
geom_surface_split_1 = Autodesk.Geometry.Split(geom_surface_offset, geom_surface_cut_plane_1);
geom_surface_1 = DSCore.List.GetItemAtIndex(geom_surface_split_1@L2<1>, 1);
geom_surface_perimeter_1 = Autodesk.Surface.PerimeterCurves(geom_surface_1);
geom_surface_perimeter_as_polycurve_1 = PolyCurve.ByJoinedCurves(geom_surface_perimeter_1);
geom_surface_perimeter_curves_1 = Autodesk.Geometry.Explode(geom_surface_perimeter_as_polycurve_1);
//Estribo 2
geom_surface_coo_sys_2 = Autodesk.Surface.CoordinateSystemAtParameter(geom_surface_offset, 0, 0.30667);
geom_surface_cut_plane_2 = CoordinateSystem.ZXPlane(geom_surface_coo_sys_2);
geom_surface_split_2 = Autodesk.Geometry.Split(geom_surface_offset, geom_surface_cut_plane_2);
geom_surface_2 = DSCore.List.GetItemAtIndex(geom_surface_split_2@L2<1>, 0);
geom_surface_perimeter_2 = Autodesk.Surface.PerimeterCurves(geom_surface_2);
geom_surface_perimeter_as_polycurve_2 = PolyCurve.ByJoinedCurves(geom_surface_perimeter_2);
geom_surface_perimeter_curves_2 = Autodesk.Geometry.Explode(geom_surface_perimeter_as_polycurve_2);
//Estribo 3
geom_surface_coo_sys_3_A = Autodesk.Surface.CoordinateSystemAtParameter(geom_surface_offset, 0, 0.15905);
geom_surface_coo_sys_3_B = Autodesk.Surface.CoordinateSystemAtParameter(geom_surface_offset, 0, 0.84095);
geom_surface_cut_plane_3_A = CoordinateSystem.ZXPlane(geom_surface_coo_sys_3_A);
geom_surface_cut_plane_3_B = CoordinateSystem.ZXPlane(geom_surface_coo_sys_3_B);
geom_surface_intersect_3_A = Autodesk.Geometry.Intersect(geom_surface_offset, geom_surface_cut_plane_3_A);
geom_surface_intersect_3_B = Autodesk.Geometry.Intersect(geom_surface_offset, geom_surface_cut_plane_3_B);
geom_surface_transpose = DSCore.List.Flatten(DSCore.List.Transpose([geom_surface_intersect_3_A, geom_surface_intersect_3_B])@L3<1>, -1);
geom_surface_3 = Autodesk.Surface.ByLoft(geom_surface_transpose@L2<1>);
geom_surface_perimeter_curves_3 = Autodesk.Surface.PerimeterCurves(geom_surface_3);
//Traba
geom_surface_coo_sys_3 = Autodesk.Surface.CoordinateSystemAtParameter(geom_surface_offset, 0, 0.454257);
geom_surface_cut_plane_3 = CoordinateSystem.ZXPlane(geom_surface_coo_sys_3);
geom_surface_intersect_3 = Autodesk.Geometry.Intersect(geom_surface_offset, geom_surface_cut_plane_3);

//Estribos 1
tag_location = g_solid_centroid;
//curves
geom_surface_perimeter_curves_1;
//rebarStyle
"StirrupTie";
//rebarBarType
tipo_barra_extremos;
//startHookType
hook;
//endHookType
hook;
//startHookOrientation
"Right";
//endtHookOrientation
"Right";
//hostElement
structural_framing_hormigon_lst;
//vector
structural_framing_hormigon_lst_vector;
//spacing
espaciamiento_extremos;
//ArrayLength
elem_curve_vector_len;
//Punto para posicionar tag
tag_location;










//Estribos 2
tag_location;
//curves
geom_surface_perimeter_curves_2;
//rebarStyle
"StirrupTie";
//rebarBarType
tipo_barra_extremos;
//startHookType
hook;
//endHookType
hook;
//startHookOrientation
"Left";
//endtHookOrientation
"Left";
//hostElement
structural_framing_hormigon_lst;
//vector
structural_framing_hormigon_lst_vector;
//spacing
espaciamiento_extremos;
//ArrayLength
elem_curve_vector_len;











//Estribos 3
//curves
geom_surface_perimeter_curves_3;
//rebarStyle
"StirrupTie";
//rebarBarType
tipo_barra_extremos;
//startHookType
hook;
//endHookType
hook;
//startHookOrientation
"Left";
//endtHookOrientation
"Left";
//hostElement
structural_framing_hormigon_lst;
//vector
structural_framing_hormigon_lst_vector;
//spacing
espaciamiento_extremos;
//ArrayLength
elem_curve_vector_len;

//
# ----------------------------------------
fromCurves_12 = StructuralDesign.Rebar.Create.FromCurves(curves=code_block_37.out86, rebarStyle=code_block_37.out87, rebarBarType=code_block_37.out88, startHookType=code_block_37.out89, endHookType=code_block_37.out90, startHookOrientation=code_block_37.out91, endHookOrientation=code_block_37.out92, hostElement=code_block_37.out93, vector=code_block_37.out94)
setLayoutAsMaximumSpacing_12 = StructuralDesign.Rebar.Layout.SetLayoutAsMaximumSpacing(rebar=fromCurves_12, spacing=code_block_37.out95, arrayLength=code_block_37.out96, lacing=Longest)
code_block_38 = CodeBlock { "FirstLast"; }
setRebarPresentation_12 = Custom[SetRebarPresentation](rebarElements=setLayoutAsMaximumSpacing_12, rebarRepresentation=code_block_38)
flatten_12 = List.Flatten(list=setRebarPresentation_12)
code_block_39 = CodeBlock(element=flatten_12, tag_location=code_block_37.out97)  # same code as code_block_34
create_tag_7 = Custom[Create Tag](view=activeView_11@L1, element=code_block_39.out2@L2, TagLocation=code_block_39.out3@L2, TagType=code_block_39.out5@L1, horizontal=code_block_39.out6@L1, addLeader=code_block_39.out7@L1, LinkInstance=code_block_39.out8@L1, RunIt=code_block_39.out9@L1, lacing=Longest)
fromCurves_13 = StructuralDesign.Rebar.Create.FromCurves(curves=code_block_37.out99, rebarStyle=code_block_37.out100, rebarBarType=code_block_37.out101, startHookType=code_block_37.out102, endHookType=code_block_37.out103, startHookOrientation=code_block_37.out104, endHookOrientation=code_block_37.out105, hostElement=code_block_37.out106, vector=code_block_37.out107)
setLayoutAsMaximumSpacing_13 = StructuralDesign.Rebar.Layout.SetLayoutAsMaximumSpacing(rebar=fromCurves_13, spacing=code_block_37.out108, arrayLength=code_block_37.out109, lacing=Longest)
code_block_40 = CodeBlock { "FirstLast"; }
setRebarPresentation_13 = Custom[SetRebarPresentation](rebarElements=setLayoutAsMaximumSpacing_13, rebarRepresentation=code_block_40)
flatten_13 = List.Flatten(list=setRebarPresentation_13)
code_block_41 = CodeBlock(element=flatten_13)  # same code as code_block_32
fromCurves_14 = StructuralDesign.Rebar.Create.FromCurves(curves=code_block_37.out110, rebarStyle=code_block_37.out111, rebarBarType=code_block_37.out112, startHookType=code_block_37.out113, endHookType=code_block_37.out114, startHookOrientation=code_block_37.out115, endHookOrientation=code_block_37.out116, hostElement=code_block_37.out117, vector=code_block_37.out118)
setLayoutAsMaximumSpacing_14 = StructuralDesign.Rebar.Layout.SetLayoutAsMaximumSpacing(rebar=fromCurves_14, spacing=code_block_37.out119, arrayLength=code_block_37.out120, lacing=Longest)
code_block_42 = CodeBlock { "FirstLast"; }
setRebarPresentation_14 = Custom[SetRebarPresentation](rebarElements=setLayoutAsMaximumSpacing_14, rebarRepresentation=code_block_42)
flatten_14 = List.Flatten(list=setRebarPresentation_14)
code_block_43 = CodeBlock(element=flatten_14)  # same code as code_block_32

current_13 = Document.Current()
activeView_13 = Document.ActiveView(document=current_13)
element_types_ᶜᵒⁿᵛᵉʳᵗᵉᵈ_ᵈʳᵒᵖᵈᵒʷⁿ_10 = CodeBlock { DSCore.Types.FindTypeByNameInAssembly("RebarShape", "RevitAPI"); }
all_elements_of_type_10 = ElementsOfType(element_type=element_types_ᶜᵒⁿᵛᵉʳᵗᵉᵈ_ᵈʳᵒᵖᵈᵒʷⁿ_10)
code_block_44 = CodeBlock(x=code_block_8.out1) { x; }
code_block_45 = CodeBlock(x=code_block_44) { x[0]; }
geometry = Custom[Element.Geometry+](element=code_block_45)  # package Clockwork for Dynamo 2.x; Returns Dynamo AND native Revit geometry of a given element
flatten_15 = List.Flatten(list=geometry.dynamoGeometry)
faces = Topology.Faces(topology=flatten_15)
surfaceGeometry = Face.SurfaceGeometry(face=faces)
getLocation = Element.GetLocation(element=code_block_45)
code_block_46 = CodeBlock { 0.5; }
planeAtParameter = Curve.PlaneAtParameter(curve=getLocation, param=code_block_46, lacing=Longest)
byPlane = CoordinateSystem.ByPlane(plane=planeAtParameter)
YAxis = CoordinateSystem.YAxis(coordinateSystem=byPlane)
normalAtParameter = Surface.NormalAtParameter(surface=surfaceGeometry)
isParallel = Vector.IsParallel(vector=YAxis@L1, other=normalAtParameter@L2, lacing=Longest)
filterByBoolMask = List.FilterByBoolMask(list=surfaceGeometry, mask=isParallel)
code_block_47 = CodeBlock { 0; }
getItemAtIndex = List.GetItemAtIndex(list=filterByBoolMask.in@L2, index=code_block_47)
perimeterCurves = Surface.PerimeterCurves(surface=getItemAtIndex@L2)
code_block_48 = CodeBlock { 1; }
getItemAtIndex_2 = List.GetItemAtIndex(list=perimeterCurves@L2, index=code_block_48)
YAxis_2 = CoordinateSystem.YAxis(coordinateSystem=byPlane)
reverse = Vector.Reverse(vector=YAxis_2)
code_block_49 = CodeBlock { 45; }
translate = Geometry.Translate(geometry=getItemAtIndex_2, direction=reverse, distance=code_block_49)
XAxis = CoordinateSystem.XAxis(coordinateSystem=byPlane)
reverse_2 = Vector.Reverse(vector=XAxis)
code_block_50 = CodeBlock { 200; }
translate_2 = Geometry.Translate(geometry=translate, direction=reverse_2, distance=code_block_50)
code_block_51 = CodeBlock(x=code_block_44) { x[1]; }
code_block_52 = CodeBlock(curves=translate_2, rebarBarType=code_block_51, hostElement=code_block_45, vector=reverse_2)
# ---------- code_block_52.designscript (26 lines) ----------
//curves
curves;

//rebarStyle
"Standard";

//rebarBarType
rebarBarType;

//startHookType
null;

//endHookType
null;

//startHookOrientation
"Right";

//endHookOrientation
"Right";

//hostElement
hostElement;

//vector
vector;
# ----------------------------------------
fromCurves_15 = StructuralDesign.Rebar.Create.FromCurves(curves=code_block_52.curves, rebarStyle=code_block_52.out1, rebarBarType=code_block_52.rebarBarType, startHookType=code_block_52.out3, endHookType=code_block_52.out4, startHookOrientation=code_block_52.out5, endHookOrientation=code_block_52.out6, hostElement=code_block_52.hostElement, vector=code_block_52.vector, lacing=Longest)
code_block_53 = CodeBlock { "Type"; }
getParameterValueByName = Element.GetParameterValueByName(element=code_block_45, parameterName=code_block_53)
code_block_54 = CodeBlock { "Height"; }
getParameterValueByName_2 = Element.GetParameterValueByName(element=getParameterValueByName, parameterName=code_block_54)
code_block_55 = CodeBlock(h=getParameterValueByName_2) { h - 400; }
code_block_56 = CodeBlock(h=getParameterValueByName_2) { DSCore.Math.Ceiling((h / 200)) - 1; }
setLayoutAsFixedNumber = StructuralDesign.Rebar.Layout.SetLayoutAsFixedNumber(rebar=fromCurves_15, arrayLength=code_block_55, numberOfBarPositions=code_block_56)
code_block_57 = CodeBlock(elem=all_elements_of_type_10, rebar=setLayoutAsFixedNumber)
# ---------- code_block_57.designscript (6 lines) ----------
//Asigna el Rebar Shape Indicado
elem_names = Revit.Elements.Element.Name(elem);
mask = elem_names == "R_S_00";
rebar_shape_R_S_00 = DSCore.List.FilterByBoolMask(elem, mask)["in"];
Revit.Elements.Element.SetParameterByName(rebar<1L>, "Shape", rebar_shape_R_S_00<1L>);
Revit.Elements.Element.SetParameterByName(rebar<1L>, "Tipo Barra", "Lateral");
# ----------------------------------------
hideElements = archilab.Revit.Views.Views.HideElements(view=activeView_13, elements=code_block_57.out4)
current_14 = Document.Current()
activeView_14 = Document.ActiveView(document=current_14)
ZXPlane = CoordinateSystem.ZXPlane(coordinateSystem=byPlane)
code_block_58 = CodeBlock { true; }
mirror = Custom[Element.Mirror](element=code_block_57.out4, plane=ZXPlane, copy=code_block_58, lacing=Longest)  # package Clockwork for Dynamo 2.x; Mirrors an element about a given plane.
code_block_59 = CodeBlock { "Middle"; }
python_script = Python(IN[0]=mirror, IN[1]=code_block_59)
# ---------- python_script.python (69 lines) ----------
# BIBLIOTECAS
import clr
import sys
import os

# Para trabajar con la RevitAPI
clr.AddReference('RevitAPI')
import Autodesk
from Autodesk.Revit.DB import *
from Autodesk.Revit.DB.Architecture import *
from Autodesk.Revit.ApplicationServices import *
from Autodesk.Revit.DB.Structure import *

# Para trabajar contra el documento y hacer transacciones
clr.AddReference('RevitServices')
from RevitServices.Persistence import DocumentManager
from RevitServices.Transactions import TransactionManager

# Identificadores
doc = DocumentManager.Instance.CurrentDBDocument
uiapp = DocumentManager.Instance.CurrentUIApplication
app = uiapp.Application
uidoc = uiapp.ActiveUIDocument

# Obtiene el documento activo de Revit
doc = DocumentManager.Instance.CurrentDBDocument

# Obtiene la vista activa del documento actual
active_view = doc.ActiveView

# Funciones
def toList(input):
	if isinstance(input, list):
		return input
	else:
		return [input]

# Obtiene el elemento de barra de refuerzo desde el input y desenrolla el elemento
rebar_list = UnwrapElement(toList(IN[0]))
representation = IN[1]

# Lista para almacenar los elementos modificados
elem_mod = []

# Cambia la presentación de la barra de refuerzo a "Mostrar primera y última"
TransactionManager.Instance.EnsureInTransaction(doc)
for rebar in rebar_list:
	if isinstance(rebar, Rebar):
		presentation_all = RebarPresentationMode.All
		presentation_firstlast = RebarPresentationMode.FirstLast
		presentation_middle = RebarPresentationMode.Middle
		if representation == "FirstLast":
			rebar.SetPresentationMode(active_view, presentation_firstlast)
			elem_mod.append(rebar)
		elif representation == "All":
			rebar.SetPresentationMode(active_view, presentation_all)
			elem_mod.append(rebar)
		elif representation == "Middle":
			rebar.SetPresentationMode(active_view, presentation_middle)
			elem_mod.append(rebar)
	else:
		pass
TransactionManager.Instance.TransactionTaskDone()

# Regenera la vista actual
doc.Regenerate()

# Devuelve los elementos modificados
OUT = elem_mod
# ----------------------------------------
code_block_60 = CodeBlock(x=code_block_45) { x; }
geometry_2 = Custom[Element.Geometry+](element=code_block_60)
flatten_16 = List.Flatten(list=geometry_2.dynamoGeometry)
centroid = Solid.Centroid(solid=flatten_16)
getLocation_2 = Element.GetLocation(element=code_block_60)
code_block_61 = CodeBlock { 0.5; }
planeAtParameter_2 = Curve.PlaneAtParameter(curve=getLocation_2, param=code_block_61)
XAxis_2 = Plane.XAxis(plane=planeAtParameter_2)
code_block_62 = CodeBlock { -200; }
translate_3 = Geometry.Translate(geometry=centroid, direction=XAxis_2, distance=code_block_62)
byElementAndLocation = Tag.ByElementAndLocation(view=activeView_14, element=python_script, location=translate_3)
