# Dynamo graph estribo1Segmento_script.dyn (Dynamo 2.6.2.15705)
# packages: Clockwork for Dynamo 2.x 2.4.0, Data-Shapes 2022.2.103, Genius Loci 2021.11.10, Structural Design 2021.1.22

current = Document.Current()
activeView = Document.ActiveView(document=current)
code_block = CodeBlock { "Seleccionar Elementos"; }
categories_ᶜᵒⁿᵛᵉʳᵗᵉᵈ_ᵈʳᵒᵖᵈᵒʷⁿ = CodeBlock()
# ---------- categories_ᶜᵒⁿᵛᵉʳᵗᵉᵈ_ᵈʳᵒᵖᵈᵒʷⁿ.designscript (8 lines) ----------
//InputName
"";
//ButtonText
"SELECCIONAR";
//CategoryFilter
Revit.Category.ByName("Structural Framing");
//SelectSingleElement
false;
# ----------------------------------------
selectmodelelements_data = Custom[SelectModelElements Data](InputName=categories_ᶜᵒⁿᵛᵉʳᵗᵉᵈ_ᵈʳᵒᵖᵈᵒʷⁿ.out0, ButtonText=categories_ᶜᵒⁿᵛᵉʳᵗᵉᵈ_ᵈʳᵒᵖᵈᵒʷⁿ.out1, CategoryFilter=categories_ᶜᵒⁿᵛᵉʳᵗᵉᵈ_ᵈʳᵒᵖᵈᵒʷⁿ.out2, SelectSingleElement=categories_ᶜᵒⁿᵛᵉʳᵗᵉᵈ_ᵈʳᵒᵖᵈᵒʷⁿ.out3)  # package Data-Shapes; Creates a Revit element selection input for UI.MultipleInputForm++ . Check out www.data-shapes.net for more infos!
inputgroup_data = Custom[InputGroup Data](GroupTitle=code_block, Inputs=selectmodelelements_data)  # package Data-Shapes; Creates a group of inputs for UI.MultipleInputForm ++ . Check out www.data-shapes.net for more infos !
code_block_2 = CodeBlock { "Estribos"; }
element_types_ᶜᵒⁿᵛᵉʳᵗᵉᵈ_ᵈʳᵒᵖᵈᵒʷⁿ = CodeBlock { DSCore.Types.FindTypeByNameInAssembly("RebarBarType", "RevitAPI"); }
all_elements_of_type = ElementsOfType(element_type=element_types_ᶜᵒⁿᵛᵉʳᵗᵉᵈ_ᵈʳᵒᵖᵈᵒʷⁿ)
code_block_3 = CodeBlock(elem_type=all_elements_of_type)
# ---------- code_block_3.designscript (15 lines) ----------
elem_type;
elem_type_diameter = Properties.RebarDiameter(elem_type);
elem_sorted = DSCore.List.SortByKey(elem_type, elem_type_diameter)["sorted list"];
elem_name = Revit.Elements.Element.Name(elem_sorted);

//InputName
"Diametro";
//Keys
elem_name;
//Values
elem_sorted;
//DefaultValueIndex
0;
//Sorted_optional
false;
# ----------------------------------------
dropdown_data = Custom[DropDown Data](InputName=code_block_3.out4, Keys=code_block_3.out5, Values=code_block_3.out6, DefaultValueIndex=code_block_3.out7, Sorted_optional=code_block_3.out8)  # package Data-Shapes; Create data for DropDown input in UI.MultiInputForm ++ . Check out www.data-shapes.net for more infos.
code_block_4 = CodeBlock()
# ---------- code_block_4.designscript (6 lines) ----------
//InputName
"Espaciamiento";
//DefaultText
"200";
//IsNumberEntry
true;
# ----------------------------------------
textbox_data = Custom[TextBox Data](InputName=code_block_4.out0, DefaultText=code_block_4.out1, IsNumberEntry=code_block_4.out2)  # package Data-Shapes; Create Data for TextBox input in UI.MultipleInputForm ++ . Check out www.data-shapes.net for more informations
list_create = List.Create(item0=dropdown_data, item1=textbox_data)
inputgroup_data_2 = Custom[InputGroup Data](GroupTitle=code_block_2, Inputs=list_create)
list_create_2 = List.Create(item0=inputgroup_data, item1=inputgroup_data_2)
code_block_5 = CodeBlock(inputs=list_create_2)
# ---------- code_block_5.designscript (20 lines) ----------
//Description
"Estribos";
//Logo
"C:\\Arainco\\Arainco.png";
//ButtonText
"INICIAR";
//Inputs
inputs;
//Toggle
true;
//LinkToHelp
null;
//CancelButtonText
"CANCELAR";
//MaxHeight
0;
//Width
430;
//LabelWidth
170;
# ----------------------------------------
multipleinputform = Custom[MultipleInputForm ++](Description_optional=code_block_5.out0, Logo_optional=code_block_5.out1, ButtonText_optional=code_block_5.out2, Inputs=code_block_5.inputs, Toggle=code_block_5.out4, LinkToHelp_optional=code_block_5.out5, CancelButtonText_optional=code_block_5.out6, MaxHeight_optional=code_block_5.out7, Width_optional=code_block_5.out8, LabelWidth_optional=code_block_5.out9)  # package Data-Shapes; Create a form with multiple inputs. see www.data-shapes.net for tutorials and infos!
code_block_6 = CodeBlock(l=multipleinputform.User_Inputs)
# ---------- code_block_6.designscript (12 lines) ----------
l;
[Imperative]
{
	if (l == null)
	{
		return = [[],[],[],[],[],[],[],[],[],[]];
	}
	else
	{
		return = l;
	}
};
# ----------------------------------------
current_2 = Document.Current()
activeView_2 = Document.ActiveView(document=current_2)

# group: 2 Barras
element_types_ᶜᵒⁿᵛᵉʳᵗᵉᵈ_ᵈʳᵒᵖᵈᵒʷⁿ_2 = CodeBlock { DSCore.Types.FindTypeByNameInAssembly("RebarHookType", "RevitAPI"); }
all_elements_of_type_2 = ElementsOfType(element_type=element_types_ᶜᵒⁿᵛᵉʳᵗᵉᵈ_ᵈʳᵒᵖᵈᵒʷⁿ_2)
plane = Custom[View.Plane](view=activeView_2)  # package Clockwork for Dynamo 2.x; Retrieves the plane of a given view
code_block_7 = CodeBlock(x=code_block_6.out1, pata=all_elements_of_type_2, view_plane=plane)
# ---------- code_block_7.designscript (120 lines) ----------
elementos = x[0];
tipo_barra_extremos = x[1];
espaciamiento_extremos = x[2];
pata;
pata_names = Revit.Elements.Element.Name(pata);
mask = pata_names == "Stirrup/Tie - 135 deg.";
hook = DSCore.List.FilterByBoolMask(pata, mask)["in"][0];

//Obtener la cantidad de barras para definir cuantos estribos utilizar
rebar_cat = Revit.Category.ByName("Structural Rebar");
str_framing_rebars = Rhythm.Elements.DependentElementsOfCategory(elementos, rebar_cat);
str_framing_rebars_shapes = Revit.Elements.Element.GetParameterValueByName(str_framing_rebars, "Shape");
str_framing_rebars_shapes_names = Revit.Elements.Element.Name(str_framing_rebars_shapes);
str_framing_rebars_mask = DSCore.String.Contains(str_framing_rebars_shapes_names, "R_S_", false);
str_framing_rebars_R_S_ = DSCore.List.GetItemAtIndex(DSCore.List.FilterByBoolMask(str_framing_rebars, str_framing_rebars_mask)["in"]@L2<1>, 0);
str_framing_rebars_quantities = Revit.Elements.Element.GetParameterValueByName(str_framing_rebars_R_S_, "Quantity");

//filtro de elementos en funcion de la cantidad de barras
elementos_mask = str_framing_rebars_quantities == 2;
elem = DSCore.List.FilterByBoolMask(elementos, elementos_mask)["in"];


//Normal plano vista actual
view_plane_normal = Autodesk.Plane.Normal(view_plane);

//Variables para filtrar elementos por categoria
elem_category = Revit.Elements.Element.GetCategory(elem);
elem_category_name = Revit.Category.Name(elem_category);

//Filtrar vigas de hormigon paralelos a la vista actual
structural_framing_mask = elem_category_name == "Structural Framing";
structural_framing = DSCore.List.FilterByBoolMask(elem, structural_framing_mask)["in"];
structural_framing_material = DSCore.List.Flatten(Revit.Elements.Element.GetMaterials(structural_framing, false));
structural_framing_material_name = Revit.Material.Name(structural_framing_material);
structural_framing_material_mask = structural_framing_material_name == "Concrete, Cast-in-Place gray";
structural_framing_hormigon = DSCore.List.FilterByBoolMask(structural_framing, structural_framing_material_mask)["in"];
structural_framing_hormigon_location = Revit.Elements.Element.GetLocation(structural_framing_hormigon);
structural_framing_hormigon_vector = Line.Direction(structural_framing_hormigon_location);
structural_framing_hormigon_centroid = Autodesk.Solid.Centroid(DSCore.List.Flatten(Revit.Elements.Element.Geometry(structural_framing_hormigon)));
structural_framing_hormigon_coo_sys = Autodesk.Curve.CoordinateSystemAtParameter(structural_framing_hormigon_location);
structural_framing_hormigon_vector_mask = Autodesk.Vector.IsParallel(CoordinateSystem.XAxis(structural_framing_hormigon_coo_sys), view_plane_normal);
structural_framing_hormigon_lst = DSCore.List.FilterByBoolMask(structural_framing_hormigon, structural_framing_hormigon_vector_mask)["in"];
structural_framing_hormigon_lst_location = Revit.Elements.Element.GetLocation(structural_framing_hormigon_lst);
structural_framing_hormigon_lst_cut_len = Revit.Elements.Element.GetParameterValueByName(structural_framing_hormigon_lst, "Cut Length");
structural_framing_hormigon_lst_location_len = Autodesk.Curve.Length(structural_framing_hormigon_lst_location);
structural_framing_hormigon_lst_location_start_p = Autodesk.Curve.StartPoint(structural_framing_hormigon_lst_location);
structural_framing_hormigon_lst_location_end_p = Autodesk.Curve.EndPoint(structural_framing_hormigon_lst_location);
structural_framing_hormigon_lst_vector = Autodesk.Vector.ByTwoPoints(structural_framing_hormigon_lst_location_start_p, structural_framing_hormigon_lst_location_end_p);
structural_framing_hormigon_lst_vector_len = Autodesk.Vector.Length(structural_framing_hormigon_lst_vector);

//Altura de Vigas seleccionadas
elem_altura = Revit.Elements.Element.GetParameterValueByName(Revit.Elements.Element.GetParameterValueByName(elem, "Type"), "Height");

//Curva de las Vigas
elem_curve_inicial = Revit.Elements.Element.GetLocation(structural_framing_hormigon_lst);
elem_curve_inicial_len = DesignScript.Curve.Length(elem_curve_inicial);
dif_len = DSCore.Math.Abs(structural_framing_hormigon_lst_cut_len - structural_framing_hormigon_lst_location_len) / 2;
x_1 = Autodesk.Curve.ExtendEnd(Autodesk.Curve.ExtendStart(structural_framing_hormigon_lst_location, (dif_len + 50) * -1), (dif_len + 50) * -1);
x_2 = Autodesk.Curve.ExtendEnd(Autodesk.Curve.ExtendStart(structural_framing_hormigon_lst_location, (dif_len + 50) * -1), (dif_len + 50) * -1);

elem_curve = [Imperative]
{
	if(structural_framing_hormigon_lst_location_len >= structural_framing_hormigon_lst_cut_len)
	{
		return  x_1;
	}
	else
	{
		return  x_2;
	}
};
elem_curve_start_p = Autodesk.Curve.StartPoint(elem_curve);
elem_curve_end_p = Autodesk.Curve.EndPoint(elem_curve);
elem_curve_vector = Autodesk.Vector.ByTwoPoints(elem_curve_start_p, elem_curve_end_p);
elem_curve_vector_len = Autodesk.Vector.Length(elem_curve_vector);

//Geometria a Cortar
g_elem_solid = DSCore.List.Flatten(Revit.Elements.Element.Geometry(structural_framing_hormigon_lst));
g_solid_centroid = Autodesk.Solid.Centroid(g_elem_solid);
g_solid_coo_sys = Autodesk.Curve.CoordinateSystemAtParameter(structural_framing_hormigon_lst_location, 0.5);
g_solid_plane = CoordinateSystem.YZPlane(g_solid_coo_sys);
g_solid_scaled = Autodesk.Geometry.Scale(g_elem_solid, g_solid_plane, 5, 1, 1);

//Geometria Estribo
geom_param_at_point = DesignScript.Curve.ParameterAtPoint(elem_curve, elem_curve_start_p);
geom_plane_at_param = DesignScript.Curve.PlaneAtParameter(elem_curve, geom_param_at_point);
geom_surface = DSCore.List.Flatten(Autodesk.Geometry.Intersect(g_solid_scaled, geom_plane_at_param), -1);
geom_surface_perimeter = Autodesk.Surface.PerimeterCurves(geom_surface);
geom_surface_perimeter_as_polycurve = PolyCurve.ByJoinedCurves(geom_surface_perimeter);
geom_surface_perimeter_curves = Autodesk.Geometry.Explode(PolyCurve.Offset(geom_surface_perimeter_as_polycurve, -25, false));

//Estribos Extermos
tag_location = g_solid_centroid;
//curves
geom_surface_perimeter_curves;
//rebarStyle
"StirrupTie";
//rebarBarType
tipo_barra_extremos;
//startHookType
hook;
//endHookType
hook;
//startHookOrientation
"Left";
//endtHookOrientation
"Left";
//hostElement
structural_framing_hormigon_lst;
//vector
structural_framing_hormigon_lst_vector;
//spacing
espaciamiento_extremos;
//ArrayLength
elem_curve_vector_len;
//Punto para posicionar tag
tag_location;


//
# ----------------------------------------
fromCurves = StructuralDesign.Rebar.Create.FromCurves(curves=code_block_7.out61, rebarStyle=code_block_7.out62, rebarBarType=code_block_7.out63, startHookType=code_block_7.out64, endHookType=code_block_7.out65, startHookOrientation=code_block_7.out66, endHookOrientation=code_block_7.out67, hostElement=code_block_7.out68, vector=code_block_7.out69)
setLayoutAsMaximumSpacing = StructuralDesign.Rebar.Layout.SetLayoutAsMaximumSpacing(rebar=fromCurves, spacing=code_block_7.out70, arrayLength=code_block_7.out71, lacing=Longest)
code_block_8 = CodeBlock { "FirstLast"; }
setRebarPresentation = Custom[SetRebarPresentation](rebarElements=setLayoutAsMaximumSpacing, rebarRepresentation=code_block_8)  # Change de Rebar representation of the selected elements in the active view. Rebar Representations Options - All - FirstLast - Middle
flatten = List.Flatten(list=setRebarPresentation)
code_block_9 = CodeBlock(element=flatten, tag_location=code_block_7.out72)
# ---------- code_block_9.designscript (19 lines) ----------
//Asigna el tipo de estribo (sim, doble, etc...)
Revit.Elements.Element.SetParameterByName(element, "Estribo", "E.");
tag_location;

//element
element;
//TagLocation
tag_location;
//TagType
family = Revit.Family.ByName("EST_A_STRUCTURAL REBAR TAG_ESTRIBO");
tag_type = Revit.Elements.FamilyType.ByFamilyAndName(family, "R_E_00");
//horizontal
true;
//addLeader
false;
//LinkInstance
null;
//RunIt
true;
# ----------------------------------------
create_tag = Custom[Create Tag](view=activeView@L1, element=code_block_9.out2@L2, TagLocation=code_block_9.out3@L2, TagType=code_block_9.out5@L1, horizontal=code_block_9.out6@L1, addLeader=code_block_9.out7@L1, LinkInstance=code_block_9.out8@L1, RunIt=code_block_9.out9@L1, lacing=Longest)  # package Genius Loci; Works only in Revit 2018 and later. Creates a tag at a given location, of given type and in a supplied view. The node also works with Linked Elements (except space and area), Multi Category tag and Material Tag. Based on an archilab node

current_3 = Document.Current()
activeView_3 = Document.ActiveView(document=current_3)
current_4 = Document.Current()
activeView_4 = Document.ActiveView(document=current_4)

# group: 3 Barras
element_types_ᶜᵒⁿᵛᵉʳᵗᵉᵈ_ᵈʳᵒᵖᵈᵒʷⁿ_3 = CodeBlock { DSCore.Types.FindTypeByNameInAssembly("RebarHookType", "RevitAPI"); }
all_elements_of_type_3 = ElementsOfType(element_type=element_types_ᶜᵒⁿᵛᵉʳᵗᵉᵈ_ᵈʳᵒᵖᵈᵒʷⁿ_3)
plane_2 = Custom[View.Plane](view=activeView_4)
code_block_10 = CodeBlock(x=code_block_6.out1, pata=all_elements_of_type_3, view_plane=plane_2)
# ---------- code_block_10.designscript (120 lines) ----------
elementos = x[0];
tipo_barra_extremos = x[1];
espaciamiento_extremos = x[2];
pata;
pata_names = Revit.Elements.Element.Name(pata);
mask = pata_names == "Stirrup/Tie - 135 deg.";
hook = DSCore.List.FilterByBoolMask(pata, mask)["in"][0];

//Obtener la cantidad de barras para definir cuantos estribos utilizar
rebar_cat = Revit.Category.ByName("Structural Rebar");
str_framing_rebars = Rhythm.Elements.DependentElementsOfCategory(elementos, rebar_cat);
str_framing_rebars_shapes = Revit.Elements.Element.GetParameterValueByName(str_framing_rebars, "Shape");
str_framing_rebars_shapes_names = Revit.Elements.Element.Name(str_framing_rebars_shapes);
str_framing_rebars_mask = DSCore.String.Contains(str_framing_rebars_shapes_names, "R_S_", false);
str_framing_rebars_R_S_ = DSCore.List.GetItemAtIndex(DSCore.List.FilterByBoolMask(str_framing_rebars, str_framing_rebars_mask)["in"]@L2<1>, 0);
str_framing_rebars_quantities = Revit.Elements.Element.GetParameterValueByName(str_framing_rebars_R_S_, "Quantity");

//filtro de elementos en funcion de la cantidad de barras
elementos_mask = str_framing_rebars_quantities == 3;
elem = DSCore.List.FilterByBoolMask(elementos, elementos_mask)["in"];


//Normal plano vista actual
view_plane_normal = Autodesk.Plane.Normal(view_plane);

//Variables para filtrar elementos por categoria
elem_category = Revit.Elements.Element.GetCategory(elem);
elem_category_name = Revit.Category.Name(elem_category);

//Filtrar vigas de hormigon paralelos a la vista actual
structural_framing_mask = elem_category_name == "Structural Framing";
structural_framing = DSCore.List.FilterByBoolMask(elem, structural_framing_mask)["in"];
structural_framing_material = DSCore.List.Flatten(Revit.Elements.Element.GetMaterials(structural_framing, false));
structural_framing_material_name = Revit.Material.Name(structural_framing_material);
structural_framing_material_mask = structural_framing_material_name == "Concrete, Cast-in-Place gray";
structural_framing_hormigon = DSCore.List.FilterByBoolMask(structural_framing, structural_framing_material_mask)["in"];
structural_framing_hormigon_location = Revit.Elements.Element.GetLocation(structural_framing_hormigon);
structural_framing_hormigon_vector = Line.Direction(structural_framing_hormigon_location);
structural_framing_hormigon_centroid = Autodesk.Solid.Centroid(DSCore.List.Flatten(Revit.Elements.Element.Geometry(structural_framing_hormigon)));
structural_framing_hormigon_coo_sys = Autodesk.Curve.CoordinateSystemAtParameter(structural_framing_hormigon_location);
structural_framing_hormigon_vector_mask = Autodesk.Vector.IsParallel(CoordinateSystem.XAxis(structural_framing_hormigon_coo_sys), view_plane_normal);
structural_framing_hormigon_lst = DSCore.List.FilterByBoolMask(structural_framing_hormigon, structural_framing_hormigon_vector_mask)["in"];
structural_framing_hormigon_lst_location = Revit.Elements.Element.GetLocation(structural_framing_hormigon_lst);
structural_framing_hormigon_lst_cut_len = Revit.Elements.Element.GetParameterValueByName(structural_framing_hormigon_lst, "Cut Length");
structural_framing_hormigon_lst_location_len = Autodesk.Curve.Length(structural_framing_hormigon_lst_location);
structural_framing_hormigon_lst_location_start_p = Autodesk.Curve.StartPoint(structural_framing_hormigon_lst_location);
structural_framing_hormigon_lst_location_end_p = Autodesk.Curve.EndPoint(structural_framing_hormigon_lst_location);
structural_framing_hormigon_lst_vector = Autodesk.Vector.ByTwoPoints(structural_framing_hormigon_lst_location_start_p, structural_framing_hormigon_lst_location_end_p);
structural_framing_hormigon_lst_vector_len = Autodesk.Vector.Length(structural_framing_hormigon_lst_vector);

//Altura de Vigas seleccionadas
elem_altura = Revit.Elements.Element.GetParameterValueByName(Revit.Elements.Element.GetParameterValueByName(elem, "Type"), "Height");

//Curva de las Vigas
elem_curve_inicial = Revit.Elements.Element.GetLocation(structural_framing_hormigon_lst);
elem_curve_inicial_len = DesignScript.Curve.Length(elem_curve_inicial);
dif_len = DSCore.Math.Abs(structural_framing_hormigon_lst_cut_len - structural_framing_hormigon_lst_location_len) / 2;
x_1 = Autodesk.Curve.ExtendEnd(Autodesk.Curve.ExtendStart(structural_framing_hormigon_lst_location, (dif_len + 50) * -1), (dif_len + 50) * -1);
x_2 = Autodesk.Curve.ExtendEnd(Autodesk.Curve.ExtendStart(structural_framing_hormigon_lst_location, (dif_len + 50) * -1), (dif_len + 50) * -1);

elem_curve = [Imperative]
{
	if(structural_framing_hormigon_lst_location_len >= structural_framing_hormigon_lst_cut_len)
	{
		return  x_1;
	}
	else
	{
		return  x_2;
	}
};
elem_curve_start_p = Autodesk.Curve.StartPoint(elem_curve);
elem_curve_end_p = Autodesk.Curve.EndPoint(elem_curve);
elem_curve_vector = Autodesk.Vector.ByTwoPoints(elem_curve_start_p, elem_curve_end_p);
elem_curve_vector_len = Autodesk.Vector.Length(elem_curve_vector);

//Geometria a Cortar
g_elem_solid = DSCore.List.Flatten(Revit.Elements.Element.Geometry(structural_framing_hormigon_lst));
g_solid_centroid = Autodesk.Solid.Centroid(g_elem_solid);
g_solid_coo_sys = Autodesk.Curve.CoordinateSystemAtParameter(structural_framing_hormigon_lst_location, 0.5);
g_solid_plane = CoordinateSystem.YZPlane(g_solid_coo_sys);
g_solid_scaled = Autodesk.Geometry.Scale(g_elem_solid, g_solid_plane, 5, 1, 1);

//Geometria Estribo
geom_param_at_point = DesignScript.Curve.ParameterAtPoint(elem_curve, elem_curve_start_p);
geom_plane_at_param = DesignScript.Curve.PlaneAtParameter(elem_curve, geom_param_at_point);
geom_surface = DSCore.List.Flatten(Autodesk.Geometry.Intersect(g_solid_scaled, geom_plane_at_param), -1);
geom_surface_perimeter = Autodesk.Surface.PerimeterCurves(geom_surface);
geom_surface_perimeter_as_polycurve = PolyCurve.ByJoinedCurves(geom_surface_perimeter);
geom_surface_perimeter_curves = Autodesk.Geometry.Explode(PolyCurve.Offset(geom_surface_perimeter_as_polycurve, -25, false));

//Estribos Extermos
tag_location = g_solid_centroid;
//curves
geom_surface_perimeter_curves;
//rebarStyle
"StirrupTie";
//rebarBarType
tipo_barra_extremos;
//startHookType
hook;
//endHookType
hook;
//startHookOrientation
"Left";
//endtHookOrientation
"Left";
//hostElement
structural_framing_hormigon_lst;
//vector
structural_framing_hormigon_lst_vector;
//spacing
espaciamiento_extremos;
//ArrayLength
elem_curve_vector_len;
//Punto para posicionar tag
tag_location;


//
# ----------------------------------------
fromCurves_2 = StructuralDesign.Rebar.Create.FromCurves(curves=code_block_10.out61, rebarStyle=code_block_10.out62, rebarBarType=code_block_10.out63, startHookType=code_block_10.out64, endHookType=code_block_10.out65, startHookOrientation=code_block_10.out66, endHookOrientation=code_block_10.out67, hostElement=code_block_10.out68, vector=code_block_10.out69)
setLayoutAsMaximumSpacing_2 = StructuralDesign.Rebar.Layout.SetLayoutAsMaximumSpacing(rebar=fromCurves_2, spacing=code_block_10.out70, arrayLength=code_block_10.out71, lacing=Longest)
code_block_11 = CodeBlock { "FirstLast"; }
setRebarPresentation_2 = Custom[SetRebarPresentation](rebarElements=setLayoutAsMaximumSpacing_2, rebarRepresentation=code_block_11)
flatten_2 = List.Flatten(list=setRebarPresentation_2)
code_block_12 = CodeBlock(element=flatten_2, tag_location=code_block_10.out72)  # same code as code_block_9
create_tag_2 = Custom[Create Tag](view=activeView_3@L1, element=code_block_12.out2@L2, TagLocation=code_block_12.out3@L2, TagType=code_block_12.out5@L1, horizontal=code_block_12.out6@L1, addLeader=code_block_12.out7@L1, LinkInstance=code_block_12.out8@L1, RunIt=code_block_12.out9@L1, lacing=Longest)

current_5 = Document.Current()
activeView_5 = Document.ActiveView(document=current_5)
current_6 = Document.Current()
activeView_6 = Document.ActiveView(document=current_6)

# group: 4 Barras
element_types_ᶜᵒⁿᵛᵉʳᵗᵉᵈ_ᵈʳᵒᵖᵈᵒʷⁿ_4 = CodeBlock { DSCore.Types.FindTypeByNameInAssembly("RebarHookType", "RevitAPI"); }
all_elements_of_type_4 = ElementsOfType(element_type=element_types_ᶜᵒⁿᵛᵉʳᵗᵉᵈ_ᵈʳᵒᵖᵈᵒʷⁿ_4)
plane_3 = Custom[View.Plane](view=activeView_6)
code_block_13 = CodeBlock(x=code_block_6.out1, pata=all_elements_of_type_4, view_plane=plane_3)
# ---------- code_block_13.designscript (171 lines) ----------
elementos = x[0];
tipo_barra_extremos = x[1];
espaciamiento_extremos = x[2];
pata;
pata_names = Revit.Elements.Element.Name(pata);
mask = pata_names == "Stirrup/Tie - 135 deg.";
hook = DSCore.List.FilterByBoolMask(pata, mask)["in"][0];

//Obtener la cantidad de barras para definir cuantos estribos utilizar
rebar_cat = Revit.Category.ByName("Structural Rebar");
str_framing_rebars = Rhythm.Elements.DependentElementsOfCategory(elementos, rebar_cat);
str_framing_rebars_shapes = Revit.Elements.Element.GetParameterValueByName(str_framing_rebars, "Shape");
str_framing_rebars_shapes_names = Revit.Elements.Element.Name(str_framing_rebars_shapes);
str_framing_rebars_mask = DSCore.String.Contains(str_framing_rebars_shapes_names, "R_S_", false);
str_framing_rebars_R_S_ = DSCore.List.GetItemAtIndex(DSCore.List.FilterByBoolMask(str_framing_rebars, str_framing_rebars_mask)["in"]@L2<1>, 0);
str_framing_rebars_quantities = Revit.Elements.Element.GetParameterValueByName(str_framing_rebars_R_S_, "Quantity");

//filtro de elementos en funcion de la cantidad de barras
elementos_mask = str_framing_rebars_quantities == 4;
elem = DSCore.List.FilterByBoolMask(elementos, elementos_mask)["in"];

//Normal plano vista actual
view_plane_normal = Autodesk.Plane.Normal(view_plane);

//Variables para filtrar elementos por categoria
elem_category = Revit.Elements.Element.GetCategory(elem);
elem_category_name = Revit.Category.Name(elem_category);

//Filtrar vigas de hormigon paralelos a la vista actual
structural_framing_mask = elem_category_name == "Structural Framing";
structural_framing = DSCore.List.FilterByBoolMask(elem, structural_framing_mask)["in"];
structural_framing_material = DSCore.List.Flatten(Revit.Elements.Element.GetMaterials(structural_framing, false));
structural_framing_material_name = Revit.Material.Name(structural_framing_material);
structural_framing_material_mask = structural_framing_material_name == "Concrete, Cast-in-Place gray";
structural_framing_hormigon = DSCore.List.FilterByBoolMask(structural_framing, structural_framing_material_mask)["in"];
structural_framing_hormigon_location = Revit.Elements.Element.GetLocation(structural_framing_hormigon);
structural_framing_hormigon_vector = Line.Direction(structural_framing_hormigon_location);
structural_framing_hormigon_centroid = Autodesk.Solid.Centroid(DSCore.List.Flatten(Revit.Elements.Element.Geometry(structural_framing_hormigon)));
structural_framing_hormigon_coo_sys = Autodesk.Curve.CoordinateSystemAtParameter(structural_framing_hormigon_location);
structural_framing_hormigon_vector_mask = Autodesk.Vector.IsParallel(CoordinateSystem.XAxis(structural_framing_hormigon_coo_sys), view_plane_normal);
structural_framing_hormigon_lst = DSCore.List.FilterByBoolMask(structural_framing_hormigon, structural_framing_hormigon_vector_mask)["in"];
structural_framing_hormigon_lst_location = Revit.Elements.Element.GetLocation(structural_framing_hormigon_lst);
structural_framing_hormigon_lst_cut_len = Revit.Elements.Element.GetParameterValueByName(structural_framing_hormigon_lst, "Cut Length");
structural_framing_hormigon_lst_location_len = Autodesk.Curve.Length(structural_framing_hormigon_lst_location);
structural_framing_hormigon_lst_location_start_p = Autodesk.Curve.StartPoint(structural_framing_hormigon_lst_location);
structural_framing_hormigon_lst_location_end_p = Autodesk.Curve.EndPoint(structural_framing_hormigon_lst_location);
structural_framing_hormigon_lst_vector = Autodesk.Vector.ByTwoPoints(structural_framing_hormigon_lst_location_start_p, structural_framing_hormigon_lst_location_end_p);
structural_framing_hormigon_lst_vector_len = Autodesk.Vector.Length(structural_framing_hormigon_lst_vector);

//Altura de Vigas seleccionadas
elem_altura = Revit.Elements.Element.GetParameterValueByName(Revit.Elements.Element.GetParameterValueByName(elem, "Type"), "Height");

//Curva de las Vigas
elem_curve_inicial = Revit.Elements.Element.GetLocation(structural_framing_hormigon_lst);
elem_curve_inicial_len = DesignScript.Curve.Length(elem_curve_inicial);
dif_len = DSCore.Math.Abs(structural_framing_hormigon_lst_cut_len - structural_framing_hormigon_lst_location_len) / 2;
x_1 = Autodesk.Curve.ExtendEnd(Autodesk.Curve.ExtendStart(structural_framing_hormigon_lst_location, (dif_len + 50) * -1), (dif_len + 50) * -1);
x_2 = Autodesk.Curve.ExtendEnd(Autodesk.Curve.ExtendStart(structural_framing_hormigon_lst_location, (dif_len + 50) * -1), (dif_len + 50) * -1);

elem_curve = [Imperative]
{
	if(structural_framing_hormigon_lst_location_len >= structural_framing_hormigon_lst_cut_len)
	{
		return  x_1;
	}
	else
	{
		return  x_2;
	}
};
elem_curve_start_p = Autodesk.Curve.StartPoint(elem_curve);
elem_curve_end_p = Autodesk.Curve.EndPoint(elem_curve);
elem_curve_vector = Autodesk.Vector.ByTwoPoints(elem_curve_start_p, elem_curve_end_p);
elem_curve_vector_len = Autodesk.Vector.Length(elem_curve_vector);

//Geometria a Cortar
g_elem_solid = DSCore.List.Flatten(Revit.Elements.Element.Geometry(structural_framing_hormigon_lst));
g_solid_centroid = Autodesk.Solid.Centroid(g_elem_solid);
g_solid_coo_sys = Autodesk.Curve.CoordinateSystemAtParameter(structural_framing_hormigon_lst_location, 0.5);
g_solid_plane = CoordinateSystem.YZPlane(g_solid_coo_sys);
g_solid_scaled = Autodesk.Geometry.Scale(g_elem_solid, g_solid_plane, 5, 1, 1);

//Geometria Estribo
geom_param_at_point = DesignScript.Curve.ParameterAtPoint(elem_curve, elem_curve_start_p);
geom_plane_at_param = DesignScript.Curve.PlaneAtParameter(elem_curve, geom_param_at_point);
geom_surface = DSCore.List.Flatten(Autodesk.Geometry.Intersect(g_solid_scaled, geom_plane_at_param), -1);
geom_surface_perimeter = Autodesk.Surface.PerimeterCurves(geom_surface);
geom_surface_perimeter_as_polycurve = PolyCurve.Offset(PolyCurve.ByJoinedCurves(geom_surface_perimeter), -25, false);
geom_surface_offset = Autodesk.Surface.ByPatch(geom_surface_perimeter_as_polycurve);
//Estribo 1
geom_surface_coo_sys_1 = Autodesk.Surface.CoordinateSystemAtParameter(geom_surface_offset, 0, 0.6935);
geom_surface_cut_plane_1 = CoordinateSystem.ZXPlane(geom_surface_coo_sys_1);
geom_surface_split_1 = Autodesk.Geometry.Split(geom_surface_offset, geom_surface_cut_plane_1);
geom_surface_1 = DSCore.List.GetItemAtIndex(geom_surface_split_1@L2<1>, 1);
geom_surface_perimeter_1 = Autodesk.Surface.PerimeterCurves(geom_surface_1);
geom_surface_perimeter_as_polycurve_1 = PolyCurve.ByJoinedCurves(geom_surface_perimeter_1);
geom_surface_perimeter_curves_1 = Autodesk.Geometry.Explode(geom_surface_perimeter_as_polycurve_1);
//Estribo 2
geom_surface_coo_sys_2 = Autodesk.Surface.CoordinateSystemAtParameter(geom_surface_offset, 0, 0.3065);
geom_surface_cut_plane_2 = CoordinateSystem.ZXPlane(geom_surface_coo_sys_2);
geom_surface_split_2 = Autodesk.Geometry.Split(geom_surface_offset, geom_surface_cut_plane_2);
geom_surface_2 = DSCore.List.GetItemAtIndex(geom_surface_split_2@L2<1>, 0);
geom_surface_perimeter_2 = Autodesk.Surface.PerimeterCurves(geom_surface_2);
geom_surface_perimeter_as_polycurve_2 = PolyCurve.ByJoinedCurves(geom_surface_perimeter_2);
geom_surface_perimeter_curves_2 = Autodesk.Geometry.Explode(geom_surface_perimeter_as_polycurve_2);

geom_surface_perimeter_curves_lst = [geom_surface_perimeter_curves_1, geom_surface_perimeter_curves_2];

//Estribos 1
tag_location = g_solid_centroid;
//curves
geom_surface_perimeter_curves_1;
//rebarStyle
"StirrupTie";
//rebarBarType
tipo_barra_extremos;
//startHookType
hook;
//endHookType
hook;
//startHookOrientation
"Right";
//endtHookOrientation
"Right";
//hostElement
structural_framing_hormigon_lst;
//vector
structural_framing_hormigon_lst_vector;
//spacing
espaciamiento_extremos;
//ArrayLength
elem_curve_vector_len;
//Punto para posicionar tag
tag_location;










//Estribos 2
//curves
geom_surface_perimeter_curves_2;
//rebarStyle
"StirrupTie";
//rebarBarType
tipo_barra_extremos;
//startHookType
hook;
//endHookType
hook;
//startHookOrientation
"Left";
//endtHookOrientation
"Left";
//hostElement
structural_framing_hormigon_lst;
//vector
structural_framing_hormigon_lst_vector;
//spacing
espaciamiento_extremos;
//ArrayLength
elem_curve_vector_len;
//Punto para posicionar tag
tag_location;

//
# ----------------------------------------
fromCurves_3 = StructuralDesign.Rebar.Create.FromCurves(curves=code_block_13.out76, rebarStyle=code_block_13.out77, rebarBarType=code_block_13.out78, startHookType=code_block_13.out79, endHookType=code_block_13.out80, startHookOrientation=code_block_13.out81, endHookOrientation=code_block_13.out82, hostElement=code_block_13.out83, vector=code_block_13.out84)
setLayoutAsMaximumSpacing_3 = StructuralDesign.Rebar.Layout.SetLayoutAsMaximumSpacing(rebar=fromCurves_3, spacing=code_block_13.out85, arrayLength=code_block_13.out86, lacing=Longest)
code_block_14 = CodeBlock { "FirstLast"; }
setRebarPresentation_3 = Custom[SetRebarPresentation](rebarElements=setLayoutAsMaximumSpacing_3, rebarRepresentation=code_block_14)
flatten_3 = List.Flatten(list=setRebarPresentation_3)
code_block_15 = CodeBlock(element=flatten_3, tag_location=code_block_13.out87)
# ---------- code_block_15.designscript (19 lines) ----------
//Asigna el tipo de estribo (sim, doble, etc...)
Revit.Elements.Element.SetParameterByName(element, "Estribo", "ED.");
tag_location;

//element
element;
//TagLocation
tag_location;
//TagType
family = Revit.Family.ByName("EST_A_STRUCTURAL REBAR TAG_ESTRIBO");
tag_type = Revit.Elements.FamilyType.ByFamilyAndName(family, "R_E_00");
//horizontal
true;
//addLeader
false;
//LinkInstance
null;
//RunIt
true;
# ----------------------------------------
create_tag_3 = Custom[Create Tag](view=activeView_5@L1, element=code_block_15.out2@L2, TagLocation=code_block_15.out3@L2, TagType=code_block_15.out5@L1, horizontal=code_block_15.out6@L1, addLeader=code_block_15.out7@L1, LinkInstance=code_block_15.out8@L1, RunIt=code_block_15.out9@L1, lacing=Longest)
fromCurves_4 = StructuralDesign.Rebar.Create.FromCurves(curves=code_block_13.out88, rebarStyle=code_block_13.out89, rebarBarType=code_block_13.out90, startHookType=code_block_13.out91, endHookType=code_block_13.out92, startHookOrientation=code_block_13.out93, endHookOrientation=code_block_13.out94, hostElement=code_block_13.out95, vector=code_block_13.out96)
setLayoutAsMaximumSpacing_4 = StructuralDesign.Rebar.Layout.SetLayoutAsMaximumSpacing(rebar=fromCurves_4, spacing=code_block_13.out97, arrayLength=code_block_13.out98, lacing=Longest)
code_block_16 = CodeBlock { "FirstLast"; }
setRebarPresentation_4 = Custom[SetRebarPresentation](rebarElements=setLayoutAsMaximumSpacing_4, rebarRepresentation=code_block_16)
flatten_4 = List.Flatten(list=setRebarPresentation_4)
code_block_17 = CodeBlock(element=flatten_4)
# ---------- code_block_17.designscript (2 lines) ----------
//Asigna el tipo de estribo (sim, doble, etc...)
Revit.Elements.Element.SetParameterByName(element, "Estribo", "ED.");
# ----------------------------------------

current_7 = Document.Current()
activeView_7 = Document.ActiveView(document=current_7)
current_8 = Document.Current()
activeView_8 = Document.ActiveView(document=current_8)

# group: 5 Barras
element_types_ᶜᵒⁿᵛᵉʳᵗᵉᵈ_ᵈʳᵒᵖᵈᵒʷⁿ_5 = CodeBlock { DSCore.Types.FindTypeByNameInAssembly("RebarHookType", "RevitAPI"); }
all_elements_of_type_5 = ElementsOfType(element_type=element_types_ᶜᵒⁿᵛᵉʳᵗᵉᵈ_ᵈʳᵒᵖᵈᵒʷⁿ_5)
plane_4 = Custom[View.Plane](view=activeView_8)
code_block_18 = CodeBlock(x=code_block_6.out1, pata=all_elements_of_type_5, view_plane=plane_4)
# ---------- code_block_18.designscript (174 lines) ----------
elementos = x[0];
tipo_barra_extremos = x[1];
espaciamiento_extremos = x[2];
pata;
pata_names = Revit.Elements.Element.Name(pata);
mask = pata_names == "Stirrup/Tie - 135 deg.";
hook = DSCore.List.FilterByBoolMask(pata, mask)["in"][0];

//Obtener la cantidad de barras para definir cuantos estribos utilizar
rebar_cat = Revit.Category.ByName("Structural Rebar");
str_framing_rebars = Rhythm.Elements.DependentElementsOfCategory(elementos, rebar_cat);
str_framing_rebars_shapes = Revit.Elements.Element.GetParameterValueByName(str_framing_rebars, "Shape");
str_framing_rebars_shapes_names = Revit.Elements.Element.Name(str_framing_rebars_shapes);
str_framing_rebars_mask = DSCore.String.Contains(str_framing_rebars_shapes_names, "R_S_", false);
str_framing_rebars_R_S_ = DSCore.List.GetItemAtIndex(DSCore.List.FilterByBoolMask(str_framing_rebars, str_framing_rebars_mask)["in"]@L2<1>, 0);
str_framing_rebars_quantities = Revit.Elements.Element.GetParameterValueByName(str_framing_rebars_R_S_, "Quantity");

//filtro de elementos en funcion de la cantidad de barras
elementos_mask = str_framing_rebars_quantities == 5;
elem = DSCore.List.FilterByBoolMask(elementos, elementos_mask)["in"];

//Normal plano vista actual
view_plane_normal = Autodesk.Plane.Normal(view_plane);

//Variables para filtrar elementos por categoria
elem_category = Revit.Elements.Element.GetCategory(elem);
elem_category_name = Revit.Category.Name(elem_category);

//Filtrar vigas de hormigon paralelos a la vista actual
structural_framing_mask = elem_category_name == "Structural Framing";
structural_framing = DSCore.List.FilterByBoolMask(elem, structural_framing_mask)["in"];
structural_framing_material = DSCore.List.Flatten(Revit.Elements.Element.GetMaterials(structural_framing, false));
structural_framing_material_name = Revit.Material.Name(structural_framing_material);
structural_framing_material_mask = structural_framing_material_name == "Concrete, Cast-in-Place gray";
structural_framing_hormigon = DSCore.List.FilterByBoolMask(structural_framing, structural_framing_material_mask)["in"];
structural_framing_hormigon_location = Revit.Elements.Element.GetLocation(structural_framing_hormigon);
structural_framing_hormigon_vector = Line.Direction(structural_framing_hormigon_location);
structural_framing_hormigon_centroid = Autodesk.Solid.Centroid(DSCore.List.Flatten(Revit.Elements.Element.Geometry(structural_framing_hormigon)));
structural_framing_hormigon_coo_sys = Autodesk.Curve.CoordinateSystemAtParameter(structural_framing_hormigon_location);
structural_framing_hormigon_vector_mask = Autodesk.Vector.IsParallel(CoordinateSystem.XAxis(structural_framing_hormigon_coo_sys), view_plane_normal);
structural_framing_hormigon_lst = DSCore.List.FilterByBoolMask(structural_framing_hormigon, structural_framing_hormigon_vector_mask)["in"];
structural_framing_hormigon_lst_location = Revit.Elements.Element.GetLocation(structural_framing_hormigon_lst);
structural_framing_hormigon_lst_cut_len = Revit.Elements.Element.GetParameterValueByName(structural_framing_hormigon_lst, "Cut Length");
structural_framing_hormigon_lst_location_len = Autodesk.Curve.Length(structural_framing_hormigon_lst_location);
structural_framing_hormigon_lst_location_start_p = Autodesk.Curve.StartPoint(structural_framing_hormigon_lst_location);
structural_framing_hormigon_lst_location_end_p = Autodesk.Curve.EndPoint(structural_framing_hormigon_lst_location);
structural_framing_hormigon_lst_vector = Autodesk.Vector.ByTwoPoints(structural_framing_hormigon_lst_location_start_p, structural_framing_hormigon_lst_location_end_p);
structural_framing_hormigon_lst_vector_len = Autodesk.Vector.Length(structural_framing_hormigon_lst_vector);

//Altura de Vigas seleccionadas
elem_altura = Revit.Elements.Element.GetParameterValueByName(Revit.Elements.Element.GetParameterValueByName(elem, "Type"), "Height");

//Curva de las Vigas
elem_curve_inicial = Revit.Elements.Element.GetLocation(structural_framing_hormigon_lst);
elem_curve_inicial_len = DesignScript.Curve.Length(elem_curve_inicial);
dif_len = DSCore.Math.Abs(structural_framing_hormigon_lst_cut_len - structural_framing_hormigon_lst_location_len) / 2;
x_1 = Autodesk.Curve.ExtendEnd(Autodesk.Curve.ExtendStart(structural_framing_hormigon_lst_location, (dif_len + 50) * -1), (dif_len + 50) * -1);
x_2 = Autodesk.Curve.ExtendEnd(Autodesk.Curve.ExtendStart(structural_framing_hormigon_lst_location, (dif_len + 50) * -1), (dif_len + 50) * -1);

elem_curve = [Imperative]
{
	if(structural_framing_hormigon_lst_location_len >= structural_framing_hormigon_lst_cut_len)
	{
		return  x_1;
	}
	else
	{
		return  x_2;
	}
};
elem_curve_start_p = Autodesk.Curve.StartPoint(elem_curve);
elem_curve_end_p = Autodesk.Curve.EndPoint(elem_curve);
elem_curve_vector = Autodesk.Vector.ByTwoPoints(elem_curve_start_p, elem_curve_end_p);
elem_curve_vector_len = Autodesk.Vector.Length(elem_curve_vector);

//Geometria a Cortar
g_elem_solid = DSCore.List.Flatten(Revit.Elements.Element.Geometry(structural_framing_hormigon_lst));
g_solid_centroid = Autodesk.Solid.Centroid(g_elem_solid);
g_solid_coo_sys = Autodesk.Curve.CoordinateSystemAtParameter(structural_framing_hormigon_lst_location, 0.5);
g_solid_plane = CoordinateSystem.YZPlane(g_solid_coo_sys);
g_solid_scaled = Autodesk.Geometry.Scale(g_elem_solid, g_solid_plane, 5, 1, 1);

//Geometria Estribo
geom_param_at_point = DesignScript.Curve.ParameterAtPoint(elem_curve, elem_curve_start_p);
geom_plane_at_param = DesignScript.Curve.PlaneAtParameter(elem_curve, geom_param_at_point);
geom_surface = DSCore.List.Flatten(Autodesk.Geometry.Intersect(g_solid_scaled, geom_plane_at_param), -1);
geom_surface_perimeter = Autodesk.Surface.PerimeterCurves(geom_surface);
geom_surface_perimeter_as_polycurve = PolyCurve.Offset(PolyCurve.ByJoinedCurves(geom_surface_perimeter), -25, false);
geom_surface_offset = Autodesk.Surface.ByPatch(geom_surface_perimeter_as_polycurve);
//Estribo 1
geom_surface_coo_sys_1 = Autodesk.Surface.CoordinateSystemAtParameter(geom_surface_offset, 0, 0.76715);
geom_surface_cut_plane_1 = CoordinateSystem.ZXPlane(geom_surface_coo_sys_1);
geom_surface_split_1 = Autodesk.Geometry.Split(geom_surface_offset, geom_surface_cut_plane_1);
geom_surface_1 = DSCore.List.GetItemAtIndex(geom_surface_split_1@L2<1>, 1);
geom_surface_perimeter_1 = Autodesk.Surface.PerimeterCurves(geom_surface_1);
geom_surface_perimeter_as_polycurve_1 = PolyCurve.ByJoinedCurves(geom_surface_perimeter_1);
geom_surface_perimeter_curves_1 = Autodesk.Geometry.Explode(geom_surface_perimeter_as_polycurve_1);
//Estribo 2
geom_surface_coo_sys_2 = Autodesk.Surface.CoordinateSystemAtParameter(geom_surface_offset, 0, 0.23285);
geom_surface_cut_plane_2 = CoordinateSystem.ZXPlane(geom_surface_coo_sys_2);
geom_surface_split_2 = Autodesk.Geometry.Split(geom_surface_offset, geom_surface_cut_plane_2);
geom_surface_2 = DSCore.List.GetItemAtIndex(geom_surface_split_2@L2<1>, 0);
geom_surface_perimeter_2 = Autodesk.Surface.PerimeterCurves(geom_surface_2);
geom_surface_perimeter_as_polycurve_2 = PolyCurve.ByJoinedCurves(geom_surface_perimeter_2);
geom_surface_perimeter_curves_2 = Autodesk.Geometry.Explode(geom_surface_perimeter_as_polycurve_2);
//Traba
geom_surface_coo_sys_3 = Autodesk.Surface.CoordinateSystemAtParameter(geom_surface_offset, 0, 0.454257);
geom_surface_cut_plane_3 = CoordinateSystem.ZXPlane(geom_surface_coo_sys_3);
geom_surface_intersect_3 = Autodesk.Geometry.Intersect(geom_surface_offset, geom_surface_cut_plane_3);




//Estribos 1
tag_location = g_solid_centroid;
//curves
geom_surface_perimeter_curves_1;
//rebarStyle
"StirrupTie";
//rebarBarType
tipo_barra_extremos;
//startHookType
hook;
//endHookType
hook;
//startHookOrientation
"Right";
//endtHookOrientation
"Right";
//hostElement
structural_framing_hormigon_lst;
//vector
structural_framing_hormigon_lst_vector;
//spacing
espaciamiento_extremos;
//ArrayLength
elem_curve_vector_len;
//Punto para posicionar tag
tag_location;










//Estribos 2
//curves
geom_surface_perimeter_curves_2;
//rebarStyle
"StirrupTie";
//rebarBarType
tipo_barra_extremos;
//startHookType
hook;
//endHookType
hook;
//startHookOrientation
"Left";
//endtHookOrientation
"Left";
//hostElement
structural_framing_hormigon_lst;
//vector
structural_framing_hormigon_lst_vector;
//spacing
espaciamiento_extremos;
//ArrayLength
elem_curve_vector_len;

//
# ----------------------------------------
fromCurves_5 = StructuralDesign.Rebar.Create.FromCurves(curves=code_block_18.out78, rebarStyle=code_block_18.out79, rebarBarType=code_block_18.out80, startHookType=code_block_18.out81, endHookType=code_block_18.out82, startHookOrientation=code_block_18.out83, endHookOrientation=code_block_18.out84, hostElement=code_block_18.out85, vector=code_block_18.out86)
setLayoutAsMaximumSpacing_5 = StructuralDesign.Rebar.Layout.SetLayoutAsMaximumSpacing(rebar=fromCurves_5, spacing=code_block_18.out87, arrayLength=code_block_18.out88, lacing=Longest)
code_block_19 = CodeBlock { "FirstLast"; }
setRebarPresentation_5 = Custom[SetRebarPresentation](rebarElements=setLayoutAsMaximumSpacing_5, rebarRepresentation=code_block_19)
flatten_5 = List.Flatten(list=setRebarPresentation_5)
code_block_20 = CodeBlock(element=flatten_5, tag_location=code_block_18.out89)  # same code as code_block_15
create_tag_4 = Custom[Create Tag](view=activeView_7@L1, element=code_block_20.out2@L2, TagLocation=code_block_20.out3@L2, TagType=code_block_20.out5@L1, horizontal=code_block_20.out6@L1, addLeader=code_block_20.out7@L1, LinkInstance=code_block_20.out8@L1, RunIt=code_block_20.out9@L1, lacing=Longest)
fromCurves_6 = StructuralDesign.Rebar.Create.FromCurves(curves=code_block_18.out90, rebarStyle=code_block_18.out91, rebarBarType=code_block_18.out92, startHookType=code_block_18.out93, endHookType=code_block_18.out94, startHookOrientation=code_block_18.out95, endHookOrientation=code_block_18.out96, hostElement=code_block_18.out97, vector=code_block_18.out98)
setLayoutAsMaximumSpacing_6 = StructuralDesign.Rebar.Layout.SetLayoutAsMaximumSpacing(rebar=fromCurves_6, spacing=code_block_18.out99, arrayLength=code_block_18.out100, lacing=Longest)
code_block_21 = CodeBlock { "FirstLast"; }
setRebarPresentation_6 = Custom[SetRebarPresentation](rebarElements=setLayoutAsMaximumSpacing_6, rebarRepresentation=code_block_21)
flatten_6 = List.Flatten(list=setRebarPresentation_6)
code_block_22 = CodeBlock(element=flatten_6)  # same code as code_block_17

current_9 = Document.Current()
activeView_9 = Document.ActiveView(document=current_9)
current_10 = Document.Current()
activeView_10 = Document.ActiveView(document=current_10)

# group: 6 Barras
element_types_ᶜᵒⁿᵛᵉʳᵗᵉᵈ_ᵈʳᵒᵖᵈᵒʷⁿ_6 = CodeBlock { DSCore.Types.FindTypeByNameInAssembly("RebarHookType", "RevitAPI"); }
all_elements_of_type_6 = ElementsOfType(element_type=element_types_ᶜᵒⁿᵛᵉʳᵗᵉᵈ_ᵈʳᵒᵖᵈᵒʷⁿ_6)
plane_5 = Custom[View.Plane](view=activeView_9)
code_block_23 = CodeBlock(x=code_block_6.out1, pata=all_elements_of_type_6, view_plane=plane_5)
# ---------- code_block_23.designscript (213 lines) ----------
elementos = x[0];
tipo_barra_extremos = x[1];
espaciamiento_extremos = x[2];
pata;
pata_names = Revit.Elements.Element.Name(pata);
mask = pata_names == "Stirrup/Tie - 135 deg.";
hook = DSCore.List.FilterByBoolMask(pata, mask)["in"][0];

//Obtener la cantidad de barras para definir cuantos estribos utilizar
rebar_cat = Revit.Category.ByName("Structural Rebar");
str_framing_rebars = Rhythm.Elements.DependentElementsOfCategory(elementos, rebar_cat);
str_framing_rebars_shapes = Revit.Elements.Element.GetParameterValueByName(str_framing_rebars, "Shape");
str_framing_rebars_shapes_names = Revit.Elements.Element.Name(str_framing_rebars_shapes);
str_framing_rebars_mask = DSCore.String.Contains(str_framing_rebars_shapes_names, "R_S_", false);
str_framing_rebars_R_S_ = DSCore.List.GetItemAtIndex(DSCore.List.FilterByBoolMask(str_framing_rebars, str_framing_rebars_mask)["in"]@L2<1>, 0);
str_framing_rebars_quantities = Revit.Elements.Element.GetParameterValueByName(str_framing_rebars_R_S_, "Quantity");

//filtro de elementos en funcion de la cantidad de barras
elementos_mask = str_framing_rebars_quantities == 6;
elem = DSCore.List.FilterByBoolMask(elementos, elementos_mask)["in"];

//Normal plano vista actual
view_plane_normal = Autodesk.Plane.Normal(view_plane);

//Variables para filtrar elementos por categoria
elem_category = Revit.Elements.Element.GetCategory(elem);
elem_category_name = Revit.Category.Name(elem_category);

//Filtrar vigas de hormigon paralelos a la vista actual
structural_framing_mask = elem_category_name == "Structural Framing";
structural_framing = DSCore.List.FilterByBoolMask(elem, structural_framing_mask)["in"];
structural_framing_material = DSCore.List.Flatten(Revit.Elements.Element.GetMaterials(structural_framing, false));
structural_framing_material_name = Revit.Material.Name(structural_framing_material);
structural_framing_material_mask = structural_framing_material_name == "Concrete, Cast-in-Place gray";
structural_framing_hormigon = DSCore.List.FilterByBoolMask(structural_framing, structural_framing_material_mask)["in"];
structural_framing_hormigon_location = Revit.Elements.Element.GetLocation(structural_framing_hormigon);
structural_framing_hormigon_vector = Line.Direction(structural_framing_hormigon_location);
structural_framing_hormigon_centroid = Autodesk.Solid.Centroid(DSCore.List.Flatten(Revit.Elements.Element.Geometry(structural_framing_hormigon)));
structural_framing_hormigon_coo_sys = Autodesk.Curve.CoordinateSystemAtParameter(structural_framing_hormigon_location);
structural_framing_hormigon_vector_mask = Autodesk.Vector.IsParallel(CoordinateSystem.XAxis(structural_framing_hormigon_coo_sys), view_plane_normal);
structural_framing_hormigon_lst = DSCore.List.FilterByBoolMask(structural_framing_hormigon, structural_framing_hormigon_vector_mask)["in"];
structural_framing_hormigon_lst_location = Revit.Elements.Element.GetLocation(structural_framing_hormigon_lst);
structural_framing_hormigon_lst_cut_len = Revit.Elements.Element.GetParameterValueByName(structural_framing_hormigon_lst, "Cut Length");
structural_framing_hormigon_lst_location_len = Autodesk.Curve.Length(structural_framing_hormigon_lst_location);
structural_framing_hormigon_lst_location_start_p = Autodesk.Curve.StartPoint(structural_framing_hormigon_lst_location);
structural_framing_hormigon_lst_location_end_p = Autodesk.Curve.EndPoint(structural_framing_hormigon_lst_location);
structural_framing_hormigon_lst_vector = Autodesk.Vector.ByTwoPoints(structural_framing_hormigon_lst_location_start_p, structural_framing_hormigon_lst_location_end_p);
structural_framing_hormigon_lst_vector_len = Autodesk.Vector.Length(structural_framing_hormigon_lst_vector);

//Altura de Vigas seleccionadas
elem_altura = Revit.Elements.Element.GetParameterValueByName(Revit.Elements.Element.GetParameterValueByName(elem, "Type"), "Height");

//Curva de las Vigas
elem_curve_inicial = Revit.Elements.Element.GetLocation(structural_framing_hormigon_lst);
elem_curve_inicial_len = DesignScript.Curve.Length(elem_curve_inicial);
dif_len = DSCore.Math.Abs(structural_framing_hormigon_lst_cut_len - structural_framing_hormigon_lst_location_len) / 2;
x_1 = Autodesk.Curve.ExtendEnd(Autodesk.Curve.ExtendStart(structural_framing_hormigon_lst_location, (dif_len + 50) * -1), (dif_len + 50) * -1);
x_2 = Autodesk.Curve.ExtendEnd(Autodesk.Curve.ExtendStart(structural_framing_hormigon_lst_location, (dif_len + 50) * -1), (dif_len + 50) * -1);

elem_curve = [Imperative]
{
	if(structural_framing_hormigon_lst_location_len >= structural_framing_hormigon_lst_cut_len)
	{
		return  x_1;
	}
	else
	{
		return  x_2;
	}
};
elem_curve_start_p = Autodesk.Curve.StartPoint(elem_curve);
elem_curve_end_p = Autodesk.Curve.EndPoint(elem_curve);
elem_curve_vector = Autodesk.Vector.ByTwoPoints(elem_curve_start_p, elem_curve_end_p);
elem_curve_vector_len = Autodesk.Vector.Length(elem_curve_vector);

//Geometria a Cortar
g_elem_solid = DSCore.List.Flatten(Revit.Elements.Element.Geometry(structural_framing_hormigon_lst));
g_solid_centroid = Autodesk.Solid.Centroid(g_elem_solid);
g_solid_coo_sys = Autodesk.Curve.CoordinateSystemAtParameter(structural_framing_hormigon_lst_location, 0.5);
g_solid_plane = CoordinateSystem.YZPlane(g_solid_coo_sys);
g_solid_scaled = Autodesk.Geometry.Scale(g_elem_solid, g_solid_plane, 5, 1, 1);

//Geometria Estribo
geom_param_at_point = DesignScript.Curve.ParameterAtPoint(elem_curve, elem_curve_start_p);
geom_plane_at_param = DesignScript.Curve.PlaneAtParameter(elem_curve, geom_param_at_point);
geom_surface = DSCore.List.Flatten(Autodesk.Geometry.Intersect(g_solid_scaled, geom_plane_at_param), -1);
geom_surface_perimeter = Autodesk.Surface.PerimeterCurves(geom_surface);
geom_surface_perimeter_as_polycurve = PolyCurve.Offset(PolyCurve.ByJoinedCurves(geom_surface_perimeter), -25, false);
geom_surface_offset = Autodesk.Surface.ByPatch(geom_surface_perimeter_as_polycurve);
//Estribo 1
geom_surface_coo_sys_1 = Autodesk.Surface.CoordinateSystemAtParameter(geom_surface_offset, 0, 0.6343);
geom_surface_cut_plane_1 = CoordinateSystem.ZXPlane(geom_surface_coo_sys_1);
geom_surface_split_1 = Autodesk.Geometry.Split(geom_surface_offset, geom_surface_cut_plane_1);
geom_surface_1 = DSCore.List.GetItemAtIndex(geom_surface_split_1@L2<1>, 1);
geom_surface_perimeter_1 = Autodesk.Surface.PerimeterCurves(geom_surface_1);
geom_surface_perimeter_as_polycurve_1 = PolyCurve.ByJoinedCurves(geom_surface_perimeter_1);
geom_surface_perimeter_curves_1 = Autodesk.Geometry.Explode(geom_surface_perimeter_as_polycurve_1);
//Estribo 2
geom_surface_coo_sys_2 = Autodesk.Surface.CoordinateSystemAtParameter(geom_surface_offset, 0, 0.3657);
geom_surface_cut_plane_2 = CoordinateSystem.ZXPlane(geom_surface_coo_sys_2);
geom_surface_split_2 = Autodesk.Geometry.Split(geom_surface_offset, geom_surface_cut_plane_2);
geom_surface_2 = DSCore.List.GetItemAtIndex(geom_surface_split_2@L2<1>, 0);
geom_surface_perimeter_2 = Autodesk.Surface.PerimeterCurves(geom_surface_2);
geom_surface_perimeter_as_polycurve_2 = PolyCurve.ByJoinedCurves(geom_surface_perimeter_2);
geom_surface_perimeter_curves_2 = Autodesk.Geometry.Explode(geom_surface_perimeter_as_polycurve_2);
//Estribo 3
geom_surface_coo_sys_3_A = Autodesk.Surface.CoordinateSystemAtParameter(geom_surface_offset, 0, 0.1885);
geom_surface_coo_sys_3_B = Autodesk.Surface.CoordinateSystemAtParameter(geom_surface_offset, 0, 0.8115);
geom_surface_cut_plane_3_A = CoordinateSystem.ZXPlane(geom_surface_coo_sys_3_A);
geom_surface_cut_plane_3_B = CoordinateSystem.ZXPlane(geom_surface_coo_sys_3_B);
geom_surface_intersect_3_A = Autodesk.Geometry.Intersect(geom_surface_offset, geom_surface_cut_plane_3_A);
geom_surface_intersect_3_B = Autodesk.Geometry.Intersect(geom_surface_offset, geom_surface_cut_plane_3_B);
geom_surface_transpose = DSCore.List.Flatten(DSCore.List.Transpose([geom_surface_intersect_3_A, geom_surface_intersect_3_B])@L3<1>, -1);
geom_surface_3 = Autodesk.Surface.ByLoft(geom_surface_transpose@L2<1>);
geom_surface_perimeter_curves_3 = Autodesk.Surface.PerimeterCurves(geom_surface_3);


//Estribos 1
tag_location = g_solid_centroid;
//curves
geom_surface_perimeter_curves_1;
//rebarStyle
"StirrupTie";
//rebarBarType
tipo_barra_extremos;
//startHookType
hook;
//endHookType
hook;
//startHookOrientation
"Right";
//endtHookOrientation
"Right";
//hostElement
structural_framing_hormigon_lst;
//vector
structural_framing_hormigon_lst_vector;
//spacing
espaciamiento_extremos;
//ArrayLength
elem_curve_vector_len;
//Punto para posicionar tag
tag_location;










//Estribos 2
tag_location;
//curves
geom_surface_perimeter_curves_2;
//rebarStyle
"StirrupTie";
//rebarBarType
tipo_barra_extremos;
//startHookType
hook;
//endHookType
hook;
//startHookOrientation
"Left";
//endtHookOrientation
"Left";
//hostElement
structural_framing_hormigon_lst;
//vector
structural_framing_hormigon_lst_vector;
//spacing
espaciamiento_extremos;
//ArrayLength
elem_curve_vector_len;











//Estribos 2
//curves
geom_surface_perimeter_curves_3;
//rebarStyle
"StirrupTie";
//rebarBarType
tipo_barra_extremos;
//startHookType
hook;
//endHookType
hook;
//startHookOrientation
"Left";
//endtHookOrientation
"Left";
//hostElement
structural_framing_hormigon_lst;
//vector
structural_framing_hormigon_lst_vector;
//spacing
espaciamiento_extremos;
//ArrayLength
elem_curve_vector_len;

//
# ----------------------------------------
fromCurves_7 = StructuralDesign.Rebar.Create.FromCurves(curves=code_block_23.out108, rebarStyle=code_block_23.out109, rebarBarType=code_block_23.out110, startHookType=code_block_23.out111, endHookType=code_block_23.out112, startHookOrientation=code_block_23.out113, endHookOrientation=code_block_23.out114, hostElement=code_block_23.out115, vector=code_block_23.out116)
setLayoutAsMaximumSpacing_7 = StructuralDesign.Rebar.Layout.SetLayoutAsMaximumSpacing(rebar=fromCurves_7, spacing=code_block_23.out117, arrayLength=code_block_23.out118, lacing=Longest)
code_block_24 = CodeBlock { "FirstLast"; }
setRebarPresentation_7 = Custom[SetRebarPresentation](rebarElements=setLayoutAsMaximumSpacing_7, rebarRepresentation=code_block_24)
flatten_7 = List.Flatten(list=setRebarPresentation_7)
code_block_25 = CodeBlock(element=flatten_7)
# ---------- code_block_25.designscript (2 lines) ----------
//Asigna el tipo de estribo (sim, doble, etc...)
Revit.Elements.Element.SetParameterByName(element, "Estribo", "ET.");
# ----------------------------------------
fromCurves_8 = StructuralDesign.Rebar.Create.FromCurves(curves=code_block_23.out84, rebarStyle=code_block_23.out85, rebarBarType=code_block_23.out86, startHookType=code_block_23.out87, endHookType=code_block_23.out88, startHookOrientation=code_block_23.out89, endHookOrientation=code_block_23.out90, hostElement=code_block_23.out91, vector=code_block_23.out92)
setLayoutAsMaximumSpacing_8 = StructuralDesign.Rebar.Layout.SetLayoutAsMaximumSpacing(rebar=fromCurves_8, spacing=code_block_23.out93, arrayLength=code_block_23.out94, lacing=Longest)
code_block_26 = CodeBlock { "FirstLast"; }
setRebarPresentation_8 = Custom[SetRebarPresentation](rebarElements=setLayoutAsMaximumSpacing_8, rebarRepresentation=code_block_26)
flatten_8 = List.Flatten(list=setRebarPresentation_8)
code_block_27 = CodeBlock(element=flatten_8, tag_location=code_block_23.out95)
# ---------- code_block_27.designscript (19 lines) ----------
//Asigna el tipo de estribo (sim, doble, etc...)
Revit.Elements.Element.SetParameterByName(element, "Estribo", "ET.");
tag_location;

//element
element;
//TagLocation
tag_location;
//TagType
family = Revit.Family.ByName("EST_A_STRUCTURAL REBAR TAG_ESTRIBO");
tag_type = Revit.Elements.FamilyType.ByFamilyAndName(family, "R_E_00");
//horizontal
true;
//addLeader
false;
//LinkInstance
null;
//RunIt
true;
# ----------------------------------------
create_tag_5 = Custom[Create Tag](view=activeView_10@L1, element=code_block_27.out2@L2, TagLocation=code_block_27.out3@L2, TagType=code_block_27.out5@L1, horizontal=code_block_27.out6@L1, addLeader=code_block_27.out7@L1, LinkInstance=code_block_27.out8@L1, RunIt=code_block_27.out9@L1, lacing=Longest)
fromCurves_9 = StructuralDesign.Rebar.Create.FromCurves(curves=code_block_23.out97, rebarStyle=code_block_23.out98, rebarBarType=code_block_23.out99, startHookType=code_block_23.out100, endHookType=code_block_23.out101, startHookOrientation=code_block_23.out102, endHookOrientation=code_block_23.out103, hostElement=code_block_23.out104, vector=code_block_23.out105)
setLayoutAsMaximumSpacing_9 = StructuralDesign.Rebar.Layout.SetLayoutAsMaximumSpacing(rebar=fromCurves_9, spacing=code_block_23.out106, arrayLength=code_block_23.out107, lacing=Longest)
code_block_28 = CodeBlock { "FirstLast"; }
setRebarPresentation_9 = Custom[SetRebarPresentation](rebarElements=setLayoutAsMaximumSpacing_9, rebarRepresentation=code_block_28)
flatten_9 = List.Flatten(list=setRebarPresentation_9)
code_block_29 = CodeBlock(element=flatten_9)  # same code as code_block_25

current_11 = Document.Current()
activeView_11 = Document.ActiveView(document=current_11)
current_12 = Document.Current()
activeView_12 = Document.ActiveView(document=current_12)

# group: 7 Barras
element_types_ᶜᵒⁿᵛᵉʳᵗᵉᵈ_ᵈʳᵒᵖᵈᵒʷⁿ_7 = CodeBlock { DSCore.Types.FindTypeByNameInAssembly("RebarHookType", "RevitAPI"); }
all_elements_of_type_7 = ElementsOfType(element_type=element_types_ᶜᵒⁿᵛᵉʳᵗᵉᵈ_ᵈʳᵒᵖᵈᵒʷⁿ_7)
plane_6 = Custom[View.Plane](view=activeView_12)
code_block_30 = CodeBlock(x=code_block_6.out1, pata=all_elements_of_type_7, view_plane=plane_6)  # unwired: elementos, tipo_barra_extremos
# ---------- code_block_30.designscript (216 lines) ----------
https://helpcenter.bimcollab.com/portal/es/kb/articles/downloads-eselementos = x[0];
tipo_barra_extremos = x[1];
espaciamiento_extremos = x[2];
pata;
pata_names = Revit.Elements.Element.Name(pata);
mask = pata_names == "Stirrup/Tie - 135 deg.";
hook = DSCore.List.FilterByBoolMask(pata, mask)["in"][0];

//Obtener la cantidad de barras para definir cuantos estribos utilizar
rebar_cat = Revit.Category.ByName("Structural Rebar");
str_framing_rebars = Rhythm.Elements.DependentElementsOfCategory(elementos, rebar_cat);
str_framing_rebars_shapes = Revit.Elements.Element.GetParameterValueByName(str_framing_rebars, "Shape");
str_framing_rebars_shapes_names = Revit.Elements.Element.Name(str_framing_rebars_shapes);
str_framing_rebars_mask = DSCore.String.Contains(str_framing_rebars_shapes_names, "R_S_", false);
str_framing_rebars_R_S_ = DSCore.List.GetItemAtIndex(DSCore.List.FilterByBoolMask(str_framing_rebars, str_framing_rebars_mask)["in"]@L2<1>, 0);
str_framing_rebars_quantities = Revit.Elements.Element.GetParameterValueByName(str_framing_rebars_R_S_, "Quantity");

//filtro de elementos en funcion de la cantidad de barras
elementos_mask = str_framing_rebars_quantities == 7;
elem = DSCore.List.FilterByBoolMask(elementos, elementos_mask)["in"];

//Normal plano vista actual
view_plane_normal = Autodesk.Plane.Normal(view_plane);

//Variables para filtrar elementos por categoria
elem_category = Revit.Elements.Element.GetCategory(elem);
elem_category_name = Revit.Category.Name(elem_category);

//Filtrar vigas de hormigon paralelos a la vista actual
structural_framing_mask = elem_category_name == "Structural Framing";
structural_framing = DSCore.List.FilterByBoolMask(elem, structural_framing_mask)["in"];
structural_framing_material = DSCore.List.Flatten(Revit.Elements.Element.GetMaterials(structural_framing, false));
structural_framing_material_name = Revit.Material.Name(structural_framing_material);
structural_framing_material_mask = structural_framing_material_name == "Concrete, Cast-in-Place gray";
structural_framing_hormigon = DSCore.List.FilterByBoolMask(structural_framing, structural_framing_material_mask)["in"];
structural_framing_hormigon_location = Revit.Elements.Element.GetLocation(structural_framing_hormigon);
structural_framing_hormigon_vector = Line.Direction(structural_framing_hormigon_location);
structural_framing_hormigon_centroid = Autodesk.Solid.Centroid(DSCore.List.Flatten(Revit.Elements.Element.Geometry(structural_framing_hormigon)));
structural_framing_hormigon_coo_sys = Autodesk.Curve.CoordinateSystemAtParameter(structural_framing_hormigon_location);
structural_framing_hormigon_vector_mask = Autodesk.Vector.IsParallel(CoordinateSystem.XAxis(structural_framing_hormigon_coo_sys), view_plane_normal);
structural_framing_hormigon_lst = DSCore.List.FilterByBoolMask(structural_framing_hormigon, structural_framing_hormigon_vector_mask)["in"];
structural_framing_hormigon_lst_location = Revit.Elements.Element.GetLocation(structural_framing_hormigon_lst);
structural_framing_hormigon_lst_cut_len = Revit.Elements.Element.GetParameterValueByName(structural_framing_hormigon_lst, "Cut Length");
structural_framing_hormigon_lst_location_len = Autodesk.Curve.Length(structural_framing_hormigon_lst_location);
structural_framing_hormigon_lst_location_start_p = Autodesk.Curve.StartPoint(structural_framing_hormigon_lst_location);
structural_framing_hormigon_lst_location_end_p = Autodesk.Curve.EndPoint(structural_framing_hormigon_lst_location);
structural_framing_hormigon_lst_vector = Autodesk.Vector.ByTwoPoints(structural_framing_hormigon_lst_location_start_p, structural_framing_hormigon_lst_location_end_p);
structural_framing_hormigon_lst_vector_len = Autodesk.Vector.Length(structural_framing_hormigon_lst_vector);

//Altura de Vigas seleccionadas
elem_altura = Revit.Elements.Element.GetParameterValueByName(Revit.Elements.Element.GetParameterValueByName(elem, "Type"), "Height");

//Curva de las Vigas
elem_curve_inicial = Revit.Elements.Element.GetLocation(structural_framing_hormigon_lst);
elem_curve_inicial_len = DesignScript.Curve.Length(elem_curve_inicial);
dif_len = DSCore.Math.Abs(structural_framing_hormigon_lst_cut_len - structural_framing_hormigon_lst_location_len) / 2;
x_1 = Autodesk.Curve.ExtendEnd(Autodesk.Curve.ExtendStart(structural_framing_hormigon_lst_location, (dif_len + 50) * -1), (dif_len + 50) * -1);
x_2 = Autodesk.Curve.ExtendEnd(Autodesk.Curve.ExtendStart(structural_framing_hormigon_lst_location, (dif_len + 50) * -1), (dif_len + 50) * -1);

elem_curve = [Imperative]
{
	if(structural_framing_hormigon_lst_location_len >= structural_framing_hormigon_lst_cut_len)
	{
		return  x_1;
	}
	else
	{
		return  x_2;
	}
};
elem_curve_start_p = Autodesk.Curve.StartPoint(elem_curve);
elem_curve_end_p = Autodesk.Curve.EndPoint(elem_curve);
elem_curve_vector = Autodesk.Vector.ByTwoPoints(elem_curve_start_p, elem_curve_end_p);
elem_curve_vector_len = Autodesk.Vector.Length(elem_curve_vector);

//Geometria a Cortar
g_elem_solid = DSCore.List.Flatten(Revit.Elements.Element.Geometry(structural_framing_hormigon_lst));
g_solid_centroid = Autodesk.Solid.Centroid(g_elem_solid);
g_solid_coo_sys = Autodesk.Curve.CoordinateSystemAtParameter(structural_framing_hormigon_lst_location, 0.5);
g_solid_plane = CoordinateSystem.YZPlane(g_solid_coo_sys);
g_solid_scaled = Autodesk.Geometry.Scale(g_elem_solid, g_solid_plane, 5, 1, 1);

//Geometria Estribo
geom_param_at_point = DesignScript.Curve.ParameterAtPoint(elem_curve, elem_curve_start_p);
geom_plane_at_param = DesignScript.Curve.PlaneAtParameter(elem_curve, geom_param_at_point);
geom_surface = DSCore.List.Flatten(Autodesk.Geometry.Intersect(g_solid_scaled, geom_plane_at_param), -1);
geom_surface_perimeter = Autodesk.Surface.PerimeterCurves(geom_surface);
geom_surface_perimeter_as_polycurve = PolyCurve.Offset(PolyCurve.ByJoinedCurves(geom_surface_perimeter), -25, false);
geom_surface_offset = Autodesk.Surface.ByPatch(geom_surface_perimeter_as_polycurve);
//Estribo 1
geom_surface_coo_sys_1 = Autodesk.Surface.CoordinateSystemAtParameter(geom_surface_offset, 0, 0.69333);
geom_surface_cut_plane_1 = CoordinateSystem.ZXPlane(geom_surface_coo_sys_1);
geom_surface_split_1 = Autodesk.Geometry.Split(geom_surface_offset, geom_surface_cut_plane_1);
geom_surface_1 = DSCore.List.GetItemAtIndex(geom_surface_split_1@L2<1>, 1);
geom_surface_perimeter_1 = Autodesk.Surface.PerimeterCurves(geom_surface_1);
geom_surface_perimeter_as_polycurve_1 = PolyCurve.ByJoinedCurves(geom_surface_perimeter_1);
geom_surface_perimeter_curves_1 = Autodesk.Geometry.Explode(geom_surface_perimeter_as_polycurve_1);
//Estribo 2
geom_surface_coo_sys_2 = Autodesk.Surface.CoordinateSystemAtParameter(geom_surface_offset, 0, 0.30667);
geom_surface_cut_plane_2 = CoordinateSystem.ZXPlane(geom_surface_coo_sys_2);
geom_surface_split_2 = Autodesk.Geometry.Split(geom_surface_offset, geom_surface_cut_plane_2);
geom_surface_2 = DSCore.List.GetItemAtIndex(geom_surface_split_2@L2<1>, 0);
geom_surface_perimeter_2 = Autodesk.Surface.PerimeterCurves(geom_surface_2);
geom_surface_perimeter_as_polycurve_2 = PolyCurve.ByJoinedCurves(geom_surface_perimeter_2);
geom_surface_perimeter_curves_2 = Autodesk.Geometry.Explode(geom_surface_perimeter_as_polycurve_2);
//Estribo 3
geom_surface_coo_sys_3_A = Autodesk.Surface.CoordinateSystemAtParameter(geom_surface_offset, 0, 0.15905);
geom_surface_coo_sys_3_B = Autodesk.Surface.CoordinateSystemAtParameter(geom_surface_offset, 0, 0.84095);
geom_surface_cut_plane_3_A = CoordinateSystem.ZXPlane(geom_surface_coo_sys_3_A);
geom_surface_cut_plane_3_B = CoordinateSystem.ZXPlane(geom_surface_coo_sys_3_B);
geom_surface_intersect_3_A = Autodesk.Geometry.Intersect(geom_surface_offset, geom_surface_cut_plane_3_A);
geom_surface_intersect_3_B = Autodesk.Geometry.Intersect(geom_surface_offset, geom_surface_cut_plane_3_B);
geom_surface_transpose = DSCore.List.Flatten(DSCore.List.Transpose([geom_surface_intersect_3_A, geom_surface_intersect_3_B])@L3<1>, -1);
geom_surface_3 = Autodesk.Surface.ByLoft(geom_surface_transpose@L2<1>);
geom_surface_perimeter_curves_3 = Autodesk.Surface.PerimeterCurves(geom_surface_3);
//Traba
geom_surface_coo_sys_3 = Autodesk.Surface.CoordinateSystemAtParameter(geom_surface_offset, 0, 0.454257);
geom_surface_cut_plane_3 = CoordinateSystem.ZXPlane(geom_surface_coo_sys_3);
geom_surface_intersect_3 = Autodesk.Geometry.Intersect(geom_surface_offset, geom_surface_cut_plane_3);

//Estribos 1
tag_location = g_solid_centroid;
//curves
geom_surface_perimeter_curves_1;
//rebarStyle
"StirrupTie";
//rebarBarType
tipo_barra_extremos;
//startHookType
hook;
//endHookType
hook;
//startHookOrientation
"Right";
//endtHookOrientation
"Right";
//hostElement
structural_framing_hormigon_lst;
//vector
structural_framing_hormigon_lst_vector;
//spacing
espaciamiento_extremos;
//ArrayLength
elem_curve_vector_len;
//Punto para posicionar tag
tag_location;










//Estribos 2
tag_location;
//curves
geom_surface_perimeter_curves_2;
//rebarStyle
"StirrupTie";
//rebarBarType
tipo_barra_extremos;
//startHookType
hook;
//endHookType
hook;
//startHookOrientation
"Left";
//endtHookOrientation
"Left";
//hostElement
structural_framing_hormigon_lst;
//vector
structural_framing_hormigon_lst_vector;
//spacing
espaciamiento_extremos;
//ArrayLength
elem_curve_vector_len;











//Estribos 3
//curves
geom_surface_perimeter_curves_3;
//rebarStyle
"StirrupTie";
//rebarBarType
tipo_barra_extremos;
//startHookType
hook;
//endHookType
hook;
//startHookOrientation
"Left";
//endtHookOrientation
"Left";
//hostElement
structural_framing_hormigon_lst;
//vector
structural_framing_hormigon_lst_vector;
//spacing
espaciamiento_extremos;
//ArrayLength
elem_curve_vector_len;

//
# ----------------------------------------
fromCurves_10 = StructuralDesign.Rebar.Create.FromCurves(curves=code_block_30.out86, rebarStyle=code_block_30.out87, rebarBarType=code_block_30.out88, startHookType=code_block_30.out89, endHookType=code_block_30.out90, startHookOrientation=code_block_30.out91, endHookOrientation=code_block_30.out92, hostElement=code_block_30.out93, vector=code_block_30.out94)
setLayoutAsMaximumSpacing_10 = StructuralDesign.Rebar.Layout.SetLayoutAsMaximumSpacing(rebar=fromCurves_10, spacing=code_block_30.out95, arrayLength=code_block_30.out96, lacing=Longest)
code_block_31 = CodeBlock { "FirstLast"; }
setRebarPresentation_10 = Custom[SetRebarPresentation](rebarElements=setLayoutAsMaximumSpacing_10, rebarRepresentation=code_block_31)
flatten_10 = List.Flatten(list=setRebarPresentation_10)
code_block_32 = CodeBlock(element=flatten_10, tag_location=code_block_30.out97)  # same code as code_block_27
create_tag_6 = Custom[Create Tag](view=activeView_11@L1, element=code_block_32.out2@L2, TagLocation=code_block_32.out3@L2, TagType=code_block_32.out5@L1, horizontal=code_block_32.out6@L1, addLeader=code_block_32.out7@L1, LinkInstance=code_block_32.out8@L1, RunIt=code_block_32.out9@L1, lacing=Longest)
fromCurves_11 = StructuralDesign.Rebar.Create.FromCurves(curves=code_block_30.out99, rebarStyle=code_block_30.out100, rebarBarType=code_block_30.out101, startHookType=code_block_30.out102, endHookType=code_block_30.out103, startHookOrientation=code_block_30.out104, endHookOrientation=code_block_30.out105, hostElement=code_block_30.out106, vector=code_block_30.out107)
setLayoutAsMaximumSpacing_11 = StructuralDesign.Rebar.Layout.SetLayoutAsMaximumSpacing(rebar=fromCurves_11, spacing=code_block_30.out108, arrayLength=code_block_30.out109, lacing=Longest)
code_block_33 = CodeBlock { "FirstLast"; }
setRebarPresentation_11 = Custom[SetRebarPresentation](rebarElements=setLayoutAsMaximumSpacing_11, rebarRepresentation=code_block_33)
flatten_11 = List.Flatten(list=setRebarPresentation_11)
code_block_34 = CodeBlock(element=flatten_11)  # same code as code_block_25
fromCurves_12 = StructuralDesign.Rebar.Create.FromCurves(curves=code_block_30.out110, rebarStyle=code_block_30.out111, rebarBarType=code_block_30.out112, startHookType=code_block_30.out113, endHookType=code_block_30.out114, startHookOrientation=code_block_30.out115, endHookOrientation=code_block_30.out116, hostElement=code_block_30.out117, vector=code_block_30.out118)
setLayoutAsMaximumSpacing_12 = StructuralDesign.Rebar.Layout.SetLayoutAsMaximumSpacing(rebar=fromCurves_12, spacing=code_block_30.out119, arrayLength=code_block_30.out120, lacing=Longest)
code_block_35 = CodeBlock { "FirstLast"; }
setRebarPresentation_12 = Custom[SetRebarPresentation](rebarElements=setLayoutAsMaximumSpacing_12, rebarRepresentation=code_block_35)
flatten_12 = List.Flatten(list=setRebarPresentation_12)
code_block_36 = CodeBlock(element=flatten_12)  # same code as code_block_25
