# Dynamo graph estribo3Segmentos_script.dyn (Dynamo 2.6.2.15705)
# packages: Structural Design 2021.1.22, Clockwork for Dynamo 2.x 2.4.0, Orchid 206.3.0.8161, Data-Shapes 2022.2.103, Genius Loci 2021.11.10

o_document_activeview = Orchid.RevitProject.Common.Document.ActiveView()
code_block = CodeBlock { "Seleccionar Elementos"; }
categories_ᶜᵒⁿᵛᵉʳᵗᵉᵈ_ᵈʳᵒᵖᵈᵒʷⁿ = CodeBlock()
# ---------- categories_ᶜᵒⁿᵛᵉʳᵗᵉᵈ_ᵈʳᵒᵖᵈᵒʷⁿ.designscript (8 lines) ----------
//InputName
"";
//ButtonText
"SELECCIONAR";
//CategoryFilter
Revit.Category.ByName("Structural Framing");
//SelectSingleElement
false;
# ----------------------------------------
selectmodelelements_data = Custom[SelectModelElements Data](InputName=categories_ᶜᵒⁿᵛᵉʳᵗᵉᵈ_ᵈʳᵒᵖᵈᵒʷⁿ.out0, ButtonText=categories_ᶜᵒⁿᵛᵉʳᵗᵉᵈ_ᵈʳᵒᵖᵈᵒʷⁿ.out1, CategoryFilter=categories_ᶜᵒⁿᵛᵉʳᵗᵉᵈ_ᵈʳᵒᵖᵈᵒʷⁿ.out2, SelectSingleElement=categories_ᶜᵒⁿᵛᵉʳᵗᵉᵈ_ᵈʳᵒᵖᵈᵒʷⁿ.out3)  # package Data-Shapes; Creates a Revit element selection input for UI.MultipleInputForm++ . Check out www.data-shapes.net for more infos!
inputgroup_data = Custom[InputGroup Data](GroupTitle=code_block, Inputs=selectmodelelements_data)  # package Data-Shapes; Creates a group of inputs for UI.MultipleInputForm ++ . Check out www.data-shapes.net for more infos !
code_block_2 = CodeBlock { "Estribos Extremos"; }
element_types_ᶜᵒⁿᵛᵉʳᵗᵉᵈ_ᵈʳᵒᵖᵈᵒʷⁿ = CodeBlock { DSCore.Types.FindTypeByNameInAssembly("RebarBarType", "RevitAPI"); }
all_elements_of_type = ElementsOfType(element_type=element_types_ᶜᵒⁿᵛᵉʳᵗᵉᵈ_ᵈʳᵒᵖᵈᵒʷⁿ)
code_block_3 = CodeBlock(elem_type=all_elements_of_type)
# ---------- code_block_3.designscript (15 lines) ----------
elem_type;
elem_type_diameter = Properties.RebarDiameter(elem_type);
elem_sorted = DSCore.List.SortByKey(elem_type, elem_type_diameter)["sorted list"];
elem_name = Revit.Elements.Element.Name(elem_sorted);

//InputName
"Diametro";
//Keys
elem_name;
//Values
elem_sorted;
//DefaultValueIndex
0;
//Sorted_optional
false;
# ----------------------------------------
dropdown_data = Custom[DropDown Data](InputName=code_block_3.out4, Keys=code_block_3.out5, Values=code_block_3.out6, DefaultValueIndex=code_block_3.out7, Sorted_optional=code_block_3.out8)  # package Data-Shapes; Create data for DropDown input in UI.MultiInputForm ++ . Check out www.data-shapes.net for more infos.
code_block_4 = CodeBlock()
# ---------- code_block_4.designscript (6 lines) ----------
//InputName
"Espaciamiento";
//DefaultText
"200";
//IsNumberEntry
true;
# ----------------------------------------
textbox_data = Custom[TextBox Data](InputName=code_block_4.out0, DefaultText=code_block_4.out1, IsNumberEntry=code_block_4.out2)  # package Data-Shapes; Create Data for TextBox input in UI.MultipleInputForm ++ . Check out www.data-shapes.net for more informations
list_create = List.Create(item0=dropdown_data, item1=textbox_data)
inputgroup_data_2 = Custom[InputGroup Data](GroupTitle=code_block_2, Inputs=list_create)
code_block_5 = CodeBlock { "Estribos Centrales"; }
code_block_6 = CodeBlock()
# ---------- code_block_6.designscript (6 lines) ----------
//InputName
"Espaciamiento";
//DefaultText
"300";
//IsNumberEntry
true;
# ----------------------------------------
textbox_data_2 = Custom[TextBox Data](InputName=code_block_6.out0, DefaultText=code_block_6.out1, IsNumberEntry=code_block_6.out2)
list_create_2 = List.Create(item0=dropdown_data, item1=textbox_data_2)
inputgroup_data_3 = Custom[InputGroup Data](GroupTitle=code_block_5, Inputs=list_create_2)
list_create_3 = List.Create(item0=inputgroup_data, item1=inputgroup_data_2, item2=inputgroup_data_3)
code_block_7 = CodeBlock(inputs=list_create_3)
# ---------- code_block_7.designscript (20 lines) ----------
//Description
"Estribos 3 Segmentos";
//Logo
"C:\\Arainco\\Arainco.png";
//ButtonText
"INICIAR";
//Inputs
inputs;
//Toggle
true;
//LinkToHelp
null;
//CancelButtonText
"CANCELAR";
//MaxHeight
0;
//Width
430;
//LabelWidth
170;
# ----------------------------------------
multipleinputform = Custom[MultipleInputForm ++](Description_optional=code_block_7.out0, Logo_optional=code_block_7.out1, ButtonText_optional=code_block_7.out2, Inputs=code_block_7.inputs, Toggle=code_block_7.out4, LinkToHelp_optional=code_block_7.out5, CancelButtonText_optional=code_block_7.out6, MaxHeight_optional=code_block_7.out7, Width_optional=code_block_7.out8, LabelWidth_optional=code_block_7.out9)  # package Data-Shapes; Create a form with multiple inputs. see www.data-shapes.net for tutorials and infos!
code_block_8 = CodeBlock(l=multipleinputform.User_Inputs)
# ---------- code_block_8.designscript (12 lines) ----------
l;
[Imperative]
{
	if (l == null)
	{
		return = [[],[],[],[],[],[],[],[],[],[]];
	}
	else
	{
		return = l;
	}
};
# ----------------------------------------
element_types_ᶜᵒⁿᵛᵉʳᵗᵉᵈ_ᵈʳᵒᵖᵈᵒʷⁿ_2 = CodeBlock { DSCore.Types.FindTypeByNameInAssembly("RebarHookType", "RevitAPI"); }
all_elements_of_type_2 = ElementsOfType(element_type=element_types_ᶜᵒⁿᵛᵉʳᵗᵉᵈ_ᵈʳᵒᵖᵈᵒʷⁿ_2)
o_document_activeview_2 = Orchid.RevitProject.Common.Document.ActiveView()
plane = Custom[View.Plane](view=o_document_activeview_2)  # package Clockwork for Dynamo 2.x; Retrieves the plane of a given view
code_block_9 = CodeBlock(x=code_block_8.out1, pata=all_elements_of_type_2, view_plane=plane)
# ---------- code_block_9.designscript (161 lines) ----------
elementos = x[0];
tipo_barra_extremos = x[1];
espaciamiento_extremos = x[2];
tipo_barra_centrales = x[3];
espaciamiento_centrales = x[4];
pata;
pata_names = Revit.Elements.Element.Name(pata);
mask = pata_names == "Stirrup/Tie - 135 deg.";
hook = DSCore.List.FilterByBoolMask(pata, mask)["in"][0];

//Obtener la cantidad de barras para definir cuantos estribos utilizar
rebar_cat = Revit.Category.ByName("Structural Rebar");
str_framing_rebars = Rhythm.Elements.DependentElementsOfCategory(elementos, rebar_cat);
str_framing_rebars_shapes = Revit.Elements.Element.GetParameterValueByName(str_framing_rebars, "Shape");
str_framing_rebars_shapes_names = Revit.Elements.Element.Name(str_framing_rebars_shapes);
str_framing_rebars_mask = DSCore.String.Contains(str_framing_rebars_shapes_names, "R_S_", false);
str_framing_rebars_R_S_ = DSCore.List.GetItemAtIndex(DSCore.List.FilterByBoolMask(str_framing_rebars, str_framing_rebars_mask)["in"]@L2<1>, 0);
str_framing_rebars_quantities = Revit.Elements.Element.GetParameterValueByName(str_framing_rebars_R_S_, "Quantity");

//filtro de elementos en funcion de la cantidad de barras
elementos_mask = str_framing_rebars_quantities == 3;
elem = DSCore.List.FilterByBoolMask(elementos, elementos_mask)["in"];

//Normal plano vista actual
view_plane_normal = Autodesk.Plane.Normal(view_plane);

//Variables para filtrar elementos por categoria
elem_category = Revit.Elements.Element.GetCategory(elem);
elem_category_name = Revit.Category.Name(elem_category);

//Filtrar vigas de hormigon paralelos a la vista actual
structural_framing_mask = elem_category_name == "Structural Framing";
structural_framing = DSCore.List.FilterByBoolMask(elem, structural_framing_mask)["in"];
structural_framing_material = DSCore.List.Flatten(Revit.Elements.Element.GetMaterials(structural_framing, false));
structural_framing_material_name = Revit.Material.Name(structural_framing_material);
structural_framing_material_mask = structural_framing_material_name == "Concrete, Cast-in-Place gray";
structural_framing_hormigon = DSCore.List.FilterByBoolMask(structural_framing, structural_framing_material_mask)["in"];
structural_framing_hormigon_location = Revit.Elements.Element.GetLocation(structural_framing_hormigon);
structural_framing_hormigon_vector = Line.Direction(structural_framing_hormigon_location);
structural_framing_hormigon_centroid = Autodesk.Solid.Centroid(DSCore.List.Flatten(Revit.Elements.Element.Geometry(structural_framing_hormigon)));
structural_framing_hormigon_coo_sys = CoordinateSystem.ByOriginVectors(structural_framing_hormigon_centroid, view_plane_normal, structural_framing_hormigon_vector);
structural_framing_hormigon_vector_mask = Autodesk.Vector.IsParallel(CoordinateSystem.XAxis(structural_framing_hormigon_coo_sys), view_plane_normal);
structural_framing_hormigon_lst = DSCore.List.FilterByBoolMask(structural_framing_hormigon, structural_framing_hormigon_vector_mask)["in"];

//Altura de Vigas seleccionadas
elem_altura = Revit.Elements.Element.GetParameterValueByName(Revit.Elements.Element.GetParameterValueByName(elem, "Type"), "Height");

//Curva de las Vigas
elem_curve_inicial = Revit.Elements.Element.GetLocation(structural_framing_hormigon_lst);
elem_curve_inicial_len = DesignScript.Curve.Length(elem_curve_inicial);
elem_cut_len = Revit.Elements.Element.GetParameterValueByName(elem, "Cut Length");
dif_len = (elem_curve_inicial_len - elem_cut_len) / 2;
elem_curve = DesignScript.Curve.ExtendEnd(DesignScript.Curve.ExtendStart(Revit.Elements.Element.GetLocation(elem), -50), -50);

//Distancias division de Curva
dist_1 = elem_altura * 2;
dist_2 = elem_curve_inicial_len - (elem_altura * 2);
dist_lst = DSCore.List.Transpose(Maths.Round([dist_1, dist_2]));
param_lst = DesignScript.Curve.ParameterAtSegmentLength(elem_curve_inicial, dist_lst);

//Planos division de Curva
planes = DesignScript.Curve.PlaneAtSegmentLength(elem_curve_inicial, dist_lst);

//Curva dividida
curve_splitted = DesignScript.Curve.SplitByParameter(elem_curve, param_lst);
curve_splitted_start_point = DesignScript.Curve.StartPoint(curve_splitted);
curve_splitted_end_point = DesignScript.Curve.EndPoint(curve_splitted);
curve_splitted_vector = Autodesk.Vector.ByTwoPoints(curve_splitted_start_point, curve_splitted_end_point);

//Geometria a Cortar
g_elem_solid = DSCore.List.Flatten(Revit.Elements.Element.Geometry(structural_framing_hormigon_lst));
g_solid_centroid = Autodesk.Solid.Centroid(g_elem_solid);
g_solid_coo_sys = CoordinateSystem.ByOriginVectors(structural_framing_hormigon_centroid, view_plane_normal, structural_framing_hormigon_vector);
g_solid_plane = CoordinateSystem.XYPlane(g_solid_coo_sys);
g_solid_scaled = Autodesk.Geometry.Scale(g_elem_solid, g_solid_plane, 1, 10, 1);

//Geometria Estribo
geom_param_at_point = DesignScript.Curve.ParameterAtPoint(curve_splitted, curve_splitted_start_point);
geom_plane_at_param = DesignScript.Curve.PlaneAtParameter(curve_splitted, geom_param_at_point);
geom_surface = DSCore.List.Flatten(Autodesk.Geometry.Intersect(g_solid_scaled@L1<1L>, geom_plane_at_param@L2<1L>)@L3<1>, -1);
geom_surface_perimeter = Autodesk.Surface.PerimeterCurves(geom_surface);
geom_surface_perimeter_as_polycurve = PolyCurve.ByJoinedCurves(geom_surface_perimeter);
geom_surface_perimeter_curves = Autodesk.Geometry.Explode(PolyCurve.Offset(geom_surface_perimeter_as_polycurve, -25, false));

plane_ajuste_etiqueta = CoordinateSystem.XYPlane(structural_framing_hormigon_coo_sys);

//Estribos Extermos
estribos_extremos = DSCore.List.GetItemAtIndex(geom_surface_perimeter_curves@@L3<1>, [0, 2]);
estribos_extremos_vector = DSCore.List.GetItemAtIndex(curve_splitted_vector@@L2<1>, [0, 2]);
curve_splitted_len_extremos = DSCore.List.GetItemAtIndex(Autodesk.Curve.Length(curve_splitted)@@L2<1>, [0, 2]);
tag_location_extremos = DSCore.List.GetItemAtIndex(Autodesk.Curve.PointAtParameter(curve_splitted, 0.5)@@L2<1>, [0, 2]);
//curves
estribos_extremos;
//rebarStyle
"StirrupTie";
//rebarBarType
tipo_barra_extremos;
//startHookType
hook;
//endHookType
hook;
//startHookOrientation
"Left";
//endtHookOrientation
"Left";
//hostElement
elem;
//vector
estribos_extremos_vector;
//spacing
espaciamiento_extremos;
//ArrayLength
curve_splitted_len_extremos;
//Plano de ajuste etiquetas
plane_ajuste_etiqueta;
//Punto para posicionar tag
tag_location_extremos;






//Estribos Centrales
estribos_centrales = DSCore.List.GetItemAtIndex(geom_surface_perimeter_curves@@L3<1>, 1);
estribos_centrales_vector = DSCore.List.GetItemAtIndex(curve_splitted_vector@@L2<1>, 1);
curve_splitted_len_centrales = DSCore.List.GetItemAtIndex(Autodesk.Curve.Length(curve_splitted)@@L2<1>, 1);
tag_location_centrales = DSCore.List.GetItemAtIndex(Autodesk.Curve.PointAtParameter(curve_splitted, 0.5)@@L2<1>, 1);
//curves
estribos_centrales;
//rebarStyle
"StirrupTie";
//rebarBarType
tipo_barra_centrales;
//startHookType
hook;
//endHookType
hook;
//startHookOrientation
"Left";
//endtHookOrientation
"Left";
//hostElement
elem;
//vector
estribos_centrales_vector;
//spacing
espaciamiento_centrales;
//ArrayLength
curve_splitted_len_centrales;
//includeFirstBar
false;
//includeLastBar
false;
//Plano de ajuste etiquetas
plane_ajuste_etiqueta;
//Punto para posicionar tag
tag_location_centrales;


//
# ----------------------------------------
fromCurves = StructuralDesign.Rebar.Create.FromCurves(curves=code_block_9.out64, rebarStyle=code_block_9.out65, rebarBarType=code_block_9.out66, startHookType=code_block_9.out67, endHookType=code_block_9.out68, startHookOrientation=code_block_9.out69, endHookOrientation=code_block_9.out70, hostElement=code_block_9.out71, vector=code_block_9.out72)
setLayoutAsMaximumSpacing = StructuralDesign.Rebar.Layout.SetLayoutAsMaximumSpacing(rebar=fromCurves, spacing=code_block_9.out73, arrayLength=code_block_9.out74, lacing=Longest)
code_block_10 = CodeBlock { "FirstLast"; }
setRebarPresentation = Custom[SetRebarPresentation](rebarElements=setLayoutAsMaximumSpacing, rebarRepresentation=code_block_10)  # Change de Rebar representation of the selected elements in the active view. Rebar Representations Options - All - FirstLast - Middle
flatten = List.Flatten(list=setRebarPresentation@L3)
code_block_11 = CodeBlock(element=flatten, plane_ajuste_etiqueta=code_block_9.out75, tag_location_extremos=code_block_9.out76)
# ---------- code_block_11.designscript (20 lines) ----------
//Asigna el tipo de estribo (sim, doble, etc...)
Revit.Elements.Element.SetParameterByName(element, "Estribo", "E.");
plane_ajuste_etiqueta;
tag_location_extremos_corregido = Points.PullOntoPlane(tag_location_extremos, plane_ajuste_etiqueta);

//element
element;
//TagLocation
tag_location_extremos_corregido;
//TagType
family = Revit.Family.ByName("EST_A_STRUCTURAL REBAR TAG_ESTRIBO");
tag_type = Revit.Elements.FamilyType.ByFamilyAndName(family, "R_E_00");
//horizontal
true;
//addLeader
false;
//LinkInstance
null;
//RunIt
true;
# ----------------------------------------
create_tag = Custom[Create Tag](view=o_document_activeview@L1, element=code_block_11.out3@L2, TagLocation=code_block_11.out4@L2, TagType=code_block_11.out6@L1, horizontal=code_block_11.out7@L1, addLeader=code_block_11.out8@L1, LinkInstance=code_block_11.out9@L1, RunIt=code_block_11.out10@L1, lacing=Longest)  # package Genius Loci; Works only in Revit 2018 and later. Creates a tag at a given location, of given type and in a supplied view. The node also works with Linked Elements (except space and area), Multi Category tag and Material Tag. Based on an archilab node
o_document_activeview_3 = Orchid.RevitProject.Common.Document.ActiveView()
fromCurves_2 = StructuralDesign.Rebar.Create.FromCurves(curves=code_block_9.out81, rebarStyle=code_block_9.out82, rebarBarType=code_block_9.out83, startHookType=code_block_9.out84, endHookType=code_block_9.out85, startHookOrientation=code_block_9.out86, endHookOrientation=code_block_9.out87, hostElement=code_block_9.out88, vector=code_block_9.out89)
setLayoutAsMaximumSpacing_2 = StructuralDesign.Rebar.Layout.SetLayoutAsMaximumSpacing(rebar=fromCurves_2, spacing=code_block_9.out90, arrayLength=code_block_9.out91, includeFirstBar=code_block_9.out92, includeLastBar=code_block_9.out93)
code_block_12 = CodeBlock { "FirstLast"; }
setRebarPresentation_2 = Custom[SetRebarPresentation](rebarElements=setLayoutAsMaximumSpacing_2, rebarRepresentation=code_block_12)
flatten_2 = List.Flatten(list=setRebarPresentation_2)
code_block_13 = CodeBlock(element=flatten_2, plane_ajuste_etiqueta=code_block_9.out94, tag_location_centrales=code_block_9.out95)
# ---------- code_block_13.designscript (20 lines) ----------
//Asigna el tipo de estribo (sim, doble, etc...)
Revit.Elements.Element.SetParameterByName(element, "Estribo", "E.");
plane_ajuste_etiqueta;
tag_location_centrales_corregido = Points.PullOntoPlane(tag_location_centrales, plane_ajuste_etiqueta);

//element
element;
//TagLocation
tag_location_centrales_corregido;
//TagType
family = Revit.Family.ByName("EST_A_STRUCTURAL REBAR TAG_ESTRIBO");
tag_type = Revit.Elements.FamilyType.ByFamilyAndName(family, "R_E_00");
//horizontal
true;
//addLeader
false;
//LinkInstance
null;
//RunIt
true;
# ----------------------------------------
create_tag_2 = Custom[Create Tag](view=o_document_activeview_3, element=code_block_13.out3, TagLocation=code_block_13.out4, TagType=code_block_13.out6, horizontal=code_block_13.out7, addLeader=code_block_13.out8, LinkInstance=code_block_13.out9, RunIt=code_block_13.out10)
o_document_activeview_4 = Orchid.RevitProject.Common.Document.ActiveView()
element_types_ᶜᵒⁿᵛᵉʳᵗᵉᵈ_ᵈʳᵒᵖᵈᵒʷⁿ_3 = CodeBlock { DSCore.Types.FindTypeByNameInAssembly("RebarHookType", "RevitAPI"); }
all_elements_of_type_3 = ElementsOfType(element_type=element_types_ᶜᵒⁿᵛᵉʳᵗᵉᵈ_ᵈʳᵒᵖᵈᵒʷⁿ_3)
o_document_activeview_5 = Orchid.RevitProject.Common.Document.ActiveView()
plane_2 = Custom[View.Plane](view=o_document_activeview_5)
code_block_14 = CodeBlock(x=code_block_8.out1, pata=all_elements_of_type_3, view_plane=plane_2)
# ---------- code_block_14.designscript (161 lines) ----------
elementos = x[0];
tipo_barra_extremos = x[1];
espaciamiento_extremos = x[2];
tipo_barra_centrales = x[3];
espaciamiento_centrales = x[4];
pata;
pata_names = Revit.Elements.Element.Name(pata);
mask = pata_names == "Stirrup/Tie - 135 deg.";
hook = DSCore.List.FilterByBoolMask(pata, mask)["in"][0];

//Obtener la cantidad de barras para definir cuantos estribos utilizar
rebar_cat = Revit.Category.ByName("Structural Rebar");
str_framing_rebars = Rhythm.Elements.DependentElementsOfCategory(elementos, rebar_cat);
str_framing_rebars_shapes = Revit.Elements.Element.GetParameterValueByName(str_framing_rebars, "Shape");
str_framing_rebars_shapes_names = Revit.Elements.Element.Name(str_framing_rebars_shapes);
str_framing_rebars_mask = DSCore.String.Contains(str_framing_rebars_shapes_names, "R_S_", false);
str_framing_rebars_R_S_ = DSCore.List.GetItemAtIndex(DSCore.List.FilterByBoolMask(str_framing_rebars, str_framing_rebars_mask)["in"]@L2<1>, 0);
str_framing_rebars_quantities = Revit.Elements.Element.GetParameterValueByName(str_framing_rebars_R_S_, "Quantity");

//filtro de elementos en funcion de la cantidad de barras
elementos_mask = str_framing_rebars_quantities == 2;
elem = DSCore.List.FilterByBoolMask(elementos, elementos_mask)["in"];

//Normal plano vista actual
view_plane_normal = Autodesk.Plane.Normal(view_plane);

//Variables para filtrar elementos por categoria
elem_category = Revit.Elements.Element.GetCategory(elem);
elem_category_name = Revit.Category.Name(elem_category);

//Filtrar vigas de hormigon paralelos a la vista actual
structural_framing_mask = elem_category_name == "Structural Framing";
structural_framing = DSCore.List.FilterByBoolMask(elem, structural_framing_mask)["in"];
structural_framing_material = DSCore.List.Flatten(Revit.Elements.Element.GetMaterials(structural_framing, false));
structural_framing_material_name = Revit.Material.Name(structural_framing_material);
structural_framing_material_mask = structural_framing_material_name == "Concrete, Cast-in-Place gray";
structural_framing_hormigon = DSCore.List.FilterByBoolMask(structural_framing, structural_framing_material_mask)["in"];
structural_framing_hormigon_location = Revit.Elements.Element.GetLocation(structural_framing_hormigon);
structural_framing_hormigon_vector = Line.Direction(structural_framing_hormigon_location);
structural_framing_hormigon_centroid = Autodesk.Solid.Centroid(DSCore.List.Flatten(Revit.Elements.Element.Geometry(structural_framing_hormigon)));
structural_framing_hormigon_coo_sys = CoordinateSystem.ByOriginVectors(structural_framing_hormigon_centroid, view_plane_normal, structural_framing_hormigon_vector);
structural_framing_hormigon_vector_mask = Autodesk.Vector.IsParallel(CoordinateSystem.XAxis(structural_framing_hormigon_coo_sys), view_plane_normal);
structural_framing_hormigon_lst = DSCore.List.FilterByBoolMask(structural_framing_hormigon, structural_framing_hormigon_vector_mask)["in"];

//Altura de Vigas seleccionadas
elem_altura = Revit.Elements.Element.GetParameterValueByName(Revit.Elements.Element.GetParameterValueByName(elem, "Type"), "Height");

//Curva de las Vigas
elem_curve_inicial = Revit.Elements.Element.GetLocation(structural_framing_hormigon_lst);
elem_curve_inicial_len = DesignScript.Curve.Length(elem_curve_inicial);
elem_cut_len = Revit.Elements.Element.GetParameterValueByName(elem, "Cut Length");
dif_len = (elem_curve_inicial_len - elem_cut_len) / 2;
elem_curve = DesignScript.Curve.ExtendEnd(DesignScript.Curve.ExtendStart(Revit.Elements.Element.GetLocation(elem), -50), -50);

//Distancias division de Curva
dist_1 = elem_altura * 2;
dist_2 = elem_curve_inicial_len - (elem_altura * 2);
dist_lst = DSCore.List.Transpose(Maths.Round([dist_1, dist_2]));
param_lst = DesignScript.Curve.ParameterAtSegmentLength(elem_curve_inicial, dist_lst);

//Planos division de Curva
planes = DesignScript.Curve.PlaneAtSegmentLength(elem_curve_inicial, dist_lst);

//Curva dividida
curve_splitted = DesignScript.Curve.SplitByParameter(elem_curve, param_lst);
curve_splitted_start_point = DesignScript.Curve.StartPoint(curve_splitted);
curve_splitted_end_point = DesignScript.Curve.EndPoint(curve_splitted);
curve_splitted_vector = Autodesk.Vector.ByTwoPoints(curve_splitted_start_point, curve_splitted_end_point);

//Geometria a Cortar
g_elem_solid = DSCore.List.Flatten(Revit.Elements.Element.Geometry(structural_framing_hormigon_lst));
g_solid_centroid = Autodesk.Solid.Centroid(g_elem_solid);
g_solid_coo_sys = CoordinateSystem.ByOriginVectors(structural_framing_hormigon_centroid, view_plane_normal, structural_framing_hormigon_vector);
g_solid_plane = CoordinateSystem.XYPlane(g_solid_coo_sys);
g_solid_scaled = Autodesk.Geometry.Scale(g_elem_solid, g_solid_plane, 1, 10, 1);

//Geometria Estribo
geom_param_at_point = DesignScript.Curve.ParameterAtPoint(curve_splitted, curve_splitted_start_point);
geom_plane_at_param = DesignScript.Curve.PlaneAtParameter(curve_splitted, geom_param_at_point);
geom_surface = DSCore.List.Flatten(Autodesk.Geometry.Intersect(g_solid_scaled@L1<1L>, geom_plane_at_param@L2<1L>)@L3<1>, -1);
geom_surface_perimeter = Autodesk.Surface.PerimeterCurves(geom_surface);
geom_surface_perimeter_as_polycurve = PolyCurve.ByJoinedCurves(geom_surface_perimeter);
geom_surface_perimeter_curves = Autodesk.Geometry.Explode(PolyCurve.Offset(geom_surface_perimeter_as_polycurve, -25, false));

plane_ajuste_etiqueta = CoordinateSystem.XYPlane(structural_framing_hormigon_coo_sys);

//Estribos Extermos
estribos_extremos = DSCore.List.GetItemAtIndex(geom_surface_perimeter_curves@@L3<1>, [0, 2]);
estribos_extremos_vector = DSCore.List.GetItemAtIndex(curve_splitted_vector@@L2<1>, [0, 2]);
curve_splitted_len_extremos = DSCore.List.GetItemAtIndex(Autodesk.Curve.Length(curve_splitted)@@L2<1>, [0, 2]);
tag_location_extremos = DSCore.List.GetItemAtIndex(Autodesk.Curve.PointAtParameter(curve_splitted, 0.5)@@L2<1>, [0, 2]);
//curves
estribos_extremos;
//rebarStyle
"StirrupTie";
//rebarBarType
tipo_barra_extremos;
//startHookType
hook;
//endHookType
hook;
//startHookOrientation
"Left";
//endtHookOrientation
"Left";
//hostElement
elem;
//vector
estribos_extremos_vector;
//spacing
espaciamiento_extremos;
//ArrayLength
curve_splitted_len_extremos;
//Plano de ajuste etiquetas
plane_ajuste_etiqueta;
//Punto para posicionar tag
tag_location_extremos;






//Estribos Centrales
estribos_centrales = DSCore.List.GetItemAtIndex(geom_surface_perimeter_curves@@L3<1>, 1);
estribos_centrales_vector = DSCore.List.GetItemAtIndex(curve_splitted_vector@@L2<1>, 1);
curve_splitted_len_centrales = DSCore.List.GetItemAtIndex(Autodesk.Curve.Length(curve_splitted)@@L2<1>, 1);
tag_location_centrales = DSCore.List.GetItemAtIndex(Autodesk.Curve.PointAtParameter(curve_splitted, 0.5)@@L2<1>, 1);
//curves
estribos_centrales;
//rebarStyle
"StirrupTie";
//rebarBarType
tipo_barra_centrales;
//startHookType
hook;
//endHookType
hook;
//startHookOrientation
"Left";
//endtHookOrientation
"Left";
//hostElement
elem;
//vector
estribos_centrales_vector;
//spacing
espaciamiento_centrales;
//ArrayLength
curve_splitted_len_centrales;
//includeFirstBar
false;
//includeLastBar
false;
//Plano de ajuste etiquetas
plane_ajuste_etiqueta;
//Punto para posicionar tag
tag_location_centrales;


//
# ----------------------------------------
fromCurves_3 = StructuralDesign.Rebar.Create.FromCurves(curves=code_block_14.out64, rebarStyle=code_block_14.out65, rebarBarType=code_block_14.out66, startHookType=code_block_14.out67, endHookType=code_block_14.out68, startHookOrientation=code_block_14.out69, endHookOrientation=code_block_14.out70, hostElement=code_block_14.out71, vector=code_block_14.out72)
setLayoutAsMaximumSpacing_3 = StructuralDesign.Rebar.Layout.SetLayoutAsMaximumSpacing(rebar=fromCurves_3, spacing=code_block_14.out73, arrayLength=code_block_14.out74, lacing=Longest)
code_block_15 = CodeBlock { "FirstLast"; }
setRebarPresentation_3 = Custom[SetRebarPresentation](rebarElements=setLayoutAsMaximumSpacing_3, rebarRepresentation=code_block_15)
flatten_3 = List.Flatten(list=setRebarPresentation_3@L3)
code_block_16 = CodeBlock(element=flatten_3, plane_ajuste_etiqueta=code_block_14.out75, tag_location_extremos=code_block_14.out76)  # same code as code_block_11
create_tag_3 = Custom[Create Tag](view=o_document_activeview_4@L1, element=code_block_16.out3@L2, TagLocation=code_block_16.out4@L2, TagType=code_block_16.out6@L1, horizontal=code_block_16.out7@L1, addLeader=code_block_16.out8@L1, LinkInstance=code_block_16.out9@L1, RunIt=code_block_16.out10@L1, lacing=Longest)
o_document_activeview_6 = Orchid.RevitProject.Common.Document.ActiveView()
fromCurves_4 = StructuralDesign.Rebar.Create.FromCurves(curves=code_block_14.out81, rebarStyle=code_block_14.out82, rebarBarType=code_block_14.out83, startHookType=code_block_14.out84, endHookType=code_block_14.out85, startHookOrientation=code_block_14.out86, endHookOrientation=code_block_14.out87, hostElement=code_block_14.out88, vector=code_block_14.out89)
setLayoutAsMaximumSpacing_4 = StructuralDesign.Rebar.Layout.SetLayoutAsMaximumSpacing(rebar=fromCurves_4, spacing=code_block_14.out90, arrayLength=code_block_14.out91, includeFirstBar=code_block_14.out92, includeLastBar=code_block_14.out93)
code_block_17 = CodeBlock { "FirstLast"; }
setRebarPresentation_4 = Custom[SetRebarPresentation](rebarElements=setLayoutAsMaximumSpacing_4, rebarRepresentation=code_block_17)
flatten_4 = List.Flatten(list=setRebarPresentation_4)
code_block_18 = CodeBlock(element=flatten_4, plane_ajuste_etiqueta=code_block_14.out94, tag_location_centrales=code_block_14.out95)  # same code as code_block_13
create_tag_4 = Custom[Create Tag](view=o_document_activeview_6, element=code_block_18.out3, TagLocation=code_block_18.out4, TagType=code_block_18.out6, horizontal=code_block_18.out7, addLeader=code_block_18.out8, LinkInstance=code_block_18.out9, RunIt=code_block_18.out10)

# group: 3 Barras
o_document_activeview_7 = Orchid.RevitProject.Common.Document.ActiveView()  # frozen
element_types_ᶜᵒⁿᵛᵉʳᵗᵉᵈ_ᵈʳᵒᵖᵈᵒʷⁿ_4 = CodeBlock { DSCore.Types.FindTypeByNameInAssembly("RebarHookType", "RevitAPI"); }  # frozen
all_elements_of_type_4 = ElementsOfType(element_type=element_types_ᶜᵒⁿᵛᵉʳᵗᵉᵈ_ᵈʳᵒᵖᵈᵒʷⁿ_4)
o_document_activeview_8 = Orchid.RevitProject.Common.Document.ActiveView()  # frozen
plane_3 = Custom[View.Plane](view=o_document_activeview_8)  # frozen
code_block_19 = CodeBlock(x=code_block_8.out1, pata=all_elements_of_type_4, view_plane=plane_3)  # frozen
# ---------- code_block_19.designscript (120 lines) ----------
elementos = x[0];
tipo_barra_extremos = x[1];
espaciamiento_extremos = x[2];
pata;
pata_names = Revit.Elements.Element.Name(pata);
mask = pata_names == "Stirrup/Tie - 135 deg.";
hook = DSCore.List.FilterByBoolMask(pata, mask)["in"][0];

//Obtener la cantidad de barras para definir cuantos estribos utilizar
rebar_cat = Revit.Category.ByName("Structural Rebar");
str_framing_rebars = Rhythm.Elements.DependentElementsOfCategory(elementos, rebar_cat);
str_framing_rebars_shapes = Revit.Elements.Element.GetParameterValueByName(str_framing_rebars, "Shape");
str_framing_rebars_shapes_names = Revit.Elements.Element.Name(str_framing_rebars_shapes);
str_framing_rebars_mask = DSCore.String.Contains(str_framing_rebars_shapes_names, "R_S_", false);
str_framing_rebars_R_S_ = DSCore.List.GetItemAtIndex(DSCore.List.FilterByBoolMask(str_framing_rebars, str_framing_rebars_mask)["in"]@L2<1>, 0);
str_framing_rebars_quantities = Revit.Elements.Element.GetParameterValueByName(str_framing_rebars_R_S_, "Quantity");

//filtro de elementos en funcion de la cantidad de barras
elementos_mask = str_framing_rebars_quantities == 3;
elem = DSCore.List.FilterByBoolMask(elementos, elementos_mask)["in"];


//Normal plano vista actual
view_plane_normal = Autodesk.Plane.Normal(view_plane);

//Variables para filtrar elementos por categoria
elem_category = Revit.Elements.Element.GetCategory(elem);
elem_category_name = Revit.Category.Name(elem_category);

//Filtrar vigas de hormigon paralelos a la vista actual
structural_framing_mask = elem_category_name == "Structural Framing";
structural_framing = DSCore.List.FilterByBoolMask(elem, structural_framing_mask)["in"];
structural_framing_material = DSCore.List.Flatten(Revit.Elements.Element.GetMaterials(structural_framing, false));
structural_framing_material_name = Revit.Material.Name(structural_framing_material);
structural_framing_material_mask = structural_framing_material_name == "Concrete, Cast-in-Place gray";
structural_framing_hormigon = DSCore.List.FilterByBoolMask(structural_framing, structural_framing_material_mask)["in"];
structural_framing_hormigon_location = Revit.Elements.Element.GetLocation(structural_framing_hormigon);
structural_framing_hormigon_vector = Line.Direction(structural_framing_hormigon_location);
structural_framing_hormigon_centroid = Autodesk.Solid.Centroid(DSCore.List.Flatten(Revit.Elements.Element.Geometry(structural_framing_hormigon)));
structural_framing_hormigon_coo_sys = Autodesk.Curve.CoordinateSystemAtParameter(structural_framing_hormigon_location);
structural_framing_hormigon_vector_mask = Autodesk.Vector.IsParallel(CoordinateSystem.XAxis(structural_framing_hormigon_coo_sys), view_plane_normal);
structural_framing_hormigon_lst = DSCore.List.FilterByBoolMask(structural_framing_hormigon, structural_framing_hormigon_vector_mask)["in"];
structural_framing_hormigon_lst_location = Revit.Elements.Element.GetLocation(structural_framing_hormigon_lst);
structural_framing_hormigon_lst_cut_len = Revit.Elements.Element.GetParameterValueByName(structural_framing_hormigon_lst, "Cut Length");
structural_framing_hormigon_lst_location_len = Autodesk.Curve.Length(structural_framing_hormigon_lst_location);
structural_framing_hormigon_lst_location_start_p = Autodesk.Curve.StartPoint(structural_framing_hormigon_lst_location);
structural_framing_hormigon_lst_location_end_p = Autodesk.Curve.EndPoint(structural_framing_hormigon_lst_location);
structural_framing_hormigon_lst_vector = Autodesk.Vector.ByTwoPoints(structural_framing_hormigon_lst_location_start_p, structural_framing_hormigon_lst_location_end_p);
structural_framing_hormigon_lst_vector_len = Autodesk.Vector.Length(structural_framing_hormigon_lst_vector);

//Altura de Vigas seleccionadas
elem_altura = Revit.Elements.Element.GetParameterValueByName(Revit.Elements.Element.GetParameterValueByName(elem, "Type"), "Height");

//Curva de las Vigas
elem_curve_inicial = Revit.Elements.Element.GetLocation(structural_framing_hormigon_lst);
elem_curve_inicial_len = DesignScript.Curve.Length(elem_curve_inicial);
dif_len = DSCore.Math.Abs(structural_framing_hormigon_lst_cut_len - structural_framing_hormigon_lst_location_len) / 2;
x_1 = Autodesk.Curve.ExtendEnd(Autodesk.Curve.ExtendStart(structural_framing_hormigon_lst_location, (dif_len + 50) * -1), (dif_len + 50) * -1);
x_2 = Autodesk.Curve.ExtendEnd(Autodesk.Curve.ExtendStart(structural_framing_hormigon_lst_location, (dif_len + 50) * -1), (dif_len + 50) * -1);

elem_curve = [Imperative]
{
	if(structural_framing_hormigon_lst_location_len >= structural_framing_hormigon_lst_cut_len)
	{
		return  x_1;
	}
	else
	{
		return  x_2;
	}
};
elem_curve_start_p = Autodesk.Curve.StartPoint(elem_curve);
elem_curve_end_p = Autodesk.Curve.EndPoint(elem_curve);
elem_curve_vector = Autodesk.Vector.ByTwoPoints(elem_curve_start_p, elem_curve_end_p);
elem_curve_vector_len = Autodesk.Vector.Length(elem_curve_vector);

//Geometria a Cortar
g_elem_solid = DSCore.List.Flatten(Revit.Elements.Element.Geometry(structural_framing_hormigon_lst));
g_solid_centroid = Autodesk.Solid.Centroid(g_elem_solid);
g_solid_coo_sys = Autodesk.Curve.CoordinateSystemAtParameter(structural_framing_hormigon_lst_location, 0.5);
g_solid_plane = CoordinateSystem.YZPlane(g_solid_coo_sys);
g_solid_scaled = Autodesk.Geometry.Scale(g_elem_solid, g_solid_plane, 5, 1, 1);

//Geometria Estribo
geom_param_at_point = DesignScript.Curve.ParameterAtPoint(elem_curve, elem_curve_start_p);
geom_plane_at_param = DesignScript.Curve.PlaneAtParameter(elem_curve, geom_param_at_point);
geom_surface = DSCore.List.Flatten(Autodesk.Geometry.Intersect(g_solid_scaled, geom_plane_at_param), -1);
geom_surface_perimeter = Autodesk.Surface.PerimeterCurves(geom_surface);
geom_surface_perimeter_as_polycurve = PolyCurve.ByJoinedCurves(geom_surface_perimeter);
geom_surface_perimeter_curves = Autodesk.Geometry.Explode(PolyCurve.Offset(geom_surface_perimeter_as_polycurve, -25, false));

//Estribos Extermos
tag_location = g_solid_centroid;
//curves
geom_surface_perimeter_curves;
//rebarStyle
"StirrupTie";
//rebarBarType
tipo_barra_extremos;
//startHookType
hook;
//endHookType
hook;
//startHookOrientation
"Left";
//endtHookOrientation
"Left";
//hostElement
structural_framing_hormigon_lst;
//vector
structural_framing_hormigon_lst_vector;
//spacing
espaciamiento_extremos;
//ArrayLength
elem_curve_vector_len;
//Punto para posicionar tag
tag_location;


//
# ----------------------------------------
fromCurves_5 = StructuralDesign.Rebar.Create.FromCurves(curves=code_block_19.out61, rebarStyle=code_block_19.out62, rebarBarType=code_block_19.out63, startHookType=code_block_19.out64, endHookType=code_block_19.out65, startHookOrientation=code_block_19.out66, endHookOrientation=code_block_19.out67, hostElement=code_block_19.out68, vector=code_block_19.out69)  # frozen
setLayoutAsMaximumSpacing_5 = StructuralDesign.Rebar.Layout.SetLayoutAsMaximumSpacing(rebar=fromCurves_5, spacing=code_block_19.out70, arrayLength=code_block_19.out71, lacing=Longest)  # frozen
code_block_20 = CodeBlock { "FirstLast"; }  # frozen
setRebarPresentation_5 = Custom[SetRebarPresentation](rebarElements=setLayoutAsMaximumSpacing_5, rebarRepresentation=code_block_20)  # frozen
flatten_5 = List.Flatten(list=setRebarPresentation_5)
code_block_21 = CodeBlock(element=flatten_5, tag_location=code_block_19.out72)  # frozen
# ---------- code_block_21.designscript (19 lines) ----------
//Asigna el tipo de estribo (sim, doble, etc...)
Revit.Elements.Element.SetParameterByName(element, "Estribo", "E.");
tag_location;

//element
element;
//TagLocation
tag_location;
//TagType
family = Revit.Family.ByName("EST_A_STRUCTURAL REBAR TAG_ESTRIBO");
tag_type = Revit.Elements.FamilyType.ByFamilyAndName(family, "R_E_00");
//horizontal
true;
//addLeader
false;
//LinkInstance
null;
//RunIt
true;
# ----------------------------------------
create_tag_5 = Custom[Create Tag](view=o_document_activeview_7@L1, element=code_block_21.out2@L2, TagLocation=code_block_21.out3@L2, TagType=code_block_21.out5@L1, horizontal=code_block_21.out6@L1, addLeader=code_block_21.out7@L1, LinkInstance=code_block_21.out8@L1, RunIt=code_block_21.out9@L1, lacing=Longest)

# group: 4 Barras
o_document_activeview_9 = Orchid.RevitProject.Common.Document.ActiveView()  # frozen
element_types_ᶜᵒⁿᵛᵉʳᵗᵉᵈ_ᵈʳᵒᵖᵈᵒʷⁿ_5 = CodeBlock { DSCore.Types.FindTypeByNameInAssembly("RebarHookType", "RevitAPI"); }  # frozen
all_elements_of_type_5 = ElementsOfType(element_type=element_types_ᶜᵒⁿᵛᵉʳᵗᵉᵈ_ᵈʳᵒᵖᵈᵒʷⁿ_5)
o_document_activeview_10 = Orchid.RevitProject.Common.Document.ActiveView()  # frozen
plane_4 = Custom[View.Plane](view=o_document_activeview_10)  # frozen
code_block_22 = CodeBlock(x=code_block_8.out1, pata=all_elements_of_type_5, view_plane=plane_4)  # frozen
# ---------- code_block_22.designscript (171 lines) ----------
elementos = x[0];
tipo_barra_extremos = x[1];
espaciamiento_extremos = x[2];
pata;
pata_names = Revit.Elements.Element.Name(pata);
mask = pata_names == "Stirrup/Tie - 135 deg.";
hook = DSCore.List.FilterByBoolMask(pata, mask)["in"][0];

//Obtener la cantidad de barras para definir cuantos estribos utilizar
rebar_cat = Revit.Category.ByName("Structural Rebar");
str_framing_rebars = Rhythm.Elements.DependentElementsOfCategory(elementos, rebar_cat);
str_framing_rebars_shapes = Revit.Elements.Element.GetParameterValueByName(str_framing_rebars, "Shape");
str_framing_rebars_shapes_names = Revit.Elements.Element.Name(str_framing_rebars_shapes);
str_framing_rebars_mask = DSCore.String.Contains(str_framing_rebars_shapes_names, "R_S_", false);
str_framing_rebars_R_S_ = DSCore.List.GetItemAtIndex(DSCore.List.FilterByBoolMask(str_framing_rebars, str_framing_rebars_mask)["in"]@L2<1>, 0);
str_framing_rebars_quantities = Revit.Elements.Element.GetParameterValueByName(str_framing_rebars_R_S_, "Quantity");

//filtro de elementos en funcion de la cantidad de barras
elementos_mask = str_framing_rebars_quantities == 4;
elem = DSCore.List.FilterByBoolMask(elementos, elementos_mask)["in"];

//Normal plano vista actual
view_plane_normal = Autodesk.Plane.Normal(view_plane);

//Variables para filtrar elementos por categoria
elem_category = Revit.Elements.Element.GetCategory(elem);
elem_category_name = Revit.Category.Name(elem_category);

//Filtrar vigas de hormigon paralelos a la vista actual
structural_framing_mask = elem_category_name == "Structural Framing";
structural_framing = DSCore.List.FilterByBoolMask(elem, structural_framing_mask)["in"];
structural_framing_material = DSCore.List.Flatten(Revit.Elements.Element.GetMaterials(structural_framing, false));
structural_framing_material_name = Revit.Material.Name(structural_framing_material);
structural_framing_material_mask = structural_framing_material_name == "Concrete, Cast-in-Place gray";
structural_framing_hormigon = DSCore.List.FilterByBoolMask(structural_framing, structural_framing_material_mask)["in"];
structural_framing_hormigon_location = Revit.Elements.Element.GetLocation(structural_framing_hormigon);
structural_framing_hormigon_vector = Line.Direction(structural_framing_hormigon_location);
structural_framing_hormigon_centroid = Autodesk.Solid.Centroid(DSCore.List.Flatten(Revit.Elements.Element.Geometry(structural_framing_hormigon)));
structural_framing_hormigon_coo_sys = Autodesk.Curve.CoordinateSystemAtParameter(structural_framing_hormigon_location);
structural_framing_hormigon_vector_mask = Autodesk.Vector.IsParallel(CoordinateSystem.XAxis(structural_framing_hormigon_coo_sys), view_plane_normal);
structural_framing_hormigon_lst = DSCore.List.FilterByBoolMask(structural_framing_hormigon, structural_framing_hormigon_vector_mask)["in"];
structural_framing_hormigon_lst_location = Revit.Elements.Element.GetLocation(structural_framing_hormigon_lst);
structural_framing_hormigon_lst_cut_len = Revit.Elements.Element.GetParameterValueByName(structural_framing_hormigon_lst, "Cut Length");
structural_framing_hormigon_lst_location_len = Autodesk.Curve.Length(structural_framing_hormigon_lst_location);
structural_framing_hormigon_lst_location_start_p = Autodesk.Curve.StartPoint(structural_framing_hormigon_lst_location);
structural_framing_hormigon_lst_location_end_p = Autodesk.Curve.EndPoint(structural_framing_hormigon_lst_location);
structural_framing_hormigon_lst_vector = Autodesk.Vector.ByTwoPoints(structural_framing_hormigon_lst_location_start_p, structural_framing_hormigon_lst_location_end_p);
structural_framing_hormigon_lst_vector_len = Autodesk.Vector.Length(structural_framing_hormigon_lst_vector);

//Altura de Vigas seleccionadas
elem_altura = Revit.Elements.Element.GetParameterValueByName(Revit.Elements.Element.GetParameterValueByName(elem, "Type"), "Height");

//Curva de las Vigas
elem_curve_inicial = Revit.Elements.Element.GetLocation(structural_framing_hormigon_lst);
elem_curve_inicial_len = DesignScript.Curve.Length(elem_curve_inicial);
dif_len = DSCore.Math.Abs(structural_framing_hormigon_lst_cut_len - structural_framing_hormigon_lst_location_len) / 2;
x_1 = Autodesk.Curve.ExtendEnd(Autodesk.Curve.ExtendStart(structural_framing_hormigon_lst_location, (dif_len + 50) * -1), (dif_len + 50) * -1);
x_2 = Autodesk.Curve.ExtendEnd(Autodesk.Curve.ExtendStart(structural_framing_hormigon_lst_location, (dif_len + 50) * -1), (dif_len + 50) * -1);

elem_curve = [Imperative]
{
	if(structural_framing_hormigon_lst_location_len >= structural_framing_hormigon_lst_cut_len)
	{
		return  x_1;
	}
	else
	{
		return  x_2;
	}
};
elem_curve_start_p = Autodesk.Curve.StartPoint(elem_curve);
elem_curve_end_p = Autodesk.Curve.EndPoint(elem_curve);
elem_curve_vector = Autodesk.Vector.ByTwoPoints(elem_curve_start_p, elem_curve_end_p);
elem_curve_vector_len = Autodesk.Vector.Length(elem_curve_vector);

//Geometria a Cortar
g_elem_solid = DSCore.List.Flatten(Revit.Elements.Element.Geometry(structural_framing_hormigon_lst));
g_solid_centroid = Autodesk.Solid.Centroid(g_elem_solid);
g_solid_coo_sys = Autodesk.Curve.CoordinateSystemAtParameter(structural_framing_hormigon_lst_location, 0.5);
g_solid_plane = CoordinateSystem.YZPlane(g_solid_coo_sys);
g_solid_scaled = Autodesk.Geometry.Scale(g_elem_solid, g_solid_plane, 5, 1, 1);

//Geometria Estribo
geom_param_at_point = DesignScript.Curve.ParameterAtPoint(elem_curve, elem_curve_start_p);
geom_plane_at_param = DesignScript.Curve.PlaneAtParameter(elem_curve, geom_param_at_point);
geom_surface = DSCore.List.Flatten(Autodesk.Geometry.Intersect(g_solid_scaled, geom_plane_at_param), -1);
geom_surface_perimeter = Autodesk.Surface.PerimeterCurves(geom_surface);
geom_surface_perimeter_as_polycurve = PolyCurve.Offset(PolyCurve.ByJoinedCurves(geom_surface_perimeter), -25, false);
geom_surface_offset = Autodesk.Surface.ByPatch(geom_surface_perimeter_as_polycurve);
//Estribo 1
geom_surface_coo_sys_1 = Autodesk.Surface.CoordinateSystemAtParameter(geom_surface_offset, 0, 0.6935);
geom_surface_cut_plane_1 = CoordinateSystem.ZXPlane(geom_surface_coo_sys_1);
geom_surface_split_1 = Autodesk.Geometry.Split(geom_surface_offset, geom_surface_cut_plane_1);
geom_surface_1 = DSCore.List.GetItemAtIndex(geom_surface_split_1@L2<1>, 1);
geom_surface_perimeter_1 = Autodesk.Surface.PerimeterCurves(geom_surface_1);
geom_surface_perimeter_as_polycurve_1 = PolyCurve.ByJoinedCurves(geom_surface_perimeter_1);
geom_surface_perimeter_curves_1 = Autodesk.Geometry.Explode(geom_surface_perimeter_as_polycurve_1);
//Estribo 2
geom_surface_coo_sys_2 = Autodesk.Surface.CoordinateSystemAtParameter(geom_surface_offset, 0, 0.3065);
geom_surface_cut_plane_2 = CoordinateSystem.ZXPlane(geom_surface_coo_sys_2);
geom_surface_split_2 = Autodesk.Geometry.Split(geom_surface_offset, geom_surface_cut_plane_2);
geom_surface_2 = DSCore.List.GetItemAtIndex(geom_surface_split_2@L2<1>, 0);
geom_surface_perimeter_2 = Autodesk.Surface.PerimeterCurves(geom_surface_2);
geom_surface_perimeter_as_polycurve_2 = PolyCurve.ByJoinedCurves(geom_surface_perimeter_2);
geom_surface_perimeter_curves_2 = Autodesk.Geometry.Explode(geom_surface_perimeter_as_polycurve_2);

geom_surface_perimeter_curves_lst = [geom_surface_perimeter_curves_1, geom_surface_perimeter_curves_2];

//Estribos 1
tag_location = g_solid_centroid;
//curves
geom_surface_perimeter_curves_1;
//rebarStyle
"StirrupTie";
//rebarBarType
tipo_barra_extremos;
//startHookType
hook;
//endHookType
hook;
//startHookOrientation
"Right";
//endtHookOrientation
"Right";
//hostElement
structural_framing_hormigon_lst;
//vector
structural_framing_hormigon_lst_vector;
//spacing
espaciamiento_extremos;
//ArrayLength
elem_curve_vector_len;
//Punto para posicionar tag
tag_location;










//Estribos 2
//curves
geom_surface_perimeter_curves_2;
//rebarStyle
"StirrupTie";
//rebarBarType
tipo_barra_extremos;
//startHookType
hook;
//endHookType
hook;
//startHookOrientation
"Left";
//endtHookOrientation
"Left";
//hostElement
structural_framing_hormigon_lst;
//vector
structural_framing_hormigon_lst_vector;
//spacing
espaciamiento_extremos;
//ArrayLength
elem_curve_vector_len;
//Punto para posicionar tag
tag_location;

//
# ----------------------------------------
fromCurves_6 = StructuralDesign.Rebar.Create.FromCurves(curves=code_block_22.out76, rebarStyle=code_block_22.out77, rebarBarType=code_block_22.out78, startHookType=code_block_22.out79, endHookType=code_block_22.out80, startHookOrientation=code_block_22.out81, endHookOrientation=code_block_22.out82, hostElement=code_block_22.out83, vector=code_block_22.out84)  # frozen
setLayoutAsMaximumSpacing_6 = StructuralDesign.Rebar.Layout.SetLayoutAsMaximumSpacing(rebar=fromCurves_6, spacing=code_block_22.out85, arrayLength=code_block_22.out86, lacing=Longest)  # frozen
code_block_23 = CodeBlock { "FirstLast"; }  # frozen
setRebarPresentation_6 = Custom[SetRebarPresentation](rebarElements=setLayoutAsMaximumSpacing_6, rebarRepresentation=code_block_23)  # frozen
flatten_6 = List.Flatten(list=setRebarPresentation_6)
code_block_24 = CodeBlock(element=flatten_6, tag_location=code_block_22.out87)  # frozen
# ---------- code_block_24.designscript (19 lines) ----------
//Asigna el tipo de estribo (sim, doble, etc...)
Revit.Elements.Element.SetParameterByName(element, "Estribo", "ED.");
tag_location;

//element
element;
//TagLocation
tag_location;
//TagType
family = Revit.Family.ByName("EST_A_STRUCTURAL REBAR TAG_ESTRIBO");
tag_type = Revit.Elements.FamilyType.ByFamilyAndName(family, "R_E_00");
//horizontal
true;
//addLeader
false;
//LinkInstance
null;
//RunIt
true;
# ----------------------------------------
create_tag_6 = Custom[Create Tag](view=o_document_activeview_9@L1, element=code_block_24.out2@L2, TagLocation=code_block_24.out3@L2, TagType=code_block_24.out5@L1, horizontal=code_block_24.out6@L1, addLeader=code_block_24.out7@L1, LinkInstance=code_block_24.out8@L1, RunIt=code_block_24.out9@L1, lacing=Longest)
fromCurves_7 = StructuralDesign.Rebar.Create.FromCurves(curves=code_block_22.out88, rebarStyle=code_block_22.out89, rebarBarType=code_block_22.out90, startHookType=code_block_22.out91, endHookType=code_block_22.out92, startHookOrientation=code_block_22.out93, endHookOrientation=code_block_22.out94, hostElement=code_block_22.out95, vector=code_block_22.out96)  # frozen
setLayoutAsMaximumSpacing_7 = StructuralDesign.Rebar.Layout.SetLayoutAsMaximumSpacing(rebar=fromCurves_7, spacing=code_block_22.out97, arrayLength=code_block_22.out98, lacing=Longest)  # frozen
code_block_25 = CodeBlock { "FirstLast"; }  # frozen
setRebarPresentation_7 = Custom[SetRebarPresentation](rebarElements=setLayoutAsMaximumSpacing_7, rebarRepresentation=code_block_25)  # frozen
flatten_7 = List.Flatten(list=setRebarPresentation_7)  # frozen
code_block_26 = CodeBlock(element=flatten_7)  # frozen
# ---------- code_block_26.designscript (2 lines) ----------
//Asigna el tipo de estribo (sim, doble, etc...)
Revit.Elements.Element.SetParameterByName(element, "Estribo", "ED.");
# ----------------------------------------

# group: 5 Barras
o_document_activeview_11 = Orchid.RevitProject.Common.Document.ActiveView()  # frozen
element_types_ᶜᵒⁿᵛᵉʳᵗᵉᵈ_ᵈʳᵒᵖᵈᵒʷⁿ_6 = CodeBlock { DSCore.Types.FindTypeByNameInAssembly("RebarHookType", "RevitAPI"); }  # frozen
all_elements_of_type_6 = ElementsOfType(element_type=element_types_ᶜᵒⁿᵛᵉʳᵗᵉᵈ_ᵈʳᵒᵖᵈᵒʷⁿ_6)
o_document_activeview_12 = Orchid.RevitProject.Common.Document.ActiveView()  # frozen
plane_5 = Custom[View.Plane](view=o_document_activeview_12)  # frozen
code_block_27 = CodeBlock(x=code_block_8.out1, pata=all_elements_of_type_6, view_plane=plane_5)  # frozen
# ---------- code_block_27.designscript (174 lines) ----------
elementos = x[0];
tipo_barra_extremos = x[1];
espaciamiento_extremos = x[2];
pata;
pata_names = Revit.Elements.Element.Name(pata);
mask = pata_names == "Stirrup/Tie - 135 deg.";
hook = DSCore.List.FilterByBoolMask(pata, mask)["in"][0];

//Obtener la cantidad de barras para definir cuantos estribos utilizar
rebar_cat = Revit.Category.ByName("Structural Rebar");
str_framing_rebars = Rhythm.Elements.DependentElementsOfCategory(elementos, rebar_cat);
str_framing_rebars_shapes = Revit.Elements.Element.GetParameterValueByName(str_framing_rebars, "Shape");
str_framing_rebars_shapes_names = Revit.Elements.Element.Name(str_framing_rebars_shapes);
str_framing_rebars_mask = DSCore.String.Contains(str_framing_rebars_shapes_names, "R_S_", false);
str_framing_rebars_R_S_ = DSCore.List.GetItemAtIndex(DSCore.List.FilterByBoolMask(str_framing_rebars, str_framing_rebars_mask)["in"]@L2<1>, 0);
str_framing_rebars_quantities = Revit.Elements.Element.GetParameterValueByName(str_framing_rebars_R_S_, "Quantity");

//filtro de elementos en funcion de la cantidad de barras
elementos_mask = str_framing_rebars_quantities == 5;
elem = DSCore.List.FilterByBoolMask(elementos, elementos_mask)["in"];

//Normal plano vista actual
view_plane_normal = Autodesk.Plane.Normal(view_plane);

//Variables para filtrar elementos por categoria
elem_category = Revit.Elements.Element.GetCategory(elem);
elem_category_name = Revit.Category.Name(elem_category);

//Filtrar vigas de hormigon paralelos a la vista actual
structural_framing_mask = elem_category_name == "Structural Framing";
structural_framing = DSCore.List.FilterByBoolMask(elem, structural_framing_mask)["in"];
structural_framing_material = DSCore.List.Flatten(Revit.Elements.Element.GetMaterials(structural_framing, false));
structural_framing_material_name = Revit.Material.Name(structural_framing_material);
structural_framing_material_mask = structural_framing_material_name == "Concrete, Cast-in-Place gray";
structural_framing_hormigon = DSCore.List.FilterByBoolMask(structural_framing, structural_framing_material_mask)["in"];
structural_framing_hormigon_location = Revit.Elements.Element.GetLocation(structural_framing_hormigon);
structural_framing_hormigon_vector = Line.Direction(structural_framing_hormigon_location);
structural_framing_hormigon_centroid = Autodesk.Solid.Centroid(DSCore.List.Flatten(Revit.Elements.Element.Geometry(structural_framing_hormigon)));
structural_framing_hormigon_coo_sys = Autodesk.Curve.CoordinateSystemAtParameter(structural_framing_hormigon_location);
structural_framing_hormigon_vector_mask = Autodesk.Vector.IsParallel(CoordinateSystem.XAxis(structural_framing_hormigon_coo_sys), view_plane_normal);
structural_framing_hormigon_lst = DSCore.List.FilterByBoolMask(structural_framing_hormigon, structural_framing_hormigon_vector_mask)["in"];
structural_framing_hormigon_lst_location = Revit.Elements.Element.GetLocation(structural_framing_hormigon_lst);
structural_framing_hormigon_lst_cut_len = Revit.Elements.Element.GetParameterValueByName(structural_framing_hormigon_lst, "Cut Length");
structural_framing_hormigon_lst_location_len = Autodesk.Curve.Length(structural_framing_hormigon_lst_location);
structural_framing_hormigon_lst_location_start_p = Autodesk.Curve.StartPoint(structural_framing_hormigon_lst_location);
structural_framing_hormigon_lst_location_end_p = Autodesk.Curve.EndPoint(structural_framing_hormigon_lst_location);
structural_framing_hormigon_lst_vector = Autodesk.Vector.ByTwoPoints(structural_framing_hormigon_lst_location_start_p, structural_framing_hormigon_lst_location_end_p);
structural_framing_hormigon_lst_vector_len = Autodesk.Vector.Length(structural_framing_hormigon_lst_vector);

//Altura de Vigas seleccionadas
elem_altura = Revit.Elements.Element.GetParameterValueByName(Revit.Elements.Element.GetParameterValueByName(elem, "Type"), "Height");

//Curva de las Vigas
elem_curve_inicial = Revit.Elements.Element.GetLocation(structural_framing_hormigon_lst);
elem_curve_inicial_len = DesignScript.Curve.Length(elem_curve_inicial);
dif_len = DSCore.Math.Abs(structural_framing_hormigon_lst_cut_len - structural_framing_hormigon_lst_location_len) / 2;
x_1 = Autodesk.Curve.ExtendEnd(Autodesk.Curve.ExtendStart(structural_framing_hormigon_lst_location, (dif_len + 50) * -1), (dif_len + 50) * -1);
x_2 = Autodesk.Curve.ExtendEnd(Autodesk.Curve.ExtendStart(structural_framing_hormigon_lst_location, (dif_len + 50) * -1), (dif_len + 50) * -1);

elem_curve = [Imperative]
{
	if(structural_framing_hormigon_lst_location_len >= structural_framing_hormigon_lst_cut_len)
	{
		return  x_1;
	}
	else
	{
		return  x_2;
	}
};
elem_curve_start_p = Autodesk.Curve.StartPoint(elem_curve);
elem_curve_end_p = Autodesk.Curve.EndPoint(elem_curve);
elem_curve_vector = Autodesk.Vector.ByTwoPoints(elem_curve_start_p, elem_curve_end_p);
elem_curve_vector_len = Autodesk.Vector.Length(elem_curve_vector);

//Geometria a Cortar
g_elem_solid = DSCore.List.Flatten(Revit.Elements.Element.Geometry(structural_framing_hormigon_lst));
g_solid_centroid = Autodesk.Solid.Centroid(g_elem_solid);
g_solid_coo_sys = Autodesk.Curve.CoordinateSystemAtParameter(structural_framing_hormigon_lst_location, 0.5);
g_solid_plane = CoordinateSystem.YZPlane(g_solid_coo_sys);
g_solid_scaled = Autodesk.Geometry.Scale(g_elem_solid, g_solid_plane, 5, 1, 1);

//Geometria Estribo
geom_param_at_point = DesignScript.Curve.ParameterAtPoint(elem_curve, elem_curve_start_p);
geom_plane_at_param = DesignScript.Curve.PlaneAtParameter(elem_curve, geom_param_at_point);
geom_surface = DSCore.List.Flatten(Autodesk.Geometry.Intersect(g_solid_scaled, geom_plane_at_param), -1);
geom_surface_perimeter = Autodesk.Surface.PerimeterCurves(geom_surface);
geom_surface_perimeter_as_polycurve = PolyCurve.Offset(PolyCurve.ByJoinedCurves(geom_surface_perimeter), -25, false);
geom_surface_offset = Autodesk.Surface.ByPatch(geom_surface_perimeter_as_polycurve);
//Estribo 1
geom_surface_coo_sys_1 = Autodesk.Surface.CoordinateSystemAtParameter(geom_surface_offset, 0, 0.76715);
geom_surface_cut_plane_1 = CoordinateSystem.ZXPlane(geom_surface_coo_sys_1);
geom_surface_split_1 = Autodesk.Geometry.Split(geom_surface_offset, geom_surface_cut_plane_1);
geom_surface_1 = DSCore.List.GetItemAtIndex(geom_surface_split_1@L2<1>, 1);
geom_surface_perimeter_1 = Autodesk.Surface.PerimeterCurves(geom_surface_1);
geom_surface_perimeter_as_polycurve_1 = PolyCurve.ByJoinedCurves(geom_surface_perimeter_1);
geom_surface_perimeter_curves_1 = Autodesk.Geometry.Explode(geom_surface_perimeter_as_polycurve_1);
//Estribo 2
geom_surface_coo_sys_2 = Autodesk.Surface.CoordinateSystemAtParameter(geom_surface_offset, 0, 0.23285);
geom_surface_cut_plane_2 = CoordinateSystem.ZXPlane(geom_surface_coo_sys_2);
geom_surface_split_2 = Autodesk.Geometry.Split(geom_surface_offset, geom_surface_cut_plane_2);
geom_surface_2 = DSCore.List.GetItemAtIndex(geom_surface_split_2@L2<1>, 0);
geom_surface_perimeter_2 = Autodesk.Surface.PerimeterCurves(geom_surface_2);
geom_surface_perimeter_as_polycurve_2 = PolyCurve.ByJoinedCurves(geom_surface_perimeter_2);
geom_surface_perimeter_curves_2 = Autodesk.Geometry.Explode(geom_surface_perimeter_as_polycurve_2);
//Traba
geom_surface_coo_sys_3 = Autodesk.Surface.CoordinateSystemAtParameter(geom_surface_offset, 0, 0.454257);
geom_surface_cut_plane_3 = CoordinateSystem.ZXPlane(geom_surface_coo_sys_3);
geom_surface_intersect_3 = Autodesk.Geometry.Intersect(geom_surface_offset, geom_surface_cut_plane_3);




//Estribos 1
tag_location = g_solid_centroid;
//curves
geom_surface_perimeter_curves_1;
//rebarStyle
"StirrupTie";
//rebarBarType
tipo_barra_extremos;
//startHookType
hook;
//endHookType
hook;
//startHookOrientation
"Right";
//endtHookOrientation
"Right";
//hostElement
structural_framing_hormigon_lst;
//vector
structural_framing_hormigon_lst_vector;
//spacing
espaciamiento_extremos;
//ArrayLength
elem_curve_vector_len;
//Punto para posicionar tag
tag_location;










//Estribos 2
//curves
geom_surface_perimeter_curves_2;
//rebarStyle
"StirrupTie";
//rebarBarType
tipo_barra_extremos;
//startHookType
hook;
//endHookType
hook;
//startHookOrientation
"Left";
//endtHookOrientation
"Left";
//hostElement
structural_framing_hormigon_lst;
//vector
structural_framing_hormigon_lst_vector;
//spacing
espaciamiento_extremos;
//ArrayLength
elem_curve_vector_len;

//
# ----------------------------------------
fromCurves_8 = StructuralDesign.Rebar.Create.FromCurves(curves=code_block_27.out78, rebarStyle=code_block_27.out79, rebarBarType=code_block_27.out80, startHookType=code_block_27.out81, endHookType=code_block_27.out82, startHookOrientation=code_block_27.out83, endHookOrientation=code_block_27.out84, hostElement=code_block_27.out85, vector=code_block_27.out86)  # frozen
setLayoutAsMaximumSpacing_8 = StructuralDesign.Rebar.Layout.SetLayoutAsMaximumSpacing(rebar=fromCurves_8, spacing=code_block_27.out87, arrayLength=code_block_27.out88, lacing=Longest)  # frozen
code_block_28 = CodeBlock { "FirstLast"; }  # frozen
setRebarPresentation_8 = Custom[SetRebarPresentation](rebarElements=setLayoutAsMaximumSpacing_8, rebarRepresentation=code_block_28)  # frozen
flatten_8 = List.Flatten(list=setRebarPresentation_8)  # frozen
code_block_29 = CodeBlock(element=flatten_8, tag_location=code_block_27.out89)  # frozen; same code as code_block_24
create_tag_7 = Custom[Create Tag](view=o_document_activeview_11@L1, element=code_block_29.out2@L2, TagLocation=code_block_29.out3@L2, TagType=code_block_29.out5@L1, horizontal=code_block_29.out6@L1, addLeader=code_block_29.out7@L1, LinkInstance=code_block_29.out8@L1, RunIt=code_block_29.out9@L1, lacing=Longest)
fromCurves_9 = StructuralDesign.Rebar.Create.FromCurves(curves=code_block_27.out90, rebarStyle=code_block_27.out91, rebarBarType=code_block_27.out92, startHookType=code_block_27.out93, endHookType=code_block_27.out94, startHookOrientation=code_block_27.out95, endHookOrientation=code_block_27.out96, hostElement=code_block_27.out97, vector=code_block_27.out98)  # frozen
setLayoutAsMaximumSpacing_9 = StructuralDesign.Rebar.Layout.SetLayoutAsMaximumSpacing(rebar=fromCurves_9, spacing=code_block_27.out99, arrayLength=code_block_27.out100, lacing=Longest)  # frozen
code_block_30 = CodeBlock { "FirstLast"; }  # frozen
setRebarPresentation_9 = Custom[SetRebarPresentation](rebarElements=setLayoutAsMaximumSpacing_9, rebarRepresentation=code_block_30)  # frozen
flatten_9 = List.Flatten(list=setRebarPresentation_9)  # frozen
code_block_31 = CodeBlock(element=flatten_9)  # frozen; same code as code_block_26

# group: 6 Barras
element_types_ᶜᵒⁿᵛᵉʳᵗᵉᵈ_ᵈʳᵒᵖᵈᵒʷⁿ_7 = CodeBlock { DSCore.Types.FindTypeByNameInAssembly("RebarHookType", "RevitAPI"); }  # frozen
all_elements_of_type_7 = ElementsOfType(element_type=element_types_ᶜᵒⁿᵛᵉʳᵗᵉᵈ_ᵈʳᵒᵖᵈᵒʷⁿ_7)
o_document_activeview_13 = Orchid.RevitProject.Common.Document.ActiveView()  # frozen
plane_6 = Custom[View.Plane](view=o_document_activeview_13)  # frozen
code_block_32 = CodeBlock(x=code_block_8.out1, pata=all_elements_of_type_7, view_plane=plane_6)  # frozen
# ---------- code_block_32.designscript (213 lines) ----------
elementos = x[0];
tipo_barra_extremos = x[1];
espaciamiento_extremos = x[2];
pata;
pata_names = Revit.Elements.Element.Name(pata);
mask = pata_names == "Stirrup/Tie - 135 deg.";
hook = DSCore.List.FilterByBoolMask(pata, mask)["in"][0];

//Obtener la cantidad de barras para definir cuantos estribos utilizar
rebar_cat = Revit.Category.ByName("Structural Rebar");
str_framing_rebars = Rhythm.Elements.DependentElementsOfCategory(elementos, rebar_cat);
str_framing_rebars_shapes = Revit.Elements.Element.GetParameterValueByName(str_framing_rebars, "Shape");
str_framing_rebars_shapes_names = Revit.Elements.Element.Name(str_framing_rebars_shapes);
str_framing_rebars_mask = DSCore.String.Contains(str_framing_rebars_shapes_names, "R_S_", false);
str_framing_rebars_R_S_ = DSCore.List.GetItemAtIndex(DSCore.List.FilterByBoolMask(str_framing_rebars, str_framing_rebars_mask)["in"]@L2<1>, 0);
str_framing_rebars_quantities = Revit.Elements.Element.GetParameterValueByName(str_framing_rebars_R_S_, "Quantity");

//filtro de elementos en funcion de la cantidad de barras
elementos_mask = str_framing_rebars_quantities == 6;
elem = DSCore.List.FilterByBoolMask(elementos, elementos_mask)["in"];

//Normal plano vista actual
view_plane_normal = Autodesk.Plane.Normal(view_plane);

//Variables para filtrar elementos por categoria
elem_category = Revit.Elements.Element.GetCategory(elem);
elem_category_name = Revit.Category.Name(elem_category);

//Filtrar vigas de hormigon paralelos a la vista actual
structural_framing_mask = elem_category_name == "Structural Framing";
structural_framing = DSCore.List.FilterByBoolMask(elem, structural_framing_mask)["in"];
structural_framing_material = DSCore.List.Flatten(Revit.Elements.Element.GetMaterials(structural_framing, false));
structural_framing_material_name = Revit.Material.Name(structural_framing_material);
structural_framing_material_mask = structural_framing_material_name == "Concrete, Cast-in-Place gray";
structural_framing_hormigon = DSCore.List.FilterByBoolMask(structural_framing, structural_framing_material_mask)["in"];
structural_framing_hormigon_location = Revit.Elements.Element.GetLocation(structural_framing_hormigon);
structural_framing_hormigon_vector = Line.Direction(structural_framing_hormigon_location);
structural_framing_hormigon_centroid = Autodesk.Solid.Centroid(DSCore.List.Flatten(Revit.Elements.Element.Geometry(structural_framing_hormigon)));
structural_framing_hormigon_coo_sys = Autodesk.Curve.CoordinateSystemAtParameter(structural_framing_hormigon_location);
structural_framing_hormigon_vector_mask = Autodesk.Vector.IsParallel(CoordinateSystem.XAxis(structural_framing_hormigon_coo_sys), view_plane_normal);
structural_framing_hormigon_lst = DSCore.List.FilterByBoolMask(structural_framing_hormigon, structural_framing_hormigon_vector_mask)["in"];
structural_framing_hormigon_lst_location = Revit.Elements.Element.GetLocation(structural_framing_hormigon_lst);
structural_framing_hormigon_lst_cut_len = Revit.Elements.Element.GetParameterValueByName(structural_framing_hormigon_lst, "Cut Length");
structural_framing_hormigon_lst_location_len = Autodesk.Curve.Length(structural_framing_hormigon_lst_location);
structural_framing_hormigon_lst_location_start_p = Autodesk.Curve.StartPoint(structural_framing_hormigon_lst_location);
structural_framing_hormigon_lst_location_end_p = Autodesk.Curve.EndPoint(structural_framing_hormigon_lst_location);
structural_framing_hormigon_lst_vector = Autodesk.Vector.ByTwoPoints(structural_framing_hormigon_lst_location_start_p, structural_framing_hormigon_lst_location_end_p);
structural_framing_hormigon_lst_vector_len = Autodesk.Vector.Length(structural_framing_hormigon_lst_vector);

//Altura de Vigas seleccionadas
elem_altura = Revit.Elements.Element.GetParameterValueByName(Revit.Elements.Element.GetParameterValueByName(elem, "Type"), "Height");

//Curva de las Vigas
elem_curve_inicial = Revit.Elements.Element.GetLocation(structural_framing_hormigon_lst);
elem_curve_inicial_len = DesignScript.Curve.Length(elem_curve_inicial);
dif_len = DSCore.Math.Abs(structural_framing_hormigon_lst_cut_len - structural_framing_hormigon_lst_location_len) / 2;
x_1 = Autodesk.Curve.ExtendEnd(Autodesk.Curve.ExtendStart(structural_framing_hormigon_lst_location, (dif_len + 50) * -1), (dif_len + 50) * -1);
x_2 = Autodesk.Curve.ExtendEnd(Autodesk.Curve.ExtendStart(structural_framing_hormigon_lst_location, (dif_len + 50) * -1), (dif_len + 50) * -1);

elem_curve = [Imperative]
{
	if(structural_framing_hormigon_lst_location_len >= structural_framing_hormigon_lst_cut_len)
	{
		return  x_1;
	}
	else
	{
		return  x_2;
	}
};
elem_curve_start_p = Autodesk.Curve.StartPoint(elem_curve);
elem_curve_end_p = Autodesk.Curve.EndPoint(elem_curve);
elem_curve_vector = Autodesk.Vector.ByTwoPoints(elem_curve_start_p, elem_curve_end_p);
elem_curve_vector_len = Autodesk.Vector.Length(elem_curve_vector);

//Geometria a Cortar
g_elem_solid = DSCore.List.Flatten(Revit.Elements.Element.Geometry(structural_framing_hormigon_lst));
g_solid_centroid = Autodesk.Solid.Centroid(g_elem_solid);
g_solid_coo_sys = Autodesk.Curve.CoordinateSystemAtParameter(structural_framing_hormigon_lst_location, 0.5);
g_solid_plane = CoordinateSystem.YZPlane(g_solid_coo_sys);
g_solid_scaled = Autodesk.Geometry.Scale(g_elem_solid, g_solid_plane, 5, 1, 1);

//Geometria Estribo
geom_param_at_point = DesignScript.Curve.ParameterAtPoint(elem_curve, elem_curve_start_p);
geom_plane_at_param = DesignScript.Curve.PlaneAtParameter(elem_curve, geom_param_at_point);
geom_surface = DSCore.List.Flatten(Autodesk.Geometry.Intersect(g_solid_scaled, geom_plane_at_param), -1);
geom_surface_perimeter = Autodesk.Surface.PerimeterCurves(geom_surface);
geom_surface_perimeter_as_polycurve = PolyCurve.Offset(PolyCurve.ByJoinedCurves(geom_surface_perimeter), -25, false);
geom_surface_offset = Autodesk.Surface.ByPatch(geom_surface_perimeter_as_polycurve);
//Estribo 1
geom_surface_coo_sys_1 = Autodesk.Surface.CoordinateSystemAtParameter(geom_surface_offset, 0, 0.6343);
geom_surface_cut_plane_1 = CoordinateSystem.ZXPlane(geom_surface_coo_sys_1);
geom_surface_split_1 = Autodesk.Geometry.Split(geom_surface_offset, geom_surface_cut_plane_1);
geom_surface_1 = DSCore.List.GetItemAtIndex(geom_surface_split_1@L2<1>, 1);
geom_surface_perimeter_1 = Autodesk.Surface.PerimeterCurves(geom_surface_1);
geom_surface_perimeter_as_polycurve_1 = PolyCurve.ByJoinedCurves(geom_surface_perimeter_1);
geom_surface_perimeter_curves_1 = Autodesk.Geometry.Explode(geom_surface_perimeter_as_polycurve_1);
//Estribo 2
geom_surface_coo_sys_2 = Autodesk.Surface.CoordinateSystemAtParameter(geom_surface_offset, 0, 0.3657);
geom_surface_cut_plane_2 = CoordinateSystem.ZXPlane(geom_surface_coo_sys_2);
geom_surface_split_2 = Autodesk.Geometry.Split(geom_surface_offset, geom_surface_cut_plane_2);
geom_surface_2 = DSCore.List.GetItemAtIndex(geom_surface_split_2@L2<1>, 0);
geom_surface_perimeter_2 = Autodesk.Surface.PerimeterCurves(geom_surface_2);
geom_surface_perimeter_as_polycurve_2 = PolyCurve.ByJoinedCurves(geom_surface_perimeter_2);
geom_surface_perimeter_curves_2 = Autodesk.Geometry.Explode(geom_surface_perimeter_as_polycurve_2);
//Estribo 3
geom_surface_coo_sys_3_A = Autodesk.Surface.CoordinateSystemAtParameter(geom_surface_offset, 0, 0.1885);
geom_surface_coo_sys_3_B = Autodesk.Surface.CoordinateSystemAtParameter(geom_surface_offset, 0, 0.8115);
geom_surface_cut_plane_3_A = CoordinateSystem.ZXPlane(geom_surface_coo_sys_3_A);
geom_surface_cut_plane_3_B = CoordinateSystem.ZXPlane(geom_surface_coo_sys_3_B);
geom_surface_intersect_3_A = Autodesk.Geometry.Intersect(geom_surface_offset, geom_surface_cut_plane_3_A);
geom_surface_intersect_3_B = Autodesk.Geometry.Intersect(geom_surface_offset, geom_surface_cut_plane_3_B);
geom_surface_transpose = DSCore.List.Flatten(DSCore.List.Transpose([geom_surface_intersect_3_A, geom_surface_intersect_3_B])@L3<1>, -1);
geom_surface_3 = Autodesk.Surface.ByLoft(geom_surface_transpose@L2<1>);
geom_surface_perimeter_curves_3 = Autodesk.Surface.PerimeterCurves(geom_surface_3);


//Estribos 1
tag_location = g_solid_centroid;
//curves
geom_surface_perimeter_curves_1;
//rebarStyle
"StirrupTie";
//rebarBarType
tipo_barra_extremos;
//startHookType
hook;
//endHookType
hook;
//startHookOrientation
"Right";
//endtHookOrientation
"Right";
//hostElement
structural_framing_hormigon_lst;
//vector
structural_framing_hormigon_lst_vector;
//spacing
espaciamiento_extremos;
//ArrayLength
elem_curve_vector_len;
//Punto para posicionar tag
tag_location;










//Estribos 2
tag_location;
//curves
geom_surface_perimeter_curves_2;
//rebarStyle
"StirrupTie";
//rebarBarType
tipo_barra_extremos;
//startHookType
hook;
//endHookType
hook;
//startHookOrientation
"Left";
//endtHookOrientation
"Left";
//hostElement
structural_framing_hormigon_lst;
//vector
structural_framing_hormigon_lst_vector;
//spacing
espaciamiento_extremos;
//ArrayLength
elem_curve_vector_len;











//Estribos 2
//curves
geom_surface_perimeter_curves_3;
//rebarStyle
"StirrupTie";
//rebarBarType
tipo_barra_extremos;
//startHookType
hook;
//endHookType
hook;
//startHookOrientation
"Left";
//endtHookOrientation
"Left";
//hostElement
structural_framing_hormigon_lst;
//vector
structural_framing_hormigon_lst_vector;
//spacing
espaciamiento_extremos;
//ArrayLength
elem_curve_vector_len;

//
# ----------------------------------------
fromCurves_10 = StructuralDesign.Rebar.Create.FromCurves(curves=code_block_32.out108, rebarStyle=code_block_32.out109, rebarBarType=code_block_32.out110, startHookType=code_block_32.out111, endHookType=code_block_32.out112, startHookOrientation=code_block_32.out113, endHookOrientation=code_block_32.out114, hostElement=code_block_32.out115, vector=code_block_32.out116)  # frozen
setLayoutAsMaximumSpacing_10 = StructuralDesign.Rebar.Layout.SetLayoutAsMaximumSpacing(rebar=fromCurves_10, spacing=code_block_32.out117, arrayLength=code_block_32.out118, lacing=Longest)  # frozen
code_block_33 = CodeBlock { "FirstLast"; }  # frozen
setRebarPresentation_10 = Custom[SetRebarPresentation](rebarElements=setLayoutAsMaximumSpacing_10, rebarRepresentation=code_block_33)  # frozen
flatten_10 = List.Flatten(list=setRebarPresentation_10)  # frozen
code_block_34 = CodeBlock(element=flatten_10)  # frozen
# ---------- code_block_34.designscript (2 lines) ----------
//Asigna el tipo de estribo (sim, doble, etc...)
Revit.Elements.Element.SetParameterByName(element, "Estribo", "ET.");
# ----------------------------------------
o_document_activeview_14 = Orchid.RevitProject.Common.Document.ActiveView()  # frozen
fromCurves_11 = StructuralDesign.Rebar.Create.FromCurves(curves=code_block_32.out84, rebarStyle=code_block_32.out85, rebarBarType=code_block_32.out86, startHookType=code_block_32.out87, endHookType=code_block_32.out88, startHookOrientation=code_block_32.out89, endHookOrientation=code_block_32.out90, hostElement=code_block_32.out91, vector=code_block_32.out92)  # frozen
setLayoutAsMaximumSpacing_11 = StructuralDesign.Rebar.Layout.SetLayoutAsMaximumSpacing(rebar=fromCurves_11, spacing=code_block_32.out93, arrayLength=code_block_32.out94, lacing=Longest)  # frozen
code_block_35 = CodeBlock { "FirstLast"; }  # frozen
setRebarPresentation_11 = Custom[SetRebarPresentation](rebarElements=setLayoutAsMaximumSpacing_11, rebarRepresentation=code_block_35)  # frozen
flatten_11 = List.Flatten(list=setRebarPresentation_11)  # frozen
code_block_36 = CodeBlock(element=flatten_11, tag_location=code_block_32.out95)  # frozen
# ---------- code_block_36.designscript (19 lines) ----------
//Asigna el tipo de estribo (sim, doble, etc...)
Revit.Elements.Element.SetParameterByName(element, "Estribo", "ET.");
tag_location;

//element
element;
//TagLocation
tag_location;
//TagType
family = Revit.Family.ByName("EST_A_STRUCTURAL REBAR TAG_ESTRIBO");
tag_type = Revit.Elements.FamilyType.ByFamilyAndName(family, "R_E_00");
//horizontal
true;
//addLeader
false;
//LinkInstance
null;
//RunIt
true;
# ----------------------------------------
create_tag_8 = Custom[Create Tag](view=o_document_activeview_14@L1, element=code_block_36.out2@L2, TagLocation=code_block_36.out3@L2, TagType=code_block_36.out5@L1, horizontal=code_block_36.out6@L1, addLeader=code_block_36.out7@L1, LinkInstance=code_block_36.out8@L1, RunIt=code_block_36.out9@L1, lacing=Longest)
fromCurves_12 = StructuralDesign.Rebar.Create.FromCurves(curves=code_block_32.out97, rebarStyle=code_block_32.out98, rebarBarType=code_block_32.out99, startHookType=code_block_32.out100, endHookType=code_block_32.out101, startHookOrientation=code_block_32.out102, endHookOrientation=code_block_32.out103, hostElement=code_block_32.out104, vector=code_block_32.out105)  # frozen
setLayoutAsMaximumSpacing_12 = StructuralDesign.Rebar.Layout.SetLayoutAsMaximumSpacing(rebar=fromCurves_12, spacing=code_block_32.out106, arrayLength=code_block_32.out107, lacing=Longest)  # frozen
code_block_37 = CodeBlock { "FirstLast"; }  # frozen
setRebarPresentation_12 = Custom[SetRebarPresentation](rebarElements=setLayoutAsMaximumSpacing_12, rebarRepresentation=code_block_37)  # frozen
flatten_12 = List.Flatten(list=setRebarPresentation_12)  # frozen
code_block_38 = CodeBlock(element=flatten_12)  # frozen; same code as code_block_34

# group: 7 Barras
o_document_activeview_15 = Orchid.RevitProject.Common.Document.ActiveView()  # frozen
element_types_ᶜᵒⁿᵛᵉʳᵗᵉᵈ_ᵈʳᵒᵖᵈᵒʷⁿ_8 = CodeBlock { DSCore.Types.FindTypeByNameInAssembly("RebarHookType", "RevitAPI"); }  # frozen
all_elements_of_type_8 = ElementsOfType(element_type=element_types_ᶜᵒⁿᵛᵉʳᵗᵉᵈ_ᵈʳᵒᵖᵈᵒʷⁿ_8)
o_document_activeview_16 = Orchid.RevitProject.Common.Document.ActiveView()  # frozen
plane_7 = Custom[View.Plane](view=o_document_activeview_16)  # frozen
code_block_39 = CodeBlock(x=code_block_8.out1, pata=all_elements_of_type_8, view_plane=plane_7)  # frozen
# ---------- code_block_39.designscript (216 lines) ----------
elementos = x[0];
tipo_barra_extremos = x[1];
espaciamiento_extremos = x[2];
pata;
pata_names = Revit.Elements.Element.Name(pata);
mask = pata_names == "Stirrup/Tie - 135 deg.";
hook = DSCore.List.FilterByBoolMask(pata, mask)["in"][0];

//Obtener la cantidad de barras para definir cuantos estribos utilizar
rebar_cat = Revit.Category.ByName("Structural Rebar");
str_framing_rebars = Rhythm.Elements.DependentElementsOfCategory(elementos, rebar_cat);
str_framing_rebars_shapes = Revit.Elements.Element.GetParameterValueByName(str_framing_rebars, "Shape");
str_framing_rebars_shapes_names = Revit.Elements.Element.Name(str_framing_rebars_shapes);
str_framing_rebars_mask = DSCore.String.Contains(str_framing_rebars_shapes_names, "R_S_", false);
str_framing_rebars_R_S_ = DSCore.List.GetItemAtIndex(DSCore.List.FilterByBoolMask(str_framing_rebars, str_framing_rebars_mask)["in"]@L2<1>, 0);
str_framing_rebars_quantities = Revit.Elements.Element.GetParameterValueByName(str_framing_rebars_R_S_, "Quantity");

//filtro de elementos en funcion de la cantidad de barras
elementos_mask = str_framing_rebars_quantities == 7;
elem = DSCore.List.FilterByBoolMask(elementos, elementos_mask)["in"];

//Normal plano vista actual
view_plane_normal = Autodesk.Plane.Normal(view_plane);

//Variables para filtrar elementos por categoria
elem_category = Revit.Elements.Element.GetCategory(elem);
elem_category_name = Revit.Category.Name(elem_category);

//Filtrar vigas de hormigon paralelos a la vista actual
structural_framing_mask = elem_category_name == "Structural Framing";
structural_framing = DSCore.List.FilterByBoolMask(elem, structural_framing_mask)["in"];
structural_framing_material = DSCore.List.Flatten(Revit.Elements.Element.GetMaterials(structural_framing, false));
structural_framing_material_name = Revit.Material.Name(structural_framing_material);
structural_framing_material_mask = structural_framing_material_name == "Concrete, Cast-in-Place gray";
structural_framing_hormigon = DSCore.List.FilterByBoolMask(structural_framing, structural_framing_material_mask)["in"];
structural_framing_hormigon_location = Revit.Elements.Element.GetLocation(structural_framing_hormigon);
structural_framing_hormigon_vector = Line.Direction(structural_framing_hormigon_location);
structural_framing_hormigon_centroid = Autodesk.Solid.Centroid(DSCore.List.Flatten(Revit.Elements.Element.Geometry(structural_framing_hormigon)));
structural_framing_hormigon_coo_sys = Autodesk.Curve.CoordinateSystemAtParameter(structural_framing_hormigon_location);
structural_framing_hormigon_vector_mask = Autodesk.Vector.IsParallel(CoordinateSystem.XAxis(structural_framing_hormigon_coo_sys), view_plane_normal);
structural_framing_hormigon_lst = DSCore.List.FilterByBoolMask(structural_framing_hormigon, structural_framing_hormigon_vector_mask)["in"];
structural_framing_hormigon_lst_location = Revit.Elements.Element.GetLocation(structural_framing_hormigon_lst);
structural_framing_hormigon_lst_cut_len = Revit.Elements.Element.GetParameterValueByName(structural_framing_hormigon_lst, "Cut Length");
structural_framing_hormigon_lst_location_len = Autodesk.Curve.Length(structural_framing_hormigon_lst_location);
structural_framing_hormigon_lst_location_start_p = Autodesk.Curve.StartPoint(structural_framing_hormigon_lst_location);
structural_framing_hormigon_lst_location_end_p = Autodesk.Curve.EndPoint(structural_framing_hormigon_lst_location);
structural_framing_hormigon_lst_vector = Autodesk.Vector.ByTwoPoints(structural_framing_hormigon_lst_location_start_p, structural_framing_hormigon_lst_location_end_p);
structural_framing_hormigon_lst_vector_len = Autodesk.Vector.Length(structural_framing_hormigon_lst_vector);

//Altura de Vigas seleccionadas
elem_altura = Revit.Elements.Element.GetParameterValueByName(Revit.Elements.Element.GetParameterValueByName(elem, "Type"), "Height");

//Curva de las Vigas
elem_curve_inicial = Revit.Elements.Element.GetLocation(structural_framing_hormigon_lst);
elem_curve_inicial_len = DesignScript.Curve.Length(elem_curve_inicial);
dif_len = DSCore.Math.Abs(structural_framing_hormigon_lst_cut_len - structural_framing_hormigon_lst_location_len) / 2;
x_1 = Autodesk.Curve.ExtendEnd(Autodesk.Curve.ExtendStart(structural_framing_hormigon_lst_location, (dif_len + 50) * -1), (dif_len + 50) * -1);
x_2 = Autodesk.Curve.ExtendEnd(Autodesk.Curve.ExtendStart(structural_framing_hormigon_lst_location, (dif_len + 50) * -1), (dif_len + 50) * -1);

elem_curve = [Imperative]
{
	if(structural_framing_hormigon_lst_location_len >= structural_framing_hormigon_lst_cut_len)
	{
		return  x_1;
	}
	else
	{
		return  x_2;
	}
};
elem_curve_start_p = Autodesk.Curve.StartPoint(elem_curve);
elem_curve_end_p = Autodesk.Curve.EndPoint(elem_curve);
elem_curve_vector = Autodesk.Vector.ByTwoPoints(elem_curve_start_p, elem_curve_end_p);
elem_curve_vector_len = Autodesk.Vector.Length(elem_curve_vector);

//Geometria a Cortar
g_elem_solid = DSCore.List.Flatten(Revit.Elements.Element.Geometry(structural_framing_hormigon_lst));
g_solid_centroid = Autodesk.Solid.Centroid(g_elem_solid);
g_solid_coo_sys = Autodesk.Curve.CoordinateSystemAtParameter(structural_framing_hormigon_lst_location, 0.5);
g_solid_plane = CoordinateSystem.YZPlane(g_solid_coo_sys);
g_solid_scaled = Autodesk.Geometry.Scale(g_elem_solid, g_solid_plane, 5, 1, 1);

//Geometria Estribo
geom_param_at_point = DesignScript.Curve.ParameterAtPoint(elem_curve, elem_curve_start_p);
geom_plane_at_param = DesignScript.Curve.PlaneAtParameter(elem_curve, geom_param_at_point);
geom_surface = DSCore.List.Flatten(Autodesk.Geometry.Intersect(g_solid_scaled, geom_plane_at_param), -1);
geom_surface_perimeter = Autodesk.Surface.PerimeterCurves(geom_surface);
geom_surface_perimeter_as_polycurve = PolyCurve.Offset(PolyCurve.ByJoinedCurves(geom_surface_perimeter), -25, false);
geom_surface_offset = Autodesk.Surface.ByPatch(geom_surface_perimeter_as_polycurve);
//Estribo 1
geom_surface_coo_sys_1 = Autodesk.Surface.CoordinateSystemAtParameter(geom_surface_offset, 0, 0.69333);
geom_surface_cut_plane_1 = CoordinateSystem.ZXPlane(geom_surface_coo_sys_1);
geom_surface_split_1 = Autodesk.Geometry.Split(geom_surface_offset, geom_surface_cut_plane_1);
geom_surface_1 = DSCore.List.GetItemAtIndex(geom_surface_split_1@L2<1>, 1);
geom_surface_perimeter_1 = Autodesk.Surface.PerimeterCurves(geom_surface_1);
geom_surface_perimeter_as_polycurve_1 = PolyCurve.ByJoinedCurves(geom_surface_perimeter_1);
geom_surface_perimeter_curves_1 = Autodesk.Geometry.Explode(geom_surface_perimeter_as_polycurve_1);
//Estribo 2
geom_surface_coo_sys_2 = Autodesk.Surface.CoordinateSystemAtParameter(geom_surface_offset, 0, 0.30667);
geom_surface_cut_plane_2 = CoordinateSystem.ZXPlane(geom_surface_coo_sys_2);
geom_surface_split_2 = Autodesk.Geometry.Split(geom_surface_offset, geom_surface_cut_plane_2);
geom_surface_2 = DSCore.List.GetItemAtIndex(geom_surface_split_2@L2<1>, 0);
geom_surface_perimeter_2 = Autodesk.Surface.PerimeterCurves(geom_surface_2);
geom_surface_perimeter_as_polycurve_2 = PolyCurve.ByJoinedCurves(geom_surface_perimeter_2);
geom_surface_perimeter_curves_2 = Autodesk.Geometry.Explode(geom_surface_perimeter_as_polycurve_2);
//Estribo 3
geom_surface_coo_sys_3_A = Autodesk.Surface.CoordinateSystemAtParameter(geom_surface_offset, 0, 0.15905);
geom_surface_coo_sys_3_B = Autodesk.Surface.CoordinateSystemAtParameter(geom_surface_offset, 0, 0.84095);
geom_surface_cut_plane_3_A = CoordinateSystem.ZXPlane(geom_surface_coo_sys_3_A);
geom_surface_cut_plane_3_B = CoordinateSystem.ZXPlane(geom_surface_coo_sys_3_B);
geom_surface_intersect_3_A = Autodesk.Geometry.Intersect(geom_surface_offset, geom_surface_cut_plane_3_A);
geom_surface_intersect_3_B = Autodesk.Geometry.Intersect(geom_surface_offset, geom_surface_cut_plane_3_B);
geom_surface_transpose = DSCore.List.Flatten(DSCore.List.Transpose([geom_surface_intersect_3_A, geom_surface_intersect_3_B])@L3<1>, -1);
geom_surface_3 = Autodesk.Surface.ByLoft(geom_surface_transpose@L2<1>);
geom_surface_perimeter_curves_3 = Autodesk.Surface.PerimeterCurves(geom_surface_3);
//Traba
geom_surface_coo_sys_3 = Autodesk.Surface.CoordinateSystemAtParameter(geom_surface_offset, 0, 0.454257);
geom_surface_cut_plane_3 = CoordinateSystem.ZXPlane(geom_surface_coo_sys_3);
geom_surface_intersect_3 = Autodesk.Geometry.Intersect(geom_surface_offset, geom_surface_cut_plane_3);

//Estribos 1
tag_location = g_solid_centroid;
//curves
geom_surface_perimeter_curves_1;
//rebarStyle
"StirrupTie";
//rebarBarType
tipo_barra_extremos;
//startHookType
hook;
//endHookType
hook;
//startHookOrientation
"Right";
//endtHookOrientation
"Right";
//hostElement
structural_framing_hormigon_lst;
//vector
structural_framing_hormigon_lst_vector;
//spacing
espaciamiento_extremos;
//ArrayLength
elem_curve_vector_len;
//Punto para posicionar tag
tag_location;










//Estribos 2
tag_location;
//curves
geom_surface_perimeter_curves_2;
//rebarStyle
"StirrupTie";
//rebarBarType
tipo_barra_extremos;
//startHookType
hook;
//endHookType
hook;
//startHookOrientation
"Left";
//endtHookOrientation
"Left";
//hostElement
structural_framing_hormigon_lst;
//vector
structural_framing_hormigon_lst_vector;
//spacing
espaciamiento_extremos;
//ArrayLength
elem_curve_vector_len;











//Estribos 3
//curves
geom_surface_perimeter_curves_3;
//rebarStyle
"StirrupTie";
//rebarBarType
tipo_barra_extremos;
//startHookType
hook;
//endHookType
hook;
//startHookOrientation
"Left";
//endtHookOrientation
"Left";
//hostElement
structural_framing_hormigon_lst;
//vector
structural_framing_hormigon_lst_vector;
//spacing
espaciamiento_extremos;
//ArrayLength
elem_curve_vector_len;

//
# ----------------------------------------
fromCurves_13 = StructuralDesign.Rebar.Create.FromCurves(curves=code_block_39.out87, rebarStyle=code_block_39.out88, rebarBarType=code_block_39.out89, startHookType=code_block_39.out90, endHookType=code_block_39.out91, startHookOrientation=code_block_39.out92, endHookOrientation=code_block_39.out93, hostElement=code_block_39.out94, vector=code_block_39.out95)  # frozen
setLayoutAsMaximumSpacing_13 = StructuralDesign.Rebar.Layout.SetLayoutAsMaximumSpacing(rebar=fromCurves_13, spacing=code_block_39.out96, arrayLength=code_block_39.out97, lacing=Longest)  # frozen
code_block_40 = CodeBlock { "FirstLast"; }  # frozen
setRebarPresentation_13 = Custom[SetRebarPresentation](rebarElements=setLayoutAsMaximumSpacing_13, rebarRepresentation=code_block_40)  # frozen
flatten_13 = List.Flatten(list=setRebarPresentation_13)
code_block_41 = CodeBlock(element=flatten_13, tag_location=code_block_39.out98)  # frozen; same code as code_block_36
create_tag_9 = Custom[Create Tag](view=o_document_activeview_15@L1, element=code_block_41.out2@L2, TagLocation=code_block_41.out3@L2, TagType=code_block_41.out5@L1, horizontal=code_block_41.out6@L1, addLeader=code_block_41.out7@L1, LinkInstance=code_block_41.out8@L1, RunIt=code_block_41.out9@L1, lacing=Longest)
fromCurves_14 = StructuralDesign.Rebar.Create.FromCurves(curves=code_block_39.out100, rebarStyle=code_block_39.out101, rebarBarType=code_block_39.out102, startHookType=code_block_39.out103, endHookType=code_block_39.out104, startHookOrientation=code_block_39.out105, endHookOrientation=code_block_39.out106, hostElement=code_block_39.out107, vector=code_block_39.out108)  # frozen
setLayoutAsMaximumSpacing_14 = StructuralDesign.Rebar.Layout.SetLayoutAsMaximumSpacing(rebar=fromCurves_14, spacing=code_block_39.out109, arrayLength=code_block_39.out110, lacing=Longest)  # frozen
code_block_42 = CodeBlock { "FirstLast"; }  # frozen
setRebarPresentation_14 = Custom[SetRebarPresentation](rebarElements=setLayoutAsMaximumSpacing_14, rebarRepresentation=code_block_42)  # frozen
flatten_14 = List.Flatten(list=setRebarPresentation_14)  # frozen
code_block_43 = CodeBlock(element=flatten_14)  # frozen; same code as code_block_34
fromCurves_15 = StructuralDesign.Rebar.Create.FromCurves(curves=code_block_39.out111, rebarStyle=code_block_39.out112, rebarBarType=code_block_39.out113, startHookType=code_block_39.out114, endHookType=code_block_39.out115, startHookOrientation=code_block_39.out116, endHookOrientation=code_block_39.out117, hostElement=code_block_39.out118, vector=code_block_39.out119)  # frozen
setLayoutAsMaximumSpacing_15 = StructuralDesign.Rebar.Layout.SetLayoutAsMaximumSpacing(rebar=fromCurves_15, spacing=code_block_39.out120, arrayLength=code_block_39.out121, lacing=Longest)  # frozen
code_block_44 = CodeBlock { "FirstLast"; }  # frozen
setRebarPresentation_15 = Custom[SetRebarPresentation](rebarElements=setLayoutAsMaximumSpacing_15, rebarRepresentation=code_block_44)  # frozen
flatten_15 = List.Flatten(list=setRebarPresentation_15)  # frozen
code_block_45 = CodeBlock(element=flatten_15)  # frozen; same code as code_block_34

# group: 2 Barras
o_document_activeview_17 = Orchid.RevitProject.Common.Document.ActiveView()  # frozen
element_types_ᶜᵒⁿᵛᵉʳᵗᵉᵈ_ᵈʳᵒᵖᵈᵒʷⁿ_9 = CodeBlock { DSCore.Types.FindTypeByNameInAssembly("RebarHookType", "RevitAPI"); }  # frozen
all_elements_of_type_9 = ElementsOfType(element_type=element_types_ᶜᵒⁿᵛᵉʳᵗᵉᵈ_ᵈʳᵒᵖᵈᵒʷⁿ_9)
o_document_activeview_18 = Orchid.RevitProject.Common.Document.ActiveView()  # frozen
plane_8 = Custom[View.Plane](view=o_document_activeview_18)  # frozen
code_block_46 = CodeBlock(x=code_block_8.out1, pata=all_elements_of_type_9, view_plane=plane_8)
# ---------- code_block_46.designscript (120 lines) ----------
elementos = x[0];
tipo_barra_extremos = x[1];
espaciamiento_extremos = x[2];
pata;
pata_names = Revit.Elements.Element.Name(pata);
mask = pata_names == "Stirrup/Tie - 135 deg.";
hook = DSCore.List.FilterByBoolMask(pata, mask)["in"][0];

//Obtener la cantidad de barras para definir cuantos estribos utilizar
rebar_cat = Revit.Category.ByName("Structural Rebar");
str_framing_rebars = Rhythm.Elements.DependentElementsOfCategory(elementos, rebar_cat);
str_framing_rebars_shapes = Revit.Elements.Element.GetParameterValueByName(str_framing_rebars, "Shape");
str_framing_rebars_shapes_names = Revit.Elements.Element.Name(str_framing_rebars_shapes);
str_framing_rebars_mask = DSCore.String.Contains(str_framing_rebars_shapes_names, "R_S_", false);
str_framing_rebars_R_S_ = DSCore.List.GetItemAtIndex(DSCore.List.FilterByBoolMask(str_framing_rebars, str_framing_rebars_mask)["in"]@L2<1>, 0);
str_framing_rebars_quantities = Revit.Elements.Element.GetParameterValueByName(str_framing_rebars_R_S_, "Quantity");

//filtro de elementos en funcion de la cantidad de barras
elementos_mask = str_framing_rebars_quantities == 2;
elem = DSCore.List.FilterByBoolMask(elementos, elementos_mask)["in"];


//Normal plano vista actual
view_plane_normal = Autodesk.Plane.Normal(view_plane);

//Variables para filtrar elementos por categoria
elem_category = Revit.Elements.Element.GetCategory(elem);
elem_category_name = Revit.Category.Name(elem_category);

//Filtrar vigas de hormigon paralelos a la vista actual
structural_framing_mask = elem_category_name == "Structural Framing";
structural_framing = DSCore.List.FilterByBoolMask(elem, structural_framing_mask)["in"];
structural_framing_material = DSCore.List.Flatten(Revit.Elements.Element.GetMaterials(structural_framing, false));
structural_framing_material_name = Revit.Material.Name(structural_framing_material);
structural_framing_material_mask = structural_framing_material_name == "Concrete, Cast-in-Place gray";
structural_framing_hormigon = DSCore.List.FilterByBoolMask(structural_framing, structural_framing_material_mask)["in"];
structural_framing_hormigon_location = Revit.Elements.Element.GetLocation(structural_framing_hormigon);
structural_framing_hormigon_vector = Line.Direction(structural_framing_hormigon_location);
structural_framing_hormigon_centroid = Autodesk.Solid.Centroid(DSCore.List.Flatten(Revit.Elements.Element.Geometry(structural_framing_hormigon)));
structural_framing_hormigon_coo_sys = Autodesk.Curve.CoordinateSystemAtParameter(structural_framing_hormigon_location);
structural_framing_hormigon_vector_mask = Autodesk.Vector.IsParallel(CoordinateSystem.XAxis(structural_framing_hormigon_coo_sys), view_plane_normal);
structural_framing_hormigon_lst = DSCore.List.FilterByBoolMask(structural_framing_hormigon, structural_framing_hormigon_vector_mask)["in"];
structural_framing_hormigon_lst_location = Revit.Elements.Element.GetLocation(structural_framing_hormigon_lst);
structural_framing_hormigon_lst_cut_len = Revit.Elements.Element.GetParameterValueByName(structural_framing_hormigon_lst, "Cut Length");
structural_framing_hormigon_lst_location_len = Autodesk.Curve.Length(structural_framing_hormigon_lst_location);
structural_framing_hormigon_lst_location_start_p = Autodesk.Curve.StartPoint(structural_framing_hormigon_lst_location);
structural_framing_hormigon_lst_location_end_p = Autodesk.Curve.EndPoint(structural_framing_hormigon_lst_location);
structural_framing_hormigon_lst_vector = Autodesk.Vector.ByTwoPoints(structural_framing_hormigon_lst_location_start_p, structural_framing_hormigon_lst_location_end_p);
structural_framing_hormigon_lst_vector_len = Autodesk.Vector.Length(structural_framing_hormigon_lst_vector);

//Altura de Vigas seleccionadas
elem_altura = Revit.Elements.Element.GetParameterValueByName(Revit.Elements.Element.GetParameterValueByName(elem, "Type"), "Height");

//Curva de las Vigas
elem_curve_inicial = Revit.Elements.Element.GetLocation(structural_framing_hormigon_lst);
elem_curve_inicial_len = DesignScript.Curve.Length(elem_curve_inicial);
dif_len = DSCore.Math.Abs(structural_framing_hormigon_lst_cut_len - structural_framing_hormigon_lst_location_len) / 2;
x_1 = Autodesk.Curve.ExtendEnd(Autodesk.Curve.ExtendStart(structural_framing_hormigon_lst_location, (dif_len + 50) * -1), (dif_len + 50) * -1);
x_2 = Autodesk.Curve.ExtendEnd(Autodesk.Curve.ExtendStart(structural_framing_hormigon_lst_location, (dif_len + 50) * -1), (dif_len + 50) * -1);

elem_curve = [Imperative]
{
	if(structural_framing_hormigon_lst_location_len >= structural_framing_hormigon_lst_cut_len)
	{
		return  x_1;
	}
	else
	{
		return  x_2;
	}
};
elem_curve_start_p = Autodesk.Curve.StartPoint(elem_curve);
elem_curve_end_p = Autodesk.Curve.EndPoint(elem_curve);
elem_curve_vector = Autodesk.Vector.ByTwoPoints(elem_curve_start_p, elem_curve_end_p);
elem_curve_vector_len = Autodesk.Vector.Length(elem_curve_vector);

//Geometria a Cortar
g_elem_solid = DSCore.List.Flatten(Revit.Elements.Element.Geometry(structural_framing_hormigon_lst));
g_solid_centroid = Autodesk.Solid.Centroid(g_elem_solid);
g_solid_coo_sys = Autodesk.Curve.CoordinateSystemAtParameter(structural_framing_hormigon_lst_location, 0.5);
g_solid_plane = CoordinateSystem.YZPlane(g_solid_coo_sys);
g_solid_scaled = Autodesk.Geometry.Scale(g_elem_solid, g_solid_plane, 5, 1, 1);

//Geometria Estribo
geom_param_at_point = DesignScript.Curve.ParameterAtPoint(elem_curve, elem_curve_start_p);
geom_plane_at_param = DesignScript.Curve.PlaneAtParameter(elem_curve, geom_param_at_point);
geom_surface = DSCore.List.Flatten(Autodesk.Geometry.Intersect(g_solid_scaled, geom_plane_at_param), -1);
geom_surface_perimeter = Autodesk.Surface.PerimeterCurves(geom_surface);
geom_surface_perimeter_as_polycurve = PolyCurve.ByJoinedCurves(geom_surface_perimeter);
geom_surface_perimeter_curves = Autodesk.Geometry.Explode(PolyCurve.Offset(geom_surface_perimeter_as_polycurve, -25, false));

//Estribos Extermos
tag_location = g_solid_centroid;
//curves
geom_surface_perimeter_curves;
//rebarStyle
"StirrupTie";
//rebarBarType
tipo_barra_extremos;
//startHookType
hook;
//endHookType
hook;
//startHookOrientation
"Left";
//endtHookOrientation
"Left";
//hostElement
structural_framing_hormigon_lst;
//vector
structural_framing_hormigon_lst_vector;
//spacing
espaciamiento_extremos;
//ArrayLength
elem_curve_vector_len;
//Punto para posicionar tag
tag_location;


//
# ----------------------------------------
fromCurves_16 = StructuralDesign.Rebar.Create.FromCurves(curves=code_block_46.out61, rebarStyle=code_block_46.out62, rebarBarType=code_block_46.out63, startHookType=code_block_46.out64, endHookType=code_block_46.out65, startHookOrientation=code_block_46.out66, endHookOrientation=code_block_46.out67, hostElement=code_block_46.out68, vector=code_block_46.out69)
setLayoutAsMaximumSpacing_16 = StructuralDesign.Rebar.Layout.SetLayoutAsMaximumSpacing(rebar=fromCurves_16, spacing=code_block_46.out70, arrayLength=code_block_46.out71, lacing=Longest)  # frozen
code_block_47 = CodeBlock { "FirstLast"; }  # frozen
setRebarPresentation_16 = Custom[SetRebarPresentation](rebarElements=setLayoutAsMaximumSpacing_16, rebarRepresentation=code_block_47)
flatten_16 = List.Flatten(list=setRebarPresentation_16)
code_block_48 = CodeBlock(element=flatten_16, tag_location=code_block_46.out72)  # frozen; same code as code_block_21
create_tag_10 = Custom[Create Tag](view=o_document_activeview_17@L1, element=code_block_48.out2@L2, TagLocation=code_block_48.out3@L2, TagType=code_block_48.out5@L1, horizontal=code_block_48.out6@L1, addLeader=code_block_48.out7@L1, LinkInstance=code_block_48.out8@L1, RunIt=code_block_48.out9@L1, lacing=Longest)

o_document_activeview_19 = Orchid.RevitProject.Common.Document.ActiveView()
element_types_ᶜᵒⁿᵛᵉʳᵗᵉᵈ_ᵈʳᵒᵖᵈᵒʷⁿ_10 = CodeBlock { DSCore.Types.FindTypeByNameInAssembly("RebarHookType", "RevitAPI"); }
all_elements_of_type_10 = ElementsOfType(element_type=element_types_ᶜᵒⁿᵛᵉʳᵗᵉᵈ_ᵈʳᵒᵖᵈᵒʷⁿ_10)
o_document_activeview_20 = Orchid.RevitProject.Common.Document.ActiveView()
plane_9 = Custom[View.Plane](view=o_document_activeview_20)
code_block_49 = CodeBlock(x=code_block_8.out1, pata=all_elements_of_type_10, view_plane=plane_9)
# ---------- code_block_49.designscript (370 lines) ----------
elementos = x[0];
tipo_barra_extremos = x[1];
espaciamiento_extremos = x[2];
tipo_barra_centrales = x[3];
espaciamiento_centrales = x[4];
pata;
pata_names = Revit.Elements.Element.Name(pata);
mask = pata_names == "Stirrup/Tie - 135 deg.";
hook = DSCore.List.FilterByBoolMask(pata, mask)["in"][0];

//Obtener la cantidad de barras para definir cuantos estribos utilizar
rebar_cat = Revit.Category.ByName("Structural Rebar");
str_framing_rebars = Rhythm.Elements.DependentElementsOfCategory(elementos, rebar_cat);
str_framing_rebars_shapes = Revit.Elements.Element.GetParameterValueByName(str_framing_rebars, "Shape");
str_framing_rebars_shapes_names = Revit.Elements.Element.Name(str_framing_rebars_shapes);
str_framing_rebars_mask = DSCore.String.Contains(str_framing_rebars_shapes_names, "R_S_", false);
str_framing_rebars_R_S_ = DSCore.List.GetItemAtIndex(DSCore.List.FilterByBoolMask(str_framing_rebars, str_framing_rebars_mask)["in"]@L2<1>, 0);
str_framing_rebars_quantities = Revit.Elements.Element.GetParameterValueByName(str_framing_rebars_R_S_, "Quantity");

//filtro de elementos en funcion de la cantidad de barras
elementos_mask = str_framing_rebars_quantities == 4;
elem = DSCore.List.FilterByBoolMask(elementos, elementos_mask)["in"];

//Normal plano vista actual
view_plane_normal = Autodesk.Plane.Normal(view_plane);

//Variables para filtrar elementos por categoria
elem_category = Revit.Elements.Element.GetCategory(elem);
elem_category_name = Revit.Category.Name(elem_category);

//Filtrar vigas de hormigon paralelos a la vista actual
structural_framing_mask = elem_category_name == "Structural Framing";
structural_framing = DSCore.List.FilterByBoolMask(elem, structural_framing_mask)["in"];
structural_framing_material = DSCore.List.Flatten(Revit.Elements.Element.GetMaterials(structural_framing, false));
structural_framing_material_name = Revit.Material.Name(structural_framing_material);
structural_framing_material_mask = structural_framing_material_name == "Concrete, Cast-in-Place gray";
structural_framing_hormigon = DSCore.List.FilterByBoolMask(structural_framing, structural_framing_material_mask)["in"];
structural_framing_hormigon_location = Revit.Elements.Element.GetLocation(structural_framing_hormigon);
structural_framing_hormigon_vector = Line.Direction(structural_framing_hormigon_location);
structural_framing_hormigon_centroid = Autodesk.Solid.Centroid(DSCore.List.Flatten(Revit.Elements.Element.Geometry(structural_framing_hormigon)));
structural_framing_hormigon_coo_sys = Autodesk.Curve.CoordinateSystemAtParameter(structural_framing_hormigon_location);
structural_framing_hormigon_vector_mask = Autodesk.Vector.IsParallel(CoordinateSystem.XAxis(structural_framing_hormigon_coo_sys), view_plane_normal);
structural_framing_hormigon_lst = DSCore.List.FilterByBoolMask(structural_framing_hormigon, structural_framing_hormigon_vector_mask)["in"];
structural_framing_hormigon_lst_location = Revit.Elements.Element.GetLocation(structural_framing_hormigon_lst);
structural_framing_hormigon_lst_cut_len = Revit.Elements.Element.GetParameterValueByName(structural_framing_hormigon_lst, "Cut Length");
structural_framing_hormigon_lst_location_len = Autodesk.Curve.Length(structural_framing_hormigon_lst_location);
structural_framing_hormigon_lst_location_start_p = Autodesk.Curve.StartPoint(structural_framing_hormigon_lst_location);
structural_framing_hormigon_lst_location_end_p = Autodesk.Curve.EndPoint(structural_framing_hormigon_lst_location);
structural_framing_hormigon_lst_vector = Autodesk.Vector.ByTwoPoints(structural_framing_hormigon_lst_location_start_p, structural_framing_hormigon_lst_location_end_p);
structural_framing_hormigon_lst_vector_len = Autodesk.Vector.Length(structural_framing_hormigon_lst_vector);

//Altura de Vigas seleccionadas
elem_altura = Revit.Elements.Element.GetParameterValueByName(Revit.Elements.Element.GetParameterValueByName(elem, "Type"), "Height");

//Curva de las Vigas
elem_curve_inicial = Revit.Elements.Element.GetLocation(structural_framing_hormigon_lst);
elem_curve_inicial_len = DesignScript.Curve.Length(elem_curve_inicial);
dif_len = DSCore.Math.Abs(structural_framing_hormigon_lst_cut_len - structural_framing_hormigon_lst_location_len) / 2;
x_1 = Autodesk.Curve.ExtendEnd(Autodesk.Curve.ExtendStart(structural_framing_hormigon_lst_location, (dif_len + 50) * -1), (dif_len + 50) * -1);
x_2 = Autodesk.Curve.ExtendEnd(Autodesk.Curve.ExtendStart(structural_framing_hormigon_lst_location, (dif_len + 50) * -1), (dif_len + 50) * -1);

elem_curve = [Imperative]
{
	if(structural_framing_hormigon_lst_location_len >= structural_framing_hormigon_lst_cut_len)
	{
		return  x_1;
	}
	else
	{
		return  x_2;
	}
};
elem_curve_start_p = Autodesk.Curve.StartPoint(elem_curve);
elem_curve_end_p = Autodesk.Curve.EndPoint(elem_curve);
elem_curve_vector = Autodesk.Vector.ByTwoPoints(elem_curve_start_p, elem_curve_end_p);
elem_curve_vector_len = Autodesk.Vector.Length(elem_curve_vector);

//Distancias division de Curva
dist_1 = elem_altura * 2;
dist_2 = elem_curve_inicial_len - (elem_altura * 2);
dist_lst = DSCore.List.Transpose(Maths.Round([dist_1, dist_2]));
param_lst = DesignScript.Curve.ParameterAtSegmentLength(elem_curve_inicial, dist_lst);

//Planos division de Curva
planes = DesignScript.Curve.PlaneAtSegmentLength(elem_curve_inicial, dist_lst);

//Curva dividida
curve_splitted = DesignScript.Curve.SplitByParameter(elem_curve, param_lst);
curve_splitted_start_point = DesignScript.Curve.StartPoint(curve_splitted);
curve_splitted_end_point = DesignScript.Curve.EndPoint(curve_splitted);
curve_splitted_vector = Autodesk.Vector.ByTwoPoints(curve_splitted_start_point, curve_splitted_end_point);

//Geometria a Cortar
g_elem_solid = DSCore.List.Flatten(Revit.Elements.Element.Geometry(structural_framing_hormigon_lst));
g_solid_centroid = Autodesk.Solid.Centroid(g_elem_solid);
g_solid_coo_sys = Autodesk.Curve.CoordinateSystemAtParameter(structural_framing_hormigon_lst_location, 0.5);
g_solid_plane = CoordinateSystem.YZPlane(g_solid_coo_sys);
g_solid_scaled = Autodesk.Geometry.Scale(g_elem_solid, g_solid_plane, 5, 1, 1);

//Geometria Estribo
geom_param_at_point = DesignScript.Curve.ParameterAtPoint(curve_splitted, curve_splitted_start_point);
geom_plane_at_param = DesignScript.Curve.PlaneAtParameter(curve_splitted, geom_param_at_point);
geom_surface = DSCore.List.Flatten(Autodesk.Geometry.Intersect(g_solid_scaled, geom_plane_at_param), -1);
geom_surface_perimeter = Autodesk.Surface.PerimeterCurves(geom_surface);
geom_surface_perimeter_as_polycurve = PolyCurve.Offset(PolyCurve.ByJoinedCurves(geom_surface_perimeter), -25, false);
geom_surface_offset = Autodesk.Surface.ByPatch(geom_surface_perimeter_as_polycurve);
//Estribo 1
geom_surface_coo_sys_1 = Autodesk.Surface.CoordinateSystemAtParameter(geom_surface_offset, 0, 0.6935);
geom_surface_cut_plane_1 = CoordinateSystem.ZXPlane(geom_surface_coo_sys_1);
geom_surface_split_1 = Autodesk.Geometry.Split(geom_surface_offset, geom_surface_cut_plane_1);
geom_surface_1 = DSCore.List.GetItemAtIndex(geom_surface_split_1@L2<1>, 1);
geom_surface_perimeter_1 = Autodesk.Surface.PerimeterCurves(geom_surface_1);
geom_surface_perimeter_as_polycurve_1 = PolyCurve.ByJoinedCurves(geom_surface_perimeter_1);
geom_surface_perimeter_curves_1 = Autodesk.Geometry.Explode(geom_surface_perimeter_as_polycurve_1);
//Estribo 2
geom_surface_coo_sys_2 = Autodesk.Surface.CoordinateSystemAtParameter(geom_surface_offset, 0, 0.3065);
geom_surface_cut_plane_2 = CoordinateSystem.ZXPlane(geom_surface_coo_sys_2);
geom_surface_split_2 = Autodesk.Geometry.Split(geom_surface_offset, geom_surface_cut_plane_2);
geom_surface_2 = DSCore.List.GetItemAtIndex(geom_surface_split_2@L2<1>, 0);
geom_surface_perimeter_2 = Autodesk.Surface.PerimeterCurves(geom_surface_2);
geom_surface_perimeter_as_polycurve_2 = PolyCurve.ByJoinedCurves(geom_surface_perimeter_2);
geom_surface_perimeter_curves_2 = Autodesk.Geometry.Explode(geom_surface_perimeter_as_polycurve_2);

plane_ajuste_etiqueta = CoordinateSystem.YZPlane(Autodesk.Plane.ToCoordinateSystem(Autodesk.Plane.ByOriginNormal(g_solid_centroid, view_plane_normal)));

//Estribos Extermos 1_a
estribos_extremos_1_a = DSCore.List.TakeEveryNthItem(geom_surface_perimeter_curves_1@L3<1>, 3, 0);
estribos_extremos_vector_1 = DSCore.List.GetItemAtIndex(curve_splitted_vector@@L2<1>, 0);
curve_splitted_len_extremos_1 = DSCore.List.GetItemAtIndex(Autodesk.Curve.Length(curve_splitted)@@L2<1>, 0);
tag_location_extremos_1 = DSCore.List.GetItemAtIndex(Autodesk.Curve.PointAtParameter(curve_splitted, 0.5)@@L2<1>, 2);
//curves
estribos_extremos_1_a;
//rebarStyle
"StirrupTie";
//rebarBarType
tipo_barra_extremos;
//startHookType
hook;
//endHookType
hook;
//startHookOrientation
"Right";
//endtHookOrientation
"Right";
//hostElement
elem;
//vector
estribos_extremos_vector_1;
//spacing
espaciamiento_extremos;
//ArrayLength
curve_splitted_len_extremos_1;
//Plano de ajuste etiquetas
plane_ajuste_etiqueta;
//Punto para posicionar tag
tag_location_extremos_1;










//Estribos Extermos 1_b
estribos_extremos_1_b = DSCore.List.TakeEveryNthItem(geom_surface_perimeter_curves_2@L3<1>, 3, 0);
estribos_extremos_vector_1;
curve_splitted_len_extremos_1;
tag_location_extremos_1;
//curves
estribos_extremos_1_b;
//rebarStyle
"StirrupTie";
//rebarBarType
tipo_barra_extremos;
//startHookType
hook;
//endHookType
hook;
//startHookOrientation
"Left";
//endtHookOrientation
"Left";
//hostElement
elem;
//vector
estribos_extremos_vector_1;
//spacing
espaciamiento_extremos;
//ArrayLength
curve_splitted_len_extremos_1;
//Plano de ajuste etiquetas
plane_ajuste_etiqueta;
//Punto para posicionar tag
tag_location_extremos_1;










//Estribos Extermos 2_a
estribos_extremos_2_a = DSCore.List.TakeEveryNthItem(geom_surface_perimeter_curves_1@L3<1>, 3, 1);
estribos_extremos_vector_2 = DSCore.List.GetItemAtIndex(curve_splitted_vector@@L2<1>, 2);
curve_splitted_len_extremos_2 = DSCore.List.GetItemAtIndex(Autodesk.Curve.Length(curve_splitted)@@L2<1>, 2);
tag_location_extremos_2 = DSCore.List.GetItemAtIndex(Autodesk.Curve.PointAtParameter(curve_splitted, 0.5)@@L2<1>, 0);
//curves
estribos_extremos_2_a;
//rebarStyle
"StirrupTie";
//rebarBarType
tipo_barra_extremos;
//startHookType
hook;
//endHookType
hook;
//startHookOrientation
"Right";
//endtHookOrientation
"Right";
//hostElement
elem;
//vector
estribos_extremos_vector_2;
//spacing
espaciamiento_extremos;
//ArrayLength
curve_splitted_len_extremos_2;
//Plano de ajuste etiquetas
plane_ajuste_etiqueta;
//Punto para posicionar tag
tag_location_extremos_2;










//Estribos Extermos 2_b
estribos_extremos_2_b = DSCore.List.TakeEveryNthItem(geom_surface_perimeter_curves_2@L3<1>, 3, 1);
estribos_extremos_vector_2;
curve_splitted_len_extremos_2;
tag_location_extremos_2;
//curves
estribos_extremos_2_b;
//rebarStyle
"StirrupTie";
//rebarBarType
tipo_barra_extremos;
//startHookType
hook;
//endHookType
hook;
//startHookOrientation
"Left";
//endtHookOrientation
"Left";
//hostElement
elem;
//vector
estribos_extremos_vector_2;
//spacing
espaciamiento_extremos;
//ArrayLength
curve_splitted_len_extremos_2;
//Plano de ajuste etiquetas
plane_ajuste_etiqueta;
//Punto para posicionar tag
tag_location_extremos_2;










//Estribos Centrales_a
estribos_centrales_a = DSCore.List.TakeEveryNthItem(geom_surface_perimeter_curves_1@L3<1>, 3, 2);
estribos_centrales_vector = DSCore.List.GetItemAtIndex(curve_splitted_vector@@L2<1>, 1);
curve_splitted_len_centrales = DSCore.List.GetItemAtIndex(Autodesk.Curve.Length(curve_splitted)@@L2<1>, 1);
tag_location_centrales = DSCore.List.GetItemAtIndex(Autodesk.Curve.PointAtParameter(curve_splitted, 0.5)@@L2<1>, 1);
//curves
estribos_centrales_a;
//rebarStyle
"StirrupTie";
//rebarBarType
tipo_barra_centrales;
//startHookType
hook;
//endHookType
hook;
//startHookOrientation
"Right";
//endtHookOrientation
"Right";
//hostElement
elem;
//vector
estribos_centrales_vector;
//spacing
espaciamiento_centrales;
//ArrayLength
curve_splitted_len_centrales;
//includeFirstBar
false;
//includeLastBar
false;
//Plano de ajuste etiquetas
plane_ajuste_etiqueta;
//Punto para posicionar tag
tag_location_centrales;










//Estribos Centrales_b
estribos_centrales_b = DSCore.List.TakeEveryNthItem(geom_surface_perimeter_curves_2@L3<1>, 3, 2);
estribos_centrales_vector;
curve_splitted_len_centrales;
tag_location_centrales;
//curves
estribos_centrales_b;
//rebarStyle
"StirrupTie";
//rebarBarType
tipo_barra_centrales;
//startHookType
hook;
//endHookType
hook;
//startHookOrientation
"Left";
//endtHookOrientation
"Left";
//hostElement
elem;
//vector
estribos_centrales_vector;
//spacing
espaciamiento_centrales;
//ArrayLength
curve_splitted_len_centrales;
//includeFirstBar
false;
//includeLastBar
false;
//Plano de ajuste etiquetas
plane_ajuste_etiqueta;
//Punto para posicionar tag
tag_location_centrales;
//
# ----------------------------------------
fromCurves_17 = StructuralDesign.Rebar.Create.FromCurves(curves=code_block_49.out90@L2, rebarStyle=code_block_49.out91@L1, rebarBarType=code_block_49.out92@L1, startHookType=code_block_49.out93@L1, endHookType=code_block_49.out94@L1, startHookOrientation=code_block_49.out95@L1, endHookOrientation=code_block_49.out96@L1, hostElement=code_block_49.out97@L1, vector=code_block_49.out98@L1, lacing=Longest)
setLayoutAsMaximumSpacing_17 = StructuralDesign.Rebar.Layout.SetLayoutAsMaximumSpacing(rebar=fromCurves_17, spacing=code_block_49.out99, arrayLength=code_block_49.out100, lacing=Longest)
code_block_50 = CodeBlock { "FirstLast"; }
setRebarPresentation_17 = Custom[SetRebarPresentation](rebarElements=setLayoutAsMaximumSpacing_17, rebarRepresentation=code_block_50)
flatten_17 = List.Flatten(list=setRebarPresentation_17@L3)
code_block_51 = CodeBlock(element=flatten_17, plane_ajuste_etiqueta=code_block_49.out101, tag_location_extremos=code_block_49.out102)
# ---------- code_block_51.designscript (20 lines) ----------
//Asigna el tipo de estribo (sim, doble, etc...)
Revit.Elements.Element.SetParameterByName(element, "Estribo", "ED.");
plane_ajuste_etiqueta;
tag_location_extremos_corregido = Points.PullOntoPlane(tag_location_extremos, plane_ajuste_etiqueta);

//element
element;
//TagLocation
tag_location_extremos_corregido;
//TagType
family = Revit.Family.ByName("EST_A_STRUCTURAL REBAR TAG_ESTRIBO");
tag_type = Revit.Elements.FamilyType.ByFamilyAndName(family, "R_E_00");
//horizontal
true;
//addLeader
false;
//LinkInstance
null;
//RunIt
true;
# ----------------------------------------
create_tag_11 = Custom[Create Tag](view=o_document_activeview_19@L1, element=code_block_51.out3@L2, TagLocation=code_block_51.out4@L2, TagType=code_block_51.out6@L1, horizontal=code_block_51.out7@L1, addLeader=code_block_51.out8@L1, LinkInstance=code_block_51.out9@L1, RunIt=code_block_51.out10@L1, lacing=Longest)
fromCurves_18 = StructuralDesign.Rebar.Create.FromCurves(curves=code_block_49.out107@L2, rebarStyle=code_block_49.out108@L1, rebarBarType=code_block_49.out109@L1, startHookType=code_block_49.out110@L1, endHookType=code_block_49.out111@L1, startHookOrientation=code_block_49.out112@L1, endHookOrientation=code_block_49.out113@L1, hostElement=code_block_49.out114@L1, vector=code_block_49.out115@L1, lacing=Longest)
setLayoutAsMaximumSpacing_18 = StructuralDesign.Rebar.Layout.SetLayoutAsMaximumSpacing(rebar=fromCurves_18, spacing=code_block_49.out116, arrayLength=code_block_49.out117, lacing=Longest)
code_block_52 = CodeBlock { "FirstLast"; }
setRebarPresentation_18 = Custom[SetRebarPresentation](rebarElements=setLayoutAsMaximumSpacing_18, rebarRepresentation=code_block_52)
flatten_18 = List.Flatten(list=setRebarPresentation_18@L3)
code_block_53 = CodeBlock(element=flatten_18)  # same code as code_block_26
fromCurves_19 = StructuralDesign.Rebar.Create.FromCurves(curves=code_block_49.out141@L2, rebarStyle=code_block_49.out142@L1, rebarBarType=code_block_49.out143@L1, startHookType=code_block_49.out144@L1, endHookType=code_block_49.out145@L1, startHookOrientation=code_block_49.out146@L1, endHookOrientation=code_block_49.out147@L1, hostElement=code_block_49.out148@L1, vector=code_block_49.out149@L1, lacing=Longest)
setLayoutAsMaximumSpacing_19 = StructuralDesign.Rebar.Layout.SetLayoutAsMaximumSpacing(rebar=fromCurves_19, spacing=code_block_49.out150, arrayLength=code_block_49.out151, lacing=Longest)
code_block_54 = CodeBlock { "FirstLast"; }
setRebarPresentation_19 = Custom[SetRebarPresentation](rebarElements=setLayoutAsMaximumSpacing_19, rebarRepresentation=code_block_54)
flatten_19 = List.Flatten(list=setRebarPresentation_19@L3)
code_block_55 = CodeBlock(element=flatten_19)  # same code as code_block_26
o_document_activeview_21 = Orchid.RevitProject.Common.Document.ActiveView()
fromCurves_20 = StructuralDesign.Rebar.Create.FromCurves(curves=code_block_49.out124@L2, rebarStyle=code_block_49.out125@L1, rebarBarType=code_block_49.out126@L1, startHookType=code_block_49.out127@L1, endHookType=code_block_49.out128@L1, startHookOrientation=code_block_49.out129@L1, endHookOrientation=code_block_49.out130@L1, hostElement=code_block_49.out131@L1, vector=code_block_49.out132@L1, lacing=Longest)
setLayoutAsMaximumSpacing_20 = StructuralDesign.Rebar.Layout.SetLayoutAsMaximumSpacing(rebar=fromCurves_20, spacing=code_block_49.out133, arrayLength=code_block_49.out134, lacing=Longest)
code_block_56 = CodeBlock { "FirstLast"; }
setRebarPresentation_20 = Custom[SetRebarPresentation](rebarElements=setLayoutAsMaximumSpacing_20, rebarRepresentation=code_block_56)
flatten_20 = List.Flatten(list=setRebarPresentation_20@L3)
code_block_57 = CodeBlock(element=flatten_20, plane_ajuste_etiqueta=code_block_49.out135, tag_location_extremos=code_block_49.out136)  # same code as code_block_51
create_tag_12 = Custom[Create Tag](view=o_document_activeview_21@L1, element=code_block_57.out3@L2, TagLocation=code_block_57.out4@L2, TagType=code_block_57.out6@L1, horizontal=code_block_57.out7@L1, addLeader=code_block_57.out8@L1, LinkInstance=code_block_57.out9@L1, RunIt=code_block_57.out10@L1, lacing=Longest)
o_document_activeview_22 = Orchid.RevitProject.Common.Document.ActiveView()
fromCurves_21 = StructuralDesign.Rebar.Create.FromCurves(curves=code_block_49.out158@L2, rebarStyle=code_block_49.out159@L1, rebarBarType=code_block_49.out160@L1, startHookType=code_block_49.out161@L1, endHookType=code_block_49.out162@L1, startHookOrientation=code_block_49.out163@L1, endHookOrientation=code_block_49.out164@L1, hostElement=code_block_49.out165@L1, vector=code_block_49.out166@L1, lacing=Longest)
setLayoutAsMaximumSpacing_21 = StructuralDesign.Rebar.Layout.SetLayoutAsMaximumSpacing(rebar=fromCurves_21, spacing=code_block_49.out167, arrayLength=code_block_49.out168, includeFirstBar=code_block_49.out169, includeLastBar=code_block_49.out170, lacing=Longest)
code_block_58 = CodeBlock { "FirstLast"; }
setRebarPresentation_21 = Custom[SetRebarPresentation](rebarElements=setLayoutAsMaximumSpacing_21, rebarRepresentation=code_block_58)
flatten_21 = List.Flatten(list=setRebarPresentation_21@L3)
code_block_59 = CodeBlock(element=flatten_21, plane_ajuste_etiqueta=code_block_49.out171, tag_location_extremos=code_block_49.out172)  # same code as code_block_51
create_tag_13 = Custom[Create Tag](view=o_document_activeview_22@L1, element=code_block_59.out3@L2, TagLocation=code_block_59.out4@L2, TagType=code_block_59.out6@L1, horizontal=code_block_59.out7@L1, addLeader=code_block_59.out8@L1, LinkInstance=code_block_59.out9@L1, RunIt=code_block_59.out10@L1, lacing=Longest)
fromCurves_22 = StructuralDesign.Rebar.Create.FromCurves(curves=code_block_49.out177@L2, rebarStyle=code_block_49.out178@L1, rebarBarType=code_block_49.out179@L1, startHookType=code_block_49.out180@L1, endHookType=code_block_49.out181@L1, startHookOrientation=code_block_49.out182@L1, endHookOrientation=code_block_49.out183@L1, hostElement=code_block_49.out184@L1, vector=code_block_49.out185@L1, lacing=Longest)
setLayoutAsMaximumSpacing_22 = StructuralDesign.Rebar.Layout.SetLayoutAsMaximumSpacing(rebar=fromCurves_22, spacing=code_block_49.out186, arrayLength=code_block_49.out187, includeFirstBar=code_block_49.out188, includeLastBar=code_block_49.out189, lacing=Longest)
code_block_60 = CodeBlock { "FirstLast"; }
setRebarPresentation_22 = Custom[SetRebarPresentation](rebarElements=setLayoutAsMaximumSpacing_22, rebarRepresentation=code_block_60)
flatten_22 = List.Flatten(list=setRebarPresentation_22@L3)
code_block_61 = CodeBlock(element=flatten_22)  # same code as code_block_26
