# Dynamo graph scheduleMark_script.DYN "scheduleMarkV2.DYN" (Dynamo 2.6.2.15705)
# packages: spring nodes 210.1.1, Clockwork for Dynamo 2.x 2.4.0

code_block = CodeBlock { "Structural Rebar"; }
byName = Category.ByName(name=code_block)
all_elements_of_category = ElementsOfCategory(Category=byName)
code_block_2 = CodeBlock { "Bar Diameter"; }
getParameterValueByName = Element.GetParameterValueByName(element=all_elements_of_category, parameterName=code_block_2)
sortByKey = List.SortByKey(list=all_elements_of_category, keys=getParameterValueByName)
groupByKey = List.GroupByKey(list=sortByKey.sorted_list, keys=sortByKey.sorted_keys)
code_block_3 = CodeBlock { "Shape"; }
getParameterValueByName_2 = Element.GetParameterValueByName(element=groupByKey.groups, parameterName=code_block_3)
name = Element.Name(element=getParameterValueByName_2)
sortByKey_2 = List.SortByKey(list=groupByKey.groups@L2, keys=name@L2)
groupByKey_2 = List.GroupByKey(list=sortByKey_2.sorted_list@L2, keys=sortByKey_2.sorted_keys@L2)
code_block_4 = CodeBlock { "Length of each bar"; }
getParameterValueByName_3 = Element.GetParameterValueByName(element=groupByKey_2.groups, parameterName=code_block_4)
round = Math.Round(number=getParameterValueByName_3)
sortByKey_3 = List.SortByKey(list=groupByKey_2.groups@L2, keys=round@L2)
groupByKey_3 = List.GroupByKey(list=sortByKey_3.sorted_list@@L2, keys=sortByKey_3.sorted_keys@L2)
flatten = List.Flatten(list=groupByKey_3.groups@L2)
firstItem = List.FirstItem(list=flatten@L2)
code_block_5 = CodeBlock { "Bar Diameter"; }
getParameterValueByName_4 = Element.GetParameterValueByName(element=firstItem, parameterName=code_block_5)
groupByKey_4 = List.GroupByKey(list=flatten, keys=getParameterValueByName_4)
code_block_6 = CodeBlock(element=groupByKey_4.groups)
# ---------- code_block_6.designscript (5 lines) ----------
//element
element;

//parameterName
"Bar Diameter";
# ----------------------------------------
getParameterValueByName_5 = Element.GetParameterValueByName(element=code_block_6.element@L2, parameterName=code_block_6.out1)
ꟿ_number_tostring = Custom[ꟿ Number.ToString](num=getParameterValueByName_5)  # package spring nodes; Converts the input number(s) to string. You can optionally limit the number of digits.
count = List.Count(list=groupByKey_4.groups@L3)
code_block_7 = CodeBlock(amount=count)
# ---------- code_block_7.designscript (6 lines) ----------
//start
1;
//amount
amount;
//step
1;
# ----------------------------------------
sequence = Sequence(start=code_block_7.out0, amount=code_block_7.amount@L2, step=code_block_7.out2)
code_block_8 = CodeBlock(num=sequence)
# ---------- code_block_8.designscript (5 lines) ----------
//num
num;

//n
2;
# ----------------------------------------
withLeadingZeroes = Custom[List.WithLeadingZeroes](num=code_block_8.num@L2, n=code_block_8.out1)  # package Clockwork for Dynamo 2.x; Adds leading zeros to a sequence of numbers
string_from_object = FromObject(obj=withLeadingZeroes)
add = ꟿ_number_tostring@L2 + string_from_object@L1
code_block_9 = CodeBlock(element=groupByKey_4.groups, value=add)
# ---------- code_block_9.designscript (8 lines) ----------
//element
element;

//parameterName
"Schedule Mark";

//value
value;
# ----------------------------------------
setParameterByName = Element.SetParameterByName(element=code_block_9.element@L2, parameterName=code_block_9.out1@L1, value=code_block_9.value@L2, lacing=Longest)
