# Dynamo graph ElevacionEje_script.dyn (Dynamo 2.6.2.15705)
# packages: Data-Shapes 2022.2.103, Clockwork for Dynamo 2.x 2.4.0, Crumple 2022.2.13, Rhythm 2021.7.2, Genius Loci 2021.11.10, archi-lab.net 2022.210.2419

firstItem = List.FirstItem()  # unwired: list
XAxis = Vector.XAxis()
code_block = CodeBlock { "Validacion"; }
code_block_2 = CodeBlock { "Project Information"; }
byName = Category.ByName(name=code_block_2)
all_elements_of_category = ElementsOfCategory(Category=byName)
parameterExists = Custom[Element.ParameterExists](param=code_block, element=all_elements_of_category)  # package Clockwork for Dynamo 2.x; Checks if an element contains a parameter of a given name
code_block_3 = CodeBlock { "Escala:"; }
code_block_4 = CodeBlock()
# ---------- code_block_4.designscript (6 lines) ----------
[
"1:50",
"1:75",
"1:100"
];
":";
# ----------------------------------------
split = String.Split(str=code_block_4.out0, separator0=code_block_4.out1)
code_block_5 = CodeBlock { 1; }
getItemAtIndex = List.GetItemAtIndex(list=split@L2, index=code_block_5)
toNumber = String.ToNumber(str=getItemAtIndex)
code_block_6 = CodeBlock { 0; false; }
dropdown_data = Custom[DropDown Data](InputName=code_block_3, Keys=code_block_4.out0, Values=toNumber, DefaultValueIndex=code_block_6.out0, Sorted_optional=code_block_6.out1)  # package Data-Shapes; Create data for DropDown input in UI.MultiInputForm ++ . Check out www.data-shapes.net for more infos.
code_block_7 = CodeBlock { "Ejes por Elevar"; }
code_block_8 = CodeBlock { "Grids"; }
byName_2 = Category.ByName(name=code_block_8)
all_elements_of_category_2 = ElementsOfCategory(Category=byName_2)
code_block_9 = CodeBlock { "Elevado"; }
code_block_10 = CodeBlock { "Elevado"; }
getParameterValueByName = Element.GetParameterValueByName(element=all_elements_of_category_2, parameterName=code_block_10)
python_script = Python(IN[0]=getParameterValueByName)
# ---------- python_script.python (19 lines) ----------
input = IN[0]

def evaluar_valor(valor):
    if isinstance(valor, str):
        return 0
    elif valor == 0:
        return 0
    elif valor == 1:
        return 1
    else:
        return "Valor no válido"

def evaluar_lista(lista):
    resultados = []
    for elemento in lista:
        resultados.append(evaluar_valor(elemento))
    return resultados

OUT = evaluar_lista(input)
# ----------------------------------------
setParameterByName = Element.SetParameterByName(element=all_elements_of_category_2, parameterName=code_block_9, value=python_script)
code_block_11 = CodeBlock { "Elevado"; }
getParameterValueByName_2 = Element.GetParameterValueByName(element=setParameterByName, parameterName=code_block_11)
code_block_12 = CodeBlock { 1; }
eq = getParameterValueByName_2 == code_block_12
filterByBoolMask = List.FilterByBoolMask(list=setParameterByName, mask=eq)
name = Element.Name(element=filterByBoolMask.out)
sortByKey = List.SortByKey(list=filterByBoolMask.out, keys=name)
code_block_13 = CodeBlock(grid_name=sortByKey.sorted_keys) { "ELEVACION EJE " + grid_name; }
code_block_14 = CodeBlock { 0; }
radiobuttons_data = Custom[RadioButtons Data](InputName=code_block_7, Keys=code_block_13, Values=sortByKey.sorted_list, DefaultValueIndex=code_block_14)  # package Data-Shapes; Create radio buttons input for UI.MultipleInputForm ++ .
list_create = List.Create(item0=dropdown_data, item1=radiobuttons_data)
python_script_2 = Python(IN[0]=parameterExists, IN[1]=list_create)
# ---------- python_script_2.python (9 lines) ----------
validacion = IN[0][0]
inputs = IN[1]

if validacion == True:
	res = inputs
else:
	res = []

OUT = res
# ----------------------------------------
code_block_15 = CodeBlock(inputs=python_script_2)
# ---------- code_block_15.designscript (29 lines) ----------
//Description_optional
"Elevacion por Eje";

//Logo


//ButtonText
"INICIAR";

//Inputs
inputs;

//Toggle
true;

//LinkToHelp


//CancelButtonText
"CANCELAR";

//MaxHeight
800;

//Width
490;

//LabelWidth
150;
# ----------------------------------------
multipleinputform = Custom[MultipleInputForm ++](Description_optional=code_block_15.out0, ButtonText_optional=code_block_15.out1, Inputs=code_block_15.inputs, Toggle=code_block_15.out3, CancelButtonText_optional=code_block_15.out4, MaxHeight_optional=code_block_15.out5, Width_optional=code_block_15.out6, LabelWidth_optional=code_block_15.out7)  # package Data-Shapes; Create a form with multiple inputs. see www.data-shapes.net for tutorials and infos!
python_script_3 = Python(IN[0]=multipleinputform.User_Inputs)
# ---------- python_script_3.python (8 lines) ----------
input = IN[0]

if input == [] or input == None:
	res = [[], [], [], []]
else:
	res = input
	
OUT = res
# ----------------------------------------
codeblock = CodeBlock(value=python_script_3) { value[0]; value[1]; }
code_block_16 = CodeBlock { "Elevado"; 1; }
setParameterByName_2 = Element.SetParameterByName(element=codeblock.out1, parameterName=code_block_16.out0, value=code_block_16.out1)
curve = Grid.Curve(grid=setParameterByName_2)
startPoint = Curve.StartPoint(curve=curve)
endPoint = Curve.EndPoint(curve=curve)
byTwoPoints = Vector.ByTwoPoints(start=startPoint, end=endPoint)
ZAxis = Vector.ZAxis()
angleAboutAxis = Vector.AngleAboutAxis(vector=XAxis, otherVector=byTwoPoints, rotationAxis=ZAxis)
round = Math.Round(number=angleAboutAxis)
reverse = Curve.Reverse(curve=curve)
python_script_4 = Python(IN[0]=round, IN[1]=curve, IN[2]=reverse)
# ---------- python_script_4.python (8 lines) ----------
input = IN[0]

if input >= 180 and input <= 270:
	res = IN[1]
else:
	res = IN[2]

OUT = res
# ----------------------------------------
current = Document.Current()
activeView = Document.ActiveView(document=current)
code_block_17 = CodeBlock { "Section Filter"; }
getParameterValueByName_3 = Element.GetParameterValueByName(element=activeView, parameterName=code_block_17)
code_block_18 = CodeBlock(section_filter=getParameterValueByName_3) { "Building Section ("+ section_filter + ")"; }
byName_3 = ElementType.ByName(name=code_block_18)
code_block_19 = CodeBlock { 700; 200; 700; }
byLine = Custom[ViewSection.ByLine](Curves=python_script_4, ViewFamilyTypes=byName_3, ViewSectionHeight=code_block_19.out0, OffsetFromLine=code_block_19.out1, Depth=code_block_19.out2)  # package Data-Shapes; Create ViewSections in current document from DS Lines.
end = Revit.Transaction.Transaction.End(input=byLine)
setScale = View.SetScale(view=end, scale=codeblock.out0)
code_block_20 = CodeBlock { "Crop View"; 0; }
setParameterByName_3 = Element.SetParameterByName(element=setScale, parameterName=code_block_20.out0, value=code_block_20.out1)
code_block_21 = CodeBlock { "Crop Region Visible"; 0; }
setParameterByName_4 = Element.SetParameterByName(element=setParameterByName_3, parameterName=code_block_21.out0, value=code_block_21.out1)
code_block_22 = CodeBlock { "FlatColors"; }
setDisplayStyle = archilab.Revit.Views.Views.SetDisplayStyle(view=setParameterByName_4, displayStyle=code_block_22)
code_block_23 = CodeBlock { "View Name"; }
name_2 = Element.Name(element=codeblock.out1)
code_block_24 = CodeBlock(eje=name_2) { "ELEVACION EJE_" + eje; }
setParameterByName_5 = Element.SetParameterByName(element=setDisplayStyle, parameterName=code_block_23, value=code_block_24)
code_block_25 = CodeBlock { "Title on Sheet"; }
code_block_26 = CodeBlock(eje=name_2) { "ELEVACION EJE " + eje; }
setParameterByName_6 = Element.SetParameterByName(element=setParameterByName_5, parameterName=code_block_25, value=code_block_26)
viewopen = Custom[© ViewOpen](view=setParameterByName_6)  # package Crumple; Opens a Revit view (can also be a sheet).
function_apply = ApplyFunction(func=firstItem, arg1=viewopen.active)

# group: Cota Elevacion y Parcial entre Ejes
python_script_5 = Python(IN[0]=function_apply)
# ---------- python_script_5.python (8 lines) ----------
input = IN[0]

if input == None:
	res = []
else:
	res = input
	
OUT = res
# ----------------------------------------
firstItem_2 = List.FirstItem()  # unwired: list
byJoinedCurves = PolyCurve.ByJoinedCurves()  # unwired: curves
viewgetcropbox = Custom[© ViewGetCropBox](views=python_script_5)  # package Crumple; Returns the curves of a view's cropbox (even if not visible/active). Also returns whether the cropbox is currently visible and active as booleans.
flatten = List.Flatten(list=viewgetcropbox.curves)
function_apply_2 = ApplyFunction(func=byJoinedCurves, arg1=flatten)
python_script_6 = Python(IN[0]=function_apply_2)  # same code as python_script_5
byPatch = Surface.ByPatch(closedCurve=python_script_6)
code_block_27 = CodeBlock { [0, 1]; }
pointAtParameter = Surface.PointAtParameter(surface=byPatch, u=code_block_27)
python_script_7 = Python(IN[0]=pointAtParameter)
# ---------- python_script_7.python (8 lines) ----------
input = IN[0]

if input == []:
	res = [[], []]
else:
	res = input
	
OUT = res
# ----------------------------------------
codeblock_2 = CodeBlock(value=python_script_7) { value[0]; value[1]; }
byStartPointEndPoint = Line.ByStartPointEndPoint(startPoint=codeblock_2.out0, endPoint=codeblock_2.out1)
firstItem_3 = List.FirstItem()  # unwired: list
code_block_28 = CodeBlock { "Structural Foundations"; }
byName_4 = Category.ByName(name=code_block_28)
all_elements_of_category_in_view = ElementsOfCategoryInView(Category=byName_4, View=python_script_5)
code_block_29 = CodeBlock { 1; }
pointAtParameter_2 = Surface.PointAtParameter(surface=byPatch, u=code_block_29)
geometry = Custom[Element.Geometry+](element=all_elements_of_category_in_view)  # package Clockwork for Dynamo 2.x; Returns Dynamo AND native Revit geometry of a given element
flatten_2 = List.Flatten(list=geometry.dynamoGeometry)
centroid = Solid.Centroid(solid=flatten_2)
distanceTo = Geometry.DistanceTo(geometry=pointAtParameter_2, other=centroid)
minimumItem = List.MinimumItem(list=distanceTo)
eq_2 = distanceTo == minimumItem
filterByBoolMask_2 = List.FilterByBoolMask(list=all_elements_of_category_in_view, mask=eq_2)
element_surfaces_references = Custom[Element Surfaces References](element=filterByBoolMask_2.in)  # package Genius Loci; Retrieve the top, bottom, side surfaces and their associated references of the system family. This doesn't work with cylindrical system families (pipe...)
flatten_3 = List.Flatten(list=element_surfaces_references.Bottom_Reference)
function_apply_3 = ApplyFunction(func=firstItem_3, arg1=flatten_3)
python_script_8 = Python(IN[0]=function_apply_3)  # same code as python_script_5
code_block_30 = CodeBlock { "Floors"; }
byName_5 = Category.ByName(name=code_block_30)
all_elements_of_category_in_view_2 = ElementsOfCategoryInView(Category=byName_5, View=python_script_5)
element_surfaces_references_2 = Custom[Element Surfaces References](element=all_elements_of_category_in_view_2)
flatten_4 = List.Flatten(list=element_surfaces_references_2.Top_Reference)
addItemToFront = List.AddItemToFront(item=python_script_8, list=flatten_4)
dimension_byreferences = Custom[Dimension ByReferences](view=python_script_5@L1, line=byStartPointEndPoint@L1, references=addItemToFront@L2, lacing=Longest)  # package Genius Loci; Creates a new linear dimension from at least two geometric references of an object.
flatten_5 = List.Flatten(list=dimension_byreferences)
function_apply_4 = ApplyFunction(func=firstItem_2, arg1=flatten_5)
python_script_9 = Python(IN[0]=function_apply_4)  # same code as python_script_5
ʳʰʸᵗʰᵐ_dimensions = Rhythm.Revit.Elements.Dimensions.GetReferenceElements(dimension=python_script_9)
ʳʰʸᵗʰᵐ_dimensions_getcurve = Rhythm.Revit.Elements.Dimensions.GetCurve(dimension=flatten_5)
startPoint_2 = Curve.StartPoint(curve=ʳʰʸᵗʰᵐ_dimensions_getcurve)
endPoint_2 = Curve.EndPoint(curve=ʳʰʸᵗʰᵐ_dimensions_getcurve)
list_create_2 = List.Create(item0=startPoint_2, item1=endPoint_2)
flatten_6 = List.Flatten(list=list_create_2)
pruneDuplicates = Point.PruneDuplicates(points=flatten_6)
byElementAndLocation = Tag.ByElementAndLocation(view=python_script_5, element=ʳʰʸᵗʰᵐ_dimensions, location=pruneDuplicates)
code_block_31 = CodeBlock { "Type"; }
getCategory = Element.GetCategory(element=ʳʰʸᵗʰᵐ_dimensions)
string_from_object = FromObject(obj=getCategory)
python_script_10 = Python(IN[0]=string_from_object)
# ---------- python_script_10.python (13 lines) ----------
input = IN[0]

res = []
for i in input:
    if i == "Structural Foundations":
        res.append("EST_A_FOUNDATION TAG_ELEVACION")
    elif i == "Floors":
        res.append("EST_A_FLOOR TAG_ELEVACION_TOPE LOSA")
    else:
        res.append([])


OUT = res
# ----------------------------------------
byName_6 = Family.ByName(name=python_script_10)
python_script_11 = Python(IN[0]=string_from_object)
# ---------- python_script_11.python (13 lines) ----------
input = IN[0]

res = []
for i in input:
    if i == "Structural Foundations":
        res.append("Orientación Izquierda")
    elif i == "Floors":
        res.append("Orientación Izquierda")
    else:
        res.append([])


OUT = res
# ----------------------------------------
byFamilyAndName = FamilyType.ByFamilyAndName(family=byName_6, name=python_script_11)
setParameterByName_7 = Element.SetParameterByName(element=byElementAndLocation, parameterName=code_block_31, value=byFamilyAndName)
code_block_32 = CodeBlock { [1, 1]; [0, 1]; }
pointAtParameter_3 = Surface.PointAtParameter(surface=byPatch, u=code_block_32.out0, v=code_block_32.out1)
python_script_12 = Python(IN[0]=pointAtParameter_3)  # same code as python_script_7
codeblock_3 = CodeBlock(value=python_script_12) { value[0]; value[1]; }
byStartPointEndPoint_2 = Line.ByStartPointEndPoint(startPoint=codeblock_3.out0, endPoint=codeblock_3.out1)
code_block_33 = CodeBlock { "Grids"; }
byName_7 = Category.ByName(name=code_block_33)
all_elements_of_category_in_view_3 = ElementsOfCategoryInView(Category=byName_7, View=python_script_5)
element_reference = Custom[Element Reference](element=all_elements_of_category_in_view_3)  # package Genius Loci; Gets the reference of a geometric object or a dimension or a reference plane.
dimension_byreferences_2 = Custom[Dimension ByReferences](view=python_script_5@L1, line=byStartPointEndPoint_2@L1, references=element_reference@L2, lacing=Longest)

# group: Etiqueta Muro
python_script_13 = Python(IN[0]=function_apply)  # same code as python_script_5
code_block_34 = CodeBlock { "Walls"; }
byName_8 = Category.ByName(name=code_block_34)
all_elements_of_category_in_view_4 = ElementsOfCategoryInView(Category=byName_8, View=python_script_13)
plane = Custom[View.Plane](view=python_script_13)  # package Clockwork for Dynamo 2.x; Retrieves the plane of a given view
YAxis = Plane.YAxis(plane=plane)
getLocation = Element.GetLocation(element=all_elements_of_category_in_view_4)
startPoint_3 = Curve.StartPoint(curve=getLocation)
endPoint_3 = Curve.EndPoint(curve=getLocation)
byTwoPoints_2 = Vector.ByTwoPoints(start=startPoint_3, end=endPoint_3)
isParallel = Vector.IsParallel(vector=YAxis, other=byTwoPoints_2)
filterByBoolMask_3 = List.FilterByBoolMask(list=all_elements_of_category_in_view_4, mask=isParallel)
elementcentroid = Custom[© ElementCentroid](element=filterByBoolMask_3.in)  # package Crumple; Returns the centroid of the element's axis-aligned bounding box.
byElementAndLocation_2 = Tag.ByElementAndLocation(view=python_script_13, element=filterByBoolMask_3.in, location=elementcentroid)

# group: Contorno Redibujado
python_script_14 = Python(IN[0]=function_apply)  # same code as python_script_5
code_block_35 = CodeBlock()
# ---------- code_block_35.designscript (6 lines) ----------
["Floors",
"Structural Framing",
"Walls",
"Structural Foundations",
"Structural Columns"
];
# ----------------------------------------
byName_9 = Category.ByName(name=code_block_35)
all_elements_of_category_in_view_5 = ElementsOfCategoryInView(Category=byName_9, View=python_script_14)
flatten_7 = List.Flatten(list=all_elements_of_category_in_view_5@L3)
python_script_15 = Python(IN[0]=flatten_7)
# ---------- python_script_15.python (7 lines) ----------
input = IN[0]

if input[0] == []:
	input = []
else:
	input
OUT = input
# ----------------------------------------
name_3 = Material.Name()  # unwired: material
getMaterials = Element.GetMaterials(element=python_script_15)
flatten_8 = List.Flatten(list=getMaterials@L3)
function_apply_5 = ApplyFunction(func=name_3, arg1=flatten_8)
code_block_36 = CodeBlock { "Concrete, Cast-in-Place gray"; }
eq_3 = function_apply_5 == code_block_36
filterByBoolMask_4 = List.FilterByBoolMask(list=python_script_15, mask=eq_3)
code_block_37 = CodeBlock { "Hidden"; }
getByName = LinePatternElement.GetByName(name=code_block_37)
color_palette = ColorPalette({R: 0, G: 0, B: 0, A: 255})
code_block_38 = CodeBlock { 1; }
create_overridegraphicsettings = Custom[Create OverrideGraphicSettings](ProjectionLinePattern=getByName, ProjectionLineColor=color_palette, ProjectionLineWeight=code_block_38, CutLinePattern=getByName, CutLineColor=color_palette, CutLineWeight=code_block_38)  # package Genius Loci; Create a OverrideGraphicSettings (All graphic inputs are optional). Unlike the OOTB OverrideGraphicSettings.ByProperties node, the Foreground and background patterns are available. Note : Prior to Revit 2019, the materials have only one surface pattern and one cut pattern.
view_setelementoverrides = Custom[View SetElementOverrides](view=python_script_14@L1, elements=filterByBoolMask_4.in@L2, overrides=create_overridegraphicsettings@L1, lacing=Longest)  # package Genius Loci; Overrides element graphics settings in the given view. For use with the Create OverrideGraphicSettings node. Can also be used to hide or unhide elements.
perimeterCurves = Surface.PerimeterCurves()  # unwired: surface
geometry_2 = Custom[Element.Geometry+](element=filterByBoolMask_4.in)
flatten_9 = List.Flatten(list=geometry_2.dynamoGeometry)
list_clean = Custom[List Clean](list=flatten_9)  # package Genius Loci; Removes all Null, Empty and Blank from a list or nested list of lists.
byUnion = Custom[Solid.ByUnion+](solids=list_clean)  # package Clockwork for Dynamo 2.x; The OOTB node Solid.ByUnion occasionally fails when trying to merge solids with almost adjacent faces. This node will return the minimum amount of joined solids possible in such cases instead of returning null.
volume = Solid.Volume()  # unwired: solid
maximumItemByKey = List.MaximumItemByKey(list=byUnion@L2, keyProjector=volume)
plane_2 = Custom[Grid.Plane](grid=codeblock.out1)  # package Clockwork for Dynamo 2.x; Retrieves the plane of a grid. Returns null for curved grid lines.
intersect = Geometry.Intersect(geometry=maximumItemByKey@L1, other=plane_2@L1, lacing=Longest)
function_apply_6 = ApplyFunction(func=perimeterCurves, arg1=intersect)
plane_3 = Custom[View.Plane](view=python_script_14)
pullOntoPlane = Curve.PullOntoPlane(curve=function_apply_6@L2, plane=plane_3@L1, lacing=Longest)
byCurve = Custom[DetailCurve.ByCurve+](curve=pullOntoPlane@L2, view=python_script_14@L1, lacing=Longest)  # package Clockwork for Dynamo 2.x; Creates a detail line based on a given curve. Unlike the OOTB node it can also draw circles.
code_block_39 = CodeBlock { "<Medium Lines>"; "Line Style"; }
get_line_style_by_name = Custom[Get Line Style by Name](name=code_block_39.out0)  # package archi-lab.net; This node will return a line style object by its name. Line styles can be either Drafting or Model Line Property.
setParameterByName_8 = Element.SetParameterByName(element=byCurve, parameterName=code_block_39.out1, value=get_line_style_by_name, lacing=Longest)
fromElements = Custom[Group.FromElements](elements=setParameterByName_8@L2, groupName=code_block_24)  # package Clockwork for Dynamo 2.x; Creates a group from a list of Revit elements

# group: Etiqueta Viga
python_script_16 = Python(IN[0]=function_apply)  # same code as python_script_5
code_block_40 = CodeBlock { "Structural Framing"; }
byName_10 = Category.ByName(name=code_block_40)
all_elements_of_category_in_view_6 = ElementsOfCategoryInView(Category=byName_10, View=python_script_16)
location = Custom[Element.Location+](element=all_elements_of_category_in_view_6)  # package Clockwork for Dynamo 2.x; Returns the location of an element as point, curve or curve loop, along with some booleans to help filtering the results. Unlike the OOTB Element.GetLocation node, it also retunrs sketch lines of sketch-based elements like floor slabs as well as the element's rotation property.
python_script_17 = Python(IN[0]=location.curveEndpoints)  # same code as python_script_5
transpose = List.Transpose(lists=python_script_17)
python_script_18 = Python(IN[0]=transpose)  # same code as python_script_7
codeblock_4 = CodeBlock(value=python_script_18) { value[0]; value[1]; }
byTwoPoints_3 = Vector.ByTwoPoints(start=codeblock_4.out0, end=codeblock_4.out1)
plane_4 = Custom[View.Plane](view=python_script_16)
isParallelToPlane = Custom[Vector.IsParallelToPlane](vector=byTwoPoints_3, plane=plane_4)  # package Clockwork for Dynamo 2.x; Checks if a given vector is parallel to a given plane
filterByBoolMask_5 = List.FilterByBoolMask(list=all_elements_of_category_in_view_6, mask=isParallelToPlane)
geometry_3 = Custom[Element.Geometry+](element=filterByBoolMask_5.in)
flatten_10 = List.Flatten(list=geometry_3.dynamoGeometry)
byGeometry = BoundingBox.ByGeometry(geom=flatten_10, lacing=Longest)
toPolySurface = BoundingBox.ToPolySurface(boundingBox=byGeometry)
surfaces = PolySurface.Surfaces(polySurface=toPolySurface)
python_script_19 = Python(IN[0]=surfaces)
# ---------- python_script_19.python (8 lines) ----------
input = IN[0]

if input == []:
	res = [None, None]
else:
	res = input
	
OUT = res
# ----------------------------------------
code_block_41 = CodeBlock { 0; }
getItemAtIndex_2 = List.GetItemAtIndex(list=python_script_19@L2, index=code_block_41)
python_script_20 = Python(IN[0]=getItemAtIndex_2)
# ---------- python_script_20.python (8 lines) ----------
input = IN[0]

if input[0] == None:
	res = []
else:
	res = input
	
OUT = res
# ----------------------------------------
code_block_42 = CodeBlock { 0.5; }
pointAtParameter_4 = Surface.PointAtParameter(surface=python_script_20, u=code_block_42, v=code_block_42)
byElementAndLocation_3 = Tag.ByElementAndLocation(view=python_script_16, element=all_elements_of_category_in_view_6, location=pointAtParameter_4)
code_block_43 = CodeBlock { "Type"; }
code_block_44 = CodeBlock { "EST_A_STRUCTURAL FRAMING TAG_PLANTA"; "Tag Viga"; }
byFamilyNameAndTypeName = FamilyType.ByFamilyNameAndTypeName(familyName=code_block_44.out0, typeName=code_block_44.out1)
setParameterByName_9 = Element.SetParameterByName(element=byElementAndLocation_3, parameterName=code_block_43, value=byFamilyNameAndTypeName)

# group: Etiqueta Columnas Hormigon
python_script_21 = Python(IN[0]=function_apply)  # same code as python_script_5
code_block_45 = CodeBlock { "Structural Columns"; }
byName_11 = Category.ByName(name=code_block_45)
all_elements_of_category_in_view_7 = ElementsOfCategoryInView(Category=byName_11, View=python_script_21)
materials = Custom[Element.Materials+](element=all_elements_of_category_in_view_7)  # package Clockwork for Dynamo 2.x; Retrieves all materials from a given element. Unlike the OOTB node Element.GetMaterials, it also retrieves QTO information.
flatten_11 = List.Flatten(list=materials.materials)
name_4 = Material.Name(material=flatten_11)
code_block_46 = CodeBlock { "Concrete, Cast-in-Place gray"; }
eq_4 = name_4 == code_block_46
filterByBoolMask_6 = List.FilterByBoolMask(list=all_elements_of_category_in_view_7, mask=eq_4)
geometry_4 = Custom[Element.Geometry+](element=filterByBoolMask_6.in)
flatten_12 = List.Flatten(list=geometry_4.dynamoGeometry)
faces = Topology.Faces(topology=flatten_12)
surfaceGeometry = Face.SurfaceGeometry(face=faces)
byGeometry_2 = BoundingBox.ByGeometry(geom=flatten_12, lacing=Longest)
properties = Custom[BoundingBox.Properties](boundingBox=byGeometry_2)  # package Clockwork for Dynamo 2.x; Retrieves the centroid, width, depth and height of a given bounding box
plane_5 = Custom[View.Plane](view=python_script_21)
normal = Plane.Normal(plane=plane_5)
byOriginNormal = Plane.ByOriginNormal(origin=properties.Centroid, normal=normal)
YAxis_2 = Plane.YAxis(plane=byOriginNormal)
code_block_47 = CodeBlock { -500; }
translate = Geometry.Translate(geometry=properties.Centroid, direction=YAxis_2, distance=code_block_47)
byStartPointEndPoint_3 = Line.ByStartPointEndPoint(startPoint=properties.Centroid, endPoint=translate)
doesIntersect = Geometry.DoesIntersect(geometry=surfaceGeometry@L2, other=byStartPointEndPoint_3@L1)
filterByBoolMask_7 = List.FilterByBoolMask(list=surfaceGeometry, mask=doesIntersect)
code_block_48 = CodeBlock { 0.5; }
pointAtParameter_5 = Surface.PointAtParameter(surface=filterByBoolMask_7.in, u=code_block_48, v=code_block_48)
code_block_49 = CodeBlock { false; }
byElementAndLocation_4 = Tag.ByElementAndLocation(view=python_script_21, element=filterByBoolMask_6.in, location=pointAtParameter_5, horizontal=code_block_49)
code_block_50 = CodeBlock { "Type"; }
code_block_51 = CodeBlock { "EST_A_STRUCTURAL COLUMN TAG_ELEVACION_DIMENSIONES"; "Pilar Hormigon"; }
byFamilyNameAndTypeName_2 = FamilyType.ByFamilyNameAndTypeName(familyName=code_block_51.out0, typeName=code_block_51.out1)
setParameterByName_10 = Element.SetParameterByName(element=byElementAndLocation_4, parameterName=code_block_50, value=byFamilyNameAndTypeName_2)
