# Dynamo graph VistasPorUsuario_script.dyn (Dynamo 2.6.2.15705)
# packages: Genius Loci 2021.11.10, Crumple 2022.2.13, archi-lab.net 2022.210.2419, Clockwork for Dynamo 2.x 2.4.0, Data-Shapes 2025.3.118

view_family_types_ᶜᵒⁿᵛᵉʳᵗᵉᵈ = CodeBlock()  # "View Family Types ⁽ᶜᵒⁿᵛᵉʳᵗᵉᵈ ᵈʳᵒᵖᵈᵒʷⁿ⁾"
# ---------- view_family_types_ᶜᵒⁿᵛᵉʳᵗᵉᵈ.designscript (2 lines) ----------
//ElementType (Detail);
Revit.Elements.ElementSelector.ByElementId(69335);
# ----------------------------------------
code_block = CodeBlock { "Views"; }
byName = Category.ByName(name=code_block)
all_elements_of_category = ElementsOfCategory(Category=byName)
isViewTemplate = View.IsViewTemplate()  # unwired: view
function_apply = ApplyFunction(func=isViewTemplate, arg1=all_elements_of_category)
isNull = Object.IsNull(obj=function_apply)
filterByBoolMask = List.FilterByBoolMask(list=all_elements_of_category, mask=isNull)
isViewTemplate_2 = View.IsViewTemplate(view=filterByBoolMask.out)
filterByBoolMask_2 = List.FilterByBoolMask(list=filterByBoolMask.out, mask=isViewTemplate_2)
code_block_2 = CodeBlock { "Subclasificacion"; }
getParameterValueByName = Element.GetParameterValueByName(element=filterByBoolMask_2.out, parameterName=code_block_2)
code_block_3 = CodeBlock { "Validacion"; }
code_block_4 = CodeBlock { "Project Information"; }
byName_2 = Category.ByName(name=code_block_4)
all_elements_of_category_2 = ElementsOfCategory(Category=byName_2)
parameterExists = Custom[Element.ParameterExists](param=code_block_3, element=all_elements_of_category_2)  # package Clockwork for Dynamo 2.x; Checks if an element contains a parameter of a given name
code_block_5 = CodeBlock()
# ---------- code_block_5.designscript (42 lines) ----------
//InputName
"Categoria Vistas";
//Keys
key = [
"José Ignacio Núñez",
"Sergio Jimenez",
"Anibal Sanchez",
"Claudia Cancino",
"Ruben Perez",
"Hector Carrasco",
"Patricia Caroca",
"Jaime Neira",
"Cristian Orrego",
"Reinaldo Aguila",
"Leandro Barrios",
"Tamara Monge",
"Boris Lopez",
"Ariel Jamett",
"Usuario sin Asignar 01",
"Usuario sin Asignar 02"
];
//Values
val = [
"JNN",
"SJM",
"ASA",
"CCM",
"RPC",
"HCP",
"PCC",
"JNO",
"COC",
"RAA",
"LBA",
"TMM",
"BLA",
"AJJ",
"U01",
"UO2"
];
//DefaultValueIndex
0;
# ----------------------------------------
sortByKey = List.SortByKey(list=code_block_5.key, keys=code_block_5.val)
radiobuttons_data = Custom[RadioButtons Data](InputName=code_block_5.out0, Keys=sortByKey.sorted_list, Values=sortByKey.sorted_keys, DefaultValueIndex=code_block_5.out3)  # package Data-Shapes; Create radio buttons input for UI.MultipleInputForm ++ .
code_block_6 = CodeBlock { "Escala:"; }
code_block_7 = CodeBlock()
# ---------- code_block_7.designscript (10 lines) ----------
[
"1:50",
"1:75",
"1:100",
"1:125",
"1:150",
"1:175",
"1:200"
];
":";
# ----------------------------------------
split = String.Split(str=code_block_7.out0, separator0=code_block_7.out1)
code_block_8 = CodeBlock { 1; }
getItemAtIndex = List.GetItemAtIndex(list=split@L2, index=code_block_8)
toNumber = String.ToNumber(str=getItemAtIndex)
code_block_9 = CodeBlock { 0; false; }
dropdown_data = Custom[DropDown Data](InputName=code_block_6, Keys=code_block_7.out0, Values=toNumber, DefaultValueIndex=code_block_9.out0, Sorted_optional=code_block_9.out1)  # package Data-Shapes; Create data for DropDown input in UI.MultiInputForm ++ . Check out www.data-shapes.net for more infos.
list_create = List.Create(item0=radiobuttons_data, item1=dropdown_data)
python_script = Python(IN[0]=parameterExists, IN[1]=list_create)
# ---------- python_script.python (9 lines) ----------
validacion = IN[0][0]
inputs = IN[1]

if validacion == True:
	res = inputs
else:
	res = []

OUT = res
# ----------------------------------------
code_block_10 = CodeBlock(inputs=python_script)
# ---------- code_block_10.designscript (29 lines) ----------
//Description_optional
"Vistas por Usuario";

//Logo


//ButtonText
"INICIAR";

//Inputs
inputs;

//Toggle
true;

//LinkToHelp


//CancelButtonText
"CANCELAR";

//MaxHeight


//Width
490;

//LabelWidth
150;
# ----------------------------------------
multipleinputform = Custom[MultipleInputForm ++](Description_optional=code_block_10.out0, ButtonText_optional=code_block_10.out1, Inputs=code_block_10.inputs, Toggle=code_block_10.out3, CancelButtonText_optional=code_block_10.out4, Width_optional=code_block_10.out5, LabelWidth_optional=code_block_10.out6)  # package Data-Shapes; Create a form with multiple inputs. see www.data-shapes.net for tutorials and infos!
code_block_11 = CodeBlock { "Levels"; }
byName_3 = Category.ByName(name=code_block_11)
all_elements_of_category_3 = ElementsOfCategory(Category=byName_3)
code_block_12 = CodeBlock { "Building Story"; }
getParameterValueByName_2 = Element.GetParameterValueByName(element=all_elements_of_category_3, parameterName=code_block_12)
code_block_13 = CodeBlock { 1; }
eq = getParameterValueByName_2 == code_block_13
filterByBoolMask_3 = List.FilterByBoolMask(list=all_elements_of_category_3, mask=eq)
python_script_2 = Python(IN[0]=multipleinputform.User_Inputs, IN[1]=filterByBoolMask_3.in)
# ---------- python_script_2.python (9 lines) ----------
input = IN[0]
levels = IN[1]

if input == [] or input == None:
	res = [[], [], [], []]
else:
	input.insert(0, levels)
	res = input
OUT = res
# ----------------------------------------
code_block_14 = CodeBlock(x=python_script_2)
# ---------- code_block_14.designscript (4 lines) ----------
//usuario
x[1];
//zona
x[2];
# ----------------------------------------
eq_2 = getParameterValueByName == code_block_14.out0
filterByBoolMask_4 = List.FilterByBoolMask(list=filterByBoolMask_2.out, mask=eq_2)
code_block_15 = CodeBlock { "Subclasificacion"; }
getParameterValueByName_3 = Element.GetParameterValueByName(element=filterByBoolMask_4.in, parameterName=code_block_15)
uniqueItems = List.UniqueItems(list=getParameterValueByName_3)
eq_3 = code_block_14.out0 == uniqueItems
filterByBoolMask_5 = List.FilterByBoolMask(list=filterByBoolMask_4.in, mask=eq_3)
empty_list_to_null = Python(IN[0]=filterByBoolMask_5.in)
# ---------- empty_list_to_null.python (12 lines) ----------
lst = IN[0]

def obtener_lista(elemento):
    if isinstance(elemento, list) and len(elemento) > 0:
        return elemento
    else:
        return None

OUT = obtener_lista(lst)


OUT = obtener_lista(lst)
# ----------------------------------------
code_block_16 = CodeBlock(l=empty_list_to_null, lst=python_script_2)
# ---------- code_block_16.designscript (14 lines) ----------
l;
lst;

[Imperative]
{
	if (l == null)
		{
		return = lst;
		}
	else
		{
		return = [[],[],[]];
		}
};
# ----------------------------------------
code_block_17 = CodeBlock(x=code_block_16.out2)
# ---------- code_block_17.designscript (2 lines) ----------
//usuario
x[1];
# ----------------------------------------
code_block_18 = CodeBlock(usuario=code_block_17) { "Detail ("+usuario+")"; }
duplicate = archilab.Revit.Elements.ElementTypes.Duplicate(element=view_family_types_ᶜᵒⁿᵛᵉʳᵗᵉᵈ, name=code_block_18)
code_block_19 = CodeBlock { "View Template applied to new views"; }

# group: View Template Detail
code_block_20 = CodeBlock { "Views"; }
byName_4 = Category.ByName(name=code_block_20)
all_elements_of_category_4 = ElementsOfCategory(Category=byName_4)
isViewTemplate_3 = View.IsViewTemplate()  # unwired: view
function_apply_2 = ApplyFunction(func=isViewTemplate_3, arg1=all_elements_of_category_4)
isNull_2 = Object.IsNull(obj=function_apply_2)
filterByBoolMask_6 = List.FilterByBoolMask(list=all_elements_of_category_4, mask=isNull_2)
isViewTemplate_4 = View.IsViewTemplate(view=filterByBoolMask_6.out)
filterByBoolMask_7 = List.FilterByBoolMask(list=filterByBoolMask_6.out, mask=isViewTemplate_4)
name = Element.Name(element=filterByBoolMask_7.in)
code_block_21 = CodeBlock { "Architectural Detail"; }
eq_4 = name == code_block_21
filterByBoolMask_8 = List.FilterByBoolMask(list=filterByBoolMask_7.in, mask=eq_4)
code_block_22 = CodeBlock(x=code_block_16.out2)  # same code as code_block_17
code_block_23 = CodeBlock(usuario=code_block_22) { "02_TRABAJO_"+usuario+"_DETAIL"; }
duplicate_2 = archilab.Revit.Views.ViewTemplates.Duplicate(viewTemplate=filterByBoolMask_8.in, name=code_block_23)
code_block_24 = CodeBlock(usuario=code_block_22)
# ---------- code_block_24.designscript (15 lines) ----------
[
"Clasificacion",
"Subclasificacion",
"Zona",
"Discipline",
"Section Filter"
];

[
"02_TRABAJO",
usuario,
"GENERAL",
2,
usuario
];
# ----------------------------------------
setParameterByName = Element.SetParameterByName(element=duplicate_2, parameterName=code_block_24.out0, value=code_block_24.out1, lacing=Longest)
uniqueItems_2 = List.UniqueItems(list=setParameterByName)

# group: Filter Rule
code_block_25 = CodeBlock(x=code_block_16.out2)  # same code as code_block_17
code_block_26 = CodeBlock { "Sections"; }
byName_5 = Category.ByName(name=code_block_26)
code_block_27 = CodeBlock { "NotEquals"; }
element_types_ᶜᵒⁿᵛᵉʳᵗᵉᵈ_ᵈʳᵒᵖᵈᵒʷⁿ = CodeBlock { DSCore.Types.FindTypeByNameInAssembly("View", "RevitAPI"); }
all_elements_of_type = ElementsOfType(element_type=element_types_ᶜᵒⁿᵛᵉʳᵗᵉᵈ_ᵈʳᵒᵖᵈᵒʷⁿ)
code_block_28 = CodeBlock { "Section Filter"; }
parameterExists_2 = Custom[Element.ParameterExists](param=code_block_28, element=all_elements_of_type)
filterByBoolMask_9 = List.FilterByBoolMask(list=all_elements_of_type, mask=parameterExists_2)
parameterByName = Parameter.ParameterByName(element=filterByBoolMask_9.in, name=code_block_28)
firstItem = List.FirstItem(list=parameterByName)
byRuleType = Revit.Filter.FilterRule.ByRuleType(type=code_block_27, value=code_block_25, parameter=firstItem)
byRules = Revit.Filter.ParameterFilterElement.ByRules(name=code_block_25, categories=byName_5, rules=byRuleType)

byProperties = Revit.Filter.OverrideGraphicSettings.ByProperties()
code_block_29 = CodeBlock { false; }
setFilterOverrides = View.SetFilterOverrides(view=uniqueItems_2, parameterFilter=byRules, overrides=byProperties, hide=code_block_29)
setParameterByName_2 = Element.SetParameterByName(element=duplicate, parameterName=code_block_19, value=setFilterOverrides)
view_family_types_ᶜᵒⁿᵛᵉʳᵗᵉᵈ_2 = CodeBlock()  # "View Family Types ⁽ᶜᵒⁿᵛᵉʳᵗᵉᵈ ᵈʳᵒᵖᵈᵒʷⁿ⁾"
# ---------- view_family_types_ᶜᵒⁿᵛᵉʳᵗᵉᵈ_2.designscript (2 lines) ----------
//ElementType (Building Section);
Revit.Elements.ElementSelector.ByElementId(69334);
# ----------------------------------------
code_block_30 = CodeBlock(x=code_block_16.out2)  # same code as code_block_17
code_block_31 = CodeBlock(usuario=code_block_30) { "Building Section ("+usuario+")"; }
duplicate_3 = archilab.Revit.Elements.ElementTypes.Duplicate(element=view_family_types_ᶜᵒⁿᵛᵉʳᵗᵉᵈ_2, name=code_block_31)
code_block_32 = CodeBlock { "View Template applied to new views"; }

# group: View Template Detail
code_block_33 = CodeBlock { "Views"; }
byName_6 = Category.ByName(name=code_block_33)
all_elements_of_category_5 = ElementsOfCategory(Category=byName_6)
isViewTemplate_5 = View.IsViewTemplate()  # unwired: view
function_apply_3 = ApplyFunction(func=isViewTemplate_5, arg1=all_elements_of_category_5)
isNull_3 = Object.IsNull(obj=function_apply_3)
filterByBoolMask_10 = List.FilterByBoolMask(list=all_elements_of_category_5, mask=isNull_3)
isViewTemplate_6 = View.IsViewTemplate(view=filterByBoolMask_10.out)
filterByBoolMask_11 = List.FilterByBoolMask(list=filterByBoolMask_10.out, mask=isViewTemplate_6)
name_2 = Element.Name(element=filterByBoolMask_11.in)
code_block_34 = CodeBlock { "Architectural Section"; }
eq_5 = name_2 == code_block_34
filterByBoolMask_12 = List.FilterByBoolMask(list=filterByBoolMask_11.in, mask=eq_5)
code_block_35 = CodeBlock(x=code_block_16.out2)  # same code as code_block_17
code_block_36 = CodeBlock(usuario=code_block_35) { "02_TRABAJO_"+usuario+"_BUILDING SECTION"; }
duplicate_4 = archilab.Revit.Views.ViewTemplates.Duplicate(viewTemplate=filterByBoolMask_12.in, name=code_block_36)
code_block_37 = CodeBlock(usuario=code_block_35)  # same code as code_block_24
setParameterByName_3 = Element.SetParameterByName(element=duplicate_4, parameterName=code_block_37.out0, value=code_block_37.out1, lacing=Longest)
uniqueItems_3 = List.UniqueItems(list=setParameterByName_3)

byProperties_2 = Revit.Filter.OverrideGraphicSettings.ByProperties()
code_block_38 = CodeBlock { false; }
setFilterOverrides_2 = View.SetFilterOverrides(view=uniqueItems_3, parameterFilter=byRules, overrides=byProperties_2, hide=code_block_38)
setParameterByName_4 = Element.SetParameterByName(element=duplicate_3, parameterName=code_block_32, value=setFilterOverrides_2)
code_block_39 = CodeBlock(x=code_block_16.out2)
# ---------- code_block_39.designscript (4 lines) ----------
//levels
x[0];
//usuario
x[1];
# ----------------------------------------

# group: Crea y Nombra las Vistas
name_3 = Element.Name(element=code_block_39.out0)
code_block_40 = CodeBlock(usuario=code_block_39.out1, lvl_name=name_3) { usuario+"_CIELO_"+lvl_name; }
view_family_types_ᶜᵒⁿᵛᵉʳᵗᵉᵈ_3 = CodeBlock()  # "View Family Types ⁽ᶜᵒⁿᵛᵉʳᵗᵉᵈ ᵈʳᵒᵖᵈᵒʷⁿ⁾"
# ---------- view_family_types_ᶜᵒⁿᵛᵉʳᵗᵉᵈ_3.designscript (2 lines) ----------
//ElementType (Cielo);
Revit.Elements.ElementSelector.ByElementId(204495);
# ----------------------------------------
crear_vistas_de_planta = Python(IN[0]=code_block_39.out0, IN[1]=code_block_40, IN[2]=view_family_types_ᶜᵒⁿᵛᵉʳᵗᵉᵈ_3)
# ---------- crear_vistas_de_planta.python (108 lines) ----------
# Importaciones necesarias para la API de Revit y Dynamo
import clr

clr.AddReference('RevitAPI')
from Autodesk.Revit.DB import *

clr.AddReference('RevitServices')
import RevitServices
from RevitServices.Persistence import DocumentManager
from RevitServices.Transactions import TransactionManager

# Obtener el documento actual de Revit
doc = DocumentManager.Instance.CurrentDBDocument

# --- ENTRADAS DE DYNAMO ---
# IN[0]: Lista de elementos Nivel de Revit (Revit.Elements.Level)
# IN[1]: Lista de nombres (strings) para las nuevas vistas
# IN[2]: Elemento ViewFamilyType de Revit (Revit.Elements.ViewFamilyType)
input_levels = IN[0]
input_view_names = IN[1]
view_family_type_input = IN[2] # Nueva entrada para el elemento ViewFamilyType

# --- PARÁMETROS ADICIONALES ---
# (Opcional) Nombre de la plantilla de vista a aplicar (dejar como None si no se usa)
# view_template_name_input = IN[3] # Si quieres pasarla como input (cambia el índice si añades más inputs)

# --- VALIDACIÓN DE ENTRADAS ---
if not isinstance(input_levels, list):
    input_levels = [input_levels]  # Convertir a lista si es un solo elemento
if not isinstance(input_view_names, list):
    input_view_names = [input_view_names]  # Convertir a lista si es un solo elemento

if len(input_levels) == 0:
    OUT = "Error: La lista de niveles (IN[0]) está vacía."
elif len(input_view_names) == 0:
    OUT = "Error: La lista de nombres de vista (IN[1]) está vacía."
elif len(input_levels) != len(input_view_names):
    OUT = "Error: El número de niveles no coincide con el número de nombres de vista."
else: # A partir de aquí, validamos view_family_type_input
    # --- LÓGICA PRINCIPAL ---

    # 1. Obtener el Tipo de Familia de Vista (ViewFamilyType) desde la entrada directa
    target_vft = None
    if hasattr(view_family_type_input, 'InternalElement'):
        target_vft = view_family_type_input.InternalElement
    else:
        target_vft = view_family_type_input # Asumir que ya es un elemento de la API

    # Asegurarse de que el elemento de entrada es realmente un ViewFamilyType
    if not isinstance(target_vft, ViewFamilyType):
        OUT = "Error: La entrada del ViewFamilyType (IN[2]) no es un elemento ViewFamilyType válido."
    else:
        # (Opcional) Obtener la plantilla de vista si se proporcionó un nombre
        # view_template = None
        # if view_template_name_input:
        #     templates = FilteredElementCollector(doc).OfClass(View).WhereElementIsNotElementType().ToElements()
        #     for t in templates:
        #         if t.IsTemplate and t.Name == view_template_name_input:
        #             view_template = t
        #             break
        #     if not view_template:
        #         pass # print("Advertencia: Plantilla de vista '{}' no encontrada.".format(view_template_name_input))

        # 2. Iniciar una transacción para crear las vistas
        TransactionManager.Instance.EnsureInTransaction(doc)
        created_views_output = []

        # 3. Bucle para crear vistas usando las listas de entrada
        for i in range(len(input_levels)):
            level_element = input_levels[i]
            view_name = input_view_names[i]

            # Asegurarse de que el nivel sea un elemento Level de Revit
            if hasattr(level_element, 'InternalElement'):
                level_revit_element = level_element.InternalElement
            else:
                level_revit_element = level_element  # Asumir que ya es un elemento de la API

            if not isinstance(level_revit_element, Level):
                created_views_output.append("Error: El elemento en la posición {} de IN[0] no es un Nivel válido.".format(i))
                continue  # Saltar al siguiente elemento

            try:
                # Usamos ViewPlan.Create() para todos los tipos de plano.
                # El tipo específico (FloorPlan, StructuralPlan, etc.) se determina por target_vft.Id.
                new_view = ViewPlan.Create(doc, target_vft.Id, level_revit_element.Id)
                
                if new_view:
                    new_view.Name = view_name
                    
                    # (Opcional) Aplicar plantilla de vista
                    # if view_template:
                    #    new_view.ViewTemplateId = view_template.Id
                        
                    created_views_output.append(new_view)  # Devuelve el elemento de Revit
                else:
                    created_views_output.append("Error: No se pudo crear la vista para el nivel '{}'.".format(level_revit_element.Name))

            except Exception as e:
                error_message = "Error creando vista '{}' para nivel '{}': {}".format(view_name, level_revit_element.Name, str(e))
                # Comprobar si el error es por vista duplicada
                if "There is already a Plan View named" in str(e) or "ya existe una vista de plano denominada" in str(e):
                     error_message = "Ya existe una vista para el nivel '{}' con el nombre '{}' y tipo especificados.".format(level_revit_element.Name, view_name)
                created_views_output.append(error_message)

        # 4. Finalizar la transacción
        TransactionManager.Instance.TransactionTaskDone()
        OUT = created_views_output
# ----------------------------------------

code_block_41 = CodeBlock(x=code_block_16.out2)
# ---------- code_block_41.designscript (2 lines) ----------
//scale
x[2];
# ----------------------------------------
setScale = View.SetScale(view=crear_vistas_de_planta, scale=code_block_41)

# group: Asigna View Range
element_level = Custom[Element Level](element=setScale)  # package Genius Loci; Gets an element's level. Based on a Clockwork's node
levelAbove = Custom[Level.LevelAbove](level=element_level)  # package archi-lab.net; This node takes an input of level and returns level above it.
empty = List.Empty()
replacenulls = Custom[© ReplaceNulls](lst=levelAbove, replace=empty)  # package Crumple; Replaces all nulls with a given substitute.
code_block_42 = CodeBlock { 1000; 300; }
set_viewrange = Custom[Set ViewRange](view=setScale, TopLevel=replacenulls, Top=code_block_42.out1, CutLevel=element_level, CutPlane=code_block_42.out0, BottomLevel=element_level, Bottom=code_block_42.out0, DepthLevel=replacenulls, ViewDepth=code_block_42.out1, lacing=Longest)  # package Genius Loci; Set the view range of the given plan view.

code_block_43 = CodeBlock { "View Template"; }

# group: Crear View Template Plantas Cielo
code_block_44 = CodeBlock { "Views"; }
byName_7 = Category.ByName(name=code_block_44)
all_elements_of_category_6 = ElementsOfCategory(Category=byName_7)
isViewTemplate_7 = View.IsViewTemplate()  # unwired: view
function_apply_4 = ApplyFunction(func=isViewTemplate_7, arg1=all_elements_of_category_6)
isNull_4 = Object.IsNull(obj=function_apply_4)
filterByBoolMask_13 = List.FilterByBoolMask(list=all_elements_of_category_6, mask=isNull_4)
isViewTemplate_8 = View.IsViewTemplate(view=filterByBoolMask_13.out)
filterByBoolMask_14 = List.FilterByBoolMask(list=filterByBoolMask_13.out, mask=isViewTemplate_8)
name_4 = Element.Name(element=filterByBoolMask_14.in)
code_block_45 = CodeBlock { "Architectural Reflected Ceiling Plan"; }
eq_6 = name_4 == code_block_45
filterByBoolMask_15 = List.FilterByBoolMask(list=filterByBoolMask_14.in, mask=eq_6)
code_block_46 = CodeBlock(x=code_block_16.out2)  # same code as code_block_17
code_block_47 = CodeBlock(categoria=code_block_46) { "02_TRABAJO_"+categoria+"_STRUCTURAL PLAN (CIELO)"; }
duplicate_5 = archilab.Revit.Views.ViewTemplates.Duplicate(viewTemplate=filterByBoolMask_15.in, name=code_block_47)

code_block_48 = CodeBlock(x=code_block_16.out2)  # same code as code_block_17
code_block_49 = CodeBlock(usuario=code_block_48)
# ---------- code_block_49.designscript (15 lines) ----------
DSCore.List.Flatten(
[
"Clasificacion",
"Subclasificacion",
"Section Filter",
"Zona"
]);

DSCore.List.Flatten(
[
"02_TRABAJO",
usuario,
usuario,
"GENERAL"
]);
# ----------------------------------------
setParameterByName_5 = Element.SetParameterByName(element=duplicate_5, parameterName=code_block_49.out0, value=code_block_49.out1, lacing=Longest)
uniqueItems_4 = List.UniqueItems(list=setParameterByName_5)
setParameterByName_6 = Element.SetParameterByName(element=set_viewrange, parameterName=code_block_43, value=uniqueItems_4, lacing=Longest)

# group: Title on Sheet
code_block_50 = CodeBlock { "Title on Sheet"; }
code_block_51 = CodeBlock { "Associated Level"; }
getParameterValueByName_4 = Element.GetParameterValueByName(element=setParameterByName_6, parameterName=code_block_51)
code_block_52 = CodeBlock(level_name=getParameterValueByName_4) { "PLANTA ESTRUCTURA CIELO " + level_name; }
setParameterByName_7 = Element.SetParameterByName(element=setParameterByName_6, parameterName=code_block_50, value=code_block_52)

code_block_53 = CodeBlock(x=code_block_16.out2)  # same code as code_block_39

# group: Crea y Nombra las Vistas
name_5 = Element.Name(element=code_block_53.out0)
code_block_54 = CodeBlock(usuario=code_block_53.out1, lvl_name=name_5) { usuario+"_PISO_"+lvl_name; }
view_family_types_ᶜᵒⁿᵛᵉʳᵗᵉᵈ_4 = CodeBlock()  # "View Family Types ⁽ᶜᵒⁿᵛᵉʳᵗᵉᵈ ᵈʳᵒᵖᵈᵒʷⁿ⁾"
# ---------- view_family_types_ᶜᵒⁿᵛᵉʳᵗᵉᵈ_4.designscript (2 lines) ----------
//ElementType (Piso);
Revit.Elements.ElementSelector.ByElementId(92026);
# ----------------------------------------

crear_vistas_de_planta_2 = Python(IN[0]=code_block_53.out0, IN[1]=code_block_54, IN[2]=view_family_types_ᶜᵒⁿᵛᵉʳᵗᵉᵈ_4)  # same code as crear_vistas_de_planta
code_block_55 = CodeBlock(x=code_block_16.out2)  # same code as code_block_41
setScale_2 = View.SetScale(view=crear_vistas_de_planta_2, scale=code_block_55)

# group: Asigna View Range
element_level_2 = Custom[Element Level](element=setScale_2)
code_block_56 = CodeBlock { 750; -1500; }
set_viewrange_2 = Custom[Set ViewRange](view=setScale_2, TopLevel=element_level_2, Top=code_block_56.out0, CutLevel=element_level_2, CutPlane=code_block_56.out0, BottomLevel=element_level_2, Bottom=code_block_56.out1, DepthLevel=element_level_2, ViewDepth=code_block_56.out1, lacing=Longest)

code_block_57 = CodeBlock { "View Template"; }

# group: Crear View Template Plantas Piso
code_block_58 = CodeBlock { "Views"; }
byName_8 = Category.ByName(name=code_block_58)
all_elements_of_category_7 = ElementsOfCategory(Category=byName_8)
isViewTemplate_9 = View.IsViewTemplate()  # unwired: view
function_apply_5 = ApplyFunction(func=isViewTemplate_9, arg1=all_elements_of_category_7)
isNull_5 = Object.IsNull(obj=function_apply_5)
filterByBoolMask_16 = List.FilterByBoolMask(list=all_elements_of_category_7, mask=isNull_5)
isViewTemplate_10 = View.IsViewTemplate(view=filterByBoolMask_16.out)
filterByBoolMask_17 = List.FilterByBoolMask(list=filterByBoolMask_16.out, mask=isViewTemplate_10)
name_6 = Element.Name(element=filterByBoolMask_17.in)
code_block_59 = CodeBlock { "Structural Foundation Plan"; }
eq_7 = name_6 == code_block_59
filterByBoolMask_18 = List.FilterByBoolMask(list=filterByBoolMask_17.in, mask=eq_7)
code_block_60 = CodeBlock(x=code_block_16.out2)  # same code as code_block_17
code_block_61 = CodeBlock(usuario=code_block_60) { "02_TRABAJO_"+usuario+"_STRUCTURAL PLAN (PISO)"; }
duplicate_6 = archilab.Revit.Views.ViewTemplates.Duplicate(viewTemplate=filterByBoolMask_18.in, name=code_block_61)

byProperties_3 = Revit.Filter.OverrideGraphicSettings.ByProperties()
code_block_62 = CodeBlock { false; }
setFilterOverrides_3 = View.SetFilterOverrides(view=duplicate_6, parameterFilter=byRules, overrides=byProperties_3, hide=code_block_62)
code_block_63 = CodeBlock(x=code_block_16.out2)  # same code as code_block_17
code_block_64 = CodeBlock(usuario=code_block_63)  # same code as code_block_49
setParameterByName_8 = Element.SetParameterByName(element=setFilterOverrides_3, parameterName=code_block_64.out0, value=code_block_64.out1, lacing=Longest)
uniqueItems_5 = List.UniqueItems(list=setParameterByName_8)
setParameterByName_9 = Element.SetParameterByName(element=set_viewrange_2, parameterName=code_block_57, value=uniqueItems_5, lacing=Longest)

# group: Title on Sheet
code_block_65 = CodeBlock { "Title on Sheet"; }
code_block_66 = CodeBlock { "Associated Level"; }
getParameterValueByName_5 = Element.GetParameterValueByName(element=setParameterByName_9, parameterName=code_block_66)
code_block_67 = CodeBlock(level_name=getParameterValueByName_5) { "PLANTA ESTRUCTURA PISO " + level_name; }

python_script_3 = Python(IN[0]=setParameterByName_9, IN[1]=code_block_67)
# ---------- python_script_3.python (10 lines) ----------
def cuenta_elementos(lista, titulos):
    if len(lista) == 2:
        return ["PLANTA FUNDACION", "PLANTA RADIER"]
    else:
        return titulos

elem = IN[0]
titulos = IN[1]

OUT = cuenta_elementos(elem, titulos)
# ----------------------------------------

# group (continued): Title on Sheet
setParameterByName_10 = Element.SetParameterByName(element=setParameterByName_9, parameterName=code_block_65, value=python_script_3)

byProperties_4 = Revit.Filter.OverrideGraphicSettings.ByProperties()
code_block_68 = CodeBlock { false; }
setFilterOverrides_4 = View.SetFilterOverrides(view=uniqueItems_4, parameterFilter=byRules, overrides=byProperties_4, hide=code_block_68)
code_block_69 = CodeBlock()
# ---------- code_block_69.designscript (5 lines) ----------
//Tittle
"Error";

//TextNote
"Las vistas de esta Usuario ya fueron generadas. Para vistas adicionales, duplicar de las ya existentes.";
# ----------------------------------------
textnote_data = Custom[TextNote Data](Title=code_block_69.out0, TextNote=code_block_69.out1)  # package Data-Shapes; Create Data for TextNote input in UI.MultipleInputForm ++ . Check out www.data-shapes.net for more informations
isNull_6 = Object.IsNull(obj=empty_list_to_null)
code_block_70 = CodeBlock { true; false; }
scopeIf = Custom[ScopeIf+](test=isNull_6, True=code_block_70.out1, False=code_block_70.out0)  # package Clockwork for Dynamo 2.x; A (hopefully) more robust implementation of ScopeIf. Tests a single boolean and returns a value accordingly.
code_block_71 = CodeBlock(inputs=textnote_data, toggle=scopeIf)
# ---------- code_block_71.designscript (29 lines) ----------
//Description_optional
"Vistas por Usuario";

//Logo


//ButtonText
"OK";

//Inputs
inputs;

//Toggle
toggle;

//LinkToHelp


//CancelButtonText


//MaxHeight


//Width
490;

//LabelWidth
150;
# ----------------------------------------
multipleinputform_2 = Custom[MultipleInputForm ++](Description_optional=code_block_71.out0, ButtonText_optional=code_block_71.out1, Inputs=code_block_71.inputs, Toggle=code_block_71.toggle, Width_optional=code_block_71.out4, LabelWidth_optional=code_block_71.out5)
