# Dynamo graph exportarLaminasFechaEntrega_script.dyn (Dynamo 2.6.2.15705)
# packages: Data-Shapes 2022.2.103, Clockwork for Dynamo 2.x 2.4.0, Genius Loci 2021.11.10, Crumple 2022.2.13

directory_path = Directory("C:\RVT_FILES\01_PDF")
code_block = CodeBlock { "Sheets"; }
byName = Category.ByName(name=code_block)
all_elements_of_category = ElementsOfCategory(Category=byName)
sheetName = Sheet.SheetName(sheet=all_elements_of_category)
code_block_2 = CodeBlock { "Splash Screen"; }
eq = sheetName == code_block_2
filterByBoolMask = List.FilterByBoolMask(list=all_elements_of_category, mask=eq)
code_block_3 = CodeBlock { "Validacion"; }
code_block_4 = CodeBlock { "Project Information"; }
byName_2 = Category.ByName(name=code_block_4)
all_elements_of_category_2 = ElementsOfCategory(Category=byName_2)
parameterExists = Custom[Element.ParameterExists](param=code_block_3, element=all_elements_of_category_2)  # package Clockwork for Dynamo 2.x; Checks if an element contains a parameter of a given name
today = DateTime.Today()
code_block_5 = CodeBlock { "yyyy.MM.dd"; }
format = DateTime.Format(dateTime=today, format=code_block_5)
code_block_6 = CodeBlock(fecha=format)
# ---------- code_block_6.designscript (6 lines) ----------
//InputName
"Nombre de la Carpeta:";
//DefaultText
fecha + "_Entrega";
//IsNumberEntry
false;
# ----------------------------------------
textbox_data = Custom[TextBox Data](InputName=code_block_6.out0, DefaultText=code_block_6.out1, IsNumberEntry=code_block_6.out2)  # package Data-Shapes; Create Data for TextBox input in UI.MultipleInputForm ++ . Check out www.data-shapes.net for more informations
code_block_7 = CodeBlock { "Sheets"; }
byName_3 = Category.ByName(name=code_block_7)
all_elements_of_category_3 = ElementsOfCategory(Category=byName_3)
sheetName_2 = Sheet.SheetName(sheet=all_elements_of_category_3)
code_block_8 = CodeBlock { "Splash Screen"; }
eq_2 = sheetName_2 == code_block_8
filterByBoolMask_2 = List.FilterByBoolMask(list=all_elements_of_category_3, mask=eq_2)
parameters = Element.Parameters(element=filterByBoolMask_2.out)
name = Parameter.Name(parameter=parameters)
string_from_object = FromObject(obj=name)
code_block_9 = CodeBlock()
# ---------- code_block_9.designscript (8 lines) ----------
[
"_NUM",
"_DES",
"_DIB",
"_REV",
"_APR",
"_FCH"
];
# ----------------------------------------
contains = String.Contains(str=string_from_object@@L1, searchFor=code_block_9@L2, lacing=Longest)
anyTrue = Custom[Booleans.AnyTrue](seq=contains)  # package Clockwork for Dynamo 2.x; Returns true if any item in a list of booleans is true.
filterByBoolMask_3 = List.FilterByBoolMask(list=parameters, mask=anyTrue)
name_2 = Parameter.Name(parameter=filterByBoolMask_3.in)
flatten = List.Flatten(list=name_2)
uniqueItems = List.UniqueItems(list=flatten)
code_block_10 = CodeBlock { "FCH"; }
contains_2 = String.Contains(str=uniqueItems, searchFor=code_block_10)
filterByBoolMask_4 = List.FilterByBoolMask(list=uniqueItems, mask=contains_2)
getParameterValueByName = Element.GetParameterValueByName(element=filterByBoolMask_2.out@L1, parameterName=filterByBoolMask_4.in@L2, lacing=Longest)
flatten_2 = List.Flatten(list=getParameterValueByName)
uniqueItems_2 = List.UniqueItems(list=flatten_2)
list_clean = Custom[List Clean](list=uniqueItems_2)  # package Genius Loci; Removes all Null, Empty and Blank from a list or nested list of lists.
code_block_11 = CodeBlock(keys=list_clean, values=list_clean)
# ---------- code_block_11.designscript (10 lines) ----------
//InputName
"Fechas";
//Keys_
keys;
//Values_
values;
//DefaultValueIndex
0;
//Sorted_
false;
# ----------------------------------------
dropdown_data = Custom[DropDown Data](InputName=code_block_11.out0, Keys=code_block_11.keys, Values=code_block_11.values, DefaultValueIndex=code_block_11.out3, Sorted_optional=code_block_11.out4)  # package Data-Shapes; Create data for DropDown input in UI.MultiInputForm ++ . Check out www.data-shapes.net for more infos.
code_block_12 = CodeBlock(inputs=dropdown_data)
# ---------- code_block_12.designscript (4 lines) ----------
//GroupTitle
"Seleccionar una Fecha";
//Inputs
inputs;
# ----------------------------------------
inputgroup_data = Custom[InputGroup Data](GroupTitle=code_block_12.out0, Inputs=code_block_12.inputs)  # package Data-Shapes; Creates a group of inputs for UI.MultipleInputForm ++ . Check out www.data-shapes.net for more infos !
list_create = List.Create(item0=textbox_data, item1=inputgroup_data)
python_script = Python(IN[0]=parameterExists, IN[1]=list_create)
# ---------- python_script.python (9 lines) ----------
validacion = IN[0][0]
inputs = IN[1]

if validacion == True:
	res = inputs
else:
	res = []

OUT = res
# ----------------------------------------
code_block_13 = CodeBlock(inputs=python_script)
# ---------- code_block_13.designscript (29 lines) ----------
//Description_optional
"Exportar Laminas Seleccionadas";

//Logo


//ButtonText
"INICIAR";

//Inputs
inputs;

//Toggle
true;

//LinkToHelp


//CancelButtonText
"CANCELAR";

//MaxHeight
900;

//Width
500;

//LabelWidth
150;
# ----------------------------------------
multipleinputform = Custom[MultipleInputForm ++](Description_optional=code_block_13.out0, ButtonText_optional=code_block_13.out1, Inputs=code_block_13.inputs, Toggle=code_block_13.out3, CancelButtonText_optional=code_block_13.out4, MaxHeight_optional=code_block_13.out5, Width_optional=code_block_13.out6, LabelWidth_optional=code_block_13.out7)  # package Data-Shapes; Create a form with multiple inputs. see www.data-shapes.net for tutorials and infos!
python_script_2 = Python(IN[0]=multipleinputform.User_Inputs)
# ---------- python_script_2.python (7 lines) ----------
input = IN[0]

if input == [] or input == None:
	res = []
else:
	res = input[1]
OUT = res
# ----------------------------------------
parameters_2 = Element.Parameters(element=filterByBoolMask.out)
name_3 = Parameter.Name(parameter=parameters_2)
string_from_object_2 = FromObject(obj=name_3)
code_block_14 = CodeBlock()  # same code as code_block_9
contains_3 = String.Contains(str=string_from_object_2@@L1, searchFor=code_block_14@L2, lacing=Longest)
anyTrue_2 = Custom[Booleans.AnyTrue](seq=contains_3)
filterByBoolMask_5 = List.FilterByBoolMask(list=name_3, mask=anyTrue_2)
string_from_object_3 = FromObject(obj=filterByBoolMask_5.in)
code_block_15 = CodeBlock { "FCH"; }
contains_4 = String.Contains(str=string_from_object_3, searchFor=code_block_15)
filterByBoolMask_6 = List.FilterByBoolMask(list=filterByBoolMask_5.in, mask=contains_4)
getParameterValueByName_2 = Element.GetParameterValueByName(element=filterByBoolMask.out, parameterName=filterByBoolMask_6.in)
eq_3 = python_script_2 == getParameterValueByName_2
anyTrue_3 = Custom[Booleans.AnyTrue](seq=eq_3)
filterByBoolMask_7 = List.FilterByBoolMask(list=filterByBoolMask.out, mask=anyTrue_3)
sheetNumber = Sheet.SheetNumber(sheet=filterByBoolMask_7.in)
sheetName_3 = Sheet.SheetName(sheet=filterByBoolMask_7.in)
code_block_16 = CodeBlock(sheetNumber=sheetNumber, sheetName=sheetName_3) { sheetNumber+" - "+sheetName; }
filenameToFilePaths = Custom[FilenameToFilePaths](DirectoryPath=directory_path, Filenames=code_block_16)  # package Genius Loci; Add directory and .pdf extension to filenames. Be careful with forbidden characters in filenames (* . " / \ : ;) For use with the "Remove Special Characters from String" node.
code_block_17 = CodeBlock { "PDFCreator_A0"; }
print_settings_byname = Custom[Print Settings ByName](printSettingsName=code_block_17)  # package Genius Loci; Collect printsettings by given name in the active or given document.
code_block_18 = CodeBlock(file=filenameToFilePaths, views=filterByBoolMask_7.in, setting=print_settings_byname)
# ---------- code_block_18.designscript (12 lines) ----------
//FilePaths
file;
//views
views;
//PrintSetting
setting;
//PrinterName
"PDFCreator";
//PrintRange
"Select";
//RunIt
true;
# ----------------------------------------
print_pdf_multiple_formats = Custom[Print PDF (multiple formats)](FilePaths=code_block_18.file, views=code_block_18.views, PrintSetting=code_block_18.setting, PrinterName=code_block_18.out3, PrintRange=code_block_18.out4, RunIt=code_block_18.out5)  # package Genius Loci; Initiate a printing routine from a set of views/sheets, filename, printer name, print settings with many formats and print range. Note: With identical names, existing PDF files will be overwritten. Based on an archilab node.
passthrough = Custom[Passthrough](passThrough=directory_path, waitFor=print_pdf_multiple_formats)  # package Clockwork for Dynamo 2.x; Forces a sequential order of execution. The node wired into the output of the Passthrough node will be executed *after* the node wired into the waitFor input (e.g. important for some Revit operations). The value of the passThrough input will be passed on to the node wired into the output port of the Passthrough node.
code_block_19 = CodeBlock { 4; }
delay = Custom[© Delay](data=passthrough, seconds=code_block_19)  # package Crumple; Given a duration in seconds and some data, this script will delay that data by the given time. A threshold of 3 seconds is used by default to stop an undesirable number being provided.
directory_from_path = DirectoryObject(path=delay.data)
getDirectoryContents = FileSystem.GetDirectoryContents(directory=directory_from_path)
code_block_20 = CodeBlock { "\\"; }
split = String.Split(str=getDirectoryContents.files, separator0=code_block_20)
python_script_3 = Python(IN[0]=split)
# ---------- python_script_3.python (7 lines) ----------
input = IN[0]

if input == [] or input == None:
	res = [None, None, None, None]
else:
	res = input
OUT = res
# ----------------------------------------
code_block_21 = CodeBlock { 3; }
getItemAtIndex = List.GetItemAtIndex(list=python_script_3@L2, index=code_block_21)
python_script_4 = Python(IN[0]=getItemAtIndex)
# ---------- python_script_4.python (7 lines) ----------
input = IN[0]

if input[0] == None:
	res = []
else:
	res = input
OUT = res
# ----------------------------------------
code_block_22 = CodeBlock { 0; 2; }
substring = String.Substring(str=python_script_4, startIndex=code_block_22.out0, length=code_block_22.out1)
groupByKey = List.GroupByKey(list=getDirectoryContents.files, keys=substring)
python_script_5 = Python(IN[0]=multipleinputform.User_Inputs)
# ---------- python_script_5.python (7 lines) ----------
input = IN[0]

if input == [] or input == None:
	res = []
else:
	res = input[0]
OUT = res
# ----------------------------------------
code_block_23 = CodeBlock { "\\"; }
split_2 = String.Split(str=getDirectoryContents.files, separator0=code_block_23)
python_script_6 = Python(IN[0]=split_2)  # same code as python_script_3
code_block_24 = CodeBlock { 3; }
getItemAtIndex_2 = List.GetItemAtIndex(list=python_script_6@L2, index=code_block_24)
list_clean_2 = Custom[List Clean](list=getItemAtIndex_2)
code_block_25 = CodeBlock { 0; 2; }
substring_2 = String.Substring(str=list_clean_2, startIndex=code_block_25.out0, length=code_block_25.out1)
code_block_26 = CodeBlock(carpeta=python_script_5, cat=substring_2, files=list_clean_2) { "C:\\RVT_FILES\\" + carpeta + "\\01_PDF\\"+cat+"\\"+files; }
code_block_27 = CodeBlock(carpeta=python_script_5, cat=substring_2) { "C:\\RVT_FILES\\" + carpeta + "\\01_PDF\\"+cat; }
directory_from_path_2 = DirectoryObject(path=code_block_27)
waitfor = Custom[© WaitFor](data=code_block_26, waitFor=directory_from_path_2)  # package Crumple; Tells the first input to wait for the second input to arrive, then passes on the first input. Really useful for scripts which have branching paths that rely on their outputs to carry each other forward. Quite a few custom packages have a 'passthrough' or 'waitfor' node. I use these all the time, so find it useful to have them contained in this package also.
code_block_28 = CodeBlock { "\\"; }
split_3 = String.Split(str=waitfor, separator0=code_block_28)
python_script_7 = Python(IN[0]=split_3)
# ---------- python_script_7.python (7 lines) ----------
input = IN[0]

if input == [] or input == None:
	res = [None, None, None, None, None]
else:
	res = input
OUT = res
# ----------------------------------------
code_block_29 = CodeBlock { 4; }
getItemAtIndex_3 = List.GetItemAtIndex(list=python_script_7@L2, index=code_block_29)
list_clean_3 = Custom[List Clean](list=getItemAtIndex_3)
groupByKey_2 = List.GroupByKey(list=waitfor, keys=list_clean_3)
code_block_30 = CodeBlock(path=groupByKey.groups, newPath=groupByKey_2.groups)
# ---------- code_block_30.designscript (6 lines) ----------
//path
path;
//newPath
newPath;
//overwrite
true;
# ----------------------------------------
python_script_8 = Python(IN[0]=code_block_30.newPath)
# ---------- python_script_8.python (7 lines) ----------
input = IN[0]

if input == []:
	res = []
else:
	res = True
OUT = res
# ----------------------------------------
moveFile = FileSystem.MoveFile(path=code_block_30.path@L2, newPath=code_block_30.newPath@L2, overwrite=python_script_8, lacing=Longest)
code_block_31 = CodeBlock(view=filterByBoolMask_7.in, fileName=code_block_16)
# ---------- code_block_31.designscript (16 lines) ----------
//docOrRevitLinkInstance

//DirectoryPath
"C:\\RVT_FILES\\00_DWG";
//View
view;
//FileName
fileName;
//ExportSetup
"Default";
//SharedCoords
true;
//MargeViews
true;
//RunIt
true;
# ----------------------------------------
export_dwg_in_document = Custom[Export DWG in Document](DirectoryPath=code_block_31.out0, view=code_block_31.view, Filename=code_block_31.fileName, ExportSetup=code_block_31.out3, SharedCoords=code_block_31.out4, MergeViews=code_block_31.out5, RunIt=code_block_31.out6)  # package Genius Loci; Export views to DWG with export setup in the active or given document. Based on a script by Konrad K Sobon.
passthrough_2 = Custom[Passthrough](passThrough=code_block_31.out0, waitFor=export_dwg_in_document)
code_block_32 = CodeBlock { 4; }
delay_2 = Custom[© Delay](data=passthrough_2, seconds=code_block_32)
directory_from_path_3 = DirectoryObject(path=delay_2.data)
getDirectoryContents_2 = FileSystem.GetDirectoryContents(directory=directory_from_path_3)
code_block_33 = CodeBlock { "\\"; }
split_4 = String.Split(str=getDirectoryContents_2.files, separator0=code_block_33)
python_script_9 = Python(IN[0]=split_4)  # same code as python_script_3
code_block_34 = CodeBlock { 3; }
getItemAtIndex_4 = List.GetItemAtIndex(list=python_script_9@L2, index=code_block_34)
python_script_10 = Python(IN[0]=getItemAtIndex_4)  # same code as python_script_4
code_block_35 = CodeBlock { 0; 2; }
substring_3 = String.Substring(str=python_script_10, startIndex=code_block_35.out0, length=code_block_35.out1)
groupByKey_3 = List.GroupByKey(list=getDirectoryContents_2.files, keys=substring_3)
code_block_36 = CodeBlock { "\\"; }
split_5 = String.Split(str=getDirectoryContents_2.files, separator0=code_block_36)
python_script_11 = Python(IN[0]=split_5)  # same code as python_script_3
code_block_37 = CodeBlock { 3; }
getItemAtIndex_5 = List.GetItemAtIndex(list=python_script_11@L2, index=code_block_37)
list_clean_4 = Custom[List Clean](list=getItemAtIndex_5)
code_block_38 = CodeBlock { 0; 2; }
substring_4 = String.Substring(str=list_clean_4, startIndex=code_block_38.out0, length=code_block_38.out1)
code_block_39 = CodeBlock(carpeta=python_script_5, cat=substring_4, files=list_clean_4) { "C:\\RVT_FILES\\" + carpeta + "\\00_DWG\\"+cat+"\\"+files; }
code_block_40 = CodeBlock(carpeta=python_script_5, cat=substring_4) { "C:\\RVT_FILES\\" + carpeta + "\\00_DWG\\"+cat; }
directory_from_path_4 = DirectoryObject(path=code_block_40)
waitfor_2 = Custom[© WaitFor](data=code_block_39, waitFor=directory_from_path_4)
code_block_41 = CodeBlock { "\\"; }
split_6 = String.Split(str=waitfor_2, separator0=code_block_41)
python_script_12 = Python(IN[0]=split_6)  # same code as python_script_7
code_block_42 = CodeBlock { 4; }
getItemAtIndex_6 = List.GetItemAtIndex(list=python_script_12@L2, index=code_block_42)
list_clean_5 = Custom[List Clean](list=getItemAtIndex_6)
groupByKey_4 = List.GroupByKey(list=waitfor_2, keys=list_clean_5)
code_block_43 = CodeBlock(path=groupByKey_3.groups, newPath=groupByKey_4.groups)  # same code as code_block_30
python_script_13 = Python(IN[0]=code_block_43.newPath)  # same code as python_script_8
moveFile_2 = FileSystem.MoveFile(path=code_block_43.path@L2, newPath=code_block_43.newPath@L2, overwrite=python_script_13, lacing=Longest)
