# Dynamo graph eliminarEnLaminaActual_script.dyn (Dynamo 2.6.2.15705)
# packages: Data-Shapes 2022.2.103, Clockwork for Dynamo 2.x 2.4.0, archi-lab.net 2022.210.2419

code_block = CodeBlock { "Validacion"; }
code_block_2 = CodeBlock { "Project Information"; }
byName = Category.ByName(name=code_block_2)
all_elements_of_category = ElementsOfCategory(Category=byName)
parameterExists = Custom[Element.ParameterExists](param=code_block, element=all_elements_of_category)  # package Clockwork for Dynamo 2.x; Checks if an element contains a parameter of a given name
code_block_3 = CodeBlock()
# ---------- code_block_3.designscript (8 lines) ----------
//InputName
"Eliminar Nubes?:";
//Keys
["Si", "No"];
//Values
[true, false];
//Default
0;
# ----------------------------------------
radiobuttons_data = Custom[RadioButtons Data](InputName=code_block_3.out0, Keys=code_block_3.out1, Values=code_block_3.out2, DefaultValueIndex=code_block_3.out3)  # package Data-Shapes; Create radio buttons input for UI.MultipleInputForm ++ .
python_script = Python(IN[0]=parameterExists, IN[1]=radiobuttons_data)
# ---------- python_script.python (9 lines) ----------
validacion = IN[0][0]
inputs = IN[1]

if validacion == True:
	res = inputs
else:
	res = []

OUT = res
# ----------------------------------------
code_block_4 = CodeBlock(inputs=python_script)
# ---------- code_block_4.designscript (29 lines) ----------
//Description_optional
"Eliminar Nubes de Revision";

//Logo


//ButtonText
"ACEPTAR";

//Inputs
inputs;

//Toggle
true;

//LinkToHelp


//CancelButtonText
"CANCELAR";

//MaxHeight
900;

//Width
430;

//LabelWidth
150;
# ----------------------------------------
multipleinputform = Custom[MultipleInputForm ++](Description_optional=code_block_4.out0, ButtonText_optional=code_block_4.out1, Inputs=code_block_4.inputs, Toggle=code_block_4.out3, CancelButtonText_optional=code_block_4.out4, MaxHeight_optional=code_block_4.out5, Width_optional=code_block_4.out6, LabelWidth_optional=code_block_4.out7)  # package Data-Shapes; Create a form with multiple inputs. see www.data-shapes.net for tutorials and infos!
code_block_5 = CodeBlock { "Revision Clouds"; }
byName_2 = Category.ByName(name=code_block_5)
current = Document.Current()
activeView = Document.ActiveView(document=current)
all_elements_of_category_in_view = ElementsOfCategoryInView(Category=byName_2, View=activeView)
code_block_6 = CodeBlock { "Revision Clouds"; }
byName_3 = Category.ByName(name=code_block_6)
views = Sheet.Views(sheet=activeView)
all_elements_of_category_in_view_2 = ElementsOfCategoryInView(Category=byName_3, View=views)
list_create = List.Create(item0=all_elements_of_category_in_view, item1=all_elements_of_category_in_view_2)
flatten = List.Flatten(list=list_create)
python_script_2 = Python(IN[0]=multipleinputform.User_Inputs, IN[1]=flatten)
# ---------- python_script_2.python (8 lines) ----------
input = IN[0]
clouds = IN[1]

if input == [] or input == None or input[0] == False:
	res = []
else:
	res = clouds
OUT = res
# ----------------------------------------
delete = archilab.Revit.Elements.Elements.Delete(element=python_script_2)
count = List.Count(list=delete)
python_script_3 = Python(IN[0]=count)
# ---------- python_script_3.python (7 lines) ----------
input = IN[0]

if input == []:
	res = 0
else:
	res = input
OUT = res
# ----------------------------------------
string_from_object = FromObject(obj=python_script_3)
code_block_7 = CodeBlock(num=string_from_object)
# ---------- code_block_7.designscript (4 lines) ----------
//Title

//TextNote_
"Se han eliminado " + num + " nubes de revision.";
# ----------------------------------------
textnote_data = Custom[TextNote Data](TextNote=code_block_7)  # package Data-Shapes; Create Data for TextNote input in UI.MultipleInputForm ++ . Check out www.data-shapes.net for more informations
python_script_4 = Python(IN[0]=delete)
# ---------- python_script_4.python (7 lines) ----------
input = IN[0]

if input == []:
	res = False
else:
	res = True
OUT = res
# ----------------------------------------
code_block_8 = CodeBlock(inputs=textnote_data, toggle=python_script_4)
# ---------- code_block_8.designscript (29 lines) ----------
//Description_optional
"Eliminar Nubes de Revision";

//Logo


//ButtonText
"ACEPTAR";

//Inputs
inputs;

//Toggle
toggle;

//LinkToHelp


//CancelButtonText


//MaxHeight
900;

//Width
430;

//LabelWidth
150;
# ----------------------------------------
multipleinputform_2 = Custom[MultipleInputForm ++](Description_optional=code_block_8.out0, ButtonText_optional=code_block_8.out1, Inputs=code_block_8.inputs, Toggle=code_block_8.toggle, MaxHeight_optional=code_block_8.out4, Width_optional=code_block_8.out5, LabelWidth_optional=code_block_8.out6)
