# Dynamo graph eliminarNubesMultipleLaminas_script.dyn (Dynamo 2.6.2.15705)
# packages: Data-Shapes 2022.2.103, Clockwork for Dynamo 2.x 2.4.0, archi-lab.net 2022.210.2419

code_block = CodeBlock { "Revision Clouds"; }
byName = Category.ByName(name=code_block)
code_block_2 = CodeBlock { "Validacion"; }
code_block_3 = CodeBlock { "Project Information"; }
byName_2 = Category.ByName(name=code_block_3)
all_elements_of_category = ElementsOfCategory(Category=byName_2)
parameterExists = Custom[Element.ParameterExists](param=code_block_2, element=all_elements_of_category)  # package Clockwork for Dynamo 2.x; Checks if an element contains a parameter of a given name
code_block_4 = CodeBlock { "Sheets"; }
byName_3 = Category.ByName(name=code_block_4)
all_elements_of_category_2 = ElementsOfCategory(Category=byName_3)
name = Custom[Element.Name+](element=all_elements_of_category_2)  # package Clockwork for Dynamo 2.x; Gets an element's name. Unlike the OOTB node, this node should work for *all* Revit elements that have names and will also return the localized names of system parameters, parameter groups, display unit types, parameter types, unit symbol types, unit types and ForgeTypeIds.
code_block_5 = CodeBlock { "Splash"; }
contains = String.Contains(str=name, searchFor=code_block_5)
filterByBoolMask = List.FilterByBoolMask(list=all_elements_of_category_2, mask=contains)
code_block_6 = CodeBlock { "Clasificacion"; }
getParameterValueByName = Element.GetParameterValueByName(element=filterByBoolMask.out, parameterName=code_block_6)
groupByKey = List.GroupByKey(list=filterByBoolMask.out, keys=getParameterValueByName)
code_block_7 = CodeBlock(clasificacion=groupByKey.unique_keys) { "Laminas "+clasificacion; }
sheetNumber = Sheet.SheetNumber(sheet=groupByKey.groups@L2)
sheetName = Sheet.SheetName(sheet=groupByKey.groups@L2)
code_block_8 = CodeBlock(sheetNumber=sheetNumber, sheetName=sheetName) { sheetNumber+" - "+sheetName; }
code_block_9 = CodeBlock(inputName=code_block_7, keys=code_block_8, values=groupByKey.groups)
# ---------- code_block_9.designscript (20 lines) ----------
//InputName
inputName;
//Keys_
keys;
//Values_
values;
//Height_optional
250;
//HilightInView_optionnal
false;
//DisplayModeOnly_optional
false;
//ShowElementCount_optionnal
false;
//DefaultValuesIndices_optionnal
[];
//SortItems_optionnal
true;
//ShowId_optionnal
false;
# ----------------------------------------
listview_data = Custom[Listview Data](InputName=code_block_9.inputName@L1, Keys=code_block_9.keys@L2, Values=code_block_9.values@L2, Height_optionnal=code_block_9.out3, HilightInView_optionnal=code_block_9.out4, DisplayModeOnly_optionnal=code_block_9.out5, ShowElementCount_optionnal=code_block_9.out6, DefaultValueIndices_optionnal=code_block_9.out7, SortItems_optionnal=code_block_9.out8, ShowId_optionnal=code_block_9.out9)  # package Data-Shapes; Create data for ListView input in UI.MultiInputForm ++ . Check out www.data-shapes.net for more infos.
code_block_10 = CodeBlock(inputs=listview_data)
# ---------- code_block_10.designscript (4 lines) ----------
//GroupTitle
"Seleccionar Laminas";
//Inputs
inputs;
# ----------------------------------------
inputgroup_data = Custom[InputGroup Data](GroupTitle=code_block_10.out0, Inputs=code_block_10.inputs)  # package Data-Shapes; Creates a group of inputs for UI.MultipleInputForm ++ . Check out www.data-shapes.net for more infos !
python_script = Python(IN[0]=parameterExists, IN[1]=inputgroup_data)
# ---------- python_script.python (9 lines) ----------
validacion = IN[0][0]
inputs = IN[1]

if validacion == True:
	res = inputs
else:
	res = []

OUT = res
# ----------------------------------------
code_block_11 = CodeBlock(inputs=python_script)
# ---------- code_block_11.designscript (29 lines) ----------
//Description_optional
"Eliminar Nubes en Multiples Laminas";

//Logo


//ButtonText
"INICIAR";

//Inputs
inputs;

//Toggle
true;

//LinkToHelp


//CancelButtonText
"CANCELAR";

//MaxHeight
900;

//Width
600;

//LabelWidth
150;
# ----------------------------------------
multipleinputform = Custom[MultipleInputForm ++](Description_optional=code_block_11.out0, ButtonText_optional=code_block_11.out1, Inputs=code_block_11.inputs, Toggle=code_block_11.out3, CancelButtonText_optional=code_block_11.out4, MaxHeight_optional=code_block_11.out5, Width_optional=code_block_11.out6, LabelWidth_optional=code_block_11.out7)  # package Data-Shapes; Create a form with multiple inputs. see www.data-shapes.net for tutorials and infos!
python_script_2 = Python(IN[0]=multipleinputform.User_Inputs)
# ---------- python_script_2.python (7 lines) ----------
input = IN[0]

if input == [] or input == None:
	res = [[], [], [], []]
else:
	res = input
OUT = res
# ----------------------------------------
flatten = List.Flatten(list=python_script_2)
all_elements_of_category_in_view = ElementsOfCategoryInView(Category=byName, View=flatten)
code_block_12 = CodeBlock { "Revision Clouds"; }
byName_4 = Category.ByName(name=code_block_12)
views = Sheet.Views(sheet=flatten)
all_elements_of_category_in_view_2 = ElementsOfCategoryInView(Category=byName_4, View=views)
list_create = List.Create(item0=all_elements_of_category_in_view, item1=all_elements_of_category_in_view_2)
flatten_2 = List.Flatten(list=list_create)
python_script_3 = Python(IN[0]=flatten_2)
# ---------- python_script_3.python (7 lines) ----------
input = IN[0]

if input == [] or input == None or input[0] == False:
	res = []
else:
	res = input
OUT = res
# ----------------------------------------
delete = archilab.Revit.Elements.Elements.Delete(element=python_script_3)
count = List.Count(list=delete)
python_script_4 = Python(IN[0]=count)
# ---------- python_script_4.python (7 lines) ----------
input = IN[0]

if input == []:
	res = 0
else:
	res = input
OUT = res
# ----------------------------------------
string_from_object = FromObject(obj=python_script_4)
code_block_13 = CodeBlock(num=string_from_object)
# ---------- code_block_13.designscript (4 lines) ----------
//Title

//TextNote_
"Se han eliminado " + num + " nubes de revision.";
# ----------------------------------------
textnote_data = Custom[TextNote Data](TextNote=code_block_13)  # package Data-Shapes; Create Data for TextNote input in UI.MultipleInputForm ++ . Check out www.data-shapes.net for more informations
python_script_5 = Python(IN[0]=delete)
# ---------- python_script_5.python (7 lines) ----------
input = IN[0]

if input == []:
	res = False
else:
	res = True
OUT = res
# ----------------------------------------
code_block_14 = CodeBlock(inputs=textnote_data, toggle=python_script_5)
# ---------- code_block_14.designscript (29 lines) ----------
//Description_optional
"Eliminar Nubes de Revision";

//Logo


//ButtonText
"ACEPTAR";

//Inputs
inputs;

//Toggle
toggle;

//LinkToHelp


//CancelButtonText


//MaxHeight
900;

//Width
430;

//LabelWidth
150;
# ----------------------------------------
multipleinputform_2 = Custom[MultipleInputForm ++](Description_optional=code_block_14.out0, ButtonText_optional=code_block_14.out1, Inputs=code_block_14.inputs, Toggle=code_block_14.toggle, MaxHeight_optional=code_block_14.out4, Width_optional=code_block_14.out5, LabelWidth_optional=code_block_14.out6)
