# Dynamo graph cambiarFechaEntrega_script.dyn (Dynamo 2.6.2.15705)
# packages: Data-Shapes 2022.2.103, Clockwork for Dynamo 2.x 2.4.0, Genius Loci 2021.11.10

code_block = CodeBlock { "Sheets"; }
byName = Category.ByName(name=code_block)
all_elements_of_category = ElementsOfCategory(Category=byName)
sheetName = Sheet.SheetName(sheet=all_elements_of_category)
code_block_2 = CodeBlock { "Splash Screen"; }
eq = sheetName == code_block_2
filterByBoolMask = List.FilterByBoolMask(list=all_elements_of_category, mask=eq)
code_block_3 = CodeBlock { "Validacion"; }
code_block_4 = CodeBlock { "Project Information"; }
byName_2 = Category.ByName(name=code_block_4)
all_elements_of_category_2 = ElementsOfCategory(Category=byName_2)
parameterExists = Custom[Element.ParameterExists](param=code_block_3, element=all_elements_of_category_2)  # package Clockwork for Dynamo 2.x; Checks if an element contains a parameter of a given name
code_block_5 = CodeBlock { "Sheets"; }
byName_3 = Category.ByName(name=code_block_5)
all_elements_of_category_3 = ElementsOfCategory(Category=byName_3)
code_block_6 = CodeBlock { 1; }
dropItems = List.DropItems(list=all_elements_of_category_3, amount=code_block_6)
parameters = Element.Parameters(element=dropItems)
name = Parameter.Name(parameter=parameters)
string_from_object = FromObject(obj=name)
code_block_7 = CodeBlock()
# ---------- code_block_7.designscript (8 lines) ----------
[
"_NUM",
"_DES",
"_DIB",
"_REV",
"_APR",
"_FCH"
];
# ----------------------------------------
contains = String.Contains(str=string_from_object@@L1, searchFor=code_block_7@L2, lacing=Longest)
anyTrue = Custom[Booleans.AnyTrue](seq=contains)  # package Clockwork for Dynamo 2.x; Returns true if any item in a list of booleans is true.
filterByBoolMask_2 = List.FilterByBoolMask(list=name, mask=anyTrue)
flatten = List.Flatten(list=filterByBoolMask_2.in)
uniqueItems = List.UniqueItems(list=flatten)
code_block_8 = CodeBlock { "FCH"; }
contains_2 = String.Contains(str=uniqueItems, searchFor=code_block_8)
filterByBoolMask_3 = List.FilterByBoolMask(list=uniqueItems, mask=contains_2)
getParameterValueByName = Element.GetParameterValueByName(element=dropItems@L1, parameterName=filterByBoolMask_3.in@L2, lacing=Longest)
flatten_2 = List.Flatten(list=getParameterValueByName)
uniqueItems_2 = List.UniqueItems(list=flatten_2)
list_clean = Custom[List Clean](list=uniqueItems_2)  # package Genius Loci; Removes all Null, Empty and Blank from a list or nested list of lists.
code_block_9 = CodeBlock(keys=list_clean, values=list_clean)
# ---------- code_block_9.designscript (10 lines) ----------
//InputName
"Fechas";
//Keys_
keys;
//Values_
values;
//DefaultValueIndex
0;
//Sorted_
false;
# ----------------------------------------
dropdown_data = Custom[DropDown Data](InputName=code_block_9.out0, Keys=code_block_9.keys, Values=code_block_9.values, DefaultValueIndex=code_block_9.out3, Sorted_optional=code_block_9.out4)  # package Data-Shapes; Create data for DropDown input in UI.MultiInputForm ++ . Check out www.data-shapes.net for more infos.
code_block_10 = CodeBlock(inputs=dropdown_data)
# ---------- code_block_10.designscript (4 lines) ----------
//GroupTitle
"Seleccionar Fecha Actual:";
//Inputs
inputs;
# ----------------------------------------
inputgroup_data = Custom[InputGroup Data](GroupTitle=code_block_10.out0, Inputs=code_block_10.inputs)  # package Data-Shapes; Creates a group of inputs for UI.MultipleInputForm ++ . Check out www.data-shapes.net for more infos !
code_block_11 = CodeBlock()
# ---------- code_block_11.designscript (6 lines) ----------
//InputName
"Nueva Fecha:";
//DefaultText
"dd.MM.aa";
//IsNumberEntry
false;
# ----------------------------------------
textbox_data = Custom[TextBox Data](InputName=code_block_11.out0, DefaultText=code_block_11.out1, IsNumberEntry=code_block_11.out2)  # package Data-Shapes; Create Data for TextBox input in UI.MultipleInputForm ++ . Check out www.data-shapes.net for more informations
code_block_12 = CodeBlock(inputs=textbox_data)
# ---------- code_block_12.designscript (4 lines) ----------
//GroupTitle
"Asignar Nueva Fecha:";
//Inputs
inputs;
# ----------------------------------------
inputgroup_data_2 = Custom[InputGroup Data](GroupTitle=code_block_12.out0, Inputs=code_block_12.inputs)
list_create = List.Create(item0=inputgroup_data, item1=inputgroup_data_2)
python_script = Python(IN[0]=parameterExists, IN[1]=list_create)
# ---------- python_script.python (9 lines) ----------
validacion = IN[0][0]
inputs = IN[1]

if validacion == True:
	res = inputs
else:
	res = []

OUT = res
# ----------------------------------------
code_block_13 = CodeBlock(inputs=python_script)
# ---------- code_block_13.designscript (29 lines) ----------
//Description_optional
"Cambiar Fecha de Entrega";

//Logo


//ButtonText
"INICIAR";

//Inputs
inputs;

//Toggle
true;

//LinkToHelp


//CancelButtonText
"CANCELAR";

//MaxHeight
900;

//Width
430;

//LabelWidth
150;
# ----------------------------------------
multipleinputform = Custom[MultipleInputForm ++](Description_optional=code_block_13.out0, ButtonText_optional=code_block_13.out1, Inputs=code_block_13.inputs, Toggle=code_block_13.out3, CancelButtonText_optional=code_block_13.out4, MaxHeight_optional=code_block_13.out5, Width_optional=code_block_13.out6, LabelWidth_optional=code_block_13.out7)  # package Data-Shapes; Create a form with multiple inputs. see www.data-shapes.net for tutorials and infos!
python_script_2 = Python(IN[0]=multipleinputform.User_Inputs)
# ---------- python_script_2.python (7 lines) ----------
input = IN[0]

if input == [] or input == None:
	res = []
else:
	res = input[0]
OUT = res
# ----------------------------------------
parameters_2 = Element.Parameters(element=filterByBoolMask.out)
name_2 = Parameter.Name(parameter=parameters_2)
string_from_object_2 = FromObject(obj=name_2)
code_block_14 = CodeBlock()  # same code as code_block_7
contains_3 = String.Contains(str=string_from_object_2@@L1, searchFor=code_block_14@L2, lacing=Longest)
anyTrue_2 = Custom[Booleans.AnyTrue](seq=contains_3)
filterByBoolMask_4 = List.FilterByBoolMask(list=name_2, mask=anyTrue_2)
string_from_object_3 = FromObject(obj=filterByBoolMask_4.in)
code_block_15 = CodeBlock { "FCH"; }
contains_4 = String.Contains(str=string_from_object_3, searchFor=code_block_15)
filterByBoolMask_5 = List.FilterByBoolMask(list=filterByBoolMask_4.in, mask=contains_4)
getParameterValueByName_2 = Element.GetParameterValueByName(element=filterByBoolMask.out, parameterName=filterByBoolMask_5.in)
eq_2 = python_script_2 == getParameterValueByName_2
anyTrue_3 = Custom[Booleans.AnyTrue](seq=eq_2)
filterByBoolMask_6 = List.FilterByBoolMask(list=filterByBoolMask.out, mask=anyTrue_3)
filterByBoolMask_7 = List.FilterByBoolMask(list=filterByBoolMask_5.in, mask=eq_2)
flatten_3 = List.Flatten(list=filterByBoolMask_7.in)
python_script_3 = Python(IN[0]=multipleinputform.User_Inputs)
# ---------- python_script_3.python (7 lines) ----------
input = IN[0]

if input == [] or input == None:
	res = []
else:
	res = input[1]
OUT = res
# ----------------------------------------
setParameterByName = Element.SetParameterByName(element=filterByBoolMask_6.in, parameterName=flatten_3, value=python_script_3)
