# Dynamo graph revisionZero_script.dyn (Dynamo 2.6.2.15705)
# packages: Data-Shapes 2022.2.103, Clockwork for Dynamo 2.x 2.4.0, Genius Loci 2021.11.10, archi-lab.net 2022.210.2419, Modelical 2022.5.12

code_block = CodeBlock { "Validacion"; }
code_block_2 = CodeBlock { "Project Information"; }
byName = Category.ByName(name=code_block_2)
all_elements_of_category = ElementsOfCategory(Category=byName)
parameterExists = Custom[Element.ParameterExists](param=code_block, element=all_elements_of_category)  # package Clockwork for Dynamo 2.x; Checks if an element contains a parameter of a given name
code_block_3 = CodeBlock()
# ---------- code_block_3.designscript (19 lines) ----------
[
"PRELIMINAR",
"PARA APROBACION",
"EMITIDO PARA APROBACION MUNICIPAL",
"MODIFICACION GENERAL",
"APROBADO PARA LICITACION",
"ACTUALIZACION APL",
"MODIFICA LO INDICADO",
"APROBADO PARA CONSTRUCCION",
"PARA MUNICIPALIDAD",
"APTO PARA LICITACION",
"PARA LICITACION",
"INGRESA UNA DESCRIPCION",
"PARA INGRESO MUNICIPAL",
"MODIFICA Y AGREGA LO INDICADO",
"INFORMATIVO",
"PARA APROBACION",
"PARA REVISION"
];
# ----------------------------------------
code_block_4 = CodeBlock(keys=code_block_3, values=code_block_3)
# ---------- code_block_4.designscript (10 lines) ----------
//InputName
"Descripcion";
//Keys_
keys;
//Values_
values;
//DefaultValueIndex
0;
//SortedOptional
false;
# ----------------------------------------
dropdown_data = Custom[DropDown Data](InputName=code_block_4.out0, Keys=code_block_4.keys, Values=code_block_4.values, DefaultValueIndex=code_block_4.out3, Sorted_optional=code_block_4.out4)  # package Data-Shapes; Create data for DropDown input in UI.MultiInputForm ++ . Check out www.data-shapes.net for more infos.
code_block_5 = CodeBlock()
# ---------- code_block_5.designscript (4 lines) ----------
"Dibujó";
["J.N.N.","P.C.C.","A.C.C.","A.S.A.","C.M.H.","C.S.R.","S.J.M.","R.P.C.","C.O.C.","M.F.S.","D.S.P.","H.C.P.","L.B.M.","J.N.O.","T.M.M.","X.X.X.","SELECCIONA QUIEN REALIZO LA MODIFICACION"];
true;
-1;
# ----------------------------------------
code_block_6 = CodeBlock(keys=code_block_5.out1, values=code_block_5.out1)
# ---------- code_block_6.designscript (10 lines) ----------
//InputName
"Dibujo";
//Keys_
keys;
//Values_
values;
//DefaultValueIndex
-1;
//SortedOptional
false;
# ----------------------------------------
dropdown_data_2 = Custom[DropDown Data](InputName=code_block_6.out0, Keys=code_block_6.keys, Values=code_block_6.values, DefaultValueIndex=code_block_6.out3, Sorted_optional=code_block_6.out4)
code_block_7 = CodeBlock()
# ---------- code_block_7.designscript (5 lines) ----------
[
"N.V.G.",
"C.M.Q.",
"M.E.A"
];
# ----------------------------------------
code_block_8 = CodeBlock(keys=code_block_7, values=code_block_7)
# ---------- code_block_8.designscript (10 lines) ----------
//InputName
"Reviso";
//Keys_
keys;
//Values_
values;
//DefaultValueIndex
-1;
//SortedOptional
false;
# ----------------------------------------
dropdown_data_3 = Custom[DropDown Data](InputName=code_block_8.out0, Keys=code_block_8.keys, Values=code_block_8.values, DefaultValueIndex=code_block_8.out3, Sorted_optional=code_block_8.out4)
code_block_9 = CodeBlock()
# ---------- code_block_9.designscript (5 lines) ----------
[
"N.V.G.",
"C.M.Q.",
"P.A.V."
];
# ----------------------------------------
code_block_10 = CodeBlock(keys=code_block_9, values=code_block_9)
# ---------- code_block_10.designscript (10 lines) ----------
//InputName
"Aprobo";
//Keys_
keys;
//Values_
values;
//DefaultValueIndex
-1;
//SortedOptional
true;
# ----------------------------------------
dropdown_data_4 = Custom[DropDown Data](InputName=code_block_10.out0, Keys=code_block_10.keys, Values=code_block_10.values, DefaultValueIndex=code_block_10.out3, Sorted_optional=code_block_10.out4)
now = DateTime.Now()
code_block_11 = CodeBlock { "dd.MM.yy"; }
format = DateTime.Format(dateTime=now, format=code_block_11)
code_block_12 = CodeBlock { "."; }
split = String.Split(str=format, separator0=code_block_12)
toNumber = String.ToNumber(str=split)
code_block_13 = CodeBlock { 2; }
getItemAtIndex = List.GetItemAtIndex(list=toNumber, index=code_block_13)
code_block_14 = CodeBlock { 1; }
getItemAtIndex_2 = List.GetItemAtIndex(list=toNumber, index=code_block_14)
code_block_15 = CodeBlock { 0; }
getItemAtIndex_3 = List.GetItemAtIndex(list=toNumber, index=code_block_15)
daysInMonth = DateTime.DaysInMonth(year=getItemAtIndex, month=getItemAtIndex_2)
code_block_16 = CodeBlock(ini=getItemAtIndex_3, mes=daysInMonth) { ini..mes..1; }
byDate = DateTime.ByDate(year=getItemAtIndex, month=getItemAtIndex_2, day=code_block_16)
code_block_17 = CodeBlock { "dd.MM.yy"; }
format_2 = DateTime.Format(dateTime=byDate, format=code_block_17)
code_block_18 = CodeBlock(keys=format_2, values=format_2)
# ---------- code_block_18.designscript (10 lines) ----------
//InputName
"Fecha";
//Keys_
keys;
//Values_
values;
//DefaultValueIndex
0;
//SortedOptional
true;
# ----------------------------------------
dropdown_data_5 = Custom[DropDown Data](InputName=code_block_18.out0, Keys=code_block_18.keys, Values=code_block_18.values, DefaultValueIndex=code_block_18.out3, Sorted_optional=code_block_18.out4)
code_block_19 = CodeBlock { "Sheets"; }
byName_2 = Category.ByName(name=code_block_19)
all_elements_of_category_2 = ElementsOfCategory(Category=byName_2)
name = Custom[Element.Name+](element=all_elements_of_category_2)  # package Clockwork for Dynamo 2.x; Gets an element's name. Unlike the OOTB node, this node should work for *all* Revit elements that have names and will also return the localized names of system parameters, parameter groups, display unit types, parameter types, unit symbol types, unit types and ForgeTypeIds.
code_block_20 = CodeBlock { "Splash"; }
contains = String.Contains(str=name, searchFor=code_block_20)
filterByBoolMask = List.FilterByBoolMask(list=all_elements_of_category_2, mask=contains)
code_block_21 = CodeBlock { "Clasificacion"; }
getParameterValueByName = Element.GetParameterValueByName(element=filterByBoolMask.out, parameterName=code_block_21)
groupByKey = List.GroupByKey(list=filterByBoolMask.out, keys=getParameterValueByName)
code_block_22 = CodeBlock(clasificacion=groupByKey.unique_keys) { "Laminas "+clasificacion; }
sheetNumber = Sheet.SheetNumber(sheet=groupByKey.groups@L2)
sheetName = Sheet.SheetName(sheet=groupByKey.groups@L2)
code_block_23 = CodeBlock(sheetNumber=sheetNumber, sheetName=sheetName) { sheetNumber+" - "+sheetName; }
code_block_24 = CodeBlock(inputName=code_block_22, keys=code_block_23, values=groupByKey.groups)
# ---------- code_block_24.designscript (20 lines) ----------
//InputName
inputName;
//Keys_
keys;
//Values_
values;
//Height_optional
250;
//HilightInView_optionnal
false;
//DisplayModeOnly_optional
false;
//ShowElementCount_optionnal
false;
//DefaultValuesIndices_optionnal
[];
//SortItems_optionnal
true;
//ShowId_optionnal
false;
# ----------------------------------------
listview_data = Custom[Listview Data](InputName=code_block_24.inputName@L1, Keys=code_block_24.keys@L2, Values=code_block_24.values@L2, Height_optionnal=code_block_24.out3, HilightInView_optionnal=code_block_24.out4, DisplayModeOnly_optionnal=code_block_24.out5, ShowElementCount_optionnal=code_block_24.out6, DefaultValueIndices_optionnal=code_block_24.out7, SortItems_optionnal=code_block_24.out8, ShowId_optionnal=code_block_24.out9)  # package Data-Shapes; Create data for ListView input in UI.MultiInputForm ++ . Check out www.data-shapes.net for more infos.
inputgroup_data = Custom[InputGroup Data](Inputs=listview_data)  # package Data-Shapes; Creates a group of inputs for UI.MultipleInputForm ++ . Check out www.data-shapes.net for more infos !
list_create = List.Create(item0=dropdown_data, item1=dropdown_data_2, item2=dropdown_data_3, item3=dropdown_data_4, item4=dropdown_data_5, item5=inputgroup_data)
python_script = Python(IN[0]=parameterExists, IN[1]=list_create)
# ---------- python_script.python (9 lines) ----------
validacion = IN[0][0]
inputs = IN[1]

if validacion == True:
	res = inputs
else:
	res = []

OUT = res
# ----------------------------------------
code_block_25 = CodeBlock(inputs=python_script)
# ---------- code_block_25.designscript (29 lines) ----------
//Description_optional
"Revision 0";

//Logo


//ButtonText
"INICIAR";

//Inputs
inputs;

//Toggle
true;

//LinkToHelp


//CancelButtonText
"CANCELAR";

//MaxHeight
900;

//Width
600;

//LabelWidth
150;
# ----------------------------------------
multipleinputform = Custom[MultipleInputForm ++](Description_optional=code_block_25.out0, ButtonText_optional=code_block_25.out1, Inputs=code_block_25.inputs, Toggle=code_block_25.out3, CancelButtonText_optional=code_block_25.out4, MaxHeight_optional=code_block_25.out5, Width_optional=code_block_25.out6, LabelWidth_optional=code_block_25.out7)  # package Data-Shapes; Create a form with multiple inputs. see www.data-shapes.net for tutorials and infos!
python_script_2 = Python(IN[0]=multipleinputform.User_Inputs)
# ---------- python_script_2.python (7 lines) ----------
input = IN[0]

if input == [] or input == None:
	res = [[], [], [], []]
else:
	res = input
OUT = res
# ----------------------------------------
list_clean = Custom[List Clean](list=python_script_2)  # package Genius Loci; Removes all Null, Empty and Blank from a list or nested list of lists.
python_script_3 = Python(IN[0]=list_clean)
# ---------- python_script_3.python (7 lines) ----------
input = IN[0]

if input == [] or input == None:
	res = [[], [], [], [], [], [], []]
else:
	res = input
OUT = res
# ----------------------------------------
code_block_26 = CodeBlock { 5; }
dropItems = List.DropItems(list=python_script_3, amount=code_block_26)
flatten = List.Flatten(list=dropItems)

# group: Revision 0 en plantilla de Arainco
element_types_ᶜᵒⁿᵛᵉʳᵗᵉᵈ_ᵈʳᵒᵖᵈᵒʷⁿ = CodeBlock { DSCore.Types.FindTypeByNameInAssembly("Revision", "RevitAPI"); }
all_elements_of_type = ElementsOfType(element_type=element_types_ᶜᵒⁿᵛᵉʳᵗᵉᵈ_ᵈʳᵒᵖᵈᵒʷⁿ)
name_2 = Element.Name(element=all_elements_of_type)
code_block_27 = CodeBlock { "Seq. 27 - Revision 0"; }
eq = name_2 == code_block_27
filterByBoolMask_2 = List.FilterByBoolMask(list=all_elements_of_type, mask=eq)
code_block_28 = CodeBlock(x=filterByBoolMask_2.in) { x[0]; }

addRevision = Custom[Sheet.AddRevision](sheets=flatten, revisions=code_block_28)  # package Modelical; This node adds the selected revisions for the selected sheets.
parameters = Element.Parameters(element=addRevision.sheets)
name_3 = Parameter.Name(parameter=parameters)
code_block_29 = CodeBlock()
# ---------- code_block_29.designscript (8 lines) ----------
[
"_NUM",
"_DES",
"_DIB",
"_REV",
"_APR",
"_FCH"
];
# ----------------------------------------
contains_2 = String.Contains(str=name_3@@L1, searchFor=code_block_29@L2, lacing=Longest)
anyTrue = Custom[Booleans.AnyTrue](seq=contains_2)  # package Clockwork for Dynamo 2.x; Returns true if any item in a list of booleans is true.
filterByBoolMask_3 = List.FilterByBoolMask(list=name_3, mask=anyTrue)
getParameterValueByName_2 = Element.GetParameterValueByName(element=addRevision.sheets@L1, parameterName=filterByBoolMask_3.in@L2)
code_block_30 = CodeBlock { null; }
eq_2 = getParameterValueByName_2 == code_block_30
code_block_31 = CodeBlock { ""; }
eq_3 = getParameterValueByName_2 == code_block_31
xor = Math.Xor(a=eq_2, b=eq_3)
filterByBoolMask_4 = List.FilterByBoolMask(list=filterByBoolMask_3.in, mask=xor)
isEmpty = List.IsEmpty(list=filterByBoolMask_4.in)
code_block_32 = CodeBlock(x=isEmpty, y=filterByBoolMask_4.in)
# ---------- code_block_32.designscript (13 lines) ----------
x;
y;
res = [Imperative]
{
	if (x == false)
	{
		return = y;
	}
	else
	{
		return = null;
	}
};
# ----------------------------------------
code_block_33 = CodeBlock(x=isEmpty)
# ---------- code_block_33.designscript (13 lines) ----------
x;
lst = 1..5;
res = [Imperative]
{
	if (x == false)
	{
		return = 1..5;
	}
	else
	{
		return = [];
	}
};
# ----------------------------------------
getItemAtIndex_4 = List.GetItemAtIndex(list=code_block_32.out2@L2, index=code_block_33.out2)
code_block_34 = CodeBlock { 0..4; }
getItemAtIndex_5 = List.GetItemAtIndex(list=python_script_3, index=code_block_34)
setParameterByName = Element.SetParameterByName(element=addRevision.sheets@L1, parameterName=getItemAtIndex_4@L2, value=getItemAtIndex_5@L2, lacing=Longest)
flatten_2 = List.Flatten(list=setParameterByName)
uniqueItems = List.UniqueItems(list=flatten_2)
code_block_35 = CodeBlock(x=filterByBoolMask_4.in) { x; }
isEmpty_2 = List.IsEmpty(list=code_block_35)
code_block_36 = CodeBlock(x=isEmpty_2, y=code_block_35)  # same code as code_block_32
code_block_37 = CodeBlock(x=isEmpty_2)
# ---------- code_block_37.designscript (12 lines) ----------
x;
res = [Imperative]
{
	if (x == false)
	{
		return = 0;
	}
	else
	{
		return = [];
	}
};
# ----------------------------------------
getItemAtIndex_6 = List.GetItemAtIndex(list=code_block_36.out2@L2, index=code_block_37.out1)
end = Revit.Transaction.Transaction.End(input=addRevision.sheets)
revisions = archilab.Revit.Views.Sheets.Revisions(sheet=end)
lastItem = List.LastItem(list=revisions@L2)
getRevisionNumberOnSheet = archilab.Revit.Views.Sheets.GetRevisionNumberOnSheet(sheet=end, revision=lastItem)
string_from_object = FromObject(obj=getRevisionNumberOnSheet)
setParameterByName_2 = Element.SetParameterByName(element=uniqueItems, parameterName=getItemAtIndex_6, value=string_from_object)
flatten_3 = List.Flatten(list=setParameterByName_2)
code_block_38 = CodeBlock { "Revision Clouds"; }
byName_3 = Category.ByName(name=code_block_38)
all_elements_of_category_in_view = ElementsOfCategoryInView(Category=byName_3, View=flatten_3)
curves = RevisionCloud.Curves()  # unwired: revisionCloud
function_apply = ApplyFunction(func=curves, arg1=all_elements_of_category_in_view)
pointAtParameter = Curve.PointAtParameter(curve=function_apply)
byCoordinates = Point.ByCoordinates()
distanceTo = Geometry.DistanceTo(geometry=pointAtParameter, other=byCoordinates)
maximumItem = List.MaximumItem(list=distanceTo)
eq_4 = distanceTo == maximumItem
filterByBoolMask_5 = List.FilterByBoolMask(list=pointAtParameter, mask=eq_4)
byElementAndLocation = Tag.ByElementAndLocation(view=flatten_3, element=all_elements_of_category_in_view, location=filterByBoolMask_5.in)
code_block_39 = CodeBlock { "Revision"; }
identity = Object.Identity(obj=setParameterByName_2)
revisions_2 = archilab.Revit.Views.Sheets.Revisions(sheet=identity)
code_block_40 = CodeBlock { null; }
replaceEmptyLists = Custom[List.ReplaceEmptyLists](seq=revisions_2, Replacement=code_block_40)  # package Clockwork for Dynamo 2.x; Replaces all empty lists within a given list with a substitute
lastItem_2 = List.LastItem(list=replaceEmptyLists@L2)
code_block_41 = CodeBlock(x=lastItem_2)
# ---------- code_block_41.designscript (12 lines) ----------
x;
[Imperative]
{
	if(x==null)
	{
		return = [];
	}
	else
	{
		return = x;
	}
};
# ----------------------------------------
setParameterByName_3 = Element.SetParameterByName(parameterName=code_block_39@L1, value=code_block_41.out1@L1, lacing=Longest)  # unwired: element
code_block_42 = CodeBlock { "Revision Clouds"; }
byName_4 = Category.ByName(name=code_block_42)
all_elements_of_category_in_view_2 = ElementsOfCategoryInView(Category=byName_4, View=identity)
function_apply_2 = ApplyFunction(func=setParameterByName_3, arg1=all_elements_of_category_in_view_2)
code_block_43 = CodeBlock(x=setParameterByName_2) { x; }
code_block_44 = CodeBlock { "Cantidad Revisiones"; }
code_block_45 = CodeBlock { "Revision Clouds"; }
byName_5 = Category.ByName(name=code_block_45)
all_elements_of_category_in_view_3 = ElementsOfCategoryInView(Category=byName_5, View=code_block_43)
count = List.Count(list=all_elements_of_category_in_view_3@L2)
string_from_object_2 = FromObject(obj=count)
setParameterByName_4 = Element.SetParameterByName(element=code_block_43@L1, parameterName=code_block_44@L1, value=string_from_object_2@L1, lacing=Longest)
