# Dynamo graph listadoPlanos_script.dyn "listadoDePlanos2" (Dynamo 2.6.2.15705)
# packages: Data-Shapes 2021.2.94, Clockwork for Dynamo 2.x 2.4.0, Genius Loci 2023.7.11, archi-lab.net 2022.210.2419, Genius Loci 2021.11.10

code_block = CodeBlock()
# ---------- code_block.designscript (7 lines) ----------
//InputName
"Ruta de Destino";

//DefaultPath

//ButtonText
"BUSCAR";
# ----------------------------------------
directorypath_data = Custom[DirectoryPath Data](InputName=code_block.out0, ButtonText=code_block.out1)  # package Data-Shapes; Creates a DirectoryPath input for UI.MultipleInputForm ++ . Check out www.data-shapes.net for more infos!
code_block_2 = CodeBlock(inputs=directorypath_data)
# ---------- code_block_2.designscript (29 lines) ----------
//Description
"Listado de Planos";

//Logo
"C:\\Arainco\\Arainco.png";

//ButtonText
"INICIAR";

//Inputs
inputs;

//Toggle
true;

//LinkToHelp
null;

//CancelButtonText
"CANCELAR";

//MaxHeight
0;

//Width
430;

//LabelWidth
150;
# ----------------------------------------
multipleinputform = Custom[MultipleInputForm ++](Description_optional=code_block_2.out0, Logo_optional=code_block_2.out1, ButtonText_optional=code_block_2.out2, Inputs=code_block_2.inputs, Toggle=code_block_2.out4, LinkToHelp_optional=code_block_2.out5, CancelButtonText_optional=code_block_2.out6, MaxHeight_optional=code_block_2.out7, Width_optional=code_block_2.out8, LabelWidth_optional=code_block_2.out9)  # package Data-Shapes; Create a form with multiple inputs. see www.data-shapes.net for tutorials and infos!
python_script = Python(IN[0]=multipleinputform.User_Inputs)
# ---------- python_script.python (7 lines) ----------
input = IN[0]

if input == [] or input == None:
	res = []
else:
	res = input[0]
OUT = res
# ----------------------------------------
file_path = Filename("C:\Arainco\TemplateListado.xlsx")
file_from_path = FileObject(path=file_path)
projectInfo = Custom[Document.ProjectInfo]()  # package Clockwork for Dynamo 2.x; Gets the project information.
code_block_3 = CodeBlock(x=python_script, name=projectInfo.Name) { x + "\\LISTADO DE PLANOS " + name + ".xls"; }
code_block_4 = CodeBlock(file=file_from_path, destinationPath=code_block_3)
# ---------- code_block_4.designscript (8 lines) ----------
//file
file;

//destinationPath
destinationPath;

//overwrite
true;
# ----------------------------------------
copyFile = FileSystem.CopyFile(file=code_block_4.file, destinationPath=code_block_4.destinationPath, overwrite=code_block_4.out2)
code_block_5 = CodeBlock(x=copyFile)
# ---------- code_block_5.designscript (12 lines) ----------
x;
[Imperative]
{
	if(x == null)
	{
		return = [];
	}
	else
	{
		return = x;
	}
};
# ----------------------------------------
passthrough = Custom[Passthrough](passThrough=python_script, waitFor=code_block_5.out1)  # package Clockwork for Dynamo 2.x; Forces a sequential order of execution. The node wired into the output of the Passthrough node will be executed *after* the node wired into the waitFor input (e.g. important for some Revit operations). The value of the passThrough input will be passed on to the node wired into the output port of the Passthrough node.
directory_from_path = DirectoryObject(path=passthrough)
lastItem = List.LastItem()  # unwired: list
code_block_6 = CodeBlock { "\\"; }
split = String.Split(str=code_block_3, separator0=code_block_6)
function_apply = ApplyFunction(func=lastItem, arg1=split)
getDirectoryContents = FileSystem.GetDirectoryContents(directory=directory_from_path, searchString=function_apply)
code_block_7 = CodeBlock(x=getDirectoryContents.files)
# ---------- code_block_7.designscript (12 lines) ----------
x;
[Imperative]
{
	if(x == null)
	{
		return = [];
	}
	else
	{
		return = x[0];
	}
};
# ----------------------------------------
code_block_8 = CodeBlock { "Sheets"; }
byName = Category.ByName(name=code_block_8)
all_elements_of_category = ElementsOfCategory(Category=byName)
revisions = archilab.Revit.Views.Sheets.Revisions(sheet=all_elements_of_category)
isEmpty = List.IsEmpty(list=revisions@L2)
filterByBoolMask = List.FilterByBoolMask(list=all_elements_of_category, mask=isEmpty)
code_block_9 = CodeBlock { "Clasificacion"; }
getParameterValueByName = Element.GetParameterValueByName(element=filterByBoolMask.out, parameterName=code_block_9)
sortByKey = List.SortByKey(list=filterByBoolMask.out, keys=getParameterValueByName)
sheetNumber = Sheet.SheetNumber(sheet=sortByKey.sorted_list)
sortByKey_2 = List.SortByKey(list=sortByKey.sorted_list, keys=sheetNumber)
sheetNumber_2 = Sheet.SheetNumber(sheet=sortByKey_2.sorted_list)
parameters = Element.Parameters(element=sortByKey_2.sorted_list)
name = Parameter.Name(parameter=parameters)
code_block_10 = CodeBlock()
# ---------- code_block_10.designscript (6 lines) ----------
[
"_NUM",
"_DES",
"_REV",
"_FCH"
];
# ----------------------------------------
contains = String.Contains(str=name@@L1, searchFor=code_block_10@L2, lacing=Longest)
anyTrue = Custom[Booleans.AnyTrue](seq=contains)  # package Clockwork for Dynamo 2.x; Returns true if any item in a list of booleans is true.
filterByBoolMask_2 = List.FilterByBoolMask(list=name, mask=anyTrue)
getParameterValueByName_2 = Element.GetParameterValueByName(element=sortByKey_2.sorted_list, parameterName=filterByBoolMask_2.in)
list_clean = Custom[List Clean](list=getParameterValueByName_2)  # package Genius Loci; Removes all Null, Empty and Blank from a list or nested list of lists.
count = List.Count(list=list_clean@L2)
code_block_11 = CodeBlock(x=count) { x - 4; x - 3; x - 1; }
getItemAtIndex = List.GetItemAtIndex(list=list_clean@L2, index=code_block_11.out0, lacing=Longest)
getItemAtIndex_2 = List.GetItemAtIndex(list=list_clean@L2, index=code_block_11.out1, lacing=Longest)
getItemAtIndex_3 = List.GetItemAtIndex(list=list_clean@L2, index=code_block_11.out2, lacing=Longest)
sheetName = Sheet.SheetName(sheet=sortByKey_2.sorted_list)
list_create = List.Create(item0=sheetNumber_2, item1=getItemAtIndex, item2=getItemAtIndex_2, item3=getItemAtIndex_3, item4=sheetName)
transpose = List.Transpose(lists=list_create)

# group: Listado de Planos
code_block_12 = CodeBlock(filePath=code_block_7.out1, data=transpose)
# ---------- code_block_12.designscript (17 lines) ----------
//filePath
filePath;

//sheetName
"LISTADO DE PLANOS";

//startRow
12;

//startCol
0;

//data
data;

//overWrite
false;
# ----------------------------------------
exportExcel = Data.ExportExcel(filePath=code_block_12.filePath, sheetName=code_block_12.out1, startRow=code_block_12.out2, startCol=code_block_12.out3, data=code_block_12.data, overWrite=code_block_12.out5)

projectInfo_2 = Custom[Document.ProjectInfo]()

# group: Cliente
code_block_13 = CodeBlock(filePath=code_block_7.out1, data=projectInfo_2.ClientName)
# ---------- code_block_13.designscript (17 lines) ----------
//filePath
filePath;

//sheetName
"LISTADO DE PLANOS";

//starRow
7;

//startCol
1;

//data
data;

//overWrite
false;
# ----------------------------------------
exportExcel_2 = Data.ExportExcel(filePath=code_block_13.filePath, sheetName=code_block_13.out1, startRow=code_block_13.out2, startCol=code_block_13.out3, data=code_block_13.data, overWrite=code_block_13.out5)

# group: Nombre
code_block_14 = CodeBlock(filePath=code_block_7.out1, data=projectInfo_2.Name)
# ---------- code_block_14.designscript (17 lines) ----------
//filePath
filePath;

//sheetName
"LISTADO DE PLANOS";

//starRow
6;

//startCol
1;

//data
data;

//overWrite
false;
# ----------------------------------------
exportExcel_3 = Data.ExportExcel(filePath=code_block_14.filePath, sheetName=code_block_14.out1, startRow=code_block_14.out2, startCol=code_block_14.out3, data=code_block_14.data, overWrite=code_block_14.out5)

# group: Numero de Proyecto
code_block_15 = CodeBlock(filePath=code_block_7.out1, data=projectInfo_2.Number)
# ---------- code_block_15.designscript (17 lines) ----------
//filePath
filePath;

//sheetName
"LISTADO DE PLANOS";

//starRow
8;

//startCol
1;

//data
data;

//overWrite
false;
# ----------------------------------------
exportExcel_4 = Data.ExportExcel(filePath=code_block_15.filePath, sheetName=code_block_15.out1, startRow=code_block_15.out2, startCol=code_block_15.out3, data=code_block_15.data, overWrite=code_block_15.out5)

today = DateTime.Today()
code_block_16 = CodeBlock { "dd/MM/yyyy"; }
format = DateTime.Format(dateTime=today, format=code_block_16)

# group: Fecha
code_block_17 = CodeBlock(filePath=code_block_7.out1, data=format)
# ---------- code_block_17.designscript (17 lines) ----------
//filePath
filePath;

//sheetName
"LISTADO DE PLANOS";

//starRow
9;

//startCol
1;

//data
data;

//overWrite
false;
# ----------------------------------------
exportExcel_5 = Data.ExportExcel(filePath=code_block_17.filePath, sheetName=code_block_17.out1, startRow=code_block_17.out2, startCol=code_block_17.out3, data=code_block_17.data, overWrite=code_block_17.out5)

parameters_2 = Element.Parameters(element=sortByKey_2.sorted_list)
name_2 = Parameter.Name(parameter=parameters_2)
code_block_18 = CodeBlock()
# ---------- code_block_18.designscript (8 lines) ----------
[
"_NUM",
"_DES",
"_DIB",
"_REV",
"_APR",
"_FCH"
];
# ----------------------------------------
contains_2 = String.Contains(str=name_2@@L1, searchFor=code_block_18@L2, lacing=Longest)
anyTrue_2 = Custom[Booleans.AnyTrue](seq=contains_2)
filterByBoolMask_3 = List.FilterByBoolMask(list=name_2, mask=anyTrue_2)
getParameterValueByName_3 = Element.GetParameterValueByName(element=sortByKey_2.sorted_list@L1, parameterName=filterByBoolMask_3.in@L2, lacing=Longest)
list_clean_2 = Custom[List Clean](list=getParameterValueByName_3)
sheetNumber_3 = Sheet.SheetNumber(sheet=sortByKey_2.sorted_list)
sheetName_2 = Sheet.SheetName(sheet=sortByKey_2.sorted_list)
list_create_2 = List.Create(item0=sheetNumber_3, item1=sheetName_2)
transpose_2 = List.Transpose(lists=list_create_2)
code_block_19 = CodeBlock { 0; }
insert = List.Insert(list=list_clean_2@L2, element=transpose_2@L2, index=code_block_19)
flatten = List.Flatten(list=insert@L3)

# group: Historial de Revisiones
code_block_20 = CodeBlock(filePath=code_block_7.out1, data=flatten)
# ---------- code_block_20.designscript (17 lines) ----------
//filePath
filePath;

//sheetName
"HISTORIAL DE REVISIONES";

//startRow
7;

//startCol
0;

//data
data;

//overWrite
false;
# ----------------------------------------
exportExcel_6 = Data.ExportExcel(filePath=code_block_20.filePath, sheetName=code_block_20.out1, startRow=code_block_20.out2, startCol=code_block_20.out3, data=code_block_20.data, overWrite=code_block_20.out5)
