# Dynamo graph bloquearElementos_script.dyn "bloquearElementos" (Dynamo 2.6.2.15705)
# packages: Data-Shapes 2022.2.103, Clockwork for Dynamo 2.x 2.4.0

code_block = CodeBlock { "Validacion"; }
code_block_2 = CodeBlock { "Project Information"; }
byName = Category.ByName(name=code_block_2)
all_elements_of_category = ElementsOfCategory(Category=byName)
parameterExists = Custom[Element.ParameterExists](param=code_block, element=all_elements_of_category)  # package Clockwork for Dynamo 2.x; Checks if an element contains a parameter of a given name
code_block_3 = CodeBlock()
# ---------- code_block_3.designscript (7 lines) ----------
[
"Structural Foundations",
"Structural Framing",
"Structural Columns",
"Walls",
"Floors"
];
# ----------------------------------------
byName_2 = Category.ByName(name=code_block_3)
count = List.Count(list=byName_2)
code_block_4 = CodeBlock(count=count) { 0..count - 1..1; }
code_block_5 = CodeBlock(keys=code_block_3, values=byName_2, defaultValues=code_block_4)
# ---------- code_block_5.designscript (20 lines) ----------
//InputName
"Categorias";
//Keys_
keys;
//Values_
values;
//Height_optional
250;
//HilightInView_optionnal
false;
//DisplayModeOnly_optional
false;
//ShowElementCount_optionnal
false;
//DefaultValuesIndices_optionnal
defaultValues;
//SortItems_optionnal
true;
//ShowId_optionnal
false;
# ----------------------------------------
listview_data = Custom[Listview Data](InputName=code_block_5.out0, Keys=code_block_5.keys, Values=code_block_5.values, Height_optionnal=code_block_5.out3, HilightInView_optionnal=code_block_5.out4, DisplayModeOnly_optionnal=code_block_5.out5, ShowElementCount_optionnal=code_block_5.out6, DefaultValueIndices_optionnal=code_block_5.defaultValues, SortItems_optionnal=code_block_5.out8, ShowId_optionnal=code_block_5.out9)  # package Data-Shapes; Create data for ListView input in UI.MultiInputForm ++ . Check out www.data-shapes.net for more infos.
code_block_6 = CodeBlock()
# ---------- code_block_6.designscript (17 lines) ----------
//InputName
"Opciones";

//Keys
[
"Bloquear",
"Desbloquear"
];

//Values
[
true,
false
];

//DefaultValueIndex
0;
# ----------------------------------------
radiobuttons_data = Custom[RadioButtons Data](InputName=code_block_6.out0, Keys=code_block_6.out1, Values=code_block_6.out2, DefaultValueIndex=code_block_6.out3)  # package Data-Shapes; Create radio buttons input for UI.MultipleInputForm ++ .
list_create = List.Create(item0=listview_data, item1=radiobuttons_data)
python_script = Python(IN[0]=parameterExists, IN[1]=list_create)
# ---------- python_script.python (9 lines) ----------
validacion = IN[0][0]
inputs = IN[1]

if validacion == True:
	res = inputs
else:
	res = []

OUT = res
# ----------------------------------------
code_block_7 = CodeBlock(inputs=python_script)
# ---------- code_block_7.designscript (29 lines) ----------
//Description_optional
"Bloquear Elementos";

//Logo


//ButtonText
"INICIAR";

//Inputs
inputs;

//Toggle
true;

//LinkToHelp


//CancelButtonText
"CANCELAR";

//MaxHeight
900;

//Width
430;

//LabelWidth
150;
# ----------------------------------------
multipleinputform = Custom[MultipleInputForm ++](Description_optional=code_block_7.out0, ButtonText_optional=code_block_7.out1, Inputs=code_block_7.inputs, Toggle=code_block_7.out3, CancelButtonText_optional=code_block_7.out4, MaxHeight_optional=code_block_7.out5, Width_optional=code_block_7.out6, LabelWidth_optional=code_block_7.out7)  # package Data-Shapes; Create a form with multiple inputs. see www.data-shapes.net for tutorials and infos!
python_script_2 = Python(IN[0]=multipleinputform.User_Inputs)
# ---------- python_script_2.python (7 lines) ----------
input = IN[0]

if input == [] or input == None:
	res = []
else:
	res = input[0]
OUT = res
# ----------------------------------------
all_elements_of_category_2 = ElementsOfCategory(Category=python_script_2)
flatten = List.Flatten(list=all_elements_of_category_2)
python_script_3 = Python(IN[0]=multipleinputform.User_Inputs)
# ---------- python_script_3.python (7 lines) ----------
input = IN[0]

if input == [] or input == None:
	res = []
else:
	res = input[1]
OUT = res
# ----------------------------------------
setPinnedStatus = Element.SetPinnedStatus(element=flatten, pinned=python_script_3)
