# Dynamo graph linkMultipleRVT_script.dyn (Dynamo 2.16.2.5624)
# packages: Morpheus 2019.8.26, Data-Shapes 2022.2.103, Clockwork for Dynamo 2.x 2.4.0

code_block = CodeBlock { "Validacion"; }
code_block_2 = CodeBlock { "Project Information"; }
byName = Category.ByName(name=code_block_2)
all_elements_of_category = ElementsOfCategory(Category=byName)
parameterExists = Custom[Element.ParameterExists](param=code_block, element=all_elements_of_category)  # package Clockwork for Dynamo 2.x; Checks if an element contains a parameter of a given name
code_block_3 = CodeBlock()
# ---------- code_block_3.designscript (16 lines) ----------
//InputName
"Buscar Directorio";
//Keys
[
"Internal Origin to Internal Origin",
"Project Base Point to Project Base Point",
"By Shared Coordinates"
];
//Values
[
"Internal Origin to Internal Origin",
"Project Base Point to Project Base Point",
"By Shared Coordinates"
];
//DefaultValueIndex
0;
# ----------------------------------------
radiobuttons_data = Custom[RadioButtons Data](InputName=code_block_3.out0, Keys=code_block_3.out1, Values=code_block_3.out2, DefaultValueIndex=code_block_3.out3)  # package Data-Shapes; Create radio buttons input for UI.MultipleInputForm ++ .
code_block_4 = CodeBlock()
# ---------- code_block_4.designscript (6 lines) ----------
//InputName
"Buscar Directorio";
//DefaulPath

//ButtonText
"EXPLORAR";
# ----------------------------------------
directorypath_data = Custom[DirectoryPath Data](InputName=code_block_4.out0, ButtonText=code_block_4.out1)  # package Data-Shapes; Creates a DirectoryPath input for UI.MultipleInputForm ++ . Check out www.data-shapes.net for more infos!
list_create = List.Create(item0=radiobuttons_data, item1=directorypath_data)
python_script = Python(IN[0]=parameterExists, IN[1]=list_create)  # IronPython2
# ---------- python_script.python (9 lines) ----------
validacion = IN[0][0]
inputs = IN[1]

if validacion == True:
	res = inputs
else:
	res = []

OUT = res
# ----------------------------------------
code_block_5 = CodeBlock(inputs=python_script)
# ---------- code_block_5.designscript (29 lines) ----------
//Description_optional
"Vincular Modelos";

//Logo


//ButtonText
"INICIAR";

//Inputs
inputs;

//Toggle
true;

//LinkToHelp


//CancelButtonText
"CANCELAR";

//MaxHeight
900;

//Width
600;

//LabelWidth
150;
# ----------------------------------------
multipleinputform = Custom[MultipleInputForm ++](Description_optional=code_block_5.out0, ButtonText_optional=code_block_5.out1, Inputs=code_block_5.inputs, Toggle=code_block_5.out3, CancelButtonText_optional=code_block_5.out4, MaxHeight_optional=code_block_5.out5, Width_optional=code_block_5.out6, LabelWidth_optional=code_block_5.out7)  # package Data-Shapes; Create a form with multiple inputs. see www.data-shapes.net for tutorials and infos!
python_script_2 = Python(IN[0]=multipleinputform.User_Inputs)  # IronPython2
# ---------- python_script_2.python (7 lines) ----------
input = IN[0]

if input == [] or input == None:
	res = []
else:
	res = input[1]
OUT = res
# ----------------------------------------
directory_from_path = DirectoryObject(path=python_script_2)
code_block_6 = CodeBlock { "*.rvt"; }
getDirectoryContents = FileSystem.GetDirectoryContents(directory=directory_from_path, searchString=code_block_6)
code_block_7 = CodeBlock { "\\"; }
split = String.Split(string=getDirectoryContents.files, separator0=code_block_7)
python_script_3 = Python(IN[0]=split)  # IronPython2
# ---------- python_script_3.python (7 lines) ----------
input = IN[0]

if input == [] or input == None:
	res = None
else:
	res = input
OUT = res
# ----------------------------------------
lastItem = List.LastItem(list=python_script_3@L2)
code_block_8 = CodeBlock(keys=lastItem, values=getDirectoryContents.files)
# ---------- code_block_8.designscript (20 lines) ----------
//InputName
"Seleccionar Modelos";
//Keys_
keys;
//Values_
values;
//Height_optional
500;
//HilightInView_optionnal
false;
//DisplayModeOnly_optional
false;
//ShowElementCount_optionnal
false;
//DefaultValuesIndices_optionnal
[];
//SortItems_optionnal
true;
//ShowId_optionnal
false;
# ----------------------------------------
listview_data = Custom[Listview Data](InputName=code_block_8.out0, Keys=code_block_8.keys, Values=code_block_8.values, Height_optionnal=code_block_8.out3, HilightInView_optionnal=code_block_8.out4, DisplayModeOnly_optionnal=code_block_8.out5, ShowElementCount_optionnal=code_block_8.out6, DefaultValueIndices_optionnal=code_block_8.out7, SortItems_optionnal=code_block_8.out8, ShowId_optionnal=code_block_8.out9)  # package Data-Shapes; Create data for ListView input in UI.MultiInputForm ++ . Check out www.data-shapes.net for more infos.
python_script_4 = Python(IN[0]=multipleinputform.User_Inputs)  # IronPython2
# ---------- python_script_4.python (7 lines) ----------
input = IN[0]

if input == [] or input == None:
	res = False
else:
	res = True
OUT = res
# ----------------------------------------
code_block_9 = CodeBlock(inputs=listview_data, toggle=python_script_4)
# ---------- code_block_9.designscript (29 lines) ----------
//Description_optional
"Project Base Point";

//Logo


//ButtonText
"INICIAR";

//Inputs
inputs;

//Toggle
toggle;

//LinkToHelp


//CancelButtonText
"CANCELAR";

//MaxHeight
900;

//Width
600;

//LabelWidth
150;
# ----------------------------------------
multipleinputform_2 = Custom[MultipleInputForm ++](Description_optional=code_block_9.out0, ButtonText_optional=code_block_9.out1, Inputs=code_block_9.inputs, Toggle=code_block_9.toggle, CancelButtonText_optional=code_block_9.out4, MaxHeight_optional=code_block_9.out5, Width_optional=code_block_9.out6, LabelWidth_optional=code_block_9.out7)
python_script_5 = Python(IN[0]=multipleinputform_2.User_Inputs)  # IronPython2
# ---------- python_script_5.python (7 lines) ----------
input = IN[0]

if input == [] or input == None:
	res = []
else:
	res = input
OUT = res
# ----------------------------------------
flatten = List.Flatten(list=python_script_5)
python_script_6 = Python(IN[0]=multipleinputform.User_Inputs, IN[1]=flatten)  # IronPython2
# ---------- python_script_6.python (12 lines) ----------
input = IN[0]
paths = IN[1]

if input[0] == "Internal Origin to Internal Origin":
	res = [paths, [], []]
elif input[0] == "Project Base Point to Project Base Point":
	res = [[], paths, []]
elif input[0] == "By Shared Coordinates":
	res = [[], [], paths]
else:
	res = []
OUT = res
# ----------------------------------------
codeblock = CodeBlock(value=python_script_6) { value[0]; value[1]; value[2]; }
projectBasePoint = Custom[LinkModel.ProjectBasePoint](Filepaths=codeblock.out1)  # package Morpheus; Link models project base point to project base point. Optionally, the node can place the models on the selected worksets and pin them in place.
sharedCoordinates = Custom[LinkModel.SharedCoordinates](Filepaths=codeblock.out2)  # package Morpheus; Link models with shared coordinates. Optionally, the node can place the models on the selected worksets and pin them in place.
originToOrigin = Custom[LinkModel.OriginToOrigin](Filepaths=codeblock.out0)  # package Morpheus; Link models origin to origin. Optionally, the node can place the models on the selected worksets and pin them in place.
