# Dynamo graph emplantillado_script.dyn (Dynamo 2.6.2.15705)
# packages: Data-Shapes 2022.2.103, Clockwork for Dynamo 2.x 2.4.0, Genius Loci 2021.11.10

code_block = CodeBlock { "Validacion"; }
code_block_2 = CodeBlock { "Project Information"; }
byName = Category.ByName(name=code_block_2)
all_elements_of_category = ElementsOfCategory(Category=byName)
parameterExists = Custom[Element.ParameterExists](param=code_block, element=all_elements_of_category)  # package Clockwork for Dynamo 2.x; Checks if an element contains a parameter of a given name
code_block_3 = CodeBlock()
# ---------- code_block_3.designscript (11 lines) ----------
//InputName
"Seleccionar\nFundaciones";

//ButtonText
"SELECCIONAR";

//CategoryFilter
 Revit.Category.ByName("Structural Foundations");

//SelectSingleElement
false;
# ----------------------------------------
selectmodelelements_data = Custom[SelectModelElements Data](InputName=code_block_3.out0, ButtonText=code_block_3.out1, CategoryFilter=code_block_3.out2, SelectSingleElement=code_block_3.out3)  # package Data-Shapes; Creates a Revit element selection input for UI.MultipleInputForm++ . Check out www.data-shapes.net for more infos!
element_types_ᶜᵒⁿᵛᵉʳᵗᵉᵈ_ᵈʳᵒᵖᵈᵒʷⁿ = CodeBlock { DSCore.Types.FindTypeByNameInAssembly("FloorType", "RevitAPI"); }
all_elements_of_type = ElementsOfType(element_type=element_types_ᶜᵒⁿᵛᵉʳᵗᵉᵈ_ᵈʳᵒᵖᵈᵒʷⁿ)
name = Element.Name(element=all_elements_of_type)
code_block_4 = CodeBlock { "EMPLANTILLADO"; }
contains = String.Contains(str=name, searchFor=code_block_4)
filterByBoolMask = List.FilterByBoolMask(list=all_elements_of_type, mask=contains)
code_block_5 = CodeBlock { "Default Thickness"; }
getParameterValueByName = Element.GetParameterValueByName(element=filterByBoolMask.in, parameterName=code_block_5)
ceiling = Math.Ceiling(number=getParameterValueByName)
string_from_object = FromObject(obj=ceiling)
code_block_6 = CodeBlock(keys=string_from_object, values=filterByBoolMask.in)
# ---------- code_block_6.designscript (14 lines) ----------
//InputName
"Espesor Emplantillado";

//Keys
keys;

//Values
values;

//DefaultValueIndex
0;

//Sorted
true;
# ----------------------------------------
dropdown_data = Custom[DropDown Data](InputName=code_block_6.out0, Keys=code_block_6.keys, Values=code_block_6.values, DefaultValueIndex=code_block_6.out3, Sorted_optional=code_block_6.out4)  # package Data-Shapes; Create data for DropDown input in UI.MultiInputForm ++ . Check out www.data-shapes.net for more infos.
list_create = List.Create(item0=selectmodelelements_data, item1=dropdown_data)
python_script = Python(IN[0]=parameterExists, IN[1]=list_create)
# ---------- python_script.python (9 lines) ----------
validacion = IN[0][0]
inputs = IN[1]

if validacion == True:
	res = inputs
else:
	res = []

OUT = res
# ----------------------------------------
code_block_7 = CodeBlock(inputs=python_script)
# ---------- code_block_7.designscript (29 lines) ----------
//Description_optional
"Emplantillado";

//Logo


//ButtonText
"INICIAR";

//Inputs
inputs;

//Toggle
true;

//LinkToHelp


//CancelButtonText
"CANCELAR";

//MaxHeight
900;

//Width
500;

//LabelWidth
150;
# ----------------------------------------
multipleinputform = Custom[MultipleInputForm ++](Description_optional=code_block_7.out0, ButtonText_optional=code_block_7.out1, Inputs=code_block_7.inputs, Toggle=code_block_7.out3, CancelButtonText_optional=code_block_7.out4, MaxHeight_optional=code_block_7.out5, Width_optional=code_block_7.out6, LabelWidth_optional=code_block_7.out7)  # package Data-Shapes; Create a form with multiple inputs. see www.data-shapes.net for tutorials and infos!
python_script_2 = Python(IN[0]=multipleinputform.User_Inputs)
# ---------- python_script_2.python (7 lines) ----------
input = IN[0]

if input == [] or input == None:
	res = []
else:
	res = input[0]
OUT = res
# ----------------------------------------
closest_level = Custom[Closest Level](element=python_script_2)  # package Genius Loci; Return the closest level below the given element.
current = Document.Current()
activeView = Document.ActiveView(document=current)
type = Custom[View.Type](view=activeView)  # package Clockwork for Dynamo 2.x; Returns the type of a given view
python_script_3 = Python(IN[0]=type, IN[1]=activeView)
# ---------- python_script_3.python (8 lines) ----------
input = IN[0]
view = IN[1]

if input == "ThreeD" or input == None:
	res = []
else:
	res = view
OUT = res
# ----------------------------------------
byUnion = Solid.ByUnion()  # unwired: solids
byUnion_2 = Solid.ByUnion()  # unwired: solids
geometry = Custom[Element.Geometry+](element=python_script_2)  # package Clockwork for Dynamo 2.x; Returns Dynamo AND native Revit geometry of a given element
flatten = List.Flatten(list=geometry.dynamoGeometry)
doesIntersect = Geometry.DoesIntersect(geometry=flatten@L1, other=flatten@L2, lacing=Longest)
filterByBoolMask_2 = List.FilterByBoolMask(list=flatten@L2, mask=doesIntersect@L2, lacing=Longest)
function_apply = ApplyFunction(func=byUnion_2, arg1=filterByBoolMask_2.in)
python_script_4 = Python(IN[0]=function_apply)
# ---------- python_script_4.python (7 lines) ----------
input = IN[0]

if input == [] or input == None:
	res = []
else:
	res = input
OUT = res
# ----------------------------------------
doesIntersect_2 = Geometry.DoesIntersect(geometry=python_script_4@L1, other=python_script_4@L2, lacing=Longest)
filterByBoolMask_3 = List.FilterByBoolMask(list=python_script_4@L2, mask=doesIntersect_2@L2, lacing=Longest)
function_apply_2 = ApplyFunction(func=byUnion, arg1=filterByBoolMask_3.in)
python_script_5 = Python(IN[0]=function_apply_2)  # same code as python_script_4
flatten_2 = List.Flatten(list=python_script_5)
pruneDuplicates = Custom[Geometry.PruneDuplicates](GeometryList=flatten_2)  # package Data-Shapes; Removes all duplicate geometries from list.
faces = Topology.Faces(topology=pruneDuplicates)
surfaceGeometry = Face.SurfaceGeometry(face=faces)
normalAtParameter = Surface.NormalAtParameter(surface=surfaceGeometry)
ZAxis = Vector.ZAxis()
reverse = Vector.Reverse(vector=ZAxis)
isAlmostEqualTo = Vector.IsAlmostEqualTo(vector=normalAtParameter, other=reverse)
filterByBoolMask_4 = List.FilterByBoolMask(list=surfaceGeometry, mask=isAlmostEqualTo)
flatten_3 = List.Flatten(list=filterByBoolMask_4.in)
perimeterCurves = Surface.PerimeterCurves(surface=flatten_3)
python_script_6 = Python(IN[0]=perimeterCurves)
# ---------- python_script_6.python (7 lines) ----------
input = IN[0]

if input == [] or input == None:
	res = None
else:
	res = input
OUT = res
# ----------------------------------------
python_script_7 = Python(IN[0]=multipleinputform.User_Inputs)
# ---------- python_script_7.python (7 lines) ----------
input = IN[0]

if input == [] or input == None:
	res = []
else:
	res = input[1]
OUT = res
# ----------------------------------------
code_block_8 = CodeBlock { "Levels"; }
byName_2 = Category.ByName(name=code_block_8)
all_elements_of_category_2 = ElementsOfCategory(Category=byName_2)
elevation = Level.Elevation(level=all_elements_of_category_2)
minimumItem = List.MinimumItem(list=elevation)
eq = elevation == minimumItem
filterByBoolMask_5 = List.FilterByBoolMask(list=all_elements_of_category_2, mask=eq)
code_block_9 = CodeBlock(curves=python_script_6, floorType=python_script_7, level=filterByBoolMask_5.in)
# ---------- code_block_9.designscript (8 lines) ----------
//outlineCurves
curves;

//floorType
floorType;

//level
level;
# ----------------------------------------
byOutlineTypeAndLevel = Floor.ByOutlineTypeAndLevel(outlineCurves=code_block_9.curves@L2, floorType=code_block_9.floorType@L1, level=code_block_9.level@L1, lacing=Longest)
geometry_2 = Element.Geometry(element=byOutlineTypeAndLevel)
flatten_4 = List.Flatten(list=geometry_2)
centroid = Solid.Centroid(solid=flatten_4)
byElementAndLocation = Tag.ByElementAndLocation(view=python_script_3, element=byOutlineTypeAndLevel, location=centroid)
code_block_10 = CodeBlock(element=byElementAndLocation)
# ---------- code_block_10.designscript (8 lines) ----------
//element
element;

//parameterName
"Leader Line";

//value
1;
# ----------------------------------------
setParameterByName = Element.SetParameterByName(element=code_block_10.element, parameterName=code_block_10.out1, value=code_block_10.out2)
code_block_11 = CodeBlock { "EST_A_STRUCTURAL FOUNDATION TAG_ELEVACION_EMPLANTILLADO"; }
byName_3 = Family.ByName(name=code_block_11)
code_block_12 = CodeBlock { "Emplantillado"; }
byFamilyAndName = FamilyType.ByFamilyAndName(family=byName_3, name=code_block_12)
code_block_13 = CodeBlock(element=setParameterByName, value=byFamilyAndName)
# ---------- code_block_13.designscript (8 lines) ----------
//element
element;

//parameterName
"Type";

//value
value;
# ----------------------------------------
setParameterByName_2 = Element.SetParameterByName(element=code_block_13.element, parameterName=code_block_13.out1, value=code_block_13.value)
plane = Custom[View.Plane](view=activeView)  # package Clockwork for Dynamo 2.x; Retrieves the plane of a given view
XAxis = Plane.XAxis(plane=plane)
code_block_14 = CodeBlock(geometry=centroid, direction=XAxis)
# ---------- code_block_14.designscript (8 lines) ----------
//goemetry
geometry;

//direction
direction;

//distance
300;
# ----------------------------------------
translate = Geometry.Translate(geometry=code_block_14.geometry, direction=code_block_14.direction, distance=code_block_14.out2)
YAxis = Plane.YAxis(plane=plane)
code_block_15 = CodeBlock(geometry=translate, direction=YAxis)
# ---------- code_block_15.designscript (8 lines) ----------
//goemetry
geometry;

//direction
direction;

//distance
-200;
# ----------------------------------------
translate_2 = Geometry.Translate(geometry=code_block_15.geometry, direction=code_block_15.direction, distance=code_block_15.out2)
tag_setlocation = Custom[Tag SetLocation](tag=setParameterByName_2, location=translate_2)  # package Genius Loci; Moves the head of the tag to the given location point.
