# Dynamo graph script.dyn (Dynamo 2.6.2.15705)
# packages: Clockwork for Dynamo 2.x 2.4.0

code_block = CodeBlock { "Structural Framing"; }
byName = Category.ByName(name=code_block)
current = Document.Current()
activeView = Document.ActiveView(document=current)
all_elements_of_category_in_view = ElementsOfCategoryInView(Category=byName, View=activeView)
code_block_2 = CodeBlock { "Start Join Cutback"; }
parameterExists = Custom[Element.ParameterExists](param=code_block_2, element=all_elements_of_category_in_view)  # package Clockwork for Dynamo 2.x; Checks if an element contains a parameter of a given name
filterByBoolMask = List.FilterByBoolMask(list=all_elements_of_category_in_view, mask=parameterExists)
code_block_3 = CodeBlock { 0; }
setParameterByName = Element.SetParameterByName(element=filterByBoolMask.in, parameterName=code_block_2, value=code_block_3)
code_block_4 = CodeBlock { "End Join Cutback"; }
parameterExists_2 = Custom[Element.ParameterExists](param=code_block_4, element=all_elements_of_category_in_view)
filterByBoolMask_2 = List.FilterByBoolMask(list=all_elements_of_category_in_view, mask=parameterExists_2)
code_block_5 = CodeBlock { 0; }
setParameterByName_2 = Element.SetParameterByName(element=filterByBoolMask_2.in, parameterName=code_block_4, value=code_block_5)
