# Dynamo graph UnionElementos_script.dyn (Dynamo 2.6.2.15705)
# packages: Clockwork for Dynamo 2.x 2.4.0

code_block = CodeBlock { "Structural Columns"; }
byName = Category.ByName(name=code_block)
all_elements_of_category = ElementsOfCategory(Category=byName)
materials = Custom[Element.Materials+](element=all_elements_of_category)  # package Clockwork for Dynamo 2.x; Retrieves all materials from a given element. Unlike the OOTB node Element.GetMaterials, it also retrieves QTO information.
flatten = List.Flatten(list=materials.materials)
name = Custom[Element.Name+](element=flatten)  # package Clockwork for Dynamo 2.x; Gets an element's name. Unlike the OOTB node, this node should work for *all* Revit elements that have names and will also return the localized names of system parameters, parameter groups, display unit types, parameter types, unit symbol types, unit types and ForgeTypeIds.
code_block_2 = CodeBlock { "Concrete, Cast-in-Place gray"; }
eq = name == code_block_2
filterByBoolMask = List.FilterByBoolMask(list=all_elements_of_category, mask=eq)
code_block_3 = CodeBlock { ["Floors", "Structural Foundations", "Structural Framing"]; }
byName_2 = Category.ByName(name=code_block_3)
all_elements_of_category_2 = ElementsOfCategory(Category=byName_2)
flatten_2 = List.Flatten(list=all_elements_of_category_2)
materials_2 = Custom[Element.Materials+](element=flatten_2)
flatten_3 = List.Flatten(list=materials_2.materials)
name_2 = Custom[Element.Name+](element=flatten_3)
code_block_4 = CodeBlock { "Concrete, Cast-in-Place gray"; }
eq_2 = name_2 == code_block_4
filterByBoolMask_2 = List.FilterByBoolMask(list=flatten_2, mask=eq_2)
geometry = Custom[Element.Geometry+](element=filterByBoolMask.in)  # package Clockwork for Dynamo 2.x; Returns Dynamo AND native Revit geometry of a given element
flatten_4 = List.Flatten(list=geometry.dynamoGeometry)
geometry_2 = Custom[Element.Geometry+](element=filterByBoolMask_2.in)
flatten_5 = List.Flatten(list=geometry_2.dynamoGeometry)
doesIntersect = Geometry.DoesIntersect(geometry=flatten_4@L1, other=flatten_5@L2, lacing=Longest)
filterByBoolMask_3 = List.FilterByBoolMask(list=filterByBoolMask_2.in@L2, mask=doesIntersect@L2, lacing=Longest)
joinGeometry = Custom[Element.JoinGeometry](element1=filterByBoolMask.in@L1, element2=filterByBoolMask_3.in@L2, lacing=Longest)  # package Clockwork for Dynamo 2.x; Joins two model elements (if possible). Only works inside the project environment.
setGeometryJoinOrder = Element.SetGeometryJoinOrder(cuttingElement=joinGeometry.element1@L1, otherElement=joinGeometry.element2@L2, lacing=Longest)
code_block_5 = CodeBlock { "Structural Framing"; }
byName_3 = Category.ByName(name=code_block_5)
all_elements_of_category_3 = ElementsOfCategory(Category=byName_3)
materials_3 = Custom[Element.Materials+](element=all_elements_of_category_3)
flatten_6 = List.Flatten(list=materials_3.materials)
name_3 = Custom[Element.Name+](element=flatten_6)
code_block_6 = CodeBlock { "Concrete, Cast-in-Place gray"; }
eq_3 = name_3 == code_block_6
filterByBoolMask_4 = List.FilterByBoolMask(list=all_elements_of_category_3, mask=eq_3)
code_block_7 = CodeBlock { "Floors"; }
byName_4 = Category.ByName(name=code_block_7)
all_elements_of_category_4 = ElementsOfCategory(Category=byName_4)
flatten_7 = List.Flatten(list=all_elements_of_category_4)
materials_4 = Custom[Element.Materials+](element=flatten_7)
flatten_8 = List.Flatten(list=materials_4.materials)
name_4 = Custom[Element.Name+](element=flatten_8)
code_block_8 = CodeBlock { "Concrete, Cast-in-Place gray"; }
eq_4 = name_4 == code_block_8
filterByBoolMask_5 = List.FilterByBoolMask(list=flatten_7, mask=eq_4)
geometry_3 = Custom[Element.Geometry+](element=filterByBoolMask_4.in)
flatten_9 = List.Flatten(list=geometry_3.dynamoGeometry)
geometry_4 = Custom[Element.Geometry+](element=filterByBoolMask_5.in)
flatten_10 = List.Flatten(list=geometry_4.dynamoGeometry)
doesIntersect_2 = Geometry.DoesIntersect(geometry=flatten_9@L1, other=flatten_10@L2, lacing=Longest)
filterByBoolMask_6 = List.FilterByBoolMask(list=filterByBoolMask_5.in@L2, mask=doesIntersect_2@L2, lacing=Longest)
joinGeometry_2 = Custom[Element.JoinGeometry](element1=filterByBoolMask_4.in@L1, element2=filterByBoolMask_6.in@L2, lacing=Longest)
setGeometryJoinOrder_2 = Element.SetGeometryJoinOrder(cuttingElement=joinGeometry_2.element1@L1, otherElement=joinGeometry_2.element2@L2, lacing=Longest)
code_block_9 = CodeBlock { "Walls"; }
byName_5 = Category.ByName(name=code_block_9)
all_elements_of_category_5 = ElementsOfCategory(Category=byName_5)
materials_5 = Custom[Element.Materials+](element=all_elements_of_category_5)
flatten_11 = List.Flatten(list=materials_5.materials)
name_5 = Custom[Element.Name+](element=flatten_11)
code_block_10 = CodeBlock { "Concrete, Cast-in-Place gray"; }
eq_5 = name_5 == code_block_10
filterByBoolMask_7 = List.FilterByBoolMask(list=all_elements_of_category_5, mask=eq_5)
code_block_11 = CodeBlock { ["Floors", "Structural Foundations"]; }
byName_6 = Category.ByName(name=code_block_11)
all_elements_of_category_6 = ElementsOfCategory(Category=byName_6)
flatten_12 = List.Flatten(list=all_elements_of_category_6)
materials_6 = Custom[Element.Materials+](element=flatten_12)
flatten_13 = List.Flatten(list=materials_6.materials)
name_6 = Custom[Element.Name+](element=flatten_13)
code_block_12 = CodeBlock { "Concrete, Cast-in-Place gray"; }
eq_6 = name_6 == code_block_12
filterByBoolMask_8 = List.FilterByBoolMask(list=flatten_12, mask=eq_6)
geometry_5 = Custom[Element.Geometry+](element=filterByBoolMask_7.in)
flatten_14 = List.Flatten(list=geometry_5.dynamoGeometry)
geometry_6 = Custom[Element.Geometry+](element=filterByBoolMask_8.in)
flatten_15 = List.Flatten(list=geometry_6.dynamoGeometry)
doesIntersect_3 = Geometry.DoesIntersect(geometry=flatten_14@L1, other=flatten_15@L2, lacing=Longest)
filterByBoolMask_9 = List.FilterByBoolMask(list=filterByBoolMask_8.in@L2, mask=doesIntersect_3@L2, lacing=Longest)
joinGeometry_3 = Custom[Element.JoinGeometry](element1=filterByBoolMask_7.in@L1, element2=filterByBoolMask_9.in@L2, lacing=Longest)
getCategory = Element.GetCategory(element=joinGeometry_3.element2)
string_from_object = FromObject(obj=getCategory)
code_block_13 = CodeBlock { "Floors"; }
eq_7 = string_from_object == code_block_13
filterByBoolMask_10 = List.FilterByBoolMask(list=joinGeometry_3.element2, mask=eq_7)
setGeometryJoinOrder_3 = Element.SetGeometryJoinOrder(cuttingElement=joinGeometry_3.element1@L1, otherElement=filterByBoolMask_10.in@L2, lacing=Longest)
code_block_14 = CodeBlock { 0; }
getItemAtIndex = List.GetItemAtIndex(list=setGeometryJoinOrder_3@L2, index=code_block_14)
uniqueItems = List.UniqueItems(list=getItemAtIndex)
code_block_15 = CodeBlock { "Walls"; }
byName_7 = Category.ByName(name=code_block_15)
all_elements_of_category_7 = ElementsOfCategory(Category=byName_7)
flatten_16 = List.Flatten(list=all_elements_of_category_7)
materials_7 = Custom[Element.Materials+](element=flatten_16)
flatten_17 = List.Flatten(list=materials_7.materials)
name_7 = Custom[Element.Name+](element=flatten_17)
code_block_16 = CodeBlock { "Concrete, Cast-in-Place gray"; }
eq_8 = name_7 == code_block_16
filterByBoolMask_11 = List.FilterByBoolMask(list=flatten_16, mask=eq_8)
geometry_7 = Custom[Element.Geometry+](element=uniqueItems)
flatten_18 = List.Flatten(list=geometry_7.dynamoGeometry)
geometry_8 = Custom[Element.Geometry+](element=filterByBoolMask_11.in)
flatten_19 = List.Flatten(list=geometry_8.dynamoGeometry)
doesIntersect_4 = Geometry.DoesIntersect(geometry=flatten_18@L1, other=flatten_19@L2, lacing=Longest)
filterByBoolMask_12 = List.FilterByBoolMask(list=filterByBoolMask_11.in@L2, mask=doesIntersect_4@L2, lacing=Longest)
joinGeometry_4 = Custom[Element.JoinGeometry](element1=uniqueItems@L1, element2=filterByBoolMask_12.in@L2, lacing=Longest)
