# Dynamo graph CotaEspesorFundacion_script.dyn (Dynamo 2.6.2.15705)
# packages: Data-Shapes 2022.2.103, Clockwork for Dynamo 2.x 2.4.0, Genius Loci 2021.11.10

current = Document.Current()
activeView = Document.ActiveView(document=current)
type = Custom[View.Type](view=activeView)  # package Clockwork for Dynamo 2.x; Returns the type of a given view
code_block = CodeBlock(view_type=type)
# ---------- code_block.designscript (5 lines) ----------
//Tittle
"Error";

//TextNote
"Esta herramienta no puede ser usada en vistas de tipo " + view_type + ".";
# ----------------------------------------
textnote_data = Custom[TextNote Data](Title=code_block.out0, TextNote=code_block.out1)  # package Data-Shapes; Create Data for TextNote input in UI.MultipleInputForm ++ . Check out www.data-shapes.net for more informations
python_script = Python(IN[0]=type)
# ---------- python_script.python (8 lines) ----------
input = IN[0]

if input in ["CeilingPlan", "EngineeringPlan", "FloorPlan"]:
	toggle = False
else:
	toggle = True
	
OUT = toggle
# ----------------------------------------
code_block_2 = CodeBlock(inputs=textnote_data, toggle=python_script)
# ---------- code_block_2.designscript (29 lines) ----------
//Description_optional
"Acotado Fundación Corrida";

//Logo


//ButtonText
"ACEPTAR";

//Inputs
inputs;

//Toggle
toggle;

//LinkToHelp


//CancelButtonText


//MaxHeight


//Width
450;

//LabelWidth
150;
# ----------------------------------------
multipleinputform = Custom[MultipleInputForm ++](Description_optional=code_block_2.out0, ButtonText_optional=code_block_2.out1, Inputs=code_block_2.inputs, Toggle=code_block_2.toggle, Width_optional=code_block_2.out4, LabelWidth_optional=code_block_2.out5)  # package Data-Shapes; Create a form with multiple inputs. see www.data-shapes.net for tutorials and infos!
code_block_3 = CodeBlock { "Validacion"; }
code_block_4 = CodeBlock { "Project Information"; }
byName = Category.ByName(name=code_block_4)
all_elements_of_category = ElementsOfCategory(Category=byName)
parameterExists = Custom[Element.ParameterExists](param=code_block_3, element=all_elements_of_category)  # package Clockwork for Dynamo 2.x; Checks if an element contains a parameter of a given name
code_block_5 = CodeBlock()
# ---------- code_block_5.designscript (8 lines) ----------
//InputName
"Opciones";
//Keys
["Todos los Elementos en la Vista Actual", "Elementos Seleccionados en la Vista Actual"];
//Values
[false, true];
//DefaultValueIndexx
0;
# ----------------------------------------
radiobuttons_data = Custom[RadioButtons Data](InputName=code_block_5.out0, Keys=code_block_5.out1, Values=code_block_5.out2, DefaultValueIndex=code_block_5.out3)  # package Data-Shapes; Create radio buttons input for UI.MultipleInputForm ++ .
python_script_2 = Python(IN[0]=parameterExists, IN[1]=radiobuttons_data)
# ---------- python_script_2.python (9 lines) ----------
validacion = IN[0][0]
inputs = IN[1]

if validacion == True:
	res = inputs
else:
	res = []

OUT = res
# ----------------------------------------
python_script_3 = Python(IN[0]=type)
# ---------- python_script_3.python (8 lines) ----------
input = IN[0]

if input in ["CeilingPlan", "EngineeringPlan", "FloorPlan"]:
	toggle = True
else:
	toggle = False
	
OUT = toggle
# ----------------------------------------
code_block_6 = CodeBlock(inputs=python_script_2, toggle=python_script_3)
# ---------- code_block_6.designscript (29 lines) ----------
//Description_optional
"Acotado Fundación Corrida";

//Logo


//ButtonText
"SELECCIONAR";

//Inputs
inputs;

//Toggle
toggle;

//LinkToHelp


//CancelButtonText
"CANCELAR";

//MaxHeight


//Width
490;

//LabelWidth
150;
# ----------------------------------------
multipleinputform_2 = Custom[MultipleInputForm ++](Description_optional=code_block_6.out0, ButtonText_optional=code_block_6.out1, Inputs=code_block_6.inputs, Toggle=code_block_6.toggle, CancelButtonText_optional=code_block_6.out4, Width_optional=code_block_6.out5, LabelWidth_optional=code_block_6.out6)
python_script_4 = Python(IN[0]=multipleinputform_2.User_Inputs)
# ---------- python_script_4.python (8 lines) ----------
input = IN[0]

if input == None or input == [] or input[0] == "Set toggle to true!":
	input = []
else:
	input = input[0]
	
OUT = input
# ----------------------------------------
code_block_7 = CodeBlock()
# ---------- code_block_7.designscript (8 lines) ----------
//InputName
"Seleccionar Elementos";
//ButtonText
"SELECCIONAR";
//CategoryFilter
category = Revit.Category.ByName("Structural Foundations");
//SelectSingleElement
false;
# ----------------------------------------
selectmodelelements_data = Custom[SelectModelElements Data](InputName=code_block_7.out0, ButtonText=code_block_7.out1, CategoryFilter=code_block_7.category, SelectSingleElement=code_block_7.out3)  # package Data-Shapes; Creates a Revit element selection input for UI.MultipleInputForm++ . Check out www.data-shapes.net for more infos!
code_block_8 = CodeBlock(inputs=selectmodelelements_data, toggle=python_script_4)
# ---------- code_block_8.designscript (29 lines) ----------
//Description_optional
"Acotado Fundación Corrida";

//Logo


//ButtonText
"INICIAR";

//Inputs
inputs;

//Toggle
toggle;

//LinkToHelp


//CancelButtonText
"CANCELAR";

//MaxHeight


//Width
490;

//LabelWidth
150;
# ----------------------------------------
multipleinputform_3 = Custom[MultipleInputForm ++](Description_optional=code_block_8.out0, ButtonText_optional=code_block_8.out1, Inputs=code_block_8.inputs, Toggle=code_block_8.toggle, CancelButtonText_optional=code_block_8.out4, Width_optional=code_block_8.out5, LabelWidth_optional=code_block_8.out6)
code_block_9 = CodeBlock { "Structural Foundations"; }
byName_2 = Category.ByName(name=code_block_9)
current_2 = Document.Current()
activeView_2 = Document.ActiveView(document=current_2)
all_elements_of_category_in_view = ElementsOfCategoryInView(Category=byName_2, View=activeView_2)
kind = Custom[StructuralFoundation.Kind](structuralFoundation=all_elements_of_category_in_view@L2)  # package Clockwork for Dynamo 2.x; Retrieves the kind of a given structural foundation (isolated, wall, slab).
python_script_5 = Python(IN[0]=kind)
# ---------- python_script_5.python (8 lines) ----------
input = IN[0]

if input[0] == []:
	input = []
else:
	input

OUT = input
# ----------------------------------------
code_block_10 = CodeBlock { "Wall Footing"; }
eq = python_script_5 == code_block_10
filterByBoolMask = List.FilterByBoolMask(list=all_elements_of_category_in_view@L2, mask=eq@L2)
python_script_6 = Python(IN[0]=python_script_4, IN[1]=multipleinputform_3.User_Inputs, IN[2]=filterByBoolMask.in)
# ---------- python_script_6.python (10 lines) ----------
input = IN[0]
muros_seleccionados = IN[1]
muros_todos = IN[2]

if input == False:
	input = muros_todos
elif input == True:
	input = muros_seleccionados
	
OUT = input
# ----------------------------------------
python_script_7 = Python(IN[0]=python_script_6)
# ---------- python_script_7.python (8 lines) ----------
input = IN[0]

if input == []:
	input = []
else:
	input
	
OUT = input
# ----------------------------------------
element_host = Custom[Element Host](element=python_script_7@L2)  # package Genius Loci; Gets the host of the element. Unlike the OOTB node FamilyInstance.GetHost, it also works for elements hosted by a linked document, wall sweeps, foundations, railings and builing pads. Based on a Clockwork's node
python_script_8 = Python(IN[0]=element_host)  # same code as python_script_5
getLocation = Element.GetLocation(element=python_script_8)
ZAxis = Vector.ZAxis()
code_block_11 = CodeBlock { "Base Offset"; }
getParameterValueByName = Element.GetParameterValueByName(element=python_script_8, parameterName=code_block_11)
code_block_12 = CodeBlock(base_offset=getParameterValueByName) { -100 + base_offset; }
translate = Geometry.Translate(geometry=getLocation, direction=ZAxis, distance=code_block_12)
code_block_13 = CodeBlock { 0.5; }
pointAtParameter = Curve.PointAtParameter(curve=translate, param=code_block_13)
ZAxis_2 = Vector.ZAxis()
code_block_14 = CodeBlock { 90; }
rotate = Geometry.Rotate(geometry=translate, origin=pointAtParameter, axis=ZAxis_2, degrees=code_block_14)
code_block_15 = CodeBlock { 0.5; }
normalAtParameter = Curve.NormalAtParameter(curve=rotate, param=code_block_15)
code_block_16 = CodeBlock { 350; }
translate_2 = Geometry.Translate(geometry=rotate, direction=normalAtParameter, distance=code_block_16)
element_reference = Custom[Element Reference](element=element_host@L2)  # package Genius Loci; Gets the reference of a geometric object or a dimension or a reference plane.
python_script_9 = Python(IN[0]=python_script_7)
# ---------- python_script_9.python (26 lines) ----------
import clr
clr.AddReference('RevitAPI')
clr.AddReference('RevitServices')
from Autodesk.Revit.DB import Options, Solid
from RevitServices.Persistence import DocumentManager

doc = DocumentManager.Instance.CurrentDBDocument
collections_of_wall_foundations = UnwrapElement(IN[0])  # Listas de elementos de la categoría WallFoundation se proporcionan como entrada

options = Options()
options.ComputeReferences = True  # Necesario para obtener referencias

all_wall_foundation_faces = []
for wall_foundations in collections_of_wall_foundations:
    wall_foundation_faces = []
    for wall_foundation in wall_foundations:
        geo = wall_foundation.get_Geometry(options)
        wall_foundation_faces_temp = []
        for obj in geo:
            if isinstance(obj, Solid):  # Verificar si el objeto es un sólido
                for face in obj.Faces:  # Iterar sobre las caras del sólido
                    wall_foundation_faces_temp.append(face.Reference)  # Añadir la referencia de la cara a la lista temporal
        wall_foundation_faces.append(wall_foundation_faces_temp)  # Añadir la lista de caras de una pared a la lista principal
    all_wall_foundation_faces.append(wall_foundation_faces)

OUT = all_wall_foundation_faces
# ----------------------------------------
python_script_10 = Python(IN[0]=python_script_7)
# ---------- python_script_10.python (8 lines) ----------
input = IN[0]

if input == []:
	input = []
else:
	input

OUT = input
# ----------------------------------------
faces = Element.Faces(element=python_script_10)
doesIntersect = Geometry.DoesIntersect(geometry=faces, other=rotate)
filterByBoolMask_2 = List.FilterByBoolMask(list=python_script_9, mask=doesIntersect)
addItemToFront = List.AddItemToFront(item=element_reference@L1, list=filterByBoolMask_2.in@L2)
dimension_byreferences = Custom[Dimension ByReferences](line=translate_2@L1, references=addItemToFront@L2, lacing=Longest)  # package Genius Loci; Creates a new linear dimension from at least two geometric references of an object.
dimension_byreferences_2 = Custom[Dimension ByReferences](line=rotate@L1, references=filterByBoolMask_2.in@L2, lacing=Longest)
