# Dynamo graph CotaEspesorMuro_script.dyn (Dynamo 2.6.2.15705)
# packages: Clockwork for Dynamo 2.x 2.4.0, Genius Loci 2021.11.10, Rhythm 2021.7.2, Data-Shapes 2022.2.103

current = Document.Current()
activeView = Document.ActiveView(document=current)
type = Custom[View.Type](view=activeView)  # package Clockwork for Dynamo 2.x; Returns the type of a given view
python_script = Python(IN[0]=type, IN[1]=activeView)
# ---------- python_script.python (9 lines) ----------
view_type = IN[0]
view = IN[1]

if view_type in ["CeilingPlan", "EngineeringPlan", "FloorPlan"]:
	toggle = view
else:
	toggle = []
	
OUT = toggle
# ----------------------------------------
code_block = CodeBlock { "Validacion"; }
code_block_2 = CodeBlock { "Project Information"; }
byName = Category.ByName(name=code_block_2)
all_elements_of_category = ElementsOfCategory(Category=byName)
parameterExists = Custom[Element.ParameterExists](param=code_block, element=all_elements_of_category)  # package Clockwork for Dynamo 2.x; Checks if an element contains a parameter of a given name
code_block_3 = CodeBlock()
# ---------- code_block_3.designscript (8 lines) ----------
//InputName
"Opciones";
//Keys
["Todos los Elementos en la Vista Actual", "Elementos Seleccionados en la Vista Actual"];
//Values
[false, true];
//DefaultValueIndexx
0;
# ----------------------------------------
radiobuttons_data = Custom[RadioButtons Data](InputName=code_block_3.out0, Keys=code_block_3.out1, Values=code_block_3.out2, DefaultValueIndex=code_block_3.out3)  # package Data-Shapes; Create radio buttons input for UI.MultipleInputForm ++ .
python_script_2 = Python(IN[0]=parameterExists, IN[1]=radiobuttons_data)
# ---------- python_script_2.python (9 lines) ----------
validacion = IN[0][0]
inputs = IN[1]

if validacion == True:
	res = inputs
else:
	res = []

OUT = res
# ----------------------------------------
current_2 = Document.Current()
activeView_2 = Document.ActiveView(document=current_2)
type_2 = Custom[View.Type](view=activeView_2)
python_script_3 = Python(IN[0]=type_2)
# ---------- python_script_3.python (8 lines) ----------
input = IN[0]

if input in ["CeilingPlan", "EngineeringPlan", "FloorPlan"]:
	toggle = True
else:
	toggle = False
	
OUT = toggle
# ----------------------------------------
code_block_4 = CodeBlock(inputs=python_script_2, toggle=python_script_3)
# ---------- code_block_4.designscript (29 lines) ----------
//Description_optional
"Acotado Espesor Muros";

//Logo


//ButtonText
"SELECCIONAR";

//Inputs
inputs;

//Toggle
toggle;

//LinkToHelp


//CancelButtonText
"CANCELAR";

//MaxHeight


//Width
490;

//LabelWidth
150;
# ----------------------------------------
multipleinputform = Custom[MultipleInputForm ++](Description_optional=code_block_4.out0, ButtonText_optional=code_block_4.out1, Inputs=code_block_4.inputs, Toggle=code_block_4.toggle, CancelButtonText_optional=code_block_4.out4, Width_optional=code_block_4.out5, LabelWidth_optional=code_block_4.out6)  # package Data-Shapes; Create a form with multiple inputs. see www.data-shapes.net for tutorials and infos!
python_script_4 = Python(IN[0]=multipleinputform.User_Inputs)
# ---------- python_script_4.python (8 lines) ----------
input = IN[0]

if input == None or input == [] or input[0] == "Set toggle to true!":
	input = []
else:
	input = input[0]
	
OUT = input
# ----------------------------------------
code_block_5 = CodeBlock()
# ---------- code_block_5.designscript (8 lines) ----------
//InputName
"Seleccionar Elementos";
//ButtonText
"SELECCIONAR";
//CategoryFilter
category = Revit.Category.ByName("Walls");
//SelectSingleElement
false;
# ----------------------------------------
selectmodelelements_data = Custom[SelectModelElements Data](InputName=code_block_5.out0, ButtonText=code_block_5.out1, CategoryFilter=code_block_5.category, SelectSingleElement=code_block_5.out3)  # package Data-Shapes; Creates a Revit element selection input for UI.MultipleInputForm++ . Check out www.data-shapes.net for more infos!
code_block_6 = CodeBlock(inputs=selectmodelelements_data, toggle=python_script_4)
# ---------- code_block_6.designscript (29 lines) ----------
//Description_optional
"Acotado Muros";

//Logo


//ButtonText
"INICIAR";

//Inputs
inputs;

//Toggle
toggle;

//LinkToHelp


//CancelButtonText
"CANCELAR";

//MaxHeight


//Width
490;

//LabelWidth
150;
# ----------------------------------------
multipleinputform_2 = Custom[MultipleInputForm ++](Description_optional=code_block_6.out0, ButtonText_optional=code_block_6.out1, Inputs=code_block_6.inputs, Toggle=code_block_6.toggle, CancelButtonText_optional=code_block_6.out4, Width_optional=code_block_6.out5, LabelWidth_optional=code_block_6.out6)
code_block_7 = CodeBlock { "Walls"; }
byName_2 = Category.ByName(name=code_block_7)
all_elements_of_category_in_view = ElementsOfCategoryInView(Category=byName_2, View=activeView)
geometry = Element.Geometry(element=all_elements_of_category_in_view)
flatten = List.Flatten(list=geometry@L3)
python_script_5 = Python(IN[0]=flatten)
# ---------- python_script_5.python (8 lines) ----------
input = IN[0]

if input[0] == []:
	input = []
else:
	input
	
OUT = input
# ----------------------------------------
plane = Custom[View.Plane](view=activeView)  # package Clockwork for Dynamo 2.x; Retrieves the plane of a given view
ZAxis = Vector.ZAxis()
code_block_8 = CodeBlock { 1000; }
translate = Geometry.Translate(geometry=plane, direction=ZAxis, distance=code_block_8)
doesIntersect = Geometry.DoesIntersect(geometry=python_script_5, other=translate)
filterByBoolMask = List.FilterByBoolMask(list=all_elements_of_category_in_view@L2, mask=doesIntersect@L2)
python_script_6 = Python(IN[0]=python_script_4, IN[1]=multipleinputform_2.User_Inputs, IN[2]=filterByBoolMask.out)
# ---------- python_script_6.python (10 lines) ----------
input = IN[0]
muros_seleccionados = IN[1]
muros_todos = IN[2]

if input == False:
	input = muros_todos
elif input == True:
	input = muros_seleccionados
	
OUT = input
# ----------------------------------------
python_script_7 = Python(IN[0]=python_script_6)
# ---------- python_script_7.python (8 lines) ----------
input = IN[0]

if input == []:
	input = []
else:
	input
	
OUT = input
# ----------------------------------------
getLocation = Element.GetLocation(element=python_script_7)
code_block_9 = CodeBlock { 0.5; }
pointAtParameter = Curve.PointAtParameter(curve=getLocation, param=code_block_9)
ZAxis_2 = Vector.ZAxis()
code_block_10 = CodeBlock { 90; }
rotate = Geometry.Rotate(geometry=getLocation, origin=pointAtParameter, axis=ZAxis_2, degrees=code_block_10)
ZAxis_3 = Vector.ZAxis()
code_block_11 = CodeBlock { 500; }
translate_2 = Geometry.Translate(geometry=rotate, direction=ZAxis_3, distance=code_block_11)
flatten_2 = List.Flatten(list=translate_2)
python_script_8 = Python(IN[0]=python_script_7)
# ---------- python_script_8.python (26 lines) ----------
import clr
clr.AddReference('RevitAPI')
clr.AddReference('RevitServices')
from Autodesk.Revit.DB import Options, Solid
from RevitServices.Persistence import DocumentManager

doc = DocumentManager.Instance.CurrentDBDocument
collections_of_walls = UnwrapElement(IN[0])  # Listas de elementos de la categoría Wall se proporcionan como entrada

options = Options()
options.ComputeReferences = True  # Necesario para obtener referencias

all_wall_faces = []
for walls in collections_of_walls:
    wall_faces = []
    for wall in walls:
        geo = wall.get_Geometry(options)
        wall_faces_temp = []
        for obj in geo:
            if isinstance(obj, Solid):  # Verificar si el objeto es un sólido
                for face in obj.Faces:  # Iterar sobre las caras del sólido
                    wall_faces_temp.append(face.Reference)  # Añadir la referencia de la cara a la lista temporal
        wall_faces.append(wall_faces_temp)  # Añadir la lista de caras de una pared a la lista principal
    all_wall_faces.append(wall_faces)

OUT = all_wall_faces
# ----------------------------------------
faces = Element.Faces(element=python_script_7)
doesIntersect_2 = Geometry.DoesIntersect(geometry=faces, other=translate_2)
filterByBoolMask_2 = List.FilterByBoolMask(list=python_script_8, mask=doesIntersect_2)
flatten_3 = List.Flatten(list=filterByBoolMask_2.in@L2)
dimension_byreferences = Custom[Dimension ByReferences](view=python_script@L1, line=flatten_2, references=flatten_3, lacing=Longest)  # package Genius Loci; Creates a new linear dimension from at least two geometric references of an object.
code_block_12 = CodeBlock { 0.5; }
normalAtParameter = Curve.NormalAtParameter(curve=flatten_2, param=code_block_12)
code_block_13 = CodeBlock { 350; }
translate_3 = Geometry.Translate(geometry=flatten_2, direction=normalAtParameter, distance=code_block_13)
element_reference = Custom[Element Reference](element=python_script_7@L2)  # package Genius Loci; Gets the reference of a geometric object or a dimension or a reference plane.
addItemToFront = List.AddItemToFront(item=element_reference@L1, list=flatten_3@L2)
dimension_byreferences_2 = Custom[Dimension ByReferences](view=python_script@L1, line=translate_3@L1, references=addItemToFront@L2, lacing=Longest)
code_block_14 = CodeBlock { "Leader"; 0; }
setParameterByName = Element.SetParameterByName(element=dimension_byreferences_2, parameterName=code_block_14.out0, value=code_block_14.out1)
ʳʰʸᵗʰᵐ_dimensions_getcurve = Rhythm.Revit.Elements.Dimensions.GetCurve(dimension=setParameterByName)
code_block_15 = CodeBlock { 0.5; }
pointAtParameter_2 = Curve.PointAtParameter(curve=ʳʰʸᵗʰᵐ_dimensions_getcurve, param=code_block_15)
normalAtParameter_2 = Curve.NormalAtParameter(curve=ʳʰʸᵗʰᵐ_dimensions_getcurve, param=code_block_15)
byOriginNormal = Plane.ByOriginNormal(origin=pointAtParameter_2, normal=normalAtParameter_2)
code_block_16 = CodeBlock { 4; }
scale = Geometry.Scale(geometry=ʳʰʸᵗʰᵐ_dimensions_getcurve, plane=byOriginNormal, yamount=code_block_16)
startPoint = Curve.StartPoint(curve=scale)
python_script_9 = Python(IN[0]=startPoint)
# ---------- python_script_9.python (8 lines) ----------
input = IN[0]

if input == []:
	input = None
else:
	input
	
OUT = input
# ----------------------------------------
code_block_17 = CodeBlock { 0; 1; }
getItemAtIndex = List.GetItemAtIndex(list=python_script_9@L2, index=code_block_17.out0)
endPoint = Curve.EndPoint(curve=scale)
python_script_10 = Python(IN[0]=endPoint)
# ---------- python_script_10.python (8 lines) ----------
input = IN[0]

if input == []:
	input = [None, None]
else:
	input
	
OUT = input
# ----------------------------------------
getItemAtIndex_2 = List.GetItemAtIndex(list=python_script_10@L2, index=code_block_17.out1)
list_create = List.Create(item0=getItemAtIndex, item1=getItemAtIndex_2)
transpose = List.Transpose(lists=list_create)
ʳʰʸᵗʰᵐ_dimensions = Rhythm.Revit.Elements.Dimensions.SetTextLocation(dimension=setParameterByName@L1, locationPoint=transpose@L2, lacing=Longest)
code_block_18 = CodeBlock(view_type=type_2)
# ---------- code_block_18.designscript (5 lines) ----------
//Tittle
"Error";

//TextNote
"Esta herramienta no puede ser usada en vistas de tipo " + view_type + ".";
# ----------------------------------------
textnote_data = Custom[TextNote Data](Title=code_block_18.out0, TextNote=code_block_18.out1)  # package Data-Shapes; Create Data for TextNote input in UI.MultipleInputForm ++ . Check out www.data-shapes.net for more informations
python_script_11 = Python(IN[0]=type_2)
# ---------- python_script_11.python (8 lines) ----------
input = IN[0]

if input in ["CeilingPlan", "EngineeringPlan", "FloorPlan"]:
	toggle = False
else:
	toggle = True
	
OUT = toggle
# ----------------------------------------
code_block_19 = CodeBlock(inputs=textnote_data, toggle=python_script_11)
# ---------- code_block_19.designscript (29 lines) ----------
//Description_optional
"Acotado Espesor Muros";

//Logo


//ButtonText
"ACEPTAR";

//Inputs
inputs;

//Toggle
toggle;

//LinkToHelp


//CancelButtonText


//MaxHeight


//Width
450;

//LabelWidth
150;
# ----------------------------------------
multipleinputform_3 = Custom[MultipleInputForm ++](Description_optional=code_block_19.out0, ButtonText_optional=code_block_19.out1, Inputs=code_block_19.inputs, Toggle=code_block_19.toggle, Width_optional=code_block_19.out4, LabelWidth_optional=code_block_19.out5)
