# Dynamo graph laminasPorCategoria_script.dyn (Dynamo 2.6.2.15705)
# packages: Data-Shapes 2022.2.103, Clockwork for Dynamo 2.x 2.4.0

code_block = CodeBlock { "Validacion"; }
code_block_2 = CodeBlock { "Project Information"; }
byName = Category.ByName(name=code_block_2)
all_elements_of_category = ElementsOfCategory(Category=byName)
parameterExists = Custom[Element.ParameterExists](param=code_block, element=all_elements_of_category)  # package Clockwork for Dynamo 2.x; Checks if an element contains a parameter of a given name
code_block_3 = CodeBlock { "Title Blocks"; }
byName_2 = Category.ByName(name=code_block_3)
code_block_4 = CodeBlock(category=byName_2)
# ---------- code_block_4.designscript (4 lines) ----------
//category
category;
//toggle
true;
# ----------------------------------------
all_family_types_of_category = Custom[All Family Types Of Category](category=code_block_4.category, toggle=code_block_4.out1)  # package Clockwork for Dynamo 2.x; Gets all family types/symbols of a given category in the model.
name = Element.Name(element=all_family_types_of_category)
code_block_5 = CodeBlock(x=name)
# ---------- code_block_5.designscript (4 lines) ----------
//x
x;
//y
"EST_A_SPLASH SCREEN";
# ----------------------------------------
eq = code_block_5.x == code_block_5.out1
filterByBoolMask = List.FilterByBoolMask(list=all_family_types_of_category, mask=eq)
name_2 = Element.Name(element=filterByBoolMask.out)
code_block_6 = CodeBlock(keys=name_2, values=filterByBoolMask.out)
# ---------- code_block_6.designscript (8 lines) ----------
//InputName
"Tipo de Formato";
//Keys
keys;
//Values
values;
//Defaultvalueindex
0;
# ----------------------------------------
dropdown_data = Custom[DropDown Data](InputName=code_block_6.out0, Keys=code_block_6.keys, Values=code_block_6.values, DefaultValueIndex=code_block_6.out3)  # package Data-Shapes; Create data for DropDown input in UI.MultiInputForm ++ . Check out www.data-shapes.net for more infos.
code_block_7 = CodeBlock()
# ---------- code_block_7.designscript (17 lines) ----------
[
"PG - PLANTA GENERAL",
"LO - LOSAS",
"MA - MUROS",
"VH - VIGAS",
"CH - COLUMNAS",
"EM - ESTRUCTURA METALICA",
"ES - ESCALERA",
"DE - DETALLE ESTANQUE",
"RP - RAMPAS",
"MC - MONTACARGAS",
"PC - PLANO DE CARGAS",
"SK - FICHA",
"DM - DEMOLICION",
"RF - REFUERZO",
"CF - CIELO FALSO"
];
# ----------------------------------------
code_block_8 = CodeBlock(str=code_block_7)
# ---------- code_block_8.designscript (4 lines) ----------
//str
str;
//separator
" - ";
# ----------------------------------------
split = String.Split(str=code_block_8.str, separator0=code_block_8.out1)
code_block_9 = CodeBlock(list=split)
# ---------- code_block_9.designscript (4 lines) ----------
//list
list;
//index
0;
# ----------------------------------------
getItemAtIndex = List.GetItemAtIndex(list=code_block_9.list@L2, index=code_block_9.out1)
code_block_10 = CodeBlock(keys=code_block_7, values=getItemAtIndex)
# ---------- code_block_10.designscript (10 lines) ----------
//InputName
"Categoria de\nlas Laminas :";
//Keys
keys;
//Values
values;
//DefaultValueindex
0;
//Sorted
false;
# ----------------------------------------
dropdown_data_2 = Custom[DropDown Data](InputName=code_block_10.out0, Keys=code_block_10.keys, Values=code_block_10.values, DefaultValueIndex=code_block_10.out3, Sorted_optional=code_block_10.out4)
code_block_11 = CodeBlock()
# ---------- code_block_11.designscript (6 lines) ----------
//InputName
"Cantidad\nde Laminas :";
//DefaultText
"1";
//IsNumberEntry
true;
# ----------------------------------------
textbox_data = Custom[TextBox Data](InputName=code_block_11.out0, DefaultText=code_block_11.out1, IsNumberEntry=code_block_11.out2)  # package Data-Shapes; Create Data for TextBox input in UI.MultipleInputForm ++ . Check out www.data-shapes.net for more informations
code_block_12 = CodeBlock()
# ---------- code_block_12.designscript (10 lines) ----------
[
"N. VICUÑA",
"C. MANRIQUEZ",
"M. ECHEVERRIA",
"F. TORELLI",
"A. MARTINEZ",
"M. SAEZ",
"J. TORELLI",
"F. IBARRA"
];
# ----------------------------------------
code_block_13 = CodeBlock(keys=code_block_12)
# ---------- code_block_13.designscript (10 lines) ----------
//InputName
"Calculó :";
//Keys
keys;
//Values
keys;
//DefaultValueIndex
1;
//Sorted
true;
# ----------------------------------------
dropdown_data_3 = Custom[DropDown Data](InputName=code_block_13.out0, Keys=code_block_13.out1, Values=code_block_13.out2, DefaultValueIndex=code_block_13.out3, Sorted_optional=code_block_13.out4)
code_block_14 = CodeBlock(keys=code_block_12)
# ---------- code_block_14.designscript (10 lines) ----------
//InputName
"Revisó :";
//Keys
keys;
//Values
keys;
//DefaultValueIndex
0;
//Sorted
true;
# ----------------------------------------
dropdown_data_4 = Custom[DropDown Data](InputName=code_block_14.out0, Keys=code_block_14.out1, Values=code_block_14.out2, DefaultValueIndex=code_block_14.out3, Sorted_optional=code_block_14.out4)
code_block_15 = CodeBlock()
# ---------- code_block_15.designscript (5 lines) ----------
[
"N. VICUÑA",
"C. MANRIQUEZ",
"P. ARANEDA"
];
# ----------------------------------------
code_block_16 = CodeBlock(keys=code_block_15)
# ---------- code_block_16.designscript (10 lines) ----------
//InputName
"Aprobó :";
//Keys
keys;
//Values
keys;
//DefaultValueIndex
2;
//Sorted
true;
# ----------------------------------------
dropdown_data_5 = Custom[DropDown Data](InputName=code_block_16.out0, Keys=code_block_16.out1, Values=code_block_16.out2, DefaultValueIndex=code_block_16.out3, Sorted_optional=code_block_16.out4)
code_block_17 = CodeBlock()
# ---------- code_block_17.designscript (13 lines) ----------
[
"J. NUÑEZ",
"P. CAROCA",
"A. SANCHEZ",
"S. JIMENEZ",
"H. CARRASCO",
"R. PEREZ",
"C. ORREGO",
"L. BARRIOS",
"R. AGUILA",
"J. NEIRA",
"C. CANCINO"
];
# ----------------------------------------
code_block_18 = CodeBlock(data=code_block_17)
# ---------- code_block_18.designscript (10 lines) ----------
//InputName
"Dibujó :";
//Keys
data;
//Values
data;
//DefaultvalueIndex
0;
//Sorted
true;
# ----------------------------------------
dropdown_data_6 = Custom[DropDown Data](InputName=code_block_18.out0, Keys=code_block_18.out1, Values=code_block_18.out2, DefaultValueIndex=code_block_18.out3, Sorted_optional=code_block_18.out4)
now = DateTime.Now()
components = DateTime.Components(dateTime=now)
string_from_object = FromObject(obj=components.year)
code_block_19 = CodeBlock(year=string_from_object, defaultValue=components.month)
# ---------- code_block_19.designscript (10 lines) ----------
//InputName
"Fecha creación\nde las Laminas :";
//Keys
["ENERO","FEBRERO","MARZO","ABRIL","MAYO","JUNIO","JULIO","AGOSTO","SEPTIEMBRE","OCTUBRE","NOVIEMBRE","DICIEMBRE"];
//Values
["ENE. "+year,"FEB ."+year,"MAR. "+year,"ABR. "+year,"MAY ."+year,"JUN. "+year,"JUL. "+year,"AGO. "+year,"SEP. "+year,"OCT. "+year,"NOV. "+year,"DIC. "+year];
//DefaultValueIndex
defaultValue - 1;
//Sorted
false;
# ----------------------------------------
dropdown_data_7 = Custom[DropDown Data](InputName=code_block_19.out0, Keys=code_block_19.out1, Values=code_block_19.out2, DefaultValueIndex=code_block_19.out3, Sorted_optional=code_block_19.out4)
list_create = List.Create(item0=dropdown_data, item1=dropdown_data_2, item2=textbox_data, item3=dropdown_data_3, item4=dropdown_data_4, item5=dropdown_data_5, item6=dropdown_data_6, item7=dropdown_data_7)
python_script = Python(IN[0]=parameterExists, IN[1]=list_create)
# ---------- python_script.python (9 lines) ----------
validacion = IN[0][0]
inputs = IN[1]

if validacion == True:
	res = inputs
else:
	res = []

OUT = res
# ----------------------------------------
code_block_20 = CodeBlock(inputs=python_script)
# ---------- code_block_20.designscript (29 lines) ----------
//Description_optional
"Laminas por Categoria";

//Logo


//ButtonText
"INICIAR";

//Inputs
inputs;

//Toggle
true;

//LinkToHelp


//CancelButtonText
"CANCELAR";

//MaxHeight
900;

//Width
430;

//LabelWidth
150;
# ----------------------------------------
multipleinputform = Custom[MultipleInputForm ++](Description_optional=code_block_20.out0, ButtonText_optional=code_block_20.out1, Inputs=code_block_20.inputs, Toggle=code_block_20.out3, CancelButtonText_optional=code_block_20.out4, MaxHeight_optional=code_block_20.out5, Width_optional=code_block_20.out6, LabelWidth_optional=code_block_20.out7)  # package Data-Shapes; Create a form with multiple inputs. see www.data-shapes.net for tutorials and infos!
python_script_2 = Python(IN[0]=multipleinputform.User_Inputs)
# ---------- python_script_2.python (7 lines) ----------
input = IN[0]

if input == [] or input == None:
	res = [[], [], []]
else:
	res = input[1], input[2]
OUT = res
# ----------------------------------------
codeblock = CodeBlock(value=python_script_2) { value[0]; value[1]; }
ofRepeatedItem = List.OfRepeatedItem(item=codeblock.out0, amount=codeblock.out1)
code_block_21 = CodeBlock { "Sheets"; }
byName_3 = Category.ByName(name=code_block_21)
all_elements_of_category_2 = ElementsOfCategory(Category=byName_3)
code_block_22 = CodeBlock { "Clasificacion"; }
getParameterValueByName = Element.GetParameterValueByName(element=all_elements_of_category_2, parameterName=code_block_22)
eq_2 = getParameterValueByName == codeblock.out0  # lacing=Longest
filterByBoolMask_2 = List.FilterByBoolMask(list=all_elements_of_category_2, mask=eq_2)
sheetNumber = Sheet.SheetNumber(sheet=filterByBoolMask_2.in)
code_block_23 = CodeBlock { "-"; }
split_2 = String.Split(str=sheetNumber, separator0=code_block_23)
python_script_3 = Python(IN[0]=split_2)
# ---------- python_script_3.python (7 lines) ----------
input = IN[0]

if input == [] or input == None:
	res = [None, None, None]
else:
	res = input
OUT = res
# ----------------------------------------
code_block_24 = CodeBlock { 1; }
getItemAtIndex_2 = List.GetItemAtIndex(list=python_script_3@L2, index=code_block_24)
python_script_4 = Python(IN[0]=getItemAtIndex_2)
# ---------- python_script_4.python (7 lines) ----------
input = IN[0]

if input[0] == [] or input[0] == None:
	res = []
else:
	res = input
OUT = res
# ----------------------------------------
toNumber = String.ToNumber(str=python_script_4)
python_script_5 = Python(IN[0]=toNumber)
# ---------- python_script_5.python (7 lines) ----------
input = IN[0]

if input == []:
	res = 0
else:
	res = input
OUT = res
# ----------------------------------------
maximumItem = List.MaximumItem(list=python_script_5)
count = List.Count(list=ofRepeatedItem)
code_block_25 = CodeBlock(start=maximumItem, amount=count) { start + 1; amount; 1; }
sequence = Sequence(start=code_block_25.out0, amount=code_block_25.amount, step=code_block_25.out2)
code_block_26 = CodeBlock { 3; }
withLeadingZeroes = Custom[List.WithLeadingZeroes](num=sequence, n=code_block_26)  # package Clockwork for Dynamo 2.x; Adds leading zeros to a sequence of numbers
code_block_27 = CodeBlock(cat=ofRepeatedItem, num=withLeadingZeroes) { cat + "-" + num; }
python_script_6 = Python(IN[0]=multipleinputform.User_Inputs)
# ---------- python_script_6.python (7 lines) ----------
input = IN[0]

if input == [] or input == None:
	res = [[], [], []]
else:
	res = input[0], input[2]
OUT = res
# ----------------------------------------
codeblock_2 = CodeBlock(value=python_script_6) { value[0]; value[1]; }
ofRepeatedItem_2 = List.OfRepeatedItem(item=codeblock_2.out0, amount=codeblock_2.out1)
code_block_28 = CodeBlock(num=code_block_27, tb=ofRepeatedItem_2)
# ---------- code_block_28.designscript (6 lines) ----------
//sheetName
"CONTENIDO LAMINA";
//sheetNumber
num;
//titleBlock
tb;
# ----------------------------------------
byNameNumberTitleBlock = Sheet.ByNameNumberTitleBlock(sheetName=code_block_28.out0, sheetNumber=code_block_28.num, titleBlockFamilyType=code_block_28.tb)
code_block_29 = CodeBlock()
# ---------- code_block_29.designscript (8 lines) ----------
[
"Approved By",
"Designed By",
"Checked By",
"Drawn By",
"Sheet Issue Date",
"Clasificacion"
];
# ----------------------------------------
python_script_7 = Python(IN[0]=multipleinputform.User_Inputs)
# ---------- python_script_7.python (7 lines) ----------
input = IN[0]

if input == [] or input == None:
	res = [[], [], []]
else:
	res = input[5], input[3], input[4], input[6], input[7], input[1]
OUT = res
# ----------------------------------------
setParameterByName = Element.SetParameterByName(element=byNameNumberTitleBlock@L1, parameterName=code_block_29@L2, value=python_script_7@L2, lacing=Longest)
