# Dynamo graph CotasPlanta_script.dyn (Dynamo 2.6.2.15705)
# packages: Clockwork for Dynamo 2.x 2.4.0, Crumple 2022.2.13, Genius Loci 2021.11.10, Data-Shapes 2022.2.103, Modelical 2022.5.12

code_block = CodeBlock { "Validacion"; }
code_block_2 = CodeBlock { "Project Information"; }
byName = Category.ByName(name=code_block_2)
all_elements_of_category = ElementsOfCategory(Category=byName)
parameterExists = Custom[Element.ParameterExists](param=code_block, element=all_elements_of_category)  # package Clockwork for Dynamo 2.x; Checks if an element contains a parameter of a given name
current = Document.Current()
python_script = Python(IN[0]=parameterExists, IN[1]=current)
# ---------- python_script.python (9 lines) ----------
validacion = IN[0][0]
inputs = IN[1]

if validacion == True:
	res = inputs
else:
	res = []

OUT = res
# ----------------------------------------
activeView = Document.ActiveView(document=python_script)
type = Custom[View.Type](view=activeView)  # package Clockwork for Dynamo 2.x; Returns the type of a given view
python_script_2 = Python(IN[0]=type, IN[1]=activeView)
# ---------- python_script_2.python (9 lines) ----------
input = IN[0]
view = IN[1]

if input in ["CeilingPlan", "EngineeringPlan", "FloorPlan"]:
	toggle = view
else:
	toggle = []
	
OUT = toggle
# ----------------------------------------
code_block_3 = CodeBlock { "Crop View"; }
getParameterValueByName = Element.GetParameterValueByName(element=python_script_2, parameterName=code_block_3)
python_script_3 = Python(IN[0]=getParameterValueByName, IN[1]=python_script_2)
# ---------- python_script_3.python (9 lines) ----------
input = IN[0]
view = IN[1]

if input == 0:
	res = [[], True]
else:
	res = [view, False]
	
OUT = res
# ----------------------------------------
code_block_4 = CodeBlock(x=python_script_3) { x[0]; x[1]; }
code_block_5 = CodeBlock { "Crop Region Visible"; 0; }
setParameterByName = Element.SetParameterByName(element=code_block_4.out0, parameterName=code_block_5.out0, value=code_block_5.out1)
scale = Custom[View.Scale](view=setParameterByName)  # package Clockwork for Dynamo 2.x; Returns the scale of a given view
python_script_4 = Python(IN[0]=scale)
# ---------- python_script_4.python (16 lines) ----------
input = IN[0]

if input == 25:
	res = 0.3
elif input == 50:
	res = 0.6
elif input == 75:
	res = 0.9
elif input == 100:
	res = 1.2
elif input == 125:
	res = 1.5
else:
	res = 1.8
	
OUT = res
# ----------------------------------------
fitToCropView = Custom[Grid.FitToCropView](views=setParameterByName, offset=python_script_4)  # package Modelical; This node fit the grids to the crop view on the selected views.
python_script_5 = Python(IN[0]=fitToCropView.views)
# ---------- python_script_5.python (8 lines) ----------
input = IN[0]

if input == []:
	res = []
else:
	res = input[0]
	
OUT = res
# ----------------------------------------
viewgetcropbox = Custom[© ViewGetCropBox](views=python_script_5)  # package Crumple; Returns the curves of a view's cropbox (even if not visible/active). Also returns whether the cropbox is currently visible and active as booleans.
flatten = List.Flatten(list=viewgetcropbox.curves)
code_block_6 = CodeBlock { "Grids"; }
byName_2 = Category.ByName(name=code_block_6)
all_elements_of_category_in_view = ElementsOfCategoryInView(Category=byName_2, View=python_script_5)
curve = Grid.Curve(grid=all_elements_of_category_in_view)
plane = Custom[View.Plane](view=python_script_5)  # package Clockwork for Dynamo 2.x; Retrieves the plane of a given view
pullOntoPlane = Curve.PullOntoPlane(curve=curve, plane=plane)
doesIntersect = Geometry.DoesIntersect(geometry=flatten@L1, other=pullOntoPlane@L2, lacing=Longest)
filterByBoolMask = List.FilterByBoolMask(list=all_elements_of_category_in_view@L2, mask=doesIntersect@L2, lacing=Longest)
python_script_6 = Python(IN[0]=filterByBoolMask.in)
# ---------- python_script_6.python (8 lines) ----------
input = IN[0]

if input[0] == []:
	res = []
else:
	res = input
	
OUT = res
# ----------------------------------------
startPoint = Curve.StartPoint(curve=flatten)
endPoint = Curve.EndPoint(curve=flatten)
byTwoPoints = Vector.ByTwoPoints(start=startPoint, end=endPoint)
curve_2 = Grid.Curve(grid=python_script_6)
startPoint_2 = Curve.StartPoint(curve=curve_2)
endPoint_2 = Curve.EndPoint(curve=curve_2)
byTwoPoints_2 = Vector.ByTwoPoints(start=startPoint_2, end=endPoint_2)
angleWithVector = Vector.AngleWithVector(vector=byTwoPoints@L1, otherVector=byTwoPoints_2@L2, lacing=Longest)
code_block_7 = CodeBlock { 90; }
eq = angleWithVector == code_block_7
filterByBoolMask_2 = List.FilterByBoolMask(list=python_script_6, mask=eq)
element_reference = Custom[Element Reference](element=filterByBoolMask_2.in@L2)  # package Genius Loci; Gets the reference of a geometric object or a dimension or a reference plane.
dimension_byreferences = Custom[Dimension ByReferences](line=flatten@L1, references=element_reference@L2, lacing=Longest)  # package Genius Loci; Creates a new linear dimension from at least two geometric references of an object.
byJoinedCurves = PolyCurve.ByJoinedCurves()  # unwired: curves
function_apply = ApplyFunction(func=byJoinedCurves, arg1=flatten)
python_script_7 = Python(IN[0]=function_apply)
# ---------- python_script_7.python (8 lines) ----------
input = IN[0]

if input == None:
	res = []
else:
	res = input
	
OUT = res
# ----------------------------------------
scale_2 = Custom[View.Scale](view=python_script_5)
python_script_8 = Python(IN[0]=scale_2)
# ---------- python_script_8.python (16 lines) ----------
input = IN[0]

if input == 25:
	res = -175
elif input == 50:
	res = -350
elif input == 75:
	res = -525
elif input == 100:
	res = -700
elif input == 125:
	res = -875
else:
	res = -1050
	
OUT = res
# ----------------------------------------
code_block_8 = CodeBlock(signedDistance=python_script_8) { signedDistance; false; }
offset = PolyCurve.Offset(polyCurve=python_script_7, signedDistance=code_block_8.signedDistance, extendCircular=code_block_8.out1)
explode = Geometry.Explode(geometry=offset)
code_block_9 = CodeBlock { "Walls"; }
byName_3 = Category.ByName(name=code_block_9)
all_elements_of_category_in_view_2 = ElementsOfCategoryInView(Category=byName_3, View=python_script_5)
geometry = Element.Geometry(element=all_elements_of_category_in_view_2)
flatten_2 = List.Flatten(list=geometry)
doesIntersect_2 = Geometry.DoesIntersect(geometry=plane, other=flatten_2)
filterByBoolMask_3 = List.FilterByBoolMask(list=all_elements_of_category_in_view_2, mask=doesIntersect_2)
getLocation = Element.GetLocation(element=filterByBoolMask_3.in)
code_block_10 = CodeBlock { 0.5; }
pointAtParameter = Curve.PointAtParameter(curve=getLocation, param=code_block_10)
ZAxis = Vector.ZAxis()
byOriginNormal = Plane.ByOriginNormal(origin=pointAtParameter, normal=ZAxis)
code_block_11 = CodeBlock { 15; }
scale_3 = Geometry.Scale(geometry=getLocation, plane=byOriginNormal, xamount=code_block_11, yamount=code_block_11)
doesIntersect_3 = Geometry.DoesIntersect(geometry=explode@L1, other=scale_3@L2, lacing=Longest)
filterByBoolMask_4 = List.FilterByBoolMask(list=filterByBoolMask_3.in@L2, mask=doesIntersect_3@L2, lacing=Longest)
python_script_9 = Python(IN[0]=filterByBoolMask_4.in)  # same code as python_script_6
faces = Element.Faces(element=python_script_9)
surface_reference = Custom[Surface Reference](surface=faces@@L2)  # package Genius Loci; Obtains the reference of a given Revit surface in the current document.
getLocation_2 = Element.GetLocation(element=python_script_9)
code_block_12 = CodeBlock { 0.5; }
pointAtParameter_2 = Curve.PointAtParameter(curve=getLocation_2, param=code_block_12)
ZAxis_2 = Vector.ZAxis()
byOriginNormal_2 = Plane.ByOriginNormal(origin=pointAtParameter_2, normal=ZAxis_2)
code_block_13 = CodeBlock { 90; }
rotate = Geometry.Rotate(geometry=getLocation_2, basePlane=byOriginNormal_2, degrees=code_block_13)
code_block_14 = CodeBlock { 0.015; }
scale_4 = Geometry.Scale(geometry=rotate, plane=byOriginNormal_2, xamount=code_block_14, yamount=code_block_14)
ZAxis_3 = Vector.ZAxis()
code_block_15 = CodeBlock { 200; }
translate = Geometry.Translate(geometry=scale_4, direction=ZAxis_3, distance=code_block_15)
doesIntersect_4 = Geometry.DoesIntersect(geometry=translate@L1, other=faces@L2, lacing=Longest)
filterByBoolMask_5 = List.FilterByBoolMask(list=surface_reference@L3, mask=doesIntersect_4@L3, lacing=Longest)
count = List.Count(list=filterByBoolMask_5.in@L3)
ofRepeatedItem = List.OfRepeatedItem(item=explode@L1, amount=count@L1)
flatten_3 = List.Flatten(list=ofRepeatedItem)
flatten_4 = List.Flatten(list=filterByBoolMask_5.in@L2)
code_block_16 = CodeBlock { "Linear - 2.5mm Arial_Fixed Dim Line 10mm"; }
byName_4 = ElementType.ByName(name=code_block_16)
dimension_byreferences_2 = Custom[Dimension ByReferences](line=flatten_3@L1, references=flatten_4@L2, dimensionType=byName_4@L1, lacing=Longest)
type_2 = Custom[View.Type](view=activeView)
code_block_17 = CodeBlock(view_type=type_2)
# ---------- code_block_17.designscript (5 lines) ----------
//Tittle
"Error";

//TextNote
"Esta herramienta no puede ser usada en vistas de tipo " + view_type + ".";
# ----------------------------------------
textnote_data = Custom[TextNote Data](Title=code_block_17.out0, TextNote=code_block_17.out1)  # package Data-Shapes; Create Data for TextNote input in UI.MultipleInputForm ++ . Check out www.data-shapes.net for more informations
python_script_10 = Python(IN[0]=type_2)
# ---------- python_script_10.python (8 lines) ----------
input = IN[0]

if input in ["CeilingPlan", "EngineeringPlan", "FloorPlan"]:
	toggle = False
else:
	toggle = True
	
OUT = toggle
# ----------------------------------------
code_block_18 = CodeBlock(inputs=textnote_data, toggle=python_script_10)
# ---------- code_block_18.designscript (29 lines) ----------
//Description_optional
"Acotado General";

//Logo


//ButtonText
"ACEPTAR";

//Inputs
inputs;

//Toggle
toggle;

//LinkToHelp


//CancelButtonText


//MaxHeight


//Width
450;

//LabelWidth
150;
# ----------------------------------------
multipleinputform = Custom[MultipleInputForm ++](Description_optional=code_block_18.out0, ButtonText_optional=code_block_18.out1, Inputs=code_block_18.inputs, Toggle=code_block_18.toggle, Width_optional=code_block_18.out4, LabelWidth_optional=code_block_18.out5)  # package Data-Shapes; Create a form with multiple inputs. see www.data-shapes.net for tutorials and infos!
code_block_19 = CodeBlock()
# ---------- code_block_19.designscript (5 lines) ----------
//Tittle
"Error";

//TextNote
"Se debe definir un Crop View antes de generar las Cotas";
# ----------------------------------------
textnote_data_2 = Custom[TextNote Data](Title=code_block_19.out0, TextNote=code_block_19.out1)
code_block_20 = CodeBlock(inputs=textnote_data_2, toggle=code_block_4.out1)  # same code as code_block_18
multipleinputform_2 = Custom[MultipleInputForm ++](Description_optional=code_block_20.out0, ButtonText_optional=code_block_20.out1, Inputs=code_block_20.inputs, Toggle=code_block_20.toggle, Width_optional=code_block_20.out4, LabelWidth_optional=code_block_20.out5)
