# Dynamo graph EtiquetadoPlanta_script.dyn (Dynamo 2.6.2.15705)
# packages: Data-Shapes 2022.2.103, Clockwork for Dynamo 2.x 2.4.0, Genius Loci 2021.11.10

code_block = CodeBlock { "Validacion"; }
code_block_2 = CodeBlock { "Project Information"; }
byName = Category.ByName(name=code_block_2)
all_elements_of_category = ElementsOfCategory(Category=byName)
parameterExists = Custom[Element.ParameterExists](param=code_block, element=all_elements_of_category)  # package Clockwork for Dynamo 2.x; Checks if an element contains a parameter of a given name
current = Document.Current()
activeView = Document.ActiveView(document=current)
python_script = Python(IN[0]=parameterExists, IN[1]=activeView)
# ---------- python_script.python (11 lines) ----------
input = IN[0]
vista = IN[1]

for i in input:
	if i == True:
		res = vista
	else:
		res = []
		
OUT = res
		
# ----------------------------------------
type = Custom[View.Type](view=python_script)  # package Clockwork for Dynamo 2.x; Returns the type of a given view
code_block_3 = CodeBlock(view_type=type)
# ---------- code_block_3.designscript (5 lines) ----------
//Tittle
"Error";

//TextNote
"Esta herramienta no puede ser usada en vistas de tipo " + view_type + ".";
# ----------------------------------------
textnote_data = Custom[TextNote Data](Title=code_block_3.out0, TextNote=code_block_3.out1)  # package Data-Shapes; Create Data for TextNote input in UI.MultipleInputForm ++ . Check out www.data-shapes.net for more informations
python_script_2 = Python(IN[0]=type)
# ---------- python_script_2.python (8 lines) ----------
input = IN[0]

if input in ["CeilingPlan", "EngineeringPlan", "FloorPlan"]:
	toggle = False
else:
	toggle = True
	
OUT = toggle
# ----------------------------------------
code_block_4 = CodeBlock(inputs=textnote_data, toggle=python_script_2)
# ---------- code_block_4.designscript (29 lines) ----------
//Description_optional
"Etiquetado Planta";

//Logo


//ButtonText
"ACEPTAR";

//Inputs
inputs;

//Toggle
toggle;

//LinkToHelp


//CancelButtonText


//MaxHeight


//Width
450;

//LabelWidth
150;
# ----------------------------------------
multipleinputform = Custom[MultipleInputForm ++](Description_optional=code_block_4.out0, ButtonText_optional=code_block_4.out1, Inputs=code_block_4.inputs, Toggle=code_block_4.toggle, Width_optional=code_block_4.out4, LabelWidth_optional=code_block_4.out5)  # package Data-Shapes; Create a form with multiple inputs. see www.data-shapes.net for tutorials and infos!
python_script_3 = Python(IN[0]=multipleinputform.User_Inputs, IN[1]=python_script)
# ---------- python_script_3.python (9 lines) ----------
input = IN[0]
view = IN[1]

if input == []:
	res = []
else:
	res = [view]
	
OUT = res
# ----------------------------------------
end = Revit.Transaction.Transaction.End(input=python_script_3)
code_block_5 = CodeBlock(x=end) { x; }
python_script_4 = Python(IN[0]=code_block_5)
# ---------- python_script_4.python (8 lines) ----------
elementos = IN[0]

if elementos == []:
	res = []
else:
	res = elementos[0]

OUT = res
# ----------------------------------------
code_block_6 = CodeBlock { "Type"; "View Direction"; }
getParameterValueByName = Element.GetParameterValueByName(element=python_script_4, parameterName=code_block_6.out0)
getParameterValueByName_2 = Element.GetParameterValueByName(element=getParameterValueByName, parameterName=code_block_6.out1)
python_script_5 = Python(IN[0]=code_block_5, IN[1]=getParameterValueByName_2)
# ---------- python_script_5.python (9 lines) ----------
inputs = IN[0]
view_direction = IN[1]

if view_direction == 1:
	res = inputs
else:
	res = []

OUT = res
# ----------------------------------------
code_block_7 = CodeBlock { "Structural Columns"; }
byName_2 = Category.ByName(name=code_block_7)
all_elements_of_category_in_view = ElementsOfCategoryInView(Category=byName_2, View=python_script_5)
element_taggedstatus = Custom[Element TaggedStatus](element=all_elements_of_category_in_view@L2)  # package Genius Loci; Identify the tagged and untagged elements. Please note : This doesn't work with areas and spaces.
python_script_6 = Python(IN[0]=element_taggedstatus.NotTagged)
# ---------- python_script_6.python (8 lines) ----------
input = IN[0]

if input[0] == []:
	input = []
else:
	input
		
OUT = input	
# ----------------------------------------
geometry = Element.Geometry(element=python_script_6)
empty_list_to_null = Python(IN[0]=geometry)
# ---------- empty_list_to_null.python (9 lines) ----------
lst = IN[0]

def obtener_lista(elemento):
    if isinstance(elemento, list) and len(elemento) > 0:
        return elemento
    else:
        return None

OUT = obtener_lista(lst)
# ----------------------------------------
flatten = List.Flatten(list=empty_list_to_null@L3)
view_level = Custom[View Level](view=python_script_5)  # package Genius Loci; Returns the level to which a view is associated.
plane = Custom[Level.Plane](level=view_level)  # package Clockwork for Dynamo 2.x; Retrieves the plane of a given level
ZAxis = Vector.ZAxis()
code_block_8 = CodeBlock { 300; }
translate = Geometry.Translate(geometry=plane, direction=ZAxis, distance=code_block_8)
doesIntersect = Geometry.DoesIntersect(geometry=flatten, other=translate)
filterByBoolMask = List.FilterByBoolMask(list=python_script_6, mask=doesIntersect)
geometry_2 = Element.Geometry(element=filterByBoolMask.in)
byGeometry = BoundingBox.ByGeometry(geom=geometry_2)
toPolySurface = BoundingBox.ToPolySurface(boundingBox=byGeometry)
surfaces = PolySurface.Surfaces(polySurface=toPolySurface)
code_block_9 = CodeBlock { 1; }
getItemAtIndex = List.GetItemAtIndex(list=surfaces@@L2, index=code_block_9)
code_block_10 = CodeBlock { 1; }
pointAtParameter = Surface.PointAtParameter(surface=getItemAtIndex, u=code_block_10)
byElementAndLocation = Tag.ByElementAndLocation(view=python_script_5, element=filterByBoolMask.in, location=pointAtParameter)
code_block_11 = CodeBlock { "Type"; }
name = Material.Name()  # unwired: material
getMaterials = Element.GetMaterials(element=filterByBoolMask.in)
flatten_2 = List.Flatten(list=getMaterials@L3)
function_apply = ApplyFunction(func=name, arg1=flatten_2)
code_block_12 = CodeBlock { "Concrete, Cast-in-Place gray"; }
eq = function_apply == code_block_12
code_block_13 = CodeBlock { "EST_A_STRUCTURAL COLUMN TAG_PLANTA"; }
byName_3 = Family.ByName(name=code_block_13)
code_block_14 = CodeBlock { "Pilar Hormigon Numerado"; }
byFamilyAndName = FamilyType.ByFamilyAndName(family=byName_3, name=code_block_14)
byName_4 = Family.ByName(name=code_block_13)
code_block_15 = CodeBlock { "Pilar Metalico Numerado"; }
byFamilyAndName_2 = FamilyType.ByFamilyAndName(family=byName_4, name=code_block_15)
if_ = If(test=eq, true=byFamilyAndName, false=byFamilyAndName_2)
setParameterByName = Element.SetParameterByName(element=byElementAndLocation, parameterName=code_block_11, value=if_)
code_block_16 = CodeBlock(x=end) { x; }
code_block_17 = CodeBlock { "Floors"; }
byName_5 = Category.ByName(name=code_block_17)
all_elements_of_category_in_view_2 = ElementsOfCategoryInView(Category=byName_5, View=code_block_16)
element_taggedstatus_2 = Custom[Element TaggedStatus](element=all_elements_of_category_in_view_2@L2)
python_script_7 = Python(IN[0]=element_taggedstatus_2.NotTagged)  # same code as python_script_6
code_block_18 = CodeBlock { true; false; "Center"; }
byElement = Tag.ByElement(view=code_block_16, element=python_script_7, horizontal=code_block_18.out0, addLeader=code_block_18.out1, horizontalAlignment=code_block_18.out2, verticalAlignment=code_block_18.out2)
code_block_19 = CodeBlock { "Type"; }
name_2 = Element.Name(element=python_script_7)
code_block_20 = CodeBlock { "EST_A_FLOOR TAG_PLANTA_LOSA"; }
byName_6 = Family.ByName(name=code_block_20)
code_block_21 = CodeBlock { "Tope Losa y Nivel"; }
byFamilyAndName_3 = FamilyType.ByFamilyAndName(family=byName_6, name=code_block_21)
code_block_22 = CodeBlock { "EST_A_FLOOR TAG_PLANTA_RADIER"; }
byName_7 = Family.ByName(name=code_block_22)
code_block_23 = CodeBlock { "Tope Radier y Nivel"; }
byFamilyAndName_4 = FamilyType.ByFamilyAndName(family=byName_7, name=code_block_23)
python_script_8 = Python(IN[0]=name_2, IN[1]=byFamilyAndName_3, IN[2]=byFamilyAndName_4)
# ---------- python_script_8.python (17 lines) ----------
nombre_elementos = IN[0]
tag_losa = IN[1]
tag_radier = IN[2]

resultado = []
for nombre in nombre_elementos:
    sub_resultado = []
    for n in nombre:
        if "LOSA e=" in n:
            sub_resultado.append(tag_losa)
        elif "RADIER e=" in n:
            sub_resultado.append(tag_radier)
        else:
            sub_resultado.append([])
    resultado.append(sub_resultado)

OUT = resultado
# ----------------------------------------
setParameterByName_2 = Element.SetParameterByName(element=byElement, parameterName=code_block_19, value=python_script_8)
code_block_24 = CodeBlock(x=end) { x; }
python_script_9 = Python(IN[0]=code_block_24)  # same code as python_script_4
code_block_25 = CodeBlock { "Type"; "View Direction"; }
getParameterValueByName_3 = Element.GetParameterValueByName(element=python_script_9, parameterName=code_block_25.out0)
getParameterValueByName_4 = Element.GetParameterValueByName(element=getParameterValueByName_3, parameterName=code_block_25.out1)
python_script_10 = Python(IN[0]=code_block_24, IN[1]=getParameterValueByName_4)  # same code as python_script_5
code_block_26 = CodeBlock { "Walls"; }
byName_8 = Category.ByName(name=code_block_26)
all_elements_of_category_in_view_3 = ElementsOfCategoryInView(Category=byName_8, View=python_script_10)
element_taggedstatus_3 = Custom[Element TaggedStatus](element=all_elements_of_category_in_view_3@L2)
python_script_11 = Python(IN[0]=element_taggedstatus_3.NotTagged)  # same code as python_script_6
geometry_3 = Element.Geometry(element=python_script_11)
empty_list_to_null_2 = Python(IN[0]=geometry_3)  # same code as empty_list_to_null
flatten_3 = List.Flatten(list=empty_list_to_null_2@L3)
view_level_2 = Custom[View Level](view=python_script_10)
plane_2 = Custom[Level.Plane](level=view_level_2)
ZAxis_2 = Vector.ZAxis()
code_block_27 = CodeBlock { 300; }
translate_2 = Geometry.Translate(geometry=plane_2, direction=ZAxis_2, distance=code_block_27)
doesIntersect_2 = Geometry.DoesIntersect(geometry=flatten_3, other=translate_2)
filterByBoolMask_2 = List.FilterByBoolMask(list=python_script_11, mask=doesIntersect_2)
getLocation = Element.GetLocation(element=filterByBoolMask_2.in)
code_block_28 = CodeBlock { 0.5; }
pointAtParameter_2 = Curve.PointAtParameter(curve=getLocation, param=code_block_28)
code_block_29 = CodeBlock { 0.5; }
normalAtParameter = Curve.NormalAtParameter(curve=getLocation, param=code_block_29)
X = Vector.X(vector=normalAtParameter)
code_block_30 = CodeBlock { 2; }
round = Math.Round(number=X, digits=code_block_30)
Y = Vector.Y(vector=normalAtParameter)
code_block_31 = CodeBlock { 2; }
round_2 = Math.Round(number=Y, digits=code_block_31)
evalua_la_posicion_del_tag = Python(IN[0]=round, IN[1]=round_2)
# ---------- evalua_la_posicion_del_tag.python (26 lines) ----------
x_lists = IN[0]
y_lists = IN[1]

def compare_lists(x, y):
    result_comparison = []

    try:
        # Verifica si x e y son listas anidadas o listas simples
        if isinstance(x[0], list) and isinstance(y[0], list):
            # Manejo de listas anidadas
            for x_sublist, y_sublist in zip(x, y):
                comparison_sublist = []
                for x_elem, y_elem in zip(x_sublist, y_sublist):
                    comparison_sublist.append(x_elem <= y_elem)
                result_comparison.append(comparison_sublist)
        else:
            # Manejo de listas simples
            for x_elem, y_elem in zip(x, y):
                result_comparison.append(x_elem <= y_elem)
    except Exception as e:
        # En caso de excepción, devuelve una lista vacía
        return []

    return result_comparison
    
OUT = compare_lists(x_lists, y_lists)
# ----------------------------------------

# group: Type Parameter
code_block_32 = CodeBlock { "Type"; "Width"; }
getParameterValueByName_5 = Element.GetParameterValueByName(element=filterByBoolMask_2.in, parameterName=code_block_32.out0)
getParameterValueByName_6 = Element.GetParameterValueByName(element=getParameterValueByName_5, parameterName=code_block_32.out1)

code_block_33 = CodeBlock(a=getParameterValueByName_6) { a / 2; (a / 2) * -1; }
if_2 = If(test=evalua_la_posicion_del_tag, true=code_block_33.out0, false=code_block_33.out1)
translate_3 = Geometry.Translate(geometry=pointAtParameter_2, direction=normalAtParameter, distance=if_2)
byElementAndLocation_2 = Tag.ByElementAndLocation(view=python_script_10, element=filterByBoolMask_2.in, location=translate_3)
code_block_34 = CodeBlock { "Type"; }
code_block_35 = CodeBlock { "EST_A_WALL TAG_PLANTA"; }
byName_9 = Family.ByName(name=code_block_35)
code_block_36 = CodeBlock { "Muro"; }
byFamilyAndName_5 = FamilyType.ByFamilyAndName(family=byName_9, name=code_block_36)
setParameterByName_3 = Element.SetParameterByName(element=byElementAndLocation_2, parameterName=code_block_34, value=byFamilyAndName_5)
code_block_37 = CodeBlock(x=end) { x; }
code_block_38 = CodeBlock { "Structural Framing"; }
byName_10 = Category.ByName(name=code_block_38)
all_elements_of_category_in_view_4 = ElementsOfCategoryInView(Category=byName_10, View=code_block_37)
element_taggedstatus_4 = Custom[Element TaggedStatus](element=all_elements_of_category_in_view_4@L2)
python_script_12 = Python(IN[0]=element_taggedstatus_4.NotTagged)  # same code as python_script_6
getLocation_2 = Element.GetLocation(element=python_script_12)
code_block_39 = CodeBlock { 0.5; }
pointAtParameter_3 = Curve.PointAtParameter(curve=getLocation_2, param=code_block_39)
code_block_40 = CodeBlock { 0.5; }
normalAtParameter_2 = Curve.NormalAtParameter(curve=getLocation_2, param=code_block_40)
X_2 = Vector.X(vector=normalAtParameter_2)
code_block_41 = CodeBlock { 2; }
round_3 = Math.Round(number=X_2, digits=code_block_41)
Y_2 = Vector.Y(vector=normalAtParameter_2)
code_block_42 = CodeBlock { 2; }
round_4 = Math.Round(number=Y_2, digits=code_block_42)
evalua_la_posicion_del_tag_2 = Python(IN[0]=round_3, IN[1]=round_4)  # same code as evalua_la_posicion_del_tag

# group: Type Parameter
code_block_43 = CodeBlock { "Type"; "Width"; }
getParameterValueByName_7 = Element.GetParameterValueByName(element=python_script_12, parameterName=code_block_43.out0)
getParameterValueByName_8 = Element.GetParameterValueByName(element=getParameterValueByName_7, parameterName=code_block_43.out1)

code_block_44 = CodeBlock(a=getParameterValueByName_8) { a / 2; (a / 2) * -1; }
if_3 = If(test=evalua_la_posicion_del_tag_2, true=code_block_44.out0, false=code_block_44.out1)
translate_4 = Geometry.Translate(geometry=pointAtParameter_3, direction=normalAtParameter_2, distance=if_3)
byElementAndLocation_3 = Tag.ByElementAndLocation(view=code_block_37, element=python_script_12, location=translate_4)
code_block_45 = CodeBlock { "Type"; }
code_block_46 = CodeBlock { "EST_A_STRUCTURAL FRAMING TAG_PLANTA"; }
byName_11 = Family.ByName(name=code_block_46)
code_block_47 = CodeBlock { "Tag Viga"; }
byFamilyAndName_6 = FamilyType.ByFamilyAndName(family=byName_11, name=code_block_47)
setParameterByName_4 = Element.SetParameterByName(element=byElementAndLocation_3, parameterName=code_block_45, value=byFamilyAndName_6)
code_block_48 = CodeBlock(x=end) { x; }
python_script_13 = Python(IN[0]=code_block_48)  # same code as python_script_4
code_block_49 = CodeBlock { "Type"; "View Direction"; }
getParameterValueByName_9 = Element.GetParameterValueByName(element=python_script_13, parameterName=code_block_49.out0)
getParameterValueByName_10 = Element.GetParameterValueByName(element=getParameterValueByName_9, parameterName=code_block_49.out1)
python_script_14 = Python(IN[0]=code_block_48, IN[1]=getParameterValueByName_10)
# ---------- python_script_14.python (9 lines) ----------
inputs = IN[0]
view_direction = IN[1]

if view_direction == 1:
	res = []
else:
	res = inputs

OUT = res
# ----------------------------------------
code_block_50 = CodeBlock { "Structural Foundations"; }
byName_12 = Category.ByName(name=code_block_50)
all_elements_of_category_in_view_5 = ElementsOfCategoryInView(Category=byName_12, View=python_script_14)
element_taggedstatus_5 = Custom[Element TaggedStatus](element=all_elements_of_category_in_view_5@L2)
python_script_15 = Python(IN[0]=element_taggedstatus_5.NotTagged)  # same code as python_script_6
flatten_4 = List.Flatten(list=python_script_15)
kind = Custom[StructuralFoundation.Kind](structuralFoundation=flatten_4)  # package Clockwork for Dynamo 2.x; Retrieves the kind of a given structural foundation (isolated, wall, slab).
python_script_16 = Python(IN[0]=kind)
# ---------- python_script_16.python (8 lines) ----------
elemento = IN[0]

if elemento[0] == []:
	elemento = []
else:
	elemento
	
OUT = elemento
# ----------------------------------------
code_block_51 = CodeBlock { "Wall Footing"; }
eq_2 = python_script_16 == code_block_51
filterByBoolMask_3 = List.FilterByBoolMask(list=flatten_4, mask=eq_2)
python_script_17 = Python(IN[0]=filterByBoolMask_3.in)  # same code as python_script_6
host = Custom[Element.Host+](element=python_script_17)  # package Clockwork for Dynamo 2.x; Gets an element's host. Unlike the OOTB node FamilyInstance.GetHost it not only works for family instances but also for elements like wall sweeps, foundations, railings, builing pads and topo subregions.
python_script_18 = Python(IN[0]=host)  # same code as python_script_16
getLocation_3 = Element.GetLocation(element=python_script_18)
code_block_52 = CodeBlock { 0.5; }
normalAtParameter_3 = Curve.NormalAtParameter(curve=getLocation_3, param=code_block_52)
X_3 = Vector.X(vector=normalAtParameter_3)
code_block_53 = CodeBlock { 2; }
round_5 = Math.Round(number=X_3, digits=code_block_53)
Y_3 = Vector.Y(vector=normalAtParameter_3)
code_block_54 = CodeBlock { 2; }
round_6 = Math.Round(number=Y_3, digits=code_block_54)
evalua_la_posicion_del_tag_3 = Python(IN[0]=round_5, IN[1]=round_6)
# ---------- evalua_la_posicion_del_tag_3.python (25 lines) ----------
x_lists = IN[0]
y_lists = IN[1]

def compare_lists(x, y):
    result_comparison = []

    try:
        # Verifica si x e y son listas anidadas o listas simples
        if isinstance(x[0], list) and isinstance(y[0], list):
            # Manejo de listas anidadas
            for x_sublist, y_sublist in zip(x, y):
                comparison_sublist = []
                for x_elem, y_elem in zip(x_sublist, y_sublist):
                    comparison_sublist.append(x_elem <= y_elem)
                result_comparison.append(comparison_sublist)
        else:
            # Manejo de listas simples
            for x_elem, y_elem in zip(x, y):
                result_comparison.append(x_elem <= y_elem)
    except Exception as e:
        return []

    return result_comparison
    
OUT = compare_lists(x_lists, y_lists)
# ----------------------------------------
code_block_55 = CodeBlock { "Type"; "Width"; }
getParameterValueByName_11 = Element.GetParameterValueByName(element=python_script_17, parameterName=code_block_55.out0)
getParameterValueByName_12 = Element.GetParameterValueByName(element=getParameterValueByName_11, parameterName=code_block_55.out1)
code_block_56 = CodeBlock(a=getParameterValueByName_12) { (a / 2) * -1; (a / 2); }
if_4 = If(test=evalua_la_posicion_del_tag_3, true=code_block_56.out0, false=code_block_56.out1)
translate_5 = Geometry.Translate(geometry=getLocation_3, direction=normalAtParameter_3, distance=if_4)
code_block_57 = CodeBlock { 0.5; }
pointAtParameter_4 = Curve.PointAtParameter(curve=translate_5, param=code_block_57)
planeAtParameter = Curve.PlaneAtParameter(curve=getLocation_3)
byPlane = CoordinateSystem.ByPlane(plane=planeAtParameter)
ZAxis_3 = CoordinateSystem.ZAxis(coordinateSystem=byPlane)
plane_3 = Custom[View.Plane](view=python_script_14)  # package Clockwork for Dynamo 2.x; Retrieves the plane of a given view
toCoordinateSystem = Plane.ToCoordinateSystem(plane=plane_3)
YAxis = CoordinateSystem.YAxis(coordinateSystem=toCoordinateSystem)
isParallel = Vector.IsParallel(vector=ZAxis_3@L2, other=YAxis@L1, lacing=Longest)
flatten_5 = List.Flatten(list=isParallel)
python_script_19 = Python(IN[0]=flatten_5)
# ---------- python_script_19.python (9 lines) ----------
def invertir_lista(lista):
    if isinstance(lista, list):
        return [invertir_lista(elemento) if isinstance(elemento, list) else not elemento for elemento in lista]
    else:
        return not lista

lista = IN[0]
lista_invertida = invertir_lista(lista)
OUT = lista_invertida
# ----------------------------------------
byElementAndLocation_4 = Tag.ByElementAndLocation(view=python_script_14, element=python_script_17, location=pointAtParameter_4, horizontal=python_script_19, lacing=Longest)
code_block_58 = CodeBlock { "Type"; }
code_block_59 = CodeBlock { "EST_A_STRUCTURAL FOUNDATION TAG_PLANTA_SELLO FUNDACION"; }
byName_13 = Family.ByName(name=code_block_59)
code_block_60 = CodeBlock { "Sello Fundacion"; }
byFamilyAndName_7 = FamilyType.ByFamilyAndName(family=byName_13, name=code_block_60)
setParameterByName_5 = Element.SetParameterByName(element=byElementAndLocation_4, parameterName=code_block_58, value=byFamilyAndName_7)
kind_2 = Custom[StructuralFoundation.Kind](structuralFoundation=flatten_4)
python_script_20 = Python(IN[0]=kind_2)  # same code as python_script_16
code_block_61 = CodeBlock { "Isolated"; }
eq_3 = python_script_20 == code_block_61
filterByBoolMask_4 = List.FilterByBoolMask(list=flatten_4, mask=eq_3)
geometry_4 = Element.Geometry(element=filterByBoolMask_4.in)
byGeometry_2 = BoundingBox.ByGeometry(geom=geometry_4)
toPolySurface_2 = BoundingBox.ToPolySurface(boundingBox=byGeometry_2)
surfaces_2 = PolySurface.Surfaces(polySurface=toPolySurface_2)
code_block_62 = CodeBlock { 0; }
getItemAtIndex_2 = List.GetItemAtIndex(list=surfaces_2@L2, index=code_block_62)
code_block_63 = CodeBlock()
# ---------- code_block_63.designscript (4 lines) ----------
//u
[1, 0.5];
//v
[1, 0];
# ----------------------------------------
pointAtParameter_5 = Surface.PointAtParameter(surface=getItemAtIndex_2@L2, u=code_block_63.out0, v=code_block_63.out1, lacing=Longest)
transpose = List.Transpose(lists=pointAtParameter_5)
byElementAndLocation_5 = Tag.ByElementAndLocation(view=python_script_14, element=filterByBoolMask_4.in, location=transpose, lacing=Longest)
transpose_2 = List.Transpose(lists=byElementAndLocation_5)
code_block_64 = CodeBlock { "Type"; }
code_block_65 = CodeBlock { "EST_A_STRUCTURAL FOUNDATION TAG_PLANTA_TIPO FUNDACION"; }
byName_14 = Family.ByName(name=code_block_65)
code_block_66 = CodeBlock { "Tipo Fundacion"; }
byFamilyAndName_8 = FamilyType.ByFamilyAndName(family=byName_14, name=code_block_66)
code_block_67 = CodeBlock { "EST_A_STRUCTURAL FOUNDATION TAG_PLANTA_SELLO FUNDACION"; }
byName_15 = Family.ByName(name=code_block_67)
code_block_68 = CodeBlock { "Sello Fundacion"; }
byFamilyAndName_9 = FamilyType.ByFamilyAndName(family=byName_15, name=code_block_68)
list_create = List.Create(item0=byFamilyAndName_8, item1=byFamilyAndName_9)
setParameterByName_6 = Element.SetParameterByName(element=transpose_2, parameterName=code_block_64, value=list_create, lacing=Longest)
