# Dynamo graph spotElevCotaElev_script.dyn "spotElevationCotaElevacion" (Dynamo 2.6.2.15705)
# packages: Genius Loci 2023.7.11, Genius Loci 2021.11.10, Clockwork for Dynamo 2.x 2.4.0, Data-Shapes 2022.2.103

current = Document.Current()
activeView = Document.ActiveView(document=current)
code_block = CodeBlock { "Validacion"; }
code_block_2 = CodeBlock { "Project Information"; }
byName = Category.ByName(name=code_block_2)
all_elements_of_category = ElementsOfCategory(Category=byName)
parameterExists = Custom[Element.ParameterExists](param=code_block, element=all_elements_of_category)  # package Clockwork for Dynamo 2.x; Checks if an element contains a parameter of a given name
code_block_3 = CodeBlock()
# ---------- code_block_3.designscript (11 lines) ----------
//InputName
"Seleccionar Cota";

//ButtonText
"SELECCIONAR";

//CategoryFilter
 Revit.Category.ByName("Dimensions");

//SelectSingleElement
true;
# ----------------------------------------
selectmodelelements_data = Custom[SelectModelElements Data](InputName=code_block_3.out0, ButtonText=code_block_3.out1, CategoryFilter=code_block_3.out2, SelectSingleElement=code_block_3.out3)  # package Data-Shapes; Creates a Revit element selection input for UI.MultipleInputForm++ . Check out www.data-shapes.net for more infos!
python_script = Python(IN[0]=parameterExists, IN[1]=selectmodelelements_data)
# ---------- python_script.python (9 lines) ----------
validacion = IN[0][0]
inputs = IN[1]

if validacion == True:
	res = inputs
else:
	res = []

OUT = res
# ----------------------------------------
code_block_4 = CodeBlock(inputs=python_script)
# ---------- code_block_4.designscript (29 lines) ----------
//Description_optional
"Spot Elevations en Cota";

//Logo


//ButtonText
"INICIAR";

//Inputs
inputs;

//Toggle
true;

//LinkToHelp


//CancelButtonText
"CANCELAR";

//MaxHeight
900;

//Width
500;

//LabelWidth
150;
# ----------------------------------------
multipleinputform = Custom[MultipleInputForm ++](Description_optional=code_block_4.out0, ButtonText_optional=code_block_4.out1, Inputs=code_block_4.inputs, Toggle=code_block_4.out3, CancelButtonText_optional=code_block_4.out4, MaxHeight_optional=code_block_4.out5, Width_optional=code_block_4.out6, LabelWidth_optional=code_block_4.out7)  # package Data-Shapes; Create a form with multiple inputs. see www.data-shapes.net for tutorials and infos!
python_script_2 = Python(IN[0]=multipleinputform.User_Inputs)
# ---------- python_script_2.python (7 lines) ----------
input = IN[0]

if input == [] or input == None:
	res = []
else:
	res = input[0]
OUT = res
# ----------------------------------------
dimension_properties = Custom[Dimension Properties](dimension=python_script_2, lacing=Longest)  # package Genius Loci; Returns the origin of the dimension, the dimension's curve, the value, the text position, the prefix, the suffix, the value override and all elements that are referenced by the given dimension
reference_surface = Custom[Reference Surface](reference=dimension_properties.References)  # package Genius Loci; Obtains the Revit surface from a reference in the given document.
code_block_5 = CodeBlock { 0.5; }
pointAtParameter = Surface.PointAtParameter(surface=reference_surface, u=code_block_5, v=code_block_5)
startPoint = Curve.StartPoint(curve=dimension_properties.Curve)
endPoint = Curve.EndPoint(curve=dimension_properties.Curve)
list_create = List.Create(item0=startPoint, item1=endPoint)
flatten = List.Flatten(list=list_create)
pruneDuplicates = Point.PruneDuplicates(points=flatten)
plane = Custom[View.Plane](view=activeView)  # package Clockwork for Dynamo 2.x; Retrieves the plane of a given view
YAxis = Plane.YAxis(plane=plane)
code_block_6 = CodeBlock { -400; }
translate = Geometry.Translate(geometry=pruneDuplicates, direction=YAxis, distance=code_block_6, lacing=Longest)
getCategory = Element.GetCategory(element=dimension_properties.ReferencedElements)
string_from_object = FromObject(obj=getCategory)
element_types_ᶜᵒⁿᵛᵉʳᵗᵉᵈ_ᵈʳᵒᵖᵈᵒʷⁿ = CodeBlock { DSCore.Types.FindTypeByNameInAssembly("SpotDimensionType", "RevitAPI"); }
all_elements_of_type = ElementsOfType(element_type=element_types_ᶜᵒⁿᵛᵉʳᵗᵉᵈ_ᵈʳᵒᵖᵈᵒʷⁿ)
name = Element.Name(element=all_elements_of_type)
code_block_7 = CodeBlock()
# ---------- code_block_7.designscript (6 lines) ----------
[
"Nivel Sello de Fundacion",
"Nivel Tope de Losa",
"Nivel Tope de Concreto",
"Nivel de Proyecto"
];
# ----------------------------------------
contains = String.Contains(str=name@L1, searchFor=code_block_7@L2, lacing=Longest)
anyTrue = Custom[Booleans.AnyTrue](seq=contains)  # package Clockwork for Dynamo 2.x; Returns true if any item in a list of booleans is true.
filterByBoolMask = List.FilterByBoolMask(list=all_elements_of_type, mask=anyTrue)
codeblock = CodeBlock(value=filterByBoolMask.in) { value[0]; value[1]; value[2]; value[3]; }
python_script_3 = Python(IN[0]=string_from_object, IN[1]=codeblock.out1, IN[2]=codeblock.out3, IN[3]=codeblock.out2, IN[4]=codeblock.out0)
# ---------- python_script_3.python (31 lines) ----------
# Importamos las bibliotecas necesarias
import clr
clr.AddReference('RevitAPI')
clr.AddReference('RevitServices')
from Autodesk.Revit.DB import *
from RevitServices.Persistence import DocumentManager
from RevitServices.Transactions import TransactionManager

# Definimos la lista
lista = IN[0]  # Entrada desde Dynamo
sello_de_fundacion = IN[1]
tope_de_losa = IN[2]
tope_de_concreto = IN[3]
nivel_de_proyecto = IN[4]

# Función para determinar el tipo
def determinar_tipo(valor):
    if valor == "Floors":
        return tope_de_losa
    elif valor == "Structural Foundations":
        return sello_de_fundacion
    elif valor == "Walls":
        return tope_de_concreto
    else:
        return nivel_de_proyecto

# Bucle que recorre la lista y genera la lista de tipos resultantes
tipos_resultantes = [determinar_tipo(valor) for valor in lista]

# Devolver la lista de tipos resultantes a Dynamo
OUT = tipos_resultantes
# ----------------------------------------
spotelevation_byreference = Custom[SpotElevation ByReference](view=activeView, reference=dimension_properties.References, point=pointAtParameter, bend=pruneDuplicates, end=translate, spotDimensionType=python_script_3, lacing=Longest)  # package Genius Loci; Places a spot elevation at a given reference in a given view. Inspired by the Dynamo Forum
flatten_2 = List.Flatten(list=spotelevation_byreference)
dimension_properties_2 = Custom[Dimension Properties](dimension=flatten_2, lacing=Longest)
flatten_3 = List.Flatten(list=dimension_properties_2.ReferencedElements)
name_2 = Element.Name(element=flatten_3)
code_block_8 = CodeBlock { "RADIER"; }
contains_2 = String.Contains(str=name_2, searchFor=code_block_8)
filterByBoolMask_2 = List.FilterByBoolMask(list=flatten_2, mask=contains_2)
code_block_9 = CodeBlock { "Type"; }
element_types_ᶜᵒⁿᵛᵉʳᵗᵉᵈ_ᵈʳᵒᵖᵈᵒʷⁿ_2 = CodeBlock { DSCore.Types.FindTypeByNameInAssembly("SpotDimensionType", "RevitAPI"); }
all_elements_of_type_2 = ElementsOfType(element_type=element_types_ᶜᵒⁿᵛᵉʳᵗᵉᵈ_ᵈʳᵒᵖᵈᵒʷⁿ_2)
name_3 = Element.Name(element=all_elements_of_type_2)
code_block_10 = CodeBlock { "Nivel Tope de Radier"; }
contains_3 = String.Contains(str=name_3, searchFor=code_block_10)
filterByBoolMask_3 = List.FilterByBoolMask(list=all_elements_of_type_2, mask=contains_3)
setParameterByName = Element.SetParameterByName(element=filterByBoolMask_2.in, parameterName=code_block_9, value=filterByBoolMask_3.in)
