# Dynamo graph cropBoxByCurves_script.dyn "cropBoxxByCurves_script" (Dynamo 2.6.2.15705)
# packages: Data-Shapes 2021.2.94, Clockwork for Dynamo 2.x 2.4.0, Data-Shapes 2022.2.103, archi-lab.net 2022.210.2419, Orchid 2.6.7.6080, QuasarII 2021.25.101

current = Document.Current()
activeView = Document.ActiveView(document=current)
type = Custom[View.Type](view=activeView)  # package Clockwork for Dynamo 2.x; Returns the type of a given view
code_block = CodeBlock(view_type=type)
# ---------- code_block.designscript (5 lines) ----------
//Tittle
"Error";

//TextNote
"Esta herramienta no puede ser usada en vistas de tipo " + view_type + ".";
# ----------------------------------------
textnote_data = Custom[TextNote Data](Title=code_block.out0, TextNote=code_block.out1)  # package Data-Shapes; Create Data for TextNote input in UI.MultipleInputForm ++ . Check out www.data-shapes.net for more informations
python_script = Python(IN[0]=type)
# ---------- python_script.python (8 lines) ----------
input = IN[0]

if input in ["CeilingPlan", "EngineeringPlan", "FloorPlan", "Detail", "Elevation", "Section"]:
	toggle = False
else:
	toggle = True
	
OUT = toggle
# ----------------------------------------
code_block_2 = CodeBlock(inputs=textnote_data, toggle=python_script)
# ---------- code_block_2.designscript (29 lines) ----------
//Description_optional
"Crop View por Lineas";

//Logo


//ButtonText
"ACEPTAR";

//Inputs
inputs;

//Toggle
toggle;

//LinkToHelp


//CancelButtonText


//MaxHeight


//Width
450;

//LabelWidth
150;
# ----------------------------------------
multipleinputform = Custom[MultipleInputForm ++](Description_optional=code_block_2.out0, ButtonText_optional=code_block_2.out1, Inputs=code_block_2.inputs, Toggle=code_block_2.toggle, Width_optional=code_block_2.out4, LabelWidth_optional=code_block_2.out5)  # package Data-Shapes; Create a form with multiple inputs. see www.data-shapes.net for tutorials and infos!
code_block_3 = CodeBlock { "Validacion"; }
code_block_4 = CodeBlock { "Project Information"; }
byName = Category.ByName(name=code_block_4)
all_elements_of_category = ElementsOfCategory(Category=byName)
parameterExists = Custom[Element.ParameterExists](param=code_block_3, element=all_elements_of_category)  # package Clockwork for Dynamo 2.x; Checks if an element contains a parameter of a given name
code_block_5 = CodeBlock()
# ---------- code_block_5.designscript (10 lines) ----------
//InputName
"Seleccionar Lineas";

//ButtonText
"SELECCIONAR";

//CategoryFilter
Revit.Category.ByName("Lines");

//SelectSingleElement
# ----------------------------------------
selectmodelelements_data = Custom[SelectModelElements Data](InputName=code_block_5.out0, ButtonText=code_block_5.out1, CategoryFilter=code_block_5.out2)  # package Data-Shapes; Creates a Revit element selection input for UI.MultipleInputForm++ . Check out www.data-shapes.net for more infos!
code_block_6 = CodeBlock()
# ---------- code_block_6.designscript (11 lines) ----------
//InputName


//Keys
["Vista Actual", "Multiples Vistas"];

//Values
[true, false];

//DefaultValueIndex
0;
# ----------------------------------------
radiobuttons_data = Custom[RadioButtons Data](Keys=code_block_6.out0, Values=code_block_6.out1, DefaultValueIndex=code_block_6.out2)  # package Data-Shapes; Create radio buttons input for UI.MultipleInputForm ++ .
list_create = List.Create(item0=selectmodelelements_data, item1=radiobuttons_data)
python_script_2 = Python(IN[0]=parameterExists, IN[1]=list_create)
# ---------- python_script_2.python (9 lines) ----------
validacion = IN[0][0]
inputs = IN[1]

if validacion == True:
	res = inputs
else:
	res = []

OUT = res
# ----------------------------------------
python_script_3 = Python(IN[0]=type)
# ---------- python_script_3.python (8 lines) ----------
input = IN[0]

if input in ["CeilingPlan", "EngineeringPlan", "FloorPlan", "Detail", "Elevation", "Section"]:
	toggle = True
else:
	toggle = False
	
OUT = toggle
# ----------------------------------------
code_block_7 = CodeBlock(inputs=python_script_2, toggle=python_script_3)
# ---------- code_block_7.designscript (27 lines) ----------
//Description
"Crop View por Lineas";

//Logo

//ButtonText
"INICIAR";

//Inputs
inputs;

//Toggle
toggle;

//LinkToHelp

//CancelButtonText
"CANCELAR";

//MaxHeight


//width
450;

//LabelWidth
180;
# ----------------------------------------
multipleinputform_2 = Custom[MultipleInputForm ++](Description_optional=code_block_7.out0, ButtonText_optional=code_block_7.out1, Inputs=code_block_7.inputs, Toggle=code_block_7.toggle, CancelButtonText_optional=code_block_7.out4, Width_optional=code_block_7.out5, LabelWidth_optional=code_block_7.out6)
python_script_4 = Python(IN[0]=multipleinputform_2.User_Inputs)
# ---------- python_script_4.python (8 lines) ----------
input = IN[0]

if input == None or input == [] or input[0] == "Set toggle to true!":
	input = []
else:
	input = input[0]
	
OUT = input
# ----------------------------------------
geometry = Element.Geometry(element=python_script_4)
flatten = List.Flatten(list=geometry)
python_script_5 = Python(IN[0]=flatten)
# ---------- python_script_5.python (8 lines) ----------
input = IN[0]

if input == []:
	input = []
else:
	input = 0.001
	
OUT = input
# ----------------------------------------
byJoinedCurves = PolyCurve.ByJoinedCurves(curves=flatten, joinTolerance=python_script_5)
explode = Geometry.Explode(geometry=byJoinedCurves)
current_2 = Document.Current()
activeView_2 = Document.ActiveView(document=current_2)
python_script_6 = Python(IN[0]=explode, IN[1]=activeView_2)
# ---------- python_script_6.python (9 lines) ----------
input = IN[0]
view = IN[1]

if input == []:
	res = []
else:
	res = view
	
OUT = res
# ----------------------------------------
element_types_ᶜᵒⁿᵛᵉʳᵗᵉᵈ_ᵈʳᵒᵖᵈᵒʷⁿ = CodeBlock { DSCore.Types.FindTypeByNameInAssembly("View", "RevitAPI"); }
all_elements_of_type = ElementsOfType(element_type=element_types_ᶜᵒⁿᵛᵉʳᵗᵉᵈ_ᵈʳᵒᵖᵈᵒʷⁿ)
type_2 = Custom[View.Type](view=all_elements_of_type)
code_block_8 = CodeBlock { ["FloorPlan", "CeilingPlan", "EngineeringPlan"]; }
eq = type_2@L1 == code_block_8@L2  # lacing=Longest
anyTrue = Custom[Booleans.AnyTrue](seq=eq@L2)  # package Clockwork for Dynamo 2.x; Returns true if any item in a list of booleans is true.
filterByBoolMask = List.FilterByBoolMask(list=all_elements_of_type, mask=anyTrue)
code_block_9 = CodeBlock { "Subclasificacion"; }
getParameterValueByName = Element.GetParameterValueByName(element=python_script_6, parameterName=code_block_9)
code_block_10 = CodeBlock { "Subclasificacion"; }
getParameterValueByName_2 = Element.GetParameterValueByName(element=filterByBoolMask.in, parameterName=code_block_10)
eq_2 = getParameterValueByName == getParameterValueByName_2
filterByBoolMask_2 = List.FilterByBoolMask(list=filterByBoolMask.in, mask=eq_2)
python_script_7 = Python(IN[0]=multipleinputform_2.User_Inputs)
# ---------- python_script_7.python (8 lines) ----------
input = IN[0]

if input == None or input == [] or input[0] == "Set toggle to true!":
	input = []
else:
	input = input[1]
	
OUT = input
# ----------------------------------------
python_script_8 = Python(IN[0]=python_script_6, IN[1]=filterByBoolMask_2.in, IN[2]=python_script_7)
# ---------- python_script_8.python (10 lines) ----------
active_view = [IN[0]]
view_list = IN[1]
bool = IN[2]

if bool == True:
	res = active_view
else:
	res = active_view + view_list
	
OUT = res
# ----------------------------------------
isViewTemplate = Custom[View.IsViewTemplate+](view=python_script_8)  # package Clockwork for Dynamo 2.x; Checks if a given view is a view template. Unlike the OOTB node it works for all view types.
filterByBoolMask_3 = List.FilterByBoolMask(list=python_script_8, mask=isViewTemplate)
setCropBoxByCurves = archilab.Revit.Views.Views.SetCropBoxByCurves(view=filterByBoolMask_3.out, curves=explode)
code_block_11 = CodeBlock { ["Crop View","Crop Region Visible"]; [1,0]; }
setParameterByName = Element.SetParameterByName(element=setCropBoxByCurves@L1, parameterName=code_block_11.out0@L2, value=code_block_11.out1@L2, lacing=Longest)
flatten_2 = List.Flatten(list=setParameterByName)
uniqueItems = List.UniqueItems(list=flatten_2)
o_datastream_await = Orchid.Common.DataStream.Await(pass=python_script_4, waitFor=uniqueItems)
delete = archilab.Revit.Elements.Elements.Delete(element=o_datastream_await)
viewTypes = ViewTypeUIDropDown("EngineeringPlan")
