# Dynamo graph EliminarEtiquetas_script.dyn "EliminarEtiquetas" (Dynamo 2.6.2.15705)
# packages: Data-Shapes 2022.2.103, Structural Design 2021.1.22

current = Document.Current()
activeView = Document.ActiveView(document=current)
viewType = StructuralDesign.Model.Geometry.ViewType(view=activeView)
views = Sheet.Views()  # unwired: sheet
function_apply = ApplyFunction(func=views, arg1=activeView)
python_script = Python(IN[0]=viewType, IN[1]=activeView, IN[2]=function_apply)
# ---------- python_script.python (10 lines) ----------
input1 = IN[0]
input2 = IN[1]
input3 = IN[2]

if input1 != "DrawingSheet":
	res = input2
else:
	res = input3

OUT = res
# ----------------------------------------
code_block = CodeBlock()
# ---------- code_block.designscript (7 lines) ----------
[
"Structural Rebar Tags",
"Structural Framing Tags",
"Structural Column Tags",
"Wall Tags",
"Structural Foundation Tags"
];
# ----------------------------------------
byName = Category.ByName(name=code_block)
all_elements_of_categories_in = Custom[All Elements Of Categories in View](Views=python_script@L1, Categories=byName@L2, lacing=Longest)  # package Data-Shapes; Retrieves all elements of the given categories in the given view
flatten = List.Flatten(list=all_elements_of_categories_in)
delete = Element.Delete(element=flatten)
