# Dynamo graph laminasPorCategoria_script.dyn (Dynamo 2.6.2.15705)
# packages: Data-Shapes 2022.2.103, Clockwork for Dynamo 2.x 2.4.0, Rhythm 2021.7.2, Genius Loci 2022.4.19

code_block = CodeBlock { "Sheets"; }
byName = Category.ByName(name=code_block)
all_elements_of_category = ElementsOfCategory(Category=byName)
code_block_2 = CodeBlock { "Láminas por Categoría"; }
code_block_3 = CodeBlock()
# ---------- code_block_3.designscript (4 lines) ----------
"INICIAR";
"CANCELAR";
//Width
440;
# ----------------------------------------
boolean = BoolSelector(true)
multipleinputform = Custom[MultipleInputForm ++](Description_optional=code_block_2, ButtonText_optional=code_block_3.out0, Toggle=boolean, CancelButtonText_optional=code_block_3.out1, Width_optional=code_block_3.out2)  # frozen; package Data-Shapes; Create a form with multiple inputs. see www.data-shapes.net for tutorials and infos!; unwired: Inputs
code_block_4 = CodeBlock(l=multipleinputform.User_Inputs)
# ---------- code_block_4.designscript (12 lines) ----------
l;
[Imperative]
{
	if (l == null)
		{
		return = [[],[],[],[],[],[],[]];
		}
	else
		{
		return = l;
		}
};
# ----------------------------------------
code_block_5 = CodeBlock(x=code_block_4.out1) { x; }
code_block_6 = CodeBlock(l=code_block_5) { DSCore.List.Flatten(([l[1]]),1); }
identity = Object.Identity(obj=code_block_6)
code_block_7 = CodeBlock { "Clasificacion"; }
getParameterValueByName = Element.GetParameterValueByName(element=all_elements_of_category, parameterName=code_block_7)
eq = identity == getParameterValueByName  # lacing=Longest
filterByBoolMask = List.FilterByBoolMask(list=all_elements_of_category, mask=eq)
code_block_8 = CodeBlock { null; }
replaceEmptyLists = Custom[List.ReplaceEmptyLists](seq=filterByBoolMask.in, Replacement=code_block_8)  # package Clockwork for Dynamo 2.x; Replaces all empty lists within a given list with a substitute
code_block_9 = CodeBlock(l=code_block_5) { l[0]; l[2]; DSCore.List.OfRepeatedItem(l[0],l[2]); }
code_block_10 = CodeBlock(l=replaceEmptyLists, y=code_block_9.out2)
# ---------- code_block_10.designscript (13 lines) ----------
l;
y;
[Imperative]
{
	if (l == null)
		{
		return = y;
		}
	else
		{
		return = [];
		}
};
# ----------------------------------------
ʳʰʸᵗʰᵐ_sheet_create = Rhythm.Revit.Elements.Sheet.Create(titleblock=code_block_10.out2)
code_block_11 = CodeBlock()
# ---------- code_block_11.designscript (9 lines) ----------
[
"Sheet Name",
"Designed By",
"Checked By",
"Drawn By",
"Sheet Issue Date",
"Approved By",
"Clasificacion"
];
# ----------------------------------------
code_block_12 = CodeBlock(l=code_block_5) { ls = DSCore.List.Slice(l,3,8,1); l[2]; DSCore.List.Flatten([ls,"P. ARANEDA",l[1]],1); }
list_clean = Custom[List Clean](list=code_block_12.out2)  # package Genius Loci; Removes all Null, Empty and Blank from a list or nested list of lists.
setParameterByName = Element.SetParameterByName(element=ʳʰʸᵗʰᵐ_sheet_create@L1, parameterName=code_block_11@L2, value=list_clean@L2, lacing=Longest)
code_block_13 = CodeBlock(lst=setParameterByName) { DSCore.List.UniqueItems(DSCore.List.Flatten(lst,1)); }
code_block_14 = CodeBlock { "Sheet Number"; }
code_block_15 = CodeBlock(x=code_block_5) { x[1]; }
code_block_16 = CodeBlock(l=code_block_5) { 1..l[2]..1; }
code_block_17 = CodeBlock { 3; }
withLeadingZeroes = Custom[List.WithLeadingZeroes](num=code_block_16, n=code_block_17)  # package Clockwork for Dynamo 2.x; Adds leading zeros to a sequence of numbers
code_block_18 = CodeBlock { null; }
replaceEmptyLists_2 = Custom[List.ReplaceEmptyLists](seq=withLeadingZeroes, Replacement=code_block_18)
code_block_19 = CodeBlock(l=replaceEmptyLists_2)
# ---------- code_block_19.designscript (12 lines) ----------
l;
[Imperative]
{
	if (l == null)
		{
		return = [];
		}
	else
		{
		return = l;
		}
};
# ----------------------------------------
code_block_20 = CodeBlock(clas=code_block_15, lst=code_block_19.out1) { clas+"-"+lst; }
setParameterByName_2 = Element.SetParameterByName(element=code_block_13, parameterName=code_block_14, value=code_block_20, lacing=Longest)
code_block_21 = CodeBlock { "Sheets"; }
byName_2 = Category.ByName(name=code_block_21)
all_elements_of_category_2 = ElementsOfCategory(Category=byName_2)
code_block_22 = CodeBlock(x=code_block_4.out1) { x; }
code_block_23 = CodeBlock(l=code_block_22) { DSCore.List.Flatten(([l[1]]),1); }
identity_2 = Object.Identity(obj=code_block_23)
code_block_24 = CodeBlock { "Clasificacion"; }
getParameterValueByName_2 = Element.GetParameterValueByName(element=all_elements_of_category_2, parameterName=code_block_24)
eq_2 = identity_2 == getParameterValueByName_2  # lacing=Longest
filterByBoolMask_2 = List.FilterByBoolMask(list=all_elements_of_category_2, mask=eq_2)
isEmpty = List.IsEmpty(list=filterByBoolMask_2.in)
sheetNumber = Sheet.SheetNumber(sheet=filterByBoolMask_2.in)
code_block_25 = CodeBlock { null; }
replaceEmptyLists_3 = Custom[List.ReplaceEmptyLists](seq=sheetNumber, Replacement=code_block_25)
code_block_26 = CodeBlock(l=replaceEmptyLists_3)
# ---------- code_block_26.designscript (12 lines) ----------
l;
[Imperative]
{
	if (l == null)
		{
		return = [[]];
		}
	else
		{
		return = l;
		}
};
# ----------------------------------------
lastItem = List.LastItem(list=code_block_26.out1)
code_block_27 = CodeBlock { 0; 3; }
remove = String.Remove(str=lastItem, startIndex=code_block_27.out0, count=code_block_27.out1)
code_block_28 = CodeBlock(l=code_block_22, x=remove) { lst = l[2]+DSCore.String.ToNumber(x); DSCore.String.ToNumber(x)+1..lst..1; }
code_block_29 = CodeBlock { 3; }
withLeadingZeroes_2 = Custom[List.WithLeadingZeroes](num=code_block_28.out1, n=code_block_29)
count = List.Count(list=withLeadingZeroes_2)
code_block_30 = CodeBlock(l=code_block_22, x=count) { l[0]; x; DSCore.List.OfRepeatedItem(l[0],x); }
code_block_31 = CodeBlock(l=isEmpty, y=code_block_30.out2)
# ---------- code_block_31.designscript (13 lines) ----------
l;
y;
[Imperative]
{
	if (l == false)
		{
		return = y;
		}
	else
		{
		return = [];
		}
};
# ----------------------------------------
ʳʰʸᵗʰᵐ_sheet_create_2 = Rhythm.Revit.Elements.Sheet.Create(titleblock=code_block_31.out2)
code_block_32 = CodeBlock()  # same code as code_block_11
code_block_33 = CodeBlock(l=code_block_22) { ls = DSCore.List.Slice(l,3,8,1); l[2]; DSCore.List.Flatten([ls,"P. ARANEDA",l[1]],1); }
list_clean_2 = Custom[List Clean](list=code_block_33.out2)
setParameterByName_3 = Element.SetParameterByName(element=ʳʰʸᵗʰᵐ_sheet_create_2@L1, parameterName=code_block_32@L2, value=list_clean_2@L2, lacing=Longest)
code_block_34 = CodeBlock(lst=setParameterByName_3) { DSCore.List.UniqueItems(DSCore.List.Flatten(lst,1)); }
code_block_35 = CodeBlock { "Sheet Number"; }
code_block_36 = CodeBlock { "Clasificacion"; }
getParameterValueByName_3 = Element.GetParameterValueByName(element=code_block_34, parameterName=code_block_36)
code_block_37 = CodeBlock(clas=getParameterValueByName_3, num=withLeadingZeroes_2) { clas+"-"+num; }
setParameterByName_4 = Element.SetParameterByName(element=code_block_34, parameterName=code_block_35, value=code_block_37, lacing=Longest)
code_block_38 = CodeBlock { "Validacion"; }
code_block_39 = CodeBlock { "Project Information"; }
byName_3 = Category.ByName(name=code_block_39)
all_elements_of_category_3 = ElementsOfCategory(Category=byName_3)
parameterExists = Custom[Element.ParameterExists](param=code_block_38, element=all_elements_of_category_3)  # package Clockwork for Dynamo 2.x; Checks if an element contains a parameter of a given name
code_block_40 = CodeBlock { "Title Blocks"; }
byName_4 = Category.ByName(name=code_block_40)
code_block_41 = CodeBlock(category=byName_4)
# ---------- code_block_41.designscript (4 lines) ----------
//category
category;
//toggle
true;
# ----------------------------------------
all_family_types_of_category = Custom[All Family Types Of Category](category=code_block_41.category, toggle=code_block_41.out1)  # package Clockwork for Dynamo 2.x; Gets all family types/symbols of a given category in the model.
name = Element.Name(element=all_family_types_of_category)
code_block_42 = CodeBlock(x=name)
# ---------- code_block_42.designscript (4 lines) ----------
//x
x;
//y
"EST_A_SPLASH SCREEN";
# ----------------------------------------
eq_3 = code_block_42.x == code_block_42.out1
filterByBoolMask_3 = List.FilterByBoolMask(list=all_family_types_of_category, mask=eq_3)
name_2 = Element.Name(element=filterByBoolMask_3.out)
code_block_43 = CodeBlock(keys=name_2, values=filterByBoolMask_3.out)
# ---------- code_block_43.designscript (8 lines) ----------
//InputName
"Tipo de Formato";
//Keys
keys;
//Values
values;
//Defaultvalueindex
0;
# ----------------------------------------
dropdown_data = Custom[DropDown Data](InputName=code_block_43.out0, Keys=code_block_43.keys, Values=code_block_43.values, DefaultValueIndex=code_block_43.out3)  # package Data-Shapes; Create data for DropDown input in UI.MultiInputForm ++ . Check out www.data-shapes.net for more infos.
code_block_44 = CodeBlock()
# ---------- code_block_44.designscript (17 lines) ----------
[
"PG - PLANTA GENERAL",
"LO - LOSAS",
"MA - MUROS",
"VH - VIGAS",
"CH - COLUMNAS",
"EM - ESTRUCTURA METALICA",
"ES - ESCALERA",
"DE - DETALLE ESTANQUE",
"RP - RAMPAS",
"MC - MONTACARGAS",
"PC - PLANO DE CARGAS",
"SK - FICHA",
"DM - DEMOLICION",
"RF - REFUERZO",
"CF - CIELO FALSO"
];
# ----------------------------------------
code_block_45 = CodeBlock(str=code_block_44)
# ---------- code_block_45.designscript (4 lines) ----------
//str
str;
//separator
" - ";
# ----------------------------------------
split = String.Split(str=code_block_45.str, separator0=code_block_45.out1)
code_block_46 = CodeBlock(list=split)
# ---------- code_block_46.designscript (4 lines) ----------
//list
list;
//index
0;
# ----------------------------------------
getItemAtIndex = List.GetItemAtIndex(list=code_block_46.list@L2, index=code_block_46.out1)
code_block_47 = CodeBlock(keys=code_block_44, values=getItemAtIndex)
# ---------- code_block_47.designscript (10 lines) ----------
//InputName
"Categoria de\nlas Laminas :";
//Keys
keys;
//Values
values;
//DefaultValueindex
0;
//Sorted
false;
# ----------------------------------------
dropdown_data_2 = Custom[DropDown Data](InputName=code_block_47.out0, Keys=code_block_47.keys, Values=code_block_47.values, DefaultValueIndex=code_block_47.out3, Sorted_optional=code_block_47.out4)
code_block_48 = CodeBlock()
# ---------- code_block_48.designscript (4 lines) ----------
//InputName
"Cantidad\nde Laminas :";
//IsNumberEntry
true;
# ----------------------------------------
textbox_data = Custom[TextBox Data](InputName=code_block_48.out0, IsNumberEntry=code_block_48.out1)  # package Data-Shapes; Create Data for TextBox input in UI.MultipleInputForm ++ . Check out www.data-shapes.net for more informations
code_block_49 = CodeBlock()
# ---------- code_block_49.designscript (10 lines) ----------
[
"N. VICUÑA",
"C. MANRIQUEZ",
"M. ECHEVERRIA",
"F. TORELLI",
"A. MARTINEZ",
"M. SAEZ",
"J. TORELLI",
"F. IBARRA"
];
# ----------------------------------------
code_block_50 = CodeBlock(keys=code_block_49)
# ---------- code_block_50.designscript (8 lines) ----------
//InputName
"Calculó :";
//Keys
keys;
//Values
keys;
//Sorted
true;
# ----------------------------------------
dropdown_data_3 = Custom[DropDown Data](InputName=code_block_50.out0, Keys=code_block_50.out1, Values=code_block_50.out2, Sorted_optional=code_block_50.out3)
code_block_51 = CodeBlock()
# ---------- code_block_51.designscript (5 lines) ----------
[
["N. VICUÑA",
"C. MANRIQUEZ",
"P. ARANEDA"]
];
# ----------------------------------------
code_block_52 = CodeBlock(keys=code_block_51)
# ---------- code_block_52.designscript (8 lines) ----------
//InputName
"Revisó :";
//Keys
keys;
//Values
keys;
//Sorted
true;
# ----------------------------------------
dropdown_data_4 = Custom[DropDown Data](InputName=code_block_52.out0, Keys=code_block_52.out1, Values=code_block_52.out2, Sorted_optional=code_block_52.out3)
code_block_53 = CodeBlock()
# ---------- code_block_53.designscript (3 lines) ----------
"Dibujó :";
["J. NUÑEZ","P. CAROCA","A. SANCHEZ","A. CIFUENTES","S. JIMENEZ","H. CARRASCO","R. PEREZ","C. ORREGO","R. MUÑOZ","C. SALINAS","D. SALAZAR","M. FUENTES","L. BARRIOS","R. AGUILA"];
true;
# ----------------------------------------
dropdown_data_5 = Custom[DropDown Data](InputName=code_block_53.out0, Keys=code_block_53.out1, Values=code_block_53.out1, Sorted_optional=code_block_53.out2)
now = DateTime.Now()
components = DateTime.Components(dateTime=now)
string_from_object = FromObject(obj=components.year)
code_block_54 = CodeBlock(year=string_from_object)
# ---------- code_block_54.designscript (4 lines) ----------
"Fecha creación\nde las Laminas :";
["ENERO","FEBRERO","MARZO","ABRIL","MAYO","JUNIO","JULIO","AGOSTO","SEPTIEMBRE","OCTUBRE","NOVIEMBRE","DICIEMBRE"];
["ENE. "+year,"FEB ."+year,"MAR. "+year,"ABR. "+year,"MAY ."+year,"JUN. "+year,"JUL. "+year,"AGO. "+year,"SEP. "+year,"OCT. "+year,"NOV. "+year,"DIC. "+year];
false;
# ----------------------------------------
dropdown_data_6 = Custom[DropDown Data](InputName=code_block_54.out0, Keys=code_block_54.out1, Values=code_block_54.out2, Sorted_optional=code_block_54.out3)
list_create = List.Create(item0=dropdown_data, item1=dropdown_data_2, item2=textbox_data, item4=dropdown_data_3, item5=dropdown_data_4, item6=dropdown_data_5, item7=dropdown_data_6)  # unwired: item3
python_script = Python(IN[0]=parameterExists, IN[1]=list_create)
# ---------- python_script.python (9 lines) ----------
validacion = IN[0][0]
inputs = IN[1]

if validacion == True:
	res = inputs
else:
	res = []

OUT = res
# ----------------------------------------
code_block_55 = CodeBlock(inputs=python_script)
# ---------- code_block_55.designscript (29 lines) ----------
//Description_optional
"Descripcion";

//Logo


//ButtonText
"INICIAR";

//Inputs
inputs;

//Toggle
true;

//LinkToHelp


//CancelButtonText
"CANCELAR";

//MaxHeight
900;

//Width
500;

//LabelWidth
150;
# ----------------------------------------
multipleinputform_2 = Custom[MultipleInputForm ++](Description_optional=code_block_55.out0, ButtonText_optional=code_block_55.out1, Inputs=code_block_55.inputs, Toggle=code_block_55.out3, CancelButtonText_optional=code_block_55.out4, MaxHeight_optional=code_block_55.out5, Width_optional=code_block_55.out6, LabelWidth_optional=code_block_55.out7)
