# Dynamo graph script.dyn (Dynamo 2.6.2.15705)
# packages: Data-Shapes 2022.2.103, Clockwork for Dynamo 2.x 2.4.0, Genius Loci 2021.11.10

code_block = CodeBlock { "Structural Columns"; }
byName = Category.ByName(name=code_block)
current = Document.Current()
activeView = Document.ActiveView(document=current)
all_elements_of_category_in_view = ElementsOfCategoryInView(Category=byName, View=activeView)
code_block_2 = CodeBlock { "Numeracion Columna"; }
parameterExists = Custom[Element.ParameterExists](param=code_block_2, element=all_elements_of_category_in_view)  # package Clockwork for Dynamo 2.x; Checks if an element contains a parameter of a given name
filterByBoolMask = List.FilterByBoolMask(list=all_elements_of_category_in_view, mask=parameterExists)
code_block_3 = CodeBlock { "Numeracion Columna"; }
getParameterValueByName = Element.GetParameterValueByName(element=filterByBoolMask.in, parameterName=code_block_3)
code_block_4 = CodeBlock { "Validacion"; }
code_block_5 = CodeBlock { "Project Information"; }
byName_2 = Category.ByName(name=code_block_5)
all_elements_of_category = ElementsOfCategory(Category=byName_2)
parameterExists_2 = Custom[Element.ParameterExists](param=code_block_4, element=all_elements_of_category)
code_block_6 = CodeBlock { "Selecciona un Tipo de Barra"; }
code_block_7 = CodeBlock { "Structural Columns"; }
byName_3 = Category.ByName(name=code_block_7)
current_2 = Document.Current()
activeView_2 = Document.ActiveView(document=current_2)
all_elements_of_category_in_view_2 = ElementsOfCategoryInView(Category=byName_3, View=activeView_2)
code_block_8 = CodeBlock { "Numeracion Columna"; }
parameterExists_3 = Custom[Element.ParameterExists](param=code_block_8, element=all_elements_of_category_in_view_2)
filterByBoolMask_2 = List.FilterByBoolMask(list=all_elements_of_category_in_view_2, mask=parameterExists_3)
code_block_9 = CodeBlock { "Numeracion Columna"; }
getParameterValueByName_2 = Element.GetParameterValueByName(element=filterByBoolMask_2.in, parameterName=code_block_9)
groupByKey = List.GroupByKey(list=getParameterValueByName_2, keys=getParameterValueByName_2)
code_block_10 = CodeBlock { ""; }
eq = groupByKey.unique_keys == code_block_10
filterByBoolMask_3 = List.FilterByBoolMask(list=groupByKey.groups, mask=eq)
count = List.Count(list=filterByBoolMask_3.out@L2)
code_block_11 = CodeBlock(tipo=groupByKey.unique_keys, cant=count) { tipo; cant; "TIPO " + tipo + "   |   Cantidad: " + cant; }
list_sortnatural = Custom[List SortNatural](list=code_block_11.out2)  # package Genius Loci; Sorts a specified list in natural order in either ascending or descending order.
filterByBoolMask_4 = List.FilterByBoolMask(list=groupByKey.unique_keys, mask=eq)
list_sortnatural_2 = Custom[List SortNatural](list=filterByBoolMask_4.out)
radiobuttons_data = Custom[RadioButtons Data](Keys=list_sortnatural, Values=list_sortnatural_2)  # package Data-Shapes; Create radio buttons input for UI.MultipleInputForm ++ .
inputgroup_data = Custom[InputGroup Data](GroupTitle=code_block_6, Inputs=radiobuttons_data)  # package Data-Shapes; Creates a group of inputs for UI.MultipleInputForm ++ . Check out www.data-shapes.net for more infos !
python_script = Python(IN[0]=parameterExists_2, IN[1]=inputgroup_data)
# ---------- python_script.python (9 lines) ----------
validacion = IN[0][0]
inputs = IN[1]

if validacion == True:
	res = inputs
else:
	res = []

OUT = res
# ----------------------------------------
code_block_12 = CodeBlock(inputs=python_script)
# ---------- code_block_12.designscript (29 lines) ----------
//Description_optional
"Tipo de Barra";

//Logo


//ButtonText
"INICIAR";

//Inputs
inputs;

//Toggle
true;

//LinkToHelp


//CancelButtonText
"CANCELAR";

//MaxHeight
850;

//Width
430;

//LabelWidth
150;
# ----------------------------------------
multipleinputform = Custom[MultipleInputForm ++](Description_optional=code_block_12.out0, ButtonText_optional=code_block_12.out1, Inputs=code_block_12.inputs, Toggle=code_block_12.out3, CancelButtonText_optional=code_block_12.out4, MaxHeight_optional=code_block_12.out5, Width_optional=code_block_12.out6, LabelWidth_optional=code_block_12.out7)  # package Data-Shapes; Create a form with multiple inputs. see www.data-shapes.net for tutorials and infos!
empty = List.Empty()
scopeIf = Custom[ScopeIf+](test=multipleinputform.Was_Cancelled, True=empty, False=multipleinputform.User_Inputs)  # package Clockwork for Dynamo 2.x; A (hopefully) more robust implementation of ScopeIf. Tests a single boolean and returns a value accordingly.
eq_2 = getParameterValueByName == scopeIf  # lacing=Longest
filterByBoolMask_5 = List.FilterByBoolMask(list=filterByBoolMask.in, mask=eq_2)
python_script_2 = Python(IN[0]=filterByBoolMask_5.in)
# ---------- python_script_2.python (25 lines) ----------
import clr

clr.AddReference('RevitAPI')
from Autodesk.Revit.DB import *

clr.AddReference("RevitServices")
import RevitServices
from RevitServices.Persistence import DocumentManager

from System.Collections.Generic import *

uidoc = DocumentManager.Instance.CurrentUIApplication.ActiveUIDocument

def select(items):
    if isinstance(items, type(None)): # Select none
        items = []
    elif not hasattr(items, "__iter__"): # Check if single element
        items = [items]
        
    ids = List[ElementId](i.Id for i in items)
    uidoc.Selection.SetElementIds(ids)
    return "Success"
    
    
OUT = select(UnwrapElement(IN[0]))
# ----------------------------------------
