# Dynamo graph script.dyn (Dynamo 2.6.2.15705)
# packages: Data-Shapes 2022.2.96, Genius Loci 2021.11.10, Data-Shapes 2021.2.94, Clockwork for Dynamo 2.x 2.4.0

code_block = CodeBlock { "Text Notes"; }
byName = Category.ByName(name=code_block)
current = Document.Current()
activeView = Document.ActiveView(document=current)
all_elements_of_category_in_view = ElementsOfCategoryInView(Category=byName, View=activeView)
text = TextNote.Text(textNote=all_elements_of_category_in_view)
code_block_2 = CodeBlock { "Validacion"; }
code_block_3 = CodeBlock { "Project Information"; }
byName_2 = Category.ByName(name=code_block_3)
all_elements_of_category = ElementsOfCategory(Category=byName_2)
parameterExists = Custom[Element.ParameterExists](param=code_block_2, element=all_elements_of_category)  # package Clockwork for Dynamo 2.x; Checks if an element contains a parameter of a given name
code_block_4 = CodeBlock { "Selecciona un Texto"; }
code_block_5 = CodeBlock { "Text Notes"; }
byName_3 = Category.ByName(name=code_block_5)
current_2 = Document.Current()
activeView_2 = Document.ActiveView(document=current_2)
all_elements_of_category_in_view_2 = ElementsOfCategoryInView(Category=byName_3, View=activeView_2)
text_2 = TextNote.Text(textNote=all_elements_of_category_in_view_2)
uniqueItems = List.UniqueItems(list=text_2)
list_sortnatural = Custom[List SortNatural](list=uniqueItems)  # package Genius Loci; Sorts a specified list in natural order in either ascending or descending order.
radiobuttons_data = Custom[RadioButtons Data](Keys=list_sortnatural, Values=list_sortnatural)  # package Data-Shapes; Create radio buttons input for UI.MultipleInputForm ++ .
inputgroup_data = Custom[InputGroup Data](GroupTitle=code_block_4, Inputs=radiobuttons_data)  # package Data-Shapes; Creates a group of inputs for UI.MultipleInputForm ++ . Check out www.data-shapes.net for more infos !
python_script = Python(IN[0]=parameterExists, IN[1]=inputgroup_data)
# ---------- python_script.python (9 lines) ----------
validacion = IN[0][0]
inputs = IN[1]

if validacion == True:
	res = inputs
else:
	res = []

OUT = res
# ----------------------------------------
code_block_6 = CodeBlock(inputs=python_script)
# ---------- code_block_6.designscript (29 lines) ----------
//Description_optional
"Buscar Texto";

//Logo


//ButtonText
"INICIAR";

//Inputs
inputs;

//Toggle
true;

//LinkToHelp


//CancelButtonText
"CANCELAR";

//MaxHeight
850;

//Width
430;

//LabelWidth
150;
# ----------------------------------------
multipleinputform = Custom[MultipleInputForm ++](Description_optional=code_block_6.out0, ButtonText_optional=code_block_6.out1, Inputs=code_block_6.inputs, Toggle=code_block_6.out3, CancelButtonText_optional=code_block_6.out4, MaxHeight_optional=code_block_6.out5, Width_optional=code_block_6.out6, LabelWidth_optional=code_block_6.out7)  # package Data-Shapes; Create a form with multiple inputs. see www.data-shapes.net for tutorials and infos!
python_script_2 = Python(IN[0]=multipleinputform.User_Inputs)
# ---------- python_script_2.python (8 lines) ----------
input = IN[0]

if input == [] or input == None:
	res = []
else:
	res = input
	
OUT = res
# ----------------------------------------
eq = text == python_script_2  # lacing=Longest
filterByBoolMask = List.FilterByBoolMask(list=all_elements_of_category_in_view, mask=eq)
python_script_3 = Python(IN[0]=filterByBoolMask.in)
# ---------- python_script_3.python (25 lines) ----------
import clr

clr.AddReference('RevitAPI')
from Autodesk.Revit.DB import *

clr.AddReference("RevitServices")
import RevitServices
from RevitServices.Persistence import DocumentManager

from System.Collections.Generic import *

uidoc = DocumentManager.Instance.CurrentUIApplication.ActiveUIDocument

def select(items):
    if isinstance(items, type(None)): # Select none
        items = []
    elif not hasattr(items, "__iter__"): # Check if single element
        items = [items]
        
    ids = List[ElementId](i.Id for i in items)
    uidoc.Selection.SetElementIds(ids)
    return "Success"
    
    
OUT = select(UnwrapElement(IN[0]))
# ----------------------------------------
