# Dynamo graph script.dyn (Dynamo 2.6.2.15705)
# packages: Data-Shapes 2022.2.96, Clockwork for Dynamo 2.x 2.3.0, Genius Loci 2021.11.10, Data-Shapes 2021.2.94, Clockwork for Dynamo 2.x 2.4.0

code_block = CodeBlock { "Generic Annotations"; }
byName = Category.ByName(name=code_block)
current = Document.Current()
activeView = Document.ActiveView(document=current)
all_elements_of_category_in_view = ElementsOfCategoryInView(Category=byName, View=activeView)
code_block_2 = CodeBlock { "Linea de Fierro"; }
parameterExists = Custom[Element.ParameterExists](param=code_block_2, element=all_elements_of_category_in_view)  # package Clockwork for Dynamo 2.x; Checks if an element contains a parameter of a given name
filterByBoolMask = List.FilterByBoolMask(list=all_elements_of_category_in_view, mask=parameterExists)
code_block_3 = CodeBlock { "Linea de Fierro"; }
getParameterValueByName = Element.GetParameterValueByName(element=filterByBoolMask.in, parameterName=code_block_3)
code_block_4 = CodeBlock { "Busca y Selecciona Tipo de Barra"; }
code_block_5 = CodeBlock { "INICIAR"; "CANCELAR"; 850; 430; }
code_block_6 = CodeBlock { "Selecciona un Tipo de Barra"; }
code_block_7 = CodeBlock { "TIPO "; }
code_block_8 = CodeBlock { "Generic Annotations"; }
byName_2 = Category.ByName(name=code_block_8)
current_2 = Document.Current()
activeView_2 = Document.ActiveView(document=current_2)
all_elements_of_category_in_view_2 = ElementsOfCategoryInView(Category=byName_2, View=activeView_2)
code_block_9 = CodeBlock { "Linea de Fierro"; }
parameterExists_2 = Custom[Element.ParameterExists](param=code_block_9, element=all_elements_of_category_in_view_2)
filterByBoolMask_2 = List.FilterByBoolMask(list=all_elements_of_category_in_view_2, mask=parameterExists_2)
code_block_10 = CodeBlock { "Linea de Fierro"; }
getParameterValueByName_2 = Element.GetParameterValueByName(element=filterByBoolMask_2.in, parameterName=code_block_10)
uniqueItems = List.UniqueItems(list=getParameterValueByName_2)
list_sortnatural = Custom[List SortNatural](list=uniqueItems)  # package Genius Loci; Sorts a specified list in natural order in either ascending or descending order.
add = code_block_7 + list_sortnatural
radiobuttons_data = Custom[RadioButtons Data](Keys=add, Values=list_sortnatural)  # package Data-Shapes; Create radio buttons input for UI.MultipleInputForm ++ .
inputgroup_data = Custom[InputGroup Data](GroupTitle=code_block_6, Inputs=radiobuttons_data)  # package Data-Shapes; Creates a group of inputs for UI.MultipleInputForm ++ . Check out www.data-shapes.net for more infos !
boolean = BoolSelector(true)
multipleinputform = Custom[MultipleInputForm ++](Description_optional=code_block_4, ButtonText_optional=code_block_5.out0, Inputs=inputgroup_data, Toggle=boolean, CancelButtonText_optional=code_block_5.out1, MaxHeight_optional=code_block_5.out2, Width_optional=code_block_5.out3)  # package Data-Shapes; Create a form with multiple inputs. see www.data-shapes.net for tutorials and infos!
empty = List.Empty()
scopeIf = Custom[ScopeIf+](test=multipleinputform.Was_Cancelled, True=empty, False=multipleinputform.User_Inputs)  # package Clockwork for Dynamo 2.x; A (hopefully) more robust implementation of ScopeIf. Tests a single boolean and returns a value accordingly.
eq = getParameterValueByName == scopeIf  # lacing=Longest
filterByBoolMask_3 = List.FilterByBoolMask(list=filterByBoolMask.in, mask=eq)
python_script = Python(IN[0]=filterByBoolMask_3.in)
# ---------- python_script.python (25 lines) ----------
import clr

clr.AddReference('RevitAPI')
from Autodesk.Revit.DB import *

clr.AddReference("RevitServices")
import RevitServices
from RevitServices.Persistence import DocumentManager

from System.Collections.Generic import *

uidoc = DocumentManager.Instance.CurrentUIApplication.ActiveUIDocument

def select(items):
    if isinstance(items, type(None)): # Select none
        items = []
    elif not hasattr(items, "__iter__"): # Check if single element
        items = [items]
        
    ids = List[ElementId](i.Id for i in items)
    uidoc.Selection.SetElementIds(ids)
    return "Success"
    
    
OUT = select(UnwrapElement(IN[0]))
# ----------------------------------------
