# Dynamo graph checkTituloPlanos_script.dyn (Dynamo 2.3.1.11775)
# packages: Clockwork for Dynamo 2.x 2.4.0, Crumple 2022.2.13

code_block = CodeBlock { "Info."; }
code_block_2 = CodeBlock { "\n"; }
code_block_3 = CodeBlock { "Sheets"; }
byName = Category.ByName(name=code_block_3)
all_elements_of_category = ElementsOfCategory(Category=byName)
sheetName = Sheet.SheetName(sheet=all_elements_of_category)
length = String.Length(str=sheetName)
code_block_4 = CodeBlock { 70; }
gt = length > code_block_4
filterByBoolMask = List.FilterByBoolMask(list=all_elements_of_category, mask=gt)
sheetNumber = Sheet.SheetNumber(sheet=filterByBoolMask.in)
sheetName_2 = Sheet.SheetName(sheet=filterByBoolMask.in)
code_block_5 = CodeBlock(a=sheetNumber, b=sheetName_2) { lam = a+" - "+b; }
code_block_6 = CodeBlock { null; }
replaceEmptyLists = Custom[List.ReplaceEmptyLists](seq=code_block_5, Replacement=code_block_6)  # package Clockwork for Dynamo 2.x; Replaces all empty lists within a given list with a substitute
join = String.Join(separator=code_block_2, string0=replaceEmptyLists)
code_block_7 = CodeBlock(l=join)
# ---------- code_block_7.designscript (12 lines) ----------
l;
[Imperative]
{
	if (l == "")
	{
		return = [];
	}
	else
	{
		return = l;
	}
};
# ----------------------------------------
uimessenger = Custom[© UIMessenger](title=code_block, body=code_block_7.out1)  # package Crumple; Displays a message box with a title/body and OK/cancel button. If OK is selected, the third input's data will be passed through.
code_block_8 = CodeBlock { "Info."; }
code_block_9 = CodeBlock(l=join)
# ---------- code_block_9.designscript (12 lines) ----------
l;
[Imperative]
{
	if (l == "")
	{
		return = "No hay Planos con mas de 70 caracteres";
	}
	else
	{
		return = [];
	}
};
# ----------------------------------------
uimessenger_2 = Custom[© UIMessenger](title=code_block_8, body=code_block_9.out1)
