# Dynamo graph structuralUsageEEMM_script.dyn (Dynamo 2.3.1.11775)
# packages: Orchid 200.4.0.7938

code_block = CodeBlock { "Structural Framing"; }
byName = Category.ByName(name=code_block)
activeView = Orchid.RevitProject.Common.Document.ActiveView()
all_elements_of_category_in_view = ElementsOfCategoryInView(Category=byName, View=activeView)
code_block_2 = CodeBlock(t2=all_elements_of_category_in_view)
# ---------- code_block_2.designscript (6 lines) ----------
t1 = Revit.Elements.Element.GetParameterValueByName(t2, "Type");
t3 = Revit.Elements.Element.GetParameterValueByName(t1, "Structural Material");
t4 = t3 == "";
t5 = DSCore.List.FilterByBoolMask(t2, t4);
t6 = Dictionary.ValueAtKey(t5, "in");
t7 = Dictionary.ValueAtKey(t5, "out");
# ----------------------------------------
getMaterials = Element.GetMaterials(element=code_block_2.t7)
name = Material.Name(material=getMaterials@L1)
code_block_3 = CodeBlock { "Steel"; }
eq = name == code_block_3
filterByBoolMask = List.FilterByBoolMask(list=code_block_2.t7, mask=eq)
code_block_4 = CodeBlock { "Structural Usage"; }
getParameterValueByName = Element.GetParameterValueByName(element=filterByBoolMask.in, parameterName=code_block_4)
groupByKey = List.GroupByKey(list=filterByBoolMask.in@L2, keys=getParameterValueByName@L2)
color_palette = ColorPalette({R: 255, G: 0, B: 255, A: 255})
color_palette_2 = ColorPalette({R: 127, G: 255, B: 0, A: 255})
color_palette_3 = ColorPalette({R: 0, G: 0, B: 255, A: 255})
color_palette_4 = ColorPalette({R: 255, G: 255, B: 0, A: 255})
color_palette_5 = ColorPalette({R: 0, G: 255, B: 255, A: 255})
list_create = List.Create(item0=color_palette, item1=color_palette_2, item2=color_palette_3, item3=color_palette_4, item4=color_palette_5)
overrideColorInView = Element.OverrideColorInView(element=groupByKey.groups@L2, color=list_create@L1, lacing=Longest)
