# Dynamo graph script.dyn "previousPhase" (Dynamo 2.3.2.15696)
# packages: Orchid 200.4.0.7938, Genius Loci 2021.11.10

activeView = Orchid.RevitProject.Common.Document.ActiveView()
code_block = CodeBlock { "Phase Filter"; }
code_block_2 = CodeBlock { "Show Previous Phase"; }
phase_filter_byname = Custom[Phase Filter ByName](Name=code_block_2)  # package Genius Loci; Enter the name of the phase filter to get the phase filter element.
setParameterByName = Element.SetParameterByName(element=activeView, parameterName=code_block, value=phase_filter_byname)
