# Dynamo graph resetOverrrides_script.dyn (Dynamo 2.3.1.11775)
# packages: Genius Loci 2021.11.10, Orchid 200.4.0.7938

activeView = Orchid.RevitProject.Common.Document.ActiveView()
all_elements_in_active_view = ElementsInView()
view_resetelementoverrides = Custom[View ResetElementOverrides](view=activeView, element=all_elements_in_active_view)  # package Genius Loci; Removes all Graphics overrides for an element in a given view.
