# Dynamo graph script.dyn (Dynamo 2.3.2.15696)
# packages: Rhythm 2020.7.25, Crumple 2022.2.13, Data-Shapes 2021.2.94

code_block = CodeBlock { "Area de la Cara"; }
code_block_2 = CodeBlock { "Área Cara"; }
code_block_3 = CodeBlock { "INICIAR"; "CANCELAR"; 430; }
code_block_4 = CodeBlock { "SELECCIONAR UNA CARA"; }
selectfaces_data = Custom[SelectFaces Data](ButtonText=code_block_4)  # package Data-Shapes; Creates a Revit face selection input for UI.MultipleInputForm++. Check out www.data-shapes.net for more infos!
boolean = BoolSelector(true)
multipleinputform = Custom[MultipleInputForm ++](Description_optional=code_block_2, ButtonText_optional=code_block_3.out0, Inputs=selectfaces_data, Toggle=boolean, CancelButtonText_optional=code_block_3.out1, Width_optional=code_block_3.out2)  # package Data-Shapes; Create a form with multiple inputs. see www.data-shapes.net for tutorials and infos!
code_block_5 = CodeBlock(x=multipleinputform.User_Inputs)
# ---------- code_block_5.designscript (12 lines) ----------
x;
[Imperative]
{
	if(x == null)
	{
		return = [];
	}
	else
	{
		return = x;
	}
};
# ----------------------------------------
flatten = List.Flatten(list=code_block_5.out1)
area = Surface.Area(surface=flatten)
ceiling = Math.Ceiling(number=area)
convert_between_units = DynamoConvert(ceiling, MeasurementType="Area", FromConversion="SquareMillimeter", ToConversion="SquareMeter")
code_block_6 = CodeBlock { 3; }
roundtostring = Custom[© RoundToString](numbers=convert_between_units, digits=code_block_6)  # package Crumple; Given a list of numbers with decimal places, round them to a specific length and convert that to a string. More reliable than String.ToObject.
code_block_7 = CodeBlock(a=roundtostring) { a+" m²"; }
ʳʰʸᵗʰᵐ_helpers_simpleusermessage = Rhythm.Revit.Helpers.Helpers.SimpleUserMessage(caption=code_block, message=code_block_7)
