# Dynamo graph aislarPorMaterial_script.dyn (Dynamo 2.6.2.15705)
# packages: Data-Shapes 2022.2.103, Clockwork for Dynamo 2.x 2.4.0

current = Document.Current()
activeView = Document.ActiveView(document=current)
code_block = CodeBlock()
# ---------- code_block.designscript (7 lines) ----------
[
"Floors",
"Structural Columns",
"Structural Foundations",
"Structural Framing",
"Walls"
];
# ----------------------------------------
byName = Category.ByName(name=code_block)
current_2 = Document.Current()
activeView_2 = Document.ActiveView(document=current_2)
all_elements_of_category_in_view = ElementsOfCategoryInView(Category=byName, View=activeView_2)
flatten = List.Flatten(list=all_elements_of_category_in_view)
name = Material.Name()  # unwired: material
getMaterials = Element.GetMaterials(element=flatten)
python_script = Python(IN[0]=getMaterials)
# ---------- python_script.python (7 lines) ----------
input = IN[0]

if input == [] or input == None:
	res = None
else:
	res = input
OUT = res
# ----------------------------------------
isEmpty = List.IsEmpty(list=python_script@L2)
code_block_2 = CodeBlock { true; }
ne = isEmpty != code_block_2
filterByBoolMask = List.FilterByBoolMask(list=python_script, mask=ne)
code_block_3 = CodeBlock { 0; }
getItemAtIndex = List.GetItemAtIndex(list=filterByBoolMask.in@L2, index=code_block_3)
python_script_2 = Python(IN[0]=getItemAtIndex)
# ---------- python_script_2.python (7 lines) ----------
input = IN[0]

if input[0] == [] or input[0] == None:
	res = []
else:
	res = input
OUT = res
# ----------------------------------------
function_apply = ApplyFunction(func=name, arg1=python_script_2)
code_block_4 = CodeBlock { "Validacion"; }
code_block_5 = CodeBlock { "Project Information"; }
byName_2 = Category.ByName(name=code_block_5)
all_elements_of_category = ElementsOfCategory(Category=byName_2)
parameterExists = Custom[Element.ParameterExists](param=code_block_4, element=all_elements_of_category)  # package Clockwork for Dynamo 2.x; Checks if an element contains a parameter of a given name
name_2 = Material.Name()  # unwired: material
uniqueItems = List.UniqueItems(list=python_script_2)
function_apply_2 = ApplyFunction(func=name_2, arg1=uniqueItems)
code_block_6 = CodeBlock(keys=function_apply_2, values=function_apply_2)
# ---------- code_block_6.designscript (8 lines) ----------
//InputName
"Descripcion";
//Keys_
keys;
//Values_
values;
//DefaultValueIndex
0;
# ----------------------------------------
radiobuttons_data = Custom[RadioButtons Data](InputName=code_block_6.out0, Keys=code_block_6.keys, Values=code_block_6.values, DefaultValueIndex=code_block_6.out3)  # package Data-Shapes; Create radio buttons input for UI.MultipleInputForm ++ .
python_script_3 = Python(IN[0]=parameterExists, IN[1]=radiobuttons_data)
# ---------- python_script_3.python (9 lines) ----------
validacion = IN[0][0]
inputs = IN[1]

if validacion == True:
	res = inputs
else:
	res = []

OUT = res
# ----------------------------------------
code_block_7 = CodeBlock(inputs=python_script_3)
# ---------- code_block_7.designscript (29 lines) ----------
//Description_optional
"Aislar Elementos por Materialidad";

//Logo


//ButtonText
"INICIAR";

//Inputs
inputs;

//Toggle
true;

//LinkToHelp


//CancelButtonText
"CANCELAR";

//MaxHeight
900;

//Width
430;

//LabelWidth
150;
# ----------------------------------------
multipleinputform = Custom[MultipleInputForm ++](Description_optional=code_block_7.out0, ButtonText_optional=code_block_7.out1, Inputs=code_block_7.inputs, Toggle=code_block_7.out3, CancelButtonText_optional=code_block_7.out4, MaxHeight_optional=code_block_7.out5, Width_optional=code_block_7.out6, LabelWidth_optional=code_block_7.out7)  # package Data-Shapes; Create a form with multiple inputs. see www.data-shapes.net for tutorials and infos!
python_script_4 = Python(IN[0]=multipleinputform.User_Inputs)
# ---------- python_script_4.python (7 lines) ----------
input = IN[0]

if input == [] or input == None:
	res = []
else:
	res = input
OUT = res
# ----------------------------------------
eq = function_apply == python_script_4  # lacing=Longest
filterByBoolMask_2 = List.FilterByBoolMask(list=flatten, mask=eq)
flatten_2 = List.Flatten(list=filterByBoolMask_2.in)
temporarilyIsolateElement = Custom[View.TemporarilyIsolateElement](view=activeView, element=flatten_2)  # package Clockwork for Dynamo 2.x; Temporarily isolates elements in the given view
