# Dynamo graph aislarPorWorkset_script.dyn "aislarPorParametro_script" (Dynamo 2.6.2.15705)
# packages: Data-Shapes 2022.2.103, Clockwork for Dynamo 2.x 2.4.0, archi-lab.net 2022.210.2419, Genius Loci 2021.11.10

current = Document.Current()
activeView = Document.ActiveView(document=current)
code_block = CodeBlock()
# ---------- code_block.designscript (7 lines) ----------
[
"Floors",
"Structural Columns",
"Structural Foundations",
"Structural Framing",
"Walls"
];
# ----------------------------------------
byName = Category.ByName(name=code_block)
current_2 = Document.Current()
activeView_2 = Document.ActiveView(document=current_2)
all_elements_of_category_in_view = ElementsOfCategoryInView(Category=byName, View=activeView_2)
flatten = List.Flatten(list=all_elements_of_category_in_view)
code_block_2 = CodeBlock { "Workset"; }
getParameterValueByName = Element.GetParameterValueByName(element=flatten, parameterName=code_block_2)
code_block_3 = CodeBlock { "Validacion"; }
code_block_4 = CodeBlock { "Project Information"; }
byName_2 = Category.ByName(name=code_block_4)
all_elements_of_category = ElementsOfCategory(Category=byName_2)
parameterExists = Custom[Element.ParameterExists](param=code_block_3, element=all_elements_of_category)  # package Clockwork for Dynamo 2.x; Checks if an element contains a parameter of a given name
getAll = archilab.Revit.Elements.Workset.GetAll()
name = archilab.Revit.Elements.Workset.Name(workset=getAll)
workset_byname = Custom[Workset ByName](Workset_Name=name)  # package Genius Loci; Retrieves the workset by the given name.
code_block_5 = CodeBlock(keys=name, values=workset_byname.Id)
# ---------- code_block_5.designscript (8 lines) ----------
//InputName
"Worksets";
//Keys_
keys;
//Values_
values;
//ShowId
false;
# ----------------------------------------
listview_data = Custom[Listview Data](InputName=code_block_5.out0, Keys=code_block_5.keys, Values=code_block_5.values, ShowId_optionnal=code_block_5.out3)  # package Data-Shapes; Create data for ListView input in UI.MultiInputForm ++ . Check out www.data-shapes.net for more infos.
python_script = Python(IN[0]=parameterExists, IN[1]=listview_data)
# ---------- python_script.python (9 lines) ----------
validacion = IN[0][0]
inputs = IN[1]

if validacion == True:
	res = inputs
else:
	res = []

OUT = res
# ----------------------------------------
code_block_6 = CodeBlock(inputs=python_script)
# ---------- code_block_6.designscript (29 lines) ----------
//Description_optional
"Aislar Elementos por Workset";

//Logo


//ButtonText
"INICIAR";

//Inputs
inputs;

//Toggle
true;

//LinkToHelp


//CancelButtonText
"CANCELAR";

//MaxHeight
900;

//Width
430;

//LabelWidth
150;
# ----------------------------------------
multipleinputform = Custom[MultipleInputForm ++](Description_optional=code_block_6.out0, ButtonText_optional=code_block_6.out1, Inputs=code_block_6.inputs, Toggle=code_block_6.out3, CancelButtonText_optional=code_block_6.out4, MaxHeight_optional=code_block_6.out5, Width_optional=code_block_6.out6, LabelWidth_optional=code_block_6.out7)  # package Data-Shapes; Create a form with multiple inputs. see www.data-shapes.net for tutorials and infos!
python_script_2 = Python(IN[0]=multipleinputform.User_Inputs)
# ---------- python_script_2.python (7 lines) ----------
input = IN[0]

if input == [] or input == None:
	res = []
else:
	res = input[0]
OUT = res
# ----------------------------------------
eq = getParameterValueByName@L1 == python_script_2@L2  # lacing=Longest
anyTrue = Custom[Booleans.AnyTrue](seq=eq)  # package Clockwork for Dynamo 2.x; Returns true if any item in a list of booleans is true.
filterByBoolMask = List.FilterByBoolMask(list=flatten, mask=anyTrue)
temporarilyIsolateElement = Custom[View.TemporarilyIsolateElement](view=activeView, element=filterByBoolMask.in)  # package Clockwork for Dynamo 2.x; Temporarily isolates elements in the given view
