# Dynamo graph resetOverrrides_script.dyn (Dynamo 2.6.2.15705)
# packages: Genius Loci 2021.11.10

current = Document.Current()
activeView = Document.ActiveView(document=current)
all_elements_in_active_view = ElementsInView()
view_resetelementoverrides = Custom[View ResetElementOverrides](view=activeView, element=all_elements_in_active_view)  # package Genius Loci; Removes all Graphics overrides for an element in a given view.
