# Dynamo graph script.dyn (Dynamo 2.3.2.15696)
# packages: Clockwork for Dynamo 2.x 2.3.0, Data-Shapes 2021.2.93, Genius Loci 2021.4.13, Rhythm 2021.4.2, Data-Shapes 2021.2.94

current = Document.Current()
activeView = Document.ActiveView(document=current)
code_block = CodeBlock { "Diametro de Barras"; }
code_block_2 = CodeBlock { "EST_D_BARRA VERTICAL_DERECHA_RECTA EMPOTRADA"; }
byName = Family.ByName(name=code_block_2)
code_block_3 = CodeBlock()
# ---------- code_block_3.designscript (13 lines) ----------
[
"ø6",
"ø8",
"ø10",
"ø12",
"ø16",
"ø18",
"ø22",
"ø25",
"ø28",
"ø32",
"ø36"
];
# ----------------------------------------
byFamilyAndName = FamilyType.ByFamilyAndName(family=byName, name=code_block_3)
name = Element.Name()  # unwired: element
sortByFunction = List.SortByFunction(list=byFamilyAndName, func=name)
code_block_4 = CodeBlock { 2; }
shiftIndices = List.ShiftIndices(list=sortByFunction, amount=code_block_4)
name_2 = Element.Name(element=shiftIndices)
code_block_5 = CodeBlock { 4; }
code_block_6 = CodeBlock { false; }
# note: Custom Node: Data-Shapes v.2021.2.94
dropdown_data = Custom[DropDown Data](InputName=code_block, Keys=name_2, Values=shiftIndices, DefaultValueIndex=code_block_5, Sorted_optional=code_block_6)  # package Data-Shapes; Create data for DropDown input in UI.MultiInputForm ++ . Check out www.data-shapes.net for more infos.
code_block_7 = CodeBlock { "Cantidad de Barras"; }
code_block_8 = CodeBlock { 1..10..1; 1; }
code_block_9 = CodeBlock { false; }
dropdown_data_2 = Custom[DropDown Data](InputName=code_block_7, Keys=code_block_8.out0, Values=code_block_8.out0, DefaultValueIndex=code_block_8.out1, Sorted_optional=code_block_9)
code_block_10 = CodeBlock { "Posicion Barra\na Empotrar"; }
code_block_11 = CodeBlock { "SELECCIONAR"; }
selectpointsonface_data = Custom[SelectPointsOnFace data](InputName=code_block_10, ButtonText=code_block_11)  # package Data-Shapes; Creates a UI.MultipleInputForm++ input that allows point on face selection
list_create = List.Create(item0=dropdown_data, item1=dropdown_data_2, item2=selectpointsonface_data)
code_block_12 = CodeBlock(inputs=list_create)
# ---------- code_block_12.designscript (29 lines) ----------
//Description_optional
"Barra Vertical Recta Empotrada";

//Logo


//ButtonText
"INICIAR";

//Inputs
inputs;

//Toggle
true;

//LinkToHelp


//CancelButtonText
"CANCELAR";

//MaxHeight


//Width
490;

//LabelWidth
150;
# ----------------------------------------
multipleinputform = Custom[MultipleInputForm ++](Description_optional=code_block_12.out0, ButtonText_optional=code_block_12.out1, Inputs=code_block_12.inputs, Toggle=code_block_12.out3, CancelButtonText_optional=code_block_12.out4, Width_optional=code_block_12.out5, LabelWidth_optional=code_block_12.out6)  # package Data-Shapes; Create a form with multiple inputs. see www.data-shapes.net for tutorials and infos!
python_script = Python(IN[0]=multipleinputform.User_Inputs)
# ---------- python_script.python (7 lines) ----------
input = IN[0]

if input == [] or input == None:
	res = [[], [], [[]], []]
else:
	res = input
OUT = res
# ----------------------------------------
code_block_13 = CodeBlock(l=python_script) { l[2][0]; }
code_block_14 = CodeBlock(l=python_script) { l[0]; }
# note: Custom Node: Clockwork v.2.4.0
byPointInView = Custom[FamilyInstance.ByPointInView](point=code_block_13, familyType=code_block_14, view=activeView)  # package Clockwork for Dynamo 2.x; Places a family instance at a given point in a given view (e.g. a detail component).
code_block_15 = CodeBlock { "Cantidad de Barras"; }
code_block_16 = CodeBlock(l=python_script) { l[1]; }
setParameterByName = Element.SetParameterByName(element=byPointInView, parameterName=code_block_15, value=code_block_16)
code_block_17 = CodeBlock { "Visibilidad Empalme"; 0; }
setParameterByName_2 = Element.SetParameterByName(element=setParameterByName, parameterName=code_block_17.out0, value=code_block_17.out1)
end = Revit.Transaction.Transaction.End(input=setParameterByName_2)
converted_from_dropdown_with = CodeBlock { DSCore.Types.FindTypeByNameInAssembly("DimensionType", "RevitAPI"); }  # "Converted from Dropdown with Monocle™"
all_elements_of_type = ElementsOfType(element_type=converted_from_dropdown_with)
name_3 = Element.Name(element=all_elements_of_type)
code_block_18 = CodeBlock { "EST_EMPALME"; }
eq = name_3 == code_block_18
filterByBoolMask = List.FilterByBoolMask(list=all_elements_of_type, mask=eq)

# group: EMPALMES
# note: Custom Node: GeniusLoci v.2021.11.10
familyinstance_2d_geometry = Custom[FamilyInstance 2D Geometry](element=end)  # package Genius Loci; Gets the curves of the family instance. Works only with the family categories : Generic Annotation and Detail Item.
code_block_19 = CodeBlock { 2; }
getItemAtIndex = List.GetItemAtIndex(list=familyinstance_2d_geometry@L2, index=code_block_19)
familyinstance_references = Custom[FamilyInstance References](familyInstance=end)  # package Genius Loci; Returns all references and references names.
# note: Custom Node: Orchid v. 200.4.0.7938
code_block_20 = CodeBlock { "Empalme"; }

contains = String.Contains(str=familyinstance_references.ReferenceName, searchFor=code_block_20)

# group (continued): EMPALMES
filterByBoolMask_2 = List.FilterByBoolMask(list=familyinstance_references.Reference, mask=contains)
dimension_byreferences = Custom[Dimension ByReferences](view=activeView, line=getItemAtIndex, references=filterByBoolMask_2.in, dimensionType=filterByBoolMask.in, lacing=Longest)  # package Genius Loci; Creates a new linear dimension from at least two geometric references of an object.

# note: Custom Node: Rhythm v.2020.7.25
ʳʰʸᵗʰᵐ_dimensions_getcurve = Rhythm.Revit.Elements.Dimensions.GetCurve(dimension=dimension_byreferences)
code_block_21 = CodeBlock { 0.5; }
pointAtParameter = Curve.PointAtParameter(curve=ʳʰʸᵗʰᵐ_dimensions_getcurve, param=code_block_21)
code_block_22 = CodeBlock { 250; }
translate = Geometry.Translate(geometry=pointAtParameter, xTranslation=code_block_22, yTranslation=code_block_22)
# note: Custom Node: GeniusLoci v.2021.11.10
element_setlocation = Custom[Element SetLocation](element=dimension_byreferences, location=translate)  # package Genius Loci; Modify the location of the given element. (Same as the Move command in Revit.) Works for point/ line/ sketch based elements, view-specific elements, groups and link instances.
familyinstance_2d_geometry_2 = Custom[FamilyInstance 2D Geometry](element=end)
code_block_23 = CodeBlock { 1; }
getItemAtIndex_2 = List.GetItemAtIndex(list=familyinstance_2d_geometry_2@L2, index=code_block_23)
code_block_24 = CodeBlock { 0.5; }
pointAtParameter_2 = Curve.PointAtParameter(curve=getItemAtIndex_2, param=code_block_24)
code_block_25 = CodeBlock { "Barra Vertical Recta"; }
byName_2 = FamilyType.ByName(name=code_block_25)
code_block_26 = CodeBlock { true; }
boolean = BoolSelector(true)
create_tag = Custom[Create Tag](view=activeView, element=end, TagLocation=pointAtParameter_2, TagType=byName_2, addLeader=code_block_26, RunIt=boolean)  # package Genius Loci; Works only in Revit 2018 and later. Creates a tag at a given location, of given type and in a supplied view. The node also works with Linked Elements (except space and area), Multi Category tag and Material Tag. Based on an archilab node
tag_getlocation = Custom[Tag GetLocation](tag=create_tag)  # package Genius Loci; Retrieves the position of the head of tag.
code_block_27 = CodeBlock { 75; }
translate_2 = Geometry.Translate(geometry=tag_getlocation, xTranslation=code_block_27, yTranslation=code_block_27)
tag_setlocation = Custom[Tag SetLocation](tag=create_tag, location=translate_2)  # package Genius Loci; Moves the head of the tag to the given location point.
end_2 = Revit.Transaction.Transaction.End(input=tag_setlocation)
code_block_28 = CodeBlock { "Leader Type"; 1; }
setParameterByName_3 = Element.SetParameterByName(element=end_2, parameterName=code_block_28.out0, value=code_block_28.out1)
