# Dynamo graph script.dyn (Dynamo 2.3.2.15696)
# packages: Clockwork for Dynamo 2.x 2.3.0, Data-Shapes 2021.2.93, Genius Loci 2021.4.13, WombatDynamo 2.3.4, Orchid 204.1.4.7501, Rhythm 2021.4.2, Data-Shapes 2021.2.94

current = Document.Current()
activeView = Document.ActiveView(document=current)
code_block = CodeBlock { "Barra Horizontal Empalmada Pata Derecha en Fundacion"; }
file_path = Filename("..\00_IMAGENES\editable Arainco-cmyk-01.png")
code_block_2 = CodeBlock { 150; "INICIAR"; "CANCELAR"; }
code_block_3 = CodeBlock { "Diametro de Barras"; }
code_block_4 = CodeBlock { "EST_D_MURO_BARRA HORIZONTAL_INFERIOR_PATA DERECHA"; }
byName = Family.ByName(name=code_block_4)
code_block_5 = CodeBlock()
# ---------- code_block_5.designscript (13 lines) ----------
[
"ø6",
"ø8",
"ø10",
"ø12",
"ø16",
"ø18",
"ø22",
"ø25",
"ø28",
"ø32",
"ø36"
];
# ----------------------------------------
byFamilyAndName = FamilyType.ByFamilyAndName(family=byName, name=code_block_5)
name = Element.Name()  # unwired: element
sortByFunction = List.SortByFunction(list=byFamilyAndName, func=name)
code_block_6 = CodeBlock { 2; }
shiftIndices = List.ShiftIndices(list=sortByFunction, amount=code_block_6)
name_2 = Element.Name(element=shiftIndices)
code_block_7 = CodeBlock { 4; }
code_block_8 = CodeBlock { false; }
dropdown_data = Custom[DropDown Data](InputName=code_block_3, Keys=name_2, Values=shiftIndices, DefaultValueIndex=code_block_7, Sorted_optional=code_block_8)  # package Data-Shapes; Create data for DropDown input in UI.MultiInputForm ++ . Check out www.data-shapes.net for more infos.
code_block_9 = CodeBlock { "Cantidad de Barras"; }
code_block_10 = CodeBlock { 1..10..1; 1; }
code_block_11 = CodeBlock { false; }
dropdown_data_2 = Custom[DropDown Data](InputName=code_block_9, Keys=code_block_10.out0, Values=code_block_10.out0, DefaultValueIndex=code_block_10.out1, Sorted_optional=code_block_11)
code_block_12 = CodeBlock { "Barra A Empalmar"; }
code_block_13 = CodeBlock { "SELECCIONAR"; }
code_block_14 = CodeBlock { "Detail Items"; }
byName_2 = Category.ByName(name=code_block_14)
code_block_15 = CodeBlock { true; }
selectmodelelements_data = Custom[SelectModelElements Data](InputName=code_block_12, ButtonText=code_block_13, CategoryFilter=byName_2, SelectSingleElement=code_block_15)  # package Data-Shapes; Creates a Revit element selection input for UI.MultipleInputForm++ . Check out www.data-shapes.net for more infos!
list_create = List.Create(item0=dropdown_data, item1=dropdown_data_2, item2=selectmodelelements_data)
boolean = BoolSelector(true)
multipleinputform = Custom[MultipleInputForm ++](Description_optional=code_block, Logo_optional=file_path, ButtonText_optional=code_block_2.out1, Inputs=list_create, Toggle=boolean, CancelButtonText_optional=code_block_2.out2, LabelWidth_optional=code_block_2.out0)  # package Data-Shapes; Create a form with multiple inputs. see www.data-shapes.net for tutorials and infos!
nullItem = WombatDynamo.List.NullItem()
if_ = If(test=multipleinputform.Was_Cancelled, true=nullItem, false=multipleinputform.User_Inputs)
code_block_16 = CodeBlock(l=if_) { l[2]; }
familyinstance_2d_geometry = Custom[FamilyInstance 2D Geometry](element=code_block_16)  # package Genius Loci; Gets the curves of the family instance. Works only with the family categories : Generic Annotation and Detail Item.
code_block_17 = CodeBlock { 0; }
getItemAtIndex = List.GetItemAtIndex(list=familyinstance_2d_geometry@L2, index=code_block_17)
startPoint = Curve.StartPoint(curve=getItemAtIndex)
code_block_18 = CodeBlock(l=if_) { l[0]; }
byPointInView = Custom[FamilyInstance.ByPointInView](point=startPoint, familyType=code_block_18, view=activeView)  # package Clockwork for Dynamo 2.x; Places a family instance at a given point in a given view (e.g. a detail component).
code_block_19 = CodeBlock { "Cantidad de Barras"; }
code_block_20 = CodeBlock(l=if_) { l[1]; }
setParameterByName = Element.SetParameterByName(element=byPointInView, parameterName=code_block_19, value=code_block_20)
end = Revit.Transaction.Transaction.End(input=setParameterByName)

# group: BARRA VERTICAL CON PATA INFERIOR
familyinstance_2d_geometry_2 = Custom[FamilyInstance 2D Geometry](element=end)
code_block_21 = CodeBlock { 1; }
getItemAtIndex_2 = List.GetItemAtIndex(list=familyinstance_2d_geometry_2@L2, index=code_block_21)
code_block_22 = CodeBlock { 0.5; }
pointAtParameter = Curve.PointAtParameter(curve=getItemAtIndex_2, param=code_block_22)
code_block_23 = CodeBlock { "Barra Horizontal Pata Derecha"; }
byName_3 = FamilyType.ByName(name=code_block_23)
boolean_2 = BoolSelector(true)
create_tag = Custom[Create Tag](view=activeView, element=end, TagLocation=pointAtParameter, TagType=byName_3, RunIt=boolean_2)  # package Genius Loci; Works only in Revit 2018 and later. Creates a tag at a given location, of given type and in a supplied view. The node also works with Linked Elements (except space and area), Multi Category tag and Material Tag. Based on an archilab node
tag_getlocation = Custom[Tag GetLocation](tag=create_tag)  # package Genius Loci; Retrieves the position of the head of tag.
code_block_24 = CodeBlock { -200; }
translate = Geometry.Translate(geometry=tag_getlocation, zTranslation=code_block_24)
tag_setlocation = Custom[Tag SetLocation](tag=create_tag, location=translate)  # package Genius Loci; Moves the head of the tag to the given location point.

converted_from_dropdown_with = CodeBlock { DSCore.Types.FindTypeByNameInAssembly("DimensionType", "RevitAPI"); }  # "Converted from Dropdown with Monocle™"
all_elements_of_type = ElementsOfType(element_type=converted_from_dropdown_with)
name_3 = Element.Name(element=all_elements_of_type)
code_block_25 = CodeBlock { "EST_EMPALME"; }
eq = name_3 == code_block_25
filterByBoolMask = List.FilterByBoolMask(list=all_elements_of_type, mask=eq)

# group: EMPALMES
familyinstance_2d_geometry_3 = Custom[FamilyInstance 2D Geometry](element=end)
code_block_26 = CodeBlock { 2; }
getItemAtIndex_3 = List.GetItemAtIndex(list=familyinstance_2d_geometry_3@L2, index=code_block_26)
familyinstance_references = Custom[FamilyInstance References](familyInstance=end)  # package Genius Loci; Returns all references and references names.
code_block_27 = CodeBlock { "Empalme"; }
contains = Orchid.Common.String.Contains(string=familyinstance_references.ReferenceName, searchFor=code_block_27)
filterByBoolMask_2 = List.FilterByBoolMask(list=familyinstance_references.Reference, mask=contains)
dimension_byreferences = Custom[Dimension ByReferences](view=activeView, line=getItemAtIndex_3, references=filterByBoolMask_2.in, dimensionType=filterByBoolMask.in, lacing=Longest)  # package Genius Loci; Creates a new linear dimension from at least two geometric references of an object.

ʳʰʸᵗʰᵐ_dimensions_getcurve = Rhythm.Revit.Elements.Dimensions.GetCurve(dimension=dimension_byreferences)
code_block_28 = CodeBlock { 0.5; }
pointAtParameter_2 = Curve.PointAtParameter(curve=ʳʰʸᵗʰᵐ_dimensions_getcurve, param=code_block_28)
code_block_29 = CodeBlock { -370; }
translate_2 = Geometry.Translate(geometry=pointAtParameter_2, zTranslation=code_block_29)
element_setlocation = Custom[Element SetLocation](element=dimension_byreferences, location=translate_2)  # package Genius Loci; Modify the location of the given element. (Same as the Move command in Revit.) Works for point/ line/ sketch based elements, view-specific elements, groups and link instances.
