# Dynamo graph script.dyn (Dynamo 2.3.2.15696)
# packages: Clockwork for Dynamo 2.x 2.3.0, Data-Shapes 2021.2.93, Orchid 204.1.4.7501, Genius Loci 2021.4.13, WombatDynamo 2.3.4, Orchid 200.4.0.7938

current = Document.Current()
activeView = Document.ActiveView(document=current)
code_block = CodeBlock { "Barra Horizontal Superior con Pata Izquierda"; }
file_path = Filename("..\00_IMAGENES\editable Arainco-cmyk-01.png")
code_block_2 = CodeBlock { 150; "INICIAR"; "CANCELAR"; }
code_block_3 = CodeBlock { "Diametro de Barras"; }
code_block_4 = CodeBlock { "EST_D_VIGA_BARRA HORIZONTAL_SUPERIOR_PATA IZQUIERDA"; }
byName = Family.ByName(name=code_block_4)
code_block_5 = CodeBlock()
# ---------- code_block_5.designscript (13 lines) ----------
[
"ø6",
"ø8",
"ø10",
"ø12",
"ø16",
"ø18",
"ø22",
"ø25",
"ø28",
"ø32",
"ø36"
];
# ----------------------------------------
byFamilyAndName = FamilyType.ByFamilyAndName(family=byName, name=code_block_5)
sortNatural = Orchid.Common.List.SortNatural(list=byFamilyAndName)
name = Element.Name(element=sortNatural)
code_block_6 = CodeBlock { 4; }
code_block_7 = CodeBlock { false; }
dropdown_data = Custom[DropDown Data](InputName=code_block_3, Keys=name, Values=sortNatural, DefaultValueIndex=code_block_6, Sorted_optional=code_block_7)  # package Data-Shapes; Create data for DropDown input in UI.MultiInputForm ++ . Check out www.data-shapes.net for more infos.
code_block_8 = CodeBlock { "Cantidad de Barras"; }
code_block_9 = CodeBlock { 1..10..1; 1; }
code_block_10 = CodeBlock { false; }
dropdown_data_2 = Custom[DropDown Data](InputName=code_block_8, Keys=code_block_9.out0, Values=code_block_9.out0, DefaultValueIndex=code_block_9.out1, Sorted_optional=code_block_10)
code_block_11 = CodeBlock { "Selecciona un punto de Inserción"; "SELECCIONAR"; }
selectpointsonface_data = Custom[SelectPointsOnFace data](InputName=code_block_11.out0, ButtonText=code_block_11.out1)  # package Data-Shapes; Creates a UI.MultipleInputForm++ input that allows point on face selection
list_create = List.Create(item0=dropdown_data, item1=dropdown_data_2, item2=selectpointsonface_data)
boolean = BoolSelector(true)
multipleinputform = Custom[MultipleInputForm ++](Description_optional=code_block, Logo_optional=file_path, ButtonText_optional=code_block_2.out1, Inputs=list_create, Toggle=boolean, CancelButtonText_optional=code_block_2.out2, LabelWidth_optional=code_block_2.out0)  # package Data-Shapes; Create a form with multiple inputs. see www.data-shapes.net for tutorials and infos!
nullItem = WombatDynamo.List.NullItem()
if_ = If(test=multipleinputform.Was_Cancelled, true=nullItem, false=multipleinputform.User_Inputs)
code_block_12 = CodeBlock(l=if_) { l[2]; }
code_block_13 = CodeBlock(l=if_) { l[0]; }
byPointInView = Custom[FamilyInstance.ByPointInView](point=code_block_12, familyType=code_block_13, view=activeView)  # package Clockwork for Dynamo 2.x; Places a family instance at a given point in a given view (e.g. a detail component).
code_block_14 = CodeBlock { "Cantidad de Barras"; }
code_block_15 = CodeBlock(l=if_) { l[1]; }
setParameterByName = Element.SetParameterByName(element=byPointInView, parameterName=code_block_14, value=code_block_15)
end = Revit.Transaction.Transaction.End(input=setParameterByName)
familyinstance_2d_geometry = Custom[FamilyInstance 2D Geometry](element=end)  # package Genius Loci; Gets the curves of the family instance. Works only with the family categories : Generic Annotation and Detail Item.
code_block_16 = CodeBlock { 1; }
getItemAtIndex = List.GetItemAtIndex(list=familyinstance_2d_geometry@L2, index=code_block_16)
code_block_17 = CodeBlock { 0.5; }
pointAtParameter = Curve.PointAtParameter(curve=getItemAtIndex, param=code_block_17)
code_block_18 = CodeBlock { "EST_A_TAG BARRA"; }
byName_2 = Orchid.RevitProject.Elements.Family.ByName(name=code_block_18)
code_block_19 = CodeBlock { "Barra Horizontal Pata Izquierda"; }
byFamilyAndName_2 = FamilyType.ByFamilyAndName(family=byName_2, name=code_block_19)
boolean_2 = BoolSelector(true)
create_tag = Custom[Create Tag](view=activeView@L1, element=end@L1, TagLocation=pointAtParameter@L1, TagType=byFamilyAndName_2@L1, RunIt=boolean_2@L1)  # package Genius Loci; Works only in Revit 2018 and later. Creates a tag at a given location, of given type and in a supplied view. The node also works with Linked Elements (except space and area), Multi Category tag and Material Tag. Based on an archilab node
tag_getlocation = Custom[Tag GetLocation](tag=create_tag@L1)  # package Genius Loci; Retrieves the position of the head of tag.
code_block_20 = CodeBlock { 200; }
translate = Geometry.Translate(geometry=tag_getlocation, zTranslation=code_block_20)
tag_setlocation = Custom[Tag SetLocation](tag=create_tag@L1, location=translate@L1)  # package Genius Loci; Moves the head of the tag to the given location point.
